vi "Configure Data Source.gvi"   [LabVIEW NXG 4.0.0]
# Receives UDP packets forwarded to the target TX. This node creates a packet of pseudorandom numbers in PN mode.
# Refer also to Data source in 802.11802.11 v2.0802.11 v2.0802.11 Host.gvi.
inputs:
  "error in": error
  "external mode": bool
  "session in": "Host Session.gtype"
    # Cluster containing all references the host uses during runtime. This cluster includes the following components:
    # FPGA interface: empty reference to the FPGA handle; needs to be cast each time it is used.
    # FlexRIO session: handle to the FlexRIO device. This component is valid only with FlexRIO devices.
    # FlexRIO TX Characterization Data: This component is valid only with FlexRIO sessions.
    # FlexRIO RX Characterization Data: This component is valid only with FlexRIO sessions.
    # USRP session: handle to the USRP device, including charaterization data. This component is valid only with USRP.
    # stop queue: handle to queue used to coordinate host shutdown between the loops.
    # send queue: handle to queue used to buffer TX packets to the target.
    # receive queue: handle to queue used to buffer RX packets from the target.
    # receive throughput queue: handle to queue used to buffer information about received RX packets (time and transferred bytes).
    # UDP receiver: handle to a UPD socket used to receive payload from outside the host.
    # PN packet: byte array used to stream payload inside the host.
outputs:
  "error out": error
  "session out": "Host Session.gtype"
    # Cluster containing all references the host uses during runtime. This cluster includes the following components:
    # FPGA interface: empty reference to the FPGA handle; needs to be cast each time it is used.
    # FlexRIO session: handle to the FlexRIO device. This component is valid only with FlexRIO devices.
    # FlexRIO TX Characterization Data: This component is valid only with FlexRIO sessions.
    # FlexRIO RX Characterization Data: This component is valid only with FlexRIO sessions.
    # USRP session: handle to the USRP device, including charaterization data. This component is valid only with USRP.
    # stop queue: handle to queue used to coordinate host shutdown between the loops.
    # send queue: handle to queue used to buffer TX packets to the target.
    # receive queue: handle to queue used to buffer RX packets from the target.
    # receive throughput queue: handle to queue used to buffer information about received RX packets (time and transferred bytes).
    # UDP receiver: handle to a UPD socket used to receive payload from outside the host.
    # PN packet: byte array used to stream payload inside the host.
  "success?": bool  # Returns True if configuration succeeded and the system is ready to operate.
types:
  T1 = cluster{"Timestamp": u32, "Transferred Bytes": u32}
  T2 = cluster{"fpga ref": any, "bus instance": u32, "instruction FIFO depth": u32, "executing on FPGA target": bool, "show error call chain": bool}
  T3 = cluster{"Actual Gain [dB]": f64, "Attenuation Table Index": i32}
  T4 = cluster{"Attenuation Table [dB]": f64[][], "Frequencies [Hz]": f64[], "IQ Imbalance Table": "IQ Imbalance.gtype"[], "Gain Table": T3[][]}
  "Register Bus Session.gtype" = Queue<"Session Data.gtype">
  "Semaphore.gtype" = i32
  "DB Queue Reference.gtype" = Queue<"Daughterboard Data.gtype">
  "niUsrpRio Session.gtype" = cluster{"FPGA Interface": any, "RIO Interface Number": u32, "Data Clock Rate": u32, "FPGA Data Clock Rate": u32, "Global Settings Register Bus": "Register Bus Session.gtype", "Radio 0 Settings Register Bus": "Register Bus Session.gtype", "Radio 1 Settings Register Bus": "Register Bus Session.gtype", "Radio Settings Bus Semaphore": "Semaphore.gtype", "DB Queues": "DB Queue Reference.gtype"[], "Characterization Data Valid?": bool, "EEPROM Header": "EEPROM Header.gtype", "Device Data Header": "EEPROM Device Data Header.gtype", "EEPROM Characterization Header": "EEPROM Characterization Header.gtype", "Characterization Data": "Characterization Data.gtype"[], "FPGA Current Version": u32, "FPGA Oldest Compatible Version": u32, "Fixed Logic Current Version": u32, "Fixed Logic Oldest Compatible Version": u32, "FPGA Radio Settings Bus Current Version": u32, "FPGA Radio Settings Bus Oldest Compatible Version": u32, "FPGA Board Config Current Version": u32, "FPGA Board Config Oldest Compatible Version": u32, "Daughterboard Clock Rate": u32}
  "Host Session.gtype" = cluster{"station number": u16, "FPGA interface": "FGPA Reference.gtype", "MAC High Requests": Queue<u8[]>, "MAC High Confirmations": Queue<u8[]>, "Triggered TX Requests": Queue<"TX Request Confirmation Reference Parameters.gtype">, "receive queue": Queue<u8[]>, "receive throughput queue": Queue<T1>, "UDP Receiver": UdpNetworkConnectionRefnum, "PN packet": u8[], "FlexRIO session": Queue<T2>, "FlexRIO TX Characterization Data": T4, "FlexRIO RX Characterization Data": T4, "USRP session": "niUsrpRio Session.gtype", "RF loop clock frequency": f64, "UDP Receiver TX Request": UdpNetworkConnectionRefnum, "UDP Receiver TX Confirmation": UdpNetworkConnectionRefnum, "UDP Receiver RX Indication": UdpNetworkConnectionRefnum, "UDP Sender": UdpNetworkConnectionRefnum}
uses:
  AFW::802_11::Configuration::UDP Port Assignment.gvi
  NI::G Core::Error::Legacy::Clear Errors.gvi
  AFW::Common::Set Socket Option.gvi
  AFW::802_11::Configuration::Random Bit Generator.gvi
diagram:
  Property Node(instance in=$"session in") -> ("station number"=w1, "UDP Receiver"=w2, "UDP Receiver TX Request"=w3, "UDP Receiver TX Confirmation"=w4, "UDP Receiver RX Indication"=w5, instance out=w6)
  call "UDP Port Assignment.gvi"(station number=w1, external mode=$"external mode") -> (UDP data=w7, TX requests=w8, local TX confirmations=w9, local RX indications=w10)
  Udp Close(connection ID=w4, error in=$"error in") -> (error out=w11)
  call "Clear Errors.gvi"(specific error code to clear=1, error in=w11) -> (error out=w12)
  Udp Close(connection ID=w5, error in=$"error in") -> (error out=w13)
  call "Clear Errors.gvi"(specific error code to clear=1, error in=w13) -> (error out=w14)
  case ($"external mode") {
    frame True {
      w15 = w12
      w16 = w14
      w17 = UdpNetworkConnectionRefnum constant
      w18 = UdpNetworkConnectionRefnum constant
    }
    frame False {
      Udp Open(error in=w12, net address=0, port=w9, service name="", timeout ms=25000) -> (connection ID=w18, error out=w15)
      Udp Open(error in=w14, net address=0, port=w10, service name="", timeout ms=25000) -> (connection ID=w17, error out=w16)
    }
  }
  Udp Close(connection ID=w2, error in=$"error in") -> (error out=w19)
  call "Clear Errors.gvi"(specific error code to clear=1, error in=w19) -> (error out=w20)
  Udp Open(error in=w20, net address=0, port=w7, service name="", timeout ms=25000) -> (connection ID=w21, error out=w22)
  Udp Close(connection ID=w3, error in=$"error in") -> (error out=w23)
  call "Clear Errors.gvi"(specific error code to clear=1, error in=w23) -> (error out=w24)
  Udp Open(error in=w24, net address=0, port=w8, service name="", timeout ms=25000) -> (connection ID=w25, error out=w26)
  Merge Errors(w22, w26, w15, w16) -> (error out=w27)
  Property Node(instance in=w27) -> ("code"=w28, instance out=w29)
  case (w28) {
    frame 0, Default {
      case ($"external mode") {
        frame True {
          w36 = w29
          w37 = w29
          w34 = w18
          w35 = w17
        }
        frame False {
          call "Set Socket Option.gvi"(connection in=w18, level=0xFFFF, option name=0x1002, value=1024000, error in=w29) -> (error out=w36, connection out=w34)
          call "Set Socket Option.gvi"(connection in=w17, level=0xFFFF, option name=0x1002, value=1024000, error in=w29) -> (error out=w37, connection out=w35)
        }
      }
      call "Set Socket Option.gvi"(connection in=w21, level=0xFFFF, option name=0x1002, value=1024000, error in=w29) -> (error out=w38, connection out=w30)
      call "Set Socket Option.gvi"(connection in=w25, level=0xFFFF, option name=0x1002, value=1024000, error in=w29) -> (error out=w39, connection out=w33)
      Merge Errors(w38, w39, w36, w37) -> (error out=w31)
      w32 = TRUE
    }
    frame 60 {
      call "Clear Errors.gvi"(specific error code to clear=w28, error in=w29) -> (error out=w31)
      w40 = "The specified port or network address is currently in use, e.g. by another instance of this VI. Select an available port or network address."
      One Button Dialog(message=w40)
      w30 = w21
      w32 = default
      w33 = w25
      w34 = w18
      w35 = w17
    }
  }
  w41 = 4061  # max packet size in byte
  call "Random Bit Generator.gvi"(packet size=w41) -> (random array=w42)
  Property Node(instance in=w6, "UDP Receiver"=w30, "PN packet"=w42, "UDP Receiver TX Request"=w33, "UDP Receiver TX Confirmation"=w34, "UDP Receiver RX Indication"=w35) -> (instance out=w43)
  $"session out" <- w43
  $"error out" <- w31
  $"success?" <- w32
