vi "Configure RF.gvi"   [LabVIEW NXG 4.0.0]
inputs:
  "error in": error
  "session": "Host Session.gtype"
    # Cluster containing all references the host uses during runtime. This cluster includes the following components:
    # FPGA interface: empty reference to the FPGA handle; needs to be cast each time it is used.
    # FlexRIO session: handle to the FlexRIO device. This component is valid only with FlexRIO devices.
    # FlexRIO TX Characterization Data: This component is valid only with FlexRIO sessions.
    # FlexRIO RX Characterization Data: This component is valid only with FlexRIO sessions.
    # USRP session: handle to the USRP device, including charaterization data. This component is valid only with USRP.
    # stop queue: handle to queue used to coordinate host shutdown between the loops.
    # send queue: handle to queue used to buffer TX packets to the target.
    # receive queue: handle to queue used to buffer RX packets from the target.
    # receive throughput queue: handle to queue used to buffer information about received RX packets (time and transferred bytes).
    # UDP receiver: handle to a UPD socket used to receive payload from outside the host.
    # PN packet: byte array used to stream payload inside the host.
  "TX Port": enum{"TX1/RF 0", "TX1/RF 1"} = "TX1/RF 0"  # RF port used for TX (applicable only for USRP RIO devices).
  "RX port": T1 = "RX2/RF 1"  # RF port used for RX (applicable only for USRP RIO devices).
  "primary channel selector": UFXP(2.0) = 1  # Numeric control to determine which subband is used as the primary channel. The PHY covers 80 MHz bandwidth, which can be divided into four subbands {0,…,3} of 20 MHz bandwidth for the non-HT signal. For wider bandwidths the subbands get combined. Visit ni.com/info and enter the Info Code 80211AppFW Manual to access the LabVIEW Communications 802.11 Application Framework Manual for more information about channelization.
  "TX power level": f64 = -10  # TX power level to configure on the target, in dBm.
  "RX gain": f64  # RX gain to configure on the target, in dB.
  "primary channel center frequency": f64 = 5200000000  # Primary channel center frequency of the transmitter in Hz. Valid values depend on the device the station is running on.
outputs:
  "session dup": "Host Session.gtype"
    # Cluster containing all references the host uses during runtime. This cluster includes the following components:
    # FPGA interface: empty reference to the FPGA handle; needs to be cast each time it is used.
    # FlexRIO session: handle to the FlexRIO device. This component is valid only with FlexRIO devices.
    # FlexRIO TX Characterization Data: This component is valid only with FlexRIO sessions.
    # FlexRIO RX Characterization Data: This component is valid only with FlexRIO sessions.
    # USRP session: handle to the USRP device, including charaterization data. This component is valid only with USRP.
    # stop queue: handle to queue used to coordinate host shutdown between the loops.
    # send queue: handle to queue used to buffer TX packets to the target.
    # receive queue: handle to queue used to buffer RX packets from the target.
    # receive throughput queue: handle to queue used to buffer information about received RX packets (time and transferred bytes).
    # UDP receiver: handle to a UPD socket used to receive payload from outside the host.
    # PN packet: byte array used to stream payload inside the host.
  "error out": error
  "coerced RX LO frequency": f64  # LO frequency actually configured for RX on the target, in Hz.
  "coerced TX LO frequency": f64  # LO frequency actually configured for TX on the target, in Hz.
  "coerced RX gain": f64  # RX gain actually configured on the target, in dB.
  "coerced TX power level": f64  # TX power level actually configured on the target, in dBm.
  "RF center frequency": f64  # RF center frequency after the adjustment based on the Primary Channel Selector control and the operating bandwidth.
types:
  T1 = enum{"RX1/RF 0", "RX2/RF 0", "RX1/RF 1", "RX2/RF 1"}
  T2 = cluster{"Timestamp": u32, "Transferred Bytes": u32}
  T3 = cluster{"fpga ref": any, "bus instance": u32, "instruction FIFO depth": u32, "executing on FPGA target": bool, "show error call chain": bool}
  T4 = cluster{"Actual Gain [dB]": f64, "Attenuation Table Index": i32}
  T5 = cluster{"Attenuation Table [dB]": f64[][], "Frequencies [Hz]": f64[], "IQ Imbalance Table": "IQ Imbalance.gtype"[], "Gain Table": T4[][]}
  "Register Bus Session.gtype" = Queue<"Session Data.gtype">
  "Semaphore.gtype" = i32
  "DB Queue Reference.gtype" = Queue<"Daughterboard Data.gtype">
  "niUsrpRio Session.gtype" = cluster{"FPGA Interface": any, "RIO Interface Number": u32, "Data Clock Rate": u32, "FPGA Data Clock Rate": u32, "Global Settings Register Bus": "Register Bus Session.gtype", "Radio 0 Settings Register Bus": "Register Bus Session.gtype", "Radio 1 Settings Register Bus": "Register Bus Session.gtype", "Radio Settings Bus Semaphore": "Semaphore.gtype", "DB Queues": "DB Queue Reference.gtype"[], "Characterization Data Valid?": bool, "EEPROM Header": "EEPROM Header.gtype", "Device Data Header": "EEPROM Device Data Header.gtype", "EEPROM Characterization Header": "EEPROM Characterization Header.gtype", "Characterization Data": "Characterization Data.gtype"[], "FPGA Current Version": u32, "FPGA Oldest Compatible Version": u32, "Fixed Logic Current Version": u32, "Fixed Logic Oldest Compatible Version": u32, "FPGA Radio Settings Bus Current Version": u32, "FPGA Radio Settings Bus Oldest Compatible Version": u32, "FPGA Board Config Current Version": u32, "FPGA Board Config Oldest Compatible Version": u32, "Daughterboard Clock Rate": u32}
  "Host Session.gtype" = cluster{"station number": u16, "FPGA interface": "FGPA Reference.gtype", "MAC High Requests": Queue<u8[]>, "MAC High Confirmations": Queue<u8[]>, "Triggered TX Requests": Queue<"TX Request Confirmation Reference Parameters.gtype">, "receive queue": Queue<u8[]>, "receive throughput queue": Queue<T2>, "UDP Receiver": UdpNetworkConnectionRefnum, "PN packet": u8[], "FlexRIO session": Queue<T3>, "FlexRIO TX Characterization Data": T5, "FlexRIO RX Characterization Data": T5, "USRP session": "niUsrpRio Session.gtype", "RF loop clock frequency": f64, "UDP Receiver TX Request": UdpNetworkConnectionRefnum, "UDP Receiver TX Confirmation": UdpNetworkConnectionRefnum, "UDP Receiver RX Indication": UdpNetworkConnectionRefnum, "UDP Sender": UdpNetworkConnectionRefnum}
uses:
  AFW::802_11::Configuration::Primary Channel Settings to RF Settings.gvi
  AFW::802_11::RF Control::Configure TX RF.gvi
  AFW::802_11::RF Control::Configure RX RF.gvi
diagram:
  call "Primary Channel Settings to RF Settings.gvi"(session=$session, primary channel center frequency=$"primary channel center frequency", primary channel selector=$"primary channel selector", error in=$"error in") -> (session dup=w1, frequency=w2, LO frequency=w3, error out=w4)
  $"RF center frequency" <- w2
  call "Configure TX RF.gvi"(session=w1, TX frequency=w2, TX power level=$"TX power level", error in=w4, LO frequency [Hz]=w3, TX port=$"TX Port") -> (session dup=w5, coerced LO frequency=w6, coerced TX power level=w7, error out=w8)
  call "Configure RX RF.gvi"(session=w5, RX frequency=w2, RX gain=$"RX gain", error in=w8, LO frequency=w3, RX port=$"RX port") -> (session dup=w9, coerced LO frequency=w10, coerced RX gain=w11, error out=w12)
  $"session dup" <- w9
  $"error out" <- w12
  $"coerced RX LO frequency" <- w10
  $"coerced RX gain" <- w11
  $"coerced TX LO frequency" <- w6
  $"coerced TX power level" <- w7
