vi "Host Init.gvi"   [LabVIEW NXG 4.0.0]
# Initializes the host. The node completes the following steps to initialize:
# 	Opens, downloads, and starts the FPGA target (specific to the chosen target)
# 	Sets up all message queues
# 	Set up and starts direct memory access (DMA) FIFOs
# 	Sets up the FPGA target (specific to chosen target)
# 	Sets the Reference Clock
# - Initializes a session cluster with the elements specified above
inputs:
  "device": string = "RIO0"  # RIO name of the target device. Default: RIO0
  "error in": error
  "reference clock": string = "Internal"  # Reference Clock source.
outputs:
  "session out": "Host Session.gtype"
    # Cluster containing all references the host uses during runtime. This cluster includes the following components:
    # FPGA interface: empty reference to the FPGA handle; needs to be cast each time it is used.
    # FlexRIO session: handle to the FlexRIO device. This component is valid only with FlexRIO devices.
    # FlexRIO TX Characterization Data: This component is valid only with FlexRIO sessions.
    # FlexRIO RX Characterization Data: This component is valid only with FlexRIO sessions.
    # USRP session: handle to the USRP device, including charaterization data. This component is valid only with USRP.
    # stop queue: handle to queue used to coordinate host shutdown between the loops.
    # send queue: handle to queue used to buffer TX packets to the target.
    # receive queue: handle to queue used to buffer RX packets from the target.
    # receive throughput queue: handle to queue used to buffer information about received RX packets (time and transferred bytes).
    # UDP receiver: handle to a UPD socket used to receive payload from outside the host.
    # PN packet: byte array used to stream payload inside the host.
  "error out": error
panel controls:
  "FPGA reference": any
types:
  T1 = cluster{"Timestamp": u32, "Transferred Bytes": u32}
  T2 = cluster{"fpga ref": any, "bus instance": u32, "instruction FIFO depth": u32, "executing on FPGA target": bool, "show error call chain": bool}
  T3 = cluster{"Actual Gain [dB]": f64, "Attenuation Table Index": i32}
  T4 = cluster{"Attenuation Table [dB]": f64[][], "Frequencies [Hz]": f64[], "IQ Imbalance Table": "IQ Imbalance.gtype"[], "Gain Table": T3[][]}
  "Register Bus Session.gtype" = Queue<"Session Data.gtype">
  "Semaphore.gtype" = i32
  "DB Queue Reference.gtype" = Queue<"Daughterboard Data.gtype">
  "niUsrpRio Session.gtype" = cluster{"FPGA Interface": any, "RIO Interface Number": u32, "Data Clock Rate": u32, "FPGA Data Clock Rate": u32, "Global Settings Register Bus": "Register Bus Session.gtype", "Radio 0 Settings Register Bus": "Register Bus Session.gtype", "Radio 1 Settings Register Bus": "Register Bus Session.gtype", "Radio Settings Bus Semaphore": "Semaphore.gtype", "DB Queues": "DB Queue Reference.gtype"[], "Characterization Data Valid?": bool, "EEPROM Header": "EEPROM Header.gtype", "Device Data Header": "EEPROM Device Data Header.gtype", "EEPROM Characterization Header": "EEPROM Characterization Header.gtype", "Characterization Data": "Characterization Data.gtype"[], "FPGA Current Version": u32, "FPGA Oldest Compatible Version": u32, "Fixed Logic Current Version": u32, "Fixed Logic Oldest Compatible Version": u32, "FPGA Radio Settings Bus Current Version": u32, "FPGA Radio Settings Bus Oldest Compatible Version": u32, "FPGA Board Config Current Version": u32, "FPGA Board Config Oldest Compatible Version": u32, "Daughterboard Clock Rate": u32}
  "Host Session.gtype" = cluster{"station number": u16, "FPGA interface": "FGPA Reference.gtype", "MAC High Requests": Queue<u8[]>, "MAC High Confirmations": Queue<u8[]>, "Triggered TX Requests": Queue<"TX Request Confirmation Reference Parameters.gtype">, "receive queue": Queue<u8[]>, "receive throughput queue": Queue<T1>, "UDP Receiver": UdpNetworkConnectionRefnum, "PN packet": u8[], "FlexRIO session": Queue<T2>, "FlexRIO TX Characterization Data": T4, "FlexRIO RX Characterization Data": T4, "USRP session": "niUsrpRio Session.gtype", "RF loop clock frequency": f64, "UDP Receiver TX Request": UdpNetworkConnectionRefnum, "UDP Receiver TX Confirmation": UdpNetworkConnectionRefnum, "UDP Receiver RX Indication": UdpNetworkConnectionRefnum, "UDP Sender": UdpNetworkConnectionRefnum}
  "TX Request Confirmation Reference Parameters.gtype" = cluster{"reference ID": u16, "MSDU length": u16}
uses:
  AFW::802_11::RF Control::Open FPGA Target.gvi
  AFW::Common::Set Socket Option.gvi
  AFW::802_11::Configuration::Setup DMA FIFOs.gvi
diagram:
  call "Open FPGA Target.gvi"(RIO device=$device, error in=$"error in") -> (FPGA interface=w1, RF loop clock frequency=w2, device bandwidth=w3, error out=w4)
  FPGA Run Node(error in=w4, reference in=w1) -> (error out=w5, reference out=w6)
  Type Cast(type="FGPA Reference.gtype" constant, x=w6) -> w7
  Property Node(instance in="Host Session.gtype" {all zero or empty}, "FPGA interface"=w7) -> (instance out=w8)
  Property Node(instance in=w8) -> ("FPGA interface"=w9)
  Type Cast(type=$"FPGA reference", x=w9) -> w10
  # Removed Setup FPGA Target
  Property Node(instance in=w10, "data clock locked?"=TRUE)
  Udp Open(error in=w5, net address=0, port=0, service name="", timeout ms=100) -> (connection ID=w11, error out=w12)
  call "Set Socket Option.gvi"(connection in=w11, level=0xFFFF, option name=0x1001, value=1024000, error in=w12) -> (error out=w13, connection out=w14)
  Obtain Queue(create if not found=TRUE, element data type=u8[] [], error in=w13, max queue size=1000) -> (error out=w15, queue out=w16)
  Obtain Queue(create if not found=TRUE, element data type=u8[] [], error in=w13, max queue size=1000) -> (error out=w17, queue out=w18)
  w19 = "TX Request Confirmation Reference Parameters.gtype" {all zero or empty}
  Obtain Queue(create if not found=TRUE, element data type=w19, error in=w13) -> (error out=w20, queue out=w21)
  Obtain Queue(create if not found=TRUE, element data type=u8[] [], error in=w13, max queue size=-1) -> (error out=w22, queue out=w23)
  Obtain Queue(create if not found=TRUE, element data type=T1 {all zero or empty}, error in=w13, max queue size=-1) -> (error out=w24, queue out=w25)
  Property Node(instance in=w8, "MAC High Requests"=w16, "receive queue"=w23, "receive throughput queue"=w25, "RF loop clock frequency"=w2, "MAC High Confirmations"=w18, "Triggered TX Requests"=w21, "UDP Sender"=w14) -> (instance out=w26)
  $"session out" <- w26
  call "Setup DMA FIFOs.gvi"(FPGA interface=w7, start debugging FIFOs=FALSE, error in=w13) -> (error out=w27)
  Property Node(instance in=w7, "device bandwidth"=w3, error in=w13) -> (error out=w28)
  Merge Errors(w28, w27, w15, w17, w20, w22, w24) -> (error out=w29)
  $"error out" <- w29
