vi "Primary Channel Settings to RF Settings.gvi"   [LabVIEW NXG 4.0.0]
# Derives the RF center freqeuncy of the active subband based on the given primary channel center frequency, primary channel selector value, and if the traget supports 80 MHz bandwidth or not.
inputs:
  "session": "Host Session.gtype"
    # Cluster containing all references the host uses during runtime. This cluster includes the following components:
    # FPGA interface: empty reference to the FPGA handle; needs to be cast each time it is used.
    # FlexRIO session: handle to the FlexRIO device. This component is valid only with FlexRIO devices.
    # FlexRIO TX Characterization Data: This component is valid only with FlexRIO sessions.
    # FlexRIO RX Characterization Data: This component is valid only with FlexRIO sessions.
    # USRP session: handle to the USRP device, including charaterization data. This component is valid only with USRP.
    # stop queue: handle to queue used to coordinate host shutdown between the loops.
    # send queue: handle to queue used to buffer TX packets to the target.
    # receive queue: handle to queue used to buffer RX packets from the target.
    # receive throughput queue: handle to queue used to buffer information about received RX packets (time and transferred bytes).
    # UDP receiver: handle to a UPD socket used to receive payload from outside the host.
    # PN packet: byte array used to stream payload inside the host.
  "error in": error
  "primary channel center frequency": f64 = 5200000000  # It is the primary channel center frequency of the transmitter in Hz. Valid values depend on the device the station is running on.
  "primary channel selector": UFXP(2.0) = 1  # Numeric control to determine which subband is used as the primary channel. The PHY covers 80 MHz bandwidth, which can be divided into four subbands {0,…,3} of 20 MHz bandwidth for the non-HT signal. For wider bandwidths the subbands get combined. Visit ni.com/info and enter the Info Code 80211AppFW Manual to access the LabVIEW Communications 802.11 Application Framework Manual for more information about channelization.
outputs:
  "session dup": "Host Session.gtype"
    # Cluster containing all references the host uses during runtime. This cluster includes the following components:
    # FPGA interface: empty reference to the FPGA handle; needs to be cast each time it is used.
    # FlexRIO session: handle to the FlexRIO device. This component is valid only with FlexRIO devices.
    # FlexRIO TX Characterization Data: This component is valid only with FlexRIO sessions.
    # FlexRIO RX Characterization Data: This component is valid only with FlexRIO sessions.
    # USRP session: handle to the USRP device, including charaterization data. This component is valid only with USRP.
    # stop queue: handle to queue used to coordinate host shutdown between the loops.
    # send queue: handle to queue used to buffer TX packets to the target.
    # receive queue: handle to queue used to buffer RX packets from the target.
    # receive throughput queue: handle to queue used to buffer information about received RX packets (time and transferred bytes).
    # UDP receiver: handle to a UPD socket used to receive payload from outside the host.
    # PN packet: byte array used to stream payload inside the host.
  "error out": error
  "LO frequency": f64  # Derived LO frequency based on the primary channel center frequency and target bandwidth. The RF center frequency is typically set to the center of the FFT at the baseband frequency of 0 MHz. There is a special handling for USRP devices only capable of 40 MHz bandwidth. In this case the RF center frequency is set to the center of the VHT 40 MHz. 80 MHz transmissions are not supported on those devices.
  "frequency": f64  # Adjusted LO frequency based on the primary channel selector value and the target supported bandwidth.
  "80 MHz supported": bool  # Valid flag if the target supports 80 MHz bandwidth.
types:
  T1 = cluster{"Timestamp": u32, "Transferred Bytes": u32}
  T2 = cluster{"fpga ref": any, "bus instance": u32, "instruction FIFO depth": u32, "executing on FPGA target": bool, "show error call chain": bool}
  T3 = cluster{"Actual Gain [dB]": f64, "Attenuation Table Index": i32}
  T4 = cluster{"Attenuation Table [dB]": f64[][], "Frequencies [Hz]": f64[], "IQ Imbalance Table": "IQ Imbalance.gtype"[], "Gain Table": T3[][]}
  "Register Bus Session.gtype" = Queue<"Session Data.gtype">
  "Semaphore.gtype" = i32
  "DB Queue Reference.gtype" = Queue<"Daughterboard Data.gtype">
  "niUsrpRio Session.gtype" = cluster{"FPGA Interface": any, "RIO Interface Number": u32, "Data Clock Rate": u32, "FPGA Data Clock Rate": u32, "Global Settings Register Bus": "Register Bus Session.gtype", "Radio 0 Settings Register Bus": "Register Bus Session.gtype", "Radio 1 Settings Register Bus": "Register Bus Session.gtype", "Radio Settings Bus Semaphore": "Semaphore.gtype", "DB Queues": "DB Queue Reference.gtype"[], "Characterization Data Valid?": bool, "EEPROM Header": "EEPROM Header.gtype", "Device Data Header": "EEPROM Device Data Header.gtype", "EEPROM Characterization Header": "EEPROM Characterization Header.gtype", "Characterization Data": "Characterization Data.gtype"[], "FPGA Current Version": u32, "FPGA Oldest Compatible Version": u32, "Fixed Logic Current Version": u32, "Fixed Logic Oldest Compatible Version": u32, "FPGA Radio Settings Bus Current Version": u32, "FPGA Radio Settings Bus Oldest Compatible Version": u32, "FPGA Board Config Current Version": u32, "FPGA Board Config Oldest Compatible Version": u32, "Daughterboard Clock Rate": u32}
  "Host Session.gtype" = cluster{"station number": u16, "FPGA interface": "FGPA Reference.gtype", "MAC High Requests": Queue<u8[]>, "MAC High Confirmations": Queue<u8[]>, "Triggered TX Requests": Queue<"TX Request Confirmation Reference Parameters.gtype">, "receive queue": Queue<u8[]>, "receive throughput queue": Queue<T1>, "UDP Receiver": UdpNetworkConnectionRefnum, "PN packet": u8[], "FlexRIO session": Queue<T2>, "FlexRIO TX Characterization Data": T4, "FlexRIO RX Characterization Data": T4, "USRP session": "niUsrpRio Session.gtype", "RF loop clock frequency": f64, "UDP Receiver TX Request": UdpNetworkConnectionRefnum, "UDP Receiver TX Confirmation": UdpNetworkConnectionRefnum, "UDP Receiver RX Indication": UdpNetworkConnectionRefnum, "UDP Sender": UdpNetworkConnectionRefnum}
uses:
  AFW::802_11::RF Control::FPGA Target Configuration.gvi
diagram:
  $"session dup" <- $session
  call "FPGA Target Configuration.gvi"(session=$session, error in=$"error in") -> (bandwidth=w1, error out=w2)
  $"error out" <- w2
  Is Greater Or Equal(x=w1, y=80000000) -> w3
  $"80 MHz supported" <- w3
  To Unsigned 8 Bit Integer(number=$"primary channel selector") -> w4
  case (w3) {
    frame False, Default {
      Is Less(x=w4, y=2) -> w6
      Select(s=w6, t=20000000, f=-20000000) -> w5
    }
    frame True {
      w5 = 0
    }
  }
  # w7: LUT for primary channel
  # center frequency from RF
  # center frequency
  case (w3) {
    frame True {
      w7 = [-30000000, -10000000, 10000000, 30000000]
    }
    frame False {
      w7 = [-10000000, 10000000, -10000000, 10000000]
    }
  }
  To Signed 32 Bit Integer(number=$"primary channel selector") -> w8
  Array Index(array=w7) -> (out0[w8]=w9)
  Subtract(x=$"primary channel center frequency", y=w9) -> w10
  Add(w5, w10) -> w11
  $frequency <- w11
  $"LO frequency" <- w10
