vi "Setup DMA FIFOs.gvi"   [LabVIEW NXG 4.0.0]
# Configures and starts the direct memory access (DMA) FIFO. The FIFOs are dimensioned to buffer the data for one second of operation in 802.11ac, with 40 MHz bandwidth and maximal throughput.
inputs:
  "FPGA interface": "FGPA Reference.gtype"  # Interface to the device's FPGA handle.
  "error in": error
  "start debugging FIFOs": bool  # Boolean control to debug the DMA FIFOs.
outputs:
  "FPGA interface dup": "FGPA Reference.gtype"  # Interface to the device's FPGA handle.
  "error out": error
diagram:
  # FIFO sizes depending on
  # size needed for 1 sec transmission of
  # 802.11 VHT40
  # 4000 bytes payload
  # ACK disabled
  #
  # but at least 1M elements
  Host Fifo Configure Node[FifoName="AFW::802_11::Resources::802.11 AFW Resources.grsc::T2H Events"](depth=1000000, error in=$"error in", reference in=$"FPGA interface") -> (error out=w1, reference out=w2)
  Host Fifo Start Node[FifoName="AFW::802_11::Resources::802.11 AFW Resources.grsc::T2H Events"](error in=w1, reference in=w2) -> (error out=w3, reference out=w4)
  $"FPGA interface dup" <- w4
  case ($"start debugging FIFOs") {
    frame False, Default {
      w5 = $"error in"
    }
    frame True {
      Host Fifo Configure Node[FifoName="AFW::802_11::Resources::802.11 AFW Resources.grsc::H2T RX Baseband"](depth=1000000, error in=$"error in", reference in=$"FPGA interface") -> (error out=w6, reference out=w7)
      Host Fifo Start Node[FifoName="AFW::802_11::Resources::802.11 AFW Resources.grsc::H2T RX Baseband"](error in=w6, reference in=w7) -> (error out=w5)
    }
  }
  case ($"start debugging FIFOs") {
    frame False, Default {
      w8 = $"error in"
    }
    frame True {
      Host Fifo Configure Node[FifoName="AFW::802_11::Resources::802.11 AFW Resources.grsc::T2H RX Bit Processing Output"](depth=1000000, error in=$"error in", reference in=$"FPGA interface") -> (error out=w9, reference out=w10)
      Host Fifo Start Node[FifoName="AFW::802_11::Resources::802.11 AFW Resources.grsc::T2H RX Bit Processing Output"](error in=w9, reference in=w10) -> (error out=w8)
    }
  }
  case ($"start debugging FIFOs") {
    frame False, Default {
      w11 = $"error in"
    }
    frame True {
      Host Fifo Configure Node[FifoName="AFW::802_11::Resources::802.11 AFW Resources.grsc::T2H TX Bit Processing Output"](depth=1000000, error in=$"error in", reference in=$"FPGA interface") -> (error out=w12, reference out=w13)
      Host Fifo Start Node[FifoName="AFW::802_11::Resources::802.11 AFW Resources.grsc::T2H TX Bit Processing Output"](error in=w12, reference in=w13) -> (error out=w11)
    }
  }
  Host Fifo Configure Node[FifoName="AFW::802_11::Resources::802.11 AFW Resources.grsc::T2H RX Power Spectrum"](depth=4000000, error in=$"error in", reference in=$"FPGA interface") -> (error out=w14, reference out=w15)
  Host Fifo Start Node[FifoName="AFW::802_11::Resources::802.11 AFW Resources.grsc::T2H RX Power Spectrum"](error in=w14, reference in=w15) -> (error out=w16)
  Host Fifo Configure Node[FifoName="AFW::802_11::Resources::802.11 AFW Resources.grsc::T2H Constellation"](depth=25000000, error in=$"error in", reference in=$"FPGA interface") -> (error out=w17, reference out=w18)
  Host Fifo Start Node[FifoName="AFW::802_11::Resources::802.11 AFW Resources.grsc::T2H Constellation"](error in=w17, reference in=w18) -> (error out=w19)
  Host Fifo Configure Node[FifoName="AFW::802_11::Resources::802.11 AFW Resources.grsc::T2H RX Data"](depth=20000000, error in=$"error in", reference in=$"FPGA interface") -> (error out=w20, reference out=w21)
  Host Fifo Start Node[FifoName="AFW::802_11::Resources::802.11 AFW Resources.grsc::T2H RX Data"](error in=w20, reference in=w21) -> (error out=w22)
  Host Fifo Configure Node[FifoName="AFW::802_11::Resources::802.11 AFW Resources.grsc::H2T TX Data"](depth=4000000, error in=$"error in", reference in=$"FPGA interface") -> (error out=w23, reference out=w24)
  Host Fifo Start Node[FifoName="AFW::802_11::Resources::802.11 AFW Resources.grsc::H2T TX Data"](error in=w23, reference in=w24) -> (error out=w25)
  Host Fifo Configure Node[FifoName="AFW::802_11::Resources::802.11 AFW Resources.grsc::T2H TX Baseband"](depth=1000000, error in=$"error in", reference in=$"FPGA interface") -> (error out=w26, reference out=w27)
  Host Fifo Start Node[FifoName="AFW::802_11::Resources::802.11 AFW Resources.grsc::T2H TX Baseband"](error in=w26, reference in=w27) -> (error out=w28)
  Host Fifo Configure Node[FifoName="AFW::802_11::Resources::802.11 AFW Resources.grsc::T2H Channel Estimation"](depth=2000000, error in=$"error in", reference in=$"FPGA interface") -> (error out=w29, reference out=w30)
  Host Fifo Start Node[FifoName="AFW::802_11::Resources::802.11 AFW Resources.grsc::T2H Channel Estimation"](error in=w29, reference in=w30) -> (error out=w31)
  # max. 16129 packets per second
  # * 11 elements per TX indication
  # = 177419, round up to 200000
  Host Fifo Configure Node[FifoName="AFW::802_11::Resources::802.11 AFW Resources.grsc::T2H TX Feedback"](depth=200000, error in=$"error in", reference in=$"FPGA interface") -> (error out=w32, reference out=w33)
  Host Fifo Start Node[FifoName="AFW::802_11::Resources::802.11 AFW Resources.grsc::T2H TX Feedback"](error in=w32, reference in=w33) -> (error out=w34)
  Merge Errors(w3, w5, w16, w19, w8, w22, w25, w11, w28, w31, w34) -> (error out=w35)
  $"error out" <- w35
