vi "UDP Port Assignment.gvi"   [LabVIEW NXG 4.0.0]
# Derives the required user datagram protocol (UDP) ports based on the given station number.
inputs:
  "station number": u16  # Given station number.
  "external mode": bool  # True if data source is external mode.
outputs:
  "UDP data": u16  # Reference to the UDP socket used for externa data.
  "TX requests": u16  # Reference to the UDP socket used to send or receive the TX requests.
  "local TX confirmations": u16  # Reference to the UDP socket used to send or receive the TX confirmations.
  "local RX indications": u16  # Reference to the UDP socket used to send or receive the RX indications.
  "local TX indications": u16  # Reference to the UDP socket used to send or receive the TX indications.
diagram:
  w1 = [12000, 12100, 12200, 12300, 12400]  # UDP port assignments
  Add($"station number", w1) -> w2
  Array Index(array=w2) -> (out0[_]=w3, out1[_]=w4, out2[_]=w5, out3[_]=w6, out4[_]=w7)
  $"UDP data" <- w3
  $"TX requests" <- w4
  Select(s=$"external mode", t=300, f=0) -> w8
  Add(w5, w8) -> w9
  $"local TX confirmations" <- w9
  Add(w6, w8) -> w10
  $"local TX indications" <- w10
  Add(w7, w8) -> w11
  $"local RX indications" <- w11
