vi "Events to String.gvi"   [LabVIEW NXG 4.0.0]
# Deserializes events encoded in U64 into human-readable strings.
# See also: 802.11 Read Event FIFO.gvi
inputs:
  "raw event data": u64[][]  # 2D array of event data and time stamps.
outputs:
  "event strings": string[]  # 1D array of events. Each element consists of a string containing the time stamp followed by a human-readable event description.
  "event log": "Event Log Item.gtype"[]
types:
  "Events.gtype" = enum{"PHY TX start request", "PHY TX end indication", "PHY RX start indication", "PHY RX end indication", "PHY CCA timing indication", "PHY RX gain change indication", "DCF state indication", "MAC MPDU RX indication", "MAC MPDU TX request"}
  "Event Log Item.gtype" = cluster{"event type": "Events.gtype", "timestamp": u32, "log message": string}
  "RX Error.gtype" = enum{"NoError", "CarrierLost", "FormatViolation", "UnsupportedRate", "Filtered"}
  "Non HT Bandwidth.gtype" = enum{"20 MHz", "40 MHz", "80 MHz", "160 MHz"}
  "CCA Indication Channel List Element.gtype" = enum{"none", "primary", "secondary", "secondary40"}
  "AGC State.gtype" = enum{"Idle", "maximum gain", "wait for measurement", "gain set", "gain locked", "wait for channel clearance"}
  "DCF State Machine State.gtype" = enum{"NAV waiting", "start IFS", "wait for IFS to be active", "wait for IFS end", "start backoff", "wait backoff", "primary channel free", "DCF opportunity", "wait for TX to be active", "TX active / RX timeout", "primary channel busy"}
  "A-MPDU De-Aggregation Status.gtype" = enum{"A-MPDU De-Aggregation not executed", "A-MPDU De-Aggregation successful", "PSDU length mismatch", "VHT delimiter CRC fail", "VHT delimiter signature comparison fail", "EOF field check fail", "MPDU length mismatch"}
  "FCS Check Status.gtype" = enum{"FCS check not executed", "FCS check pass", "FCS check fail"}
  "MPDU Length Check Status.gtype" = enum{"MPDU length check not executed", "MPDU length check pass", "MPDU length check not standard compliant", "MPDU length check exceeds implemented buffer"}
  "MPDU Disassembly Status.gtype" = enum{"Disassembly not executed", "Disassembly successful", "Disassembly done partially", "Disassembly not successful"}
uses:
  AFW::802_11::Conversion::U8 to PHY Parameter.gvi
  AFW::802_11::Conversion::Sequence Control Field Conversion.gvi
  AFW::802_11::Conversion::Frame Control Field Conversion.gvi
  AFW::802_11::Conversion::Frame Type and Subtype to Description.gvi
diagram:
  w1 = 0  # number of valid events
  s1 = w1  # shift register
  for {
    w2 = each element of $"raw event data"
    Array Index(array=w2) -> (out0[0]=w5, out1[1]=w6)
    Split Number(x=w5) -> (high(x)=w7, low(x)=w8)
    Split Number(x=w8) -> (high(x)=w9, low(x)=w10)
    Split Number(x=w10) -> (high(x)=w11, low(x)=w12)
    # w7: Timestamp
    # w13: event
    Type Cast(type="Events.gtype" "PHY TX start request", x=w12) -> w13
    Split Number(x=w9) -> (high(x)=w14, low(x)=w15)
    Split Number(x=w6) -> (high(x)=w16, low(x)=w17)
    Split Number(x=w16) -> (high(x)=w18, low(x)=w19)
    Split Number(x=w18) -> (high(x)=w20, low(x)=w21)
    Split Number(x=w19) -> (high(x)=w22, low(x)=w23)
    Split Number(x=w17) -> (high(x)=w24, low(x)=w25)
    Split Number(x=w24) -> (high(x)=w26, low(x)=w27)
    Split Number(x=w25) -> (high(x)=w28, low(x)=w29)
    Build Array(w20, w21, w22, w23, w26, w27, w28, w29) -> w30
    Reverse 1D Array(array=w30) -> (reversed array=w31)
    # w32: event data
    Build Array(w31, w11, w15, w14) -> w32
    case (w13) {
      frame "PHY TX start request" {
        w34 = "PhyTxStart.req format: %s, bandwidth: %s, MCS: %d, length: %d"
        Array Index(array=w32) -> (out0[_]=w35, out2[_]=w36, out3[_]=w37, out4[_]=w38, out5[_]=w39)
        call "U8 to PHY Parameter.gvi"(PHY parameter=w35) -> (format=w40, bandwidth=w41, MCS=w42)
        Join Numbers(high(x)=w39, low(x)=w38) -> w43
        Join Numbers(high(x)=w37, low(x)=w36) -> w44
        Join Numbers(high(x)=w43, low(x)=w44) -> w45
        Format Into String(formatString=w34, w40, w41, w42, w45) -> w33
      }
      frame "PHY TX end indication" {
        Array Index(array=w32) -> (out0[_]=w46, out1[_]=w47)
        Format Into String(formatString="PhyTxEnd.ind unsupported mode: %d, scrambler seed: %d", w46, w47) -> w33
      }
      frame "PHY RX start indication" {
        w48 = "PhyRxStart.ind format: %s, bandwidth: %s, MCS: %d, PSDU length: %d"
        Array Index(array=w32) -> (out0[_]=w49, out1[_]=w50, out2[_]=w51, out3[_]=w52, out4[_]=w53)
        Join Numbers(high(x)=w53, low(x)=w52) -> w54
        Join Numbers(high(x)=w51, low(x)=w50) -> w55
        Join Numbers(high(x)=w54, low(x)=w55) -> w56
        call "U8 to PHY Parameter.gvi"(PHY parameter=w49) -> (format=w57, bandwidth=w58, MCS=w59)
        Format Into String(formatString=w48, w57, w58, w59, w56) -> w33
      }
      frame "PHY RX end indication" {
        Array Index(array=w32) -> (out0[_]=w60, out1[_]=w61, out2[_]=w62, out3[_]=w63, out4[_]=w64, out5[_]=w65, out6[_]=w66, out7[_]=w67)
        w68 = "PhyRxEnd.ind RX error: %s, format: %s, bandwidth: %s, MCS: %d, PSDU length: %d, non HT bandwidth: %s, dynamic bandwidth support: %d"
        Type Cast(type="RX Error.gtype" "NoError", x=w60) -> w69
        call "U8 to PHY Parameter.gvi"(PHY parameter=w61) -> (format=w70, bandwidth=w71, MCS=w72)
        Type Cast(type="Non HT Bandwidth.gtype" "20 MHz", x=w66) -> w73
        Join Numbers(high(x)=w63, low(x)=w62) -> w74
        Join Numbers(high(x)=w65, low(x)=w64) -> w75
        Join Numbers(high(x)=w75, low(x)=w74) -> w76
        Format Into String(formatString=w68, w69, w70, w71, w72, w76, w73, w67) -> w33
      }
      frame "PHY CCA timing indication" {
        Array Index(array=w32) -> (out0[_]=w77, out1[_]=w78)
        Type Cast(type="CCA Indication Channel List Element.gtype" "primary", x=w77) -> w79
        Format Into String(formatString="PHY CCA Timing.ind busy: %d channel: %s", w78, w79) -> w33
      }
      frame "PHY RX gain change indication" {
        Array Index(array=w32) -> (out0[_]=w80, out1[_]=w81)
        Type Cast(type="AGC State.gtype" "Idle", x=w80) -> w82
        Reinterpret Number[RestrictToSameWordLength=True](data in=w81, type=UFXP(7.1) 0) -> (data out=w83)
        To Double Precision Float(number=w83) -> w84
        Format Into String(formatString="PHY RX Gain Change.ind new gain value: %.1f, state: %s", w84, w82) -> w33
      }
      frame "DCF state indication" {
        Array Index(array=w32) -> (out0[_]=w85, out1[_]=w86, out2[_]=w87, out3[_]=w88, out4[_]=w89, out5[_]=w90, out6[_]=w91, out7[_]=w92)
        Join Numbers(high(x)=w92, low(x)=w91) -> w93
        w94 = "DCF state: %s, NAV %d, backoff: %d, DIFS busy: %d, EIFS busy: %d, SIFS opportunity: %d"
        Join Numbers(high(x)=w90, low(x)=w89) -> w95
        Join Numbers(high(x)=w88, low(x)=w87) -> w96
        Join Numbers(high(x)=w95, low(x)=w96) -> w97
        Join Numbers(high(x)=w86, low(x)=w85) -> w98
        Logical And(w98, 15) -> w99
        To Unsigned 8 Bit Integer(number=w99) -> w100
        Type Cast(type="DCF State Machine State.gtype" "NAV waiting", x=w100) -> w101
        Logical Shift(x=w98, y=-11) -> w102
        Logical And(w102, 1) -> w103
        Logical Shift(x=w98, y=-12) -> w104
        Logical And(1, w104) -> w105
        Logical Shift(x=w98, y=-10) -> w106
        Logical And(1, w106) -> w107
        Format Into String(formatString=w94, w101, w97, w93, w103, w105, w107) -> w33
      }
      frame "MAC MPDU RX indication" {
        Array Index(array=w32) -> (out0[_]=w108, out1[_]=w109, out2[_]=w110, out3[_]=w111, out4[_]=w112, out5[_]=w113, out6[_]=w114, out7[_]=w115, out8[_]=w116, out9[_]=w117, out10[_]=w118)
        w119 = "MAC RX indication type: %s, subtype: %s, to DS: %d, from DS: %d, HT: %d, sequence nr.: %d, fragment nr.: %d, MPDU frame body length: %d, %s, %s, %s, %s, recipient address : %2x:xx:xx:xx:%2x:%2x"
        Join Numbers(high(x)=w113, low(x)=w112) -> w120
        Join Numbers(high(x)=w110, low(x)=w111) -> w121
        call "Sequence Control Field Conversion.gvi"(value=w121) -> (sequence number=w122, fragment number=w123)
        To Signed 32 Bit Integer(number=w122) -> w124
        To Signed 32 Bit Integer(number=w123) -> w125
        w126 = "A-MPDU De-Aggregation Status.gtype" "A-MPDU De-Aggregation not executed"  # A-MPDU De-Aggregation Status
        Join Numbers(high(x)=w115, low(x)=w114) -> w127
        Number To Boolean Array(number=w127) -> (Boolean array=w128)
        Array Subset(array=w128, index0=0, length0=3) -> w129
        Boolean Array To Number(Boolean array=w129) -> (number=w130: u8)
        Type Cast(type=w126, x=w130) -> w131
        Array Subset(array=w128, index0=3, length0=2) -> w132
        Boolean Array To Number(Boolean array=w132) -> (number=w133: u8)
        Type Cast(type="FCS Check Status.gtype" "FCS check not executed", x=w133) -> w134
        Array Subset(array=w128, index0=5, length0=2) -> w135
        Boolean Array To Number(Boolean array=w135) -> (number=w136: u8)
        w137 = "MPDU Length Check Status.gtype" "MPDU length check not executed"  # MPDU Length Check Status
        Type Cast(type=w137, x=w136) -> w138
        Array Subset(array=w128, index0=7, length0=2) -> w139
        Boolean Array To Number(Boolean array=w139) -> (number=w140: u8)
        Type Cast(type="MPDU Disassembly Status.gtype" "Disassembly not executed", x=w140) -> w141
        Join Numbers(high(x)=w109, low(x)=w108) -> w142
        call "Frame Control Field Conversion.gvi"(value=w142) -> (frame control=w143)
        Property Node(instance in=w143) -> ("type"=w144, "subtype"=w145, "to DS"=w146, "from DS"=w147, "HTC / order"=w148)
        Boolean To 0 Or 1(Boolean=w146) -> (0, 1=w149)
        Boolean To 0 Or 1(Boolean=w147) -> (0, 1=w150)
        Boolean To 0 Or 1(Boolean=w148) -> (0, 1=w151)
        call "Frame Type and Subtype to Description.gvi"(field type=w144, field subtype=w145) -> (frame type description=w152, frame subtype description=w153)
        Format Into String(formatString=w119, w152, w153, w149, w150, w151, w124, w125, w120, w131, w134, w138, w141, w116, w117, w118) -> w33
      }
      frame "MAC MPDU TX request" {
        Array Index(array=w32) -> (out0[_]=w154, out1[_]=w155, out2[_]=w156, out3[_]=w157, out4[_]=w158, out5[_]=w159, out6[_]=w160, out7[_]=w161, out8[_]=w162, out9[_]=w163, out10[_]=w164)
        w165 = "MAC TX request type: %s, subtype: %s, to DS: %d, from DS: %d, HT: %d, sequence nr.: %d, fragment nr.: %d, MPDU frame body length: %d,  recipient address: %2x:xx:%2x:%2x:%2x:%2x"
        Join Numbers(high(x)=w159, low(x)=w158) -> w166
        Join Numbers(high(x)=w156, low(x)=w157) -> w167
        call "Sequence Control Field Conversion.gvi"(value=w167) -> (sequence number=w168, fragment number=w169)
        To Signed 32 Bit Integer(number=w168) -> w170
        To Signed 32 Bit Integer(number=w169) -> w171
        Join Numbers(high(x)=w155, low(x)=w154) -> w172
        call "Frame Control Field Conversion.gvi"(value=w172) -> (frame control=w173)
        Property Node(instance in=w173) -> ("type"=w174, "subtype"=w175, "to DS"=w176, "from DS"=w177, "HTC / order"=w178)
        Boolean To 0 Or 1(Boolean=w176) -> (0, 1=w179)
        Boolean To 0 Or 1(Boolean=w177) -> (0, 1=w180)
        Boolean To 0 Or 1(Boolean=w178) -> (0, 1=w181)
        call "Frame Type and Subtype to Description.gvi"(field type=w174, field subtype=w175) -> (frame type description=w182, frame subtype description=w183)
        Format Into String(formatString=w165, w182, w183, w179, w180, w181, w170, w171, w166, w160, w161, w162, w163, w164) -> w33
      }
    }
    Number To Decimal String(number=w7) -> (decimal integer string=w184)
    Concatenate Strings(w184, " ", w33, "\r\n") -> w185
    Property Node(instance in="Event Log Item.gtype" {all zero or empty}, "event type"=w13, "timestamp"=w7, "log message"=w185) -> (instance out=w186)
    Increment(x=s1) -> w187
    append w185 to w3
    append w186 to w4
    next s1 = w187
  }
  $"event log" <- w4
  w188 = 0  # current index
  # initialize for valid number of event strings
  Initialize Array(element="", size=s1) -> w189
  s2 = w189  # shift register
  s3 = w188  # shift register
  for {
    w190 = each element of w3
    Is Empty String Or Path(string/path=w190) -> w191
    case (w191) {
      frame False, Default {
        Replace Array Subset(inArray=s2, index=s3, new=w190) -> w192
        Increment(x=s3) -> w193
      }
      frame True {
        w192 = s2
        w193 = s3
      }
    }
    next s2 = w192
    next s3 = w193
  }
  $"event strings" <- s2
