vi "Frame Control Field Conversion.gvi"   [LabVIEW NXG 4.0.0]
# Interprets the given control field in U16 format to a frame control cluster of the current frame, as described in Section 9.2.4.1 of IEEE Standard 802.11-2012.
inputs:
  "value": u16  # Frame control field value in U16 format that will be interpreted to the frame control field cluster.
outputs:
  "frame control": "MAC Header Frame Control.gtype"  # Intrepreted Frame control field as described in Section 9.2.4.1 of IEEE Standard 802.11-2012.
types:
  "MAC Header Frame Control.gtype" = cluster{"protocol version": UFXP(2.0), "type": UFXP(2.0), "subtype": UFXP(4.0), "to DS": bool, "from DS": bool, "more fragments": bool, "retry": bool, "power management": bool, "more data": bool, "protected frame": bool, "HTC / order": bool}
diagram:
  Number To Boolean Array(number=$value) -> (Boolean array=w1)
  Split 1D Array(array=w1, index=2) -> (first subarray=w2, second subarray=w3)
  Split 1D Array(array=w3, index=2) -> (first subarray=w4, second subarray=w5)
  Split 1D Array(array=w5, index=4) -> (first subarray=w6, second subarray=w7)
  Array Index(array=w7) -> (out0[_]=w8, out1[_]=w9, out2[_]=w10, out3[_]=w11, out4[_]=w12, out5[_]=w13, out6[_]=w14, out7[_]=w15)
  Boolean Array To Number(Boolean array=w2) -> (number=w16: UFXP(2.0))
  Boolean Array To Number(Boolean array=w4) -> (number=w17: UFXP(2.0))
  Boolean Array To Number(Boolean array=w6) -> (number=w18: UFXP(4.0))
  # interpret frame control field as described in 9.2.4.1
  Property Node(instance in="MAC Header Frame Control.gtype" {all zero or empty}, "protocol version"=w16, "type"=w17, "subtype"=w18, "from DS"=w9, "to DS"=w8, "more fragments"=w10, "retry"=w11, "power management"=w12, "more data"=w13, "protected frame"=w14, "HTC / order"=w15) -> (instance out=w19)
  $"frame control" <- w19
