vi "Frame Type and Subtype to Description.gvi"   [LabVIEW NXG 4.0.0]
# Maps the given binary signals of field type (represented by FXP U2.0) and field subtype (represented by FXP U4.0) to frame type and subtype, respectively, as a description. The mapping process is based on Table 8-1 of IEEE Standard 802.11-2012.
inputs:
  "field type": UFXP(2.0)  # Type description from Table 8-1 of IEEE Standard 802.11-2012.
  "field subtype": UFXP(4.0)  # Subtype description from Table 8-1 of IEEE Standard 802.11-2012.
outputs:
  "frame type description": "MAC Frame Type.gtype"  # Frame type as a description that is evaluated based on the given binary field type.
  "frame subtype description": "MAC Frame Subtype.gtype"  # Frame subtype as a description that is evaluated based on the given binary fields type and subtype.
types:
  "MAC Frame Subtype.gtype" = enum{"Association request", "Association response", "Reassociation request", "Reassociation response", "Probe request", "Probe response", "Timing Advertisement", "Reserved Management 0111", "Beacon", "ATIM", "Disassociation", "Authentication", "Deauthentication", "Action", "Action No Ack", "Reserved Management 1111", "Reserved Control 0000", "Reserved Control 0001", "Reserved Control 0010", "Reserved Control 0011", "Beamforming Report Poll", "VHT NDP Announcement", "Control Frame Extension", "Control Wrapper", "Block Ack Request", "Block Ack", "PS-Poll", "RTS", "CTS", "ACK", "CF-End", "CF-End + CF-Ack", "Data", "Data + CF-Ack", "Data + CF-Poll", "Data + CF-Ack + CF-Poll", "Null", "CF-Ack", "CF-Poll", "CF-Ack + CF-Poll", "QoS Data", "QoS Data + CF-Ack", "QoS Data + CF-Poll", "QoS Data + CF-Ack + CF-Poll", "QoS Null", "Reserved Data 1101", "QoS CF-Poll", "QoS CF-Ack + CF-Poll", "DMG Beacon", "Reserved Extension 0001", "Reserved Extension 0010", "Reserved Extension 0011", "Reserved Extension 0100", "Reserved Extension 0101", "Reserved Extension 0110", "Reserved Extension 0111", "Reserved Extension 1000", "Reserved Extension 1001", "Reserved Extension 1010", "Reserved Extension 1011", "Reserved Extension 1100", "Reserved Extension 1101", "Reserved Extension 1110", "Reserved Extension 1111"}
  "MAC Frame Type.gtype" = enum{"Management", "Control", "Data", "Extension"}
diagram:
  To Unsigned 8 Bit Integer(number=$"field subtype") -> w1
  To Unsigned 8 Bit Integer(number=$"field type") -> w2
  Logical Shift(x=w2, y=4) -> w3
  Logical Or(w3, w1) -> w4
  Type Cast(type="MAC Frame Subtype.gtype" "Association request", x=w4) -> w5
  $"frame subtype description" <- w5
  To Unsigned 8 Bit Integer(number=$"field type") -> w6
  Type Cast(type="MAC Frame Type.gtype" "Management", x=w6) -> w7
  $"frame type description" <- w7
