vi "Log Events.gvi"   [LabVIEW NXG 4.0.0]
# Deserializes events encoded in U64 into human-readable strings.
# See also: 802.11 Read Event FIFO.gvi
inputs:
  "raw event data": u64[][]  # 2D array of event data and time stamps.
  "error in": error
  "FPGA interface": "FGPA Reference.gtype"  # Interface to the device's FPGA handle.
  "queue name": string  # Given queue name.
  "maximal number of log entries": i32 = -1  # Maximal number of log entries.
outputs:
  "error out": error
  "num events": u32[]  # Numerical indicators to show the number of events.
  "events": string[]  # Cluster that has the event information, where the event could be one of those: • PHY TX start request • PHY TX end indication • PHY RX start indication • PHY RX end indication • PHY CCA timing indication • PHY RX gain change indication • DCF state indication • MAC MPDU RX indication • MAC MPDU TX request
  "timestamps": u32[]  # Created timestamps of events.
  "dropped events": bool  # Indicator to show that the events are dropped if the number of events is larger than maximal number of log entries.
types:
  "Events.gtype" = enum{"PHY TX start request", "PHY TX end indication", "PHY RX start indication", "PHY RX end indication", "PHY CCA timing indication", "PHY RX gain change indication", "DCF state indication", "MAC MPDU RX indication", "MAC MPDU TX request"}
  "RX Error.gtype" = enum{"NoError", "CarrierLost", "FormatViolation", "UnsupportedRate", "Filtered"}
  "Non HT Bandwidth.gtype" = enum{"20 MHz", "40 MHz", "80 MHz", "160 MHz"}
  "CCA Indication Channel List Element.gtype" = enum{"none", "primary", "secondary", "secondary40"}
  "AGC State.gtype" = enum{"Idle", "maximum gain", "wait for measurement", "gain set", "gain locked", "wait for channel clearance"}
  "DCF State Machine State.gtype" = enum{"NAV waiting", "start IFS", "wait for IFS to be active", "wait for IFS end", "start backoff", "wait backoff", "primary channel free", "DCF opportunity", "wait for TX to be active", "TX active / RX timeout", "primary channel busy"}
  "A-MPDU De-Aggregation Status.gtype" = enum{"A-MPDU De-Aggregation not executed", "A-MPDU De-Aggregation successful", "PSDU length mismatch", "VHT delimiter CRC fail", "VHT delimiter signature comparison fail", "EOF field check fail", "MPDU length mismatch"}
  "FCS Check Status.gtype" = enum{"FCS check not executed", "FCS check pass", "FCS check fail"}
  "MPDU Length Check Status.gtype" = enum{"MPDU length check not executed", "MPDU length check pass", "MPDU length check not standard compliant", "MPDU length check exceeds implemented buffer"}
  "MPDU Disassembly Status.gtype" = enum{"Disassembly not executed", "Disassembly successful", "Disassembly done partially", "Disassembly not successful"}
uses:
  AFW::802_11::Conversion::U8 to PHY Parameter.gvi
  AFW::802_11::Conversion::Sequence Control Field Conversion.gvi
  AFW::802_11::Conversion::Frame Control Field Conversion.gvi
  AFW::802_11::Conversion::Frame Type and Subtype to Description.gvi
  AFW::Common::Logging::Log.gvi
diagram:
  case ($"maximal number of log entries") {
    frame -1 {
      w1 = FALSE
      w2 = $"raw event data"
    }
    frame Default {
      Array Size(array=$"raw event data") -> (size(s)=w3)
      Array Index(array=w3) -> (out0[_]=w4)
      Is Greater(x=w4, y=$"maximal number of log entries") -> w1
      case (w1) {
        frame False, Default {
          w2 = $"raw event data"
        }
        frame True {
          Delete From Array(inArray=$"raw event data", length (1)=$"maximal number of log entries") -> (deleted=w2)
        }
      }
    }
  }
  Property Node(instance in=$"FPGA interface", error in=$"error in") -> ("Timestamp"=w5, error out=w6)
  sequence {
    frame 0 {
      Tick Count[Units=Microseconds]() -> (timer value=w7)
      Multiply(10, w7) -> w8
    }
  }
  Merge Errors($"error in", w6) -> (error out=w9)
  To Signed 64 Bit Integer(number=w8) -> w10
  To Signed 64 Bit Integer(number=w5) -> w11
  Subtract(x=w10, y=w11) -> w12
  To Unsigned 32 Bit Integer(number=w12) -> w13
  Type Cast(type=u8 0, x="MAC MPDU TX request") -> w14
  To Signed 32 Bit Integer(number=w14) -> w15
  Initialize Array(element=0, size=w15) -> w16
  w17 = 0  # number of valid events
  s1 = w17  # shift register
  s2 = w16  # shift register
  for {
    w18 = each element of w2
    Array Index(array=w18) -> (out0[0]=w21, out1[1]=w22)
    Split Number(x=w21) -> (high(x)=w23, low(x)=w24)
    # w23: Timestamp
    Add(w13, w23) -> w25
    Split Number(x=w24) -> (high(x)=w26, low(x)=w27)
    Split Number(x=w27) -> (high(x)=w28, low(x)=w29)
    # w30: event
    Type Cast(type="Events.gtype" "PHY TX start request", x=w29) -> w30
    Split Number(x=w26) -> (high(x)=w31, low(x)=w32)
    Split Number(x=w22) -> (high(x)=w33, low(x)=w34)
    Split Number(x=w33) -> (high(x)=w35, low(x)=w36)
    Split Number(x=w35) -> (high(x)=w37, low(x)=w38)
    Split Number(x=w36) -> (high(x)=w39, low(x)=w40)
    Split Number(x=w34) -> (high(x)=w41, low(x)=w42)
    Split Number(x=w41) -> (high(x)=w43, low(x)=w44)
    Split Number(x=w42) -> (high(x)=w45, low(x)=w46)
    Build Array(w37, w38, w39, w40, w43, w44, w45, w46) -> w47
    Reverse 1D Array(array=w47) -> (reversed array=w48)
    # w49: event data
    Build Array(w48, w28, w32, w31) -> w49
    case (w30) {
      frame "PHY TX start request" {
        w51 = "PhyTxStart.req format: %s, bandwidth: %s, MCS: %d, length: %d"
        Array Index(array=w49) -> (out0[_]=w52, out2[_]=w53, out3[_]=w54, out4[_]=w55, out5[_]=w56)
        call "U8 to PHY Parameter.gvi"(PHY parameter=w52) -> (format=w57, bandwidth=w58, MCS=w59)
        Join Numbers(high(x)=w56, low(x)=w55) -> w60
        Join Numbers(high(x)=w54, low(x)=w53) -> w61
        Join Numbers(high(x)=w60, low(x)=w61) -> w62
        Format Into String(formatString=w51, w57, w58, w59, w62) -> w50
      }
      frame "PHY TX end indication" {
        Array Index(array=w49) -> (out0[_]=w63, out1[_]=w64)
        Format Into String(formatString="PhyTxEnd.ind unsupported mode: %d, scrambler seed: %d", w63, w64) -> w50
      }
      frame "PHY RX start indication" {
        w65 = "PhyRxStart.ind format: %s, bandwidth: %s, MCS: %d, PSDU length: %d"
        Array Index(array=w49) -> (out0[_]=w66, out1[_]=w67, out2[_]=w68, out3[_]=w69, out4[_]=w70)
        Join Numbers(high(x)=w70, low(x)=w69) -> w71
        Join Numbers(high(x)=w68, low(x)=w67) -> w72
        Join Numbers(high(x)=w71, low(x)=w72) -> w73
        call "U8 to PHY Parameter.gvi"(PHY parameter=w66) -> (format=w74, bandwidth=w75, MCS=w76)
        Format Into String(formatString=w65, w74, w75, w76, w73) -> w50
      }
      frame "PHY RX end indication" {
        Array Index(array=w49) -> (out0[_]=w77, out1[_]=w78, out2[_]=w79, out3[_]=w80, out4[_]=w81, out5[_]=w82, out6[_]=w83, out7[_]=w84)
        w85 = "PhyRxEnd.ind RX error: %s, format: %s, bandwidth: %s, MCS: %d, PSDU length: %d, non HT bandwidth: %s, dynamic bandwidth support: %d"
        Type Cast(type="RX Error.gtype" "NoError", x=w77) -> w86
        call "U8 to PHY Parameter.gvi"(PHY parameter=w78) -> (format=w87, bandwidth=w88, MCS=w89)
        Type Cast(type="Non HT Bandwidth.gtype" "20 MHz", x=w83) -> w90
        Join Numbers(high(x)=w80, low(x)=w79) -> w91
        Join Numbers(high(x)=w82, low(x)=w81) -> w92
        Join Numbers(high(x)=w92, low(x)=w91) -> w93
        Format Into String(formatString=w85, w86, w87, w88, w89, w93, w90, w84) -> w50
      }
      frame "PHY CCA timing indication" {
        Array Index(array=w49) -> (out0[_]=w94, out1[_]=w95)
        Type Cast(type="CCA Indication Channel List Element.gtype" "primary", x=w94) -> w96
        Format Into String(formatString="PHY CCA Timing.ind busy: %d channel: %s", w95, w96) -> w50
      }
      frame "PHY RX gain change indication" {
        Array Index(array=w49) -> (out0[_]=w97, out1[_]=w98)
        Type Cast(type="AGC State.gtype" "Idle", x=w97) -> w99
        Reinterpret Number[RestrictToSameWordLength=True](data in=w98, type=UFXP(7.1) 0) -> (data out=w100)
        To Double Precision Float(number=w100) -> w101
        Format Into String(formatString="PHY RX Gain Change.ind new gain value: %.1f, state: %s", w101, w99) -> w50
      }
      frame "DCF state indication" {
        Array Index(array=w49) -> (out0[_]=w102, out1[_]=w103, out2[_]=w104, out3[_]=w105, out4[_]=w106, out5[_]=w107, out6[_]=w108, out7[_]=w109)
        Join Numbers(high(x)=w109, low(x)=w108) -> w110
        w111 = "DCF state: %s, NAV %d, backoff: %d, DIFS busy: %d, EIFS busy: %d, SIFS opportunity: %d"
        Join Numbers(high(x)=w107, low(x)=w106) -> w112
        Join Numbers(high(x)=w105, low(x)=w104) -> w113
        Join Numbers(high(x)=w112, low(x)=w113) -> w114
        Join Numbers(high(x)=w103, low(x)=w102) -> w115
        Logical And(w115, 15) -> w116
        To Unsigned 8 Bit Integer(number=w116) -> w117
        Type Cast(type="DCF State Machine State.gtype" "NAV waiting", x=w117) -> w118
        Logical Shift(x=w115, y=-11) -> w119
        Logical And(w119, 1) -> w120
        Logical Shift(x=w115, y=-12) -> w121
        Logical And(1, w121) -> w122
        Logical Shift(x=w115, y=-10) -> w123
        Logical And(1, w123) -> w124
        Format Into String(formatString=w111, w118, w114, w110, w120, w122, w124) -> w50
      }
      frame "MAC MPDU RX indication" {
        Array Index(array=w49) -> (out0[_]=w125, out1[_]=w126, out2[_]=w127, out3[_]=w128, out4[_]=w129, out5[_]=w130, out6[_]=w131, out7[_]=w132, out8[_]=w133, out9[_]=w134, out10[_]=w135)
        w136 = "MAC RX indication type: %s, subtype: %s, to DS: %d, from DS: %d, HT: %d, sequence nr.: %d, fragment nr.: %d, MPDU frame body length: %d, %s, %s, %s, %s, recipient address : %2x:xx:xx:xx:%2x:%2x"
        Join Numbers(high(x)=w130, low(x)=w129) -> w137
        Join Numbers(high(x)=w127, low(x)=w128) -> w138
        call "Sequence Control Field Conversion.gvi"(value=w138) -> (sequence number=w139, fragment number=w140)
        To Signed 32 Bit Integer(number=w139) -> w141
        To Signed 32 Bit Integer(number=w140) -> w142
        w143 = "A-MPDU De-Aggregation Status.gtype" "A-MPDU De-Aggregation not executed"  # A-MPDU De-Aggregation Status
        Join Numbers(high(x)=w132, low(x)=w131) -> w144
        Number To Boolean Array(number=w144) -> (Boolean array=w145)
        Array Subset(array=w145, index0=0, length0=3) -> w146
        Boolean Array To Number(Boolean array=w146) -> (number=w147: u8)
        Type Cast(type=w143, x=w147) -> w148
        Array Subset(array=w145, index0=3, length0=2) -> w149
        Boolean Array To Number(Boolean array=w149) -> (number=w150: u8)
        Type Cast(type="FCS Check Status.gtype" "FCS check not executed", x=w150) -> w151
        Array Subset(array=w145, index0=5, length0=2) -> w152
        Boolean Array To Number(Boolean array=w152) -> (number=w153: u8)
        w154 = "MPDU Length Check Status.gtype" "MPDU length check not executed"  # MPDU Length Check Status
        Type Cast(type=w154, x=w153) -> w155
        Array Subset(array=w145, index0=7, length0=2) -> w156
        Boolean Array To Number(Boolean array=w156) -> (number=w157: u8)
        Type Cast(type="MPDU Disassembly Status.gtype" "Disassembly not executed", x=w157) -> w158
        Join Numbers(high(x)=w126, low(x)=w125) -> w159
        call "Frame Control Field Conversion.gvi"(value=w159) -> (frame control=w160)
        Property Node(instance in=w160) -> ("type"=w161, "subtype"=w162, "to DS"=w163, "from DS"=w164, "HTC / order"=w165)
        Boolean To 0 Or 1(Boolean=w163) -> (0, 1=w166)
        Boolean To 0 Or 1(Boolean=w164) -> (0, 1=w167)
        Boolean To 0 Or 1(Boolean=w165) -> (0, 1=w168)
        call "Frame Type and Subtype to Description.gvi"(field type=w161, field subtype=w162) -> (frame type description=w169, frame subtype description=w170)
        Format Into String(formatString=w136, w169, w170, w166, w167, w168, w141, w142, w137, w148, w151, w155, w158, w133, w134, w135) -> w50
      }
      frame "MAC MPDU TX request" {
        Array Index(array=w49) -> (out0[_]=w171, out1[_]=w172, out2[_]=w173, out3[_]=w174, out4[_]=w175, out5[_]=w176, out6[_]=w177, out7[_]=w178, out8[_]=w179, out9[_]=w180, out10[_]=w181)
        w182 = "MAC TX request type: %s, subtype: %s, to DS: %d, from DS: %d, HT: %d, sequence nr.: %d, fragment nr.: %d, MPDU frame body length: %d,  recipient address: %2x:xx:%2x:%2x:%2x:%2x"
        Join Numbers(high(x)=w176, low(x)=w175) -> w183
        Join Numbers(high(x)=w173, low(x)=w174) -> w184
        call "Sequence Control Field Conversion.gvi"(value=w184) -> (sequence number=w185, fragment number=w186)
        To Signed 32 Bit Integer(number=w185) -> w187
        To Signed 32 Bit Integer(number=w186) -> w188
        Join Numbers(high(x)=w172, low(x)=w171) -> w189
        call "Frame Control Field Conversion.gvi"(value=w189) -> (frame control=w190)
        Property Node(instance in=w190) -> ("type"=w191, "subtype"=w192, "to DS"=w193, "from DS"=w194, "HTC / order"=w195)
        Boolean To 0 Or 1(Boolean=w193) -> (0, 1=w196)
        Boolean To 0 Or 1(Boolean=w194) -> (0, 1=w197)
        Boolean To 0 Or 1(Boolean=w195) -> (0, 1=w198)
        call "Frame Type and Subtype to Description.gvi"(field type=w191, field subtype=w192) -> (frame type description=w199, frame subtype description=w200)
        Format Into String(formatString=w182, w199, w200, w196, w197, w198, w187, w188, w183, w177, w178, w179, w180, w181) -> w50
      }
    }
    Format Into String(formatString="%s %s", errIn=w9, w30, w50) -> (outString=w201, errOut=w202)
    call "Log.gvi"(queue name=$"queue name", log level="Info", module="FPGA", message=w201, error in=w202, automatic timestamp=FALSE, timestamp=w25) -> (error out=w203)
    Type Cast(type=u8 0, x=w30) -> w204
    To Signed 32 Bit Integer(number=w204) -> w205
    Array Index(array=s2) -> (out0[w205]=w206)
    Increment(x=w206) -> w207
    Replace Array Subset(inArray=s2, index=w205, new=w207) -> w208
    Increment(x=s1) -> w209
    append w50 to w19
    append w25 to w20
    next s1 = w209
    next s2 = w208
  }
  $timestamps <- w20
  $"error out" <- w203
  $events <- w19
  $"dropped events" <- w1
  $"num events" <- s2
