vi "MAC Address from Byte Array to String.gvi"   [LabVIEW NXG 4.0.0]
# Converts the given MAC address from an array in byte format to a string (6-octet format).
inputs:
  "error in": error
  "MAC address in": u8[6]  # Given MAC address in U8 format.
outputs:
  "error out": error
  "MAC address out": string  # 6-octet 80211 MAC address Default: 47:6F:4B:75:6D:61
diagram:
  Array Index(array=$"MAC address in") -> (out0[_]=w1, out1[_]=w2, out2[_]=w3, out3[_]=w4, out4[_]=w5, out5[_]=w6)
  Format Into String(formatString="%2x:%2x:%2x:%2x:%2x:%2x", errIn=$"error in", w1, w2, w3, w4, w5, w6) -> (outString=w7, errOut=w8)
  $"MAC address out" <- w7
  $"error out" <- w8
