vi "MAC RX Indication to Byte Array.gvi"   [LabVIEW NXG 4.0.0]
# Converts a MAC RX indication cluster into a byte array in least-significant bit (LSB) order.
# The valid flag is not serialized.
inputs:
  "MAC RX indication": "MAC RX Indication.gtype"  # Consists MAC configuration information passed to the subsequent module in MAC RX chain: RX vector, RX status, MPDU configuration
outputs:
  "array": u8[64]  # Serialized byte array of MAC RX indication in LSB order.
types:
  "PHY Frame Format.gtype" = enum{"NON_HT_OFDM", "VHT", "NON_HT_DUP_OFDM"}
  "Bandwidth.gtype" = enum{"20 MHz", "40 MHz", "80 MHz"}
  "Non HT Bandwidth.gtype" = enum{"20 MHz", "40 MHz", "80 MHz", "160 MHz"}
  "RX Vector.gtype" = cluster{"format": "PHY Frame Format.gtype", "bandwidth": "Bandwidth.gtype", "PSDU length": u32, "MCS": UFXP(4.0), "non HT bandwidth": "Non HT Bandwidth.gtype", "dynamic bandwidth support": bool}
  "A-MPDU De-Aggregation Status.gtype" = enum{"A-MPDU De-Aggregation not executed", "A-MPDU De-Aggregation successful", "PSDU length mismatch", "VHT delimiter CRC fail", "VHT delimiter signature comparison fail", "EOF field check fail", "MPDU length mismatch"}
  "FCS Check Status.gtype" = enum{"FCS check not executed", "FCS check pass", "FCS check fail"}
  "MPDU Length Check Status.gtype" = enum{"MPDU length check not executed", "MPDU length check pass", "MPDU length check not standard compliant", "MPDU length check exceeds implemented buffer"}
  "MPDU Disassembly Status.gtype" = enum{"Disassembly not executed", "Disassembly successful", "Disassembly done partially", "Disassembly not successful"}
  "MPDU Filtering Status.gtype" = enum{"MPDU Filtering not executed", "MPDU valid for further processing", "MPDU pass through for sniffer mode"}
  "MSDU Defragmentation Status.gtype" = enum{"Defragmentation not executed", "Unfragmented MSDU successfully received", "Unsupported MSDU fragment received"}
  "MSDU Duplicate Detection Status.gtype" = enum{"Duplicate detection not executed", "Duplicate detection successfully passed", "Duplicate detected"}
  "RX Status.gtype" = cluster{"A-MPDU de-aggregation status": "A-MPDU De-Aggregation Status.gtype", "MPDU FCS check status": "FCS Check Status.gtype", "MPDU length check status": "MPDU Length Check Status.gtype", "MPDU disassembly status": "MPDU Disassembly Status.gtype", "MPDU Filtering Status": "MPDU Filtering Status.gtype", "MSDU Defragmentation Status": "MSDU Defragmentation Status.gtype", "MSDU Duplicate Detection Status": "MSDU Duplicate Detection Status.gtype"}
  "MPDU Configuration.gtype" = cluster{"frame control": "MAC Header Frame Control.gtype", "header contents": "MAC Header Contents.gtype", "parameters": "MPDU Parameters.gtype"}
  "MAC RX Indication.gtype" = cluster{"RX vector": "RX Vector.gtype", "RX status": "RX Status.gtype", "MPDU configuration": "MPDU Configuration.gtype", "valid": bool}
uses:
  AFW::802_11::Conversion::MAC RX Indication::RX Vector to Byte Array.gvi
  AFW::802_11::Conversion::MAC RX Indication::RX Status to Byte Array.gvi
  AFW::802_11::Conversion::Shared::MAC Header Frame Control to Byte Array.gvi
  AFW::802_11::Conversion::Shared::MAC Header Contents to Byte Array.gvi
  AFW::802_11::Conversion::Shared::MPDU Parameters to Byte Array.gvi
diagram:
  Property Node(instance in=$"MAC RX indication") -> ("RX vector"=w1, "RX status"=w2, "MPDU configuration"=w3)
  call "RX Vector to Byte Array.gvi"(RX vector=w1) -> (array=w4)
  call "RX Status to Byte Array.gvi"(RX status=w2) -> (array=w5)
  Property Node(instance in=w3) -> ("frame control"=w6, "header contents"=w7, "parameters"=w8)
  call "MAC Header Frame Control to Byte Array.gvi"(MAC header frame control in=w6) -> (array=w9)
  call "MAC Header Contents to Byte Array.gvi"(MAC header contents in=w7) -> (array=w10)
  call "MPDU Parameters to Byte Array.gvi"(MPDU parameters in=w8) -> (array=w11)
  Build Array(w4, w5, w9, w10, w11) -> w12
  Type Cast(type=u8[64] [0, 0, 0, 0, 0, 0, 0, 0, 0, 0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], x=w12) -> w13
  $array <- w13
