vi "RX Status to Byte Array.gvi"   [LabVIEW NXG 4.0.0]
# Converts a RX status cluster into a byte array in least-significant bit (LSB) order.
inputs:
  "RX status": "RX Status.gtype"  # %RX STATUS%
outputs:
  "array": u8[6]  # Serialized byte array of RX status in LSB order.
types:
  "A-MPDU De-Aggregation Status.gtype" = enum{"A-MPDU De-Aggregation not executed", "A-MPDU De-Aggregation successful", "PSDU length mismatch", "VHT delimiter CRC fail", "VHT delimiter signature comparison fail", "EOF field check fail", "MPDU length mismatch"}
  "FCS Check Status.gtype" = enum{"FCS check not executed", "FCS check pass", "FCS check fail"}
  "MPDU Length Check Status.gtype" = enum{"MPDU length check not executed", "MPDU length check pass", "MPDU length check not standard compliant", "MPDU length check exceeds implemented buffer"}
  "MPDU Disassembly Status.gtype" = enum{"Disassembly not executed", "Disassembly successful", "Disassembly done partially", "Disassembly not successful"}
  "MPDU Filtering Status.gtype" = enum{"MPDU Filtering not executed", "MPDU valid for further processing", "MPDU pass through for sniffer mode"}
  "MSDU Defragmentation Status.gtype" = enum{"Defragmentation not executed", "Unfragmented MSDU successfully received", "Unsupported MSDU fragment received"}
  "MSDU Duplicate Detection Status.gtype" = enum{"Duplicate detection not executed", "Duplicate detection successfully passed", "Duplicate detected"}
  "RX Status.gtype" = cluster{"A-MPDU de-aggregation status": "A-MPDU De-Aggregation Status.gtype", "MPDU FCS check status": "FCS Check Status.gtype", "MPDU length check status": "MPDU Length Check Status.gtype", "MPDU disassembly status": "MPDU Disassembly Status.gtype", "MPDU Filtering Status": "MPDU Filtering Status.gtype", "MSDU Defragmentation Status": "MSDU Defragmentation Status.gtype", "MSDU Duplicate Detection Status": "MSDU Duplicate Detection Status.gtype"}
diagram:
  Property Node(instance in=$"RX status") -> ("A-MPDU de-aggregation status"=w1, "MPDU FCS check status"=w2, "MPDU length check status"=w3, "MPDU disassembly status"=w4, "MPDU Filtering Status"=w5, "MSDU Defragmentation Status"=w6)
  Type Cast(type=u8 0, x=w1) -> w7
  Type Cast(type=u8 0, x=w2) -> w8
  Type Cast(type=u8 0, x=w3) -> w9
  Type Cast(type=u8 0, x=w4) -> w10
  Type Cast(type=u8 0, x=w5) -> w11
  Type Cast(type=u8 0, x=w6) -> w12
  Build Array(w7, w8, w9, w10, w11, w12) -> w13
  Type Cast(type=u8[6] default, x=w13) -> w14
  $array <- w14
