vi "RX Vector to Byte Array.gvi"   [LabVIEW NXG 4.0.0]
# Converts a RX vector cluster into a byte array in least-significant bit (LSB) order.
inputs:
  "RX vector": "RX Vector.gtype"  # %RX VECTOR%
outputs:
  "array": u8[9]  # Serialized byte array of RX vector in LSB order.
types:
  "PHY Frame Format.gtype" = enum{"NON_HT_OFDM", "VHT", "NON_HT_DUP_OFDM"}
  "Bandwidth.gtype" = enum{"20 MHz", "40 MHz", "80 MHz"}
  "Non HT Bandwidth.gtype" = enum{"20 MHz", "40 MHz", "80 MHz", "160 MHz"}
  "RX Vector.gtype" = cluster{"format": "PHY Frame Format.gtype", "bandwidth": "Bandwidth.gtype", "PSDU length": u32, "MCS": UFXP(4.0), "non HT bandwidth": "Non HT Bandwidth.gtype", "dynamic bandwidth support": bool}
diagram:
  Property Node(instance in=$"RX vector") -> ("format"=w1, "bandwidth"=w2, "PSDU length"=w3, "MCS"=w4, "non HT bandwidth"=w5, "dynamic bandwidth support"=w6)
  To Unsigned 8 Bit Integer(number=w4) -> w7
  Type Cast(type=u8 0, x=w5) -> w8
  Boolean To 0 Or 1(Boolean=w6) -> (0, 1=w9)
  To Unsigned 8 Bit Integer(number=w9) -> w10
  Type Cast(type=u8 0, x=w1) -> w11
  Type Cast(type=u8 0, x=w2) -> w12
  Split Number(x=w3) -> (high(x)=w13, low(x)=w14)
  Split Number(x=w13) -> (high(x)=w15, low(x)=w16)
  Split Number(x=w14) -> (high(x)=w17, low(x)=w18)
  Build Array(w15, w16, w17, w18) -> w19
  Reverse 1D Array(array=w19) -> (reversed array=w20)
  Build Array(w11, w12, w20, w7, w8, w10) -> w21
  Type Cast(type=u8[9] [0, 0, 0, 0, 0, 0, 0, 0, 0], x=w21) -> w22
  $array <- w22
