vi "Variable Length Byte Array to MAC RX Indication.gvi"   [LabVIEW NXG 4.0.0]
# Converts a least-significant bit (LSB) ordered byte array into a MAC RX indication cluster. In addition, it checks if the size of the given byte array is 64 otherwise, it reports an error.
inputs:
  "byte array": u8[]  # Serialized byte array of MAC RX indication in LSB order.
  "error in": error
outputs:
  "MAC RX Indication": "MAC RX Indication.gtype"  # Consists MAC configuration information passed to the subsequent module in MAC RX chain: RX vector, RX status, MPDU configuration
  "error out": error
types:
  "PHY Frame Format.gtype" = enum{"NON_HT_OFDM", "VHT", "NON_HT_DUP_OFDM"}
  "Bandwidth.gtype" = enum{"20 MHz", "40 MHz", "80 MHz"}
  "Non HT Bandwidth.gtype" = enum{"20 MHz", "40 MHz", "80 MHz", "160 MHz"}
  "RX Vector.gtype" = cluster{"format": "PHY Frame Format.gtype", "bandwidth": "Bandwidth.gtype", "PSDU length": u32, "MCS": UFXP(4.0), "non HT bandwidth": "Non HT Bandwidth.gtype", "dynamic bandwidth support": bool}
  "A-MPDU De-Aggregation Status.gtype" = enum{"A-MPDU De-Aggregation not executed", "A-MPDU De-Aggregation successful", "PSDU length mismatch", "VHT delimiter CRC fail", "VHT delimiter signature comparison fail", "EOF field check fail", "MPDU length mismatch"}
  "FCS Check Status.gtype" = enum{"FCS check not executed", "FCS check pass", "FCS check fail"}
  "MPDU Length Check Status.gtype" = enum{"MPDU length check not executed", "MPDU length check pass", "MPDU length check not standard compliant", "MPDU length check exceeds implemented buffer"}
  "MPDU Disassembly Status.gtype" = enum{"Disassembly not executed", "Disassembly successful", "Disassembly done partially", "Disassembly not successful"}
  "MPDU Filtering Status.gtype" = enum{"MPDU Filtering not executed", "MPDU valid for further processing", "MPDU pass through for sniffer mode"}
  "MSDU Defragmentation Status.gtype" = enum{"Defragmentation not executed", "Unfragmented MSDU successfully received", "Unsupported MSDU fragment received"}
  "MSDU Duplicate Detection Status.gtype" = enum{"Duplicate detection not executed", "Duplicate detection successfully passed", "Duplicate detected"}
  "RX Status.gtype" = cluster{"A-MPDU de-aggregation status": "A-MPDU De-Aggregation Status.gtype", "MPDU FCS check status": "FCS Check Status.gtype", "MPDU length check status": "MPDU Length Check Status.gtype", "MPDU disassembly status": "MPDU Disassembly Status.gtype", "MPDU Filtering Status": "MPDU Filtering Status.gtype", "MSDU Defragmentation Status": "MSDU Defragmentation Status.gtype", "MSDU Duplicate Detection Status": "MSDU Duplicate Detection Status.gtype"}
  "MPDU Configuration.gtype" = cluster{"frame control": "MAC Header Frame Control.gtype", "header contents": "MAC Header Contents.gtype", "parameters": "MPDU Parameters.gtype"}
  "MAC RX Indication.gtype" = cluster{"RX vector": "RX Vector.gtype", "RX status": "RX Status.gtype", "MPDU configuration": "MPDU Configuration.gtype", "valid": bool}
uses:
  NI::G Core::Error::Build Error Cluster.gvi
  AFW::802_11::Conversion::MAC RX Indication::Byte Array to MAC RX Indication.gvi
diagram:
  Array Size(array=$"byte array") -> (size(s)=w1)
  case (w1) {
    frame Default {
      Property Node(instance in="MAC RX Indication.gtype" {all zero or empty}) -> (instance out=w3)
      call "Build Error Cluster.gvi"(code=-1, description="Array does not contain 64 bytes.", error in=$"error in") -> (error out=w2)
    }
    frame 64 {
      Type Cast(type=u8[64] [0, 0, 0, 0, 0, 0, 0, 0, 0, 0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], x=$"byte array") -> w4
      call "Byte Array to MAC RX Indication.gvi"(array=w4) -> (MAC RX indication=w5)
      Property Node(instance in=w5, "valid"=TRUE) -> (instance out=w3)
      w2 = $"error in"
    }
  }
  $"MAC RX Indication" <- w3
  $"error out" <- w2
