vi "Byte Array to MAC TX Request.gvi"   [LabVIEW NXG 4.0.0]
# Converts a least-significant bit (LSB) ordered byte array into a MAC TX request cluster.
inputs:
  "array": u8[60]  # Serialized byte array of MAC TX request in LSB order.
outputs:
  "MAC TX request": "MAC TX Request.gtype"  # %MAC TX REQUEST%
types:
  "MPDU Configuration.gtype" = cluster{"frame control": "MAC Header Frame Control.gtype", "header contents": "MAC Header Contents.gtype", "parameters": "MPDU Parameters.gtype"}
  "PHY Frame Format.gtype" = enum{"NON_HT_OFDM", "VHT", "NON_HT_DUP_OFDM"}
  "Bandwidth.gtype" = enum{"20 MHz", "40 MHz", "80 MHz"}
  "TX Vector.gtype" = cluster{"format": "PHY Frame Format.gtype", "bandwidth": "Bandwidth.gtype", "PSDU length": u32, "(A-)MPDU length": u32, "MCS": UFXP(4.0)}
  "MAC TX Request.gtype" = cluster{"MPDU configuration": "MPDU Configuration.gtype", "TX vector": "TX Vector.gtype", "valid": bool}
uses:
  AFW::802_11::Conversion::MAC TX Request::Byte Array to TX Vector.gvi
  AFW::802_11::Conversion::Shared::Byte Array to MAC Header Frame Control.gvi
  AFW::802_11::Conversion::Shared::Byte Array to MAC Header Contents.gvi
  AFW::802_11::Conversion::Shared::Byte Array to MPDU Parameters.gvi
diagram:
  Split 1D Array(array=$array, index=2) -> (first subarray=w1, second subarray=w2)
  Split 1D Array(array=w2, index=40) -> (first subarray=w3, second subarray=w4)
  Split 1D Array(array=w4, index=7) -> (first subarray=w5, second subarray=w6)
  call "Byte Array to TX Vector.gvi"(array=w6) -> (TX vector=w7)
  call "Byte Array to MAC Header Frame Control.gvi"(array=w1) -> (MAC header frame control=w8)
  call "Byte Array to MAC Header Contents.gvi"(array=w3) -> (MAC header contents=w9)
  call "Byte Array to MPDU Parameters.gvi"(array=w5) -> (MPDU parameters=w10)
  Property Node(instance in="MPDU Configuration.gtype" {all zero or empty}, "frame control"=w8, "header contents"=w9, "parameters"=w10) -> (instance out=w11)
  Property Node(instance in="MAC TX Request.gtype" {all zero or empty}, "MPDU configuration"=w11, "TX vector"=w7, "valid"=FALSE) -> (instance out=w12)
  $"MAC TX request" <- w12
