vi "Byte Array to TX Vector.gvi"   [LabVIEW NXG 4.0.0]
# Converts a least-significant bit (LSB) ordered byte array into a TX vector cluster.
inputs:
  "array": u8[11]  # Serialized byte array of TX vector in LSB order.
outputs:
  "TX vector": "TX Vector.gtype"  # %TX VECTOR%
types:
  "PHY Frame Format.gtype" = enum{"NON_HT_OFDM", "VHT", "NON_HT_DUP_OFDM"}
  "Bandwidth.gtype" = enum{"20 MHz", "40 MHz", "80 MHz"}
  "TX Vector.gtype" = cluster{"format": "PHY Frame Format.gtype", "bandwidth": "Bandwidth.gtype", "PSDU length": u32, "(A-)MPDU length": u32, "MCS": UFXP(4.0)}
diagram:
  Split 1D Array(array=$array, index=2) -> (first subarray=w1, second subarray=w2)
  Array Index(array=w1) -> (out0[_]=w3, out1[_]=w4)
  To Signed 32 Bit Integer(number=w3) -> w5
  Array Index(array=["NON_HT_OFDM", "VHT", "NON_HT_DUP_OFDM"]) -> (out0[w5]=w6)
  To Signed 32 Bit Integer(number=w4) -> w7
  Array Index(array=["20 MHz", "40 MHz", "80 MHz"]) -> (out0[w7]=w8)
  Split 1D Array(array=w2, index=4) -> (first subarray=w9, second subarray=w10)
  Split 1D Array(array=w10, index=4) -> (first subarray=w11, second subarray=w12)
  Array Index(array=w12) -> (out0[_]=w13)
  To Fixed Point(fixed-point type=UFXP(4.0) 0, number=w13) -> w14
  Reverse 1D Array(array=w9) -> (reversed array=w15)
  Array Index(array=w15) -> (out0[_]=w16, out1[_]=w17, out2[_]=w18, out3[_]=w19)
  Join Numbers(high(x)=w16, low(x)=w17) -> w20
  Join Numbers(high(x)=w18, low(x)=w19) -> w21
  Join Numbers(high(x)=w20, low(x)=w21) -> w22
  Reverse 1D Array(array=w11) -> (reversed array=w23)
  Array Index(array=w23) -> (out0[_]=w24, out1[_]=w25, out2[_]=w26, out3[_]=w27)
  Join Numbers(high(x)=w24, low(x)=w25) -> w28
  Join Numbers(high(x)=w26, low(x)=w27) -> w29
  Join Numbers(high(x)=w28, low(x)=w29) -> w30
  Property Node(instance in="TX Vector.gtype" {all zero or empty}, "format"=w6, "bandwidth"=w8, "PSDU length"=w22, "(A-)MPDU length"=w30, "MCS"=w14) -> (instance out=w31)
  $"TX vector" <- w31
