vi "MAC TX Request to Byte Array.gvi"   [LabVIEW NXG 4.0.0]
# Converts a MAC TX request cluster into a byte array in least-significant bit (LSB) order.
# The valid flag is not serialized.
inputs:
  "MAC TX request in": "MAC TX Request.gtype"  # %MAC TX REQUEST%
outputs:
  "array": u8[60]  # Serialized byte array of MAC RX request in LSB order.
types:
  "MPDU Configuration.gtype" = cluster{"frame control": "MAC Header Frame Control.gtype", "header contents": "MAC Header Contents.gtype", "parameters": "MPDU Parameters.gtype"}
  "PHY Frame Format.gtype" = enum{"NON_HT_OFDM", "VHT", "NON_HT_DUP_OFDM"}
  "Bandwidth.gtype" = enum{"20 MHz", "40 MHz", "80 MHz"}
  "TX Vector.gtype" = cluster{"format": "PHY Frame Format.gtype", "bandwidth": "Bandwidth.gtype", "PSDU length": u32, "(A-)MPDU length": u32, "MCS": UFXP(4.0)}
  "MAC TX Request.gtype" = cluster{"MPDU configuration": "MPDU Configuration.gtype", "TX vector": "TX Vector.gtype", "valid": bool}
uses:
  AFW::802_11::Conversion::Shared::MAC Header Frame Control to Byte Array.gvi
  AFW::802_11::Conversion::Shared::MAC Header Contents to Byte Array.gvi
  AFW::802_11::Conversion::Shared::MPDU Parameters to Byte Array.gvi
  AFW::802_11::Conversion::MAC TX Request::TX Vector to Byte Array.gvi
diagram:
  Property Node(instance in=$"MAC TX request in") -> ("MPDU configuration"=w1, "TX vector"=w2)
  Property Node(instance in=w1) -> ("frame control"=w3, "header contents"=w4, "parameters"=w5)
  call "MAC Header Frame Control to Byte Array.gvi"(MAC header frame control in=w3) -> (array=w6)
  call "MAC Header Contents to Byte Array.gvi"(MAC header contents in=w4) -> (array=w7)
  call "MPDU Parameters to Byte Array.gvi"(MPDU parameters in=w5) -> (array=w8)
  call "TX Vector to Byte Array.gvi"(TX vector=w2) -> (array=w9)
  Build Array(w6, w7, w8, w9) -> w10
  Type Cast(type=u8[60] [0, 0, 0, 0, 0, 0, 0, 0, 0, 0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], x=w10) -> w11
  $array <- w11
