vi "PHY Parameter to U8.gvi"   [LabVIEW NXG 4.0.0]
# Serializes format, bandwidth, and MCS into a U8 datatype.
inputs:
  "format": "PHY Frame Format.gtype" = "NON_HT_OFDM"
  "bandwidth": "Bandwidth.gtype" = "20 MHz"
  "MCS": UFXP(4.0)  # Modulation and coding scheme index. Depending on the current 802.11 format (a or ac) and the bandwidth, valid indexes range from 0 to 7, 8 or 9.
outputs:
  "sample": u8  # Serialized data.
types:
  "PHY Frame Format.gtype" = enum{"NON_HT_OFDM", "VHT", "NON_HT_DUP_OFDM"}
  "Bandwidth.gtype" = enum{"20 MHz", "40 MHz", "80 MHz"}
diagram:
  case ($format) {
    frame "NON_HT_OFDM" {
      w1 = 0
    }
    frame "VHT" {
      w1 = 1
    }
    frame "NON_HT_DUP_OFDM" {
      w1 = 2
    }
  }
  Number To Boolean Array(number=w1) -> (Boolean array=w2)
  case ($bandwidth) {
    frame "20 MHz" {
      w3 = 0
    }
    frame "40 MHz" {
      w3 = 1
    }
    frame "80 MHz" {
      w3 = 2
    }
  }
  Number To Boolean Array(number=w3) -> (Boolean array=w4)
  Number To Boolean Array(number=$MCS) -> (Boolean array=w5)
  Build Array(w2, w4, w5) -> w6
  Boolean Array To Number(Boolean array=w6) -> (number=w7: u8)
  $sample <- w7
