vi "Prepare TX Block Error Rate Measurements.gvi"   [LabVIEW NXG 4.0.0]
# Calculates the TX Block Error rate and the averaged retransmissions per packet based on the decoded messages from FPGA.
inputs:
  "TX Status and retransmission data": "MAC TX End Indication.gtype"[]  # Dequeued TX Status and retransmission array.
outputs:
  "current TX block error rate": f64  # Current TX block error rate that has been calculated by dividing the number of unsuccessful transmitted packets (including retransmissions) by the number of all packets (including retransmissions).
  "current TX packet error rate": f64  # Current TX packet error rate that has been calculated by dividing the number of unsuccessful transmitted packets by the number of all packets.
  "averaged retransmissions per packet": f64  # Averaged retransmissions per packet that has been calculated based on the failed and the total elements received from the queue.
  "max. retransmissions per packet": f64  # Maximum retransmissions per packet that has been calculated based on the failed and the total elements received from the queue.
  "TX Error Rates": f64[][]  # Values “current TX packet error rate” and “current TX block error rate” combined to be written to a plot.
types:
  "TX Status.gtype" = enum{"MPDU transmitted", "MPDU discarded"}
  "MAC TX End Indication.gtype" = cluster{"TX status": "TX Status.gtype", "number of transmission tries": u16, "valid": bool}
diagram:
  Array Size(array=$"TX Status and retransmission data") -> (size(s)=w1)
  Is Equal To 0(x=w1) -> w2
  for {
    w3 = each element of $"TX Status and retransmission data"
    Property Node(instance in=w3) -> ("TX status"=w7, "number of transmission tries"=w8)
    Is Equal(x="MPDU transmitted", y=w7) -> w9
    # w10: transmission
    # successful
    # w11: retransmissions
    Boolean To 0 Or 1(Boolean=w9) -> (0, 1=w10)
    # w8: all transmissions
    Decrement(x=w8) -> w11
    append w11 to w4
    append w10 to w5
    append w8 to w6
  }
  # w12: number of
  # successful
  # transmissions
  Add Array Elements(numeric array=w5) -> (sum=w12)
  To Double Precision Float(number=w12) -> w13
  To Double Precision Float(number=w1) -> w14
  Divide(x=w13, y=w14) -> w15
  Subtract(x=1, y=w15) -> w16
  Select(s=w2, t=NaN, f=w16) -> w17
  Add Array Elements(numeric array=w6) -> (sum=w18)
  Is Equal To 0(x=w18) -> w19
  To Double Precision Float(number=w12) -> w20
  To Double Precision Float(number=w18) -> w21
  Divide(x=w20, y=w21) -> w22
  Subtract(x=1, y=w22) -> w23
  Select(s=w19, t=NaN, f=w23) -> w24
  Build Array(w17, w24) -> w25
  Build Array(w25) -> w26
  $"TX Error Rates" <- w26
  $"current TX packet error rate" <- w17
  $"current TX block error rate" <- w24
  # w27: number of
  # retransmissions
  Add Array Elements(numeric array=w4) -> (sum=w27)
  To Double Precision Float(number=w27) -> w28
  To Double Precision Float(number=w1) -> w29
  Divide(x=w28, y=w29) -> w30
  $"averaged retransmissions per packet" <- w30
  # w18: number of
  # all transmissions
  # w31: max. number of
  # retransmissions
  # w1: number of
  # sequences
  Array Max And Min(array=w4) -> (max value=w31)
  To Double Precision Float(number=w31) -> w32
  Is Equal To 0(x=w1) -> w33
  Select(s=w33, t=NaN, f=w32) -> w34
  $"max. retransmissions per packet" <- w34
