vi "Prepare Throughput Measurements.gvi"   [LabVIEW NXG 4.0.0]
# Reads the most recent transferred bytes count from the receiver throughput queue to calculate the current RX throughput rate. The MAC statistics are read to calculate a block error rate for the sent TX packets. Both results are smoothed with a moving average.
inputs:
  "reset": bool  # Resets internal averaging.
  "FPGA interface": "FGPA Reference.gtype"  # Interface to the device's FPGA handle.
  "receive throughput queue": Queue<T1>  # Queue containing an array of clusters with the time stamp and transferred byte count for each received RX packet.
  "error in": error
  "timing granularity": u32 = 100  # Sets the rate at which the node is called, in ms, to enable calculation of throughput per second. Default: 100
outputs:
  "packet rate": f64  # Number of RX packets transferred per second.
  "error out": error
  "TX block error rate": f64  # Error rate of sent TX packets versus received ACKs in a range of [0,1].
  "RX throughput": f64  # Throughput of the RX payload, in bits/s.
types:
  T1 = cluster{"Timestamp": u32, "Transferred Bytes": u32}
uses:
  AFW::802_11::Conversion::Moving Average.gvi
diagram:
  Flush Queue(error in=$"error in", queue=$"receive throughput queue") -> (error out=w1, remaining elements=w2)
  # keep this order because this
  # read delay prevents the BLER
  # to be lower than 0
  Property Node(instance in=$"FPGA interface", error in=w1) -> (error out=w3)
  $"error out" <- w3
  w4 = 0  # temp
  Feedback Node(input=w4) -> w5
  Subtract(x=w4, y=w5) -> w6
  Is Equal To 0(x=w6) -> w7
  w8 = 0  # number of ACKs received
  Feedback Node(input=w8) -> w9
  Subtract(x=w8, y=w9) -> w10
  To Double Precision Float(number=w10) -> w11
  To Double Precision Float(number=w6) -> w12
  Divide(x=w11, y=w12) -> w13
  Subtract(x=1, y=w13) -> w14
  Select(s=w7, t=0, f=w14) -> w15
  call "Moving Average.gvi"(sample=w15, samples to average=10, reset=$reset) -> (average=w16)
  $"TX block error rate" <- w16
  To Double Precision Float(number=$"timing granularity") -> w17
  Divide(x=1000, y=w17) -> w18
  Array Size(array=w2) -> (size(s)=w19)
  To Double Precision Float(number=w19) -> w20
  Multiply(w20, w18) -> w21
  $"packet rate" <- w21
  for {
    w22 = each element of w2
    Property Node(instance in=w22) -> ("Transferred Bytes"=w24)
    append w24 to w23
  }
  To Double Precision Float(number=w23) -> w25
  Add Array Elements(numeric array=w25) -> (sum=w26)
  Multiply(w26, 8) -> w27
  To Double Precision Float(number=w27) -> w28
  Multiply(w28, w18) -> w29
  call "Moving Average.gvi"(sample=w29, samples to average=10, reset=$reset) -> (average=w30)
  $"RX throughput" <- w30
