vi "Sequence Control Field Conversion.gvi"   [LabVIEW NXG 4.0.0]
# Interprets the Given sequence control field in U16 format to a fragment number and a sequence number of the current frame, as described in section 8.2.4.4.1 of IEEE Standard 802.11-2012.
inputs:
  "value": u16  # Given sequence control field in U16 format.
outputs:
  "sequence number": UFXP(12.0)  # Sequence number of the current frame, as described in section 8.2.4.4.1 of IEEE Standard 802.11-2012.
  "fragment number": UFXP(4.0)  # Fragment number of the current frame, as described in section 8.2.4.4.1 of IEEE Standard 802.11-2012.
diagram:
  Number To Boolean Array(number=$value) -> (Boolean array=w1)
  Split 1D Array(array=w1, index=12) -> (first subarray=w2, second subarray=w3)
  Boolean Array To Number(Boolean array=w2) -> (number=w4: UFXP(12.0))
  # interpret sequence control field as described in 9.2.4.4
  $"sequence number" <- w4
  Boolean Array To Number(Boolean array=w3) -> (number=w5: UFXP(4.0))
  $"fragment number" <- w5
