vi "Byte Array to MAC Header Frame Control.gvi"   [LabVIEW NXG 4.0.0]
# Converts a least-significant bit (LSB) ordered byte array into a MAC header frame control cluster.
inputs:
  "array": u8[2]  # Serialized byte array of MAC header frame control in LSB order.
outputs:
  "MAC header frame control": "MAC Header Frame Control.gtype"  # %MAC HEADER FRAME CONTROL%
types:
  "MAC Header Frame Control.gtype" = cluster{"protocol version": UFXP(2.0), "type": UFXP(2.0), "subtype": UFXP(4.0), "to DS": bool, "from DS": bool, "more fragments": bool, "retry": bool, "power management": bool, "more data": bool, "protected frame": bool, "HTC / order": bool}
diagram:
  Array Index(array=$array) -> (out0[_]=w1, out1[_]=w2)
  Number To Boolean Array(number=w1) -> (Boolean array=w3)
  Split 1D Array(array=w3, index=2) -> (first subarray=w4, second subarray=w5)
  Boolean Array To Number(Boolean array=w4) -> (number=w6: u8)
  To Fixed Point(fixed-point type=UFXP(2.0) 0, number=w6) -> w7
  Number To Boolean Array(number=w2) -> (Boolean array=w8)
  Array Index(array=w8) -> (out0[_]=w9, out1[_]=w10, out2[_]=w11, out3[_]=w12, out4[_]=w13, out5[_]=w14, out6[_]=w15, out7[_]=w16)
  Split 1D Array(array=w5, index=2) -> (first subarray=w17, second subarray=w18)
  Boolean Array To Number(Boolean array=w17) -> (number=w19: u8)
  To Fixed Point(fixed-point type=UFXP(2.0) 0, number=w19) -> w20
  Boolean Array To Number(Boolean array=w18) -> (number=w21: u8)
  To Fixed Point(fixed-point type=UFXP(4.0) 0, number=w21) -> w22
  Property Node(instance in="MAC Header Frame Control.gtype" {all zero or empty}, "protocol version"=w7, "type"=w20, "subtype"=w22, "to DS"=w9, "from DS"=w10, "more fragments"=w11, "retry"=w12, "power management"=w13, "more data"=w14, "protected frame"=w15, "HTC / order"=w16) -> (instance out=w23)
  $"MAC header frame control" <- w23
