vi "MAC Header Contents to Byte Array.gvi"   [LabVIEW NXG 4.0.0]
# Converts a MAC header content cluster into a byte array in least-significant bit (LSB) order.
# Sequence and fragment number are serialized into one single U16.
inputs:
  "MAC header contents in": "MAC Header Contents.gtype"  # %MAC HEADER CONTENTS%
outputs:
  "array": u8[40]  # Serialized byte array of MAC header contents in LSB order.
types:
  "MAC Header Contents.gtype" = cluster{"duration": u16, "source address": u8[6], "destination address": u8[6], "basic service set identifier": u8[6], "recipient address": u8[6], "transmitter address": u8[6], "sequence number": UFXP(12.0), "fragment number": UFXP(4.0), "QoS control": u16, "HT control": u32}
diagram:
  Property Node(instance in=$"MAC header contents in") -> ("duration"=w1, "source address"=w2, "destination address"=w3, "basic service set identifier"=w4, "recipient address"=w5, "transmitter address"=w6, "sequence number"=w7, "fragment number"=w8, "QoS control"=w9, "HT control"=w10)
  To Unsigned 16 Bit Integer(number=w1) -> w11
  Split Number(x=w11) -> (high(x)=w12, low(x)=w13)
  Build Array(w12, w13) -> w14
  Reverse 1D Array(array=w14) -> (reversed array=w15)
  Number To Boolean Array(number=w7) -> (Boolean array=w16)
  Number To Boolean Array(number=w8) -> (Boolean array=w17)
  Build Array(w16, w17) -> w18
  Boolean Array To Number(Boolean array=w18) -> (number=w19: u16)
  Split Number(x=w19) -> (high(x)=w20, low(x)=w21)
  Build Array(w20, w21) -> w22
  Reverse 1D Array(array=w22) -> (reversed array=w23)
  Split Number(x=w9) -> (high(x)=w24, low(x)=w25)
  Build Array(w24, w25) -> w26
  Reverse 1D Array(array=w26) -> (reversed array=w27)
  Split Number(x=w10) -> (high(x)=w28, low(x)=w29)
  Split Number(x=w28) -> (high(x)=w30, low(x)=w31)
  Split Number(x=w29) -> (high(x)=w32, low(x)=w33)
  Build Array(w30, w31, w32, w33) -> w34
  Reverse 1D Array(array=w34) -> (reversed array=w35)
  Build Array(w15, w2, w3, w4, w5, w6, w23, w27, w35) -> w36
  Type Cast(type=u8[40] [0, 0, 0, 0, 0, 0, 0, 0, 0, 0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], x=w36) -> w37
  $array <- w37
