vi "Subcarrier Format to Configuration.gvi"   [LabVIEW NXG 4.0.0]
# Extracts modulation, coding rate, format, and bandwidth from the modulation and coding scheme (MCS) and subcarrier format.
inputs:
  "MCS": UFXP(4.0)  # Modulation and coding scheme index.
  "Subcarrier Format": "Subcarrier Format.gtype" = "20 MHz (IEEE 802.11 a)"  # Subcarrier format to use. This includes the 802.11 format (a and ac supported) as well as the bandwith (20 MHz (a and ac) or 40/80 Mhz (ac only)).
  "error in": error
outputs:
  "modulation and coding rate": string  # Modulation and coding rate, which are dependent on the MCS and subcarrier format. MCS has different meanings depending on the format and bandwidth you use. Refer to Table 18-4 of IEEE Standard 802.11-2012, and Table 22-30 and Table 22-38 of IEEE Standard 802.11ac-2013.
  "error out": error
  "format": "PHY Frame Format.gtype"  # Format according to the subcarrier format.
  "bandwidth": "Bandwidth.gtype"  # Bandwidth according to the subcarrier format.
  "valid configuration": bool  # Signals whether MCS points to a valid configuration according to subcarrier format.
types:
  "PHY Frame Format.gtype" = enum{"NON_HT_OFDM", "VHT", "NON_HT_DUP_OFDM"}
  "Bandwidth.gtype" = enum{"20 MHz", "40 MHz", "80 MHz"}
  "Subcarrier Format.gtype" = enum{"20 MHz (IEEE 802.11 a)", "20 MHz (IEEE 802.11 ac)", "40 MHz (IEEE 802.11 ac)", "80 MHz (IEEE 802.11 ac)"}
diagram:
  case ($"Subcarrier Format") {
    frame "20 MHz (IEEE 802.11 a)" {
      # 802.11a 20MHz (802.11-2012 table 18-4)
      w6 = ["BPSK", "BPSK", "QPSK", "QPSK", "16-QAM", "16-QAM", "64-QAM", "64-QAM"]
      To Signed 32 Bit Integer(number=$MCS) -> w7
      Array Index(array=w6) -> (out0[w7]=w1)
      Array Index(array=["1/2", "3/4", "1/2", "3/4", "1/2", "3/4", "2/3", "3/4"]) -> (out0[w7]=w3)
      w8 = "NON_HT_OFDM"  # PHY Frame Format
      w9 = "20 MHz"  # Bandwidth
      w2 = 7
      w4 = w8
      w5 = w9
    }
    frame "20 MHz (IEEE 802.11 ac)" {
      # 802.11ac 20MHz (802.11ac-2013 table 22-30)
      w10 = ["BPSK", "QPSK", "QPSK", "16-QAM", "16-QAM", "64-QAM", "64-QAM", "64-QAM", "256-QAM"]
      To Signed 32 Bit Integer(number=$MCS) -> w11
      Array Index(array=w10) -> (out0[w11]=w1)
      w12 = ["1/2", "1/2", "3/4", "1/2", "3/4", "2/3", "3/4", "5/6", "3/4"]
      Array Index(array=w12) -> (out0[w11]=w3)
      w13 = "VHT"  # PHY Frame Format
      w14 = "20 MHz"  # Bandwidth
      w2 = 8
      w4 = w13
      w5 = w14
    }
    frame "40 MHz (IEEE 802.11 ac)" {
      # 802.11ac 40MHz (802.11ac-2013 table 22-38)
      w15 = ["BPSK", "QPSK", "QPSK", "16-QAM", "16-QAM", "64-QAM", "64-QAM", "64-QAM", "256-QAM", "256-QAM"]
      To Signed 32 Bit Integer(number=$MCS) -> w16
      Array Index(array=w15) -> (out0[w16]=w1)
      w17 = ["1/2", "1/2", "3/4", "1/2", "3/4", "2/3", "3/4", "5/6", "3/4", "5/6"]
      Array Index(array=w17) -> (out0[w16]=w3)
      w18 = "VHT"  # PHY Frame Format
      w19 = "40 MHz"  # Bandwidth
      w2 = 9
      w4 = w18
      w5 = w19
    }
    frame "80 MHz (IEEE 802.11 ac)" {
      # 802.11ac 80MHz (802.11ac-2013 table 22-46)
      To Signed 32 Bit Integer(number=$MCS) -> w20
      Array Index(array=["BPSK", "QPSK", "QPSK", "16-QAM", "16-QAM"]) -> (out0[w20]=w1)
      Array Index(array=["1/2", "1/2", "3/4", "1/2", "3/4"]) -> (out0[w20]=w3)
      # limited by PHY capabilites
      w21 = "VHT"  # PHY Frame Format
      w22 = "80 MHz"  # Bandwidth
      w2 = 4
      w4 = w21
      w5 = w22
    }
  }
  Is Greater(x=$MCS, y=w2) -> w23
  Format Into String(formatString="%s (%s)", errIn=$"error in", w1, w3) -> (outString=w24, errOut=w25)
  Select(s=w23, t="invalid", f=w24) -> w26
  $"modulation and coding rate" <- w26
  Not(x=w23) -> w27
  $"valid configuration" <- w27
  $format <- w4
  $bandwidth <- w5
  $"error out" <- w25
