vi "Decode ICP.gvi"   [LabVIEW NXG 4.0.0]
# Reads the interface communication protocol (ICP) header and payload from RX Data direct memory access (DMA) FIFO. The ICP header is dropped and the payload (A-MPDU) is transferred to the receive queue for further processing. The current time stamp and payload size are written to the receive throughput queue for statistics purposes.
inputs:
  "array": u8[]  # Byte array containing ICP encoded message.
outputs:
  "remaining data": u8[]  # Bytes remaining from array after at most one message was decoded.
  "decoded": bool  # Indicates that an ICP packet was successfully decoded.
  "message": u8[]  # Message part of ICP message.
  "payload": u8[]  # Payload part of ICP message.
diagram:
  w1 = 8  # message and payload length descriptor
  Array Size(array=$array) -> (size(s)=w2)
  Is Greater Or Equal(x=w2, y=w1) -> w3
  # Removes at most one ICP message from byte stream
  # If the message cannot be fully decoded it is not decoded
  # at all (signaled with decoded).
  # Remaining data is passed in the results.
  case (w3) {
    frame False, Default {
      w4 = FALSE
      w5 = $array
      w6 = default
      w7 = default
    }
    frame True {
      # Read ICP length (message and payload)
      Array Subset(array=$array, length0=w1) -> w8
      Reverse 1D Array(array=w8) -> (reversed array=w9)
      Array Index(array=w9) -> (out0[_]=w10, out1[_]=w11, out2[_]=w12, out3[_]=w13, out4[_]=w14, out5[_]=w15, out6[_]=w16, out7[_]=w17)
      Join Numbers(high(x)=w14, low(x)=w15) -> w18
      Join Numbers(high(x)=w16, low(x)=w17) -> w19
      Join Numbers(high(x)=w18, low(x)=w19) -> w20
      # w21: message length
      To Signed 32 Bit Integer(number=w20) -> w21
      Join Numbers(high(x)=w10, low(x)=w11) -> w22
      Join Numbers(high(x)=w12, low(x)=w13) -> w23
      Join Numbers(high(x)=w22, low(x)=w23) -> w24
      # w25: payload length
      To Signed 32 Bit Integer(number=w24) -> w25
      Add(w25, w21) -> w26
      Add(w26, w1) -> w27
      Is Greater Or Equal(x=w2, y=w27) -> w4
      case (w4) {
        frame False, Default {
          w5 = $array
          w6 = default
          w7 = default
        }
        frame True {
          Delete From Array(inArray=$array, length (1)=w27, index0=0) -> (outArray=w5, deleted=w28)
          Delete From Array(inArray=w28, length (1)=w1, index0=0) -> w29
          # Remove message if byte array
          # contains all bytes of ICP
          # message
          Split 1D Array(array=w29, index=w21) -> (first subarray=w6, second subarray=w7)
        }
      }
    }
  }
  $decoded <- w4
  $"remaining data" <- w5
  $message <- w6
  $payload <- w7
