vi "Encode ICP.gvi"   [LabVIEW NXG 4.0.0]
# Encodes a message and payload into interface communication protocol (ICP) format.
# In ICP format the length of message and payload are written first in LSB order. A value of zero for both is allowed. Message and payload bytes are written afterward.
inputs:
  "message": u8[]  # Message as byte array.
  "payload": u8[]  # Payload as byte array.
outputs:
  "ICP message": u8[]  # ICP message as byte array.
diagram:
  Array Size(array=$message) -> (size(s)=w1)
  Split Number(x=w1) -> (high(x)=w2, low(x)=w3)
  Split Number(x=w2) -> (high(x)=w4, low(x)=w5)
  Split Number(x=w3) -> (high(x)=w6, low(x)=w7)
  Build Array(w4, w5, w6, w7) -> w8
  Reverse 1D Array(array=w8) -> (reversed array=w9)
  Array Size(array=$payload) -> (size(s)=w10)
  Split Number(x=w10) -> (high(x)=w11, low(x)=w12)
  Split Number(x=w11) -> (high(x)=w13, low(x)=w14)
  Split Number(x=w12) -> (high(x)=w15, low(x)=w16)
  Build Array(w13, w14, w15, w16) -> w17
  Reverse 1D Array(array=w17) -> (reversed array=w18)
  Build Array(w9, w18, $message, $payload) -> w19
  $"ICP message" <- w19
