vi "Check Confirmation Status.gvi"   [LabVIEW NXG 4.0.0]
# Checks if the confirmation status of the input MAC SAP TX CNF cluster is either Success or Range Violation and outputs the extracted confirmation status.
inputs:
  "MAC SAP TX CNF": "MAC SAP TX Confirmation.gtype"  # MAC SAP TX CNF input cluster, which contains the confirmation status to be checked.
  "error in": error
outputs:
  "error out": error
  "confirmation status": "Confirmation States.gtype"  # Result of the extracted confirmation status.
types:
  "General Message Header.gtype" = cluster{"message type ID": u16, "reference ID": u16, "instance ID": u8}
  "SAP Sub Header.gtype" = cluster{"timestamp": u32, "number of submessages": u8, "confirmation mode": bool}
  "Confirmation States.gtype" = enum{"Success", "Unknown Message", "Message not Supported", "Unknown Parameter (Set)", "Missing Parameter (Set)", "Parameter (Set) Repetition", "Range Violation", "State Violation", "Timeout", "Config Payload Mismatch", "Length Mismatch", "Input Buffer Full", "Internal Error", "Instance ID Mismatch"}
  "MAC SAP TX Confirmation.gtype" = cluster{"General Message Header": "General Message Header.gtype", "SAP Sub Header": "SAP Sub Header.gtype", "Confirmation status": "Confirmation States.gtype"}
uses:
  NI::G Core::Error::Build Error Cluster.gvi
diagram:
  Property Node(instance in=$"MAC SAP TX CNF") -> ("Confirmation status"=w1)
  $"confirmation status" <- w1
  w2 = "Success"  # Confirmation States
  Is Equal(x=w2, y=w1) -> w3
  case (w3) {
    frame True {
      w4 = default
    }
    frame False {
      Format Into String(formatString="invalid confirmation status:\nreceived value: %s", w1) -> w5
      Type Cast(type=u8 0, x=w1) -> w6
      To Signed 32 Bit Integer(number=w6) -> w7
      call "Build Error Cluster.gvi"(code=w7, description=w5) -> (error out=w4)
    }
  }
  Merge Errors($"error in", w4) -> (error out=w8)
  $"error out" <- w8
