vi "Get MAC SAP TX CNF.gvi"   [LabVIEW NXG 4.0.0]
# Dequeues elements from the MAC SAP TX CNF message queue as long as they do not match the given message type ID and outputs the decoded MAC SAP TX CNF cluster.
inputs:
  "received MAC SAP TX CNF message queue": Queue<u8[]>  # Received MAC SAP TX CNF message queue reference.
  "timeout in milliseconds": i32 = -1  # Timeout for the dequeuing node in milliseconds.
  "error in": error
outputs:
  "MAC SAP TX CNF": "MAC SAP TX Confirmation.gtype"  # Decoded MAC SAP TX CNF cluster.
  "MAC SAP TX CNF message queue out": Queue<u8[]>  # MAC SAP TX CNF message queue reference.
  "error out": error
  "time out": bool  # Boolean output, which changes to TRUE if the dequeuing node exceeded the timeout value.
types:
  "General Message Header.gtype" = cluster{"message type ID": u16, "reference ID": u16, "instance ID": u8}
  "SAP Sub Header.gtype" = cluster{"timestamp": u32, "number of submessages": u8, "confirmation mode": bool}
  "Confirmation States.gtype" = enum{"Success", "Unknown Message", "Message not Supported", "Unknown Parameter (Set)", "Missing Parameter (Set)", "Parameter (Set) Repetition", "Range Violation", "State Violation", "Timeout", "Config Payload Mismatch", "Length Mismatch", "Input Buffer Full", "Internal Error", "Instance ID Mismatch"}
  "MAC SAP TX Confirmation.gtype" = cluster{"General Message Header": "General Message Header.gtype", "SAP Sub Header": "SAP Sub Header.gtype", "Confirmation status": "Confirmation States.gtype"}
uses:
  AFW::802_11::Transport::Decode General Message Header.gvi
  AFW::802_11::Transport::Decode MAC SAP TX Confirmation.gvi
diagram:
  while {
    Dequeue Element(error in=$"error in", queue=$"received MAC SAP TX CNF message queue", timeout in ms=$"timeout in milliseconds") -> (element=w1, error out=w2, queue out=w3, timed out?=w4)
    call "Decode General Message Header.gvi"(received general message header=w1) -> (decoded general message header=w5)
    Property Node(instance in=w5) -> ("message type ID"=w6)
    Is Equal(x=w6, y=0x5201) -> w7
    Logical Or(w7, w4) -> w8
    stop if w8
  }
  $"MAC SAP TX CNF message queue out" <- w3
  call "Decode MAC SAP TX Confirmation.gvi"(received MAC SAP TX confirmation=w1) -> (decoded MAC SAP TX confirmation=w9, error out=w10)
  $"MAC SAP TX CNF" <- w9
  $"time out" <- w4
  Merge Errors(w2, w10) -> (error out=w11)
  $"error out" <- w11
