vi "Check Duplication or Missing Parameter Set.gvi"   [LabVIEW NXG 4.0.0]
# Checks if one of sub-messages is repeated or missing.
inputs:
  "decoded submessages indices": u8[]  # Indices of sub-messages that have been decoded from SAP Sub-header.
  "number of submessages": u8 = 2  # Number of sub-messages which is the larger value either the expected number of sub-messages or the decoded number of sub-messages that have been decoded from SAP Sub-header.
outputs:
  "error out": error
uses:
  NI::G Core::Error::Build Error Cluster.gvi
diagram:
  To Signed 32 Bit Integer(number=$"number of submessages") -> w1
  for (N = w1) (iteration -> i1) {
    s1 = 0  # shift register
    for {
      w4 = each element of $"decoded submessages indices"
      Increment(x=s1) -> w5
      To Unsigned 8 Bit Integer(number=i1) -> w6
      Is Equal(x=w4, y=w6) -> w7
      Select(s=w7, t=w5, f=s1) -> w8
      next s1 = w8
    }
    Is Greater(x=s1, y=1) -> w9
    case (w9) {
      frame False, Default {
        w10 = default
      }
      frame True {
        Type Cast(type=u8 0, x="Parameter (Set) Repetition") -> w11
        To Signed 32 Bit Integer(number=w11) -> w12
        call "Build Error Cluster.gvi"(code=w12, description="invalid parameter set") -> (error out=w10)
      }
    }
    Is Equal To 0(x=s1) -> w13
    case (w13) {
      frame False, Default {
        w14 = default
      }
      frame True {
        Type Cast(type=u8 0, x="Missing Parameter (Set)") -> w15
        To Signed 32 Bit Integer(number=w15) -> w16
        call "Build Error Cluster.gvi"(code=w16, description="invalid parameter set") -> (error out=w14)
      }
    }
    append w10 to w2
    append w14 to w3
  }
  Merge Errors(w2, w3) -> (error out=w17)
  $"error out" <- w17
