vi "Generate MAC SAP TX Status Indication.gvi"   [LabVIEW NXG 4.0.0]
# Receives the MAC MSDU TX End IND from MAC Middle TX and reads out the oldest element from TX REQ CNF Reference Queue to determine the Reference ID for the MAC SAP TX STATUS IND. Then it generates the MAC SAP STATUS IND.
inputs:
  "FPGA interface": "FGPA Reference.gtype"  # Interface to the device's FPGA handle.
  "TX request confirmation reference queue in": Queue<"TX Request Confirmation Reference Parameters.gtype">  # Queue reference of TX request confirmation that stores clusters of two elements (reference ID and MSDU length)
  "instance ID": u8  # Instance ID of station.
  "error in": error
  "TX status and retransmission queue": Queue<"MAC TX End Indication.gtype">  # Queue ID reference of TX status indication that stores clusters of two elements ( TX status und number of retransmissions).
  "external mode": bool  # True if data source is external mode.
  "UDP send connection": UdpNetworkConnectionRefnum  # Reference to the UDP socket used to send the TX Status Indication message.
outputs:
  "num indications received": u32
  "error out": error
  "num indications triggered": u32
types:
  "TX Request Confirmation Reference Parameters.gtype" = cluster{"reference ID": u16, "MSDU length": u16}
  "TX Status.gtype" = enum{"MPDU transmitted", "MPDU discarded"}
  "MAC TX End Indication.gtype" = cluster{"TX status": "TX Status.gtype", "number of transmission tries": u16, "valid": bool}
uses:
  AFW::802_11::Transmission::Receive MAC MSDU TX end indication ICP.gvi
  AFW::802_11::Configuration::UDP Port Assignment.gvi
  AFW::802_11::Transport::Create MAC SAP TX Status Indication.gvi
  AFW::802_11::Transport::Encode MAC SAP TX Status Indication.gvi
diagram:
  call "Receive MAC MSDU TX end indication ICP.gvi"(FPGA interface=$"FPGA interface", error in=$"error in") -> (MAC MSDU TX end indications=w1, error out=w2)
  To Unsigned 16 Bit Integer(number=$"instance ID") -> w3
  call "UDP Port Assignment.gvi"(station number=w3, external mode=$"external mode") -> (local TX indications=w4)
  # Reads MAC MSDU TX end Indication from FPGA
  # If decoded correctly, create the MAC SAP TX Status Indication
  # If a valid signal is received from FPGA, the reference queue should already have elements
  s1 = w2  # shift register
  for {
    w5 = each element of w1
    Property Node(instance in=w5) -> ("valid"=w7, instance out=w8)
    # - Reads out the oldest element from the reference queue of TX REQ Confirmation
    # - Generates the MSDU SAP TX Status Indication
    case (w7) {
      frame False, Default {
        w9 = s1
      }
      frame True {
        Dequeue Element(error in=s1, queue=$"TX request confirmation reference queue in", timeout in ms=0) -> (element=w10, error out=w11)
        Enqueue Element(element=w8, error in=w11, queue=$"TX status and retransmission queue", timeout in ms=0) -> (error out=w12)
        Property Node(instance in=w10) -> ("reference ID"=w13)
        Property Node(instance in=w8) -> ("TX status"=w14)
        Is Equal(x="MPDU transmitted", y=w14) -> w15
        call "Create MAC SAP TX Status Indication.gvi"(instance ID=$"instance ID", reference ID=w13, MSDU transmission status=w15) -> (MAC SAP TX status indication=w16)
        call "Encode MAC SAP TX Status Indication.gvi"(MAC SAP TX status indication=w16) -> (encoded MAC SAP TX status indication=w17)
        # Write the encoded MAC SAP TX status indication.
        Udp Write Binary(address="127.0.0.1", connection ID=$"UDP send connection", data in=w17, error in=w12, port or service name=w4) -> (error out=w9)
      }
    }
    append TRUE to w6 if w7
    next s1 = w9
  }
  $"error out" <- s1
  Array Size(array=w6) -> (size(s)=w18)
  To Unsigned 32 Bit Integer(number=w18) -> w19
  Feedback Node(input=w20) -> w21
  Add(w19, w21) -> w20
  $"num indications triggered" <- w20
  Array Size(array=w1) -> (size(s)=w22)
  To Unsigned 32 Bit Integer(number=w22) -> w23
  Feedback Node(input=w24) -> w25
  Add(w23, w25) -> w24
  $"num indications received" <- w24
