vi "MAC SAP TX Request Confirmation Handler.gvi"   [LabVIEW NXG 4.0.0]
# Polls input queue for MAC SAP TX request message pairs and relies on/checks the specified message sequence (MAC SAP TX CONFIG REQ before MAC SAP TX PAYLOAD REQ). In addition, it decodes the received TX request messages and runs parameter and consistency checks. If checks fail, it generates a negative MAC SAP TX CNF messages. It prepares the MAC MSDU TX REQ and calls the MAC middle TX.
inputs:
  "FPGA interface": "FGPA Reference.gtype"  # Interface to the device's FPGA handle.
  "UDP connection TX request": UdpNetworkConnectionRefnum  # UDP reference of MAC SAP TX requests.
  "UDP send connection": UdpNetworkConnectionRefnum  # UDP interface to send out MAC SAP TX confirmation. May use arbritrary port as send port.
  "error in": error
  "TX request confirmation reference queue in": Queue<"TX Request Confirmation Reference Parameters.gtype">  # Queue reference that is used to store the reference ID and MSDU length.
  "external mode": bool  # True if data source is external mode.
  "instance ID": u8  # Instance ID of the corresponding station.
outputs:
  "error out": error
  "num packets to FPGA": u32
  "num TX Request": cluster{"Config": u32, "Payload": u32}
  "num TX Confirmation": cluster{"Config": u32, "Payload": u32}
  "num packets dropped": u32
types:
  "TX Request Confirmation Reference Parameters.gtype" = cluster{"reference ID": u16, "MSDU length": u16}
  "Confirmation States.gtype" = enum{"Success", "Unknown Message", "Message not Supported", "Unknown Parameter (Set)", "Missing Parameter (Set)", "Parameter (Set) Repetition", "Range Violation", "State Violation", "Timeout", "Config Payload Mismatch", "Length Mismatch", "Input Buffer Full", "Internal Error", "Instance ID Mismatch"}
uses:
  NI::G Core::Error::Filter Error Code.gvi
  AFW::802_11::Transport::Decode General Message Header.gvi
  AFW::802_11::MAC Middle SAP::Check Instance Identification.gvi
  AFW::802_11::MAC Middle SAP::Check Expected Message.gvi
  AFW::802_11::Configuration::UDP Port Assignment.gvi
  NI::G Core::Error::Is Error.gvi
  AFW::802_11::MAC Middle SAP::Send TX Confirmation.gvi
  AFW::802_11::Transport::Decode MAC SAP TX Configuration Request.gvi
  AFW::802_11::Transport::Decode MAC SAP TX Payload Request.gvi
  AFW::802_11::MAC Middle SAP::Check MAC SAP TX Configuration and Payload Consistency.gvi
  AFW::802_11::MAC Middle SAP::Parameter Sets Generation of MAC MSDU TX Request.gvi
  AFW::802_11::TX::MSDU Sequence Number Assignment.gvi
  AFW::802_11::Transmission::Send MAC MSDU TX Request ICP.gvi
  AFW::802_11::MAC Middle SAP::Write TX Request Reference Parameters to Queue.gvi
diagram:
  for (N = 100) {
    Udp Read I Pv 6 Binary(connection ID=$"UDP connection TX request", error in=$"error in", max size=0xFFFF, timeout ms=0) -> (connection ID out=w7, data out=w8, error out=w9)
    call "Filter Error Code.gvi"(code to clear=56, error in=w9) -> (error cleared?=w10, error out=w11)
    case (w10) {
      frame False, Default {
        call "Decode General Message Header.gvi"(received general message header=w8) -> (decoded general message header=w19)
        call "Check Instance Identification.gvi"(instance ID=$"instance ID", general message header=w19, error in=w11) -> (error out=w20)
        call "Check Expected Message.gvi"(general message header=w19, error in=w20, expected message=0x5101) -> (error out=w21)
        To Unsigned 16 Bit Integer(number=$"instance ID") -> w22
        call "UDP Port Assignment.gvi"(station number=w22, external mode=$"external mode") -> (local TX confirmations=w23)
        # Check if the local instance ID is not like the decoded instance ID.
        # Checks the received message ID, expected to be MAC SAP TX configuration Request
        call "Is Error.gvi"(error in=w21) -> (error?=w24)
        case (w24) {
          frame False, Default {
            Udp Read I Pv 6 Binary(connection ID=w7, error in=w21, max size=0xFFFF, timeout ms=100) -> (data out=w25, error out=w26)
            call "Filter Error Code.gvi"(code to clear=56, error in=w26) -> (error cleared?=w27, error out=w28)
            case (w27) {
              frame True {
                call "Filter Error Code.gvi"(code to clear=56, error in=w28) -> (error out=w29)
                # Error reading TX payload request
                call "Send TX Confirmation.gvi"(UDP connection in=$"UDP send connection", general message header=w19, confirmation status="Timeout", error in=w29, IP address="127.0.0.1", port=w23) -> (error out=w12)
                w13 = default
                w14 = TRUE
                w16 = FALSE
                w15 = TRUE
                w17 = FALSE
                w18 = default
              }
              frame False {
                call "Decode General Message Header.gvi"(received general message header=w25) -> (decoded general message header=w30)
                call "Check Instance Identification.gvi"(instance ID=$"instance ID", general message header=w30, error in=w28) -> (error out=w31)
                call "Check Expected Message.gvi"(general message header=w30, error in=w31, expected message=0x5102) -> (error out=w32)
                call "Is Error.gvi"(error in=w32) -> (error?=w33)
                # Checks the received message ID, expected to be MAC SAP TX Payload Request
                case (w33) {
                  frame False, Default {
                    Property Node(instance in=$"FPGA interface", error in=w32) -> ("device bandwidth"=w34, error out=w35, instance out=w36)
                    call "Decode MAC SAP TX Configuration Request.gvi"(received MAC SAP TX configuration request=w8, error in=w35, device bandwidth=w34) -> (decoded MAC SAP TX configuration request=w37, error out=w38)
                    call "Decode MAC SAP TX Payload Request.gvi"(received MAC SAP TX payload request=w25, error in=w32) -> (decoded MAC SAP TX payload request=w39, error out=w40)
                    call "Is Error.gvi"(error in=w40) -> (error?=w41)
                    call "Is Error.gvi"(error in=w38) -> (error?=w42)
                    Logical Or(w42, w41) -> w43
                    # Decodes the received MAC SAP TX and MAC SAP Payload Requests and checks if all parameters are valid.
                    case (w43) {
                      frame True {
                        Property Node(instance in=w40) -> ("code"=w44, instance out=w45)
                        To Unsigned 8 Bit Integer(number=w44) -> w46
                        Type Cast(type="Confirmation States.gtype" "Success", x=w46) -> w47
                        Select(s=w41, t=w47, f="State Violation") -> w48
                        call "Filter Error Code.gvi"(code to clear=w44, error in=w45) -> (error out=w49)
                        Property Node(instance in=w38) -> ("code"=w50, instance out=w51)
                        call "Filter Error Code.gvi"(code to clear=w50, error in=w51) -> (error out=w52)
                        Merge Errors(w52, w49) -> (error out=w53)
                        To Unsigned 8 Bit Integer(number=w50) -> w54
                        Type Cast(type="Confirmation States.gtype" "Success", x=w54) -> w55
                        Select(s=w42, t=w55, f="State Violation") -> w56
                        # Error decoding TX config and TX payload request
                        call "Send TX Confirmation.gvi"(UDP connection in=$"UDP send connection", general message header=w19, confirmation status=w56, error in=w53, IP address="127.0.0.1", port=w23) -> (connection out=w57, error out=w58)
                        # Send TX Confirmation messages for both MAC SAP TX configuration and MAC SAP TX payload requests
                        call "Send TX Confirmation.gvi"(UDP connection in=w57, general message header=w30, confirmation status=w48, error in=w58, IP address="127.0.0.1", port=w23) -> (error out=w12)
                        w13 = default
                        w14 = TRUE
                        w16 = TRUE
                        w15 = TRUE
                        w17 = TRUE
                        w18 = default
                      }
                      frame False {
                        Merge Errors(w38, w40) -> (error out=w59)
                        call "Check MAC SAP TX Configuration and Payload Consistency.gvi"(MAC SAP TX configuration request in=w37, MAC SAP TX payload request in=w39, error in=w59) -> (MAC SAP TX configuration request out=w60, MAC SAP TX payload request out=w61, error out=w62)
                        call "Is Error.gvi"(error in=w62) -> (error?=w63)
                        case (w63) {
                          frame False, Default {
                            call "Parameter Sets Generation of MAC MSDU TX Request.gvi"(MAC SAP TX configuration request in=w60, MAC SAP TX payload request in=w61, error in=w62) -> (MAC TX request out=w64, MSDU data out=w65, error out=w66)
                            call "MSDU Sequence Number Assignment.gvi"(MAC TX request input=w64, MSDU data input=w65, error in=w66) -> (MAC TX request output=w67, MSDU data output=w68, error out=w69)
                            call "Send MAC MSDU TX Request ICP.gvi"(FPGA interface=w36, MAC TX request in=w67, payload=w68, error in=w69) -> (buffer full=w18, error out=w70)
                            # Write TX Request Reference Parameters to Queue
                            case (w18) {
                              frame True {
                                # Error: input
                                # buffer full
                                w71 = w70
                                w72 = "Input Buffer Full"
                              }
                              frame False {
                                call "Write TX Request Reference Parameters to Queue.gvi"(TX request confirmation reference queue in=$"TX request confirmation reference queue in", general message header=w30, MAC TX request in=w67, error in=w70) -> (error out=w71)
                                w72 = "Success"
                              }
                            }
                            call "Send TX Confirmation.gvi"(UDP connection in=$"UDP send connection", general message header=w19, confirmation status=w72, error in=w71, IP address="127.0.0.1", port=w23) -> (error out=w73)
                            call "Send TX Confirmation.gvi"(UDP connection in=$"UDP send connection", general message header=w30, confirmation status=w72, error in=w73, IP address="127.0.0.1", port=w23) -> (error out=w12)
                            w14 = TRUE
                            w16 = TRUE
                            w15 = TRUE
                            w17 = TRUE
                          }
                          frame True {
                            # Error: MAC SAP TX Configuration and Payload not consistent
                            Property Node(instance in=w62) -> ("code"=w74, instance out=w75)
                            To Unsigned 8 Bit Integer(number=w74) -> w76
                            Type Cast(type="Confirmation States.gtype" "Success", x=w76) -> w77
                            call "Filter Error Code.gvi"(code to clear=w74, error in=w75) -> (error out=w78)
                            call "Send TX Confirmation.gvi"(UDP connection in=$"UDP send connection", general message header=w19, confirmation status=w77, error in=w78, IP address="127.0.0.1", port=w23) -> (connection out=w79, error out=w80)
                            call "Send TX Confirmation.gvi"(UDP connection in=w79, general message header=w30, confirmation status=w77, error in=w80, IP address="127.0.0.1", port=w23) -> (error out=w12)
                            w14 = TRUE
                            w16 = TRUE
                            w15 = TRUE
                            w17 = TRUE
                            w18 = default
                          }
                        }
                        Not(x=w63) -> w13
                      }
                    }
                  }
                  frame True {
                    Property Node(instance in=w32) -> ("code"=w81, instance out=w82)
                    To Unsigned 8 Bit Integer(number=w81) -> w83
                    # Send TX Confirmation messages for both MAC SAP TX configuration and MAC SAP TX payload requests
                    Type Cast(type="Confirmation States.gtype" "Success", x=w83) -> w84
                    call "Filter Error Code.gvi"(code to clear=w81, error in=w82) -> (error out=w85)
                    # Error decoding TX payload request header
                    call "Send TX Confirmation.gvi"(UDP connection in=$"UDP send connection", general message header=w19, confirmation status="State Violation", error in=w85, IP address="127.0.0.1", port=w23) -> (connection out=w86, error out=w87)
                    call "Send TX Confirmation.gvi"(UDP connection in=w86, general message header=w30, confirmation status=w84, error in=w87, IP address="127.0.0.1", port=w23) -> (error out=w12)
                    w13 = default
                    w14 = TRUE
                    w16 = TRUE
                    w15 = TRUE
                    w17 = TRUE
                    w18 = default
                  }
                }
              }
            }
          }
          frame True {
            Property Node(instance in=w21) -> ("code"=w88, instance out=w89)
            call "Filter Error Code.gvi"(code to clear=w88, error in=w89) -> (error out=w90)
            To Unsigned 8 Bit Integer(number=w88) -> w91
            Type Cast(type="Confirmation States.gtype" "Success", x=w91) -> w92
            # Error decoding TX config request header
            call "Send TX Confirmation.gvi"(UDP connection in=$"UDP send connection", general message header=w19, confirmation status=w92, error in=w90, IP address="127.0.0.1", port=w23) -> (error out=w12)
            w13 = default
            w14 = TRUE
            w16 = FALSE
            w15 = TRUE
            w17 = FALSE
            w18 = default
          }
        }
      }
      frame True {
        # Error reading TX config request
        w12 = w11
        w13 = default
        w14 = FALSE
        w15 = FALSE
        w16 = FALSE
        w17 = FALSE
        w18 = default
      }
    }
    append TRUE to w1 if w13
    append TRUE to w2 if w14
    append TRUE to w3 if w16
    append TRUE to w4 if w15
    append TRUE to w5 if w17
    append TRUE to w6 if w18
    stop if w10
  }
  Array Size(array=w2) -> (size(s)=w93)
  To Unsigned 32 Bit Integer(number=w93) -> w94
  Array Size(array=w3) -> (size(s)=w95)
  To Unsigned 32 Bit Integer(number=w95) -> w96
  Property Node(instance in=cluster{"Config": u32, "Payload": u32} {all zero or empty}, "Config"=w94, "Payload"=w96) -> (instance out=w97)
  Feedback Node(input=w98) -> w99
  Add(w97, w99) -> w98
  $"num TX Request" <- w98
  Array Size(array=w4) -> (size(s)=w100)
  To Unsigned 32 Bit Integer(number=w100) -> w101
  Array Size(array=w5) -> (size(s)=w102)
  To Unsigned 32 Bit Integer(number=w102) -> w103
  Property Node(instance in=cluster{"Config": u32, "Payload": u32} {all zero or empty}, "Config"=w101, "Payload"=w103) -> (instance out=w104)
  Feedback Node(input=w105) -> w106
  Add(w104, w106) -> w105
  $"num TX Confirmation" <- w105
  $"error out" <- w12
  Array Size(array=w6) -> (size(s)=w107)
  To Unsigned 32 Bit Integer(number=w107) -> w108
  Feedback Node(input=w109) -> w110
  Add(w108, w110) -> w109
  $"num packets dropped" <- w109
  Array Size(array=w1) -> (size(s)=w111)
  To Unsigned 32 Bit Integer(number=w111) -> w112
  Feedback Node(input=w113) -> w114
  Add(w112, w114) -> w113
  $"num packets to FPGA" <- w113
