vi "Parameter Sets Generation of MAC MSDU RX Indication.gvi"   [LabVIEW NXG 4.0.0]
# Maps the parameters from MAC MSDU RX IND to parameter sets required for the MAC SAP RX Indication pair. The MSDU RX indication message is mapped to the sub-messages of MAC SAP RX Indication, which has four sub-messages: MSDU RX parameters, PHY RX parameters, Additional MSDU RX parameters, and MAC RX status. The payload is mapped to MAC SAP RX Payload Indication message.
inputs:
  "MAC RX indication in": "MAC RX Indication.gtype"  # Consists MAC configuration information passed to the subsequent module in MAC RX chain: RX vector, RX status, MPDU configuration
  "MSDU data in": u8[]  # Received MSDU data after duplicate detection.
outputs:
  "MSDU RX parameters out": "MSDU TX Parameters.gtype"  # MSDU RX Parameters cluster.
  "PHY RX parameters out": "PHY TX Parameters.gtype"  # PHY RX Parameters cluster.
  "MSDU RX payload out": "MSDU TX Payload.gtype"  # MSDU RX Payload cluster.
  "MAC RX status out": "RX Status.gtype"  # MAC RX Status cluster.
  "additional MSDU RX parameters out": "Additional MSDU RX Parameters.gtype"  # Additional MSDU RX Parameters cluster.
types:
  "MSDU TX Payload.gtype" = cluster{"MSDU index": u8, "MSDU length": u16, "MSDU data": u8[]}
  "MAC Frame Type.gtype" = enum{"Management", "Control", "Data", "Extension"}
  "MSDU TX Parameters.gtype" = cluster{"MSDU index": u8, "frame type": "MAC Frame Type.gtype", "subtype": u8, "to DS": bool, "from DS": bool, "power management": u8, "more data": u8, "protected frame": u8, "HTC / order": u8, "source address": u8[6], "destination address": u8[6], "basic service set identifier": u8[6], "recipient address": u8[6], "transmitter address": u8[6], "MSDU length": u16}
  "A-MPDU De-Aggregation Status.gtype" = enum{"A-MPDU De-Aggregation not executed", "A-MPDU De-Aggregation successful", "PSDU length mismatch", "VHT delimiter CRC fail", "VHT delimiter signature comparison fail", "EOF field check fail", "MPDU length mismatch"}
  "FCS Check Status.gtype" = enum{"FCS check not executed", "FCS check pass", "FCS check fail"}
  "MPDU Length Check Status.gtype" = enum{"MPDU length check not executed", "MPDU length check pass", "MPDU length check not standard compliant", "MPDU length check exceeds implemented buffer"}
  "MPDU Disassembly Status.gtype" = enum{"Disassembly not executed", "Disassembly successful", "Disassembly done partially", "Disassembly not successful"}
  "MPDU Filtering Status.gtype" = enum{"MPDU Filtering not executed", "MPDU valid for further processing", "MPDU pass through for sniffer mode"}
  "MSDU Defragmentation Status.gtype" = enum{"Defragmentation not executed", "Unfragmented MSDU successfully received", "Unsupported MSDU fragment received"}
  "MSDU Duplicate Detection Status.gtype" = enum{"Duplicate detection not executed", "Duplicate detection successfully passed", "Duplicate detected"}
  "RX Status.gtype" = cluster{"A-MPDU de-aggregation status": "A-MPDU De-Aggregation Status.gtype", "MPDU FCS check status": "FCS Check Status.gtype", "MPDU length check status": "MPDU Length Check Status.gtype", "MPDU disassembly status": "MPDU Disassembly Status.gtype", "MPDU Filtering Status": "MPDU Filtering Status.gtype", "MSDU Defragmentation Status": "MSDU Defragmentation Status.gtype", "MSDU Duplicate Detection Status": "MSDU Duplicate Detection Status.gtype"}
  "PHY Frame Format.gtype" = enum{"NON_HT_OFDM", "VHT", "NON_HT_DUP_OFDM"}
  "Bandwidth.gtype" = enum{"20 MHz", "40 MHz", "80 MHz"}
  "PHY TX Parameters.gtype" = cluster{"MSDU index": u8, "format": "PHY Frame Format.gtype", "bandwidth": "Bandwidth.gtype", "MCS": u8}
  "Additional MSDU RX Parameters.gtype" = cluster{"retry flag": bool}
  "Non HT Bandwidth.gtype" = enum{"20 MHz", "40 MHz", "80 MHz", "160 MHz"}
  "RX Vector.gtype" = cluster{"format": "PHY Frame Format.gtype", "bandwidth": "Bandwidth.gtype", "PSDU length": u32, "MCS": UFXP(4.0), "non HT bandwidth": "Non HT Bandwidth.gtype", "dynamic bandwidth support": bool}
  "MPDU Configuration.gtype" = cluster{"frame control": "MAC Header Frame Control.gtype", "header contents": "MAC Header Contents.gtype", "parameters": "MPDU Parameters.gtype"}
  "MAC RX Indication.gtype" = cluster{"RX vector": "RX Vector.gtype", "RX status": "RX Status.gtype", "MPDU configuration": "MPDU Configuration.gtype", "valid": bool}
diagram:
  # MSDU index to associate the MSDU data contained in the MAC SAP RX Payload Indication to the corresponding configuration sub-messages contained in the MAC SAP RX CONFIG IND
  Feedback Node(initial value=0, input=w1) -> w2
  Increment(x=w2) -> w1
  Property Node(instance in=$"MAC RX indication in") -> ("RX vector"=w3, "MPDU configuration"=w4, "RX status"=w5)
  Property Node(instance in=w3) -> ("format"=w6, "bandwidth"=w7, "MCS"=w8)
  To Unsigned 8 Bit Integer(number=w8) -> w9
  Property Node(instance in="PHY TX Parameters.gtype" {all zero or empty}, "MSDU index"=w2, "format"=w6, "bandwidth"=w7, "MCS"=w9) -> (instance out=w10)
  # MAC SAP RX Configuration Indication has four sub-messages:
  # - MSDU RX parameters
  # - PHY RX parameters
  # - Additional MSDU RX parameters
  # - MAC RX status
  $"PHY RX parameters out" <- w10
  Property Node(instance in=w4) -> ("frame control"=w11, "header contents"=w12, "parameters"=w13)
  Property Node(instance in=w11) -> ("type"=w14, "subtype"=w15, "to DS"=w16, "from DS"=w17, "power management"=w18, "more data"=w19, "protected frame"=w20, "HTC / order"=w21, "retry"=w22)
  Property Node(instance in=w12) -> ("source address"=w23, "destination address"=w24, "basic service set identifier"=w25, "recipient address"=w26, "transmitter address"=w27)
  Property Node(instance in=w13) -> ("MSDU length"=w28)
  To Unsigned 8 Bit Integer(number=w15) -> w29
  To Unsigned 8 Bit Integer(number=w14) -> w30
  Type Cast(type="MAC Frame Type.gtype" "Management", x=w30) -> w31
  Boolean To 0 Or 1(Boolean=w18) -> (0, 1=w32)
  To Unsigned 8 Bit Integer(number=w32) -> w33
  Boolean To 0 Or 1(Boolean=w19) -> (0, 1=w34)
  To Unsigned 8 Bit Integer(number=w34) -> w35
  Boolean To 0 Or 1(Boolean=w20) -> (0, 1=w36)
  To Unsigned 8 Bit Integer(number=w36) -> w37
  Boolean To 0 Or 1(Boolean=w21) -> (0, 1=w38)
  To Unsigned 8 Bit Integer(number=w38) -> w39
  Property Node(instance in="MSDU TX Parameters.gtype" {all zero or empty}, "MSDU index"=w2, "frame type"=w31, "subtype"=w29, "to DS"=w16, "from DS"=w17, "power management"=w33, "more data"=w35, "protected frame"=w37, "HTC / order"=w39, "source address"=w23, "destination address"=w24, "basic service set identifier"=w25, "recipient address"=w26, "transmitter address"=w27, "MSDU length"=w28) -> (instance out=w40)
  $"MSDU RX parameters out" <- w40
  Property Node(instance in="Additional MSDU RX Parameters.gtype" {all zero or empty}, "retry flag"=w22) -> (instance out=w41)
  $"additional MSDU RX parameters out" <- w41
  Property Node(instance in=w5) -> ("A-MPDU de-aggregation status"=w42, "MPDU FCS check status"=w43, "MPDU length check status"=w44, "MPDU disassembly status"=w45, "MPDU Filtering Status"=w46, "MSDU Defragmentation Status"=w47, "MSDU Duplicate Detection Status"=w48)
  Property Node(instance in="RX Status.gtype" {all zero or empty}, "A-MPDU de-aggregation status"=w42, "MPDU FCS check status"=w43, "MPDU length check status"=w44, "MPDU disassembly status"=w45, "MPDU Filtering Status"=w46, "MSDU Defragmentation Status"=w47, "MSDU Duplicate Detection Status"=w48) -> (instance out=w49)
  $"MAC RX status out" <- w49
  Property Node(instance in="MSDU TX Payload.gtype" {all zero or empty}, "MSDU index"=w2, "MSDU length"=w28, "MSDU data"=$"MSDU data in") -> (instance out=w50)
  # MAC SAP RX Payload Indication has one sub-message:
  # - MAC RX payload
  $"MSDU RX payload out" <- w50
