vi "Parameter Sets Generation of MAC MSDU TX Request.gvi"   [LabVIEW NXG 4.0.0]
# Maps the parameters of MAC SAP TX Request (MAC SAP TX configuration request and MAC SAP TX payload request
# ) to the MAC TX request cluster. and get the MSDU data.
inputs:
  "MAC SAP TX configuration request in": "MAC SAP TX Configuration Request.gtype"  # MAC SAP TX configuration request.
  "MAC SAP TX payload request in": "MAC SAP TX Payload Request.gtype"  # MAC SAP TX payload request message.
  "error in": error
outputs:
  "MAC TX request out": "MAC TX Request.gtype"  # Created MAC TX request cluster to be transferred to MAC TX middle. ·
  "MSDU data out": u8[]  # Payload to be transferred to the target MAC TX.
  "error out": error
types:
  "General Message Header.gtype" = cluster{"message type ID": u16, "reference ID": u16, "instance ID": u8}
  "SAP Sub Header.gtype" = cluster{"timestamp": u32, "number of submessages": u8, "confirmation mode": bool}
  "MAC Frame Type.gtype" = enum{"Management", "Control", "Data", "Extension"}
  "MSDU TX Parameters.gtype" = cluster{"MSDU index": u8, "frame type": "MAC Frame Type.gtype", "subtype": u8, "to DS": bool, "from DS": bool, "power management": u8, "more data": u8, "protected frame": u8, "HTC / order": u8, "source address": u8[6], "destination address": u8[6], "basic service set identifier": u8[6], "recipient address": u8[6], "transmitter address": u8[6], "MSDU length": u16}
  "PHY Frame Format.gtype" = enum{"NON_HT_OFDM", "VHT", "NON_HT_DUP_OFDM"}
  "Bandwidth.gtype" = enum{"20 MHz", "40 MHz", "80 MHz"}
  "PHY TX Parameters.gtype" = cluster{"MSDU index": u8, "format": "PHY Frame Format.gtype", "bandwidth": "Bandwidth.gtype", "MCS": u8}
  "MAC SAP TX Configuration Request.gtype" = cluster{"General Message Header": "General Message Header.gtype", "SAP Sub Header": "SAP Sub Header.gtype", "MSDU TX Parameters": "MSDU TX Parameters.gtype", "PHY TX Parameters": "PHY TX Parameters.gtype"}
  "MSDU TX Payload.gtype" = cluster{"MSDU index": u8, "MSDU length": u16, "MSDU data": u8[]}
  "MAC SAP TX Payload Request.gtype" = cluster{"General Message Header": "General Message Header.gtype", "SAP Sub Header": "SAP Sub Header.gtype", "MSDU TX Payload": "MSDU TX Payload.gtype"}
  "MPDU Configuration.gtype" = cluster{"frame control": "MAC Header Frame Control.gtype", "header contents": "MAC Header Contents.gtype", "parameters": "MPDU Parameters.gtype"}
  "TX Vector.gtype" = cluster{"format": "PHY Frame Format.gtype", "bandwidth": "Bandwidth.gtype", "PSDU length": u32, "(A-)MPDU length": u32, "MCS": UFXP(4.0)}
  "MAC TX Request.gtype" = cluster{"MPDU configuration": "MPDU Configuration.gtype", "TX vector": "TX Vector.gtype", "valid": bool}
  "MAC Header Frame Control.gtype" = cluster{"protocol version": UFXP(2.0), "type": UFXP(2.0), "subtype": UFXP(4.0), "to DS": bool, "from DS": bool, "more fragments": bool, "retry": bool, "power management": bool, "more data": bool, "protected frame": bool, "HTC / order": bool}
  "MAC Header Contents.gtype" = cluster{"duration": u16, "source address": u8[6], "destination address": u8[6], "basic service set identifier": u8[6], "recipient address": u8[6], "transmitter address": u8[6], "sequence number": UFXP(12.0), "fragment number": UFXP(4.0), "QoS control": u16, "HT control": u32}
  "Frame Sequence Type.gtype" = enum{"RTS | CTS | DATA | ACK", "DATA | ACK", "DATA"}
  "MPDU Parameters.gtype" = cluster{"MSDU length": u16, "MPDU frame body length": u16, "MPDU length": u16, "sequence type": "Frame Sequence Type.gtype"}
uses:
  AFW::802_11::MAC Middle SAP::Determine Recipient Address and Transmitter Address.gvi
diagram:
  Property Node(instance in=$"MAC SAP TX configuration request in") -> ("MSDU TX Parameters"=w1, "PHY TX Parameters"=w2)
  Property Node(instance in=w2) -> ("format"=w3, "bandwidth"=w4, "MCS"=w5)
  To Fixed Point(fixed-point type=UFXP(4.0) 0, number=w5) -> w6
  Property Node(instance in="TX Vector.gtype" {all zero or empty}, "format"=w3, "bandwidth"=w4, "MCS"=w6) -> (instance out=w7)
  Property Node(instance in=w1) -> ("frame type"=w8, "subtype"=w9, "to DS"=w10, "from DS"=w11, "power management"=w12, "more data"=w13, "protected frame"=w14, "HTC / order"=w15, "source address"=w16, "destination address"=w17, "basic service set identifier"=w18, "MSDU length"=w19)
  Type Cast(type=u8 0, x=w8) -> w20
  To Fixed Point(fixed-point type=UFXP(2.0) 0, number=w20) -> w21
  Type Cast(type=u8 0, x=w9) -> w22
  To Fixed Point(fixed-point type=UFXP(4.0) 0, number=w22) -> w23
  Is Not Equal To 0(x=w12) -> w24
  Is Not Equal To 0(x=w13) -> w25
  Is Not Equal To 0(x=w14) -> w26
  Is Not Equal To 0(x=w15) -> w27
  Property Node(instance in="MAC Header Frame Control.gtype" {all zero or empty}, "type"=w21, "subtype"=w23, "to DS"=w10, "from DS"=w11, "power management"=w24, "more data"=w25, "protected frame"=w26, "HTC / order"=w27) -> (instance out=w28)
  call "Determine Recipient Address and Transmitter Address.gvi"(MSDU TX parameters=w1) -> (recipient address=w29, transmitter address=w30)
  Property Node(instance in="MAC Header Contents.gtype" {all zero or empty}, "source address"=w16, "destination address"=w17, "basic service set identifier"=w18, "recipient address"=w29, "transmitter address"=w30) -> (instance out=w31)
  Property Node(instance in="MPDU Parameters.gtype" {all zero or empty}, "MSDU length"=w19) -> (instance out=w32)
  Property Node(instance in="MPDU Configuration.gtype" {all zero or empty}, "frame control"=w28, "header contents"=w31, "parameters"=w32) -> (instance out=w33)
  Property Node(instance in="MAC TX Request.gtype" {all zero or empty}, "MPDU configuration"=w33, "TX vector"=w7, "valid"=TRUE) -> (instance out=w34)
  $"MAC TX request out" <- w34
  Property Node(instance in=$"MAC SAP TX payload request in") -> ("MSDU TX Payload:MSDU data"=w35)
  $"MSDU data out" <- w35
  $"error out" <- $"error in"
