vi "Check for Frame Exclusion from Duplicate Detection.gvi"   [LabVIEW NXG 4.0.0]
# Checks for frames which are excluded from duplicate detection and RX cache updates. Those are:
# -        –
# If the frame type is
# Management (00b) AND subtype is
# ATIM (
# 1001b).
# -       –  If the recipient address (RA)  is a group address and not individual address.
inputs:
  "MAC RX indication in": "MAC RX Indication.gtype"  # Consists MAC configuration information passed to the subsequent module in MAC RX chain: RX vector, RX status, MPDU configuration
outputs:
  "MAC RX indication out": "MAC RX Indication.gtype"  # Consists MAC configuration information passed to the subsequent module in MAC RX chain: RX vector, RX status, MPDU configuration
  "is excluded frame from duplicate detection": bool  # Valid signal if the frame will be excluded from the duplicate detection process and RX cache update.
  "is a group address": bool  # Valid signal if the recipient address (RA) address is a group address and not individual address.
  "is a frame type management ATIM": bool  # Valid signal if the frame type is Management (00b) AND subtype is ATIM (1001b).
types:
  "PHY Frame Format.gtype" = enum{"NON_HT_OFDM", "VHT", "NON_HT_DUP_OFDM"}
  "Bandwidth.gtype" = enum{"20 MHz", "40 MHz", "80 MHz"}
  "Non HT Bandwidth.gtype" = enum{"20 MHz", "40 MHz", "80 MHz", "160 MHz"}
  "RX Vector.gtype" = cluster{"format": "PHY Frame Format.gtype", "bandwidth": "Bandwidth.gtype", "PSDU length": u32, "MCS": UFXP(4.0), "non HT bandwidth": "Non HT Bandwidth.gtype", "dynamic bandwidth support": bool}
  "A-MPDU De-Aggregation Status.gtype" = enum{"A-MPDU De-Aggregation not executed", "A-MPDU De-Aggregation successful", "PSDU length mismatch", "VHT delimiter CRC fail", "VHT delimiter signature comparison fail", "EOF field check fail", "MPDU length mismatch"}
  "FCS Check Status.gtype" = enum{"FCS check not executed", "FCS check pass", "FCS check fail"}
  "MPDU Length Check Status.gtype" = enum{"MPDU length check not executed", "MPDU length check pass", "MPDU length check not standard compliant", "MPDU length check exceeds implemented buffer"}
  "MPDU Disassembly Status.gtype" = enum{"Disassembly not executed", "Disassembly successful", "Disassembly done partially", "Disassembly not successful"}
  "MPDU Filtering Status.gtype" = enum{"MPDU Filtering not executed", "MPDU valid for further processing", "MPDU pass through for sniffer mode"}
  "MSDU Defragmentation Status.gtype" = enum{"Defragmentation not executed", "Unfragmented MSDU successfully received", "Unsupported MSDU fragment received"}
  "MSDU Duplicate Detection Status.gtype" = enum{"Duplicate detection not executed", "Duplicate detection successfully passed", "Duplicate detected"}
  "RX Status.gtype" = cluster{"A-MPDU de-aggregation status": "A-MPDU De-Aggregation Status.gtype", "MPDU FCS check status": "FCS Check Status.gtype", "MPDU length check status": "MPDU Length Check Status.gtype", "MPDU disassembly status": "MPDU Disassembly Status.gtype", "MPDU Filtering Status": "MPDU Filtering Status.gtype", "MSDU Defragmentation Status": "MSDU Defragmentation Status.gtype", "MSDU Duplicate Detection Status": "MSDU Duplicate Detection Status.gtype"}
  "MPDU Configuration.gtype" = cluster{"frame control": "MAC Header Frame Control.gtype", "header contents": "MAC Header Contents.gtype", "parameters": "MPDU Parameters.gtype"}
  "MAC RX Indication.gtype" = cluster{"RX vector": "RX Vector.gtype", "RX status": "RX Status.gtype", "MPDU configuration": "MPDU Configuration.gtype", "valid": bool}
uses:
  AFW::802_11::Conversion::Frame Type and Subtype to Description.gvi
  AFW::802_11::RX::MAC Group Address Evaluation.gvi
diagram:
  # Task: Check for frames which are excluded from duplicate detection and RX cache updates
  # - If ( frame type == 00b (Management) AND subtype == 1001b (ATIM) )
  # - OR  (recipient address (RA) is group address )
  Property Node(instance in=$"MAC RX indication in") -> ("MPDU configuration:frame control:type"=w1, "MPDU configuration:frame control:subtype"=w2, "MPDU configuration:header contents:recipient address"=w3, instance out=w4)
  $"MAC RX indication out" <- w4
  call "Frame Type and Subtype to Description.gvi"(field type=w1, field subtype=w2) -> (frame type description=w5, frame subtype description=w6)
  Is Equal[ComparisonMode=CompareAggregates](x=w5, y="Management") -> w7
  Is Equal[ComparisonMode=CompareAggregates](x=w6, y="ATIM") -> w8
  Logical And(w7, w8) -> w9
  $"is a frame type management ATIM" <- w9
  # Check if recipient address (RA) is group address.
  call "MAC Group Address Evaluation.gvi"(MAC address=w3) -> (is a group address=w10)
  Logical Or(w9, w10) -> w11
  $"is excluded frame from duplicate detection" <- w11
  $"is a group address" <- w10
