vi "FPGA AGC Control.gvi"   [LabVIEW NXG 4.0.0]
# Enables or disables AGC gain on target based on the AGC Boolean control if it is enabled or disabled and the initialization control status. It forces the application to use the manual gain value when the value of initialization control changes while the AGC is disabled or if the AGC is switched off. See 802.11 Gain Control.gvi.
inputs:
  "session": "Host Session.gtype"
    # Cluster containing all references the host uses during runtime. This cluster includes the following components:
    # FPGA interface: empty reference to the FPGA handle; needs to be cast each time it is used.
    # FlexRIO session: handle to the FlexRIO device. This component is valid only with FlexRIO devices.
    # FlexRIO TX Characterization Data: This component is valid only with FlexRIO sessions.
    # FlexRIO RX Characterization Data: This component is valid only with FlexRIO sessions.
    # USRP session: handle to the USRP device, including charaterization data. This component is valid only with USRP.
    # stop queue: handle to queue used to coordinate host shutdown between the loops.
    # send queue: handle to queue used to buffer TX packets to the target.
    # receive queue: handle to queue used to buffer RX packets from the target.
    # receive throughput queue: handle to queue used to buffer information about received RX packets (time and transferred bytes).
    # UDP receiver: handle to a UPD socket used to receive payload from outside the host.
    # PN packet: byte array used to stream payload inside the host.
  "error in": error
  "AGC": bool = TRUE  # Enables or disables the automatic gain control.
  "RX Port (USRP only)": T1 = "RX2/RF 1"  # RF port used for the receiver (USRP only).
  "initialize": bool  # Forces application of the manual gain value which is otherwise only applied when the value changes.
outputs:
  "session dup": "Host Session.gtype"
    # Cluster containing all references the host uses during runtime. This cluster includes the following components:
    # FPGA interface: empty reference to the FPGA handle; needs to be cast each time it is used.
    # FlexRIO session: handle to the FlexRIO device. This component is valid only with FlexRIO devices.
    # FlexRIO TX Characterization Data: This component is valid only with FlexRIO sessions.
    # FlexRIO RX Characterization Data: This component is valid only with FlexRIO sessions.
    # USRP session: handle to the USRP device, including charaterization data. This component is valid only with USRP.
    # stop queue: handle to queue used to coordinate host shutdown between the loops.
    # send queue: handle to queue used to buffer TX packets to the target.
    # receive queue: handle to queue used to buffer RX packets from the target.
    # receive throughput queue: handle to queue used to buffer information about received RX packets (time and transferred bytes).
    # UDP receiver: handle to a UPD socket used to receive payload from outside the host.
    # PN packet: byte array used to stream payload inside the host.
  "error out": error
  "force host AGC update": bool  # Forces application of the manual gain value which is otherwise only applied when the value changes.
types:
  T1 = enum{"RX1/RF 0", "RX2/RF 0", "RX1/RF 1", "RX2/RF 1"}
  T2 = cluster{"Timestamp": u32, "Transferred Bytes": u32}
  T3 = cluster{"fpga ref": any, "bus instance": u32, "instruction FIFO depth": u32, "executing on FPGA target": bool, "show error call chain": bool}
  T4 = cluster{"Actual Gain [dB]": f64, "Attenuation Table Index": i32}
  T5 = cluster{"Attenuation Table [dB]": f64[][], "Frequencies [Hz]": f64[], "IQ Imbalance Table": "IQ Imbalance.gtype"[], "Gain Table": T4[][]}
  "Register Bus Session.gtype" = Queue<"Session Data.gtype">
  "Semaphore.gtype" = i32
  "DB Queue Reference.gtype" = Queue<"Daughterboard Data.gtype">
  "niUsrpRio Session.gtype" = cluster{"FPGA Interface": any, "RIO Interface Number": u32, "Data Clock Rate": u32, "FPGA Data Clock Rate": u32, "Global Settings Register Bus": "Register Bus Session.gtype", "Radio 0 Settings Register Bus": "Register Bus Session.gtype", "Radio 1 Settings Register Bus": "Register Bus Session.gtype", "Radio Settings Bus Semaphore": "Semaphore.gtype", "DB Queues": "DB Queue Reference.gtype"[], "Characterization Data Valid?": bool, "EEPROM Header": "EEPROM Header.gtype", "Device Data Header": "EEPROM Device Data Header.gtype", "EEPROM Characterization Header": "EEPROM Characterization Header.gtype", "Characterization Data": "Characterization Data.gtype"[], "FPGA Current Version": u32, "FPGA Oldest Compatible Version": u32, "Fixed Logic Current Version": u32, "Fixed Logic Oldest Compatible Version": u32, "FPGA Radio Settings Bus Current Version": u32, "FPGA Radio Settings Bus Oldest Compatible Version": u32, "FPGA Board Config Current Version": u32, "FPGA Board Config Oldest Compatible Version": u32, "Daughterboard Clock Rate": u32}
  "Host Session.gtype" = cluster{"station number": u16, "FPGA interface": "FGPA Reference.gtype", "MAC High Requests": Queue<u8[]>, "MAC High Confirmations": Queue<u8[]>, "Triggered TX Requests": Queue<"TX Request Confirmation Reference Parameters.gtype">, "receive queue": Queue<u8[]>, "receive throughput queue": Queue<T2>, "UDP Receiver": UdpNetworkConnectionRefnum, "PN packet": u8[], "FlexRIO session": Queue<T3>, "FlexRIO TX Characterization Data": T5, "FlexRIO RX Characterization Data": T5, "USRP session": "niUsrpRio Session.gtype", "RF loop clock frequency": f64, "UDP Receiver TX Request": UdpNetworkConnectionRefnum, "UDP Receiver TX Confirmation": UdpNetworkConnectionRefnum, "UDP Receiver RX Indication": UdpNetworkConnectionRefnum, "UDP Sender": UdpNetworkConnectionRefnum}
uses:
  AFW::802_11::RF Control::Apply RX Gain.gvi
diagram:
  Logical And($initialize, not $AGC) -> w1
  # w2: init with AGC
  # enabled
  Feedback Node(initial value=FALSE, input=$AGC) -> w3
  # w4: AGC switched off
  # w1: init with AGC
  # disabled
  Logical And(w3, not $AGC) -> w4
  Logical Or(w4, w1) -> w5
  Logical And($initialize, $AGC) -> w2
  Logical And(not w3, $AGC) -> w6
  Logical Or(w2, w6) -> w7
  # enable target AGC
  # w6: AGC switched on
  case (w7) {
    frame False, Default {
      w8 = $"error in"
      w9 = $session
    }
    frame True {
      # set to maximum gain
      call "Apply RX Gain.gvi"(session=$session, RX gain=100, error in=$"error in", RX port=$"RX Port (USRP only)") -> (session dup=w10, coerced RX gain=w11, error out=w12)
      sequence {
        frame 0 {
          Wait(time to wait=10)
        }
      }
      # enable target based AGC
      # wait until RX gain is set
      # (register bus done)
      Property Node(instance in=w10) -> ("FPGA interface"=w13, instance out=w9)
      w14 = 31.5  # target AGC range
      Subtract(x=w11, y=w14) -> w15
      To Fixed Point(number=w15) -> w16: UFXP(5.1) Saturate:ConvergentRounding
      Property Node(instance in=w13, "AGC gain offset"=w16, "enable AGC"=TRUE, error in=w12) -> (error out=w8)
    }
  }
  # disable target AGC
  case (w5) {
    frame False, Default {
      w17 = w8
      w18 = w9
      w19 = FALSE
    }
    frame True {
      Property Node(instance in=w9) -> ("FPGA interface"=w20, instance out=w18)
      Property Node(instance in=w20, "enable AGC"=FALSE, error in=w8) -> (error out=w17)
      sequence {
        frame 0 {
          Wait(time to wait=10)
        }
      }
      w19 = TRUE
    }
  }
  $"force host AGC update" <- w19
  $"session dup" <- w18
  $"error out" <- w17
