vi "Gain Control.gvi"   [LabVIEW NXG 4.0.0]
# Controls the RX gain setting. You can either apply a manual gain, or you can configure and enable the automatic gain control.
inputs:
  "initialize": bool  # Forces application of the manual gain value which is otherwise only applied when the value changes.
  "RX Port (USRP only)": T1 = "RX2/RF 1"  # RF port used for the receiver (USPR only).
  "session": "Host Session.gtype"
    # Cluster containing all references the host uses during runtime. This cluster includes the following components:
    # FPGA interface: empty reference to the FPGA handle; needs to be cast each time it is used.
    # FlexRIO session: handle to the FlexRIO device. This component is valid only with FlexRIO devices.
    # FlexRIO TX Characterization Data: This component is valid only with FlexRIO sessions.
    # FlexRIO RX Characterization Data: This component is valid only with FlexRIO sessions.
    # USRP session: handle to the USRP device, including charaterization data. This component is valid only with USRP.
    # stop queue: handle to queue used to coordinate host shutdown between the loops.
    # send queue: handle to queue used to buffer TX packets to the target.
    # receive queue: handle to queue used to buffer RX packets from the target.
    # receive throughput queue: handle to queue used to buffer information about received RX packets (time and transferred bytes).
    # UDP receiver: handle to a UPD socket used to receive payload from outside the host.
    # PN packet: byte array used to stream payload inside the host.
  "AGC": bool = TRUE  # Enables or disables the automatic gain control.
  "error in": error
  "Manual RX gain [dB]": f64 = 37.5  # Manual RX gain level that is applied if you disable the automatic gain control.
  "force update": bool  # Forces application of the manual gain value which is otherwise only applied when the value changes.
outputs:
  "Applied RX Gain [dB]": f64  # Applied gain value, which is either the coerced gain value after applying the manual gain, or the reported AGC gain read from the FPGA.
  "error out": error
types:
  T1 = enum{"RX1/RF 0", "RX2/RF 0", "RX1/RF 1", "RX2/RF 1"}
  T2 = cluster{"Timestamp": u32, "Transferred Bytes": u32}
  T3 = cluster{"fpga ref": any, "bus instance": u32, "instruction FIFO depth": u32, "executing on FPGA target": bool, "show error call chain": bool}
  T4 = cluster{"Actual Gain [dB]": f64, "Attenuation Table Index": i32}
  T5 = cluster{"Attenuation Table [dB]": f64[][], "Frequencies [Hz]": f64[], "IQ Imbalance Table": "IQ Imbalance.gtype"[], "Gain Table": T4[][]}
  "Register Bus Session.gtype" = Queue<"Session Data.gtype">
  "Semaphore.gtype" = i32
  "DB Queue Reference.gtype" = Queue<"Daughterboard Data.gtype">
  "niUsrpRio Session.gtype" = cluster{"FPGA Interface": any, "RIO Interface Number": u32, "Data Clock Rate": u32, "FPGA Data Clock Rate": u32, "Global Settings Register Bus": "Register Bus Session.gtype", "Radio 0 Settings Register Bus": "Register Bus Session.gtype", "Radio 1 Settings Register Bus": "Register Bus Session.gtype", "Radio Settings Bus Semaphore": "Semaphore.gtype", "DB Queues": "DB Queue Reference.gtype"[], "Characterization Data Valid?": bool, "EEPROM Header": "EEPROM Header.gtype", "Device Data Header": "EEPROM Device Data Header.gtype", "EEPROM Characterization Header": "EEPROM Characterization Header.gtype", "Characterization Data": "Characterization Data.gtype"[], "FPGA Current Version": u32, "FPGA Oldest Compatible Version": u32, "Fixed Logic Current Version": u32, "Fixed Logic Oldest Compatible Version": u32, "FPGA Radio Settings Bus Current Version": u32, "FPGA Radio Settings Bus Oldest Compatible Version": u32, "FPGA Board Config Current Version": u32, "FPGA Board Config Oldest Compatible Version": u32, "Daughterboard Clock Rate": u32}
  "Host Session.gtype" = cluster{"station number": u16, "FPGA interface": "FGPA Reference.gtype", "MAC High Requests": Queue<u8[]>, "MAC High Confirmations": Queue<u8[]>, "Triggered TX Requests": Queue<"TX Request Confirmation Reference Parameters.gtype">, "receive queue": Queue<u8[]>, "receive throughput queue": Queue<T2>, "UDP Receiver": UdpNetworkConnectionRefnum, "PN packet": u8[], "FlexRIO session": Queue<T3>, "FlexRIO TX Characterization Data": T5, "FlexRIO RX Characterization Data": T5, "USRP session": "niUsrpRio Session.gtype", "RF loop clock frequency": f64, "UDP Receiver TX Request": UdpNetworkConnectionRefnum, "UDP Receiver TX Confirmation": UdpNetworkConnectionRefnum, "UDP Receiver RX Indication": UdpNetworkConnectionRefnum, "UDP Sender": UdpNetworkConnectionRefnum}
uses:
  AFW::802_11::RF Control::Apply RX Gain.gvi
diagram:
  Property Node(instance in=$session) -> ("FPGA interface"=w1)
  Logical And(not $AGC, $initialize) -> w2
  Is Not Equal(x=$"Manual RX gain [dB]", y=$"Applied RX Gain [dB]") -> w3
  Logical And(w3, not $AGC) -> w4
  Logical Or(w4, w2, $"force update") -> w5
  case (w5) {
    frame False {
      w6 = $"error in"
      w7 = $"Manual RX gain [dB]"
    }
    frame True {
      call "Apply RX Gain.gvi"(session=$session, RX gain=$"Manual RX gain [dB]", error in=$"error in", RX port=$"RX Port (USRP only)") -> (coerced RX gain=w7, error out=w8)
      To Fixed Point(number=w7) -> w9: FXP(10.3) Saturate:ConvergentRounding
      Property Node(instance in=w1, "RF gain"=w9, error in=w8) -> (error out=w6)
    }
  }
  case ($AGC) {
    frame False, Default {
      w10 = w6
      w11 = w7
    }
    frame True {
      Property Node(instance in=w1, error in=w6) -> ("last applied gain"=w12, error out=w10)
      To Double Precision Float(number=w12) -> w11
    }
  }
  $"error out" <- w10
  $"Applied RX Gain [dB]" <- w11
