vi "MAC Group Address Evaluation.gvi"   [LabVIEW NXG 4.0.0]
# Determines whether a MAC address is a group address or an individual address.
inputs:
  "MAC address": u8[6]  # Given MAC Address that contains 6 octets (48 bit).
outputs:
  "is a group address": bool  # Valid signal. It is true if the given MAC address is a group address else it is false.
  "is a local administrated address": bool  # Valid signal. It is true if the given MAC address is a local administrated address.
diagram:
  # To determine whether a MAC address is a group address or an individual address
  # Ref. Sources: 9.2.4.3
  # [1] 	IEEE, "Part 11: Wireless LAN Medium Access Control (MAC) and Physical Layer (PHY) Specifications," 2016.
  # [2] 	IEEE, "Standard Group MAC Addresses: A Tutorial Guide," [Online]. Available: http://standards.ieee.org/develop/regauth/tut/macgrp.pdf.
  Array Index(array=$"MAC address") -> (out0[0]=w1)
  Number To Boolean Array(number=w1) -> (Boolean array=w2)
  Array Index(array=w2) -> (out0[0]=w3, out1[1]=w4)
  $"is a group address" <- w3
  # Procedure:
  # A MAC address contains 6 octets (48 bit)
  # The least significant bit of the first octet is the “Individual/Group address bit”
  # Steps:
  # - Extract the first address octet
  # - Extract the least significant bit of this octet (“LSB”)
  # - 	If LSB == 1, set Is a group address = TRUE
  # - 	If LSB == 0, set Is a group address = FALSE
  $"is a local administrated address" <- w4
