vi "Read BB Data.gvi"   [LabVIEW NXG 4.0.0]
inputs:
  "file path": path
  "fpga ref": "FGPA Reference.gtype"
  "error in": error
outputs:
  "error out": error
  "ref out": ByteStreamFileRefnum
panel indicators:
  "number": u32[]
  "empty elements remaining": u32
  "x + yi": CFXP(3.13)[]
uses:
  NI::G Core::Strings::Delimited String to 1D String Array.gvi
diagram:
  Read From Text File(file (use dialog)=$"file path") -> (refnum out=w1, text=w2)
  call "Delimited String to 1D String Array.gvi"(delimited string=w2, delimiter=" ") -> (string array=w3)
  Hexadecimal String To Number(string=w3) -> (number=w4)
  Split Number(x=w4) -> (high(x)=w5, low(x)=w6)
  To Signed 16 Bit Integer(number=w6) -> w7
  Reinterpret Number[RestrictToSameWordLength=True](data in=w7, type=FXP(3.13) 0) -> (data out=w8)
  To Signed 16 Bit Integer(number=w5) -> w9
  Reinterpret Number[RestrictToSameWordLength=True](data in=w9, type=FXP(3.13) 0) -> (data out=w10)
  Real And Imaginary To Complex(x=w8, y=w10) -> w11
  $"x + yi" <- w11
  $"ref out" <- w1
  $number <- w4
  Host Fifo Write Node[FifoName="AFW::802_11::Resources::802.11 AFW Resources.grsc::H2T RX Baseband"](data=w4, error in=$"error in", reference in=$"fpga ref", timeout (ms)=-1) -> (empty elements remaining=w12, error out=w13)
  $"empty elements remaining" <- w12
  $"error out" <- w13
