vi "Read BB Data_test.gvi"   [LabVIEW NXG 4.0.0]
inputs:
  "file path": path
panel indicators:
  "number": u32[]
  "x + yi": CFXP(3.13)[]
uses:
  NI::G Core::Strings::Delimited String to 1D String Array.gvi
diagram:
  Read From Text File(file (use dialog)=$"file path") -> (text=w1)
  call "Delimited String to 1D String Array.gvi"(delimited string=w1, delimiter=" ") -> (string array=w2)
  Hexadecimal String To Number(string=w2) -> (number=w3)
  Split Number(x=w3) -> (high(x)=w4, low(x)=w5)
  To Signed 16 Bit Integer(number=w5) -> w6
  Reinterpret Number[RestrictToSameWordLength=True](data in=w6, type=FXP(3.13) 0) -> (data out=w7)
  To Signed 16 Bit Integer(number=w4) -> w8
  Reinterpret Number[RestrictToSameWordLength=True](data in=w8, type=FXP(3.13) 0) -> (data out=w9)
  Real And Imaginary To Complex(x=w7, y=w9) -> w10
  $"x + yi" <- w10
  $number <- w3
