vi "Receive UDP Data.gvi"   [LabVIEW NXG 4.0.0]
# Reads UDP packets from the socket and puts them into the send queue. The content of the send queue is transferred to the target TX.
inputs:
  "UDP receiver": UdpNetworkConnectionRefnum  # Reference to the local UDP socket.
  "send queue": Queue<u8[]>  # Queue to store the packet for the target transmitter.
  "error in": error
outputs:
  "data transfer": bool  # Indicates that a UDP packet was received and queued for the transmitter.
  "error out": error
  "FIFO full": bool  # Indicates that the UDP packets were lost due to socket buffer overflow. Increase buffer size with setsocketopt (refer to 802.11commonCommon_v1_0HostSet Socket Option.gvi for more information).
  "num packets": u32
uses:
  NI::G Core::Error::Legacy::Clear Errors.gvi
diagram:
  Is Not A Number Or Path Or Refnum(number=$"UDP receiver") -> w1
  case (w1) {
    frame True {
      w2 = $"error in"
      w3 = default
      w4 = default
      w5 = default
    }
    frame False {
      s1 = $"error in"  # shift register
      for (N = 100) {
        Udp Read I Pv 6 Binary(connection ID=$"UDP receiver", error in=s1, max size=4061, timeout ms=0) -> (data out=w8, error out=w9)
        call "Clear Errors.gvi"(specific error code to clear=56, error in=w9) -> (specific error cleared?=w10, error out=w11)
        Not(x=w10) -> w12
        case (w10) {
          frame True {
            w13 = w11
          }
          frame False {
            Enqueue Element(element=w8, error in=w11, queue=$"send queue", timeout in ms=-1) -> (error out=w13)
          }
        }
        call "Clear Errors.gvi"(specific error code to clear=113, error in=w13) -> (specific error cleared?=w14, error out=w15)
        call "Clear Errors.gvi"(specific error code to clear=66, error in=w15) -> (error out=w16)
        # w10: timeout
        call "Clear Errors.gvi"(specific error code to clear=1, error in=w16) -> (error out=w17)
        append w14 to w6
        append w12 to w7
        next s1 = w17
        stop if w10
      }
      Or Array Elements(Boolean array=w6) -> (logical OR=w4)
      Or Array Elements(Boolean array=w7) -> (logical OR=w3)
      Boolean To 0 Or 1(Boolean=w7) -> (0, 1=w18)
      To Unsigned 32 Bit Integer(number=w18) -> w19
      Add Array Elements(numeric array=w19) -> (sum=w5)
      w2 = s1
    }
  }
  $"FIFO full" <- w4
  $"data transfer" <- w3
  $"num packets" <- w5
  $"error out" <- w2
