vi "Send MAC MSDU TX Request ICP.gvi"   [LabVIEW NXG 4.0.0]
# Receives the payload and MAC TX request and serializes it into interface communication protocol (ICP) packets. The encoded ICP packets are transmitted to the target TX using the TX Data DMA FIFO.
inputs:
  "FPGA interface": "FGPA Reference.gtype"  # Interface to the device's FPGA handle.
  "MAC TX request in": "MAC TX Request.gtype"  # TX request configuration cluster to be sent to the target MAC TX.
  "error in": error
  "payload": u8[]  # Payload to be transferred to the target MAC TX.
outputs:
  "buffer full": bool  # Indicates that the payload was not forwarded to TX Data DMA FIFO because the FIFO was full.
  "error out": error
  "FPGA interface dup": "FGPA Reference.gtype"  # Interface to the device's FPGA handle.
types:
  "MPDU Configuration.gtype" = cluster{"frame control": "MAC Header Frame Control.gtype", "header contents": "MAC Header Contents.gtype", "parameters": "MPDU Parameters.gtype"}
  "PHY Frame Format.gtype" = enum{"NON_HT_OFDM", "VHT", "NON_HT_DUP_OFDM"}
  "Bandwidth.gtype" = enum{"20 MHz", "40 MHz", "80 MHz"}
  "TX Vector.gtype" = cluster{"format": "PHY Frame Format.gtype", "bandwidth": "Bandwidth.gtype", "PSDU length": u32, "(A-)MPDU length": u32, "MCS": UFXP(4.0)}
  "MAC TX Request.gtype" = cluster{"MPDU configuration": "MPDU Configuration.gtype", "TX vector": "TX Vector.gtype", "valid": bool}
uses:
  AFW::802_11::Conversion::MAC TX Request::MAC TX Request to Byte Array.gvi
  AFW::802_11::ICP::Encode ICP.gvi
  NI::G Core::Error::Filter Error Code.gvi
diagram:
  call "MAC TX Request to Byte Array.gvi"(MAC TX request in=$"MAC TX request in") -> (array=w1)
  call "Encode ICP.gvi"(message=w1, payload=$payload) -> (ICP message=w2)
  Host Fifo Write Node[FifoName="AFW::802_11::Resources::802.11 AFW Resources.grsc::H2T TX Data"](data=w2, error in=$"error in", reference in=$"FPGA interface", timeout (ms)=0) -> (error out=w3, reference out=w4)
  $"FPGA interface dup" <- w4
  call "Filter Error Code.gvi"(code to clear=-50400, error in=w3) -> (error cleared?=w5, error out=w6)
  $"error out" <- w6
  $"buffer full" <- w5
