vi "Send UDP Data.gvi"   [LabVIEW NXG 4.0.0]
# Forwards the payload received from the target RX to a specified UDP port.
inputs:
  "target port": u16 = 12346  # UDP port to send the payload to.
  "target IP address": string = "127.0.0.1"  # IP address to send the payload to.
  "receive queue": Queue<u8[]>  # Queue the payload will be read from.
  "UDP sender": UdpNetworkConnectionRefnum  # Reference to the UDP socket used to send the payload.
  "enable": bool  # If False, the RX data is still read from the RX Data DMA FIFO, but is not forwarded to the specified UDP address/port combination.
  "error in": error
outputs:
  "DNS resolve failed": bool
  "FIFO full": bool  # Indicates that the socket buffer of the UDP sender was too small to receive all of the payload from the RX Data DMA FIFO, so packets were dropped. Increase the socket buffer size.
  "error out": error
  "UDP sender dup": UdpNetworkConnectionRefnum  # Reference to the UDP socket used to send the payload.
  "data transfer": bool  # Indicates that packets were successfully read from the DMA FIFO and forwarded to the UDP.
  "num packets": u32
uses:
  NI::G Core::Error::Legacy::Clear Errors.gvi
diagram:
  Flush Queue(error in=$"error in", queue=$"receive queue") -> (error out=w1, remaining elements=w2)
  case ($enable) {
    frame True {
      String To Ip Address(name=$"target IP address") -> (net address=w8)
      Is Equal To 0(x=w8) -> w7
      Select(s=w7, t=cluster{"Element 0": u8[]}[] [], f=w2) -> w9
      Is Empty Array(array=w9) -> w10
      Not(x=w10) -> w5
      s1 = w1  # shift register
      s2 = $"UDP sender"  # shift register
      for {
        w11 = each element of w9
        Property Node(instance in=w11) -> ("Element 0"=w12)
        Udp Write Binary(address=w8, connection ID=s2, data in=w12, error in=s1, port or service name=$"target port", timeout ms=10) -> (connection ID out=w13, error out=w14)
        call "Clear Errors.gvi"(specific error code to clear=1, error in=w14) -> (error out=w15)
        call "Clear Errors.gvi"(specific error code to clear=55, error in=w15) -> (specific error cleared?=w16, error out=w17)
        append w16 to w4
        next s1 = w17
        next s2 = w13
        stop if w16
      }
      w3 = s1
      w6 = s2
    }
    frame False {
      w3 = w1
      w4 = default
      w5 = default
      w6 = $"UDP sender"
      w7 = default
    }
  }
  $"data transfer" <- w5
  $"UDP sender dup" <- w6
  Or Array Elements(Boolean array=w4) -> (logical OR=w18)
  $"FIFO full" <- w18
  $"error out" <- w3
  $"DNS resolve failed" <- w7
  Array Size(array=w2) -> (size(s)=w19)
  To Unsigned 32 Bit Integer(number=w19) -> w20
  $"num packets" <- w20
