vi "Check General Message Header.gvi"   [LabVIEW NXG 4.0.0]
# Reads the received General Message Header and checks if the received message type ID and message body length match the expected ones.
inputs:
  "received general message header": "General Message Header.gtype"  # Received General Message Header cluster to be read out.
  "expected message ID": u16  # Expected message ID (U16) to be initialized by upper level VI.
  "check minimal size": bool  # If this input is TRUE, this node checks if the received message body length is greater than the minimal one (for PAYLOAD messages). Otherwise it checks if the received message body length is equal to the received one.
  "received message body length": u32  # Expected message body length (U24) to be initialized by Decode General Message Header.
  "expected message body length": u32  # Expected message body length (U24) to be initialized by upper level VI.
outputs:
  "error out": error
  "valid message type ID": bool  # Valid signal if message type ID is valid.
  "valid message body length": bool  # Valid signal if message body length is valid.
types:
  "General Message Header.gtype" = cluster{"message type ID": u16, "reference ID": u16, "instance ID": u8}
uses:
  NI::G Core::Error::Build Error Cluster.gvi
diagram:
  Property Node(instance in=$"received general message header") -> ("message type ID"=w1)
  Is Equal(x=w1, y=$"expected message ID") -> w2
  $"valid message type ID" <- w2
  case (w2) {
    frame True {
      w3 = default
    }
    frame False {
      Format Into String(formatString="mismatch: message type ID\nreceived: %d, expected %d", w1, $"expected message ID") -> w4
      Type Cast(type=u8 0, x="State Violation") -> w5
      To Signed 32 Bit Integer(number=w5) -> w6
      call "Build Error Cluster.gvi"(code=w6, description=w4) -> (error out=w3)
    }
  }
  case ($"check minimal size") {
    frame True {
      Is Greater Or Equal(x=$"received message body length", y=$"expected message body length") -> w7
    }
    frame False {
      Is Equal(x=$"received message body length", y=$"expected message body length") -> w7
    }
  }
  case (w7) {
    frame True {
      w8 = default
    }
    frame False {
      Format Into String(formatString="mismatch: message body length received: %d, expected %d", $"received message body length", $"expected message body length") -> w9
      Type Cast(type=u8 0, x="Length Mismatch") -> w10
      To Signed 32 Bit Integer(number=w10) -> w11
      call "Build Error Cluster.gvi"(code=w11, description=w9) -> (error out=w8)
    }
  }
  Merge Errors(w3, w8) -> (error out=w12)
  $"error out" <- w12
  $"valid message body length" <- w7
