vi "Check SAP Sub Header.gvi"   [LabVIEW NXG 4.0.0]
# Reads the received SAP Sub Header and checks if the received number of submessages, confirmation mode and reserved field match the expected ones.
inputs:
  "received SAP sub header": "SAP Sub Header.gtype"  # Received SAP Sub Header cluster to be read out.
  "expected number of submessages": u8  # Expected number of submessages (U8) to be initialized by upper level node.
  "received message type ID": u16  # Received message type ID (U8) to be used for the confirmation mode check.
  "received reserved field": u16  # Received reserved field (U16) to be initialized by Decode SAP Sub Header.
outputs:
  "error out": error
  "valid number of submessages": bool  # Valid signal if number of sub-messages is correct.
  "valid confirm mode": bool  # Valid signal if number of confirm mode is correct.
types:
  "SAP Sub Header.gtype" = cluster{"timestamp": u32, "number of submessages": u8, "confirmation mode": bool}
uses:
  NI::G Core::Error::Build Error Cluster.gvi
diagram:
  Property Node(instance in=$"received SAP sub header") -> ("number of submessages"=w1, "confirmation mode"=w2)
  Is Equal(x=w1, y=$"expected number of submessages") -> w3
  $"valid number of submessages" <- w3
  Number To Boolean Array(number=$"received message type ID") -> (Boolean array=w4)
  Array Subset(array=w4, index0=8, length0=2) -> w5
  Boolean Array To Number(Boolean array=w5) -> (number=w6)
  case (w6) {
    frame 0, Default {
      w7 = FALSE
    }
    frame 1 {
      w7 = TRUE
    }
  }
  Is Equal(x=w2, y=w7) -> w8
  $"valid confirm mode" <- w8
  case (w8) {
    frame True {
      w9 = default
    }
    frame False {
      Format Into String(formatString="mismatch: confirmation mode\nreceived: %d, expected %d", w2, w7) -> w10
      Type Cast(type=u8 0, x="Range Violation") -> w11
      To Signed 32 Bit Integer(number=w11) -> w12
      call "Build Error Cluster.gvi"(code=w12, description=w10) -> (error out=w9)
    }
  }
  case (w3) {
    frame True {
      w13 = default
    }
    frame False {
      Format Into String(formatString="mismatch: number of submessages\nreceived: %d, expected %d", w1, $"expected number of submessages") -> w14
      Type Cast(type=u8 0, x="Range Violation") -> w15
      To Signed 32 Bit Integer(number=w15) -> w16
      call "Build Error Cluster.gvi"(code=w16, description=w14) -> (error out=w13)
    }
  }
  Is Equal(x=$"received reserved field", y=0) -> w17
  case (w17) {
    frame True {
      w18 = default
    }
    frame False {
      Format Into String(formatString="mismatch: reserved\nreceived: %d, expected %d", $"received reserved field", 0) -> w19
      call "Build Error Cluster.gvi"(code=-1, description=w19) -> (error out=w18)
    }
  }
  Merge Errors(w13, w9, w18) -> (error out=w20)
  $"error out" <- w20
