vi "Check Sub Message Header.gvi"   [LabVIEW NXG 4.0.0]
# Checks the received parameters in the sub-message header if they are outside the supported range. Those are sub-message type and parameter set body length.
inputs:
  "parameter submessage header": u8[]  # Parameter sub message header as 1D array of 4 bytes.
  "maximal submessage type": u8  # Maximal value of sub-message type.
  "supported parameter set body length": T1[] = [{"parameter set body length"=4, "minimal size"=TRUE}]  # Cluster containing the minimal value (minimal = TRUE) or the exact value (minimal = FALSE) of the parameter set body length.
outputs:
  "error out": error
  "submessage type": u8  # Received sub-message type.
  "parameter set body length": u16  # Received parameter set body length.
types:
  T1 = cluster{"parameter set body length": u16, "minimal size": bool}
uses:
  NI::G Core::Error::Build Error Cluster.gvi
diagram:
  Array Index(array=$"parameter submessage header") -> (out0[_]=w1, out2[_]=w2, out3[_]=w3)
  $"submessage type" <- w1
  # w1: submessage type
  # w4: parameter set body length
  Join Numbers(high(x)=w2, low(x)=w3) -> w4
  $"parameter set body length" <- w4
  Is Less Or Equal(x=w1, y=$"maximal submessage type") -> w5
  case (w5) {
    frame True {
      w6 = default
    }
    frame False {
      w7 = "submessage type is not identified\nreceived value: %d. The expected value should be less than: %d"
      Format Into String(initString=w7, w1, $"maximal submessage type") -> w8
      Type Cast(type=u8 0, x="Range Violation") -> w9
      To Signed 32 Bit Integer(number=w9) -> w10
      call "Build Error Cluster.gvi"(code=w10, description=w8) -> (error out=w6)
    }
  }
  To Signed 32 Bit Integer(number=w1) -> w11
  Array Index(array=$"supported parameter set body length") -> (out0[w11]=w12)
  Property Node(instance in=w12) -> ("minimal size"=w13, "parameter set body length"=w14)
  Is Greater Or Equal(x=w4, y=w14) -> w15
  Is Equal(x=w14, y=w4) -> w16
  Select(s=w13, t=w15, f=w16) -> w17
  case (w17) {
    frame True {
      w18 = default
    }
    frame False {
      case (w13) {
        frame False, Default {
          w19 = "mismatch: parameter set body length: %d, expected: %d"
        }
        frame True {
          w20 = "parameter set body length below minimal size\nreceived: %d, minimum: %d"
          w19 = w20
        }
      }
      Format Into String(formatString=w19, w14, w4) -> w21
      Type Cast(type=u8 0, x="Length Mismatch") -> w22
      To Signed 32 Bit Integer(number=w22) -> w23
      call "Build Error Cluster.gvi"(code=w23, description=w21) -> (error out=w18)
    }
  }
  Merge Errors(w6, w18) -> (error out=w24)
  $"error out" <- w24
