vi "Create MAC SAP RX Payload Indication.gvi"   [LabVIEW NXG 4.0.0]
# Generates the MAC SAP RX Payload Indication message using the MSDU RX Payload submessage.
inputs:
  "MSDU RX payload": "MSDU TX Payload.gtype"  # MSDU RX Payload cluster.
  "instance ID": u8  # Instance ID (U8) input.
outputs:
  "MAC SAP RX payload indication": "MAC SAP RX Payload Indication.gtype"  # Initialized MAC SAP RX Payload Indication cluster.
types:
  "MSDU TX Payload.gtype" = cluster{"MSDU index": u8, "MSDU length": u16, "MSDU data": u8[]}
  "General Message Header.gtype" = cluster{"message type ID": u16, "reference ID": u16, "instance ID": u8}
  "SAP Sub Header.gtype" = cluster{"timestamp": u32, "number of submessages": u8, "confirmation mode": bool}
  "MAC SAP RX Payload Indication.gtype" = cluster{"General Message Header": "General Message Header.gtype", "SAP Sub Header": "SAP Sub Header.gtype", "MSDU RX Payload": "MSDU TX Payload.gtype"}
uses:
  AFW::802_11::Transport::Create Timestamp.gvi
diagram:
  call "Create Timestamp.gvi"() -> (timestamp=w1)
  Feedback Node(initial value=0, input=w2) -> w3
  Property Node(instance in="MAC SAP RX Payload Indication.gtype" {all zero or empty}, "General Message Header:message type ID"=0x5082, "General Message Header:instance ID"=$"instance ID", "General Message Header:reference ID"=w3, "SAP Sub Header:timestamp"=w1, "SAP Sub Header:number of submessages"=1, "SAP Sub Header:confirmation mode"=FALSE, "MSDU RX Payload"=$"MSDU RX payload") -> (instance out=w4)
  $"MAC SAP RX payload indication" <- w4
  Increment(x=w3) -> w2
