vi "Create MAC SAP TX Configuration Request.gvi"   [LabVIEW NXG 4.0.0]
# Creates the MAC SAP TX Configuration Request cluster from the given parameters and sub clusters.
inputs:
  "MSDU TX parameters": "MSDU TX Parameters.gtype"  # Required MSDU TX parameters for MAC SAP TX CONFIG REQ cluster creation.
  "PHY TX parameters": "PHY TX Parameters.gtype"  # Required PHY TX parameters for MAC SAP TX CONFIG REQ cluster creation.
  "instance ID": u8  # Instance identifier.
outputs:
  "MAC SAP TX configuration request": "MAC SAP TX Configuration Request.gtype"  # Created MAC SAP TX Configuration Request cluster.
types:
  "MAC Frame Type.gtype" = enum{"Management", "Control", "Data", "Extension"}
  "MSDU TX Parameters.gtype" = cluster{"MSDU index": u8, "frame type": "MAC Frame Type.gtype", "subtype": u8, "to DS": bool, "from DS": bool, "power management": u8, "more data": u8, "protected frame": u8, "HTC / order": u8, "source address": u8[6], "destination address": u8[6], "basic service set identifier": u8[6], "recipient address": u8[6], "transmitter address": u8[6], "MSDU length": u16}
  "PHY Frame Format.gtype" = enum{"NON_HT_OFDM", "VHT", "NON_HT_DUP_OFDM"}
  "Bandwidth.gtype" = enum{"20 MHz", "40 MHz", "80 MHz"}
  "PHY TX Parameters.gtype" = cluster{"MSDU index": u8, "format": "PHY Frame Format.gtype", "bandwidth": "Bandwidth.gtype", "MCS": u8}
  "General Message Header.gtype" = cluster{"message type ID": u16, "reference ID": u16, "instance ID": u8}
  "SAP Sub Header.gtype" = cluster{"timestamp": u32, "number of submessages": u8, "confirmation mode": bool}
  "MAC SAP TX Configuration Request.gtype" = cluster{"General Message Header": "General Message Header.gtype", "SAP Sub Header": "SAP Sub Header.gtype", "MSDU TX Parameters": "MSDU TX Parameters.gtype", "PHY TX Parameters": "PHY TX Parameters.gtype"}
uses:
  AFW::802_11::Transport::Create Timestamp.gvi
diagram:
  w1 = 0x5101  # message type ID
  w2 = 2  # number of submessages
  w3 = TRUE  # confirmation mode
  call "Create Timestamp.gvi"() -> (timestamp=w4)
  Feedback Node(initial value=0, input=w5) -> w6
  Property Node(instance in="MAC SAP TX Configuration Request.gtype" {all zero or empty}, "General Message Header:message type ID"=w1, "General Message Header:instance ID"=$"instance ID", "General Message Header:reference ID"=w6, "SAP Sub Header:timestamp"=w4, "SAP Sub Header:number of submessages"=w2, "SAP Sub Header:confirmation mode"=w3, "MSDU TX Parameters"=$"MSDU TX parameters", "PHY TX Parameters"=$"PHY TX parameters") -> (instance out=w7)
  $"MAC SAP TX configuration request" <- w7
  # Number of submessages is 2, a MAC SAP TX CONFIG REQ must always contain the 2 mandatory parameter sets
  # - MSDU TX parameters
  # - PHY TX parameters
  Increment(x=w6) -> w5
