vi "Create MAC SAP TX Payload Request.gvi"   [LabVIEW NXG 4.0.0]
# Creates the MAC SAP TX Payload Request cluster from the given parameters and sub clusters.
inputs:
  "MSDU TX payload": "MSDU TX Payload.gtype"  # Required MSDU TX payload parameters for MAC SAP TX PAYLOAD REQ cluster creation.
  "instance ID": u8  # Instance identifier.
outputs:
  "MAC SAP TX payload request": "MAC SAP TX Payload Request.gtype"  # Created MAC SAP TX Payload Request cluster.
types:
  "General Message Header.gtype" = cluster{"message type ID": u16, "reference ID": u16, "instance ID": u8}
  "SAP Sub Header.gtype" = cluster{"timestamp": u32, "number of submessages": u8, "confirmation mode": bool}
  "MSDU TX Payload.gtype" = cluster{"MSDU index": u8, "MSDU length": u16, "MSDU data": u8[]}
  "MAC SAP TX Payload Request.gtype" = cluster{"General Message Header": "General Message Header.gtype", "SAP Sub Header": "SAP Sub Header.gtype", "MSDU TX Payload": "MSDU TX Payload.gtype"}
uses:
  AFW::802_11::Transport::Create Timestamp.gvi
diagram:
  w1 = 0x5102  # message type ID
  w2 = 1  # number of submessages
  w3 = TRUE  # confirmation mode
  call "Create Timestamp.gvi"() -> (timestamp=w4)
  Feedback Node(initial value=0, input=w5) -> w6
  Property Node(instance in="MAC SAP TX Payload Request.gtype" {all zero or empty}, "General Message Header:message type ID"=w1, "General Message Header:instance ID"=$"instance ID", "General Message Header:reference ID"=w6, "SAP Sub Header:timestamp"=w4, "SAP Sub Header:number of submessages"=w2, "SAP Sub Header:confirmation mode"=w3, "MSDU TX Payload"=$"MSDU TX payload") -> (instance out=w7)
  $"MAC SAP TX payload request" <- w7
  # Number of Submessages is 1, in AFW 2.1 one MAC SAP TX PAYLOAD REQ mandatorily contains exactly one MSDU TX payload sub-message providing the payload for a single MSDU only
  Increment(x=w6) -> w5
