vi "Decode MAC SAP RX Configuration Indication.gvi"   [LabVIEW NXG 4.0.0]
# Decodes the 1D array (in bytes) of received MAC SAP RX Configuration Indication to the corresponding cluster. It also checks if the General Message, SAP Sub and Sub-message Header are correct.
inputs:
  "received MAC SAP RX configuration indication": u8[]  # Received MAC SAP RX Configuration Indication in 1D array of U8.
  "device bandwidth": u16  # Instantaneous device bandwidth
outputs:
  "decoded MAC SAP RX configuration indication": "MAC SAP RX Configuration Indication.gtype"  # Decoded MAC SAP RX Configuration Indication cluster.
  "error out": error
types:
  "General Message Header.gtype" = cluster{"message type ID": u16, "reference ID": u16, "instance ID": u8}
  "SAP Sub Header.gtype" = cluster{"timestamp": u32, "number of submessages": u8, "confirmation mode": bool}
  "MAC Frame Type.gtype" = enum{"Management", "Control", "Data", "Extension"}
  "MSDU TX Parameters.gtype" = cluster{"MSDU index": u8, "frame type": "MAC Frame Type.gtype", "subtype": u8, "to DS": bool, "from DS": bool, "power management": u8, "more data": u8, "protected frame": u8, "HTC / order": u8, "source address": u8[6], "destination address": u8[6], "basic service set identifier": u8[6], "recipient address": u8[6], "transmitter address": u8[6], "MSDU length": u16}
  "PHY Frame Format.gtype" = enum{"NON_HT_OFDM", "VHT", "NON_HT_DUP_OFDM"}
  "Bandwidth.gtype" = enum{"20 MHz", "40 MHz", "80 MHz"}
  "PHY TX Parameters.gtype" = cluster{"MSDU index": u8, "format": "PHY Frame Format.gtype", "bandwidth": "Bandwidth.gtype", "MCS": u8}
  "Additional MSDU RX Parameters.gtype" = cluster{"retry flag": bool}
  "A-MPDU De-Aggregation Status.gtype" = enum{"A-MPDU De-Aggregation not executed", "A-MPDU De-Aggregation successful", "PSDU length mismatch", "VHT delimiter CRC fail", "VHT delimiter signature comparison fail", "EOF field check fail", "MPDU length mismatch"}
  "FCS Check Status.gtype" = enum{"FCS check not executed", "FCS check pass", "FCS check fail"}
  "MPDU Length Check Status.gtype" = enum{"MPDU length check not executed", "MPDU length check pass", "MPDU length check not standard compliant", "MPDU length check exceeds implemented buffer"}
  "MPDU Disassembly Status.gtype" = enum{"Disassembly not executed", "Disassembly successful", "Disassembly done partially", "Disassembly not successful"}
  "MPDU Filtering Status.gtype" = enum{"MPDU Filtering not executed", "MPDU valid for further processing", "MPDU pass through for sniffer mode"}
  "MSDU Defragmentation Status.gtype" = enum{"Defragmentation not executed", "Unfragmented MSDU successfully received", "Unsupported MSDU fragment received"}
  "MSDU Duplicate Detection Status.gtype" = enum{"Duplicate detection not executed", "Duplicate detection successfully passed", "Duplicate detected"}
  "RX Status.gtype" = cluster{"A-MPDU de-aggregation status": "A-MPDU De-Aggregation Status.gtype", "MPDU FCS check status": "FCS Check Status.gtype", "MPDU length check status": "MPDU Length Check Status.gtype", "MPDU disassembly status": "MPDU Disassembly Status.gtype", "MPDU Filtering Status": "MPDU Filtering Status.gtype", "MSDU Defragmentation Status": "MSDU Defragmentation Status.gtype", "MSDU Duplicate Detection Status": "MSDU Duplicate Detection Status.gtype"}
  "MAC SAP RX Configuration Indication.gtype" = cluster{"General Message Header": "General Message Header.gtype", "SAP Sub Header": "SAP Sub Header.gtype", "MSDU RX Parameters": "MSDU TX Parameters.gtype", "PHY RX Parameters": "PHY TX Parameters.gtype", "Additional MSDU RX Parameters": "Additional MSDU RX Parameters.gtype", "MAC RX Status": "RX Status.gtype"}
uses:
  AFW::802_11::Transport::Decode General Message Header.gvi
  AFW::802_11::Transport::Decode SAP Sub Header.gvi
  AFW::802_11::Transport::Check Sub Message Header.gvi
  AFW::802_11::Transport::Decode MSDU TX Parameters.gvi
  AFW::802_11::Transport::Decode PHY TX Parameters.gvi
  AFW::802_11::Transport::Decode RX Status.gvi
  NI::G Core::Error::Build Error Cluster.gvi
  AFW::802_11::Transport::Check General Message Header.gvi
  AFW::802_11::Transport::Check SAP Sub Header.gvi
  AFW::802_11::MAC Middle SAP::Check Duplication or Missing Parameter Set.gvi
diagram:
  w1 = [{"parameter set body length"=41, "minimal size"=FALSE}, {"parameter set body length"=4, "minimal size"=FALSE}, {"parameter set body length"=7, "minimal size"=FALSE}, {"parameter set body length"=1, "minimal size"=FALSE}]
  Split 1D Array(array=$"received MAC SAP RX configuration indication", index=8) -> (first subarray=w2, second subarray=w3)
  Split 1D Array(array=w3, index=8) -> (first subarray=w4, second subarray=w5)
  call "Decode General Message Header.gvi"(received general message header=w2) -> (decoded general message header=w6, decoded message body length=w7)
  call "Decode SAP Sub Header.gvi"(received SAP sub header=w4) -> (decoded SAP sub header=w8, reserved=w9)
  w10 = "MAC SAP RX Configuration Indication.gtype" {all zero or empty}
  Property Node(instance in=w10, "General Message Header"=w6, "SAP Sub Header"=w8) -> (instance out=w11)
  Property Node(instance in=w8) -> ("number of submessages"=w12)
  To Signed 32 Bit Integer(number=w12) -> w13
  s1 = w5  # shift register
  s2 = w11  # shift register
  for (N = w13) {
    Split 1D Array(array=s1, index=4) -> (first subarray=w16, second subarray=w17)
    call "Check Sub Message Header.gvi"(parameter submessage header=w16, maximal submessage type=3, supported parameter set body length=w1) -> (error out=w18, submessage type=w19, parameter set body length=w20)
    To Signed 32 Bit Integer(number=w20) -> w21
    Split 1D Array(array=w17, index=w21) -> (first subarray=w22, second subarray=w23)
    case (w19) {
      frame 0 {
        call "Decode MSDU TX Parameters.gvi"(received MSDU TX parameters=w22) -> (decoded MSDU TX parameters=w26, error out=w24)
        Property Node(instance in=s2, "MSDU RX Parameters"=w26) -> (instance out=w25)
      }
      frame 1 {
        call "Decode PHY TX Parameters.gvi"(received PHY TX parameters=w22, device bandwidth=$"device bandwidth") -> (decoded PHY TX parameters=w27, error out=w24)
        Property Node(instance in=s2, "PHY RX Parameters"=w27) -> (instance out=w25)
      }
      frame 2 {
        call "Decode RX Status.gvi"(encoded RX status=w22) -> (decoded RX status=w28, error out=w24)
        Property Node(instance in=s2, "MAC RX Status"=w28) -> (instance out=w25)
      }
      frame 3 {
        Array Index(array=w22) -> (out0[_]=w29)
        case (w29) {
          frame 0, Default {
            w30 = FALSE
          }
          frame 1 {
            w30 = TRUE
          }
        }
        Property Node(instance in=s2, "Additional MSDU RX Parameters:retry flag"=w30) -> (instance out=w25)
        Is Less Or Equal(x=w29, y=1) -> w31
        case (w31) {
          frame True {
            w24 = default
          }
          frame False {
            Format Into String(formatString="retry flag {0,1} out of range:\nreceived: %d", w29) -> w32
            Type Cast(type=u8 0, x="Range Violation") -> w33
            To Signed 32 Bit Integer(number=w33) -> w34
            call "Build Error Cluster.gvi"(code=w34, description=w32) -> (error out=w24)
          }
        }
      }
      frame 4, Default {
        Type Cast(type=u8 0, x="Unknown Parameter (Set)") -> w35
        To Signed 32 Bit Integer(number=w35) -> w36
        call "Build Error Cluster.gvi"(code=w36, description="invalid parameter set") -> (error out=w24)
        w25 = s2
      }
    }
    Merge Errors(w18, w24) -> (error out=w37)
    append w37 to w14
    append w19 to w15
    next s1 = w23
    next s2 = w25
  }
  $"decoded MAC SAP RX configuration indication" <- s2
  # w7: message body length (U24)
  call "Check General Message Header.gvi"(received general message header=w6, expected message ID=0x5081, received message body length=w7, expected message body length=80) -> (error out=w38)
  # w9: reserved (U16)
  call "Check SAP Sub Header.gvi"(received SAP sub header=w8, expected number of submessages=4, received reserved field=w9) -> (error out=w39)
  Merge Errors(w38, w39) -> (error out=w40)
  w41 = 4  # number of sub-messages
  Build Array(w12, w41) -> w42
  Array Max And Min(array=w42) -> (max value=w43)
  call "Check Duplication or Missing Parameter Set.gvi"(decoded submessages indices=w15, number of submessages=w43) -> (error out=w44)
  Merge Errors(w40, w14, w44) -> (error out=w45)
  $"error out" <- w45
