vi "Decode MSDU TX Parameters.gvi"   [LabVIEW NXG 4.0.0]
inputs:
  "received MSDU TX parameters": u8[]  # Received MSDU TX Parameters in 1D array of U8.
outputs:
  "error out": error
  "decoded MSDU TX parameters": "MSDU TX Parameters.gtype"  # Decoded MSDU TX Parameters cluster.
types:
  "MAC Frame Type.gtype" = enum{"Management", "Control", "Data", "Extension"}
  "MSDU TX Parameters.gtype" = cluster{"MSDU index": u8, "frame type": "MAC Frame Type.gtype", "subtype": u8, "to DS": bool, "from DS": bool, "power management": u8, "more data": u8, "protected frame": u8, "HTC / order": u8, "source address": u8[6], "destination address": u8[6], "basic service set identifier": u8[6], "recipient address": u8[6], "transmitter address": u8[6], "MSDU length": u16}
uses:
  NI::G Core::Error::Build Error Cluster.gvi
  AFW::802_11::RX::MAC Group Address Evaluation.gvi
diagram:
  Split 1D Array(array=$"received MSDU TX parameters", index=9) -> (first subarray=w1, second subarray=w2)
  Array Index(array=w1) -> (out0[_]=w3, out1[_]=w4, out2[_]=w5, out3[_]=w6, out4[_]=w7, out5[_]=w8, out6[_]=w9, out7[_]=w10, out8[_]=w11)
  Split 1D Array(array=w2, index=6) -> (first subarray=w12, second subarray=w13)
  Type Cast(type=u8[6] default, x=w12) -> w14
  Split 1D Array(array=w13, index=6) -> (first subarray=w15, second subarray=w16)
  Type Cast(type=u8[6] default, x=w15) -> w17
  Split 1D Array(array=w16, index=6) -> (first subarray=w18, second subarray=w19)
  Type Cast(type=u8[6] default, x=w18) -> w20
  Split 1D Array(array=w19, index=6) -> (first subarray=w21, second subarray=w22)
  Type Cast(type=u8[6] default, x=w21) -> w23
  Split 1D Array(array=w22, index=6) -> (first subarray=w24, second subarray=w25)
  Type Cast(type=u8[6] default, x=w24) -> w26
  case (w6) {
    frame 0, Default {
      w27 = FALSE
    }
    frame 1 {
      w27 = TRUE
    }
  }
  case (w7) {
    frame 0, Default {
      w28 = FALSE
    }
    frame 1 {
      w28 = TRUE
    }
  }
  Type Cast(type="MAC Frame Type.gtype" "Management", x=w4) -> w29
  Array Index(array=w25) -> (out0[_]=w30, out1[_]=w31)
  Join Numbers(high(x)=w30, low(x)=w31) -> w32
  Property Node(instance in="MSDU TX Parameters.gtype" {all zero or empty}, "MSDU index"=w3, "frame type"=w29, "subtype"=w5, "to DS"=w27, "from DS"=w28, "power management"=w8, "more data"=w9, "protected frame"=w10, "HTC / order"=w11, "source address"=w14, "destination address"=w17, "basic service set identifier"=w20, "recipient address"=w23, "transmitter address"=w26, "MSDU length"=w32) -> (instance out=w33)
  $"decoded MSDU TX parameters" <- w33
  Is Equal To 0(x=w10) -> w34
  case (w34) {
    frame True {
      w35 = default
    }
    frame False {
      w36 = "protected frame (only non-encrypted transmissions are supported. Received value: %d"
      Format Into String(initString=w36, w10) -> w37
      Type Cast(type=u8 0, x="Range Violation") -> w38
      To Signed 32 Bit Integer(number=w38) -> w39
      call "Build Error Cluster.gvi"(code=w39, description=w37) -> (error out=w35)
    }
  }
  Is Equal To 0(x=w8) -> w40
  case (w40) {
    frame True {
      w41 = default
    }
    frame False {
      w42 = "Power save of power management is not supported.\nReceived value: %d"
      Format Into String(initString=w42, w8) -> w43
      Type Cast(type=u8 0, x="Range Violation") -> w44
      To Signed 32 Bit Integer(number=w44) -> w45
      call "Build Error Cluster.gvi"(code=w45, description=w43) -> (error out=w41)
    }
  }
  Is Equal To 0(x=w9) -> w46
  case (w46) {
    frame True {
      w47 = default
    }
    frame False {
      w48 = "more data is not supported (e.g. a station in PS mode that more MSDUs or MMPDU are buffered for that station at the AP).\nReceived value: %d"
      Format Into String(initString=w48, w9) -> w49
      Type Cast(type=u8 0, x="Range Violation") -> w50
      To Signed 32 Bit Integer(number=w50) -> w51
      call "Build Error Cluster.gvi"(code=w51, description=w49) -> (error out=w47)
    }
  }
  # MSDU length in bytes
  Is Less Or Equal(x=w32, y=4065) -> w52
  case (w52) {
    frame True {
      w53 = default
    }
    frame False {
      w54 = "Supported MSDU length in bytes should be less or equal than 4065.\nreceived value: %d"
      Format Into String(initString=w54, w32) -> w55
      Type Cast(type=u8 0, x="Range Violation") -> w56
      To Signed 32 Bit Integer(number=w56) -> w57
      call "Build Error Cluster.gvi"(code=w57, description=w55) -> (error out=w53)
    }
  }
  Is Equal To 0(x=w11) -> w58
  case (w58) {
    frame True {
      w59 = default
    }
    frame False {
      Format Into String(initString="HTC / order mode is not supported. Received value: %d", w11) -> w60
      Type Cast(type=u8 0, x="Range Violation") -> w61
      To Signed 32 Bit Integer(number=w61) -> w62
      call "Build Error Cluster.gvi"(code=w62, description=w60) -> (error out=w59)
    }
  }
  case (w4) {
    frame 0 {
      # Management frames are supported
      w63 = default
    }
    frame 1 {
      w64 = "frame type should be {0,2}. control frames are not supported.\nreceived value: %d"
      Format Into String(initString=w64, w4) -> w65
      Type Cast(type=u8 0, x="Range Violation") -> w66
      To Signed 32 Bit Integer(number=w66) -> w67
      call "Build Error Cluster.gvi"(code=w67, description=w65) -> (error out=w63)
    }
    frame 2 {
      # data frames are supported
      w63 = default
    }
    frame 3 {
      w68 = "frame type should be {0,2}. extension frames are not supported.\nreceived value: %d"
      Format Into String(initString=w68, w4) -> w69
      Type Cast(type=u8 0, x="Range Violation") -> w70
      To Signed 32 Bit Integer(number=w70) -> w71
      call "Build Error Cluster.gvi"(code=w71, description=w69) -> (error out=w63)
    }
    frame 4, Default {
      w72 = "frame type should be between 0 and 3. Only {0,2} are supported. Out of range, received value: %d"
      Format Into String(initString=w72, w4) -> w73
      Type Cast(type=u8 0, x="Range Violation") -> w74
      To Signed 32 Bit Integer(number=w74) -> w75
      call "Build Error Cluster.gvi"(code=w75, description=w73) -> (error out=w63)
    }
  }
  Is Less Or Equal(x=w6, y=1) -> w76
  case (w76) {
    frame True {
      w77 = default
    }
    frame False {
      Format Into String(initString="to DS {0,1} out of range:\nreceived value: %d", w6) -> w78
      Type Cast(type=u8 0, x="Range Violation") -> w79
      To Signed 32 Bit Integer(number=w79) -> w80
      call "Build Error Cluster.gvi"(code=w80, description=w78) -> (error out=w77)
    }
  }
  Is Less Or Equal(x=w7, y=1) -> w81
  case (w81) {
    frame True {
      w82 = default
    }
    frame False {
      Format Into String(initString="from DS {0,1} out of range:\nreceived value: %d", w7) -> w83
      Type Cast(type=u8 0, x="Range Violation") -> w84
      To Signed 32 Bit Integer(number=w84) -> w85
      call "Build Error Cluster.gvi"(code=w85, description=w83) -> (error out=w82)
    }
  }
  Array Index(array=w20) -> (out0[_]=w86, out1[_]=w87, out2[_]=w88, out3[_]=w89, out4[_]=w90, out5[_]=w91)
  Format Into String(formatString="%02X:%02X:%02X:%02X:%02X:%02X", w86, w87, w88, w89, w90, w91) -> (outString=w92, errOut=w93)
  call "MAC Group Address Evaluation.gvi"(MAC address=w20) -> (is a group address=w94, is a local administrated address=w95)
  Logical And(not w94, w95) -> w96
  case (w96) {
    frame True {
      w97 = default
    }
    frame False {
      case (w94) {
        frame False, Default {
          w98 = default
        }
        frame True {
          w99 = "Basic basic service set identifier (BSSID) is a group address: "
          Concatenate Strings(w99, w92) -> w100
          Type Cast(type=u8 0, x="Range Violation") -> w101
          To Signed 32 Bit Integer(number=w101) -> w102
          call "Build Error Cluster.gvi"(code=w102, description=w100) -> (error out=w98)
        }
      }
      case (w95) {
        frame True {
          w103 = default
        }
        frame False {
          w104 = "Basic basic service set identifier (BSSID) is not a locally administered address: "
          Concatenate Strings(w104, w92) -> w105
          Type Cast(type=u8 0, x="Range Violation") -> w106
          To Signed 32 Bit Integer(number=w106) -> w107
          call "Build Error Cluster.gvi"(code=w107, description=w105) -> (error out=w103)
        }
      }
      Merge Errors(w98, w103) -> (error out=w97)
    }
  }
  Merge Errors(w97, w93) -> (error out=w108)
  Array Index(array=w26) -> (out0[_]=w109, out1[_]=w110, out2[_]=w111, out3[_]=w112, out4[_]=w113, out5[_]=w114)
  Format Into String(formatString="%02X:%02X:%02X:%02X:%02X:%02X", w109, w110, w111, w112, w113, w114) -> (outString=w115, errOut=w116)
  call "MAC Group Address Evaluation.gvi"(MAC address=w26) -> (is a group address=w117)
  Logical And(w28, w27) -> w118
  # transmitter address (TA) is an individual address if <to DS> == 1 AND <from DS> == 1
  # (Note: This check is only applied for <to DS> == <from DS> == 1, since only in this case the transmitter address will be evaluated at the MAC Middle SAP)
  case (w118) {
    frame False, Default {
      w119 = default
    }
    frame True {
      case (w117) {
        frame False {
          w119 = default
        }
        frame True {
          w120 = "transmitter address (TA) is a group address where <to DS> = 1 AND <from DS> = 1: "
          Concatenate Strings(w120, w115) -> w121
          Type Cast(type=u8 0, x="Range Violation") -> w122
          To Signed 32 Bit Integer(number=w122) -> w123
          call "Build Error Cluster.gvi"(code=w123, description=w121) -> (error out=w119)
        }
      }
    }
  }
  Merge Errors(w119, w116) -> (error out=w124)
  Array Index(array=w14) -> (out0[_]=w125, out1[_]=w126, out2[_]=w127, out3[_]=w128, out4[_]=w129, out5[_]=w130)
  Format Into String(formatString="%02X:%02X:%02X:%02X:%02X:%02X", w125, w126, w127, w128, w129, w130) -> (outString=w131, errOut=w132)
  call "MAC Group Address Evaluation.gvi"(MAC address=w14) -> (is a group address=w133)
  case (w133) {
    frame False {
      w134 = default
    }
    frame True {
      Concatenate Strings("Source Address (SA) is a group address: ", w131) -> w135
      Type Cast(type=u8 0, x="Range Violation") -> w136
      To Signed 32 Bit Integer(number=w136) -> w137
      call "Build Error Cluster.gvi"(code=w137, description=w135) -> (error out=w134)
    }
  }
  Merge Errors(w134, w132) -> (error out=w138)
  Is Equal To 0(x=w4) -> w139
  Is Less Or Equal(x=w5, y=15) -> w140
  Logical And(w140, w139) -> w141
  case (w139) {
    frame False, Default {
      w142 = default
    }
    frame True {
      case (w141) {
        frame False {
          w143 = "frame type and frame subtype mismatch.\nreceived frame type value: %d\nreceived frame subtype value: %d"
          Format Into String(initString=w143, w4, w5) -> w144
          Type Cast(type=u8 0, x="Range Violation") -> w145
          To Signed 32 Bit Integer(number=w145) -> w146
          call "Build Error Cluster.gvi"(code=w146, description=w144) -> (error out=w142)
        }
        frame True {
          w142 = default
        }
      }
    }
  }
  # supported value range:
  # 0…15 for frame type == 0
  # (all management frames)
  # 0 for frame type == 2
  # (only data frames of subtype “data”)
  # 0: management frames
  # 1: control frames
  # 2: data frames
  # (3: extension frames)
  # Note: only management frames (0) and data frames (2) are supported at the MAC middle SAP (TX side)
  Is Equal(x=w4, y=2) -> w147
  Is Equal To 0(x=w5) -> w148
  Logical And(w148, w147) -> w149
  case (w147) {
    frame False, Default {
      w150 = default
    }
    frame True {
      case (w149) {
        frame False {
          w151 = "frame type and frame subtype mismatch.\nreceived frame type value: %d\nreceived frame subtype value: %d"
          Format Into String(initString=w151, w4, w5) -> w152
          Type Cast(type=u8 0, x="Range Violation") -> w153
          To Signed 32 Bit Integer(number=w153) -> w154
          call "Build Error Cluster.gvi"(code=w154, description=w152) -> (error out=w150)
        }
        frame True {
          w150 = default
        }
      }
    }
  }
  Merge Errors(w142, w150) -> (error out=w155)
  Merge Errors(w53, w124, w138, w108, w155, w63, w77, w82, w41, w47, w35, w59) -> (error out=w156)
  $"error out" <- w156
