vi "Decode MSDU TX Payload.gvi"   [LabVIEW NXG 4.0.0]
# Decodes the 1D array (in bytes) of received MSDU TX Payload to the corresponding cluster.
inputs:
  "received MSDU TX payload": u8[]  # Received MSDU TX Payload.
outputs:
  "decoded MSDU TX payload": "MSDU TX Payload.gtype"  # Decoded MSDU TX Payload.
  "error out": error
types:
  "MSDU TX Payload.gtype" = cluster{"MSDU index": u8, "MSDU length": u16, "MSDU data": u8[]}
uses:
  NI::G Core::Error::Build Error Cluster.gvi
diagram:
  Split 1D Array(array=$"received MSDU TX payload", index=4) -> (first subarray=w1, second subarray=w2)
  Array Index(array=w1) -> (out0[_]=w3, out2[_]=w4, out3[_]=w5)
  Join Numbers(high(x)=w4, low(x)=w5) -> w6
  # ignore second U8 of reserved field
  Property Node(instance in="MSDU TX Payload.gtype" {all zero or empty}, "MSDU index"=w3, "MSDU length"=w6, "MSDU data"=w2) -> (instance out=w7)
  $"decoded MSDU TX payload" <- w7
  # MSDU length in byte without padding bytes
  Is Less Or Equal(x=w6, y=4065) -> w8
  case (w8) {
    frame True {
      w9 = default
    }
    frame False {
      Type Cast(type=u8 0, x="Range Violation") -> w10
      To Signed 32 Bit Integer(number=w10) -> w11
      Format Into String(formatString="MSDU length maximum: %d. received: %d", 4065, w6) -> w12
      call "Build Error Cluster.gvi"(code=w11, description=w12) -> (error out=w9)
    }
  }
  $"error out" <- w9
