vi "Decode PHY TX Parameters.gvi"   [LabVIEW NXG 4.0.0]
# Decodes the 1D array (in bytes) of received PHY TX Parameters to the corresponding cluster and also checks if the decoded values for format, bandwidth and MCS are out of range.
inputs:
  "received PHY TX parameters": u8[]  # Received PHY TX Parameters in 1D array of U8.
  "device bandwidth": u16  # Instantaneous device bandwidth
outputs:
  "decoded PHY TX parameters": "PHY TX Parameters.gtype"  # Decoded PHY TX Parameters cluster.
  "error out": error
types:
  "PHY Frame Format.gtype" = enum{"NON_HT_OFDM", "VHT", "NON_HT_DUP_OFDM"}
  "Bandwidth.gtype" = enum{"20 MHz", "40 MHz", "80 MHz"}
  "PHY TX Parameters.gtype" = cluster{"MSDU index": u8, "format": "PHY Frame Format.gtype", "bandwidth": "Bandwidth.gtype", "MCS": u8}
uses:
  NI::G Core::Error::Build Error Cluster.gvi
diagram:
  Array Index(array=$"received PHY TX parameters") -> (out0[_]=w1, out1[_]=w2, out2[_]=w3, out3[_]=w4)
  To Signed 32 Bit Integer(number=w2) -> w5
  Array Index(array=["NON_HT_OFDM", "NON_HT_DUP_OFDM", "VHT"]) -> (out0[w5]=w6)
  To Signed 32 Bit Integer(number=w3) -> w7
  Array Index(array=["20 MHz", "40 MHz", "80 MHz"]) -> (out0[w7]=w8)
  Property Node(instance in="PHY TX Parameters.gtype" {all zero or empty}, "MSDU index"=w1, "format"=w6, "bandwidth"=w8, "MCS"=w4) -> (instance out=w9)
  $"decoded PHY TX parameters" <- w9
  Is Less Or Equal(x=w2, y=2) -> w10
  case (w10) {
    frame True {
      w11 = default
    }
    frame False {
      w12 = "Format {0: “NON_HT_OFDM”, 1: “NON_HT_DUP_OFDM” , 2: “VHT”} out of range:\nReceived value: %d"
      Format Into String(initString=w12, w2) -> w13
      Type Cast(type=u8 0, x="Range Violation") -> w14
      To Signed 32 Bit Integer(number=w14) -> w15
      call "Build Error Cluster.gvi"(code=w15, description=w13) -> (error out=w11)
    }
  }
  Is Less Or Equal(x=w3, y=2) -> w16
  case (w16) {
    frame True {
      w17 = default
    }
    frame False {
      w18 = "Bandwidth out of supported range {0,…,2} {0: 20MHz, 1: 40MHz, 2: 80MHz, 3: 160MHz, 4: 80+80MHz}\nreceived value: %d"
      Format Into String(initString=w18, w3) -> w19
      Type Cast(type=u8 0, x="Range Violation") -> w20
      To Signed 32 Bit Integer(number=w20) -> w21
      call "Build Error Cluster.gvi"(code=w21, description=w19) -> (error out=w17)
    }
  }
  Is Less Or Equal(x=w4, y=9) -> w22
  case (w22) {
    frame True {
      w23 = default
    }
    frame False {
      Format Into String(initString="MCS {0...9} out of range:\nreceived value: %d", w4) -> w24
      Type Cast(type=u8 0, x="Range Violation") -> w25
      To Signed 32 Bit Integer(number=w25) -> w26
      call "Build Error Cluster.gvi"(code=w26, description=w24) -> (error out=w23)
    }
  }
  Is Equal(x=w2, y=0) -> w27
  Is Equal(x=w3, y=0) -> w28
  Is Less Or Equal(x=w4, y=7) -> w29
  case (w27) {
    frame False, Default {
      w30 = default
    }
    frame True {
      case (w28) {
        frame True {
          w31 = default
        }
        frame False {
          w32 = "At NON_HT_OFDM, the bandwidth should be 20 MHz {0: 20MHz, 1: 40MHz, 2: 80MHz}. \nReceived bandwidth: %d MHz\n"
          case (w3) {
            frame 0, Default {
              w33 = 20
            }
            frame 1 {
              w33 = 40
            }
            frame 2 {
              w33 = 80
            }
            frame 3 {
              w33 = 160
            }
            frame 4 {
              w33 = 80
            }
          }
          Is Equal(x=4, y=w3) -> w34
          case (w34) {
            frame False, Default {
              Format Into String(initString=w32, w33) -> w35
            }
            frame True {
              w36 = "At NON_HT_OFDM, the bandwidth should be 20 MHz {0: 20MHz, 1: 40MHz, 2: 80MHz}. \nReceived bandwidth: %d + %d MHz\n"
              Format Into String(initString=w36, w33, w33) -> w35
            }
          }
          Type Cast(type=u8 0, x="Range Violation") -> w37
          To Signed 32 Bit Integer(number=w37) -> w38
          call "Build Error Cluster.gvi"(code=w38, description=w35) -> (error out=w31)
        }
      }
      case (w29) {
        frame True {
          w39 = default
        }
        frame False {
          w40 = "At NON_HT_OFDM, the MCS should be between {0...7}. \nReceived MCS: %d"
          Format Into String(initString=w40, w4) -> w41
          Type Cast(type=u8 0, x="Range Violation") -> w42
          To Signed 32 Bit Integer(number=w42) -> w43
          call "Build Error Cluster.gvi"(code=w43, description=w41) -> (error out=w39)
        }
      }
      Merge Errors(w31, w39) -> (error out=w30)
    }
  }
  Is Equal(x=w2, y=1) -> w44
  Is Less Or Equal(x=w4, y=7) -> w45
  # NON_HT_DUP_OFDM
  case (w44) {
    frame False, Default {
      w46 = default
    }
    frame True {
      case (w45) {
        frame True {
          w46 = default
        }
        frame False {
          w47 = "At NON_HT_DUP_OFDM, the MCS should be between {0...7}. \nreceived MCS: %d"
          Format Into String(initString=w47, w4) -> w48
          Type Cast(type=u8 0, x="Range Violation") -> w49
          To Signed 32 Bit Integer(number=w49) -> w50
          call "Build Error Cluster.gvi"(code=w50, description=w48) -> (error out=w46)
        }
      }
    }
  }
  # VHT
  Is Equal(x=w2, y=2) -> w51
  case (w51) {
    frame False, Default {
      w52 = default
    }
    frame True {
      case (w3) {
        frame 0 {
          Is Less Or Equal(x=w4, y=8) -> w53
          # 20 MHz BW
          case (w53) {
            frame True {
              w52 = default
            }
            frame False {
              w54 = "At VHT and 20 MHz bandwidth, the MCS should be between {0...8}. \nreceived MCS: %d"
              Format Into String(initString=w54, w4) -> w55
              Type Cast(type=u8 0, x="Range Violation") -> w56
              To Signed 32 Bit Integer(number=w56) -> w57
              call "Build Error Cluster.gvi"(code=w57, description=w55) -> (error out=w52)
            }
          }
        }
        frame Default {
          w58 = "At VHT, the maximum supported bandwidth is 80 MHz. The 80+80 and 160 MHz is not supported."
          Type Cast(type=u8 0, x="Range Violation") -> w59
          To Signed 32 Bit Integer(number=w59) -> w60
          call "Build Error Cluster.gvi"(code=w60, description=w58) -> (error out=w52)
        }
        frame 2 {
          Is Less Or Equal(x=w4, y=4) -> w61
          # 80 MHz BW
          case (w61) {
            frame True {
              w52 = default
            }
            frame False {
              w62 = "At VHT and 80 MHz bandwidth, the supported MCS is {0...4}. \nreceived MCS: %d"
              Format Into String(initString=w62, w4) -> w63
              Type Cast(type=u8 0, x="Range Violation") -> w64
              To Signed 32 Bit Integer(number=w64) -> w65
              call "Build Error Cluster.gvi"(code=w65, description=w63) -> (error out=w52)
            }
          }
        }
        frame 1 {
          Is Less Or Equal(x=w4, y=9) -> w66
          # 40 MHz BW
          case (w66) {
            frame True {
              w52 = default
            }
            frame False {
              w67 = "At VHT and 40 MHz bandwidth, the MCS should be between {0...9}. \nreceived MCS: %d"
              Format Into String(initString=w67, w4) -> w68
              Type Cast(type=u8 0, x="Range Violation") -> w69
              To Signed 32 Bit Integer(number=w69) -> w70
              call "Build Error Cluster.gvi"(code=w70, description=w68) -> (error out=w52)
            }
          }
        }
      }
    }
  }
  case (w3) {
    frame 0 {
      w71 = 20
    }
    frame 1 {
      w71 = 40
    }
    frame 2 {
      w71 = 80
    }
    frame 3, 4, Default {
      w71 = 160
    }
  }
  Is Greater(x=w71, y=$"device bandwidth") -> w72
  case (w72) {
    frame False {
      w73 = default
    }
    frame True {
      w74 = "Requested bandwidth (%d MHz) exceeds device bandwidth (%d MHz)"
      Format Into String(formatString=w74, w71, $"device bandwidth") -> w75
      Type Cast(type=u8 0, x="Range Violation") -> w76
      To Signed 32 Bit Integer(number=w76) -> w77
      call "Build Error Cluster.gvi"(code=w77, description=w75) -> (error out=w73)
    }
  }
  Merge Errors(w11, w17, w23, w30, w46, w52, w73) -> (error out=w78)
  $"error out" <- w78
