vi "Encode Additional MSDU RX Parameters.gvi"   [LabVIEW NXG 4.0.0]
# Builds an 1D array of U8 (byte) with the Additional MSDU RX Parameters cluster and the sub-message header parameters.
inputs:
  "additional MSDU RX parameters": "Additional MSDU RX Parameters.gtype"  # Additional MSDU RX Parameters cluster to be encoded.
outputs:
  "encoded additional MSDU RX parameters": u8[]  # Additional MSDU RX Parameters cluster and sub-message header parameters in 1D array of U8.
types:
  "Additional MSDU RX Parameters.gtype" = cluster{"retry flag": bool}
diagram:
  w1 = 3  # submessage type
  w2 = 0  # parameter set ID
  w3 = 1  # parameter set body length
  Split Number(x=w3) -> (high(x)=w4, low(x)=w5)
  Property Node(instance in=$"additional MSDU RX parameters") -> ("retry flag"=w6)
  Boolean To 0 Or 1(Boolean=w6) -> (0, 1=w7)
  To Unsigned 8 Bit Integer(number=w7) -> w8
  Build Array(w1, w2, w4, w5, w8) -> w9
  $"encoded additional MSDU RX parameters" <- w9
