vi "Encode General Message Header.gvi"   [LabVIEW NXG 4.0.0]
# Builds an 1D array of U8 (byte) with the General Message Header cluster and the message body length.
inputs:
  "general message header": "General Message Header.gtype"  # General message header that needs to be flatten to array U8 type.
  "message body length": u32  # Message body length in U32 (only U24 is effective).
outputs:
  "encoded general message header": u8[]  # General message header and sub-message header parameters in 1D array of U8.
types:
  "General Message Header.gtype" = cluster{"message type ID": u16, "reference ID": u16, "instance ID": u8}
diagram:
  Property Node(instance in=$"general message header") -> ("message type ID"=w1, "reference ID"=w2, "instance ID"=w3)
  Split Number(x=$"message body length") -> (high(x)=w4, low(x)=w5)
  Split Number(x=w4) -> w6
  Split Number(x=w5) -> (high(x)=w7, low(x)=w8)
  Build Array(w6, w7, w8) -> w9
  # message body length in 1D array of U8 (3 elements).
  Split Number(x=w1) -> (high(x)=w10, low(x)=w11)
  Split Number(x=w2) -> (high(x)=w12, low(x)=w13)
  Build Array(w10, w11, w12, w13, w3, w9) -> w14
  $"encoded general message header" <- w14
