vi "Encode MAC SAP RX Configuration Indication.gvi"   [LabVIEW NXG 4.0.0]
# Encodes the MAC SAP RX Configuration Indication cluster to an 1D array of U8 (byte).
inputs:
  "MAC SAP RX configuration indication": "MAC SAP RX Configuration Indication.gtype"
outputs:
  "encoded MAC SAP RX configuration indication": u8[]  # MAC SAP RX Configuration Indication cluster in 1D array of U8.
types:
  "General Message Header.gtype" = cluster{"message type ID": u16, "reference ID": u16, "instance ID": u8}
  "SAP Sub Header.gtype" = cluster{"timestamp": u32, "number of submessages": u8, "confirmation mode": bool}
  "MAC Frame Type.gtype" = enum{"Management", "Control", "Data", "Extension"}
  "MSDU TX Parameters.gtype" = cluster{"MSDU index": u8, "frame type": "MAC Frame Type.gtype", "subtype": u8, "to DS": bool, "from DS": bool, "power management": u8, "more data": u8, "protected frame": u8, "HTC / order": u8, "source address": u8[6], "destination address": u8[6], "basic service set identifier": u8[6], "recipient address": u8[6], "transmitter address": u8[6], "MSDU length": u16}
  "PHY Frame Format.gtype" = enum{"NON_HT_OFDM", "VHT", "NON_HT_DUP_OFDM"}
  "Bandwidth.gtype" = enum{"20 MHz", "40 MHz", "80 MHz"}
  "PHY TX Parameters.gtype" = cluster{"MSDU index": u8, "format": "PHY Frame Format.gtype", "bandwidth": "Bandwidth.gtype", "MCS": u8}
  "Additional MSDU RX Parameters.gtype" = cluster{"retry flag": bool}
  "A-MPDU De-Aggregation Status.gtype" = enum{"A-MPDU De-Aggregation not executed", "A-MPDU De-Aggregation successful", "PSDU length mismatch", "VHT delimiter CRC fail", "VHT delimiter signature comparison fail", "EOF field check fail", "MPDU length mismatch"}
  "FCS Check Status.gtype" = enum{"FCS check not executed", "FCS check pass", "FCS check fail"}
  "MPDU Length Check Status.gtype" = enum{"MPDU length check not executed", "MPDU length check pass", "MPDU length check not standard compliant", "MPDU length check exceeds implemented buffer"}
  "MPDU Disassembly Status.gtype" = enum{"Disassembly not executed", "Disassembly successful", "Disassembly done partially", "Disassembly not successful"}
  "MPDU Filtering Status.gtype" = enum{"MPDU Filtering not executed", "MPDU valid for further processing", "MPDU pass through for sniffer mode"}
  "MSDU Defragmentation Status.gtype" = enum{"Defragmentation not executed", "Unfragmented MSDU successfully received", "Unsupported MSDU fragment received"}
  "MSDU Duplicate Detection Status.gtype" = enum{"Duplicate detection not executed", "Duplicate detection successfully passed", "Duplicate detected"}
  "RX Status.gtype" = cluster{"A-MPDU de-aggregation status": "A-MPDU De-Aggregation Status.gtype", "MPDU FCS check status": "FCS Check Status.gtype", "MPDU length check status": "MPDU Length Check Status.gtype", "MPDU disassembly status": "MPDU Disassembly Status.gtype", "MPDU Filtering Status": "MPDU Filtering Status.gtype", "MSDU Defragmentation Status": "MSDU Defragmentation Status.gtype", "MSDU Duplicate Detection Status": "MSDU Duplicate Detection Status.gtype"}
  "MAC SAP RX Configuration Indication.gtype" = cluster{"General Message Header": "General Message Header.gtype", "SAP Sub Header": "SAP Sub Header.gtype", "MSDU RX Parameters": "MSDU TX Parameters.gtype", "PHY RX Parameters": "PHY TX Parameters.gtype", "Additional MSDU RX Parameters": "Additional MSDU RX Parameters.gtype", "MAC RX Status": "RX Status.gtype"}
uses:
  AFW::802_11::Transport::Encode General Message Header.gvi
  AFW::802_11::Transport::Encode SAP Sub Header.gvi
  AFW::802_11::Transport::Encode MSDU TX Parameters.gvi
  AFW::802_11::Transport::Encode PHY TX Parameters.gvi
  AFW::802_11::Transport::Encode Additional MSDU RX Parameters.gvi
  AFW::802_11::Transport::Encode RX Status.gvi
diagram:
  Property Node(instance in=$"MAC SAP RX configuration indication") -> ("General Message Header"=w1, "SAP Sub Header"=w2, "MSDU RX Parameters"=w3, "PHY RX Parameters"=w4, "Additional MSDU RX Parameters"=w5, "MAC RX Status"=w6)
  # message body length in bytes = MSDU RX parameters (parameter set body length = 41) + 4 + PHY RX parameters (parameter set body length = 4) + 4 + RX Status (parameter set body length = 7) + 4 + 8 + 8
  call "Encode General Message Header.gvi"(general message header=w1, message body length=80) -> (encoded general message header=w7)
  call "Encode SAP Sub Header.gvi"(SAP sub header=w2) -> (encoded SAP sub header=w8)
  call "Encode MSDU TX Parameters.gvi"(MSDU TX parameters=w3) -> (encoded MSDU TX parameters=w9)
  call "Encode PHY TX Parameters.gvi"(PHY TX parameters=w4) -> (encoded PHY TX parameters=w10)
  call "Encode Additional MSDU RX Parameters.gvi"(additional MSDU RX parameters=w5) -> (encoded additional MSDU RX parameters=w11)
  call "Encode RX Status.gvi"(RX status=w6) -> (encoded RX status=w12)
  Build Array(w7, w8, w9, w10, w11, w12) -> w13
  $"encoded MAC SAP RX configuration indication" <- w13
