vi "Encode MAC SAP RX Payload Indication.gvi"   [LabVIEW NXG 4.0.0]
# Encodes the MAC SAP RX Payload Indication cluster to an 1D array of U8 (byte).
inputs:
  "MAC SAP RX payload indication": "MAC SAP RX Payload Indication.gtype"  # MAC SAP RX Payload Indication cluster that needs to be converted to 1D array in bytes.
outputs:
  "encoded MAC SAP RX payload indication": u8[]  # MAC SAP RX Payload Indication cluster in 1D array of U8.
types:
  "General Message Header.gtype" = cluster{"message type ID": u16, "reference ID": u16, "instance ID": u8}
  "SAP Sub Header.gtype" = cluster{"timestamp": u32, "number of submessages": u8, "confirmation mode": bool}
  "MSDU TX Payload.gtype" = cluster{"MSDU index": u8, "MSDU length": u16, "MSDU data": u8[]}
  "MAC SAP RX Payload Indication.gtype" = cluster{"General Message Header": "General Message Header.gtype", "SAP Sub Header": "SAP Sub Header.gtype", "MSDU RX Payload": "MSDU TX Payload.gtype"}
uses:
  AFW::802_11::Transport::Encode General Message Header.gvi
  AFW::802_11::Transport::Encode SAP Sub Header.gvi
  AFW::802_11::Transport::Encode MSDU TX Payload.gvi
diagram:
  Property Node(instance in=$"MAC SAP RX payload indication") -> ("General Message Header"=w1, "SAP Sub Header"=w2, "MSDU RX Payload"=w3, "MSDU RX Payload:MSDU length"=w4)
  To Unsigned 32 Bit Integer(number=w4) -> w5
  Add(24, w5) -> w6
  call "Encode General Message Header.gvi"(general message header=w1, message body length=w6) -> (encoded general message header=w7)
  call "Encode SAP Sub Header.gvi"(SAP sub header=w2) -> (encoded SAP sub header=w8)
  call "Encode MSDU TX Payload.gvi"(MSDU TX payload=w3) -> (encoded MSDU TX payload=w9)
  Build Array(w7, w8, w9) -> w10
  $"encoded MAC SAP RX payload indication" <- w10
