vi "Encode MSDU Transmission Status.gvi"   [LabVIEW NXG 4.0.0]
# Builds a 1D array of U8 (byte) with the MSDU Transmission Status and the sub-message header parameters.
inputs:
  "MSDU transmission status": bool  # MSDU Transmission Status as a Boolean input.
outputs:
  "encoded MSDU transmission status": u8[]  # MSDU Transmission Status and additional sub-message header parameters in 1D array of U8.
diagram:
  w1 = 0  # sub-message type
  w2 = 0  # parameter set ID
  w3 = 1  # parameter set body length
  Split Number(x=w3) -> (high(x)=w4, low(x)=w5)
  Boolean To 0 Or 1(Boolean=$"MSDU transmission status") -> (0, 1=w6)
  To Unsigned 8 Bit Integer(number=w6) -> w7
  Build Array(w1, w2, w4, w5, w7) -> w8
  $"encoded MSDU transmission status" <- w8
