vi "Encode PHY TX Parameters.gvi"   [LabVIEW NXG 4.0.0]
# Builds an 1D array of U8 (byte) with the PHY TX Parameters cluster and the sub-message header parameters.
inputs:
  "PHY TX parameters": "PHY TX Parameters.gtype"  # PHY TX Parameters cluster that needs to be flatten to array U8 type.
outputs:
  "encoded PHY TX parameters": u8[]  # PHY TX Parameters cluster and sub-message header parameters in 1D array of U8.
types:
  "PHY Frame Format.gtype" = enum{"NON_HT_OFDM", "VHT", "NON_HT_DUP_OFDM"}
  "Bandwidth.gtype" = enum{"20 MHz", "40 MHz", "80 MHz"}
  "PHY TX Parameters.gtype" = cluster{"MSDU index": u8, "format": "PHY Frame Format.gtype", "bandwidth": "Bandwidth.gtype", "MCS": u8}
diagram:
  w1 = 1  # submessage type
  w2 = 0  # parameter set ID
  Property Node(instance in=$"PHY TX parameters") -> ("MSDU index"=w3, "format"=w4, "bandwidth"=w5, "MCS"=w6)
  w7 = 4  # parameter set body length
  Split Number(x=w7) -> (high(x)=w8, low(x)=w9)
  Build Array(w8, w9) -> w10
  case (w4) {
    frame "NON_HT_OFDM", Default {
      w11 = 0
    }
    frame "VHT" {
      w11 = 2
    }
    frame "NON_HT_DUP_OFDM" {
      w11 = 1
    }
  }
  case (w5) {
    frame "20 MHz", Default {
      w12 = 0
    }
    frame "40 MHz" {
      w12 = 1
    }
    frame "80 MHz" {
      w12 = 2
    }
  }
  Build Array(w1, w2, w10, w3, w11, w12, w6) -> w13
  $"encoded PHY TX parameters" <- w13
