vi "Encode RX Status.gvi"   [LabVIEW NXG 4.0.0]
# Builds an 1D array of U8 (byte) with the RX Status cluster and the sub-message header parameters.
inputs:
  "RX status": "RX Status.gtype"  # RX Status cluster.
outputs:
  "encoded RX status": u8[]  # RX Status cluster and sub-message header parameters in 1D array of U8.
types:
  "A-MPDU De-Aggregation Status.gtype" = enum{"A-MPDU De-Aggregation not executed", "A-MPDU De-Aggregation successful", "PSDU length mismatch", "VHT delimiter CRC fail", "VHT delimiter signature comparison fail", "EOF field check fail", "MPDU length mismatch"}
  "FCS Check Status.gtype" = enum{"FCS check not executed", "FCS check pass", "FCS check fail"}
  "MPDU Length Check Status.gtype" = enum{"MPDU length check not executed", "MPDU length check pass", "MPDU length check not standard compliant", "MPDU length check exceeds implemented buffer"}
  "MPDU Disassembly Status.gtype" = enum{"Disassembly not executed", "Disassembly successful", "Disassembly done partially", "Disassembly not successful"}
  "MPDU Filtering Status.gtype" = enum{"MPDU Filtering not executed", "MPDU valid for further processing", "MPDU pass through for sniffer mode"}
  "MSDU Defragmentation Status.gtype" = enum{"Defragmentation not executed", "Unfragmented MSDU successfully received", "Unsupported MSDU fragment received"}
  "MSDU Duplicate Detection Status.gtype" = enum{"Duplicate detection not executed", "Duplicate detection successfully passed", "Duplicate detected"}
  "RX Status.gtype" = cluster{"A-MPDU de-aggregation status": "A-MPDU De-Aggregation Status.gtype", "MPDU FCS check status": "FCS Check Status.gtype", "MPDU length check status": "MPDU Length Check Status.gtype", "MPDU disassembly status": "MPDU Disassembly Status.gtype", "MPDU Filtering Status": "MPDU Filtering Status.gtype", "MSDU Defragmentation Status": "MSDU Defragmentation Status.gtype", "MSDU Duplicate Detection Status": "MSDU Duplicate Detection Status.gtype"}
diagram:
  w1 = 2  # sub-message type
  w2 = 0  # parameter set ID
  Property Node(instance in=$"RX status") -> ("A-MPDU de-aggregation status"=w3, "MPDU FCS check status"=w4, "MPDU length check status"=w5, "MPDU disassembly status"=w6, "MPDU Filtering Status"=w7, "MSDU Defragmentation Status"=w8, "MSDU Duplicate Detection Status"=w9)
  Type Cast(x=w3) -> w10
  Type Cast(x=w4) -> w11
  Type Cast(x=w5) -> w12
  Type Cast(x=w6) -> w13
  Type Cast(x=w7) -> w14
  Type Cast(x=w8) -> w15
  w16 = 7  # parameter set body length
  Split Number(x=w16) -> (high(x)=w17, low(x)=w18)
  Type Cast(x=w9) -> w19
  Build Array(w1, w2, w17, w18, w10, w11, w12, w13, w14, w15, w19) -> w20
  $"encoded RX status" <- w20
