vi "Create Stop.gvi"   [LabVIEW NXG 4.0.0]
# Enqueue an element into the stop notifier if stop in indicates an event of the stop button.
inputs:
  "error in": error, required
  "stop in": bool  # Indicates to send an element into the stop notifier.
  "timed loop name array": string[]
outputs:
  "error out": error, required
uses:
  NI::G Core::Timed Loop::Stop Timed Structure.gvi
diagram:
  case ($"stop in") {
    frame False, Default {
      w1 = $"error in"
    }
    frame True {
      Call Chain() -> (callchain=w2)
      Delete From Array(inArray=w2) -> (deleted=w3)
      Format Into String(formatString="%s:stop notifier", errIn=$"error in", w3) -> (outString=w4, errOut=w5)
      Obtain Notifier(create if not found=FALSE, element data type=string "", error in=w5, name=w4) -> (error out=w6, notifier out=w7)
      Send Notification(error in (no error)=w6, notification="done", notifier=w7) -> (error out=w8, notifier out=w9)
      Release Notifier(error in (no error)=w8, notifier=w9) -> (error out=w10)
      disable {
        frame TARGET_TYPE != "RT", Default {
          w1 = w10
        }
        frame TARGET_TYPE == "RT" {
          for {
            w11 = each element of $"timed loop name array"
            call "Stop Timed Structure.gvi"(name=w11) -> (error out=w13)
            append w13 to w12
          }
          Merge Errors(w10, w12) -> (error out=w1)
        }
      }
    }
  }
  $"error out" <- w1
