vi "Apply Configuration from File.gvi"   [LabVIEW NXG 4.0.0]
inputs:
  "toplevel VI reference": VIRefnum, required
  "error in": error
  "application component path": path, required
outputs:
  "error out": error
  "configuration": cluster{"key": string, "value": string}[]
uses:
  AFW::Common::Configuration::Read Configuration Data.gvi
  AFW::Common::Configuration::Set Configuration Data.gvi
diagram:
  Property Node(instance in=$"toplevel VI reference", error in=$"error in") -> ("Panel"=w1, error out=w2)
  call "Read Configuration Data.gvi"(panel reference in=w1, application component path=$"application component path", error in=w2, configuration path=path constant) -> (configuration=w3, error out=w4)
  call "Set Configuration Data.gvi"(VI reference in=$"toplevel VI reference", configuration=w3, error in=w4) -> (error out=w5)
  $"error out" <- w5
  $configuration <- w3
