vi "Set Configuration Data.gvi"   [LabVIEW NXG 4.0.0]
inputs:
  "VI reference in": VIRefnum
  "error in": error
  "configuration": cluster{"key": string, "value": string}[]
outputs:
  "VI reference out": VIRefnum
  "error out": error
diagram:
  s1 = $"VI reference in"  # shift register
  s2 = $"error in"  # shift register
  for {
    w1 = each element of $configuration
    Property Node(instance in=w1) -> ("value"=w2, "key"=w3)
    case (w2) {
      frame Default {
        Scan Value(default (0 dbl)=f64 default, format string="%f", string=w2) -> (output string=w5, value=w6)
        Is Empty String Or Path(string/path=w2) -> w7
        Is Empty String Or Path(string/path=w5) -> w8
        # Check if string represents a number
        Is Not Equal(x=w6, y=f64 default) -> w9
        Logical And(not w7, w8, w9) -> w10
        case (w10) {
          frame True {
            To Variant(anything=w6) -> w4
          }
          frame False {
            To Variant(anything=w2) -> w4
          }
        }
      }
      frame "true" {
        To Variant(anything=TRUE) -> w4
      }
      frame "false" {
        To Variant(anything=FALSE) -> w4
      }
    }
    Set Control Value(control name=w3, control value=w4, error in=s2, reference in=s1) -> (error out=w11, reference out=w12)
    next s1 = w12
    next s2 = w11
  }
  $"VI reference out" <- s1
  $"error out" <- s2
