vi "DTP Extract Packet.gvi"   [LabVIEW NXG 4.0.0]
# Extracts a DTP packet from a given input data stream:
# 	Find the sync word
# 	Decodes the header
# 	Extracts the packet
inputs:
  "data in": u8[]  # The input data array containing the DTP packet.
outputs:
  "packet": u8[]  # The extracted packet without header and attached CRC.
  "packet valid": bool  # Indication that the packet is valid.
  "data out": u8[]  # The remaining data array after parsing.
  "counter": u16  # The counter value contained in the header. The information is only valid if the state machine is in a certain state, i.e. use it for debug purposes only.
  "expected packet size": i32  # The expected packet size as stated in the header. The information is only valid if the state machine is in a certain state, i.e. use it for debug purposes only.
uses:
  AFW::Common::Data Transfer Protocol::DTP Header.gvi
  AFW::Common::Search U8 array.gvi
  AFW::Common::Data Transfer Protocol::DTP Check Header and CRC.gvi
diagram:
  call "DTP Header.gvi"() -> (DTP sync word=w1, sync word length=w2, header length=w3, DTP packet termination=w4)
  Split Number(x=w1) -> (high(x)=w5, low(x)=w6)
  Split Number(x=w5) -> (high(x)=w7, low(x)=w8)
  Split Number(x=w6) -> (high(x)=w9, low(x)=w10)
  Build Array(w7, w8, w9, w10) -> w11
  To Signed 32 Bit Integer(number=w2) -> w12
  To Signed 32 Bit Integer(number=w3) -> w13
  Split Number(x=w4) -> (high(x)=w14, low(x)=w15)
  Split Number(x=w14) -> (high(x)=w16, low(x)=w17)
  Split Number(x=w15) -> (high(x)=w18, low(x)=w19)
  Build Array(w16, w17, w18, w19) -> w20
  s1 = $"data in"  # shift register
  s2 = 0  # shift register
  s3 = 0  # shift register
  while {
    Feedback Node(initial value="find sync word", input=w21) -> w22
    # s1: remaining data
    # s2: packet length
    # (including header
    # and terminator)
    # w12: word length
    # w13: header length
    case (w22) {
      frame "find sync word" {
        call "Search U8 array.gvi"(array=s1, search string=w11) -> (index of sub string=w29, remaining array=w24)
        Is Greater Or Equal To 0(x=w29) -> w30
        Array Size(array=w24) -> (size(s)=w31)
        Is Greater Or Equal(x=w31, y=w13) -> w32
        Logical And(w30, w32) -> w23
        Select(s=w23, t="decode header", f=w22) -> w21
        w25 = s2
        w26 = default
        w27 = default
        w28 = default
      }
      frame "decode header" {
        call "DTP Check Header and CRC.gvi"(input data array=s1) -> (counter=w28, length=w33, header CRC ok=w34)
        case (w34) {
          frame False, Default {
            Delete From Array(inArray=s1, length (1)=4, index0=0) -> w24
          }
          frame True {
            w24 = s1
          }
        }
        Add(w12, w13) -> w35
        To Signed 32 Bit Integer(number=w33) -> w36
        Add(w36, w35) -> w25
        Select(s=w34, t="extract packet", f="find sync word") -> w21
        w23 = TRUE
        w26 = default
        w27 = default
      }
      frame "extract packet" {
        Array Size(array=s1) -> (size(s)=w37)
        Is Greater Or Equal(x=w37, y=s2) -> w38
        case (w38) {
          frame False, Default {
            w26 = u8[] []
            w24 = s1
            w25 = s2
            w27 = FALSE
          }
          frame True {
            # cut packet
            Split 1D Array(array=s1, index=s2) -> (first subarray=w39, second subarray=w24)
            # remove header
            Split 1D Array(array=w39, index=w13) -> (second subarray=w40)
            Array Size(array=w40) -> (size(s)=w41)
            Subtract(x=w41, y=w12) -> w42
            # cut off terminator
            # and compare to
            # reference
            Split 1D Array(array=w40, index=w42) -> (first subarray=w26, second subarray=w43)
            Is Equal[ComparisonMode=CompareAggregates](x=w43, y=w20) -> w27
            w25 = 0
          }
        }
        w21 = "find sync word"
        w23 = FALSE
        w28 = s3
      }
    }
    next s1 = w24
    next s2 = w25
    next s3 = w28
    continue if w23
  }
  $"data out" <- s1
  $packet <- w26
  $"packet valid" <- w27
  $"expected packet size" <- s2
  $counter <- s3
