vi "Close Pipe Writer.gvi"   [LabVIEW NXG 4.0.0]
# Closes all references accociated with pipe reader.
inputs:
  "error in": error
  "pipe writer": "Pipe Writer.gtype"  # A cluster containing all references accociated with a pipe writer.
outputs:
  "error out": error
types:
  "Pipe Writer.gtype" = cluster{"file name": string, "pipe file descriptor": i32}
uses:
  AFW::Common::Linux Pipes::System Calls::close.gvi
diagram:
  Property Node(instance in=$"pipe writer") -> ("pipe file descriptor"=w1)
  call "close.gvi"(error in=$"error in", file descriptor=w1) -> (error out=w2)
  $"error out" <- w2
