vi "Open Pipe Reader.gvi"   [LabVIEW NXG 4.0.0]
# Opens a Linux pipe for read.
# The pipe must be created beforehand.
inputs:
  "error in": error
  "file name": string  # Path to a Linux RT pipe.
  "pipe size": i32 = 65536  # Request pipe size
outputs:
  "error out": error
  "pipe reader": "Pipe Reader.gtype"  # A cluster containing all reference associated with the pipe reader.
  "new pipe size": i32  # Actual pipe size.
types:
  "Pipe Reader.gtype" = cluster{"file name": string, "pipe file descriptor": i32, "timer file descriptor": i32, "epoll file descriptor": i32}
uses:
  AFW::Common::Linux Pipes::System Calls::open.gvi
  AFW::Common::Linux Pipes::Set Pipe Size.gvi
  AFW::Common::Linux Pipes::System Calls::timerfd_create.gvi
  AFW::Common::Linux Pipes::System Calls::epoll_create.gvi
  AFW::Common::Linux Pipes::System Calls::epoll_ctl.gvi
diagram:
  w1 = 2048  # O_NONBLOCK
  w2 = 0  # O_RDONLY
  Logical Or(w2, w1) -> w3
  call "open.gvi"(error in=$"error in", pathname=$"file name", flags=w3) -> (error out=w4, file descriptor=w5)
  call "Set Pipe Size.gvi"(size=$"pipe size", error in=w4, file descriptor in=w5) -> (error out=w6, file descriptor out=w7, new size=w8)
  call "timerfd_create.gvi"(clock_id="monotonic", error in=w6) -> (file descriptor=w9, error out=w10)
  To Unsigned 64 Bit Integer(number=w7) -> w11
  call "epoll_create.gvi"(error in=w10) -> (error out=w12, file descriptor=w13)
  To Unsigned 64 Bit Integer(number=w9) -> w14
  call "epoll_ctl.gvi"(epoll file descriptor in=w13, operation="EPOLL_CTL_ADD", target file descriptor=w9, error in=w12, events=[1], epoll data=w14) -> (epoll file descriptor out=w15, error out=w16)
  call "epoll_ctl.gvi"(epoll file descriptor in=w15, operation="EPOLL_CTL_ADD", target file descriptor=w7, error in=w16, events=[1], epoll data=w11) -> (epoll file descriptor out=w17, error out=w18)
  Property Node(instance in="Pipe Reader.gtype" {all zero or empty}, "file name"=$"file name", "pipe file descriptor"=w7, "timer file descriptor"=w9, "epoll file descriptor"=w17) -> (instance out=w19)
  $"pipe reader" <- w19
  $"error out" <- w18
  $"new pipe size" <- w8
