vi "epoll_wait.gvi"   [LabVIEW NXG 4.0.0]
# Encapsulate system call and evaluates errno if call returns -1.
inputs:
  "error in": error
  "epoll file descriptor in": i32
  "max events": u32
  "timeout": i32 = -1
outputs:
  "error out": error
  "epoll file descriptor out": i32
  "events out": "epoll_events.gtype"
  "number of ready file descriptors": i32
types:
  "epoll_event_names.gtype" = u32
  "epoll_event.gtype" = cluster{"events": "epoll_event_names.gtype", "data": u64}
  "epoll_events.gtype" = "epoll_event.gtype"[]
uses:
  NI::G Core::Error::Build Error Cluster.gvi
  AFW::Common::Linux Pipes::System Calls::system calls.sli::epoll_wait
  AFW::Common::Linux Pipes::Convert Errno to LabVIEW Error.gvi
diagram:
  To Signed 32 Bit Integer(number=$"max events") -> w1
  Initialize Array(element="epoll_event.gtype" {all zero or empty}, size=w1) -> w2
  Type Cast(type="epoll_events.gtype" [], x=w2) -> w3
  disable {
    frame OS == "Win" {
      w8 = 1072  # not yet implemented
      call "Build Error Cluster.gvi"(code=w8, error in=$"error in") -> (error out=w4)
      w5 = default
      w6 = default
      w7 = default
    }
    frame OS == "Linux", Default {
      call "epoll_wait"(epfd in=$"epoll file descriptor in", events in=w3, max_events=$"max events", timeout in=$timeout, error in=$"error in") -> (return=w7, epfd out=w5, events out=w6, error out=w9)
      Is Less Than 0(x=w7) -> w10
      case (w10) {
        frame False, Default {
          w4 = w9
        }
        frame True {
          call "Convert Errno to LabVIEW Error.gvi"(error in=w9) -> (error out=w4)
        }
      }
    }
  }
  $"number of ready file descriptors" <- w7
  $"epoll file descriptor out" <- w5
  $"events out" <- w6
  $"error out" <- w4
