vi "read.gvi"   [LabVIEW NXG 4.0.0]
inputs:
  "error in": error
  "file descriptor in": i32
  "buffer in": u8[]
  "bytes to read": i32 = -1
outputs:
  "error out": error
  "file descriptor out": i32
  "buffer out": u8[]
  "bytes read": i32
uses:
  NI::G Core::Error::Build Error Cluster.gvi
  AFW::Common::Linux Pipes::System Calls::system calls.sli::read
  AFW::Common::Linux Pipes::Convert Errno to LabVIEW Error.gvi
diagram:
  disable {
    frame OS == "Win" {
      w5 = 1072  # not yet implemented
      call "Build Error Cluster.gvi"(code=w5, error in=$"error in") -> (error out=w3)
      w1 = default
      w2 = default
      w4 = default
    }
    frame OS == "Linux", Default {
      Is Less Than 0(x=$"bytes to read") -> w6
      Array Size(array=$"buffer in") -> (size(s)=w7)
      Select(s=w6, t=w7, f=$"bytes to read") -> w8
      call "read"(fd=$"file descriptor in", buf in=$"buffer in", count=w8, error in=$"error in") -> (return=w9, buf out=w1, error out=w10)
      Is Less Than 0(x=w9) -> w11
      case (w11) {
        frame False, Default {
          w3 = w10
          w2 = w9
        }
        frame True {
          call "Convert Errno to LabVIEW Error.gvi"(error in=w10) -> (error out=w3)
          w2 = 0
        }
      }
      w4 = $"file descriptor in"
    }
  }
  $"file descriptor out" <- w4
  $"buffer out" <- w1
  $"bytes read" <- w2
  $"error out" <- w3
