vi "write.gvi"   [LabVIEW NXG 4.0.0]
# Encapsulate system call and evaluates errno if call returns -1.
inputs:
  "error in": error
  "file descriptor in": i32
  "buffer in": u8[]
outputs:
  "error out": error
  "bytes written": i32
  "file descriptor out": i32
uses:
  NI::G Core::Error::Build Error Cluster.gvi
  AFW::Common::Linux Pipes::System Calls::system calls.sli::write
  AFW::Common::Linux Pipes::Convert Errno to LabVIEW Error.gvi
diagram:
  disable {
    frame OS == "Win" {
      w4 = 1072  # not yet implemented
      call "Build Error Cluster.gvi"(code=w4, error in=$"error in") -> (error out=w1)
      w2 = default
      w3 = default
    }
    frame OS == "Linux", Default {
      Array Size(array=$"buffer in") -> (size(s)=w5)
      call "write"(fd=$"file descriptor in", buf=$"buffer in", count=w5, error in=$"error in") -> (return=w6, error out=w7)
      Is Less Than 0(x=w6) -> w8
      case (w8) {
        frame False, Default {
          w1 = w7
          w2 = w6
        }
        frame True {
          call "Convert Errno to LabVIEW Error.gvi"(error in=w7) -> (error out=w1)
          w2 = 0
        }
      }
      w3 = $"file descriptor in"
    }
  }
  $"file descriptor out" <- w3
  $"bytes written" <- w2
  $"error out" <- w1
