vi "Log.gvi"   [LabVIEW NXG 4.0.0]
# It initializes logging queue and enables a notifier on initial call. It checks whether the log entry should be saved, then logging must be enabled, when it exceeds the current level threshold. If the logging is enabled, it writes the log entry to the queue. The logging cluster has the following information: the module name, the error message, the log level, and the time stamp.
inputs:
  "error in": error
  "log level": "Log Level.gtype" = "Trace"  # Set the log level to one of the following states: Trace, Debug, Info, Warn, Error, and Fatal
  "module": string  # Given module name for example FPGA.
  "message": string  # Reported error message.
  "automatic timestamp": bool = TRUE  # If it is true, the automatic creation of time stamp is enabled using the Tick Account function.
  "timestamp": u32  # Given time stamp
  "queue name": string  # Given queue name. If it is embty, logger will be given as a default name.
outputs:
  "error out": error
types:
  "Log Level.gtype" = enum{"Trace", "Debug", "Info", "Warn", "Error", "Fatal"}
  "Log Configuration.gtype" = cluster{"enabled": bool, "max log level": "Log Level.gtype"}
  "Log Message.gtype" = cluster{"Time Stamp": u32, "log level": "Log Level.gtype", "module": string, "message": string}
diagram:
  Is Empty String Or Path(string/path=$"queue name") -> w1
  case (w1) {
    frame True {
      w2 = $"error in"
      w3 = "logger"
    }
    frame False {
      Call Chain() -> (callchain=w4)
      Delete From Array(inArray=w4) -> (deleted=w5)
      Concatenate Strings("%s:", $"queue name") -> w6
      Format Into String(formatString=w6, errIn=$"error in", w5) -> (outString=w3, errOut=w2)
    }
  }
  Is First Call() -> w7
  Feedback Node(input=w8) -> w9
  Feedback Node(input=w10) -> w11
  case (w7) {
    frame False, Default {
      w12 = w2
      w10 = w11
      w8 = w9
    }
    frame True {
      # Initialize logging queue and enable
      # notifier on initial call.
      Obtain Queue(element data type="Log Message.gtype" {all zero or empty}, error in=w2, name=w3) -> (error out=w13, queue out=w10)
      Obtain Notifier(create if not found=TRUE, element data type="Log Configuration.gtype" {all zero or empty}, error in=w13, name="logger status") -> (error out=w12, notifier out=w8)
    }
  }
  # Check whether log entry should be saved.
  # Logging must be enabled and exceed the
  # current level threshold.
  Get Notifier Status(error in (no error)=w12, notifier=w8) -> (error out=w14, latest notification=w15)
  Property Node(instance in=w15) -> ("enabled"=w16, "max log level"=w17)
  Is Greater Or Equal(x=$"log level", y=w17) -> w18
  Logical And(w18, w16) -> w19
  case (w19) {
    frame False, Default {
      w20 = w14
    }
    frame True {
      Tick Count[Units=Microseconds]() -> (timer value=w21)
      Multiply(w21, 10) -> w22
      Select(s=$"automatic timestamp", t=w22, f=$timestamp) -> w23
      # write log entry to queue
      Property Node(instance in="Log Message.gtype" {all zero or empty}, "Time Stamp"=w23, "log level"=$"log level", "module"=$module, "message"=$message) -> (instance out=w24)
      Enqueue Element(element=w24, error in=w14, queue=w10) -> (error out=w20)
    }
  }
  $"error out" <- w20
