vi "Count Up U16.gvi"   [LabVIEW NXG 4.0.0]
inputs:
  "increment": bool = TRUE
  "reset": bool
outputs:
  "count out": u16
diagram:
  Feedback Node(initial value=0, input=w1) -> w2
  Increment(x=w2) -> w3
  Select(s=$increment, t=w3, f=w2) -> w4
  Select(s=$reset, t=0, f=w4) -> w1
  $"count out" <- w1
