vi "Host.gvi"   [LabVIEW NXG 4.0.0]
# Calculates the RF signal power on primary and secondary channels. Compares the RF signal power against CCA energy threshold and generated CCA indication based on energy detection.
# Latency: min 10 clock cycles
panel controls:
  "Trigger TX": bool  # A Boolean control to trigger a single TX packet.
  "Clear events": bool  # Boolean control to clear the events history from the front panel. The default register size of the events history is 10,000.
  "Primary Channel Selector": UFXP(2.0) = 1  # Numeric control to determine which subband is used as the primary channel. The PHY covers 80 MHz bandwidth, which can be divided into four subbands {0,…,3} of 20 MHz bandwidth for the non-high throughput (non-HT) signal. For wider bandwidths the subbands get combined. Visit ni.com/info and enter the Info Code 80211AppFWManual to access the LabVIEW Communications 802.11 Application Framework Manual for more information about channelization.
  "Transmit IP Address": string = "127.0.0.1"  # Destination IP address for the UDP output stream.
  "Transmit Port": u16 = 13000  # Target UDP port for UDP output stream, usually between 1,025 and 65,535.
  "Tab": i32
  "Power Level": f64  # Output power level considering the transmission of a continuous wave (CW) signal that has full digital to analog converter (DAC) range. The high peak-to-average power ratio of OFDM means that the output power of transmitted 802.11 frames is usually 9 dB to 12 dB below the adjusted power level.
  "Primary Channel Center Frequency": f64 = 2462000000  # It is the primary channel center frequency of the transmitter in Hz. Valid values depend on the device the station is running on.
  "TX RF Port": enum{"TX1/RF 0", "TX1/RF 1"} = "TX1/RF 0"  # The RF port used for TX (applicable only for USRP RIO devices).
  "RX RF Port": T1 = "RX2/RF 1"  # The RF port used for RX (applicable only for USRP RIO devices).
  "AGC": bool = TRUE  # If enabled, the optimum gain setting is chosen depending on the received signal power strength. The RX gain value is taken from Manual RX Gain if the AGC has been disabled.
  "Manual RX gain": f64 = 37.5  # Manual RX gain value. Applied if AGC is disabled.
  "PN Data Packet Size": i32 = 1024  # Packet size in bytes (range is limited to 4061, which is a single A-MPDU reduced by MAC overhead)
  "Subcarrier Format": "Subcarrier Format.gtype" = "20 MHz (IEEE 802.11 a)"
  "Stop": bool  # Boolean control to stop the station.
  "RIO Device": string = "RIO0"  # The RIO address of the RF hardware device.
  "Enable Station": bool = TRUE
  "reset TX staistics": bool  # A Boolean control to reset all counters of MAC TX Statistics cluster.
  "reset RX staistics": bool  # A Boolean control to reset all counters of MAC RX Statistics cluster.
  "PN Packets per Second": u32 = 1000  # Average number of packets to transmit per second (limited to 10,000. The achievable throughput might be less depending on the configuration of the station).
  "Backoff": i32 = -1  # Backoff value that is applied before a frame is transmitted. The backoff is counted in number of slots of 9 µs duration. Based on the backoff value, the backoff counting for the Backoff procedure could be fixed or random: If the backoff value is larger than or equal zero, a fixed backoff is used. If the backoff value is negative, a random backoff counting is used.
  "All": bool  # Boolean control to enable the events tracking of the above FPGA events.
  "None": bool  # Boolean control to disable the events tracking of the above FPGA events.
  "CCA Energy Detection Threshold": FXP(10.3) = -50  # If the energy of the received signal is above the threshold, the station qualifies the medium as busy and interrupts its Backoff procedure, if any. Set the CCA Energy Detection Threshold [dBm] control to a value which is higher than the minimal value of the current curve in the RF Input Power graph.
  "MCS": UFXP(4.0) = 4  # Modulation and coding scheme index used to encode data frames. ACK frames are always sent with MCS 0. Be aware that not all MCS values are applicable for all subcarrier formats and the meaning of the MCS changes with the subcarrier format. The text field next to the MCS field shows the modulation scheme and coding rate for the current MCS and Subcarrier Format.
  "session": "Host Session.gtype"
  "Data Source Options": i32 = 1
    # Each tab shows the options for the corresponding data sources.
    # UDP Tab—A free UDP port to retrieve data for the transmitter is derived inherently based on the station number.
    # PN Tab - PN Data Packet Size—Packet size in bytes (range is limited to 4061, which is a single A-MPDU reduced by MAC overhead)
    # PN Tab - PN Packets per Second—Average number of packets to transmit per second (limited to 10,000. The achievable throughput might be less depending on the configuration of the station).
    # Manual Tab – Trigger TX—A Boolean control to trigger a single TX packet.
  "Data Sink Option": i32  # It has the following required configurations for the UDP data sink option: · Transmit IP Address—Destination IP address for the UDP output stream. Transmit Port—Target UDP port for UDP output stream, usually between 1,025 and 65,535.
  "Data Source": T7 = "PN Data"
    # Determines the source of MAC frames send from the host to the target.
    # Off— This method is useful to disable transmitting TX data while the TX chain is active to trigger ACK packets.
    # UDP—This method is useful for showing demos, such as when using an external video streaming application, or for using external network testing tool, such as Iperf. In this method, input data arrives at or is generated from the 802.11 station using user datagram protocol (UDP).
    # PN Data—This method sends random bits and is useful for functional tests. Packet size and rate can be easily adapted.
    # Manual—This method is useful to trigger single packets for debugging purposes.
    # External—Allow a potential external upper MAC realization or other external applications to use the MAC & PHY functionalities provided by the 802.11 Application Framework.
  "Data Sink": enum{"Off", "UDP"} = "Off"  # It has the following options: Off—Data is discarded. UDP—If enabled, received frames are forwarded to the configured UDP address and port (see below).
  "Reference Clock": string = "Internal"
    # Configures the reference for the device clocks. The reference frequency must be 10 MHz. You can choose from the following sources:
    # Internal—Uses the internal reference clock.
    # REF IN / ClkIn—The reference is taken from the REF IN port (USRP-294xR, and USRP-295XR) or the ClkIn port (NI 5791).
    # GPS—The reference is taken from the GPS module. Only applicable for the USRP-2950/2952/2953 devices.
    # PXI_CLK—The reference is taken from the PXI chassis. Only applicable for PXIe-7975/7976 targets with NI-5791 adapter modules.
  "dot11RTSThreshold": u32 = 2000
    # Semi-static parameter used by frame sequence selection to decide whether RTS|CTS is allowed or not.
    # If the PSDU length, i.e. PN Data Packet Size, is larger than dot11RTSThreshold, the {RTS | CTS | DATA | ACK} frame sequence is used.
    # If the PSDU length, i.e. PN Data Packet Size, is less than or equal to the dot11RTSThreshold, the {DATA | ACK} frame sequence is used.
    # This mechanism allows stations to be configured to initiate RTS/CTS either always, never, or only on frames longer than a specified length.
  "dot11ShortRetryLimit": u16 = 7  # Semi-static parameter—Maximum number of retries applied for short MPDU type (sequences without RTS|CTS). If the number of retry limits is reached, discards MPDUs and associated MPDU configuration and TX vector.
  "dot11LongRetryLimit": u16 = 4  # Semi-static parameter—Maximum number of retries applied for long MPDU type (sequences including RTS|CTS). If the number of retry limits is reached, discards MPDUs and associated MPDU configuration and TX vector.
  "control frame TX vector configuration": T8  # Applies the configured MCS values in TX vectors for RTS, CTS or ACK frames. The default control frame configuration of those frames is Non-HT-OFDM and 20 MHz bandwidth while the MCS can be configured from the host.
  "FPGA events to track": "Events Enable Mask.gtype"  # It has a set of Boolean controls; each control is used to enable or disable the tracking of the corresponding FPGA event. Those events are as follows: PHY TX start request PHY TX end indication PHY RX start indication PHY RX end indication PHY CCA timing indication PHY RX gain change indication DCF state indication MAC MPDU RX indication MAC MPDU TX request
  "Device MAC Address": string = "46:6F:4B:75:6D:61"  # MAC address associated with the station. The Boolean Indicator shows if the given MAC address is valid or not. The MAC address validation is done in the dynamic mode.
  "Destination MAC Address": string = "46:6F:4B:75:6D:62"  # MAC address of the destination to which packets should be sent. The Boolean indicator shows if the given MAC address is valid or not. If running in RF loopback mode, the Destination MAC Address and the Device MAC Address should be similar.
  "log file prefix": string = "events.txt"  # Name a text file to write the FPGA events data that have been read from the Event DMA FIFO. They presented above in the FPGA events to track. Each event consists of a time stamp and the event data. The text file is created locally in the project folder. Only the selected events in the FPGA events to track above will be written in the text file.
  "write to file": bool  # Boolean control to enable or disable the writing process of the selected FPGA events to the text file.
  "AGC target signal power": FXP(10.3) = -20  # Target RX power in digital base band used if the AGC is enabled. The optimal value depends on the peak to average power ratio (PAPR) of the received signal. Set the AGC target signal power to a value larger than that presented in the Baseband RX Power graph.
  "Station Number": u16 = 1  # Numerical control to set the station number. Each running station should have a different number. It can be up to 10. If the user would like to increase the number of running stations, the cache of MSDU Sequence Number assignment and Duplicate Detection should be increased to the required value, since the default value is 10.
  "values per second": bool  # A Boolean control to show the MAC TX Statistics and MAC RX Statistics either the accumulated values since the last reset or the values per second.
  "RF loop back demo mode": bool
    # Boolean control to switch between the operation modes:
    # RF Multi-Station (Boolean is false): At least two stations are required in the setup, where each station acts as a single 802.11 device.
    # RF Loopback (Boolean is true):  A single device is required. This setup is useful for small demos using a single station. However, the implemented MAC features have some limitations in RF Loopback mode. The ACK packets are lost while the MAC TX is waiting for them; the DCF state machine on FPGA of MAC prevents this mode. Therefore, the MAC TX always reports a transmission failed. Hence, the reported TX packet error rate and the TX block error rate on the graphical indication of TX Error Rates are ones.
  "operation mode": T9 = "BB Data from Host"
  "file path": path = path "C:\\Users\\lab18\\OneDrive\\Документы\\802.11 Testbench\\full_20mhz.txt"
  "file for writing packet": path = path "C:\\Users\\lab18\\OneDrive\\Документы\\802.11 Testbench\\lol.txt"
  "trigger for writing packet": bool
panel indicators:
  "Events": string
  "Baseband RX Power": f64[][]  # Graphical indication displays the baseband signal power at packet start. The numerical indicator shows the actual receiver's baseband power. When the AGC is enabled, the 802.11 Application Framework attempts to keep this value at the given AGC target signal power in Advanced tab by changing the RX gain accordingly.
  "Coerced LO frequency TX": f64  # Actual used TX frequency on target.
  "Coerced LO frequency RX": f64  # Actual used RX frequency on target.
  "Channel Estimation": cluster{"Element 1": i32[], "Element 2": f64[]}[]  # Graphical indication shows the amplitude and phase of the estimated channel (based on L-LTF and VHT-LTF).
  "TX Error Rates": f64[][]  # Graphical indication shows the TX packet error rate and TX block error rate. The TX packet error rate is calculated as a ratio of successful MPDU transmitted to the number of transmission tries. The TX block error rate is calculated as a ratio of successful MPDU transmitted to the total number of transmission. The most recent values are displayed on the upper right of the graph.
  "Coerced Power Level": f64  # Power level of a continuous wave of 0 dBFS that provides for the current device settings. The average output power of 802.11 signals is approximately 10 dB below this level. Indicates the actual power level considering RF frequency and device-specific calibration values from the EEPROM.
  "RX Throughput": f64  # Graphical indication shows the data rate of successful received and decoded frames matching the Device MAC Address.
  "Applied RX Gain": f64  # A numerical indicator shows RX gain value currently applied. This value is the Manual RX Gain when the AGC is disabled, or the calculated RX gain when AGC is enabled. In both cases, the gain value is coerced by the capabilities of the device.
  "RX Throughput [bits/s]": f64  # Numerical indication shows the data rate of successful received and decoded frames matching the Device MAC Address.
  "current TX packet error rate": f64
  "RF Frequency": f64  # The RF center frequency after the adjustment based on the Primary Channel Selector control and the operating bandwidth.
  "Station Active": bool  # Boolean indicator shows if the station RF is active after enabling the station by setting the Enable Station control to On.
  "Device Ready": bool  # Boolean indicator shows if the device is ready. If you receive an error, try one of the following: Ensure your RIO device is connected properly. Check the configuration of RIO Device. Check the station number. It should be different if more than one station is running on the same host.
  "Baseband RX Power [dBFS]": f64
  "RX Constellation": c128[]  # Graphical indication shows the constellation of RX I/Q samples of the received data field.
  "RX Power Spectrum": T2  # A snapshot of the current baseband spectrum from the RX.
  "TX Power Spectrum": T2  # A snapshot of the current baseband spectrum from the TX.
  "Data Transfer": bool  # Indicates that the packets are successfully read from the given port. Look to video streaming for more details.
  "FIFO Full": bool  # Indicates that the socket buffer of the UDP reader is small to read the given data, so packets are dropped. Increase the socket buffer size.
  "FIFO Full": bool  # Indicates that the socket buffer of the UDP sender is small to receive the payload from the RX Data direct memory access (DMA) FIFO, so packets are dropped. Increase the socket buffer size.
  "Data Transfer": bool  # Indicates that the packets are successfully read from the DMA FIFO and forwarded to the given UDP port.
  "Compensated CFO": f64  # Carrier frequency offset detected by coarse frequency estimation unit. For FlexRIO/FlexRIO adapter module, set the reference clock to PXI_CLK or REF IN/ClkIn.
  "modulation and coding rate": string
  "Target FIFO Overflow": bool  # Boolean indicator that lights if there is an overflow in the target to host (T2H) first-in-first-out memory buffers (FIFOs). If one of the T2H FIFOs overflows, its information is no longer reliable. Those FIFOs are as follows: T2H RX Data overflow T2H Constellation overflow T2H RX Power Spectrum overflow T2H Channel Estimation overflow TX to RF FIFO overflow
  "RF Input Power": f64[][]  # Displays the current RF input power in dBm regardless of the type of incoming signal if an 802.11 packet has been detected. This indicator displays the RF input power, in dBm, currently being measured, as well as at the most recent packet start.
  "MAC RX statistics": "MAC RX Statistics.gtype"
    # Numerical indication shows the values of the following counters related to MAC RX. The presented values could be the accumulated values since the last reset or the values per second based on the status of the Boolean control values per second.
    # preamble detected (by the synchronization)
    # PHY service data units (PSDUs) received (frames with valid physical layer convergence procedure (PLCP) header, frames without format violations)
    # MPDU CRC OK (the frame check sequence (FCS) check passes)
    # RTS detected
    # CTS detected
    # Data detected
    # ACK detected
  "MAC TX statistics": "MAC TX Statistics.gtype"  # Numerical indication shows the values of the following counters related to MAC TX. The presented values could be the accumulated values since the last reset or the values per second based on the status of the Boolean control values per second. RTS Triggered CTS Triggered Data Triggered ACK Triggered
  "Averaged Retransmissions per Packet": f64  # Graphical indication shows the average number of transmission tries. The recent value is displayed on the upper right of the graph.
  "valid": bool  # Boolean indicator shows if the given Device MAC Address associated with the device station is valid.
  "valid": bool  # Boolean indicator shows if the given Destination MAC Address associated with the device station is valid.
  "Channelization": cluster{"x": f64, "y": f64}[][]  # Graphical indication shows which sub-band is used as the primary channel based on the Primary Channel Selector. The PHY covers 80 MHz bandwidth, which can be divided into four sub-bands {0,…,3} of 20 MHz bandwidth for the non-HT signal. For wider bandwidths (40 MHz or 80 MHz), the sub-bands get combined. Visit ni.com/info and enter the Info Code 80211AppFWManual to access the LabVIEW Communications 802.11 Application Framework Manual for more information about channelization.
  "Averaged Retransmissions p. Packet": f64
  "current TX block error rate": f64
  "Receive Port": u16  # Source UDP port of UDP input stream.
  "num packets source": u32  # Numerical indicator shows the number of packets that have been received from the data source (UDP, PN Data, or Manual).
  "transfer source": bool  # Boolean indicator shows that a data is receiving from the data source (the number of received packets is not zero).
  "num packets sink": u32  # Number of received packets at data sink from MAC high.
  "transfer sink": bool  # Boolean indicator shows that a data is receiving from the MAC high.
  "TX Indications Middle MAC": u32  # Numerical indicator shows the number of MAC TX Status Indications reported from MAC Middle to MAC high using the assigned UDP port located above it.
  "TX Requests to PHY": u32  # Numerical indicator shows the number of MAC MSDU TX requests written to the DMA FIFO.
  "RX Indications from PHY": u32  # : Numerical indicator shows the number of MAC MSDU RX indications read from the DMA FIFO.
  "RX Indications High MAC": u32  # Numerical indicator shows the number of MAC MSDU RX indications with valid MSDU data received at MAC high.
  "RX Indications Middle MAC": u32  # Numerical indicator shows the number of MAC MSDU RX indications that have been decoded correctly and reported to the MAC high using the assigned UDP port located above it.
  "TX Indications from PHY": u32  # Numerical indicator shows the number of MAC MSDU TX end indications read from the DMA FIFO.
  "TX Request High MAC": cluster{"Config": u32, "Payload": u32}  # Numerical indicators show the number of MAC TX Configuration and Payload request messages generated by the MAC high abstraction layer and written to the corresponding UDP port that is located under them.
  "TX Request Middle MAC": cluster{"Config": u32, "Payload": u32}  # Numerical indicators show the number of MAC TX Configuration and Payload request messages received from the MAC high abstraction layer and read from the corresponding UDP port that is located above them. Before transfer both messages to the lower layers, the given configurations are checked if they are supported or not, in addition, the MAC TX Configuration request and MAC TX Payload request are checked if they are consistence.
  "TX Confirmation Middle MAC": cluster{"Config": u32, "Payload": u32}  # Numerical indicators show the number of confirmation messages that have been generated by the MAC middle for the MAC TX Configuration and MAC TX Payload messages and written to the assigned UDP port located above them.
  "TX Indication Overflow Count": u16  # Numerical indicator shows the number of overflows that occurred during the FIFO writing by TX End indications.
  "TX Indication Overflow": bool
  "RX Indication Overflow Count": u16  # Numerical indicator shows the number of overflows that occurred during the FIFO writing by MAC MSDU RX indications.
  "RX Indication Overflow": bool
  "TX requests": u16  # Reference to the UDP socket used to send or receive the TX requests.
  "local TX confirmations": u16  # Reference to the UDP socket used to send or receive the TX confirmations.
  "local RX indications": u16  # Reference to the UDP socket used to send or receive the RX indications.
  "local TX indications": u16  # Reference to the UDP socket used to send or receive the TX indications.
  "Packets dropped count": u32  # Numerical indicator shows the number of MAC MSDU TX requests written to the DMA FIFO.
  "Packets dropped": bool
  "packet for writing": string
types:
  T1 = enum{"RX1/RF 0", "RX2/RF 0", "RX1/RF 1", "RX2/RF 1"}
  "Subcarrier Format.gtype" = enum{"20 MHz (IEEE 802.11 a)", "20 MHz (IEEE 802.11 ac)", "40 MHz (IEEE 802.11 ac)", "80 MHz (IEEE 802.11 ac)"}
  T2 = cluster{"f0": f64, "df": f64, "magnitude": f64[]}
  T3 = cluster{"Timestamp": u32, "Transferred Bytes": u32}
  T4 = cluster{"fpga ref": any, "bus instance": u32, "instruction FIFO depth": u32, "executing on FPGA target": bool, "show error call chain": bool}
  T5 = cluster{"Actual Gain [dB]": f64, "Attenuation Table Index": i32}
  T6 = cluster{"Attenuation Table [dB]": f64[][], "Frequencies [Hz]": f64[], "IQ Imbalance Table": "IQ Imbalance.gtype"[], "Gain Table": T5[][]}
  "Register Bus Session.gtype" = Queue<"Session Data.gtype">
  "Semaphore.gtype" = i32
  "DB Queue Reference.gtype" = Queue<"Daughterboard Data.gtype">
  "niUsrpRio Session.gtype" = cluster{"FPGA Interface": any, "RIO Interface Number": u32, "Data Clock Rate": u32, "FPGA Data Clock Rate": u32, "Global Settings Register Bus": "Register Bus Session.gtype", "Radio 0 Settings Register Bus": "Register Bus Session.gtype", "Radio 1 Settings Register Bus": "Register Bus Session.gtype", "Radio Settings Bus Semaphore": "Semaphore.gtype", "DB Queues": "DB Queue Reference.gtype"[], "Characterization Data Valid?": bool, "EEPROM Header": "EEPROM Header.gtype", "Device Data Header": "EEPROM Device Data Header.gtype", "EEPROM Characterization Header": "EEPROM Characterization Header.gtype", "Characterization Data": "Characterization Data.gtype"[], "FPGA Current Version": u32, "FPGA Oldest Compatible Version": u32, "Fixed Logic Current Version": u32, "Fixed Logic Oldest Compatible Version": u32, "FPGA Radio Settings Bus Current Version": u32, "FPGA Radio Settings Bus Oldest Compatible Version": u32, "FPGA Board Config Current Version": u32, "FPGA Board Config Oldest Compatible Version": u32, "Daughterboard Clock Rate": u32}
  "Host Session.gtype" = cluster{"station number": u16, "FPGA interface": "FGPA Reference.gtype", "MAC High Requests": Queue<u8[]>, "MAC High Confirmations": Queue<u8[]>, "Triggered TX Requests": Queue<"TX Request Confirmation Reference Parameters.gtype">, "receive queue": Queue<u8[]>, "receive throughput queue": Queue<T3>, "UDP Receiver": UdpNetworkConnectionRefnum, "PN packet": u8[], "FlexRIO session": Queue<T4>, "FlexRIO TX Characterization Data": T6, "FlexRIO RX Characterization Data": T6, "USRP session": "niUsrpRio Session.gtype", "RF loop clock frequency": f64, "UDP Receiver TX Request": UdpNetworkConnectionRefnum, "UDP Receiver TX Confirmation": UdpNetworkConnectionRefnum, "UDP Receiver RX Indication": UdpNetworkConnectionRefnum, "UDP Sender": UdpNetworkConnectionRefnum}
  T7 = enum{"Off", "UDP", "PN Data", "Manual", "External"}
  T8 = cluster{"RTS MCS": UFXP(4.0), "CTS MCS": UFXP(4.0), "ACK MCS": UFXP(4.0)}
  "MAC RX Statistics.gtype" = cluster{"preamble detected": u32, "PSDUs received": u32, "MPDU CRC OK": u32, "RTS detected": u32, "CTS detected": u32, "Data detected": u32, "ACK detected": u32}
  "MAC TX Statistics.gtype" = cluster{"RTS triggered": u32, "CTS triggered": u32, "Data triggered": u32, "ACK triggered": u32}
  "Events Enable Mask.gtype" = cluster{"PHY TX start request": bool, "PHY TX end indication": bool, "PHY RX start indication": bool, "PHY RX end indication": bool, "PHY CCA timing indication": bool, "PHY RX gain change indication": bool, "DCF state indication": bool, "MAC MPDU RX indication": bool, "MAC MPDU TX request": bool}
  T9 = enum{"Baseband Loopback", "RF Loopback", "RF Multi Station", "BB Data from Host"}
  "Log Level.gtype" = enum{"Trace", "Debug", "Info", "Warn", "Error", "Fatal"}
  "Log Configuration.gtype" = cluster{"enabled": bool, "max log level": "Log Level.gtype"}
  "TX Status.gtype" = enum{"MPDU transmitted", "MPDU discarded"}
  "MAC TX End Indication.gtype" = cluster{"TX status": "TX Status.gtype", "number of transmission tries": u16, "valid": bool}
uses:
  AFW::Common::Create Stop Notifier.gvi
  AFW::802_11::Configuration::Host Init.gvi
  AFW::Common::Logging::Change Log Configuration.gvi
  AFW::802_11::Transmission::Receive UDP Data.gvi
  AFW::802_11::Transmission::Send PN Data.gvi
  AFW::802_11::Transmission::Send UDP Data.gvi
  AFW::Common::Check Stop.gvi
  AFW::802_11::TX::Read BB Data.gvi
  AFW::Common::Stop On Error.gvi
  AFW::802_11::RF Control::Mute TX RF Frontend.gvi
  NI::G Core::Error::Legacy::Clear Errors.gvi
  AFW::802_11::Configuration::Reset Statistics.gvi
  AFW::802_11::Configuration::Configure Static Parameters.gvi
  AFW::802_11::Configuration::Configure MAC Parameters.gvi
  AFW::802_11::Configuration::Configure Data Source.gvi
  AFW::802_11::Configuration::UDP Port Assignment.gvi
  AFW::802_11::Configuration::Configure Dynamic Parameters.gvi
  AFW::802_11::RX::FPGA AGC Control.gvi
  AFW::802_11::RX::Gain Control.gvi
  AFW::802_11::Conversion::Subcarrier Format to Configuration.gvi
  AFW::802_11::Conversion::MAC Address from String to Byte Array.gvi
  AFW::Common::Create Stop.gvi
  AFW::802_11::Conversion::Prepare Constellation.gvi
  AFW::802_11::Conversion::Prepare RX Power Spectrum.gvi
  AFW::802_11::Conversion::Prepare TX Power Spectrum.gvi
  AFW::802_11::Conversion::Prepare Channel Estimation.gvi
  AFW::802_11::Conversion::Read T2H Overflows.gvi
  AFW::802_11::Conversion::Read Target Registers.gvi
  AFW::802_11::Conversion::Read Event FIFO.gvi
  AFW::802_11::Conversion::Log Events.gvi
  AFW::Common::Logging::Log Formatter.gvi
  AFW::802_11::Conversion::Prepare MAC TX and RX Statistics.gvi
  AFW::802_11::Conversion::Prepare Throughput Measurements.gvi
  AFW::802_11::Conversion::Prepare TX Block Error Rate Measurements.gvi
  AFW::802_11::MAC High Abstraction::Prepare MAC SAP TX Request.gvi
  AFW::802_11::MAC High Abstraction::MAC TX Request Confirm Abstraction.gvi
  AFW::802_11::MAC High Abstraction::Receive MAC RX Indications.gvi
  AFW::802_11::MAC High Abstraction::Clear and Log MAC Middle SAP errors.gvi
  NI::G Core::Error::Filter Error Code.gvi
  AFW::802_11::MAC Middle SAP::MAC SAP TX Request Confirmation Handler.gvi
  AFW::802_11::MAC Middle SAP::Generate MAC SAP TX Status Indication.gvi
  AFW::802_11::MAC Middle SAP::Generate MAC SAP RX Indication.gvi
  AFW::802_11::Configuration::Host Release.gvi
  NI::G Core::Error::Legacy::Simple Error Handler.gvi
diagram:
  sequence {
    frame 0 {
      $Events <- ""
      $"Device Ready" <- FALSE
      $"Station Active" <- FALSE
      $"Enable Station" <- FALSE
      $"Target FIFO Overflow" <- FALSE
      $"RX Constellation" <- c128[] []
      $"RX Power Spectrum" <- T2 {all zero or empty}
      $"TX Power Spectrum" <- T2 {all zero or empty}
      $"Channel Estimation" <- cluster{"Element 1": i32[], "Element 2": f64[]}[] []
      $"current TX packet error rate" <- 0
      $"current TX block error rate" <- 0
      $"RX Throughput [bits/s]" <- 0
      $"Compensated CFO" <- 0
      $"Averaged Retransmissions p. Packet" <- 0
      for (N = 51) {
        $"RX Throughput" <- NaN
        $"Averaged Retransmissions per Packet" <- NaN
      }
      Initialize Array(element=NaN, size=51, size=2) -> w1
      $"RF Input Power" <- w1
      $"Baseband RX Power" <- w1
      $"TX Error Rates" <- w1
      $"MAC RX statistics" <- "MAC RX Statistics.gtype" {all zero or empty}
      $"MAC TX statistics" <- "MAC TX Statistics.gtype" {all zero or empty}
    }
  }
  call "Create Stop Notifier.gvi"(error in=no error) -> (error out=w2)
  sequence {
    frame 0 {
      w3 = $"Reference Clock"
      w4 = $"RIO Device"
    }
  }
  call "Host Init.gvi"(device=w4, error in=w2, reference clock=w3) -> (session out=w5, error out=w6)
  case (w6) {
    frame Error {
      w7 = w6
    }
    frame No Error {
      $"Device Ready" <- TRUE
      $session <- w5
      w7 = w6
    }
  }
  Property Node(instance in="Log Configuration.gtype" {all zero or empty}, "enabled"=TRUE, "max log level"="Info") -> (instance out=w8)
  call "Change Log Configuration.gvi"(notification=w8, error in=w7) -> (error out=w9)
  s1 = w9  # shift register
  while {
    # data source and sink
    # (UDP send and receive)
    case ($"Station Active") {
      frame False, Default {
        w10 = s1
      }
      frame True {
        Property Node(instance in=$session) -> ("UDP Receiver"=w11, "MAC High Requests"=w12, "PN packet"=w13, "UDP Sender"=w14, "receive queue"=w15)
        Array Subset(array=w13, length0=$"PN Data Packet Size") -> w16
        case ($"Data Source") {
          frame "Off", "External" {
            w17 = s1
            w18 = FALSE
            w19 = FALSE
            w20 = 0
          }
          frame "UDP" {
            # UDP
            call "Receive UDP Data.gvi"(UDP receiver=w11, send queue=w12, error in=s1) -> (data transfer=w18, error out=w17, FIFO full=w19, num packets=w20)
          }
          frame "PN Data" {
            # PN data
            call "Send PN Data.gvi"(PN packets per second=$"PN Packets per Second", send queue=w12, PN data=w16, error in=s1) -> (data transfer=w18, error out=w17, FIFO full=w19, num packets=w20)
          }
          frame "Manual" {
            # Manual
            case ($"Trigger TX") {
              frame False, Default {
                w17 = s1
                w18 = $"Trigger TX"
                w19 = default
                w20 = default
              }
              frame True {
                Enqueue Element(element=w16, error in=s1, queue=w12, timeout in ms=0) -> (error out=w17, queue out=w21, timed out?=w19)
                w18 = $"Trigger TX"
                w20 = 1
              }
            }
          }
        }
        $"Data Transfer" <- w18
        $"FIFO Full" <- w19
        Is Not Equal To 0(x=w20) -> w22
        $"transfer source" <- w22
        Feedback Node(input=w23) -> w24
        Add(w20, w24) -> w23
        $"num packets source" <- w23
        Is Equal(x=$"Data Sink", y="UDP") -> w25
        call "Send UDP Data.gvi"(target port=$"Transmit Port", target IP address=$"Transmit IP Address", receive queue=w15, UDP sender=w14, enable=w25, error in=s1) -> (DNS resolve failed=w26, FIFO full=w27, error out=w28, data transfer=w29, num packets=w30)
        $"Data Transfer" <- w29
        $"FIFO Full" <- w27
        Is Not Equal To 0(x=w30) -> w31
        $"transfer sink" <- w31
        Merge Errors(w17, w28) -> (error out=w10)
        Feedback Node(input=w32) -> w33
        Add(w30, w33) -> w32
        $"num packets sink" <- w32
        case (w26) {
          frame False, Default { }
          frame True {
            $"Data Sink" <- "Off"
            w34 = "DNS resolve of Transmit IP Address failed, disabled Data Sink"
            One Button Dialog(message=w34)
          }
        }
      }
    }
    call "Check Stop.gvi"(error in=w10) -> (error out=w35, stop=w36)
    Wait Until Next Multiple(multiple to wait=1)
    Property Node(instance in=$session) -> ("FPGA interface"=w37)
    Is Equal(x=$"operation mode", y="BB Data from Host") -> w38
    case (w38) {
      frame False, Default {
        w39 = s1
        w40 = default
      }
      frame True {
        call "Read BB Data.gvi"(file path=$"file path", fpga ref=w37, error in=s1) -> (ref out=w40, error out=w39)
      }
    }
    next s1 = w35
    stop if w36
  }
  Is Not A Number Or Path Or Refnum(number=w40) -> w41
  # close file if the reference still exists
  case (w41) {
    frame True {
      w42 = w39
    }
    frame False {
      Close File(error in=w39, refnum=w40) -> (error out=w42)
    }
  }
  call "Stop On Error.gvi"(error in=w42) -> (error out=w43)
  call "Stop On Error.gvi"(error in=s1) -> (error out=w44)
  Merge Errors(w44, w43) -> (error out=w45)
  w46 = ["MAC High Stub", "MAC Middle SAP"]  # Timed Loop Names
  s2 = w9  # shift register
  while {
    Feedback Node(input=$"Enable Station") -> w47
    Logical Exclusive Or($"Enable Station", w47) -> w48
    case (w48) {
      frame False, Default {
        w49 = s2
      }
      frame True {
        case ($"Enable Station") {
          frame False, Default {
            Property Node(instance in=$session) -> ("UDP Receiver"=w50, "FPGA interface"=w51, instance out=w52)
            sequence {
              frame 0 {
                $"Station Active" <- FALSE
              }
            }
            Property Node(instance in=w51, "station active"=FALSE, error in=s2) -> (error out=w53, instance out=w54)
            # Removed Abort RF Streams
            call "Mute TX RF Frontend.gvi"(session=w52, error in=w53) -> (error out=w55)
            Property Node(instance in=w54, "produce silent samples"=TRUE, "RX data source"="BB Data From Host", error in=w55) -> (error out=w56)
            # Removed Abort RF Streams
            sequence {
              frame 0 {
                Wait(time to wait=100)
              }
            }
            Udp Close(connection ID=w50, error in=w56) -> (error out=w57)
            call "Clear Errors.gvi"(specific error code to clear=1, error in=w57) -> (error out=w49)
          }
          frame True {
            w58 = $"Station Number"
            Is Equal(x=$"Data Source", y="External") -> w59
            # Removed FPGA Traget Conf
            case ($"RF loop back demo mode") {
              frame True {
                w60 = 1
                w61 = 1
                w62 = 0x5000
                w63 = "RF Loopback"
              }
              frame False {
                w60 = $dot11LongRetryLimit
                w61 = $dot11ShortRetryLimit
                w62 = $dot11RTSThreshold
                w63 = $"operation mode"
              }
            }
            Property Node(instance in=$session, "station number"=w58) -> (instance out=w64)
            call "Reset Statistics.gvi"(session in=w64, reset RX statistics=TRUE, reset TX statistics=TRUE, error in=s2) -> (session dup=w65, error out=w66)
            call "Configure Static Parameters.gvi"(TX advance=19, session in=w65, error in=w66, operation mode=w63, primary channel selector=$"Primary Channel Selector") -> (session dup=w67, error out=w68)
            # Removed Chan Visual
            # Removed Conf RF
            call "Configure MAC Parameters.gvi"(session in=w67, MAC address=$"Device MAC Address", dot11RTSThreshold=w62, control frame TX vector configuration=$"control frame TX vector configuration", error in=w68, dot11ShortRetryLimit=w61, dot11LongRetryLimit=w60) -> (session dup=w69, error out=w70)
            # Removed Power Calibr Offsset
            # Removed Conf RF Streams
            call "Configure Data Source.gvi"(session in=w69, error in=w70, external mode=w59) -> (session out=w71, success?=w72, error out=w49)
            sequence {
              frame 0 {
                $session <- w71
                call "UDP Port Assignment.gvi"(station number=w58, external mode=w59) -> (UDP data=w73, TX requests=w74, local TX confirmations=w75, local RX indications=w76, local TX indications=w77)
              }
              frame 1 {
                $"Enable Station" <- w72
                $"Station Active" <- w72
                $"Receive Port" <- w73
                $"TX requests" <- w74
                $"local TX confirmations" <- w75
                $"local TX indications" <- w77
                $"local RX indications" <- w76
              }
            }
            # Removed Conf AGC Regs
            $Channelization <- cluster{"x": f64, "y": f64}[][] []
            $"Coerced Power Level" <- 0
            $"Applied RX Gain" <- 0
            $"Coerced LO frequency TX" <- 0
            $"Coerced LO frequency RX" <- 0
            $"RF Frequency" <- 0
          }
        }
      }
    }
    # configuration
    Feedback Node(input=$"Station Active") -> w78
    case ($"Station Active") {
      frame False, Default {
        w79 = s2
      }
      frame True {
        Property Node(instance in=$session) -> ("FPGA interface"=w80, instance out=w81)
        Is Not Equal(x=$"Station Active", y=w78) -> w82
        Select(s=$"RF loop back demo mode", t=0, f=$Backoff) -> w83
        To Double Precision Float(number=$"AGC target signal power") -> w84
        call "Configure Dynamic Parameters.gvi"(AGC target signal power=w84, FPGA interface=w80, backoff=w83, error in=s2, CCA energy detection threshold=$"CCA Energy Detection Threshold", event enable mask=$"FPGA events to track") -> (error out=w85)
        disable {
          frame Enabled {
            w86 = default
            w79 = default
          }
          frame Disabled {
            call "FPGA AGC Control.gvi"(session=w81, AGC=$AGC, initialize=w82, error in=w85, RX Port (USRP only)=$"RX RF Port") -> (session dup=w87, force host AGC update=w88, error out=w89)
            call "Gain Control.gvi"(Manual RX gain [dB]=$"Manual RX gain", initialize=w82, session=w87, force update=w88, AGC=$AGC, error in=w89, RX Port (USRP only)=$"RX RF Port") -> (Applied RX Gain [dB]=w86, error out=w79)
          }
        }
        $"Applied RX Gain" <- w86
      }
    }
    call "Reset Statistics.gvi"(session in=$session, reset RX statistics=$"reset RX staistics", reset TX statistics=$"reset TX staistics", error in=s2) -> (error out=w90)
    call "Subcarrier Format to Configuration.gvi"(MCS=$MCS, Subcarrier Format=$"Subcarrier Format", error in=w90) -> (modulation and coding rate=w91, error out=w92)
    call "MAC Address from String to Byte Array.gvi"(error in=w92, MAC address in=$"Device MAC Address") -> (error out=w93, MAC address valid=w94)
    call "MAC Address from String to Byte Array.gvi"(error in=w93, MAC address in=$"Destination MAC Address") -> (error out=w95, MAC address valid=w96)
    Merge Errors(w79, w49, w95) -> (error out=w97)
    # disable station in last loop run and assert stop
    Feedback Node(input=$Stop) -> w98
    call "Create Stop.gvi"(error in=w97, stop in=w98, timed loop name array=w46) -> (error out=w99)
    call "Check Stop.gvi"(error in=w99) -> (error out=w100, stop=w101)
    case ($Stop) {
      frame False, Default { }
      frame True {
        $"Enable Station" <- FALSE
      }
    }
    Wait Until Next Multiple(multiple to wait=100)
    $valid <- w94
    $valid <- w96
    $"modulation and coding rate" <- w91
    next s2 = w100
    stop if w101
  }
  call "Stop On Error.gvi"(error in=s2) -> (error out=w102)
  s3 = w9  # shift register
  s4 = string[] []  # shift register
  s5 = uninitialised  # shift register
  while (iteration -> i1) {
    Property Node(instance in=$session) -> ("FPGA interface"=w103)
    Quotient And Remainder(x=i1, y=5) -> (x-y*floor(x/y)=w104)
    # update plots and indicators (slow)
    case (w104) {
      frame 0, Default {
        call "Prepare Constellation.gvi"(FPGA interface=w103, maximal number of subcarriers=4800, error in=s3) -> (data field constellation=w108, update constellation=w109, error out=w105)
        Logical And($"Station Active", w109) -> w110
        case (w110) {
          frame False { }
          frame True {
            $"RX Constellation" <- w108
          }
        }
        w106 = s4
        w107 = s5
      }
      frame 1 {
        call "Prepare RX Power Spectrum.gvi"(FPGA interface=w103, error in=s3) -> (RX power spectrum=w111, update power spectrum=w112, error out=w105)
        Logical And($"Station Active", w112) -> w113
        case (w113) {
          frame False, Default { }
          frame True {
            $"RX Power Spectrum" <- w111
          }
        }
        w106 = s4
        w107 = s5
      }
      frame 2 {
        call "Prepare TX Power Spectrum.gvi"(FPGA interface=w103, error in=s3) -> (TX power spectrum=w114, update power spectrum=w115, error out=w105)
        Logical And($"Station Active", w115) -> w116
        case (w116) {
          frame False, Default { }
          frame True {
            $"TX Power Spectrum" <- w114
          }
        }
        w106 = s4
        w107 = s5
      }
      frame 3 {
        call "Prepare Channel Estimation.gvi"(FPGA interface=w103, error in=s3) -> (channel estimation=w117, update power spectrum=w118, error out=w105)
        Logical And($"Station Active", w118) -> w119
        case (w119) {
          frame False, Default { }
          frame True {
            $"Channel Estimation" <- w117
          }
        }
        w106 = s4
        w107 = s5
      }
      frame 4 {
        call "Read T2H Overflows.gvi"(FPGA interface=w103, error in=s3) -> (TX end indication overflow count=w120, T2H RX Data overflow=w121, error out=w122)
        $"TX Indication Overflow Count" <- w120
        Is Not Equal To 0(x=w120) -> w123
        $"TX Indication Overflow" <- w123
        $"RX Indication Overflow Count" <- w121
        Is Not Equal To 0(x=w121) -> w124
        $"RX Indication Overflow" <- w124
        call "Read Target Registers.gvi"(FPGA interface=w103, error in=s3, station active=$"Station Active") -> (MAC TX statistics=w125, MAC RX statistics=w126, target FIFO overflow=w127, compensated CFO=w128, RF input power=w129, baseband signal power=w130, error out=w131)
        w132 = 10000  # max log entries
        call "Read Event FIFO.gvi"(FPGA interface=w103, error in=s3) -> (FPGA interface dup=w133, raw events=w134, error out=w135)
        call "Log Events.gvi"(FPGA interface=w133, raw event data=w134, error in=w135, maximal number of log entries=w132) -> (dropped events=w136, error out=w137)
        call "Log Formatter.gvi"(error in=w137) -> (error out=w138, log entries=w139)
        Feedback Node(input=$"write to file") -> w140
        Is Not Equal(x=$"write to file", y=w140) -> w141
        case (w141) {
          frame False, Default {
            w142 = s5
            w143 = s3
          }
          frame True {
            case ($"write to file") {
              frame False, Default {
                Close File(error in=s3, refnum=s5) -> (error out=w143)
                w142 = default
              }
              frame True {
                Get Component Directory() -> (Path=w144)
                Get Current Time() -> (current time=w145)
                Format Date Time String(time format string (%c)="_%Y-%m-%d_%H-%M-%S", time stamp=w145) -> (date/time string=w146)
                Concatenate Strings($"log file prefix", w146, ".txt") -> w147
                Build Path(base path=w144, name or relative path=w147) -> (appended path=w148)
                # reopen file if file name changed
                Open Or Create Or Replace File(access (0:read/write)="write-only", error in=s3, file path (use dialog)=w148, operation (0:open)="replace or create") -> (error out=w143, refnum out=w142)
              }
            }
          }
        }
        case (w136) {
          frame False, Default {
            w149 = w139
          }
          frame True {
            Array Subset(array=w139, index0=1) -> w150
            Build Array("(...)\n", w150) -> w149
          }
        }
        case ($"write to file") {
          frame False, Default {
            w107 = w142
            w151 = w143
          }
          frame True {
            Concatenate Strings(w149) -> w152
            Write To Text File(error in=w143, file (use dialog)=w142, text=w152) -> (error out=w151, refnum out=w107)
          }
        }
        Merge Errors(w122, w131, w138, w151) -> (error out=w105)
        $"Target FIFO Overflow" <- w127
        $"Compensated CFO" <- w128
        $"RF Input Power" <- w129
        $"Baseband RX Power" <- w130
        Array Index(array=w130) -> (out0[0, 1]=w153)
        $"Baseband RX Power [dBFS]" <- w153
        Quotient And Remainder(x=i1, y=20) -> (x-y*floor(x/y)=w154)
        Is Equal To 0(x=w154) -> w155
        call "Prepare MAC TX and RX Statistics.gvi"(MAC RX statistics in=w126, MAC TX statistics in=w125, values per second=$"values per second", 1s passed=w155) -> (MAC RX statistics out=w156, MAC TX statistics out=w157)
        $"MAC RX statistics" <- w156
        $"MAC TX statistics" <- w157
        Build Array(s4, w149) -> w158
        Array Size(array=w158) -> (size(s)=w159)
        Is Greater(x=w159, y=w132) -> w160
        case (w160) {
          frame False, Default {
            w161 = w158
          }
          frame True {
            Decrement(x=w132) -> w162
            Delete From Array(inArray=w158, length (1)=w162) -> (deleted=w163)
            case (w136) {
              frame True {
                w161 = w163
              }
              frame False {
                Build Array("(...)\n", w163) -> w161
              }
            }
          }
        }
        Select(s=$"Clear events", t=string[] [], f=w161) -> w106
        Concatenate Strings(w161) -> w164
        $Events <- w164
        Select(s=$None, t="Events Enable Mask.gtype" {all zero or empty}, f=$"FPGA events to track") -> w165
        w166 = "Events Enable Mask.gtype" {"PHY TX start request"=TRUE, "PHY TX end indication"=TRUE, "PHY RX start indication"=TRUE, "PHY RX end indication"=TRUE, "PHY CCA timing indication"=TRUE, "PHY RX gain change indication"=TRUE, "DCF state indication"=TRUE, "MAC MPDU RX indication"=TRUE, "MAC MPDU TX request"=TRUE}
        Select(s=$All, t=w166, f=w165) -> w167
        $"FPGA events to track" <- w167
      }
    }
    call "Check Stop.gvi"(error in=w105) -> (error out=w168, stop=w169)
    Wait(time to wait=50)
    Host Fifo Read Node[FifoName="AFW::802_11::Resources::802.11 AFW Resources.grsc::RF2FILE FIFO"](number of elements=0, reference in=w103, timeout (ms)=-1) -> (elements remaining=w170, reference out=w171)
    Is Greater Than 0(x=w170) -> w172
    case (w172) {
      frame False, Default { }
      frame True {
        Host Fifo Read Node[FifoName="AFW::802_11::Resources::802.11 AFW Resources.grsc::RF2FILE FIFO"](number of elements=1, reference in=w171, timeout (ms)=-1) -> (data=w173)
        Number To Hexadecimal String(number=w173) -> (hex integer string=w174)
        Concatenate Strings(w174, " ") -> w175
        Feedback Node(initial value="", input=w176) -> w177
        Concatenate Strings(w177, w175) -> w176
        Feedback Node(initial value=TRUE, input=$"trigger for writing packet") -> w178
        Is Less(x=w178, y=$"trigger for writing packet") -> w179
        case (w179) {
          frame False, Default { }
          frame True {
            Write To Text File(file (use dialog)=$"file for writing packet", text=w176)
          }
        }
        $"packet for writing" <- w176
      }
    }
    next s3 = w168
    next s4 = w106
    next s5 = w107
    stop if w169
  }
  Is Not A Number Or Path Or Refnum(number=s5) -> w180
  # close file if the reference still exists
  case (w180) {
    frame True {
      w181 = s3
    }
    frame False {
      Close File(error in=s3, refnum=s5) -> (error out=w181)
    }
  }
  call "Stop On Error.gvi"(error in=w181) -> (error out=w182)
  Obtain Queue(element data type="MAC TX End Indication.gtype" {all zero or empty}, error in=w9) -> (error out=w183, queue out=w184)
  s6 = w183  # shift register
  while {
    Feedback Node(input=$"Station Active") -> w185
    Is Not Equal(x=$"Station Active", y=w185) -> w186
    # update plots and indicators (fast)
    case ($"Station Active") {
      frame False, Default {
        w187 = s6
      }
      frame True {
        Property Node(instance in=$session) -> ("FPGA interface"=w188, "receive throughput queue"=w189)
        call "Prepare Throughput Measurements.gvi"(FPGA interface=w188, receive throughput queue=w189, reset=w186, error in=s6, timing granularity=100) -> (RX throughput=w190, error out=w191)
        Flush Queue(error in=w191, queue=w184) -> (error out=w187, remaining elements=w192)
        call "Prepare TX Block Error Rate Measurements.gvi"(TX Status and retransmission data=w192) -> (current TX packet error rate=w193, current TX block error rate=w194, TX Error Rates=w195, averaged retransmissions per packet=w196)
        $"current TX packet error rate" <- w193
        $"current TX block error rate" <- w194
        $"TX Error Rates" <- w195
        $"Averaged Retransmissions per Packet" <- w196
        $"Averaged Retransmissions p. Packet" <- w196
        $"RX Throughput [bits/s]" <- w190
        Divide(x=w190, y=1000000) -> w197
        $"RX Throughput" <- w197
      }
    }
    call "Check Stop.gvi"(error in=w187) -> (error out=w198, stop=w199)
    Wait(time to wait=100)
    next s6 = w198
    stop if w199
  }
  call "Stop On Error.gvi"(error in=s6) -> (error out=w200)
  Array Index(array=w46) -> (out0[_]=w201, out1[_]=w202)
  disable {
    frame TARGET_TYPE == "RT" {
      timed loop forever {
        Left Execution System Border Node(priority_in=100)
        Left Timing Statistics Border Node()
        Left Timing Source Border Node[AlarmName=L, DefaultTimingSourceName="1 kHz", DefaultTimingSourceType=1](period_in=1, structure_in=w201)
        Left Timing Error Border Node(error_in=w9) -> (error_out=w205)
        # MAC High Stub
        Is Not Equal(x=$"Data Source", y="External") -> w206
        Logical And(w206, $"Station Active") -> w207
        case (w207) {
          frame False, Default {
            w208 = w205
          }
          frame True {
            w209 = $session
            Property Node(instance in=w209) -> ("MAC High Requests"=w210)
            Flush Queue(error in=w205, queue=w210) -> (error out=w211, remaining elements=w212)
            Array Subset(array=w212, length0=30) -> w213
            s7 = w211  # shift register
            for (iteration -> i2) {
              w214 = each element of w213
              Property Node(instance in=w209) -> ("station number"=w215, "UDP Sender"=w216)
              Property Node(instance in=w214) -> ("Element 0"=w217)
              Select(s=$"RF loop back demo mode", t=$"Device MAC Address", f=$"Destination MAC Address") -> w218
              call "Prepare MAC SAP TX Request.gvi"(payload=w217, subcarrier format=$"Subcarrier Format", MCS=$MCS, error in=s7, device MAC address=$"Device MAC Address", destination MAC address=w218) -> (MSDU TX parameters=w219, PHY TX parameters=w220, MSDU TX payload=w221, error out=w222)
              To Unsigned 8 Bit Integer(number=w215) -> w223
              call "MAC TX Request Confirm Abstraction.gvi"(UDP connection ID in=w216, MSDU TX parameters=w219, PHY TX parameters=w220, MSDU TX payload=w221, error in=w222, instance ID=w223) -> (error out=w224)
              Increment(x=i2) -> w225
              To Unsigned 32 Bit Integer(number=w225) -> w226
              Property Node(instance in=cluster{"Config": u32, "Payload": u32} {all zero or empty}, "Config"=w226, "Payload"=w226) -> (instance out=w227)
              next s7 = w224
            }
            Property Node(instance in=w209) -> ("receive queue"=w228, "UDP Receiver RX Indication"=w229, "FPGA interface"=w230)
            Property Node(instance in=w230, error in=w205) -> ("device bandwidth"=w231, error out=w232)
            s8 = w232  # shift register
            while {
              call "Receive MAC RX Indications.gvi"(UDP interface in=w229, error in=s8, device bandwidth=w231) -> (MSDU data=w234, MSDU data valid=w235, timeout=w236, error out=w237)
              case (w235) {
                frame False, Default {
                  w238 = w237
                }
                frame True {
                  Enqueue Element(element=w234, error in=w237, queue=w228, timeout in ms=-1) -> (error out=w238)
                }
              }
              call "Clear and Log MAC Middle SAP errors.gvi"(error in=w238) -> (error out=w239)
              append TRUE to w233 if w235
              next s8 = w239
              stop if w236
            }
            Merge Errors(s7, s8) -> (error out=w208)
            Feedback Node(input=w240) -> w241
            Add(w227, w241) -> w240
            $"TX Request High MAC" <- w240
            Array Size(array=w233) -> (size(s)=w242)
            To Unsigned 32 Bit Integer(number=w242) -> w243
            Feedback Node(input=w244) -> w245
            Add(w243, w245) -> w244
            $"RX Indications High MAC" <- w244
          }
        }
        Right Timing Error Border Node(error_in=w208) -> (error_out=w246)
      }
      call "Filter Error Code.gvi"(code to clear=-816, error in=w246) -> (error out=w203)
      timed loop forever {
        Left Execution System Border Node(priority_in=100)
        Left Timing Statistics Border Node()
        Left Timing Source Border Node[AlarmName=L, DefaultTimingSourceName="1 kHz", DefaultTimingSourceType=1](period_in=1, structure_in=w202)
        Left Timing Error Border Node(error_in=w9) -> (error_out=w247)
        # Middle MAC SAP
        case ($"Station Active") {
          frame False, Default {
            w248 = w247
          }
          frame True {
            Property Node(instance in=$session) -> ("station number"=w249, "FPGA interface"=w250, "UDP Receiver TX Request"=w251, "UDP Sender"=w252, "Triggered TX Requests"=w253, "receive throughput queue"=w254)
            Is Equal(x=$"Data Source", y="External") -> w255
            To Unsigned 8 Bit Integer(number=w249) -> w256
            call "MAC SAP TX Request Confirmation Handler.gvi"(FPGA interface=w250, UDP connection TX request=w251, UDP send connection=w252, TX request confirmation reference queue in=w253, error in=w247, instance ID=w256, external mode=w255) -> (num TX Request=w257, num TX Confirmation=w258, num packets to FPGA=w259, num packets dropped=w260, error out=w261)
            $"TX Request Middle MAC" <- w257
            $"TX Confirmation Middle MAC" <- w258
            $"TX Requests to PHY" <- w259
            $"Packets dropped count" <- w260
            Feedback Node(input=w260) -> w262
            Is Not Equal(x=w260, y=w262) -> w263
            $"Packets dropped" <- w263
            call "Generate MAC SAP TX Status Indication.gvi"(FPGA interface=w250, TX request confirmation reference queue in=w253, UDP send connection=w252, TX status and retransmission queue=w184, error in=w247, instance ID=w256, external mode=w255) -> (num indications received=w264, num indications triggered=w265, error out=w266)
            call "Generate MAC SAP RX Indication.gvi"(FPGA interface=w250, receive throughput queue=w254, UDP send connection=w252, error in=w247, instance ID=w256, external mode=w255) -> (num indications received=w267, num indications triggered=w268, error out=w269)
            Merge Errors(w261, w266, w269) -> (error out=w248)
            $"TX Indications from PHY" <- w264
            $"TX Indications Middle MAC" <- w265
            $"RX Indications from PHY" <- w267
            $"RX Indications Middle MAC" <- w268
          }
        }
        Right Timing Error Border Node(error_in=w248) -> (error_out=w270)
      }
      call "Filter Error Code.gvi"(code to clear=-816, error in=w270) -> (error out=w204)
    }
    frame TARGET_TYPE != "RT", Default {
      s9 = w9  # shift register
      while {
        # MAC High Stub
        Is Not Equal(x=$"Data Source", y="External") -> w271
        Logical And(w271, $"Station Active") -> w272
        case (w272) {
          frame False, Default {
            w273 = s9
          }
          frame True {
            w274 = $session
            Property Node(instance in=w274) -> ("MAC High Requests"=w275)
            Flush Queue(error in=s9, queue=w275) -> (error out=w276, remaining elements=w277)
            Array Subset(array=w277, length0=200) -> w278
            s10 = w276  # shift register
            for (iteration -> i3) {
              w279 = each element of w278
              Property Node(instance in=w274) -> ("station number"=w280, "UDP Sender"=w281)
              Property Node(instance in=w279) -> ("Element 0"=w282)
              Select(s=$"RF loop back demo mode", t=$"Device MAC Address", f=$"Destination MAC Address") -> w283
              call "Prepare MAC SAP TX Request.gvi"(payload=w282, subcarrier format=$"Subcarrier Format", MCS=$MCS, error in=s10, device MAC address=$"Device MAC Address", destination MAC address=w283) -> (MSDU TX parameters=w284, PHY TX parameters=w285, MSDU TX payload=w286, error out=w287)
              To Unsigned 8 Bit Integer(number=w280) -> w288
              call "MAC TX Request Confirm Abstraction.gvi"(UDP connection ID in=w281, MSDU TX parameters=w284, PHY TX parameters=w285, MSDU TX payload=w286, error in=w287, instance ID=w288) -> (error out=w289)
              Increment(x=i3) -> w290
              To Unsigned 32 Bit Integer(number=w290) -> w291
              Property Node(instance in=cluster{"Config": u32, "Payload": u32} {all zero or empty}, "Config"=w291, "Payload"=w291) -> (instance out=w292)
              next s10 = w289
            }
            Property Node(instance in=w274) -> ("receive queue"=w293, "UDP Receiver RX Indication"=w294, "FPGA interface"=w295)
            Property Node(instance in=w295, error in=s9) -> ("device bandwidth"=w296, error out=w297)
            s11 = w297  # shift register
            for (N = 200) {
              call "Receive MAC RX Indications.gvi"(UDP interface in=w294, error in=s11, device bandwidth=w296) -> (MSDU data=w299, MSDU data valid=w300, timeout=w301, error out=w302)
              case (w300) {
                frame False, Default {
                  w303 = w302
                }
                frame True {
                  Enqueue Element(element=w299, error in=w302, queue=w293, timeout in ms=-1) -> (error out=w303)
                }
              }
              call "Clear and Log MAC Middle SAP errors.gvi"(error in=w303) -> (error out=w304)
              append TRUE to w298 if w300
              next s11 = w304
              stop if w301
            }
            Merge Errors(s10, s11) -> (error out=w273)
            Feedback Node(input=w305) -> w306
            Add(w292, w306) -> w305
            $"TX Request High MAC" <- w305
            Array Size(array=w298) -> (size(s)=w307)
            To Unsigned 32 Bit Integer(number=w307) -> w308
            Feedback Node(input=w309) -> w310
            Add(w308, w310) -> w309
            $"RX Indications High MAC" <- w309
          }
        }
        call "Check Stop.gvi"(error in=w273) -> (error out=w311, stop=w312)
        Wait(time to wait=10)
        next s9 = w311
        stop if w312
      }
      s12 = w9  # shift register
      while {
        Wait(time to wait=10)
        # Middle MAC SAP
        case ($"Station Active") {
          frame False, Default {
            w313 = s12
          }
          frame True {
            Property Node(instance in=$session) -> ("station number"=w314, "FPGA interface"=w315, "UDP Receiver TX Request"=w316, "UDP Sender"=w317, "Triggered TX Requests"=w318, "receive throughput queue"=w319)
            Is Equal(x=$"Data Source", y="External") -> w320
            To Unsigned 8 Bit Integer(number=w314) -> w321
            call "MAC SAP TX Request Confirmation Handler.gvi"(FPGA interface=w315, UDP connection TX request=w316, UDP send connection=w317, TX request confirmation reference queue in=w318, error in=s12, instance ID=w321, external mode=w320) -> (num TX Request=w322, num TX Confirmation=w323, num packets to FPGA=w324, num packets dropped=w325, error out=w326)
            $"TX Request Middle MAC" <- w322
            $"TX Confirmation Middle MAC" <- w323
            $"TX Requests to PHY" <- w324
            $"Packets dropped count" <- w325
            Feedback Node(input=w325) -> w327
            Is Not Equal(x=w325, y=w327) -> w328
            $"Packets dropped" <- w328
            call "Generate MAC SAP TX Status Indication.gvi"(FPGA interface=w315, TX request confirmation reference queue in=w318, UDP send connection=w317, TX status and retransmission queue=w184, error in=s12, instance ID=w321, external mode=w320) -> (num indications received=w329, num indications triggered=w330, error out=w331)
            call "Generate MAC SAP RX Indication.gvi"(FPGA interface=w315, receive throughput queue=w319, UDP send connection=w317, error in=s12, instance ID=w321, external mode=w320) -> (num indications received=w332, num indications triggered=w333, error out=w334)
            Merge Errors(w326, w331, w334) -> (error out=w313)
            $"TX Indications from PHY" <- w329
            $"TX Indications Middle MAC" <- w330
            $"RX Indications from PHY" <- w332
            $"RX Indications Middle MAC" <- w333
          }
        }
        call "Check Stop.gvi"(error in=w313) -> (error out=w335, stop=w336)
        next s12 = w335
        stop if w336
      }
      call "Stop On Error.gvi"(error in=s12) -> (error out=w204)
      w203 = s9
    }
  }
  call "Stop On Error.gvi"(error in=w203) -> (error out=w337)
  call "Stop On Error.gvi"(error in=w204) -> (error out=w338)
  Merge Errors(w102, w45, w182, w200, w337, w338) -> (error out=w339)
  sequence {
    frame 0 {
      w340 = $session
    }
  }
  call "Host Release.gvi"(session=w340, error in=w339) -> (error out=w341)
  call "Simple Error Handler.gvi"(type of dialog="OK message", error in=w341)
