vi "FPGA Target Configuration.gvi"   [LabVIEW NXG 4.0.0]
# It reads the target bandwidth based on the given FPGA reference. In addition, the TX advance (a calibration value for RX TX turnaround time in global clock ticks) is set based on the target bandwidth.
inputs:
  "session": "Host Session.gtype"
    # Cluster containing all references the host uses during runtime. This cluster includes the following components:
    # FPGA interface: empty reference to the FPGA handle; needs to be cast each time it is used.
    # FlexRIO session: handle to the FlexRIO device. This component is valid only with FlexRIO devices.
    # FlexRIO TX Characterization Data: This component is valid only with FlexRIO sessions.
    # FlexRIO RX Characterization Data: This component is valid only with FlexRIO sessions.
    # USRP session: handle to the USRP device, including charaterization data. This component is valid only with USRP.
    # stop queue: handle to queue used to coordinate host shutdown between the loops.
    # send queue: handle to queue used to buffer TX packets to the target.
    # receive queue: handle to queue used to buffer RX packets from the target.
    # receive throughput queue: handle to queue used to buffer information about received RX packets (time and transferred bytes).
    # UDP receiver: handle to a UPD socket used to receive payload from outside the host.
    # PN packet: byte array used to stream payload inside the host.
  "error in": error
outputs:
  "error out": error
  "session dup": "Host Session.gtype"
    # Cluster containing all references the host uses during runtime. This cluster includes the following components:
    # FPGA interface: empty reference to the FPGA handle; needs to be cast each time it is used.
    # FlexRIO session: handle to the FlexRIO device. This component is valid only with FlexRIO devices.
    # FlexRIO TX Characterization Data: This component is valid only with FlexRIO sessions.
    # FlexRIO RX Characterization Data: This component is valid only with FlexRIO sessions.
    # USRP session: handle to the USRP device, including charaterization data. This component is valid only with USRP.
    # stop queue: handle to queue used to coordinate host shutdown between the loops.
    # send queue: handle to queue used to buffer TX packets to the target.
    # receive queue: handle to queue used to buffer RX packets from the target.
    # receive throughput queue: handle to queue used to buffer information about received RX packets (time and transferred bytes).
    # UDP receiver: handle to a UPD socket used to receive payload from outside the host.
    # PN packet: byte array used to stream payload inside the host.
  "TX advance": u32  # RX TX turnaround time in global clock ticks (one tenth of a microsecond).
  "bandwidth": f64  # Supported bandwidth based on the target type that has been read from the FPGA.
types:
  T1 = cluster{"Timestamp": u32, "Transferred Bytes": u32}
  T2 = cluster{"fpga ref": any, "bus instance": u32, "instruction FIFO depth": u32, "executing on FPGA target": bool, "show error call chain": bool}
  T3 = cluster{"Actual Gain [dB]": f64, "Attenuation Table Index": i32}
  T4 = cluster{"Attenuation Table [dB]": f64[][], "Frequencies [Hz]": f64[], "IQ Imbalance Table": "IQ Imbalance.gtype"[], "Gain Table": T3[][]}
  "Register Bus Session.gtype" = Queue<"Session Data.gtype">
  "Semaphore.gtype" = i32
  "DB Queue Reference.gtype" = Queue<"Daughterboard Data.gtype">
  "niUsrpRio Session.gtype" = cluster{"FPGA Interface": any, "RIO Interface Number": u32, "Data Clock Rate": u32, "FPGA Data Clock Rate": u32, "Global Settings Register Bus": "Register Bus Session.gtype", "Radio 0 Settings Register Bus": "Register Bus Session.gtype", "Radio 1 Settings Register Bus": "Register Bus Session.gtype", "Radio Settings Bus Semaphore": "Semaphore.gtype", "DB Queues": "DB Queue Reference.gtype"[], "Characterization Data Valid?": bool, "EEPROM Header": "EEPROM Header.gtype", "Device Data Header": "EEPROM Device Data Header.gtype", "EEPROM Characterization Header": "EEPROM Characterization Header.gtype", "Characterization Data": "Characterization Data.gtype"[], "FPGA Current Version": u32, "FPGA Oldest Compatible Version": u32, "Fixed Logic Current Version": u32, "Fixed Logic Oldest Compatible Version": u32, "FPGA Radio Settings Bus Current Version": u32, "FPGA Radio Settings Bus Oldest Compatible Version": u32, "FPGA Board Config Current Version": u32, "FPGA Board Config Oldest Compatible Version": u32, "Daughterboard Clock Rate": u32}
  "Host Session.gtype" = cluster{"station number": u16, "FPGA interface": "FGPA Reference.gtype", "MAC High Requests": Queue<u8[]>, "MAC High Confirmations": Queue<u8[]>, "Triggered TX Requests": Queue<"TX Request Confirmation Reference Parameters.gtype">, "receive queue": Queue<u8[]>, "receive throughput queue": Queue<T1>, "UDP Receiver": UdpNetworkConnectionRefnum, "PN packet": u8[], "FlexRIO session": Queue<T2>, "FlexRIO TX Characterization Data": T4, "FlexRIO RX Characterization Data": T4, "USRP session": "niUsrpRio Session.gtype", "RF loop clock frequency": f64, "UDP Receiver TX Request": UdpNetworkConnectionRefnum, "UDP Receiver TX Confirmation": UdpNetworkConnectionRefnum, "UDP Receiver RX Indication": UdpNetworkConnectionRefnum, "UDP Sender": UdpNetworkConnectionRefnum}
uses:
  AFW::Common::USRP::Read Device Bandwidth.gvi
diagram:
  Property Node(instance in=$session) -> ("FPGA interface"=w1, instance out=w2)
  $"session dup" <- w2
  Type Cast(type=any constant, x=w1) -> w3
  call "Read Device Bandwidth.gvi"(FPGA reference in=w3, error in=$"error in") -> (error out=w4, bandwidth=w5)
  case (w5) {
    frame "40 MHz" {
      w6 = 25
      w7 = 40000000
    }
    frame "120 MHz" {
      w6 = 19
      w7 = 120000000
    }
    frame "160 MHz", Default {
      w6 = 19
      w7 = 160000000
    }
  }
  $bandwidth <- w7
  $"TX advance" <- w6
  $"error out" <- w4
