vi "Open FPGA Target.gvi"   [LabVIEW NXG 4.0.0]
# Opens an FPGA target according to the RIO device name specified, and returns an FPGA reference.
inputs:
  "RIO device": string = "RIO0"  # Name of the RIO device to use. The device must match the project target device.
  "error in": error
outputs:
  "FPGA interface": "FGPA Reference.gtype"
  "error out": error
  "RF loop clock frequency": f64
  "device bandwidth": u16  # Detected instantaneous device bandwidth
diagram:
  Scan Value(default (0 dbl)=0, format string="%d", string="160 MHz") -> (value=w1)
  $"device bandwidth" <- w1
  FPGA Open Node(RIO address=$"RIO device", error in=$"error in", run?=FALSE) -> (error out=w2, reference out=w3)
  case ("160 MHz") {
    frame "40 MHz" {
      FPGA Close Node(abort?=FALSE, error in=w2, reference in=w3) -> (error out=w7)
      FPGA Open Node(RIO address=$"RIO device", error in=w7, run?=FALSE) -> (error out=w4, reference out=w5)
      w6 = 120000000
    }
    frame Default {
      w4 = w2
      w5 = w3
      w6 = 200000000
    }
  }
  $"RF loop clock frequency" <- w6
  Type Cast(type="FGPA Reference.gtype" constant, x=w5) -> w8
  $"FPGA interface" <- w8
  $"error out" <- w4
