vi "Calculate Power.gvi"   [LabVIEW NXG 4.0.0]
# Calculate the power spectrum and power level from the complex baseband data.
inputs:
  "waveform": waveform<c128>[], required
outputs:
  "Power Spectrum": T1[]
  "Power Level": f64[][]
  "I & Q Data": f64[][]
types:
  T1 = cluster{"f0": f64, "df": f64, "magnitude": f64[]}
uses:
  Host SubVIs::Calculate Power Spectrum.gvi
  Host SubVIs::Calculate IQ Power Level.gvi
diagram:
  for {
    w1 = each element of $waveform
    call "Calculate Power Spectrum.gvi"(waveform=w1) -> (power spectrum (dBm)=w5)
    call "Calculate IQ Power Level.gvi"(iq data=w1) -> (power level (dBm)=w6)
    Property Node(instance in=w1) -> ("Y"=w7)
    Complex To Real And Imaginary(x + iy=w7) -> (x=w8, y=w9)
    Build Array(w8, w9) -> w10
    concatenate w10 onto w2
    append w6 to w3
    append w5 to w4
  }
  $"Power Spectrum" <- w4
  $"Power Level" <- w3
  $"I & Q Data" <- w2
