vi "Self Correct Rx IQ Offset.gvi"   [LabVIEW NXG 4.0.0]
panel controls:
  "commit update to device?": bool = TRUE
  "reference frequency source": string = "Internal"
  "tuning settle": u32 = 100
  "usrp rio device": string = "RIO0"
uses:
  Host SubVIs::Open Device.gvi
  NI::G Core::Error::Legacy::Error Cluster From Error Code.gvi
  Host SubVIs::Backup and Self Correct Rx Offset.gvi
  NI::USRPRIO::ConfigV1Host::Store Persistent Device Data.gvi
  Host SubVIs::Close Device.gvi
  NI::G Core::Error::Display Error.gvi
diagram:
  call "Open Device.gvi"(usrp rio device=$"usrp rio device", reference frequency source=$"reference frequency source") -> (niusrprio session out=w1, error out=w2)
  Property Node(instance in=w1) -> ("Characterization Data Valid?"=w3)
  Not(x=w3) -> w4
  case (w4) {
    frame False, Default {
      w5 = w2
    }
    frame True {
      w6 = "-5000: The correction data on this device cannot be updated because the existing data is incompatible with the update."
      call "Error Cluster From Error Code.gvi"(error code=-5000, error message=w6, show call chain?=TRUE, is warning?=FALSE) -> (error out=w7)
      Merge Errors(w2, w7) -> (error out=w5)
    }
  }
  sequence {
    frame 0 {
      Two Button Dialog(F button name ("Cancel")="No", T button name ("OK")="Yes", message="Backup the existing correction data first?") -> (T Button?=w8)
    }
  }
  w9 = $"tuning settle"
  Property Node(instance in=w1) -> ("EEPROM Header:Number of Daughterboards"=w10)
  # Rx and Tx channels on
  # each daughterboard
  Multiply(2, w10) -> w11
  s1 = w5  # shift register
  s2 = w1  # shift register
  for (N = w11) (iteration -> i1) {
    Quotient And Remainder(x=i1, y=2) -> (x-y*floor(x/y)=w12)
    Is Equal To 0(x=w12) -> w13
    case (w13) {
      frame False, Default {
        # Tx Channel
        # nothing needs to be
        # corrected for Tx
        w14 = s1
        w15 = s2
      }
      frame True {
        # Rx channel
        call "Backup and Self Correct Rx Offset.gvi"(niusrprio session in=s2, channel to update=i1, tuning settle=w9, backup existing data?=w8, error in=s1) -> (niusrprio session out=w15, error out=w14)
      }
    }
    next s1 = w14
    next s2 = w15
    stop if w14
  }
  case ($"commit update to device?") {
    frame False, Default {
      w16 = s1
      w17 = s2
    }
    frame True {
      call "Store Persistent Device Data.gvi"(niusrprio session in=s2, offset=0x0, eeprom data section="Factory Data", error in=s1) -> (niusrprio session out=w17, error out=w16)
    }
  }
  call "Close Device.gvi"(niusrprio session in=w17, error in=w16) -> (error out=w18)
  call "Display Error.gvi"(error in=w18, type of dialog="OK message + warnings")
