vi "FPGA STA.gvi"   [LabVIEW NXG 4.0.0]
# Calculates the RF signal power on primary and secondary channels. Compares the RF signal power against CCA energy threshold and generated CCA indication based on energy detection.
# Latency: min 10 clock cycles
panel controls:
  "reg.host read.go rcvd 0": bool
  "reg.notify host.go rcvd 0": bool
  "reg.reset 0": bool
  "RF 0/Rx/Enable": bool
  "RF 0/Tx/Enable": bool
  "RF 1/Rx/Enable": bool
  "RF 1/Tx/Enable": bool
  "ATR State": enum{"Idle", "Rx", "Tx", "Duplex"} = "Idle"
  "Radio Control Destination": T1 = "Radio 0 Config"
  "lo lpf enable": bool
  "power enable": bool
  "mixer enable": bool
  "tx.configuration": T2 = {"power enable"=TRUE, "mixer enable"=TRUE, "gain"=0}
  "RX data source": T3 = "RF"
  "packet start sample index": u16
  "rearm packet start generator": bool
  "bypass synchronization": bool
  "reset MAC RX statistics": bool
  "noise coefficient": FXP(8.8) = 10
  "mute RX while TX active?": bool = TRUE
  "number of samples to capture": u16 = 1024
  "produce silent samples": bool
  "power calibration offset": FXP(10.3)
  "CCA energy detect threshold": FXP(10.3) = -62
  "RF gain": FXP(10.3)
  "number of samples before trigger": u16
  "manual trigger": bool
  "enable AGC": bool
  "rx.reset": bool = TRUE
  "rx.output sample rate": UFXP(1.47)
  "rx.delay": FXP(0.16)
  "rx 0.frequency shift": FXP(0.48)
  "rx 0.phase": FXP(0.21)
  "rx 0.impairments": T4 = {"inline gain I"=-1, "inline gain Q"=0.999992370605, "cross gain I"=0.999992370605, "cross gain Q"=0, "pre-gain offset I"=0, "pre-gain offset Q"=-1, "post-gain offset I"=0, "post-gain offset Q"=0.999992370605}
  "rx.abort": bool
  "tx.abort": bool
  "tx.reset": bool = TRUE
  "tx.input sample rate": UFXP(1.47)
  "tx.delay": FXP(0.18)
  "tx 0.frequency shift": FXP(0.48)
  "tx 0.phase": FXP(0.21)
  "tx 0.impairments": T4 = {"inline gain I"=0.999992370605, "inline gain Q"=0.999992370605, "post-gain offset I"=0.999992370605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}
  "tx 0.gain": T5 = {"gain I"=1, "gain Q"=1}
  "rx 1.impairments": T4 = {"inline gain I"=-0.999992370605, "inline gain Q"=0.999992370605, "cross gain I"=-0.999992370605, "cross gain Q"=0, "pre-gain offset I"=-1, "pre-gain offset Q"=0, "post-gain offset I"=0, "post-gain offset Q"=0}
  "rx 1.frequency shift": FXP(0.48)
  "rx 1.phase": FXP(0.21)
  "tx 1.impairments": T4 = {"inline gain I"=0.999992370605, "inline gain Q"=0.999992370605, "post-gain offset I"=-1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}
  "tx 1.frequency shift": FXP(0.48)
  "tx 1.phase": FXP(0.21)
  "tx 1.gain": T5 = {"gain I"=1, "gain Q"=1}
  "rx 0.stream enable": bool
  "rx 1.stream enable": bool
  "tx 0.stream enable": bool
  "tx 1.stream enable": bool
  "Data clock cycles per tick (0.1us)": u16 = 20
  "Data clock cycles per OFDM symbol": u16 = 480
  "rx.rf channel": UFXP(1.0)
  "tx.rf channel": UFXP(1.0)
  "enable DC offset correction": bool = TRUE
  "data clock locked?": bool
  "primary channel selector": UFXP(2.0)
  "device MAC address": u8[6]
  "daughterboard": "DB Types.gtype" = "sbx"
  "antenna configuration": "Antenna Configuration.gtype" = "TX1 RX1 transmits and RX2 receives"
  "spi address": u8 = 7
  "cpld enable": bool = TRUE
  "RX Settings": "RX Settings.gtype"
  "DC Offset factor p": UFXP(4.0) = 12
  "synchronization configuration": "Synchronization Configuration.gtype"
  "TX advance": u32
  "use fixed backoff": bool
  "fixed backoff": u16
  "pass all MPDUs": bool
  "dot11RTSThreshold": u32
  "control frame TX vector configuration": "Control Frame MCS Configuration.gtype"
  "dot11ShortRetryLimit": u16
  "dot11LongRetryLimit": u16
  "bypass MAC TX": bool
  "reset MAC TX statistics": bool
  "manual PhyTxStart.req": "PhyTxStart.req.gtype"
  "AGC target signal power": FXP(10.3)
  "event enable mask": "Events Enable Mask.gtype"
  "trigger condition": "PHY RX Capture Trigger Condition.gtype" = "Immediate"
  "T2H Constellation reset": bool
  "T2H Constellation number of samples": u16
  "T2H TX Baseband reset": bool
  "T2H TX Baseband number of samples": u16
  "T2H Constellation pass all samples": bool
  "T2H TX Baseband pass all samples": bool
  "AGC timeout": u16 = 4000
  "PHY clock cycles TX active extension": u32
  "T2H RX Power Spectrum rearm": bool
  "T2H RX Power Spectrum pass all triggers": bool
  "overwrite scrambler seed": bool
  "scrambler seed": UFXP(7.0)
  "AGC gain offset": UFXP(5.1)
  "station active": bool
  "device bandwidth": u16
panel indicators:
  "reg.notify host.go 0": bool
  "reg.host read.data 0": cluster{"go": bool, "data": u32}
  "compensated CFO": FXP(0.48)
  "T2H RX Data overflow": u16
  "T2H Constallation overflow": u16
  "T2H RX Bit Processing Output FIFO overflow": u16
  "T2H RX Power Spectrum overflow": u16
  "T2H Channel Estimation overflow": u16
  "last applied gain": UFXP(6.1)
  "RF input power at packet start": FXP(10.3)
  "signal power at packet start": FXP(10.3)
  "RF input power": FXP(10.3)
  "signal power": FXP(10.3)
  "internal loopback FIFO overflow": u16
  "TX to RF FIFO overflow": u16
  "T2H TX Baseband FIFO overflow": u16
  "T2H TX Bit Processing Output FIFO overflow": u16
  "rx.samples processed": u32
  "rx.number of IQ data overflows": u64
  "rx.number of overflows": u32
  "tx.samples processed": u32
  "tx.underflows": u32
  "tx.number of IQ data overflows": u64
  "rx.dsp reset done": bool
  "tx.dsp reset done": bool
  "Timestamp": u32
  "DC average": CFXP(1.17)
  "PhyTxStart.req": "PhyTxStart.req.gtype"
  "PhyTxEnd.ind": "PhyTxEnd.ind.gtype"
  "PhyRxStart.ind": "PhyRxStart.ind.gtype"
  "PhyRxEnd.ind": "PhyRxEnd.ind.gtype"
  "PSDU TX FIFO overflow counter": u16
  "MAC RX statistics": "MAC RX Statistics.gtype"
  "TX end indication overflow count": u16
  "MAC TX statistics": "MAC TX Statistics.gtype"
  "used scrambler seed": UFXP(7.0)
  "rx.state": "Stream Control State.gtype"
  "tx.state": "Stream Control State.gtype"
  "tx end": bool
  "selector": bool
types:
  T1 = enum{"Identification", "Board Config", "Global Config", "Radio 0 Config", "Radio 1 Config", "Synchronization", "Time", "Future Events"}
  T2 = cluster{"power enable": bool, "mixer enable": bool, "gain": u8}
  T3 = enum{"RF", "BB Data From Host", "Internal Loopback"}
  T4 = cluster{"inline gain I": FXP(1.17), "inline gain Q": FXP(1.17), "cross gain I": FXP(1.17), "cross gain Q": FXP(1.17), "pre-gain offset I": FXP(1.17), "pre-gain offset Q": FXP(1.17), "post-gain offset I": FXP(1.17), "post-gain offset Q": FXP(1.17)}
  T5 = cluster{"gain I": FXP(3.21), "gain Q": FXP(3.21)}
  "DB Types.gtype" = enum{"sbx", "cbx", "wbx", "unknown", "ubx"}
  "Antenna Configuration.gtype" = enum{"TX1 RX1 transmits and RX2 receives", "TX1 RX1 receives and RX2 is unused"}
  "PHY Frame Format.gtype" = enum{"NON_HT_OFDM", "VHT", "NON_HT_DUP_OFDM"}
  "Bandwidth.gtype" = enum{"20 MHz", "40 MHz", "80 MHz"}
  "TX Vector.gtype" = cluster{"format": "PHY Frame Format.gtype", "bandwidth": "Bandwidth.gtype", "PSDU length": u32, "(A-)MPDU length": u32, "MCS": UFXP(4.0)}
  "PhyTxStart.req.gtype" = cluster{"TX vector": "TX Vector.gtype", "valid": bool}
  "PhyTxEnd.ind.gtype" = cluster{"unsupported mode": bool, "scrambler seed": UFXP(7.0), "valid": bool}
  "Non HT Bandwidth.gtype" = enum{"20 MHz", "40 MHz", "80 MHz", "160 MHz"}
  "RX Vector.gtype" = cluster{"format": "PHY Frame Format.gtype", "bandwidth": "Bandwidth.gtype", "PSDU length": u32, "MCS": UFXP(4.0), "non HT bandwidth": "Non HT Bandwidth.gtype", "dynamic bandwidth support": bool}
  "PhyRxStart.ind.gtype" = cluster{"RX vector": "RX Vector.gtype", "valid": bool}
  "RX Error.gtype" = enum{"NoError", "CarrierLost", "FormatViolation", "UnsupportedRate", "Filtered"}
  "PhyRxEnd.ind.gtype" = cluster{"valid": bool, "RX error": "RX Error.gtype", "RX vector": "RX Vector.gtype"}
  "RX Settings.gtype" = cluster{"format": "PHY Frame Format.gtype", "overwrite format detection": bool}
  "Synchronization Configuration.gtype" = cluster{"consecutive samples over threshold": u8, "squared cross correlation threshold": UFXP(1.17), "maximum peak index deviation": u8, "FFT window shift into CP": u8, "consecutive peaks for preamble detection": u8, "use static frequency shift": bool, "static frequency shift": FXP(0.48)}
  "MAC RX Statistics.gtype" = cluster{"preamble detected": u32, "PSDUs received": u32, "MPDU CRC OK": u32, "RTS detected": u32, "CTS detected": u32, "Data detected": u32, "ACK detected": u32}
  "Control Frame MCS Configuration.gtype" = cluster{"RTS MCS": UFXP(4.0), "CTS MCS": UFXP(4.0), "ACK MCS": UFXP(4.0)}
  "MAC TX Statistics.gtype" = cluster{"RTS triggered": u32, "CTS triggered": u32, "Data triggered": u32, "ACK triggered": u32}
  "Events Enable Mask.gtype" = cluster{"PHY TX start request": bool, "PHY TX end indication": bool, "PHY RX start indication": bool, "PHY RX end indication": bool, "PHY CCA timing indication": bool, "PHY RX gain change indication": bool, "DCF state indication": bool, "MAC MPDU RX indication": bool, "MAC MPDU TX request": bool}
  "PHY RX Capture Trigger Condition.gtype" = enum{"Immediate", "RX Packet Start", "TX Paket Start", "CCA energy detection", "CCA signal detection"}
  "Stream Control State.gtype" = enum{"Idle", "Active"}
  "FPGA Shared Properties.gtype" = cluster{"primary channel selector": UFXP(2.0), "device MAC address": u8[6], "device bandwidth": u16}
  T6 = cluster{"output sample rate": UFXP(1.47), "delay": FXP(0.16), "frequency shift": FXP(0.48), "impairments": T4, "phase": FXP(0.21), "DC Offset factor p": UFXP(4.0)}
  T7 = cluster{"frequency shift": FXP(0.48), "impairments": T4, "phase": FXP(0.21), "input sample rate": UFXP(1.47), "gain": T5, "delay": FXP(0.18)}
uses:
  AFW::802_11::Shared::Create Resources.gvi
  AFW::802_11::RX::PHY-SAP Read MAC.gcdl
  AFW::802_11::RX::MAC::MAC RX.gcdl
  AFW::802_11::RX::MAC::MAC RX to ICP.gcdl
  AFW::802_11::RX::RX Data Sink.gcdl
  AFW::802_11::DCF::DCF Control.gcdl
  AFW::802_11::TX::TX Data Source.gcdl
  AFW::802_11::TX::MAC::ICP to MAC TX.gcdl
  AFW::802_11::TX::MAC::MAC TX.gcdl
  AFW::802_11::TX::TX MAC Bypass.gcdl
  AFW::802_11::TX::PHY-SAP Write MAC.gcdl
  AFW::802_11::Events::Write RX Events.gcdl
  AFW::802_11::TX::MAC::MAC TX to ICP.gcdl
  AFW::802_11::TX::TX Feedback Sink.gcdl
  AFW::802_11::Events::Write TX Events.gcdl
  AFW::802_11::TX::Host Communication::Capture PHY TX Indications.gcdl
  AFW::802_11::TX::MAC::MAC TX Statistics.gcdl
  AFW::802_11::TX::PHY-SAP Read PHY.gcdl
  NI::SDR::BasicElementsV1FPGA::Detect Rising Edge.gcdl
  AFW::802_11::TX::PHY TX Request Handler.gcdl
  AFW::802_11::TX::PSDU Discard.gcdl
  AFW::802_11::TX::Bit Processing::TX Bit Processing.gcdl
  AFW::802_11::TX::Extend TX Active Signal.gcdl
  AFW::802_11::RX::RX Data Source.gcdl
  AFW::802_11::RX::Power Measurement::Signal Filter.gcdl
  AFW::802_11::RX::Power Measurement::CCA Energy Detection.gcdl
  AFW::802_11::RX::Power Measurement::Power Measurement.gcdl
  AFW::802_11::RX::Synchronization::Synchronization.gcdl
  AFW::802_11::RX::Power Measurement::AGC.gcdl
  AFW::802_11::RX::CCA.gcdl
  AFW::802_11::RX::IQ Processing::RX IQ Processing.gcdl
  AFW::802_11::RX::Bit Processing::RX Bit Processing.gcdl
  AFW::802_11::RX::State Machines::RX PHY State Machine.gcdl
  AFW::802_11::RX::PHY-SAP Write PHY.gcdl
  AFW::802_11::RX::Host Communication::Prepare RX IQ Data for T2H.gcdl
  AFW::802_11::RX::Host Communication::Prepare Channel Estimation for T2H.gcdl
  AFW::802_11::RX::Host Communication::Trigger Capture RX Samples.gcdl
  AFW::802_11::RX::Host Communication::Capture RX Samples.gcdl
  AFW::802_11::TX::IQ Processing::TX IQ Processing.gcdl
  AFW::802_11::TX::TX Data Sink.gcdl
  AFW::802_11::RX::Host Communication::RX Bit Processing Data Sink.gcdl
  AFW::802_11::TX::Host Communication::TX Bit Processing Data Sink.gcdl
  AFW::802_11::RX::Host Communication::Capture PHY RX Indications.gcdl
  AFW::Common::Counters::Mod N Indexer U16.gcdl
  NI::SDR::BasicElementsV1FPGA::Count Up U32.gcdl
  AFW::802_11::RF Control::USRP Stream RX.gcdl
  AFW::802_11::RF Control::USRP Stream TX.gcdl
  FPGA SubVIs::Create Resources.gvi
  AFW::802_11::RF Control::Set Gain.gcdl
  AFW::Common::USRP::Type Conversion::read completion from typedef.gcdl
  NI::SDR::RegisterBusV1FPGA::Process.gcdl
  AFW::802_11::RF Control::Retrieve FPGA Scoped Instruction.gcdl
  NI::SDR::RegisterBusV1FPGA::Register Instruction Arbiter (2 inputs).gcdl
  AFW::Common::USRP::Type Conversion::register instruction to typedef.gcdl
  FPGA SubVIs::Registers.gcdl
  NI::USRPRIO::ConfigV1FPGA::Process.gvi
diagram:
  call "Create Resources.gvi"() -> (registers and FIFO resources=w1, PHY SAP resources=w2)
  clock-driven loop (clock = "AFW::802_11::Resources::802.11 AFW Resources.grsc::MAC") forever {
    w3 = "AFW::802_11::Resources::802.11 AFW Resources.grsc::T2H RX Data"
    call "PHY-SAP Read MAC.gcdl"(PHY SAP=w2) -> (PhyTxEnd.ind=w4, PHY RX gain change indication=w5, PhyRxStart.ind=w6, PhyRxEnd.ind=w7, PSDU=w8, PSDU valid=w9, PHY CCA indication=w10)
    Property Node(instance in=w1) -> ("shared properties"=w11, "global timestamp"=w12)
    Register Read(reference in=w11) -> (data=w13)
    Property Node(instance in=w13) -> ("device MAC address"=w14)
    call "MAC RX.gcdl"(PHY PSDU RX Start indication=w6, Phy Rx End Indication=w7, PSDU=w8, PSDU valid=w9, STA MAC address=w14, pass all MPDUs=$"pass all MPDUs", reset MAC RX statistics=$"reset MAC RX statistics") -> (MAC MPDU RX event indication=w15, MAC RX event to TX indication=w16, MAC MPDU RX before filtering event indication=w17, MAC MSDU RX indication=w18, MSDU data=w19, MAC RX statistics=w20)
    call "MAC RX to ICP.gcdl"(MAC MSDU RX indication=w18, MSDU data=w19) -> (ICP data=w21, output valid=w22)
    call "RX Data Sink.gcdl"(ICP SDU=w21, input valid=w22, FIFO reference=w3) -> (FIFO overflow count=w23)
    $"T2H RX Data overflow" <- w23
    w24 = "AFW::802_11::Resources::802.11 AFW Resources.grsc::H2T TX Data"
    # w25: global time reference
    Register Read(reference in=w12) -> (data=w25)
    # w26: feedback TX to DCF (MAC frame TX start indication)
    Feedback Node(input=w27) -> w26
    # w28: feedback TX to DCF (RX timeout count request)
    Feedback Node(input=w29) -> w28
    # w30: feedback TX to DCF (DCF TX opportunity request)
    Feedback Node(input=w31) -> w30
    # w32: feedback TX to DCF (contention window change request)
    # w16: RX to TX feedback (MAC RX event to TX indication)
    Feedback Node(input=w33) -> w32
    call "DCF Control.gcdl"(PHY CCA indication=w10, PHY TX end indication=w4, PhyRxStart.ind=w6, PhyRxEnd.ind=w7, MAC MPDU RX event indication=w15, contention window change request=w32, DCF TX opportunity request=w30, RX timeout request=w28, MAC frame TX start indication=w26, global timestamp=w25, TX advance=$"TX advance", use fixed backoff=$"use fixed backoff", fixed backoff=$"fixed backoff") -> (DCF TX opportunity indication=w34, SIFS TX opportunity indication=w35, RX timeout pulse=w36, DCF state=w37)
    Feedback Node(input=w38) -> w39
    call "TX Data Source.gcdl"(ready for output=w39, H2T TX Data=w24, bypass MAC TX=$"bypass MAC TX") -> (ICP data=w40, output valid=w41, elements available=w42)
    Feedback Node(input=w43) -> w44
    Property Node(instance in=w44) -> ("valid"=w45)
    call "ICP to MAC TX.gcdl"(ICP data=w40, input valid=w41, elements available=w42, get next MSDU frame=w45) -> (MAC MSDU TX request=w46, MSDU data=w47, MSDU data valid=w48, ready for input=w38)
    Feedback Node(input=w49) -> w50
    call "MAC TX.gcdl"(ready for output=w50, MAC RX event to TX indication=w16, MAC MSDU TX request=w46, MSDU data=w47, MSDU data valid=w48, DCF TX opportunity indication=w34, SIFS TX opportunity indication=w35, RX timeout pulse=w36, dot11RTSThreshold=$dot11RTSThreshold, control frame TX vector configuration=$"control frame TX vector configuration", dot11ShortRetryLimit=$dot11ShortRetryLimit, dot11LongRetryLimit=$dot11LongRetryLimit, station active=$"station active") -> (MAC MSDU TX end indication=w43, contention window change request=w33, MAC frame TX request=w51, PHY PSDU TX request=w52, A-MPDU data=w53, A-MPDU data valid=w54, DCF TX opportunity request=w31, RX timeout count request=w29, MAC frame TX start indication=w27)
    call "TX MAC Bypass.gcdl"(request in=w52, MPDU=w53, input valid=w54, ready for output=w50, TX data FIFO reference=w24, bypass MAC TX=$"bypass MAC TX", manual PhyTxStart.req=$"manual PhyTxStart.req") -> (request out=w55, PSDU=w56, output valid=w57)
    call "PHY-SAP Write MAC.gcdl"(PHY SAP=w2, PSDU=w56, PSDU valid=w57, PhyTxStart.req=w55) -> (FIFO overflow counter=w58, PSDU TX ready for input=w49)
    $"PSDU TX FIFO overflow counter" <- w58
    $"MAC RX statistics" <- w20
    w59 = "AFW::802_11::Resources::802.11 AFW Resources.grsc::T2H Events"
    call "Write RX Events.gcdl"(PHY RX start indication=w6, PHY RX end indication=w7, PHY CCA indication=w10, PHY RX gain change indication=w5, MAC MPDU RX event indication=w17, global timestamp=w25, T2H FIFO reference=w59, event enable mask=$"event enable mask")
    # w43: TX end ind.
    w60 = "AFW::802_11::Resources::802.11 AFW Resources.grsc::T2H TX Feedback"
    call "MAC TX to ICP.gcdl"(MAC MSDU TX end indication=w43) -> (ICP data=w61, output valid=w62)
    call "TX Feedback Sink.gcdl"(ICP data=w61, input valid=w62, FIFO reference=w60) -> (FIFO overflow count=w63)
    $"TX end indication overflow count" <- w63
    w64 = "AFW::802_11::Resources::802.11 AFW Resources.grsc::T2H Events"
    call "Write TX Events.gcdl"(PHY TX end indication=w4, PHY TX start request=w55, MAC frame TX request=w51, DCF state=w37, global time reference=w25, T2H FIFO reference=w64, event enable mask=$"event enable mask")
    call "Capture PHY TX Indications.gcdl"(PhyTxEnd.ind in=w4, PHY TX start request in=w55) -> (PHY TX start request out=w65, PhyTxEnd.ind out=w66)
    $"PhyTxStart.req" <- w65
    $"PhyTxEnd.ind" <- w66
    call "MAC TX Statistics.gcdl"(MAC frame TX request=w51, reset=$"reset MAC TX statistics") -> (MAC TX statistics=w67)
    $"MAC TX statistics" <- w67
  }
  clock-driven loop (clock = "AFW::802_11::Resources::802.11 AFW Resources.grsc::PHY") forever {
    Feedback Node(input=w68) -> w69
    case (w69) {
      frame False, Default { }
      frame True {
        $selector <- w69
      }
    }
    Property Node(instance in=w1) -> ("shared properties"=w70, "TX active"=w71, "OFDM symbol pulse"=w72)
    Register Read(reference in=w70) -> (data=w73)
    # w74: Symbol trigger
    Property Node(instance in=w73) -> ("primary channel selector"=w75, "device bandwidth"=w76)
    Feedback Node(input=w77) -> w78
    call "PHY-SAP Read PHY.gcdl"(PHY SAP=w2, ready for output=w78) -> (PhyTxStart.req=w79, PSDU=w80, PSDU valid=w81)
    Register Read(reference in=w72) -> (data=w74, reference out=w82)
    call "Detect Rising Edge.gcdl"(signal=w74) -> (edge detected=w83)
    Feedback Node(input=w84) -> w85
    call "PHY TX Request Handler.gcdl"(PSDU discard complete=w85, symbol trigger in=w83, PhyTxStart.req=w79, device bandwidth=w76) -> (PSDU discard configuration=w86, symbol trigger out=w87, symbol index=w88, TX vector out=w89, start of packet=w90, PhyTxEnd.ind=w91, TX active=w92)
    Feedback Node(input=w93) -> w94
    call "PSDU Discard.gcdl"(ready for output=w94, PSDU in=w80, PSDU in valid=w81, configuration=w86) -> (ready for input=w77, PSDU out=w95, PSDU out valid=w96, PSDU complete=w84)
    call "TX Bit Processing.gcdl"(overwrite scrambler seed=$"overwrite scrambler seed", scrambler seed=$"scrambler seed", PSDU=w95, input valid=w96, symbol trigger=w87, TX vector=w89, OFDM symbol index=w88) -> (used scrambler seed=w97, bit=w98, output valid=w99, modulation=w100, ready for input=w93)
    Property Node(instance in=w91, "scrambler seed"=w97) -> (instance out=w101)
    Property Node(instance in=w101) -> ("valid"=w102, instance out=w103)
    Feedback Node(input=w104) -> w105
    To Fixed Point(number=w105) -> w106: FXP(10.3) Saturate:ConvergentRounding
    Select(s=$"enable AGC", t=w106, f=$"RF gain") -> w107
    Property Node(instance in=w1) -> ("RF to RX FIFO"=w108, "internal loopback FIFO"=w109, "TX to RF FIFO"=w110, "Gain Settings FIFO"=w111)
    call "Extend TX Active Signal.gcdl"(TX active=w92, cycles to extend=$"PHY clock cycles TX active extension") -> (extended TX active=w112)
    Register Write(data=w112, reference in=w71) -> (reference out=w113)
    w114 = "AFW::802_11::Resources::802.11 AFW Resources.grsc::H2T RX Baseband"
    call "RX Data Source.gcdl"(RX data source=$"RX data source", mute RX while TX active?=$"mute RX while TX active?", TX active register=w113, RF to RX FIFO=w108, internal loopback FIFO=w109, OFDM symbol trigger register=w82, produce silent samples=$"produce silent samples", H2T FIFO=w114) -> (sample=w115, output valid=w116)
    call "Signal Filter.gcdl"(sample in=w115, input valid=w116, shared properties=w73) -> (primary channel sample=w117, secondary channel sample=w118, secondary 40 MHz channel sample=w119, output valid=w120)
    call "CCA Energy Detection.gcdl"(primary channel sample=w117, secondary channel sample=w118, secondary 40 MHz channel sample=w119, input valid=w120, CCA energy detect threshold=$"CCA energy detect threshold", RF gain=w107, power calibration offset=$"power calibration offset") -> (PHY CCA energy detection indication=w121, primary channel signal power=w122, primary channel signal power valid=w123)
    call "Power Measurement.gcdl"(sample=w115, input valid=w116, power calibration offset=$"power calibration offset", RF gain=w107) -> (signal power=w124, output valid=w125, RF input power=w126)
    call "Synchronization.gcdl"(sample in=w115, input valid=w116, primary channel sample=w117, primary channel sample valid=w120, packet start sample index=$"packet start sample index", rearm packet start generator=$"rearm packet start generator", configuration=$"synchronization configuration", bypass synchronization=$"bypass synchronization", rearm packet detection=w69) -> (packet detected=w127, compensated CFO=w128, sample out=w129, output valid=w130, packet start=w131)
    call "AGC.gcdl"(timeout=$"AGC timeout", target signal power=$"AGC target signal power", gain offset=$"AGC gain offset", overall signal power=w124, overall signal power valid=w125, primary channel signal power=w122, primary channel signal power valid=w123, packet detected=w127, enable AGC=$"enable AGC") -> (gain=w132, trigger gain setting=w133, last applied gain=w104, gain change indication=w134)
    Feedback Node(input=w135) -> w136
    call "CCA.gcdl"(PHY CCA energy detection indication=w121, CCA signal detected=w127, timing valid=w136) -> (PHY CCA indication=w137)
    Feedback Node(input=w138) -> w139
    call "RX IQ Processing.gcdl"(sample=w129, input valid=w130, packet start=w131, configuration=w139) -> (subcarrier=w140, subcarrier timing=w141, subcarrier field map=w142, channel estimate=w143, channel estimate timing=w144, status=w145)
    Feedback Node(input=w146) -> w147
    call "RX Bit Processing.gcdl"(subcarrier=w140, subcarrier timing=w141, field map=w142, noise coefficient=$"noise coefficient", configuration=w147) -> (bit=w148, bit valid=w149, status=w150, PSDU=w151, PSDU valid=w152)
    Feedback Node(enable?=w131, initial value="FPGA Shared Properties.gtype" {all zero or empty}, input=w73) -> w153
    Property Node(instance in=w145) -> ("last sample"=w68, instance out=w154)
    call "RX PHY State Machine.gcdl"(bit=w148, bit valid=w149, bit processing status=w150, IQ processing status=w154, shared properties=w153, RX settings=$"RX Settings") -> (RX bit processing configuration=w146, RX IQ processing configuration=w138, RXTIME known=w135, PhyRxStart.ind=w155, PhyRxEnd.ind=w156)
    call "PHY-SAP Write PHY.gcdl"(PhyTxEnd.ind=w103, PHY RX gain change indication=w134, PhyRxStart.ind=w155, PhyRxEnd.ind=w156, PSDU=w151, PSDU valid=w152, PHY CCA indication=w137, PHY SAP=w2)
    w157 = "AFW::802_11::Resources::802.11 AFW Resources.grsc::T2H Constellation"
    call "Prepare RX IQ Data for T2H.gcdl"(reset=$"T2H Constellation reset", number of samples=$"T2H Constellation number of samples", subcarrier timing=w141, field map=w142, FIFO reference=w157, pass all samples=$"T2H Constellation pass all samples") -> (FIFO overflow count=w158)
    $"T2H Constallation overflow" <- w158
    w159 = "AFW::802_11::Resources::802.11 AFW Resources.grsc::T2H Channel Estimation"
    Property Node(instance in=w139) -> ("format"=w160)
    call "Prepare Channel Estimation for T2H.gcdl"(channel estimate=w143, channel estimate timing=w144, format=w160, FIFO reference=w159) -> (FIFO overflow count=w161)
    $"T2H Channel Estimation overflow" <- w161
    w162 = "AFW::802_11::Resources::802.11 AFW Resources.grsc::T2H RX Power Spectrum"
    call "Trigger Capture RX Samples.gcdl"(manual trigger=$"manual trigger", RX packet start=w131, packet detected=w127, PHY CCA energy detection indication=w121, TX active register=w113, trigger condition=$"trigger condition") -> (trigger=w163)
    call "Capture RX Samples.gcdl"(sample=w129, input valid=w130, trigger=w163, number of samples to capture=$"number of samples to capture", FIFO reference=w162, number of samples before trigger=$"number of samples before trigger", pass all triggers=$"T2H RX Power Spectrum pass all triggers", rearm=$"T2H RX Power Spectrum rearm") -> (FIFO overflow count=w164)
    $"T2H RX Power Spectrum overflow" <- w164
    w165 = "AFW::802_11::Resources::802.11 AFW Resources.grsc::T2H TX Baseband"
    call "TX IQ Processing.gcdl"(primary channel selector=w75, symbol trigger=w87, bit=w98, bit valid=w99, bit processing modulation=w100, start of packet=w90, TX vector=w89, OFDM symbol index=w88) -> (data out=w166, output valid=w167)
    call "TX Data Sink.gcdl"(TX to RF FIFO=w110, internal loopback FIFO=w109, sample=w166, input valid=w167, T2H FIFO=w165, number of samples=$"T2H TX Baseband number of samples", reset=$"T2H TX Baseband reset", pass all samples=$"T2H TX Baseband pass all samples") -> (T2H FIFO overflow count=w168, TX to RF FIFO overflow count=w169, internal loopback FIFO overflow count=w170)
    $"T2H TX Baseband FIFO overflow" <- w168
    $"TX to RF FIFO overflow" <- w169
    $"internal loopback FIFO overflow" <- w170
    $"compensated CFO" <- w128
    w171 = "AFW::802_11::Resources::802.11 AFW Resources.grsc::T2H RX Bit Processing Output"
    call "RX Bit Processing Data Sink.gcdl"(PSDU=w151, input valid=w152, FIFO reference=w171) -> (FIFO overflow count=w172)
    $"T2H RX Bit Processing Output FIFO overflow" <- w172
    w173 = "AFW::802_11::Resources::802.11 AFW Resources.grsc::T2H TX Bit Processing Output"
    call "TX Bit Processing Data Sink.gcdl"(bit=w98, input valid=w99, modulation=w100, FIFO reference=w173) -> (FIFO overflow count=w174)
    $"T2H TX Bit Processing Output FIFO overflow" <- w174
    call "Capture PHY RX Indications.gcdl"(PhyRxStart.ind in=w155, PhyRxEnd.ind in=w156) -> (PhyRxStart.ind out=w175, PhyRxEnd.ind out=w176)
    $"PhyRxStart.ind" <- w175
    $"PhyRxEnd.ind" <- w176
    case (w102) {
      frame False, Default { }
      frame True {
        $"tx end" <- w102
      }
    }
    $"RF input power" <- w126
    $"signal power" <- w124
    $"used scrambler seed" <- w97
    Feedback Node(enable?=w131, input=w126) -> w177
    $"RF input power at packet start" <- w177
    Feedback Node(enable?=w131, input=w124) -> w178
    $"signal power at packet start" <- w178
    FIFO Write(Control Protocol Input=w133, data=w132, reference in=w111)
    $"last applied gain" <- w104
  }
  clock-driven loop (clock = "Data Clock") forever {
    # Baseband to/from RF conversion
    # Data Reception from Antenna, downconversion to baseband sample rate, received data will be written into RX baseband input FIFO
    # Reading of TX baseband FIFO, upconversion and transmission to antenna
    Property Node(instance in=w1) -> ("shared properties"=w179, "global timestamp"=w180, "OFDM symbol pulse"=w181)
    call "Mod N Indexer U16.gcdl"(N=$"Data clock cycles per tick (0.1us)", enable=$"data clock locked?") -> (wrap back=w182)
    call "Count Up U32.gcdl"(increment=w182, reset=FALSE) -> (count out=w183)
    Register Write(data=w183, reference in=w180)
    call "Mod N Indexer U16.gcdl"(N=$"Data clock cycles per OFDM symbol", enable=$"data clock locked?") -> (wrap back=w184)
    Register Write(data=w184, reference in=w181)
    Property Node(instance in="FPGA Shared Properties.gtype" {all zero or empty}, "primary channel selector"=$"primary channel selector", "device MAC address"=$"device MAC address", "device bandwidth"=$"device bandwidth") -> (instance out=w185)
    Register Write(data=w185, reference in=w179)
    $Timestamp <- w183
    Property Node(instance in=w1) -> ("TX to RF FIFO"=w186, "RF to RX FIFO"=w187)
    Build Array($"rx 0.stream enable", $"rx 1.stream enable") -> w188
    w189 = T6 {"0x800000000000", 0, 0, "0x1FFFF", "0x1FFFF", 0, 0, 0, 0, 0, 0, 0, 0}
    Property Node(instance in=w189, "impairments"=$"rx 0.impairments", "frequency shift"=$"rx 0.frequency shift", "phase"=$"rx 0.phase", "output sample rate"=$"rx.output sample rate", "delay"=$"rx.delay", "DC Offset factor p"=$"DC Offset factor p") -> (instance out=w190)
    w191 = T6 {"0x800000000000", 0, 0, "0x1FFFF", "0x1FFFF", 0, 0, 0, 0, 0, 0, 0, 0}
    Property Node(instance in=w191, "delay"=$"rx.delay", "output sample rate"=$"rx.output sample rate", "impairments"=$"rx 1.impairments", "frequency shift"=$"rx 1.frequency shift", "phase"=$"rx 1.phase", "DC Offset factor p"=$"DC Offset factor p") -> (instance out=w192)
    Build Array(w190, w192) -> w193
    call "USRP Stream RX.gcdl"(rx.reset=$"rx.reset", rx.rf channel=$"rx.rf channel", rx. stream enabled=w188, rx.abort=$"rx.abort", DDC parameters=w193, enable DC offset correction=$"enable DC offset correction", RF to RX FIFO reference=w187) -> (DC average=w194, rx.number of IQ data overflows=w195, rx.dsp reset done=w196, rx.state=w197, rx.samples processed=w198, rx.number of overflows=w199)
    $"rx.number of IQ data overflows" <- w195
    Build Array($"tx 0.stream enable", $"tx 1.stream enable") -> w200
    w201 = T7 {0, "0x1FFFF", "0x1FFFF", 0, 0, 0, 0, 0, 0, 0, 0, "0x200000", "0x200000", 0}
    Property Node(instance in=w201, "gain"=$"tx 0.gain", "frequency shift"=$"tx 0.frequency shift", "phase"=$"tx 0.phase", "impairments"=$"tx 0.impairments", "input sample rate"=$"tx.input sample rate", "delay"=$"tx.delay") -> (instance out=w202)
    w203 = T7 {0, "0x1FFFF", "0x1FFFF", 0, 0, 0, 0, 0, 0, 0, 0, "0x200000", "0x200000", 0}
    Property Node(instance in=w203, "delay"=$"tx.delay", "input sample rate"=$"tx.input sample rate", "gain"=$"tx 1.gain", "frequency shift"=$"tx 1.frequency shift", "phase"=$"tx 1.phase", "impairments"=$"tx 1.impairments") -> (instance out=w204)
    Build Array(w202, w204) -> w205
    call "USRP Stream TX.gcdl"(tx.reset=$"tx.reset", tx.rf channel=$"tx.rf channel", tx.enable streams=w200, tx.abort=$"tx.abort", DUC parameters=w205, TX to RF FIFO reference=w186) -> (tx.state=w206, tx.samples processed=w207, tx.underflows=w208, tx.number of IQ data overflows=w209, tx.dsp reset done=w210)
    $"tx.state" <- w206
    $"rx.dsp reset done" <- w196
    $"tx.samples processed" <- w207
    $"rx.state" <- w197
    $"tx.underflows" <- w208
    $"rx.samples processed" <- w198
    $"tx.number of IQ data overflows" <- w209
    $"rx.number of overflows" <- w199
    $"tx.dsp reset done" <- w210
    $"DC average" <- w194
  }
  call "Create Resources.gvi"() -> (config.resources=w211, sync.resources=w212, time.resources=w213)
  clock-driven loop (clock = "40 MHz Onboard Clock") {
    Io Write(data=$"RF 1/Rx/Enable", reference in="RF 1/Rx/Enable")
    Io Write(data=$"RF 0/Tx/Enable", reference in="RF 0/Tx/Enable")
    Io Write(data=$"RF 0/Rx/Enable", reference in="RF 0/Rx/Enable")
    w214 = "AFW::802_11::Resources::802.11 AFW Resources.grsc::AGC Reg Bus 0 Access FIFO"
    Feedback Node(input=w215) -> w216
    Property Node(instance in=w1) -> ("Gain Settings FIFO"=w217)
    FIFO Read(Control Protocol Input=TRUE, reference in=w217) -> (Control Protocol Output=w215, data=w218)
    Feedback Node(enable?=w215, input=w218) -> w219
    To Fixed Point(number=w219) -> w220: UFXP(6.1) Wrap:Truncate
    # Register Bus and Required Controls/Indicators
    Scale By Power Of 2(n=1, x=w220) -> w221
    To Unsigned 8 Bit Integer(number=w221) -> w222
    Property Node(instance in=T2 {"power enable"=TRUE, "mixer enable"=TRUE, "gain"=0}, "power enable"=$"power enable", "mixer enable"=$"mixer enable", "gain"=w222) -> (instance out=w223)
    call "Set Gain.gcdl"(FPGA.Fifo=w214, spi address=$"spi address", cpld enable=$"cpld enable", ATR State=$"ATR State", Radio Control Destination=$"Radio Control Destination", antenna configuration=$"antenna configuration", Write ATR?=w216, lo lpf enable=$"lo lpf enable", daughterboard=$daughterboard, tx.configuration=$"tx.configuration", rx.configuration=w223)
    Io Write(data=$"RF 1/Tx/Enable", reference in="RF 1/Tx/Enable")
    w224 = "NI::SDR::RegisterBusV1FPGA::niInstr Register Bus v0.grsc::reg.host instruction fifo 0"
    Feedback Node(input=w225) -> w226
    Property Node(instance in=w226) -> ("ready for port 0 input"=w227, "ready for port 1 input"=w228)
    Feedback Node(input=w229) -> w230
    call "read completion from typedef.gcdl"(read completion (typedef)=w230) -> (read completion=w231)
    call "Process.gcdl"(reg.notify host.go rcvd=$"reg.notify host.go rcvd 0", reg.host read.go rcvd=$"reg.host read.go rcvd 0", read completion=w231, reg.reset=$"reg.reset 0", reg.host instruction fifo=w224, ready for output=w228) -> (reg.notify host.go=w232, reg.host read.data=w233, register instruction=w234)
    $"reg.notify host.go 0" <- w232
    $"reg.host read.data 0" <- w233
    w235 = "AFW::802_11::Resources::802.11 AFW Resources.grsc::AGC Reg Bus 0 Access FIFO"
    FIFO Read(Control Protocol Input=w227, reference in=w235) -> (Control Protocol Output=w236, data=w237)
    call "Retrieve FPGA Scoped Instruction.gcdl"(number=w237, valid=w236) -> (output cluster=w238)
    Feedback Node(input=w239) -> w240
    call "Register Instruction Arbiter (2 inputs).gcdl"(port 0=w238, port 1=w234, reset=FALSE, ready for output=w240) -> (register instr out=w241, ready for input=w225)
    call "register instruction to typedef.gcdl"(register instruction=w241) -> (register instruction (typedef)=w242)
    call "Registers.gcdl"(register instruction=w242, config.resources=w211, sync.resources=w212, time.resources=w213) -> (ready for input=w239, read completion out=w229)
    stop if FALSE
  }
  call "Process.gvi"(resources=w211)
