vi "writing test.gvi"   [LabVIEW NXG 4.0.0]
panel controls:
  "file for samples": path
  "number": i32
  "stop": bool
  "selector": bool
diagram:
  while {
    Number To Hexadecimal String(number=$number) -> (hex integer string=w1)
    Feedback Node(initial value="", input=w2) -> w3
    Concatenate Strings(w3, w1) -> w4
    Concatenate Strings(w4, " ") -> w2
    Feedback Node(initial value=TRUE, input=$selector) -> w5
    Is Greater(x=$selector, y=w5) -> w6
    case (w6) {
      frame False, Default { }
      frame True {
        Write To Text File(file (use dialog)=$"file for samples", text=w2)
      }
    }
    stop if $stop
  }
