vi "Create Resources.gvi"   [LabVIEW NXG 4.0.0]
# Creates the required resources from registers, FIFOs, and handshakes. The created references are going to be used for several PHY indications, share properties between MAC and PHY loops, and data streaming between RF loop and base band loop.
# Latency: 0 cycle
outputs:
  "registers and FIFO resources": "FPGA Resources.gtype"  # Created register and FIFO resources.
  "PHY SAP resources": "PHY SAP Ressources.gtype"  # Created PHY service access point resources.
types:
  "PHY SAP Ressources.gtype" = cluster{"PSDU (RX)": any, "PSDU (TX)": any, "PhyTxEnd.ind": HandshakeDataType<"PhyTxEnd.ind.gtype">, "PhyTxStart.req": HandshakeDataType<"PhyTxStart.req.gtype">, "PhyRxStart.ind": HandshakeDataType<"PhyRxStart.ind.gtype">, "PHY CCA indication": HandshakeDataType<"PHY CCA Indication.gtype">, "PhyRxEnd.ind": HandshakeDataType<"PhyRxEnd.ind.gtype">, "PHY RX gain change indication": any}
  "FPGA Resources.gtype" = cluster{"global timestamp": RegisterDataType<u32>, "OFDM symbol pulse": RegisterDataType<bool>, "TX active": RegisterDataType<bool>, "RF to RX FIFO": any, "internal loopback FIFO": any, "TX to RF FIFO": any, "Gain Settings FIFO": any, "shared properties": RegisterDataType<"FPGA Shared Properties.gtype">}
  "CCA Indication Channel List Element.gtype" = enum{"none", "primary", "secondary", "secondary40"}
  "PHY CCA Indication.gtype" = cluster{"busy": bool, "channel list": "CCA Indication Channel List Element.gtype", "valid": bool}
  "PHY Frame Format.gtype" = enum{"NON_HT_OFDM", "VHT", "NON_HT_DUP_OFDM"}
  "Bandwidth.gtype" = enum{"20 MHz", "40 MHz", "80 MHz"}
  "Non HT Bandwidth.gtype" = enum{"20 MHz", "40 MHz", "80 MHz", "160 MHz"}
  "RX Vector.gtype" = cluster{"format": "PHY Frame Format.gtype", "bandwidth": "Bandwidth.gtype", "PSDU length": u32, "MCS": UFXP(4.0), "non HT bandwidth": "Non HT Bandwidth.gtype", "dynamic bandwidth support": bool}
  "PhyRxStart.ind.gtype" = cluster{"RX vector": "RX Vector.gtype", "valid": bool}
  "RX Error.gtype" = enum{"NoError", "CarrierLost", "FormatViolation", "UnsupportedRate", "Filtered"}
  "PhyRxEnd.ind.gtype" = cluster{"valid": bool, "RX error": "RX Error.gtype", "RX vector": "RX Vector.gtype"}
  "TX Vector.gtype" = cluster{"format": "PHY Frame Format.gtype", "bandwidth": "Bandwidth.gtype", "PSDU length": u32, "(A-)MPDU length": u32, "MCS": UFXP(4.0)}
  "PhyTxStart.req.gtype" = cluster{"TX vector": "TX Vector.gtype", "valid": bool}
  "PhyTxEnd.ind.gtype" = cluster{"unsupported mode": bool, "scrambler seed": UFXP(7.0), "valid": bool}
  "AGC State.gtype" = enum{"Idle", "maximum gain", "wait for measurement", "gain set", "gain locked", "wait for channel clearance"}
  "AGC Event.gtype" = cluster{"gain": UFXP(6.1), "state": "AGC State.gtype", "valid": bool}
  "FPGA Shared Properties.gtype" = cluster{"primary channel selector": UFXP(2.0), "device MAC address": u8[6], "device bandwidth": u16}
diagram:
  FIFO Create(data type=u8 0) -> (reference out=w1)
  FIFO Create(data type=u8 0) -> (reference out=w2)
  Handshake Create(data type="PHY CCA Indication.gtype" {all zero or empty}) -> (reference out=w3)
  Handshake Create(data type="PhyRxStart.ind.gtype" {all zero or empty}) -> (reference out=w4)
  Handshake Create(data type="PhyRxEnd.ind.gtype" {all zero or empty}) -> (reference out=w5)
  Handshake Create(data type="PhyTxStart.req.gtype" {all zero or empty}) -> (reference out=w6)
  Handshake Create(data type="PhyTxEnd.ind.gtype" {all zero or empty}) -> (reference out=w7)
  FIFO Create(data type="AGC Event.gtype" {all zero or empty}, minimum depth=1025) -> (reference out=w8)
  # Latency: 0 cycle
  Property Node(instance in="PHY SAP Ressources.gtype" {all zero or empty}, "PSDU (RX)"=w1, "PSDU (TX)"=w2, "PhyTxEnd.ind"=w7, "PhyTxStart.req"=w6, "PhyRxStart.ind"=w4, "PHY CCA indication"=w3, "PhyRxEnd.ind"=w5, "PHY RX gain change indication"=w8) -> (instance out=w9)
  $"PHY SAP resources" <- w9
  Register Create(initial value=0) -> (reference out=w10)
  Register Create(initial value=FALSE) -> (reference out=w11)
  Register Create(initial value=FALSE) -> (reference out=w12)
  Register Create(initial value="FPGA Shared Properties.gtype" {all zero or empty}) -> (reference out=w13)
  FIFO Create(data type=CFXP(3.13) 0+0i, minimum depth=17) -> (reference out=w14)
  FIFO Create(data type=CFXP(3.13) 0+0i, minimum depth=1025) -> (reference out=w15)
  FIFO Create(data type=CFXP(3.13) 0+0i, minimum depth=1025) -> (reference out=w16)
  FIFO Create(data type=UFXP(5.1) 0, minimum depth=17) -> (reference out=w17)
  Property Node(instance in="FPGA Resources.gtype" {all zero or empty}, "global timestamp"=w10, "OFDM symbol pulse"=w11, "TX active"=w12, "shared properties"=w13, "RF to RX FIFO"=w14, "internal loopback FIFO"=w15, "TX to RF FIFO"=w16, "Gain Settings FIFO"=w17) -> (instance out=w18)
  $"registers and FIFO resources" <- w18
