vi "Channelization Visualization.gvi"   [LabVIEW NXG 4.0.0]
# Creates a
# graphical indication that shows which sub-band is used as the primary channel based on the Primary Channel Selector. The PHY covers 80 MHz bandwidth, which can be divided into four sub-bands {0,…,3} of 20 MHz bandwidth for the non-high throughput (non-HT) signal. For wider bandwidths (40 MHz or 80 MHz), the sub-bands get combined.
# Visit ni.com/info and enter the Info Code
# 80211AppFWManual
#  to access the LabVIEW Communications 802.11 Application Framework Manual for more information about channelization.
inputs:
  "session": "Host Session.gtype"
    # Cluster containing all references the host uses during runtime. This cluster includes the following components:
    # FPGA interface: empty reference to the FPGA handle; needs to be cast each time it is used.
    # FlexRIO session: handle to the FlexRIO device. This component is valid only with FlexRIO devices.
    # FlexRIO TX Characterization Data: This component is valid only with FlexRIO sessions.
    # FlexRIO RX Characterization Data: This component is valid only with FlexRIO sessions.
    # USRP session: handle to the USRP device, including charaterization data. This component is valid only with USRP.
    # stop queue: handle to queue used to coordinate host shutdown between the loops.
    # send queue: handle to queue used to buffer TX packets to the target.
    # receive queue: handle to queue used to buffer RX packets from the target.
    # receive throughput queue: handle to queue used to buffer information about received RX packets (time and transferred bytes).
    # UDP receiver: handle to a UPD socket used to receive payload from outside the host.
    # PN packet: byte array used to stream payload inside the host.
  "error in": error
  "primary channel selector": UFXP(2.0) = 1  # Numeric control to determine which subband is used as the primary channel. The PHY covers 80 MHz bandwidth, which can be divided into four subbands {0,…,3} of 20 MHz bandwidth for the non-HT signal. For wider bandwidths the subbands get combined. Visit ni.com/info and enter the Info Code 80211AppFWManual to access the LabVIEW Communications 802.11 Application Framework Manual for more information about channelization.
  "primary channel center frequency": f64 = 5200000000  # Primary channel center frequency of the transmitter in Hz. Valid values depend on the device the station is running on.
outputs:
  "session dup": "Host Session.gtype"
    # Cluster containing all references the host uses during runtime. This cluster includes the following components:
    # FPGA interface: empty reference to the FPGA handle; needs to be cast each time it is used.
    # FlexRIO session: handle to the FlexRIO device. This component is valid only with FlexRIO devices.
    # FlexRIO TX Characterization Data: This component is valid only with FlexRIO sessions.
    # FlexRIO RX Characterization Data: This component is valid only with FlexRIO sessions.
    # USRP session: handle to the USRP device, including charaterization data. This component is valid only with USRP.
    # stop queue: handle to queue used to coordinate host shutdown between the loops.
    # send queue: handle to queue used to buffer TX packets to the target.
    # receive queue: handle to queue used to buffer RX packets from the target.
    # receive throughput queue: handle to queue used to buffer information about received RX packets (time and transferred bytes).
    # UDP receiver: handle to a UPD socket used to receive payload from outside the host.
    # PN packet: byte array used to stream payload inside the host.
  "error out": error
  "channelization": cluster{"x": f64, "y": f64}[][]  # Graphical indication shows which sub-band is used as the primary channel based on the Primary Channel Selector. The PHY covers 80 MHz bandwidth, which can be divided into four sub-bands {0,…,3} of 20 MHz bandwidth for the non-HT signal. For wider bandwidths (40 MHz or 80 MHz), the sub-bands get combined. Visit ni.com/info and enter the Info Code 80211AppFWManual to access the LabVIEW Communications 802.11 Application Framework Manual for more information about channelization.
types:
  T1 = cluster{"Timestamp": u32, "Transferred Bytes": u32}
  T2 = cluster{"fpga ref": any, "bus instance": u32, "instruction FIFO depth": u32, "executing on FPGA target": bool, "show error call chain": bool}
  T3 = cluster{"Actual Gain [dB]": f64, "Attenuation Table Index": i32}
  T4 = cluster{"Attenuation Table [dB]": f64[][], "Frequencies [Hz]": f64[], "IQ Imbalance Table": "IQ Imbalance.gtype"[], "Gain Table": T3[][]}
  "Register Bus Session.gtype" = Queue<"Session Data.gtype">
  "Semaphore.gtype" = i32
  "DB Queue Reference.gtype" = Queue<"Daughterboard Data.gtype">
  "niUsrpRio Session.gtype" = cluster{"FPGA Interface": any, "RIO Interface Number": u32, "Data Clock Rate": u32, "FPGA Data Clock Rate": u32, "Global Settings Register Bus": "Register Bus Session.gtype", "Radio 0 Settings Register Bus": "Register Bus Session.gtype", "Radio 1 Settings Register Bus": "Register Bus Session.gtype", "Radio Settings Bus Semaphore": "Semaphore.gtype", "DB Queues": "DB Queue Reference.gtype"[], "Characterization Data Valid?": bool, "EEPROM Header": "EEPROM Header.gtype", "Device Data Header": "EEPROM Device Data Header.gtype", "EEPROM Characterization Header": "EEPROM Characterization Header.gtype", "Characterization Data": "Characterization Data.gtype"[], "FPGA Current Version": u32, "FPGA Oldest Compatible Version": u32, "Fixed Logic Current Version": u32, "Fixed Logic Oldest Compatible Version": u32, "FPGA Radio Settings Bus Current Version": u32, "FPGA Radio Settings Bus Oldest Compatible Version": u32, "FPGA Board Config Current Version": u32, "FPGA Board Config Oldest Compatible Version": u32, "Daughterboard Clock Rate": u32}
  "Host Session.gtype" = cluster{"station number": u16, "FPGA interface": "FGPA Reference.gtype", "MAC High Requests": Queue<u8[]>, "MAC High Confirmations": Queue<u8[]>, "Triggered TX Requests": Queue<"TX Request Confirmation Reference Parameters.gtype">, "receive queue": Queue<u8[]>, "receive throughput queue": Queue<T1>, "UDP Receiver": UdpNetworkConnectionRefnum, "PN packet": u8[], "FlexRIO session": Queue<T2>, "FlexRIO TX Characterization Data": T4, "FlexRIO RX Characterization Data": T4, "USRP session": "niUsrpRio Session.gtype", "RF loop clock frequency": f64, "UDP Receiver TX Request": UdpNetworkConnectionRefnum, "UDP Receiver TX Confirmation": UdpNetworkConnectionRefnum, "UDP Receiver RX Indication": UdpNetworkConnectionRefnum, "UDP Sender": UdpNetworkConnectionRefnum}
uses:
  AFW::802_11::Configuration::Primary Channel Settings to RF Settings.gvi
diagram:
  call "Primary Channel Settings to RF Settings.gvi"(session=$session, primary channel center frequency=$"primary channel center frequency", primary channel selector=$"primary channel selector", error in=$"error in") -> (80 MHz supported=w1, session dup=w2, frequency=w3, error out=w4)
  $"session dup" <- w2
  $"error out" <- w4
  To Unsigned 8 Bit Integer(number=$"primary channel selector") -> w5
  # w6: 40 MHz
  case (w5) {
    frame 2, 3 {
      w7 = [{"x"=0, "y"=0}, {"x"=7500000, "y"=1.5}, {"x"=32500000, "y"=1.5}, {"x"=40000000, "y"=0}]
      w6 = w7
    }
    frame 0, 1, Default {
      w8 = [{"x"=-40000000, "y"=0}, {"x"=-32500000, "y"=1.5}, {"x"=-7500000, "y"=1.5}, {"x"=0, "y"=0}]
      w6 = w8
    }
  }
  # w9: 80 MHz
  case (w1) {
    frame False {
      w9 = [{"x"=-40000000, "y"=0}, {"x"=40000000, "y"=0}]
    }
    frame True {
      w10 = [{"x"=-40000000, "y"=0}, {"x"=-30000000, "y"=2}, {"x"=30000000, "y"=2}, {"x"=40000000, "y"=0}]
      w9 = w10
    }
  }
  # w11: 20 MHz
  case (w5) {
    frame 0, Default {
      w12 = [{"x"=-40000000, "y"=0}, {"x"=-35000000, "y"=1}, {"x"=-25000000, "y"=1}, {"x"=-20000000, "y"=0}]
      w11 = w12
    }
    frame 1 {
      w13 = [{"x"=-20000000, "y"=0}, {"x"=-15000000, "y"=1}, {"x"=-5000000, "y"=1}, {"x"=0, "y"=0}]
      w11 = w13
    }
    frame 2 {
      w14 = [{"x"=0, "y"=0}, {"x"=5000000, "y"=1}, {"x"=15000000, "y"=1}, {"x"=20000000, "y"=0}]
      w11 = w14
    }
    frame 3 {
      w15 = [{"x"=20000000, "y"=0}, {"x"=25000000, "y"=1}, {"x"=35000000, "y"=1}, {"x"=40000000, "y"=0}]
      w11 = w15
    }
  }
  Build Array(w9, w6, w11) -> w16
  for {
    w17 = each element of w16
    for {
      w19 = each element of w17
      Property Node(instance in=w19) -> ("x"=w21, instance out=w22)
      Add(w3, w21) -> w23
      Property Node(instance in=w22, "x"=w23) -> (instance out=w24)
      append w24 to w20
    }
    append w20 to w18
  }
  $channelization <- w18
