vi "Configure Dynamic Parameters.gvi"   [LabVIEW NXG 4.0.0]
inputs:
  "FPGA interface": "FGPA Reference.gtype"  # Interface to the device's FPGA handle.
  "error in": error
  "event enable mask": "Events Enable Mask.gtype"  # Set of Boolean controls; each control is used to enable or disable the tracking of the corresponding FPGA event. Those events are as follows: • PHY TX start request • PHY TX end indication • PHY RX start indication • PHY RX end indication • PHY CCA timing indication • PHY RX gain change indication • DCF state indication • MAC MPDU RX indication • MAC MPDU TX request
  "backoff": i32 = 4  # Backoff value that is applied before a frame is transmitted. The backoff is counted in number of slots of 9 µs duration. Based on the backoff value, the backoff counting for the backoff procedure could be fixed or random: If the backoff value is larger than or equal zero, a fixed backoff is used. If the backoff value is negative, a random backoff counting is used.
  "AGC target signal power": f64  # Target RX power in digital base band used if the AGC is enabled. The optimal value depends on the PAPR (Peak to Average Power Ratio) of the received signal.
  "CCA energy detection threshold": FXP(10.3) = -72  # Threshold for the CCA energy detection busy flag. Default: -72
outputs:
  "error out": error
types:
  "Events Enable Mask.gtype" = cluster{"PHY TX start request": bool, "PHY TX end indication": bool, "PHY RX start indication": bool, "PHY RX end indication": bool, "PHY CCA timing indication": bool, "PHY RX gain change indication": bool, "DCF state indication": bool, "MAC MPDU RX indication": bool, "MAC MPDU TX request": bool}
  T1 = cluster{"PHY TX start request": bool, "PHY TX end indication": bool, "PHY RX start indication": bool, "PHY RX end indication": bool, "PHY CCA timing indication": bool, "PHY RX gain change indication": bool, "DCF state indication": bool, "MAC MPDU RX indication": bool, "MAC MPDU TX request": bool}
diagram:
  Is Greater Or Equal To 0(x=$backoff) -> w1
  w2 = 12  # CFX data type offset
  Add(w2, $"AGC target signal power") -> w3
  To Fixed Point(number=w3) -> w4: FXP(10.3) Saturate:ConvergentRounding
  Type Cast(type=T1 {all zero or empty}, x=$"event enable mask") -> w5
  To Unsigned 16 Bit Integer(number=$backoff) -> w6
  Select(s=w1, t=w6, f=0) -> w7
  Property Node(instance in=$"FPGA interface", "fixed backoff"=w7, "CCA energy detect threshold"=$"CCA energy detection threshold", "event enable mask"=w5, "use fixed backoff"=w1, "AGC target signal power"=w4, error in=$"error in") -> (error out=w8)
  $"error out" <- w8
