vi "Configure MAC Parameters.gvi"   [LabVIEW NXG 4.0.0]
# Configures all parameters that can be modified when the station is not active.
# See also: 802.11 Configure Dynamic Parameters.gvi
inputs:
  "session in": "Host Session.gtype"
    # Cluster containing all references the host uses during runtime. This cluster includes the following components:
    # FPGA interface: empty reference to the FPGA handle; needs to be cast each time it is used.
    # FlexRIO session: handle to the FlexRIO device. This component is valid only with FlexRIO devices.
    # FlexRIO TX Characterization Data: This component is valid only with FlexRIO sessions.
    # FlexRIO RX Characterization Data: This component is valid only with FlexRIO sessions.
    # USRP session: handle to the USRP device, including charaterization data. This component is valid only with USRP.
    # stop queue: handle to queue used to coordinate host shutdown between the loops.
    # send queue: handle to queue used to buffer TX packets to the target.
    # receive queue: handle to queue used to buffer RX packets from the target.
    # receive throughput queue: handle to queue used to buffer information about received RX packets (time and transferred bytes).
    # UDP receiver: handle to a UPD socket used to receive payload from outside the host.
    # PN packet: byte array used to stream payload inside the host.
  "error in": error
  "MAC address": string  # 6-octet 80211 MAC address Default: 47:6F:4B:75:6D:61
  "dot11LongRetryLimit": u16 = 4  # Semi-static parameter—: Maximum number of retries applied for long MPDU type (sequences including RTS|CTS). If the number of retry limits is reached, discards MPDUs and associated MPDU configuration and TX vector.
  "dot11ShortRetryLimit": u16 = 7  # Semi-static parameter—Maximum number of retries applied for short MPDU type (sequences without RTS|CTS). If the number of retry limits is reached, discards MPDUs and associated MPDU configuration and TX vector.
  "control frame TX vector configuration": T5  # Applies the configured MCS values in TX vectors for RTS, CTS or ACK frames. The default control frame configuration of those frames is Non-HT-OFDM and 20 MHz bandwidth while the MCS can be configured from the host.
  "dot11RTSThreshold": u32 = 2000  # Semi-static parameter used by frame sequence selection to decide whether RTS|CTS is allowed or not. If the PSDU length is larger than dot11RTSThreshold, the {RTS | CTS | DATA | ACK} frame sequence is used. If the PSDU length is less than or equal to the dot11RTSThreshold, the {DATA | ACK} frame sequence is used. This mechanism allows stations to be configured to initiate RTS/CTS either always, never, or only on frames longer than a specified length.
outputs:
  "session dup": "Host Session.gtype"
    # Cluster containing all references the host uses during runtime. This cluster includes the following components:
    # FPGA interface: empty reference to the FPGA handle; needs to be cast each time it is used.
    # FlexRIO session: handle to the FlexRIO device. This component is valid only with FlexRIO devices.
    # FlexRIO TX Characterization Data: This component is valid only with FlexRIO sessions.
    # FlexRIO RX Characterization Data: This component is valid only with FlexRIO sessions.
    # USRP session: handle to the USRP device, including charaterization data. This component is valid only with USRP.
    # stop queue: handle to queue used to coordinate host shutdown between the loops.
    # send queue: handle to queue used to buffer TX packets to the target.
    # receive queue: handle to queue used to buffer RX packets from the target.
    # receive throughput queue: handle to queue used to buffer information about received RX packets (time and transferred bytes).
    # UDP receiver: handle to a UPD socket used to receive payload from outside the host.
    # PN packet: byte array used to stream payload inside the host.
  "error out": error
types:
  T1 = cluster{"Timestamp": u32, "Transferred Bytes": u32}
  T2 = cluster{"fpga ref": any, "bus instance": u32, "instruction FIFO depth": u32, "executing on FPGA target": bool, "show error call chain": bool}
  T3 = cluster{"Actual Gain [dB]": f64, "Attenuation Table Index": i32}
  T4 = cluster{"Attenuation Table [dB]": f64[][], "Frequencies [Hz]": f64[], "IQ Imbalance Table": "IQ Imbalance.gtype"[], "Gain Table": T3[][]}
  "Register Bus Session.gtype" = Queue<"Session Data.gtype">
  "Semaphore.gtype" = i32
  "DB Queue Reference.gtype" = Queue<"Daughterboard Data.gtype">
  "niUsrpRio Session.gtype" = cluster{"FPGA Interface": any, "RIO Interface Number": u32, "Data Clock Rate": u32, "FPGA Data Clock Rate": u32, "Global Settings Register Bus": "Register Bus Session.gtype", "Radio 0 Settings Register Bus": "Register Bus Session.gtype", "Radio 1 Settings Register Bus": "Register Bus Session.gtype", "Radio Settings Bus Semaphore": "Semaphore.gtype", "DB Queues": "DB Queue Reference.gtype"[], "Characterization Data Valid?": bool, "EEPROM Header": "EEPROM Header.gtype", "Device Data Header": "EEPROM Device Data Header.gtype", "EEPROM Characterization Header": "EEPROM Characterization Header.gtype", "Characterization Data": "Characterization Data.gtype"[], "FPGA Current Version": u32, "FPGA Oldest Compatible Version": u32, "Fixed Logic Current Version": u32, "Fixed Logic Oldest Compatible Version": u32, "FPGA Radio Settings Bus Current Version": u32, "FPGA Radio Settings Bus Oldest Compatible Version": u32, "FPGA Board Config Current Version": u32, "FPGA Board Config Oldest Compatible Version": u32, "Daughterboard Clock Rate": u32}
  "Host Session.gtype" = cluster{"station number": u16, "FPGA interface": "FGPA Reference.gtype", "MAC High Requests": Queue<u8[]>, "MAC High Confirmations": Queue<u8[]>, "Triggered TX Requests": Queue<"TX Request Confirmation Reference Parameters.gtype">, "receive queue": Queue<u8[]>, "receive throughput queue": Queue<T1>, "UDP Receiver": UdpNetworkConnectionRefnum, "PN packet": u8[], "FlexRIO session": Queue<T2>, "FlexRIO TX Characterization Data": T4, "FlexRIO RX Characterization Data": T4, "USRP session": "niUsrpRio Session.gtype", "RF loop clock frequency": f64, "UDP Receiver TX Request": UdpNetworkConnectionRefnum, "UDP Receiver TX Confirmation": UdpNetworkConnectionRefnum, "UDP Receiver RX Indication": UdpNetworkConnectionRefnum, "UDP Sender": UdpNetworkConnectionRefnum}
  T5 = cluster{"RTS MCS": UFXP(4.0), "CTS MCS": UFXP(4.0), "ACK MCS": UFXP(4.0)}
uses:
  AFW::802_11::Conversion::MAC Address from String to Byte Array.gvi
diagram:
  Property Node(instance in=$"session in") -> ("FPGA interface"=w1, instance out=w2)
  $"session dup" <- w2
  call "MAC Address from String to Byte Array.gvi"(error in=$"error in", MAC address in=$"MAC address") -> (error out=w3, MAC address out=w4)
  Property Node(instance in=w1, "device MAC address"=w4, "dot11LongRetryLimit"=$dot11LongRetryLimit, "dot11RTSThreshold"=$dot11RTSThreshold, "dot11ShortRetryLimit"=$dot11ShortRetryLimit, "control frame TX vector configuration"=$"control frame TX vector configuration", "pass all MPDUs"=FALSE, error in=w3) -> (error out=w5)
  $"error out" <- w5
