vi "Configure Static Parameters.gvi"   [LabVIEW NXG 4.0.0]
# Configures all parameters that can be modified when the station is not active.
# See also: 802.11 Configure Dynamic Parameters.gvi
inputs:
  "session in": "Host Session.gtype"
    # Cluster containing all references the host uses during runtime. This cluster includes the following components:
    # FPGA interface: empty reference to the FPGA handle; needs to be cast each time it is used.
    # FlexRIO session: handle to the FlexRIO device. This component is valid only with FlexRIO devices.
    # FlexRIO TX Characterization Data: This component is valid only with FlexRIO sessions.
    # FlexRIO RX Characterization Data: This component is valid only with FlexRIO sessions.
    # USRP session: handle to the USRP device, including charaterization data. This component is valid only with USRP.
    # stop queue: handle to queue used to coordinate host shutdown between the loops.
    # send queue: handle to queue used to buffer TX packets to the target.
    # receive queue: handle to queue used to buffer RX packets from the target.
    # receive throughput queue: handle to queue used to buffer information about received RX packets (time and transferred bytes).
    # UDP receiver: handle to a UPD socket used to receive payload from outside the host.
    # PN packet: byte array used to stream payload inside the host.
  "error in": error
  "primary channel selector": UFXP(2.0) = 1  # Channel sub-band to be used to synchronize on legacy frames. Only applies to the 802.11ac format. Default: 1
  "operation mode": T1 = "Baseband Loopback"  # Current operation mode. Baseband Loopback: the baseband output of target TX is fed into the target RX. RF Loopback: the RF stream transmitted by a station is received by the same station. RF Multi Station: a station transmits data for another station and receives its data from other stations. Default: RF Loopback
  "TX advance": u32  # RX TX turnaround time in global clock ticks (one tenth of a microsecond). The calibration value depends on the USRP model.
outputs:
  "session dup": "Host Session.gtype"
    # Cluster containing all references the host uses during runtime. This cluster includes the following components:
    # FPGA interface: empty reference to the FPGA handle; needs to be cast each time it is used.
    # FlexRIO session: handle to the FlexRIO device. This component is valid only with FlexRIO devices.
    # FlexRIO TX Characterization Data: This component is valid only with FlexRIO sessions.
    # FlexRIO RX Characterization Data: This component is valid only with FlexRIO sessions.
    # USRP session: handle to the USRP device, including charaterization data. This component is valid only with USRP.
    # stop queue: handle to queue used to coordinate host shutdown between the loops.
    # send queue: handle to queue used to buffer TX packets to the target.
    # receive queue: handle to queue used to buffer RX packets from the target.
    # receive throughput queue: handle to queue used to buffer information about received RX packets (time and transferred bytes).
    # UDP receiver: handle to a UPD socket used to receive payload from outside the host.
    # PN packet: byte array used to stream payload inside the host.
  "error out": error
types:
  T1 = enum{"Baseband Loopback", "RF Loopback", "RF Multi Station"}
  T2 = cluster{"Timestamp": u32, "Transferred Bytes": u32}
  T3 = cluster{"fpga ref": any, "bus instance": u32, "instruction FIFO depth": u32, "executing on FPGA target": bool, "show error call chain": bool}
  T4 = cluster{"Actual Gain [dB]": f64, "Attenuation Table Index": i32}
  T5 = cluster{"Attenuation Table [dB]": f64[][], "Frequencies [Hz]": f64[], "IQ Imbalance Table": "IQ Imbalance.gtype"[], "Gain Table": T4[][]}
  "Register Bus Session.gtype" = Queue<"Session Data.gtype">
  "Semaphore.gtype" = i32
  "DB Queue Reference.gtype" = Queue<"Daughterboard Data.gtype">
  "niUsrpRio Session.gtype" = cluster{"FPGA Interface": any, "RIO Interface Number": u32, "Data Clock Rate": u32, "FPGA Data Clock Rate": u32, "Global Settings Register Bus": "Register Bus Session.gtype", "Radio 0 Settings Register Bus": "Register Bus Session.gtype", "Radio 1 Settings Register Bus": "Register Bus Session.gtype", "Radio Settings Bus Semaphore": "Semaphore.gtype", "DB Queues": "DB Queue Reference.gtype"[], "Characterization Data Valid?": bool, "EEPROM Header": "EEPROM Header.gtype", "Device Data Header": "EEPROM Device Data Header.gtype", "EEPROM Characterization Header": "EEPROM Characterization Header.gtype", "Characterization Data": "Characterization Data.gtype"[], "FPGA Current Version": u32, "FPGA Oldest Compatible Version": u32, "Fixed Logic Current Version": u32, "Fixed Logic Oldest Compatible Version": u32, "FPGA Radio Settings Bus Current Version": u32, "FPGA Radio Settings Bus Oldest Compatible Version": u32, "FPGA Board Config Current Version": u32, "FPGA Board Config Oldest Compatible Version": u32, "Daughterboard Clock Rate": u32}
  "Host Session.gtype" = cluster{"station number": u16, "FPGA interface": "FGPA Reference.gtype", "MAC High Requests": Queue<u8[]>, "MAC High Confirmations": Queue<u8[]>, "Triggered TX Requests": Queue<"TX Request Confirmation Reference Parameters.gtype">, "receive queue": Queue<u8[]>, "receive throughput queue": Queue<T2>, "UDP Receiver": UdpNetworkConnectionRefnum, "PN packet": u8[], "FlexRIO session": Queue<T3>, "FlexRIO TX Characterization Data": T5, "FlexRIO RX Characterization Data": T5, "USRP session": "niUsrpRio Session.gtype", "RF loop clock frequency": f64, "UDP Receiver TX Request": UdpNetworkConnectionRefnum, "UDP Receiver TX Confirmation": UdpNetworkConnectionRefnum, "UDP Receiver RX Indication": UdpNetworkConnectionRefnum, "UDP Sender": UdpNetworkConnectionRefnum}
  T6 = cluster{"consecutive samples over threshold": u8, "squared cross correlation threshold": UFXP(1.17), "maximum peak index deviation": u8, "FFT window shift into CP": u8, "consecutive peaks for preamble detection": u8, "use static frequency shift": bool, "static frequency shift": FXP(0.48)}
diagram:
  Property Node(instance in=$"session in") -> ("FPGA interface"=w1, "RF loop clock frequency"=w2, instance out=w3)
  $"session dup" <- w3
  case ($"operation mode") {
    frame "Baseband Loopback" {
      w4 = "Internal Loopback"
      w5 = TRUE
      w6 = FALSE
    }
    frame "RF Loopback" {
      w4 = "RF"
      w5 = FALSE
      w6 = FALSE
    }
    frame "RF Multi Station" {
      w4 = "RF"
      w5 = FALSE
      w6 = TRUE
    }
  }
  w7 = T6 {"consecutive samples over threshold"=3, "squared cross correlation threshold"=0.360000610352, "maximum peak index deviation"=1, "FFT window shift into CP"=1, "consecutive peaks for preamble detection"=4, "use static frequency shift"=FALSE, "static frequency shift"=0}
  w8 = 250000000  # PHY loop clock frequency
  w9 = 1.6e-05  # preamble duration [s]
  Multiply(w8, w9) -> w10
  To Unsigned 16 Bit Integer(number=w10) -> w11
  # The number of samples to capture can be set to 4061 in case of using a PXI Chassis as a host.
  w12 = 4e-06  # OFDM symbol duration [s]
  Multiply(w2, w12) -> w13
  To Unsigned 16 Bit Integer(number=w13) -> w14
  w15 = 1e-07  # Timer resolution [s]
  Multiply(w2, w15) -> w16
  To Unsigned 16 Bit Integer(number=w16) -> w17
  To Double Precision Float(number=$"TX advance") -> w18
  Multiply(w15, w18) -> w19
  Multiply(w8, w19) -> w20
  To Unsigned 32 Bit Integer(number=w20) -> w21
  Property Node(instance in=w1, "DC Offset factor p"=6, "TX advance"=$"TX advance", "enable DC offset correction"=TRUE, "primary channel selector"=$"primary channel selector", "RX data source"=w4, "produce silent samples"=w5, "mute RX while TX active?"=w6, "trigger condition"="RX Packet Start", "number of samples to capture"=2048, "number of samples before trigger"=0, "Data clock cycles per OFDM symbol"=w14, "PHY clock cycles TX active extension"=w21, "Data clock cycles per tick (0.1us)"=w17, "synchronization configuration"=w7, "AGC timeout"=w11, "station active"=TRUE, error in=$"error in") -> (error out=w22)
  $"error out" <- w22
