vi "Frame Description to Type and Subtype.gvi"   [LabVIEW NXG 4.0.0]
# Maps internal frame subtype description enum to 802.11 standard type/subtype fields.
inputs:
  "frame subtype description": "MAC Frame Subtype.gtype" = "Association request"  # Frame subtype description as enumeration type as used for internal processing.
outputs:
  "field subtype": UFXP(4.0)  # Type description from Table 8-1 of IEEE Standard 802.11-2012.
  "field type": UFXP(2.0)  # Subtype description from Table 8-1 of IEEE Standard 802.11-2012.
types:
  "MAC Frame Subtype.gtype" = enum{"Association request", "Association response", "Reassociation request", "Reassociation response", "Probe request", "Probe response", "Timing Advertisement", "Reserved Management 0111", "Beacon", "ATIM", "Disassociation", "Authentication", "Deauthentication", "Action", "Action No Ack", "Reserved Management 1111", "Reserved Control 0000", "Reserved Control 0001", "Reserved Control 0010", "Reserved Control 0011", "Beamforming Report Poll", "VHT NDP Announcement", "Control Frame Extension", "Control Wrapper", "Block Ack Request", "Block Ack", "PS-Poll", "RTS", "CTS", "ACK", "CF-End", "CF-End + CF-Ack", "Data", "Data + CF-Ack", "Data + CF-Poll", "Data + CF-Ack + CF-Poll", "Null", "CF-Ack", "CF-Poll", "CF-Ack + CF-Poll", "QoS Data", "QoS Data + CF-Ack", "QoS Data + CF-Poll", "QoS Data + CF-Ack + CF-Poll", "QoS Null", "Reserved Data 1101", "QoS CF-Poll", "QoS CF-Ack + CF-Poll", "DMG Beacon", "Reserved Extension 0001", "Reserved Extension 0010", "Reserved Extension 0011", "Reserved Extension 0100", "Reserved Extension 0101", "Reserved Extension 0110", "Reserved Extension 0111", "Reserved Extension 1000", "Reserved Extension 1001", "Reserved Extension 1010", "Reserved Extension 1011", "Reserved Extension 1100", "Reserved Extension 1101", "Reserved Extension 1110", "Reserved Extension 1111"}
diagram:
  # cast to U8
  Type Cast(type=u8 0, x=$"frame subtype description") -> w1
  # extract bits 3..0
  # wrap
  To Fixed Point(number=w1) -> w2: UFXP(4.0) Wrap:ConvergentRounding
  $"field subtype" <- w2
  # extract bits 5..4
  Logical Shift(x=w1, y=-4) -> w3
  # wrap
  To Fixed Point(number=w3) -> w4: UFXP(2.0) Wrap:ConvergentRounding
  $"field type" <- w4
