vi "MAC Address from String to Byte Array.gvi"   [LabVIEW NXG 4.0.0]
# Converts the given MAC address from a string (6-octet format) to an array in byte (U8) format.
inputs:
  "error in": error
  "MAC address in": string = "47:6F:4B:75:6D:61"  # 6-octet 80211 MAC address Default: 47:6F:4B:75:6D:61
outputs:
  "error out": error
  "MAC address out": u8[6]
  "MAC address valid": bool  # Boolean indicators show if the given Device MAC Address and Destination MAC Address associated with the stations are valid.
uses:
  NI::G Core::Error::Filter Error Code.gvi
diagram:
  Scan From String(formatString="%2x:%2x:%2x:%2x:%2x:%2x", inputString=$"MAC address in", startLoc=0, errIn=$"error in") -> (errOut=w1, out0=w2, out1=w3, out2=w4, out3=w5, out4=w6, out5=w7)
  call "Filter Error Code.gvi"(code to clear=85, error in=w1) -> (error cleared?=w8, error out=w9)
  $"error out" <- w9
  Not(x=w8) -> w10
  $"MAC address valid" <- w10
  To Unsigned 8 Bit Integer(number=w2) -> w11
  To Unsigned 8 Bit Integer(number=w3) -> w12
  To Unsigned 8 Bit Integer(number=w4) -> w13
  To Unsigned 8 Bit Integer(number=w5) -> w14
  To Unsigned 8 Bit Integer(number=w6) -> w15
  To Unsigned 8 Bit Integer(number=w7) -> w16
  Build Array(w11, w12, w13, w14, w15, w16) -> w17
  Type Cast(type=u8[6] default, x=w17) -> w18
  $"MAC address out" <- w18
