vi "Byte Array to MAC RX Indication.gvi"   [LabVIEW NXG 4.0.0]
# Converts a least-significant bit (LSB) ordered byte array into a MAC RX indication cluster.
inputs:
  "array": u8[64]  # Serialized byte array of MAC RX indication in LSB order.
outputs:
  "MAC RX indication": "MAC RX Indication.gtype"  # Consists MAC configuration information passed to the subsequent module in MAC RX chain: RX vector, RX status, MPDU configuration
types:
  "PHY Frame Format.gtype" = enum{"NON_HT_OFDM", "VHT", "NON_HT_DUP_OFDM"}
  "Bandwidth.gtype" = enum{"20 MHz", "40 MHz", "80 MHz"}
  "Non HT Bandwidth.gtype" = enum{"20 MHz", "40 MHz", "80 MHz", "160 MHz"}
  "RX Vector.gtype" = cluster{"format": "PHY Frame Format.gtype", "bandwidth": "Bandwidth.gtype", "PSDU length": u32, "MCS": UFXP(4.0), "non HT bandwidth": "Non HT Bandwidth.gtype", "dynamic bandwidth support": bool}
  "A-MPDU De-Aggregation Status.gtype" = enum{"A-MPDU De-Aggregation not executed", "A-MPDU De-Aggregation successful", "PSDU length mismatch", "VHT delimiter CRC fail", "VHT delimiter signature comparison fail", "EOF field check fail", "MPDU length mismatch"}
  "FCS Check Status.gtype" = enum{"FCS check not executed", "FCS check pass", "FCS check fail"}
  "MPDU Length Check Status.gtype" = enum{"MPDU length check not executed", "MPDU length check pass", "MPDU length check not standard compliant", "MPDU length check exceeds implemented buffer"}
  "MPDU Disassembly Status.gtype" = enum{"Disassembly not executed", "Disassembly successful", "Disassembly done partially", "Disassembly not successful"}
  "MPDU Filtering Status.gtype" = enum{"MPDU Filtering not executed", "MPDU valid for further processing", "MPDU pass through for sniffer mode"}
  "MSDU Defragmentation Status.gtype" = enum{"Defragmentation not executed", "Unfragmented MSDU successfully received", "Unsupported MSDU fragment received"}
  "MSDU Duplicate Detection Status.gtype" = enum{"Duplicate detection not executed", "Duplicate detection successfully passed", "Duplicate detected"}
  "RX Status.gtype" = cluster{"A-MPDU de-aggregation status": "A-MPDU De-Aggregation Status.gtype", "MPDU FCS check status": "FCS Check Status.gtype", "MPDU length check status": "MPDU Length Check Status.gtype", "MPDU disassembly status": "MPDU Disassembly Status.gtype", "MPDU Filtering Status": "MPDU Filtering Status.gtype", "MSDU Defragmentation Status": "MSDU Defragmentation Status.gtype", "MSDU Duplicate Detection Status": "MSDU Duplicate Detection Status.gtype"}
  "MPDU Configuration.gtype" = cluster{"frame control": "MAC Header Frame Control.gtype", "header contents": "MAC Header Contents.gtype", "parameters": "MPDU Parameters.gtype"}
  "MAC RX Indication.gtype" = cluster{"RX vector": "RX Vector.gtype", "RX status": "RX Status.gtype", "MPDU configuration": "MPDU Configuration.gtype", "valid": bool}
uses:
  AFW::802_11::Conversion::MAC RX Indication::Byte Array to RX Vector.gvi
  AFW::802_11::Conversion::MAC RX Indication::Byte Array to RX Status.gvi
  AFW::802_11::Conversion::Shared::Byte Array to MAC Header Frame Control.gvi
  AFW::802_11::Conversion::Shared::Byte Array to MAC Header Contents.gvi
  AFW::802_11::Conversion::Shared::Byte Array to MPDU Parameters.gvi
diagram:
  Split 1D Array(array=$array, index=9) -> (first subarray=w1, second subarray=w2)
  Type Cast(type=u8[9] default, x=w1) -> w3
  call "Byte Array to RX Vector.gvi"(array=w3) -> (RX vector=w4)
  Split 1D Array(array=w2, index=6) -> (first subarray=w5, second subarray=w6)
  Type Cast(type=u8[6] [0, 0, 0, 0, 0, 0], x=w5) -> w7
  call "Byte Array to RX Status.gvi"(array=w7) -> (RX status=w8)
  Split 1D Array(array=w6, index=2) -> (first subarray=w9, second subarray=w10)
  Type Cast(type=u8[2] default, x=w9) -> w11
  call "Byte Array to MAC Header Frame Control.gvi"(array=w11) -> (MAC header frame control=w12)
  Split 1D Array(array=w10, index=40) -> (first subarray=w13, second subarray=w14)
  w15 = u8[40] [90, 125, 136, 29, 173, 132, 18, 70, 77, 202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]
  Type Cast(type=w15, x=w13) -> w16
  call "Byte Array to MAC Header Contents.gvi"(array=w16) -> (MAC header contents=w17)
  Type Cast(type=u8[7] [0, 0, 0, 0, 0, 0, 0], x=w14) -> w18
  call "Byte Array to MPDU Parameters.gvi"(array=w18) -> (MPDU parameters=w19)
  Property Node(instance in="MPDU Configuration.gtype" {all zero or empty}, "frame control"=w12, "header contents"=w17, "parameters"=w19) -> (instance out=w20)
  Property Node(instance in="MAC RX Indication.gtype" {all zero or empty}, "RX vector"=w4, "RX status"=w8, "MPDU configuration"=w20, "valid"=FALSE) -> (instance out=w21)
  $"MAC RX indication" <- w21
