vi "Byte Array to RX Status.gvi"   [LabVIEW NXG 4.0.0]
# Converts a least-significant bit (LSB) ordered byte array into a RX status cluster.
inputs:
  "array": u8[6]  # Serialized byte array of RX status in LSB order.
outputs:
  "RX status": "RX Status.gtype"  # %RX STATUS%
types:
  "A-MPDU De-Aggregation Status.gtype" = enum{"A-MPDU De-Aggregation not executed", "A-MPDU De-Aggregation successful", "PSDU length mismatch", "VHT delimiter CRC fail", "VHT delimiter signature comparison fail", "EOF field check fail", "MPDU length mismatch"}
  "FCS Check Status.gtype" = enum{"FCS check not executed", "FCS check pass", "FCS check fail"}
  "MPDU Length Check Status.gtype" = enum{"MPDU length check not executed", "MPDU length check pass", "MPDU length check not standard compliant", "MPDU length check exceeds implemented buffer"}
  "MPDU Disassembly Status.gtype" = enum{"Disassembly not executed", "Disassembly successful", "Disassembly done partially", "Disassembly not successful"}
  "MPDU Filtering Status.gtype" = enum{"MPDU Filtering not executed", "MPDU valid for further processing", "MPDU pass through for sniffer mode"}
  "MSDU Defragmentation Status.gtype" = enum{"Defragmentation not executed", "Unfragmented MSDU successfully received", "Unsupported MSDU fragment received"}
  "MSDU Duplicate Detection Status.gtype" = enum{"Duplicate detection not executed", "Duplicate detection successfully passed", "Duplicate detected"}
  "RX Status.gtype" = cluster{"A-MPDU de-aggregation status": "A-MPDU De-Aggregation Status.gtype", "MPDU FCS check status": "FCS Check Status.gtype", "MPDU length check status": "MPDU Length Check Status.gtype", "MPDU disassembly status": "MPDU Disassembly Status.gtype", "MPDU Filtering Status": "MPDU Filtering Status.gtype", "MSDU Defragmentation Status": "MSDU Defragmentation Status.gtype", "MSDU Duplicate Detection Status": "MSDU Duplicate Detection Status.gtype"}
diagram:
  Array Index(array=$array) -> (out0[_]=w1, out1[_]=w2, out2[_]=w3, out3[_]=w4, out4[_]=w5, out5[_]=w6)
  w7 = "A-MPDU De-Aggregation Status.gtype" "A-MPDU De-Aggregation not executed"
  Type Cast(type=w7, x=w1) -> w8
  Type Cast(type="FCS Check Status.gtype" "FCS check not executed", x=w2) -> w9
  w10 = "MPDU Length Check Status.gtype" "MPDU length check not executed"
  Type Cast(type=w10, x=w3) -> w11
  Type Cast(type="MPDU Disassembly Status.gtype" "Disassembly not executed", x=w4) -> w12
  Type Cast(type="MPDU Filtering Status.gtype" "MPDU Filtering not executed", x=w5) -> w13
  w14 = "MSDU Defragmentation Status.gtype" "Defragmentation not executed"
  Type Cast(type=w14, x=w6) -> w15
  Property Node(instance in="RX Status.gtype" {all zero or empty}, "A-MPDU de-aggregation status"=w8, "MPDU FCS check status"=w9, "MPDU length check status"=w11, "MPDU disassembly status"=w12, "MPDU Filtering Status"=w13, "MSDU Defragmentation Status"=w15) -> (instance out=w16)
  $"RX status" <- w16
