vi "Byte Array to RX Vector.gvi"   [LabVIEW NXG 4.0.0]
# Converts a least-significant bit (LSB) ordered byte array into a RX vector cluster.
inputs:
  "array": u8[9]  # Serialized byte array of RX vector in LSB order.
outputs:
  "RX vector": "RX Vector.gtype"  # %RX VECTOR%
types:
  "PHY Frame Format.gtype" = enum{"NON_HT_OFDM", "VHT", "NON_HT_DUP_OFDM"}
  "Bandwidth.gtype" = enum{"20 MHz", "40 MHz", "80 MHz"}
  "Non HT Bandwidth.gtype" = enum{"20 MHz", "40 MHz", "80 MHz", "160 MHz"}
  "RX Vector.gtype" = cluster{"format": "PHY Frame Format.gtype", "bandwidth": "Bandwidth.gtype", "PSDU length": u32, "MCS": UFXP(4.0), "non HT bandwidth": "Non HT Bandwidth.gtype", "dynamic bandwidth support": bool}
diagram:
  Split 1D Array(array=$array, index=2) -> (first subarray=w1, second subarray=w2)
  Array Index(array=w1) -> (out0[_]=w3, out1[_]=w4)
  To Signed 32 Bit Integer(number=w3) -> w5
  Array Index(array=["NON_HT_OFDM", "VHT", "NON_HT_DUP_OFDM"]) -> (out0[w5]=w6)
  To Signed 32 Bit Integer(number=w4) -> w7
  Array Index(array=["20 MHz", "40 MHz", "80 MHz"]) -> (out0[w7]=w8)
  Split 1D Array(array=w2, index=4) -> (first subarray=w9, second subarray=w10)
  Array Index(array=w10) -> (out0[_]=w11, out1[_]=w12, out2[_]=w13)
  To Fixed Point(fixed-point type=UFXP(4.0) 0, number=w11) -> w14
  To Signed 32 Bit Integer(number=w12) -> w15
  Array Index(array=["20 MHz", "40 MHz", "80 MHz", "160 MHz"]) -> (out0[w15]=w16)
  Is Not Equal To 0(x=w13) -> w17
  Reverse 1D Array(array=w9) -> (reversed array=w18)
  Array Index(array=w18) -> (out0[_]=w19, out1[_]=w20, out2[_]=w21, out3[_]=w22)
  Join Numbers(high(x)=w19, low(x)=w20) -> w23
  Join Numbers(high(x)=w21, low(x)=w22) -> w24
  Join Numbers(high(x)=w23, low(x)=w24) -> w25
  Property Node(instance in="RX Vector.gtype" {all zero or empty}, "format"=w6, "bandwidth"=w8, "PSDU length"=w25, "MCS"=w14, "non HT bandwidth"=w16, "dynamic bandwidth support"=w17) -> (instance out=w26)
  $"RX vector" <- w26
