vi "Create TX Request.gvi"   [LabVIEW NXG 4.0.0]
# Creates MAC service data unit (MSDU) TX request cluster out of required PHY/MAC transmission parameters. This is intended to facilitate TX configuration by restricting parameter set to really required inputs.
inputs:
  "device MAC address": string
  "MSDU data": u8[]
  "destination MAC address": string
  "MCS": UFXP(4.0)
  "bandwidth": "Bandwidth.gtype" = "20 MHz"
  "format": "PHY Frame Format.gtype" = "NON_HT_OFDM"
  "error in": error
outputs:
  "MAC MSDU TX request out": "MAC TX Request.gtype"  # Generated by the MAC middle SAP to requests the transmission of a single MAC Service Data Unit (MSDU) or a MAC Management Protocol Data Unit (MMPDU) from the sub-sequent MAC TX modules.
  "error out": error
types:
  "MPDU Configuration.gtype" = cluster{"frame control": "MAC Header Frame Control.gtype", "header contents": "MAC Header Contents.gtype", "parameters": "MPDU Parameters.gtype"}
  "PHY Frame Format.gtype" = enum{"NON_HT_OFDM", "VHT", "NON_HT_DUP_OFDM"}
  "Bandwidth.gtype" = enum{"20 MHz", "40 MHz", "80 MHz"}
  "TX Vector.gtype" = cluster{"format": "PHY Frame Format.gtype", "bandwidth": "Bandwidth.gtype", "PSDU length": u32, "(A-)MPDU length": u32, "MCS": UFXP(4.0)}
  "MAC TX Request.gtype" = cluster{"MPDU configuration": "MPDU Configuration.gtype", "TX vector": "TX Vector.gtype", "valid": bool}
uses:
  AFW::802_11::Conversion::MAC Address from String to Byte Array.gvi
  AFW::802_11::Conversion::Frame Description to Type and Subtype.gvi
diagram:
  call "MAC Address from String to Byte Array.gvi"(error in=$"error in", MAC address in=$"device MAC address") -> (error out=w1, MAC address out=w2)
  call "Frame Description to Type and Subtype.gvi"(frame subtype description="Data") -> (field type=w3, field subtype=w4)
  Array Size(array=$"MSDU data") -> (size(s)=w5)
  To Unsigned 16 Bit Integer(number=w5) -> w6
  call "MAC Address from String to Byte Array.gvi"(error in=w1, MAC address in=$"destination MAC address") -> (error out=w7, MAC address out=w8)
  Property Node(instance in="MAC TX Request.gtype" {all zero or empty}, "TX vector:format"=$format, "TX vector:bandwidth"=$bandwidth, "TX vector:MCS"=$MCS, "MPDU configuration:frame control:type"=w3, "MPDU configuration:frame control:subtype"=w4, "MPDU configuration:frame control:to DS"=FALSE, "MPDU configuration:frame control:from DS"=FALSE, "MPDU configuration:header contents:source address"=w2, "MPDU configuration:header contents:destination address"=w8, "MPDU configuration:header contents:recipient address"=w8, "MPDU configuration:header contents:transmitter address"=w2, "MPDU configuration:header contents:basic service set identifier"=u8[6] default, "MPDU configuration:parameters:MSDU length"=w6, "valid"=TRUE) -> (instance out=w9)
  $"MAC MSDU TX request out" <- w9
  $"error out" <- w7
