vi "TX Vector to Byte Array.gvi"   [LabVIEW NXG 4.0.0]
# Converts a TX vector cluster into a byte array in least-significant bit (LSB) order. Enums are converted into an U8 of equal size.
inputs:
  "TX vector": "TX Vector.gtype"  # %TX VECTOR%
outputs:
  "array": u8[11]  # Serialized byte array of TX vector in LSB order.
types:
  "PHY Frame Format.gtype" = enum{"NON_HT_OFDM", "VHT", "NON_HT_DUP_OFDM"}
  "Bandwidth.gtype" = enum{"20 MHz", "40 MHz", "80 MHz"}
  "TX Vector.gtype" = cluster{"format": "PHY Frame Format.gtype", "bandwidth": "Bandwidth.gtype", "PSDU length": u32, "(A-)MPDU length": u32, "MCS": UFXP(4.0)}
diagram:
  Property Node(instance in=$"TX vector") -> ("format"=w1, "bandwidth"=w2, "PSDU length"=w3, "(A-)MPDU length"=w4, "MCS"=w5)
  To Unsigned 8 Bit Integer(number=w5) -> w6
  Type Cast(type=u8 0, x=w1) -> w7
  Type Cast(type=u8 0, x=w2) -> w8
  Build Array(w7, w8) -> w9
  Split Number(x=w3) -> (high(x)=w10, low(x)=w11)
  Split Number(x=w10) -> (high(x)=w12, low(x)=w13)
  Split Number(x=w11) -> (high(x)=w14, low(x)=w15)
  Build Array(w12, w13, w14, w15) -> w16
  Reverse 1D Array(array=w16) -> (reversed array=w17)
  Split Number(x=w4) -> (high(x)=w18, low(x)=w19)
  Split Number(x=w18) -> (high(x)=w20, low(x)=w21)
  Split Number(x=w19) -> (high(x)=w22, low(x)=w23)
  Build Array(w20, w21, w22, w23) -> w24
  Reverse 1D Array(array=w24) -> (reversed array=w25)
  Build Array(w9, w17, w25, w6) -> w26
  Type Cast(type=u8[11] [0, 0, 0, 0, 0, 0, 0, 0, 0, 0, 0], x=w26) -> w27
  $array <- w27
