vi "Prepare Channel Estimation.gvi"   [LabVIEW NXG 4.0.0]
# Reads the channel estimation direct memory access (DMA) FIFO and computes the channel estimation magnitude and phase. The DMA FIFO contains the channel estimates from legacy long training field (L-LTF) and very high throughput long training field (VHT-LTF).
inputs:
  "FPGA interface": "FGPA Reference.gtype"  # Interface to the device's FPGA handle.
  "error in": error
outputs:
  "error out": error
  "channel estimation": cluster{"Element 1": i32[], "Element 2": f64[]}[]  # 2D array containing the channel estimation (both magnitude and phase).
  "update power spectrum": bool  # Determines whether the channel estimation array contains valid information.
diagram:
  Host Fifo Read Node[FifoName="AFW::802_11::Resources::802.11 AFW Resources.grsc::T2H Channel Estimation"](error in=$"error in", number of elements=0, reference in=$"FPGA interface", timeout (ms)=-1) -> (elements remaining=w1, error out=w2, reference out=w3)
  Quotient And Remainder(x=w1, y=256) -> (floor(x/y)=w4)
  # w5: index of first subcarrier
  Is Greater Than 0(x=w4) -> w6
  $"update power spectrum" <- w6
  w7 = 245  # total number of subcarriers
  for (N = 256) (iteration -> i1) {
    To Signed 32 Bit Integer(number=i1) -> w9
    Subtract(x=w9, y=128) -> w10
    append w10 to w8
  }
  To Signed 32 Bit Integer(number=256) -> w11
  w12 = -122  # smallest frequency offset index
  w13 = 128  # FFT center
  # based on VHT 80 MHz
  Add(w13, w12) -> w5
  Multiply(w4, 256) -> w14
  Host Fifo Read Node[FifoName="AFW::802_11::Resources::802.11 AFW Resources.grsc::T2H Channel Estimation"](error in=w2, number of elements=w14, reference in=w3, timeout (ms)=-1) -> (data=w15, error out=w16)
  # w7: visible subcarriers
  # w8: subcarrier
  # offset indizes
  case (w6) {
    frame False, Default {
      w17 = default
    }
    frame True {
      Array Subset(array=w8, index0=w5, length0=w7) -> w18
      # increase chance to get a VHT-LTF
      case (w4) {
        frame Default {
          Array Subset(array=w15, index0=w11, length0=w11) -> w19
        }
        frame 1 {
          Array Subset(array=w15, length0=w11) -> w19
        }
      }
      Array Subset(array=w19, index0=w5, length0=w7) -> w20
      Split Number(x=w20) -> (high(x)=w21, low(x)=w22)
      To Signed 32 Bit Integer(number=w22) -> w23
      Reinterpret Number[RestrictToSameWordLength=True](data in=w23, type=FXP(11.21) 0) -> (data out=w24)
      To Signed 32 Bit Integer(number=w21) -> w25
      Reinterpret Number[RestrictToSameWordLength=True](data in=w25, type=FXP(11.21) 0) -> (data out=w26)
      Real And Imaginary To Complex(x=w24, y=w26) -> w27
      To Double Precision Complex(number=w27) -> w28
      Complex To Polar(r * e^(i*theta)=w28) -> (r=w29, theta=w30)
      Build Cluster(w18, w29) -> w31
      Build Cluster(w18, w30) -> w32
      Build Array(w31, w32) -> w17
    }
  }
  $"channel estimation" <- w17
  $"error out" <- w16
