vi "Prepare Constellation.gvi"   [LabVIEW NXG 4.0.0]
# Reads the constellation direct memory access (DMA) FIFO and computes the constellation. The DMA FIFO contains the constellation points as well as information about the subcarrier index, OFDM symbol index, and field type.
inputs:
  "FPGA interface": "FGPA Reference.gtype"  # Interface to the device's FPGA handle.
  "error in": error
  "maximal number of subcarriers": i32 = 4800  # Maximum number of subcarrier data to read from DMA FIFO to compute the constellation from. Default: 4,800
outputs:
  "error out": error
  "data field constellation": c128[]  # Contains a constellation formed from the L-Data and VHT-Data fields only.
  "update constellation": bool  # Determines whether a data field constellation should be plotted (only if it contains more than three OFDM symbols).
  "full constellation": c128[]  # Contains a constellation formed from all fields (for debugging purposes only).
uses:
  AFW::802_11::Conversion::Unpack RX Constellation.gvi
diagram:
  # limit size to 100
  # OFDM symbols (legacy case)
  Host Fifo Read Node[FifoName="AFW::802_11::Resources::802.11 AFW Resources.grsc::T2H Constellation"](error in=$"error in", number of elements=0, reference in=$"FPGA interface", timeout (ms)=-1) -> (elements remaining=w1, error out=w2, reference out=w3)
  Host Fifo Read Node[FifoName="AFW::802_11::Resources::802.11 AFW Resources.grsc::T2H Constellation"](error in=w2, number of elements=w1, reference in=w3, timeout (ms)=-1) -> (data=w4, error out=w5)
  Delete From Array(inArray=w4, length (1)=$"maximal number of subcarriers") -> (deleted=w6)
  call "Unpack RX Constellation.gvi"(data=w6) -> (IQ data=w7, field map=w8)
  Array Size(array=w7) -> (size(s)=w9)
  Initialize Array(element=0+0i, size=w9) -> w10
  s1 = w10  # shift register
  s2 = 0  # shift register
  for {
    w11 = each element of w8
    w12 = each element of w7
    # s1: Data field
    Property Node(instance in=w11) -> ("L-Data"=w13, "VHT-Data"=w14)
    Logical Or(w13, w14) -> w15
    case (w15) {
      frame False, Default {
        w16 = s1
        w17 = s2
      }
      frame True {
        Replace Array Subset(inArray=s1, index=s2, new=w12) -> w16
        Increment(x=s2) -> w17
      }
    }
    next s1 = w16
    next s2 = w17
  }
  Array Subset(array=s1, length0=s2) -> w18
  $"data field constellation" <- w18
  Array Size(array=w18) -> (size(s)=w19)
  # update in case of more
  # than 3 OFDM symbols
  # of data (52*3)
  Is Greater(x=w19, y=156) -> w20
  $"update constellation" <- w20
  $"full constellation" <- w7
  Property Node(instance in=$"FPGA interface", "T2H Constellation number of samples"=4096, "T2H Constellation reset"=TRUE, "T2H Constellation reset"=FALSE, error in=$"error in") -> (error out=w21)
  Merge Errors(w5, w21) -> (error out=w22)
  $"error out" <- w22
