vi "Prepare MAC TX and RX Statistics.gvi"   [LabVIEW NXG 4.0.0]
inputs:
  "MAC RX statistics in": "MAC RX Statistics.gtype"
  "MAC TX statistics in": "MAC TX Statistics.gtype"
  "values per second": bool
  "1s passed": bool
outputs:
  "MAC RX statistics out": "MAC RX Statistics.gtype"
  "MAC TX statistics out": "MAC TX Statistics.gtype"
types:
  "MAC RX Statistics.gtype" = cluster{"preamble detected": u32, "PSDUs received": u32, "MPDU CRC OK": u32, "RTS detected": u32, "CTS detected": u32, "Data detected": u32, "ACK detected": u32}
  "MAC TX Statistics.gtype" = cluster{"RTS triggered": u32, "CTS triggered": u32, "Data triggered": u32, "ACK triggered": u32}
diagram:
  Feedback Node(initial value="MAC TX Statistics.gtype" {all zero or empty}, input=w1) -> w2
  Feedback Node(initial value="MAC RX Statistics.gtype" {all zero or empty}, input=w3) -> w4
  Feedback Node(initial value="MAC TX Statistics.gtype" {all zero or empty}, input=w5) -> w6
  Feedback Node(initial value="MAC RX Statistics.gtype" {all zero or empty}, input=w7) -> w8
  # $"MAC RX statistics in": MAC RX current
  # $"MAC TX statistics in": MAC TX current
  # w7: MAC RX previous
  # w5: MAC TX previous
  # w3: MAC RX per sec.
  # w1: MAC TX per sec.
  case ($"1s passed") {
    frame False, Default {
      w1 = w2
      w3 = w4
      w7 = w8
      w5 = w6
    }
    frame True {
      Subtract(x=$"MAC RX statistics in", y=w8) -> w3
      Subtract(x=$"MAC TX statistics in", y=w6) -> w1
      w7 = $"MAC RX statistics in"
      w5 = $"MAC TX statistics in"
    }
  }
  Not(x=$"values per second") -> w9
  Select(s=w9, t=$"MAC RX statistics in", f=w3) -> w10
  $"MAC RX statistics out" <- w10
  Select(s=w9, t=$"MAC TX statistics in", f=w1) -> w11
  $"MAC TX statistics out" <- w11
