vi "Prepare RX Power Spectrum.gvi"   [LabVIEW NXG 4.0.0]
# Reads the RX power spectrum direct memory access (DMA) FIFO and computes a power spectrum from it. The DMA FIFO contains the I/Q samples from the RX processing chain.
inputs:
  "FPGA interface": "FGPA Reference.gtype"  # Interface to the device's FPGA handle.
  "error in": error
outputs:
  "error out": error
  "RX power spectrum": T1  # FFT power spectrum of RX I/Q samples.
  "update power spectrum": bool  # Determines whether the RX power spectrum array contains valid information.
types:
  T1 = cluster{"f0": f64, "df": f64, "magnitude": f64[]}
  T2 = enum{"No averaging", "Vector averaging", "RMS averaging", "Peak hold"}
  "Averaging Parameters.gtype" = cluster{"averaging mode": T2, "weighting mode": enum{"Linear", "Exponential"}, "number of averages": u32}
uses:
  AFW::Common::Type Conversion::U32 to CFX3.13.gvi
  NI::Analysis::Measurement::Power Spectrum for 1 Chan (CDB).gvi
diagram:
  Host Fifo Read Node[FifoName="AFW::802_11::Resources::802.11 AFW Resources.grsc::T2H RX Power Spectrum"](error in=$"error in", number of elements=0, reference in=$"FPGA interface", timeout (ms)=-1) -> (elements remaining=w1, error out=w2, reference out=w3)
  Quotient And Remainder(x=w1, y=4096) -> (floor(x/y)=w4)
  Is Greater Than 0(x=w4) -> w5
  $"update power spectrum" <- w5
  To Signed 32 Bit Integer(number=4096) -> w6
  Multiply(w4, 4096) -> w7
  Host Fifo Read Node[FifoName="AFW::802_11::Resources::802.11 AFW Resources.grsc::T2H RX Power Spectrum"](error in=w2, number of elements=w7, reference in=w3, timeout (ms)=-1) -> (data=w8, error out=w9)
  Property Node(instance in=$"FPGA interface", "T2H RX Power Spectrum rearm"=TRUE, "T2H RX Power Spectrum rearm"=FALSE, error in=$"error in") -> (error out=w10)
  Merge Errors(w9, w10) -> (error out=w11)
  case (w5) {
    frame False, Default {
      w12 = default
      w13 = w11
    }
    frame True {
      Array Subset(array=w8, length0=w6) -> w14
      call "U32 to CFX3.13.gvi"(data in=w14) -> (data out=w15)
      To Double Precision Complex(number=w15) -> w16
      Reciprocal(x=80000000) -> w17
      Property Node(instance in=waveform<c128> {dt=1, Y=[]}, "Y"=w16, "dt"=w17) -> (instance out=w18)
      w19 = "Averaging Parameters.gtype" {"averaging mode"="No averaging", "weighting mode"="Exponential", "number of averages"=10}
      call "Power Spectrum for 1 Chan (CDB).gvi"(signal=w18, window type="Hanning"(1), averaging parameters=w19, dB on=TRUE, error in=w11, restart averaging=FALSE) -> (power spectrum=w12, error out=w13)
    }
  }
  $"RX power spectrum" <- w12
  $"error out" <- w13
