vi "Prepare TX Power Spectrum.gvi"   [LabVIEW NXG 4.0.0]
# Reads the TX power spectrum direct memory access (DMA) FIFO and computes a power spectrum from it. The DMA FIFO contains the I/Q samples from the TX processing chain.
inputs:
  "FPGA interface": "FGPA Reference.gtype"  # Interface to the device's FPGA handle.
  "error in": error
outputs:
  "error out": error
  "TX power spectrum": T1  # FFT power spectrum of TX I/Q samples.
  "update power spectrum": bool  # Determines whether the TX power spectrum array contains valid information.
types:
  T1 = cluster{"f0": f64, "df": f64, "magnitude": f64[]}
  T2 = enum{"No averaging", "Vector averaging", "RMS averaging", "Peak hold"}
  "Averaging Parameters.gtype" = cluster{"averaging mode": T2, "weighting mode": enum{"Linear", "Exponential"}, "number of averages": u32}
uses:
  AFW::Common::Type Conversion::U32 to CFX3.13.gvi
  NI::Analysis::Measurement::Power Spectrum for 1 Chan (CDB).gvi
diagram:
  Host Fifo Read Node[FifoName="AFW::802_11::Resources::802.11 AFW Resources.grsc::T2H TX Baseband"](error in=$"error in", number of elements=0, reference in=$"FPGA interface", timeout (ms)=-1) -> (elements remaining=w1, error out=w2, reference out=w3)
  Is Greater(x=w1, y=1024) -> w4
  $"update power spectrum" <- w4
  Host Fifo Read Node[FifoName="AFW::802_11::Resources::802.11 AFW Resources.grsc::T2H TX Baseband"](error in=w2, number of elements=w1, reference in=w3, timeout (ms)=-1) -> (data=w5, error out=w6)
  To Signed 32 Bit Integer(number=1024) -> w7
  Property Node(instance in=$"FPGA interface", "T2H TX Baseband number of samples"=4096, "T2H TX Baseband reset"=TRUE, "T2H TX Baseband reset"=FALSE) -> (error out=w8)
  Merge Errors(w6, w8) -> (error out=w9)
  case (w4) {
    frame False, Default {
      w10 = default
      w11 = w9
    }
    frame True {
      Delete From Array(inArray=w5, length (1)=w7) -> (deleted=w12)
      call "U32 to CFX3.13.gvi"(data in=w12) -> (data out=w13)
      To Double Precision Complex(number=w13) -> w14
      Reciprocal(x=80000000) -> w15
      Property Node(instance in=waveform<c128> {dt=1, Y=[]}, "Y"=w14, "dt"=w15) -> (instance out=w16)
      w17 = "Averaging Parameters.gtype" {"averaging mode"="No averaging", "weighting mode"="Exponential", "number of averages"=10}
      call "Power Spectrum for 1 Chan (CDB).gvi"(signal=w16, window type="Hanning"(1), averaging parameters=w17, dB on=TRUE, error in=w9, restart averaging=FALSE) -> (power spectrum=w10, error out=w11)
    }
  }
  $"TX power spectrum" <- w10
  $"error out" <- w11
