vi "Read Event FIFO.gvi"   [LabVIEW NXG 4.0.0]
# Reads event data from the Event direct memory access (DMA) FIFO. Each event consists of a time stamp and the event data, each represented by a U64. The node ensures that only corresponding values are read.
inputs:
  "FPGA interface": "FGPA Reference.gtype"  # Interface to the device's FPGA handle.
  "error in": error
outputs:
  "raw events": u64[][]  # 1D-array containing the muxed time stamp and event data.
  "FPGA interface dup": "FGPA Reference.gtype"  # Interface to the device's FPGA handle.
  "error out": error
diagram:
  Host Fifo Read Node[FifoName="AFW::802_11::Resources::802.11 AFW Resources.grsc::T2H Events"](error in=$"error in", number of elements=0, reference in=$"FPGA interface", timeout (ms)=-1) -> (elements remaining=w1, error out=w2, reference out=w3)
  Quotient And Remainder(x=w1, y=2) -> (floor(x/y)=w4)
  Multiply(w4, 2) -> w5
  # read pairs from event FIFO
  Host Fifo Read Node[FifoName="AFW::802_11::Resources::802.11 AFW Resources.grsc::T2H Events"](error in=w2, number of elements=w5, reference in=w3, timeout (ms)=-1) -> (data=w6, error out=w7, reference out=w8)
  $"FPGA interface dup" <- w8
  $"error out" <- w7
  To Signed 32 Bit Integer(number=w4) -> w9
  To Signed 32 Bit Integer(number=2) -> w10
  Reshape Array(inArray=w6, size=w9, size=w10) -> w11
  $"raw events" <- w11
