vi "Read Target Registers.gvi"   [LabVIEW NXG 4.0.0]
# Reads the target register relevant for exposure to the host front panel.
inputs:
  "FPGA interface": "FGPA Reference.gtype"  # Interface to the device's FPGA handle.
  "error in": error
  "station active": bool  # Boolean control if the station RF is active after enabling the station by setting the Enable Station control to On. If the station is not active, the baseband signal power and RF input power indicators have non-defined value.
outputs:
  "error out": error
  "target FIFO overflow": bool  # Checks the target to host FIFOs for overflow. If one of the target to host FIFOs overflows, its information is no longer reliable.
  "compensated CFO": f64  # Compensation applied to the center frequency offset, in Hz.
  "RF input power": f64[][]  # 2D-array containing the RF input power, in dBm, currently being measured, as well as at the most recent packet start.
  "MAC RX statistics": "MAC RX Statistics.gtype"  # Counters relevant for MAC RX.
  "MAC TX statistics": "MAC TX Statistics.gtype"  # Counters relevant for MAC TX.
  "baseband signal power": f64[][]
types:
  "MAC TX Statistics.gtype" = cluster{"RTS triggered": u32, "CTS triggered": u32, "Data triggered": u32, "ACK triggered": u32}
  "MAC RX Statistics.gtype" = cluster{"preamble detected": u32, "PSDUs received": u32, "MPDU CRC OK": u32, "RTS detected": u32, "CTS detected": u32, "Data detected": u32, "ACK detected": u32}
diagram:
  Property Node(instance in=$"FPGA interface", error in=$"error in") -> ("RF input power at packet start"=w1, "T2H RX Data overflow"=w2, "T2H Constallation overflow"=w3, "T2H RX Power Spectrum overflow"=w4, "T2H Channel Estimation overflow"=w5, "signal power"=w6, "signal power at packet start"=w7, "TX to RF FIFO overflow"=w8, "RF input power"=w9, "compensated CFO"=w10, "MAC RX statistics"=w11, "MAC TX statistics"=w12, error out=w13)
  $"error out" <- w13
  Add(w2, w3, w4, w5, w8) -> w14
  Is Not Equal To 0(x=w14) -> w15
  $"target FIFO overflow" <- w15
  Not(x=$"station active") -> w16
  # set unknown power values to NaN
  To Double Precision Float(number=w6) -> w17
  Select(s=w16, t=NaN, f=w17) -> w18
  To Double Precision Float(number=w7) -> w19
  Type Cast(type="MAC RX Statistics.gtype" {all zero or empty}, x=w11) -> w20
  Property Node(instance in=w20) -> ("preamble detected"=w21, instance out=w22)
  Feedback Node(input=w21) -> w23
  Is Equal(x=w21, y=w23) -> w24
  Select(s=w24, t=NaN, f=w19) -> w25
  Build Array(w18, w25) -> w26
  Build Array(w26) -> w27
  w28 = -12  # CFX data type offset
  Add(w27, w28) -> w29
  $"baseband signal power" <- w29
  To Double Precision Float(number=w9) -> w30
  Select(s=w16, t=NaN, f=w30) -> w31
  To Double Precision Float(number=w1) -> w32
  Select(s=w24, t=NaN, f=w32) -> w33
  Build Array(w31, w33) -> w34
  Build Array(w34) -> w35
  $"RF input power" <- w35
  To Double Precision Float(number=w10) -> w36
  Multiply(w36, -80000000) -> w37
  $"compensated CFO" <- w37
  Type Cast(type="MAC TX Statistics.gtype" {all zero or empty}, x=w12) -> w38
  $"MAC TX statistics" <- w38
  $"MAC RX statistics" <- w22
