vi "Byte Array to MAC Header Contents.gvi"   [LabVIEW NXG 4.0.0]
# Converts a least-significant bit (LSB) ordered byte array into a MAC header contents cluster.
inputs:
  "array": u8[40]  # Serialized byte array of MAC header contents in LSB order.
outputs:
  "MAC header contents": "MAC Header Contents.gtype"  # %MAC HEADER CONTENTS%
types:
  "MAC Header Contents.gtype" = cluster{"duration": u16, "source address": u8[6], "destination address": u8[6], "basic service set identifier": u8[6], "recipient address": u8[6], "transmitter address": u8[6], "sequence number": UFXP(12.0), "fragment number": UFXP(4.0), "QoS control": u16, "HT control": u32}
diagram:
  Split 1D Array(array=$array, index=2) -> (first subarray=w1, second subarray=w2)
  Split 1D Array(array=w2, index=6) -> (first subarray=w3, second subarray=w4)
  Split 1D Array(array=w4, index=6) -> (first subarray=w5, second subarray=w6)
  Split 1D Array(array=w6, index=6) -> (first subarray=w7, second subarray=w8)
  Reverse 1D Array(array=w1) -> (reversed array=w9)
  Array Index(array=w9) -> (out0[_]=w10, out1[_]=w11)
  Join Numbers(high(x)=w10, low(x)=w11) -> w12
  Split 1D Array(array=w8, index=6) -> (first subarray=w13, second subarray=w14)
  Split 1D Array(array=w14, index=6) -> (first subarray=w15, second subarray=w16)
  Split 1D Array(array=w16, index=2) -> (first subarray=w17, second subarray=w18)
  Reverse 1D Array(array=w17) -> (reversed array=w19)
  Array Index(array=w19) -> (out0[_]=w20, out1[_]=w21)
  Join Numbers(high(x)=w20, low(x)=w21) -> w22
  Number To Boolean Array(number=w22) -> (Boolean array=w23)
  Split 1D Array(array=w23, index=12) -> (first subarray=w24, second subarray=w25)
  Boolean Array To Number(Boolean array=w24) -> (number=w26: u16)
  To Fixed Point(fixed-point type=UFXP(12.0) 0, number=w26) -> w27
  Boolean Array To Number(Boolean array=w25) -> (number=w28: u8)
  To Fixed Point(fixed-point type=UFXP(4.0) 0, number=w28) -> w29
  Split 1D Array(array=w18, index=2) -> (first subarray=w30, second subarray=w31)
  Reverse 1D Array(array=w30) -> (reversed array=w32)
  Array Index(array=w32) -> (out0[_]=w33, out1[_]=w34)
  Join Numbers(high(x)=w33, low(x)=w34) -> w35
  Reverse 1D Array(array=w31) -> (reversed array=w36)
  Array Index(array=w36) -> (out0[_]=w37, out1[_]=w38, out2[_]=w39, out3[_]=w40)
  Join Numbers(high(x)=w37, low(x)=w38) -> w41
  Join Numbers(high(x)=w39, low(x)=w40) -> w42
  Join Numbers(high(x)=w41, low(x)=w42) -> w43
  Property Node(instance in="MAC Header Contents.gtype" {all zero or empty}, "duration"=w12, "source address"=w3, "destination address"=w5, "basic service set identifier"=w7, "recipient address"=w13, "transmitter address"=w15, "sequence number"=w27, "fragment number"=w29, "QoS control"=w35, "HT control"=w43) -> (instance out=w44)
  $"MAC header contents" <- w44
