vi "Byte Array to MPDU Parameters.gvi"   [LabVIEW NXG 4.0.0]
# Converts a least-significant bit (LSB) ordered byte array into a MPDU parameters cluster.
inputs:
  "array": u8[7]  # Serialized byte array of MPDU parameters in LSB order.
outputs:
  "MPDU parameters": "MPDU Parameters.gtype"  # %MPDU PARAMETERS%
types:
  "Frame Sequence Type.gtype" = enum{"RTS | CTS | DATA | ACK", "DATA | ACK", "DATA"}
  "MPDU Parameters.gtype" = cluster{"MSDU length": u16, "MPDU frame body length": u16, "MPDU length": u16, "sequence type": "Frame Sequence Type.gtype"}
diagram:
  Array Index(array=$array) -> (out0[_]=w1, out1[_]=w2, out2[_]=w3, out3[_]=w4, out4[_]=w5, out5[_]=w6, out6[_]=w7)
  Join Numbers(high(x)=w2, low(x)=w1) -> w8
  Join Numbers(high(x)=w4, low(x)=w3) -> w9
  Join Numbers(high(x)=w6, low(x)=w5) -> w10
  To Signed 32 Bit Integer(number=w7) -> w11
  Array Index(array=["RTS | CTS | DATA | ACK", "DATA | ACK", "DATA"]) -> (out0[w11]=w12)
  Property Node(instance in="MPDU Parameters.gtype" {all zero or empty}, "MSDU length"=w8, "MPDU frame body length"=w9, "MPDU length"=w10, "sequence type"=w12) -> (instance out=w13)
  $"MPDU parameters" <- w13
