vi "MAC Header Frame Control to Byte Array.gvi"   [LabVIEW NXG 4.0.0]
# Converts a MAC header frame control cluster into a byte array in least-significant bit (LSB) order.
# protocol version, type and subtype are serialized into on U8. All Boolean flags are serialized into one U8.
inputs:
  "MAC header frame control in": "MAC Header Frame Control.gtype"  # %MAC HEADER FRAME CONTROL%
outputs:
  "array": u8[2]  # Serialized byte array of MAC header contents in LSB order.
types:
  "MAC Header Frame Control.gtype" = cluster{"protocol version": UFXP(2.0), "type": UFXP(2.0), "subtype": UFXP(4.0), "to DS": bool, "from DS": bool, "more fragments": bool, "retry": bool, "power management": bool, "more data": bool, "protected frame": bool, "HTC / order": bool}
diagram:
  Property Node(instance in=$"MAC header frame control in") -> ("protocol version"=w1, "type"=w2, "subtype"=w3, "to DS"=w4, "from DS"=w5, "more fragments"=w6, "retry"=w7, "power management"=w8, "more data"=w9, "protected frame"=w10, "HTC / order"=w11)
  Number To Boolean Array(number=w1) -> (Boolean array=w12)
  Number To Boolean Array(number=w2) -> (Boolean array=w13)
  Number To Boolean Array(number=w3) -> (Boolean array=w14)
  Build Array(w12, w13, w14) -> w15
  Boolean Array To Number(Boolean array=w15) -> (number=w16: u8)
  Build Array(w4, w5, w6, w7, w8, w9, w10, w11) -> w17
  Boolean Array To Number(Boolean array=w17) -> (number=w18: u8)
  Build Array(w16, w18) -> w19
  Type Cast(type=u8[2] [0, 0], x=w19) -> w20
  $array <- w20
