vi "MPDU Parameters to Byte Array.gvi"   [LabVIEW NXG 4.0.0]
# Converts a MAC protocol data unit (MPDU) parameters cluster into a byte array in least significant bit (LSB) order.
# The sequence type enumeration is serialized into a U8.
inputs:
  "MPDU parameters in": "MPDU Parameters.gtype"  # %MPDU PARAMETERS%
outputs:
  "array": u8[7]  # Serialized byte array of MPDU parameters in LSB order.
types:
  "Frame Sequence Type.gtype" = enum{"RTS | CTS | DATA | ACK", "DATA | ACK", "DATA"}
  "MPDU Parameters.gtype" = cluster{"MSDU length": u16, "MPDU frame body length": u16, "MPDU length": u16, "sequence type": "Frame Sequence Type.gtype"}
diagram:
  Property Node(instance in=$"MPDU parameters in") -> ("MSDU length"=w1, "MPDU length"=w2, "sequence type"=w3, "MPDU frame body length"=w4)
  Type Cast(type=u8 0, x=w3) -> w5
  Split Number(x=w1) -> (high(x)=w6, low(x)=w7)
  Build Array(w6, w7) -> w8
  Reverse 1D Array(array=w8) -> (reversed array=w9)
  Split Number(x=w4) -> (high(x)=w10, low(x)=w11)
  Build Array(w10, w11) -> w12
  Reverse 1D Array(array=w12) -> (reversed array=w13)
  Split Number(x=w2) -> (high(x)=w14, low(x)=w15)
  Build Array(w14, w15) -> w16
  Reverse 1D Array(array=w16) -> (reversed array=w17)
  Build Array(w9, w13, w17, w5) -> w18
  Type Cast(type=u8[7] [0, 0, 0, 0, 0, 0, 0], x=w18) -> w19
  $array <- w19
