vi "U8 to PHY Parameter.gvi"   [LabVIEW NXG 4.0.0]
# Deserializes format, bandwidth, and MCS from a U8 data type.
inputs:
  "PHY parameter": u8  # Cluster comprised of all outputs.
outputs:
  "format": "PHY Frame Format.gtype"  # Extracted format from PHY parameter.
  "bandwidth": "Bandwidth.gtype"  # Extracted bandwidth from PHY parameter.
  "MCS": u8  # Modulation and coding scheme.
types:
  "PHY Frame Format.gtype" = enum{"NON_HT_OFDM", "VHT", "NON_HT_DUP_OFDM"}
  "Bandwidth.gtype" = enum{"20 MHz", "40 MHz", "80 MHz"}
diagram:
  Number To Boolean Array(number=$"PHY parameter") -> (Boolean array=w1)
  Array Index(array=w1) -> (out0[_]=w2, out1[_]=w3, out2[_]=w4, out3[_]=w5, out4[_]=w6, out5[_]=w7, out6[_]=w8, out7[_]=w9)
  Build Array(w2, w3) -> w10
  Boolean Array To Number(Boolean array=w10) -> (number=w11)
  case (w11) {
    frame 0, Default {
      w13 = "NON_HT_OFDM"  # PHY Frame Format
      w12 = w13
    }
    frame 1 {
      w14 = "VHT"  # PHY Frame Format
      w12 = w14
    }
    frame 2 {
      w15 = "NON_HT_DUP_OFDM"  # PHY Frame Format
      w12 = w15
    }
  }
  $format <- w12
  Build Array(w4, w5) -> w16
  Boolean Array To Number(Boolean array=w16) -> (number=w17)
  case (w17) {
    frame 0, Default {
      w19 = "20 MHz"  # Bandwidth
      w18 = w19
    }
    frame 1 {
      w20 = "40 MHz"  # Bandwidth
      w18 = w20
    }
    frame 2 {
      w21 = "80 MHz"  # Bandwidth
      w18 = w21
    }
  }
  $bandwidth <- w18
  Build Array(w6, w7, w8, w9) -> w22
  Boolean Array To Number(Boolean array=w22) -> (number=w23: u8)
  $MCS <- w23
