vi "Wait for Event.gvi"   [LabVIEW NXG 4.0.0]
# Wait for events, reading event FIFO and convert to event log structure with type, timestamp and log message
# Suggested read modes:
# 	Just read current FIFO content:
# 	- set “awaited event enable” to false
# 	- set “timeout ms” to 0
# 	Read events and wait until no more events are incoming (within timeout period):
# 	- set “awaited event enable” to false
# 	- set “timeout ms” >0
# 	Read events and wait for special event:
# 	- set “awaited event enable” to true
# 	- set “awaited event” to expected event
# 	- set “timeout ms” >0
inputs:
  "FPGA interface": "FGPA Reference.gtype"  # Interface to the device's FPGA handle.
  "error in": error
  "awaited event": "Events.gtype" = "PHY TX start request"  # Special event to wait for (optional). The event polling loop aborts, if this event arrived. Note that “awaited event enable” must be true to activate this option.
  "awaited event enable": bool  # Activates option to wait for special event defined in “awaited event” control. The event polling loop aborts, if this event arrived.
  "timeout ms": i32  # Maximum wait time in ms for polling event FIFO in case that no further event arrives
outputs:
  "FPGA interface dup": "FGPA Reference.gtype"  # Output of interface to the device's FPGA handle.
  "error out": error
  "event log": "Event Log Item.gtype"[]  # Output of all log events received. The Array contains a cluster with following items: - event type (enum) - timestamp (global clock cycle ticks (0.1 us)) - log message string
  "awaited event received": bool  # Indicates that “awaited event” was received, if “awaited event enable” option is used.
types:
  "Events.gtype" = enum{"PHY TX start request", "PHY TX end indication", "PHY RX start indication", "PHY RX end indication", "PHY CCA timing indication", "PHY RX gain change indication", "DCF state indication", "MAC MPDU RX indication", "MAC MPDU TX request"}
  "Event Log Item.gtype" = cluster{"event type": "Events.gtype", "timestamp": u32, "log message": string}
uses:
  AFW::802_11::Conversion::Read Event FIFO.gvi
  AFW::802_11::Conversion::Events to String.gvi
diagram:
  while {
    s1 = $"error in"  # shift register
    while (iteration -> i1) {
      Wait Until Next Multiple(multiple to wait=1)
      Is Greater(x=i1, y=$"timeout ms") -> w2
      call "Read Event FIFO.gvi"(FPGA interface=$"FPGA interface", error in=s1) -> (FPGA interface dup=w3, raw events=w4, error out=w5)
      Array Size(array=w4) -> (size(s)=w6)
      Is Greater Than 0(x=w6) -> w7
      And Array Elements(Boolean array=w7) -> (logical AND=w8)
      Logical Or(w8, w2) -> w9
      next s1 = w5
      stop if w9
    }
    case (w8) {
      frame False, Default {
        # Timeout
        w10 = TRUE
        w11 = default
        w12 = default
        w13 = default
      }
      frame True {
        call "Events to String.gvi"(raw event data=w4) -> (event log=w11)
        case ($"awaited event enable") {
          frame False, Default {
            # No timeout, no special
            # event to wait for
            # -> continue
            w10 = FALSE
            w13 = default
          }
          frame True {
            for {
              w14 = each element of w11
              Property Node(instance in=w14) -> ("event type"=w15)
              Is Equal(x=w15, y=$"awaited event") -> w10
              stop if w10
            }
            w13 = w10
          }
        }
        w12 = TRUE
      }
    }
    concatenate w11 onto w1 if w12
    stop if w10
  }
  $"FPGA interface dup" <- w3
  $"error out" <- s1
  $"event log" <- w1
  $"awaited event received" <- w13
