vi "Check Header Identifications.gvi"   [LabVIEW NXG 4.0.0]
# Checks if the reference IDs and instance IDs of the received two MAC SAP TX CNF messages match with either the ones of the created MAC SAP TX CONFIG REQ or the MAC SAP TX PAYLOAD REQ.
inputs:
  "MAC SAP TX configuration request": "MAC SAP TX Configuration Request.gtype"  # Created MAC SAP TX CONFIG REQ message.
  "MAC SAP TX payload request": "MAC SAP TX Payload Request.gtype"  # Created MAC SAP TX PAYLOAD REQ message.
  "first received MAC SAP TX confirmation": "MAC SAP TX Confirmation.gtype"  # MAC SAP TX CNF message which was received at first.
  "second received MAC SAP TX confirmation": "MAC SAP TX Confirmation.gtype"  # MAC SAP TX CNF message which was received at second.
outputs:
  "error out": error
  "confirmation status": "Confirmation States.gtype"  # Result of the extracted confirmation status.
types:
  "General Message Header.gtype" = cluster{"message type ID": u16, "reference ID": u16, "instance ID": u8}
  "SAP Sub Header.gtype" = cluster{"timestamp": u32, "number of submessages": u8, "confirmation mode": bool}
  "Confirmation States.gtype" = enum{"Success", "Unknown Message", "Message not Supported", "Unknown Parameter (Set)", "Missing Parameter (Set)", "Parameter (Set) Repetition", "Range Violation", "State Violation", "Timeout", "Config Payload Mismatch", "Length Mismatch", "Input Buffer Full", "Internal Error", "Instance ID Mismatch"}
  "MAC SAP TX Confirmation.gtype" = cluster{"General Message Header": "General Message Header.gtype", "SAP Sub Header": "SAP Sub Header.gtype", "Confirmation status": "Confirmation States.gtype"}
  "MSDU TX Payload.gtype" = cluster{"MSDU index": u8, "MSDU length": u16, "MSDU data": u8[]}
  "MAC SAP TX Payload Request.gtype" = cluster{"General Message Header": "General Message Header.gtype", "SAP Sub Header": "SAP Sub Header.gtype", "MSDU TX Payload": "MSDU TX Payload.gtype"}
  "MAC Frame Type.gtype" = enum{"Management", "Control", "Data", "Extension"}
  "MSDU TX Parameters.gtype" = cluster{"MSDU index": u8, "frame type": "MAC Frame Type.gtype", "subtype": u8, "to DS": bool, "from DS": bool, "power management": u8, "more data": u8, "protected frame": u8, "HTC / order": u8, "source address": u8[6], "destination address": u8[6], "basic service set identifier": u8[6], "recipient address": u8[6], "transmitter address": u8[6], "MSDU length": u16}
  "PHY Frame Format.gtype" = enum{"NON_HT_OFDM", "VHT", "NON_HT_DUP_OFDM"}
  "Bandwidth.gtype" = enum{"20 MHz", "40 MHz", "80 MHz"}
  "PHY TX Parameters.gtype" = cluster{"MSDU index": u8, "format": "PHY Frame Format.gtype", "bandwidth": "Bandwidth.gtype", "MCS": u8}
  "MAC SAP TX Configuration Request.gtype" = cluster{"General Message Header": "General Message Header.gtype", "SAP Sub Header": "SAP Sub Header.gtype", "MSDU TX Parameters": "MSDU TX Parameters.gtype", "PHY TX Parameters": "PHY TX Parameters.gtype"}
uses:
  NI::G Core::Error::Build Error Cluster.gvi
diagram:
  Property Node(instance in=$"MAC SAP TX configuration request") -> ("General Message Header:reference ID"=w1, "General Message Header:instance ID"=w2)
  Property Node(instance in=$"first received MAC SAP TX confirmation") -> ("General Message Header:reference ID"=w3, "General Message Header:instance ID"=w4)
  Property Node(instance in=$"MAC SAP TX payload request") -> ("General Message Header:reference ID"=w5, "General Message Header:instance ID"=w6)
  Property Node(instance in=$"second received MAC SAP TX confirmation") -> ("General Message Header:reference ID"=w7, "General Message Header:instance ID"=w8)
  Is Equal(x=w1, y=w3) -> w9
  Is Equal(x=w2, y=w4) -> w10
  Logical And(w9, w10) -> w11
  case (w11) {
    frame False, Default {
      Is Equal(x=w3, y=w5) -> w14
      Is Equal(x=w4, y=w6) -> w15
      Logical And(w14, w15) -> w16
      # first CNF IDs =! CONFIG REQ IDs
      case (w16) {
        frame False, Default {
          # (first CNF IDs =! CONFIG REQ IDs) && (first CNF IDs =! PAYLOAD IDs)
          w17 = "The first CNF's IDs do not match either the CONFIG REQ's or the PAYLOAD REQ's IDs."
          Type Cast(type=u8 0, x="Internal Error") -> w18
          To Signed 32 Bit Integer(number=w18) -> w19
          call "Build Error Cluster.gvi"(code=w19, description=w17) -> (error out=w12)
          w13 = "Internal Error"
        }
        frame True {
          Is Equal(x=w1, y=w7) -> w20
          # first CNF IDs == PAYLOAD REQ IDs
          Is Equal(x=w2, y=w8) -> w21
          Logical And(w20, w21) -> w22
          case (w22) {
            frame False, Default {
              w23 = "first CNF IDs == PAYLOAD REQ IDs\nsecond CNF IDs =! CONFIG REQ IDs"
              Type Cast(type=u8 0, x="Internal Error") -> w24
              To Signed 32 Bit Integer(number=w24) -> w25
              call "Build Error Cluster.gvi"(code=w25, description=w23) -> (error out=w12)
              w13 = "Internal Error"
            }
            frame True {
              # first CNF IDs == PAYLOAD REQ IDs
              # second CNF IDs == CONFIG REQ IDs
              w26 = "Success"  # Confirmation States
              w12 = default
              w13 = w26
            }
          }
        }
      }
    }
    frame True {
      Is Equal(x=w5, y=w7) -> w27
      Is Equal(x=w6, y=w8) -> w28
      Logical And(w27, w28) -> w29
      # first CNF IDs == CONFIG REQ IDs
      case (w29) {
        frame False, Default {
          w30 = "first CNF IDs == CONFIG REQ IDs\nsecond CNF IDs =! PAYLOAD REQ IDs"
          Type Cast(type=u8 0, x="Internal Error") -> w31
          To Signed 32 Bit Integer(number=w31) -> w32
          call "Build Error Cluster.gvi"(code=w32, description=w30) -> (error out=w12)
          w13 = "Internal Error"
        }
        frame True {
          # first CNF IDs == CONFIG REQ IDs
          # second CNF IDs == PAYLOAD REQ IDs
          w33 = "Success"  # Confirmation States
          w12 = default
          w13 = w33
        }
      }
    }
  }
  $"confirmation status" <- w13
  $"error out" <- w12
