vi "Check MAC SAP TX Confirmations.gvi"   [LabVIEW NXG 4.0.0]
# Dequeues two MAC SAP TX CNF messages from the received TX SAP message queue, and checks if the received header IDs match the ones of the created MAC SAP TX CONFIG REQ and MAC SAP TX PAYLYOAD REQ and forwards the messages’ confirmation states, after they have also been checked.
inputs:
  "MAC SAP TX configuration request": "MAC SAP TX Configuration Request.gtype"  # MAC SAP TX Configuration request cluster, forwarded from MAC High TX Stub.
  "MAC SAP TX payload request": "MAC SAP TX Payload Request.gtype"  # · MAC SAP TX payload request cluster, forwarded from MAC High TX Stub.
  "received MAC SAP TX confirmation message queue": Queue<u8[]>  # MAC SAP TX CNF message queue, received from MAC Middle TX SAP layer.
  "timeout in milliseconds": i32 = 100  # Timeout for the dequeuing node in milliseconds.
  "error in": error
outputs:
  "confirmation status": "Confirmation States.gtype"  # Extracted confirmation status.
  "error out": error
types:
  "General Message Header.gtype" = cluster{"message type ID": u16, "reference ID": u16, "instance ID": u8}
  "SAP Sub Header.gtype" = cluster{"timestamp": u32, "number of submessages": u8, "confirmation mode": bool}
  "MSDU TX Payload.gtype" = cluster{"MSDU index": u8, "MSDU length": u16, "MSDU data": u8[]}
  "MAC SAP TX Payload Request.gtype" = cluster{"General Message Header": "General Message Header.gtype", "SAP Sub Header": "SAP Sub Header.gtype", "MSDU TX Payload": "MSDU TX Payload.gtype"}
  "Confirmation States.gtype" = enum{"Success", "Unknown Message", "Message not Supported", "Unknown Parameter (Set)", "Missing Parameter (Set)", "Parameter (Set) Repetition", "Range Violation", "State Violation", "Timeout", "Config Payload Mismatch", "Length Mismatch", "Input Buffer Full", "Internal Error", "Instance ID Mismatch"}
  "MAC Frame Type.gtype" = enum{"Management", "Control", "Data", "Extension"}
  "MSDU TX Parameters.gtype" = cluster{"MSDU index": u8, "frame type": "MAC Frame Type.gtype", "subtype": u8, "to DS": bool, "from DS": bool, "power management": u8, "more data": u8, "protected frame": u8, "HTC / order": u8, "source address": u8[6], "destination address": u8[6], "basic service set identifier": u8[6], "recipient address": u8[6], "transmitter address": u8[6], "MSDU length": u16}
  "PHY Frame Format.gtype" = enum{"NON_HT_OFDM", "VHT", "NON_HT_DUP_OFDM"}
  "Bandwidth.gtype" = enum{"20 MHz", "40 MHz", "80 MHz"}
  "PHY TX Parameters.gtype" = cluster{"MSDU index": u8, "format": "PHY Frame Format.gtype", "bandwidth": "Bandwidth.gtype", "MCS": u8}
  "MAC SAP TX Configuration Request.gtype" = cluster{"General Message Header": "General Message Header.gtype", "SAP Sub Header": "SAP Sub Header.gtype", "MSDU TX Parameters": "MSDU TX Parameters.gtype", "PHY TX Parameters": "PHY TX Parameters.gtype"}
uses:
  AFW::802_11::MAC High Abstraction::Get MAC SAP TX CNF.gvi
  AFW::802_11::MAC High Abstraction::Check Header Identifications.gvi
  AFW::802_11::MAC High Abstraction::Check Confirmation Status.gvi
  AFW::802_11::MAC High Abstraction::Combine Confirmation Status.gvi
  NI::G Core::Error::Build Error Cluster.gvi
diagram:
  call "Get MAC SAP TX CNF.gvi"(timeout in milliseconds=$"timeout in milliseconds", received MAC SAP TX CNF message queue=$"received MAC SAP TX confirmation message queue", error in=$"error in") -> (time out=w1, MAC SAP TX CNF=w2, MAC SAP TX CNF message queue out=w3, error out=w4)
  call "Get MAC SAP TX CNF.gvi"(timeout in milliseconds=$"timeout in milliseconds", received MAC SAP TX CNF message queue=w3, error in=w4) -> (time out=w5, MAC SAP TX CNF=w6, error out=w7)
  call "Check Header Identifications.gvi"(MAC SAP TX configuration request=$"MAC SAP TX configuration request", MAC SAP TX payload request=$"MAC SAP TX payload request", first received MAC SAP TX confirmation=w2, second received MAC SAP TX confirmation=w6) -> (confirmation status=w8, error out=w9)
  call "Check Confirmation Status.gvi"(MAC SAP TX CNF=w2, error in=w7) -> (confirmation status=w10, error out=w11)
  call "Check Confirmation Status.gvi"(MAC SAP TX CNF=w6, error in=w7) -> (confirmation status=w12, error out=w13)
  Merge Errors(w9, w11, w13) -> (error out=w14)
  call "Combine Confirmation Status.gvi"(resulting confirmation status of headers check=w8, first received confirmation status=w10, second received confirmation status=w12, error in=w14) -> (combined confirmation status=w15, error out=w16)
  $"confirmation status" <- w15
  Logical Or(w5, w1) -> w17
  case (w17) {
    frame False, Default {
      w18 = default
    }
    frame True {
      case (w5) {
        frame False, Default {
          w19 = default
        }
        frame True {
          w19 = "second CNF"
        }
      }
      case (w1) {
        frame False, Default {
          w20 = default
        }
        frame True {
          w20 = "first CNF"
        }
      }
      Format Into String(formatString="timeout value (%d ms) exceeded during:\n%s\n%s\n", $"timeout in milliseconds", w20, w19) -> w21
      Type Cast(type=u8 0, x="Timeout") -> w22
      To Signed 32 Bit Integer(number=w22) -> w23
      call "Build Error Cluster.gvi"(code=w23, description=w21) -> (error out=w18)
    }
  }
  Merge Errors(w18, w16) -> (error out=w24)
  $"error out" <- w24
