vi "Check MAC SAP TX Status Indication.gvi"   [LabVIEW NXG 4.0.0]
# Dequeues elements from the received MAC SAP STATUS IND message queue, decodes and enqueues them to the MAC SAP TX STATUS IND output queue, which will be forwarded to the MAC Hight TX Stub layer.
inputs:
  "received MAC SAP status indication message queue in": Queue<u8[]>  # Received MAC SAP TX STATUS IND message queue.
  "error in": error
outputs:
  "MAC SAP TX status indication queue out": Queue<"MAC SAP TX Status Indication.gtype">  # MAC SAP TX STATUS IND output message queue containing the decoded clusters.
  "error out": error
types:
  "MAC SAP TX Status Indication.gtype" = cluster{"General Message Header": "General Message Header.gtype", "SAP Sub Header": "SAP Sub Header.gtype", "MSDU transmission status": bool}
uses:
  AFW::802_11::Transport::Decode MAC SAP TX Status Indication.gvi
diagram:
  Get Queue Status(error in=$"error in", queue=$"received MAC SAP status indication message queue in") -> (# elements in queue=w1, error out=w2, queue out=w3)
  # obtain MAC SAP STATUS IND output queue
  Obtain Queue(element data type="MAC SAP TX Status Indication.gtype" {all zero or empty}) -> (error out=w4, queue out=w5)
  Merge Errors(w2, w4) -> (error out=w6)
  # error handling?
  s1 = w6  # shift register
  for (N = w1) {
    # dequeue until no elements left in queue
    Dequeue Element(error in=s1, queue=w3, timeout in ms=0) -> (element=w7, error out=w8)
    call "Decode MAC SAP TX Status Indication.gvi"(MAC SAP TX status indication in byte=w7) -> (MAC SAP TX status indication=w9, error out=w10)
    # output queue
    Merge Errors(w8, w10) -> (error out=w11)
    Enqueue Element(element=w9, error in=w11, queue=w5) -> (error out=w12, queue out=w13)
    next s1 = w12
  }
  $"MAC SAP TX status indication queue out" <- w13
  $"error out" <- s1
