vi "Clear and Log MAC Middle SAP errors.gvi"   [LabVIEW NXG 4.0.0]
# Removes all errors that are created by the MAC Middle SAP.
inputs:
  "error in": error
outputs:
  "error out": error
types:
  "Confirmation States.gtype" = enum{"Success", "Unknown Message", "Message not Supported", "Unknown Parameter (Set)", "Missing Parameter (Set)", "Parameter (Set) Repetition", "Range Violation", "State Violation", "Timeout", "Config Payload Mismatch", "Length Mismatch", "Input Buffer Full", "Internal Error", "Instance ID Mismatch"}
uses:
  NI::G Core::Error::Is Error.gvi
  NI::G Core::Error::Read Call Chain.gvi
  NI::G Core::Error::Filter Error Codes.gvi
  NI::G Core::Error::Read Description.gvi
  AFW::Common::Logging::Log Error.gvi
diagram:
  # Create Array with all MAC Middle SAP error codes
  Type Cast(type="Confirmation States.gtype" "Range Violation", x=0xFF) -> w1
  Type Cast(type=u8 0, x=w1) -> w2
  To Signed 32 Bit Integer(number=w2) -> w3
  for (N = w3) (iteration -> i1) {
    Increment(x=i1) -> w5
    append w5 to w4
  }
  call "Is Error.gvi"(error in=$"error in") -> (error?=w6)
  case (w6) {
    frame False, Default {
      w7 = $"error in"
    }
    frame True {
      call "Read Call Chain.gvi"(error in=$"error in") -> (call chain=w8)
      call "Filter Error Codes.gvi"(codes to clear=w4, error in=$"error in") -> (error out=w9)
      Flatten To JSON(anything=w8, error in (no error)=w9) -> (JSON string=w10, error out=w11)
      call "Read Description.gvi"(error in=$"error in") -> (description=w12)
      call "Log Error.gvi"(error in=w11, module="Host-Description", message=w12) -> (error out=w13)
      Is Empty Array(array=w8) -> w14
      case (w14) {
        frame True {
          w7 = w13
        }
        frame False {
          call "Log Error.gvi"(error in=w13, module="Host-Call Chain ", message=w10) -> (error out=w7)
        }
      }
    }
  }
  $"error out" <- w7
