vi "Combine Confirmation Status.gvi"   [LabVIEW NXG 4.0.0]
# Checks if the incoming two confirmation states match and outputs the combined one.
inputs:
  "first received confirmation status": "Confirmation States.gtype" = "Success"  # Confirmation status which was received at first.
  "second received confirmation status": "Confirmation States.gtype" = "Success"  # Confirmation status which was received at second.
  "resulting confirmation status of headers check": "Confirmation States.gtype" = "Success"  # Confirmation status which was received at first.
  "error in": error
outputs:
  "error out": error
  "combined confirmation status": "Confirmation States.gtype"  # Combined confirmation status output, if both message have the same one.
types:
  "Confirmation States.gtype" = enum{"Success", "Unknown Message", "Message not Supported", "Unknown Parameter (Set)", "Missing Parameter (Set)", "Parameter (Set) Repetition", "Range Violation", "State Violation", "Timeout", "Config Payload Mismatch", "Length Mismatch", "Input Buffer Full", "Internal Error", "Instance ID Mismatch"}
uses:
  NI::G Core::Error::Build Error Cluster.gvi
diagram:
  Is Equal(x=$"resulting confirmation status of headers check", y="Success") -> w1
  case (w1) {
    frame False, Default {
      w2 = $"resulting confirmation status of headers check"
      w3 = $"error in"
    }
    frame True {
      Is Equal(x=$"first received confirmation status", y=$"second received confirmation status") -> w4
      case (w4) {
        frame False, Default {
          w6 = "confirmation status mismatch\nfirst status: %s,\nsecond status: %s"
          Format Into String(formatString=w6, $"first received confirmation status", $"second received confirmation status") -> (outString=w7, errOut=w8)
          Is Not Equal(x=$"first received confirmation status", y="Success") -> w9
          Select(s=w9, t=$"first received confirmation status", f=$"second received confirmation status") -> w2
          Type Cast(type=u8 0, x=w2) -> w10
          To Signed 32 Bit Integer(number=w10) -> w11
          call "Build Error Cluster.gvi"(code=w11, description=w7, error in=w8) -> (error out=w5)
        }
        frame True {
          w2 = $"first received confirmation status"
          w5 = default
        }
      }
      Merge Errors($"error in", w5) -> (error out=w3)
    }
  }
  $"combined confirmation status" <- w2
  $"error out" <- w3
