vi "Compare MSDU Parameters.gvi"   [LabVIEW NXG 4.0.0]
# Checks if the MAC service data unit (MSDU) index and MSDU length parameters of the decoded MAC SAP RX CONFIG IND and MAC SAP RX PAYLOAD IND match.
inputs:
  "MAC SAP RX configuration indication": "MAC SAP RX Configuration Indication.gtype"
  "MAC SAP RX payload indication": "MAC SAP RX Payload Indication.gtype"  # Given MAC SAP RX configuration indication cluster.
  "error in": error
outputs:
  "error out": error
types:
  "General Message Header.gtype" = cluster{"message type ID": u16, "reference ID": u16, "instance ID": u8}
  "SAP Sub Header.gtype" = cluster{"timestamp": u32, "number of submessages": u8, "confirmation mode": bool}
  "MSDU TX Payload.gtype" = cluster{"MSDU index": u8, "MSDU length": u16, "MSDU data": u8[]}
  "MAC SAP RX Payload Indication.gtype" = cluster{"General Message Header": "General Message Header.gtype", "SAP Sub Header": "SAP Sub Header.gtype", "MSDU RX Payload": "MSDU TX Payload.gtype"}
  "MAC Frame Type.gtype" = enum{"Management", "Control", "Data", "Extension"}
  "MSDU TX Parameters.gtype" = cluster{"MSDU index": u8, "frame type": "MAC Frame Type.gtype", "subtype": u8, "to DS": bool, "from DS": bool, "power management": u8, "more data": u8, "protected frame": u8, "HTC / order": u8, "source address": u8[6], "destination address": u8[6], "basic service set identifier": u8[6], "recipient address": u8[6], "transmitter address": u8[6], "MSDU length": u16}
  "PHY Frame Format.gtype" = enum{"NON_HT_OFDM", "VHT", "NON_HT_DUP_OFDM"}
  "Bandwidth.gtype" = enum{"20 MHz", "40 MHz", "80 MHz"}
  "PHY TX Parameters.gtype" = cluster{"MSDU index": u8, "format": "PHY Frame Format.gtype", "bandwidth": "Bandwidth.gtype", "MCS": u8}
  "Additional MSDU RX Parameters.gtype" = cluster{"retry flag": bool}
  "A-MPDU De-Aggregation Status.gtype" = enum{"A-MPDU De-Aggregation not executed", "A-MPDU De-Aggregation successful", "PSDU length mismatch", "VHT delimiter CRC fail", "VHT delimiter signature comparison fail", "EOF field check fail", "MPDU length mismatch"}
  "FCS Check Status.gtype" = enum{"FCS check not executed", "FCS check pass", "FCS check fail"}
  "MPDU Length Check Status.gtype" = enum{"MPDU length check not executed", "MPDU length check pass", "MPDU length check not standard compliant", "MPDU length check exceeds implemented buffer"}
  "MPDU Disassembly Status.gtype" = enum{"Disassembly not executed", "Disassembly successful", "Disassembly done partially", "Disassembly not successful"}
  "MPDU Filtering Status.gtype" = enum{"MPDU Filtering not executed", "MPDU valid for further processing", "MPDU pass through for sniffer mode"}
  "MSDU Defragmentation Status.gtype" = enum{"Defragmentation not executed", "Unfragmented MSDU successfully received", "Unsupported MSDU fragment received"}
  "MSDU Duplicate Detection Status.gtype" = enum{"Duplicate detection not executed", "Duplicate detection successfully passed", "Duplicate detected"}
  "RX Status.gtype" = cluster{"A-MPDU de-aggregation status": "A-MPDU De-Aggregation Status.gtype", "MPDU FCS check status": "FCS Check Status.gtype", "MPDU length check status": "MPDU Length Check Status.gtype", "MPDU disassembly status": "MPDU Disassembly Status.gtype", "MPDU Filtering Status": "MPDU Filtering Status.gtype", "MSDU Defragmentation Status": "MSDU Defragmentation Status.gtype", "MSDU Duplicate Detection Status": "MSDU Duplicate Detection Status.gtype"}
  "MAC SAP RX Configuration Indication.gtype" = cluster{"General Message Header": "General Message Header.gtype", "SAP Sub Header": "SAP Sub Header.gtype", "MSDU RX Parameters": "MSDU TX Parameters.gtype", "PHY RX Parameters": "PHY TX Parameters.gtype", "Additional MSDU RX Parameters": "Additional MSDU RX Parameters.gtype", "MAC RX Status": "RX Status.gtype"}
uses:
  NI::G Core::Error::Build Error Cluster.gvi
diagram:
  Property Node(instance in=$"MAC SAP RX configuration indication") -> ("MSDU RX Parameters:MSDU index"=w1, "MSDU RX Parameters:MSDU length"=w2)
  Property Node(instance in=$"MAC SAP RX payload indication") -> ("MSDU RX Payload:MSDU index"=w3, "MSDU RX Payload:MSDU length"=w4)
  Is Equal(x=w1, y=w3) -> w5
  Is Equal(x=w2, y=w4) -> w6
  Logical And(w5, w6) -> w7
  case (w7) {
    frame True {
      w8 = $"error in"
    }
    frame False {
      w9 = """parameter mismatch:
MSDU index:
MAC SAP RX CONFIG IND: %d
MAC SAP RX PAYLOAD IND: %d
MSDU length:
MAC SAP RX CONFIG IND: %d
MAC SAP RX PAYLOAD IND: %d"""
      Format Into String(formatString=w9, w1, w3, w2, w4) -> w10
      Type Cast(type=u8 0, x="Config Payload Mismatch") -> w11
      To Signed 32 Bit Integer(number=w11) -> w12
      call "Build Error Cluster.gvi"(code=w12, description=w10) -> (error out=w13)
      Merge Errors($"error in", w13) -> (error out=w8)
    }
  }
  $"error out" <- w8
