vi "MAC TX Request Confirm Abstraction.gvi"   [LabVIEW NXG 4.0.0]
# Converts the configuration and payload inputs into MAC SAP TX request messages. It generates the MAC SAP TX request messages and write them to the corresponding UDP socket (first the MAC SAP TX Config REQ, then the MAC SAP TX Payload REQ). In addition, it waits for and evaluates the MAC SAP TX CNF messages.
inputs:
  "MSDU TX parameters": "MSDU TX Parameters.gtype"  # MSDU TX Parameters cluster.
  "PHY TX parameters": "PHY TX Parameters.gtype"  # PHY TX Parameters cluster.
  "MSDU TX payload": "MSDU TX Payload.gtype"  # MSDU TX Payload cluster.
  "error in": error
  "UDP connection ID in": UdpNetworkConnectionRefnum  # UDP reference to write the MAC SAP TX requests to.
  "external mode": bool  # True if data source is external mode.
  "instance ID": u8  # Instance ID of the corresponding station.
outputs:
  "error out": error
  "connection ID out": UdpNetworkConnectionRefnum  # UDP reference to write the MAC SAP TX requests to.
  "MAC SAP TX configuration request": "MAC SAP TX Configuration Request.gtype"  # Created MAC SAP TX Configuration Request cluster.
  "MAC SAP TX payload request": "MAC SAP TX Payload Request.gtype"  # Created MAC SAP TX Payload Request cluster.
types:
  "MAC Frame Type.gtype" = enum{"Management", "Control", "Data", "Extension"}
  "MSDU TX Parameters.gtype" = cluster{"MSDU index": u8, "frame type": "MAC Frame Type.gtype", "subtype": u8, "to DS": bool, "from DS": bool, "power management": u8, "more data": u8, "protected frame": u8, "HTC / order": u8, "source address": u8[6], "destination address": u8[6], "basic service set identifier": u8[6], "recipient address": u8[6], "transmitter address": u8[6], "MSDU length": u16}
  "PHY Frame Format.gtype" = enum{"NON_HT_OFDM", "VHT", "NON_HT_DUP_OFDM"}
  "Bandwidth.gtype" = enum{"20 MHz", "40 MHz", "80 MHz"}
  "PHY TX Parameters.gtype" = cluster{"MSDU index": u8, "format": "PHY Frame Format.gtype", "bandwidth": "Bandwidth.gtype", "MCS": u8}
  "MSDU TX Payload.gtype" = cluster{"MSDU index": u8, "MSDU length": u16, "MSDU data": u8[]}
  "General Message Header.gtype" = cluster{"message type ID": u16, "reference ID": u16, "instance ID": u8}
  "SAP Sub Header.gtype" = cluster{"timestamp": u32, "number of submessages": u8, "confirmation mode": bool}
  "MAC SAP TX Configuration Request.gtype" = cluster{"General Message Header": "General Message Header.gtype", "SAP Sub Header": "SAP Sub Header.gtype", "MSDU TX Parameters": "MSDU TX Parameters.gtype", "PHY TX Parameters": "PHY TX Parameters.gtype"}
  "MAC SAP TX Payload Request.gtype" = cluster{"General Message Header": "General Message Header.gtype", "SAP Sub Header": "SAP Sub Header.gtype", "MSDU TX Payload": "MSDU TX Payload.gtype"}
uses:
  AFW::802_11::Transport::Create MAC SAP TX Configuration Request.gvi
  AFW::802_11::Transport::Create MAC SAP TX Payload Request.gvi
  AFW::802_11::Configuration::UDP Port Assignment.gvi
  AFW::802_11::Transport::Encode MAC SAP TX Payload Request.gvi
  AFW::802_11::Transport::Encode MAC SAP TX Configuration Request.gvi
diagram:
  call "Create MAC SAP TX Configuration Request.gvi"(MSDU TX parameters=$"MSDU TX parameters", PHY TX parameters=$"PHY TX parameters", instance ID=$"instance ID") -> (MAC SAP TX configuration request=w1)
  $"MAC SAP TX configuration request" <- w1
  call "Create MAC SAP TX Payload Request.gvi"(MSDU TX payload=$"MSDU TX payload", instance ID=$"instance ID") -> (MAC SAP TX payload request=w2)
  $"MAC SAP TX payload request" <- w2
  To Unsigned 16 Bit Integer(number=$"instance ID") -> w3
  call "UDP Port Assignment.gvi"(station number=w3, external mode=$"external mode") -> (TX requests=w4)
  call "Encode MAC SAP TX Payload Request.gvi"(MAC SAP TX payload request=w2) -> (encoded MAC SAP TX payload request=w5)
  call "Encode MAC SAP TX Configuration Request.gvi"(MAC SAP TX configuration request=w1) -> (encoded MAC SAP TX configuration request=w6)
  Udp Write Binary(address="127.0.0.1", connection ID=$"UDP connection ID in", data in=w6, error in=$"error in", port or service name=w4) -> (connection ID out=w7, error out=w8)
  Udp Write Binary(address="127.0.0.1", connection ID=w7, data in=w5, error in=w8, port or service name=w4) -> (connection ID out=w9, error out=w10)
  $"connection ID out" <- w9
  $"error out" <- w10
