vi "Prepare MAC SAP TX Request.gvi"   [LabVIEW NXG 4.0.0]
# Creates the MSDU TX parameters and PHY TX parameters which are part of MAC SAP TX configuration request. In addition, it creates the MSDU TX payload which is part of MAC SAP TX payload request. They are created based on the given parameters. Other parameters of MSDU TX parameters are given default values.
inputs:
  "payload": u8[]  # Payload data in.
  "MCS": UFXP(4.0) = 4  # Modulation and coding scheme index used to encode data frames.
  "device MAC address": string = "46:6F:4B:75:6D:61"  # 6-octet MAC address of the device.
  "destination MAC address": string = "46:6F:4B:75:6D:62"  # 6-octet MAC address of the destination.
  "error in": error
  "subcarrier format": "Subcarrier Format.gtype" = "20 MHz (IEEE 802.11 a)"  # Subcarrier format which can be: 802.11a with 20 MHz Bandwidth 802.11ac with 20 MHz Bandwidth 802.11ac with 40 MHz Bandwidth 802.11ac with 80 MHz Bandwidth (supported MCS up to 4)
outputs:
  "MSDU TX parameters": "MSDU TX Parameters.gtype"  # Cluster that has the MSDU TX parameters.
  "PHY TX parameters": "PHY TX Parameters.gtype"  # Cluster that has the PHY TX parameters.
  "MSDU TX payload": "MSDU TX Payload.gtype"  # Cluster that has the MSDU TX payload.
  "error out": error
types:
  "Subcarrier Format.gtype" = enum{"20 MHz (IEEE 802.11 a)", "20 MHz (IEEE 802.11 ac)", "40 MHz (IEEE 802.11 ac)", "80 MHz (IEEE 802.11 ac)"}
  "MSDU TX Payload.gtype" = cluster{"MSDU index": u8, "MSDU length": u16, "MSDU data": u8[]}
  "PHY Frame Format.gtype" = enum{"NON_HT_OFDM", "VHT", "NON_HT_DUP_OFDM"}
  "Bandwidth.gtype" = enum{"20 MHz", "40 MHz", "80 MHz"}
  "PHY TX Parameters.gtype" = cluster{"MSDU index": u8, "format": "PHY Frame Format.gtype", "bandwidth": "Bandwidth.gtype", "MCS": u8}
  "MAC Frame Type.gtype" = enum{"Management", "Control", "Data", "Extension"}
  "MSDU TX Parameters.gtype" = cluster{"MSDU index": u8, "frame type": "MAC Frame Type.gtype", "subtype": u8, "to DS": bool, "from DS": bool, "power management": u8, "more data": u8, "protected frame": u8, "HTC / order": u8, "source address": u8[6], "destination address": u8[6], "basic service set identifier": u8[6], "recipient address": u8[6], "transmitter address": u8[6], "MSDU length": u16}
uses:
  AFW::802_11::Conversion::Subcarrier Format to Configuration.gvi
  AFW::802_11::Conversion::MAC Address from String to Byte Array.gvi
diagram:
  Array Size(array=$payload) -> (size(s)=w1)
  To Unsigned 16 Bit Integer(number=w1) -> w2
  call "Subcarrier Format to Configuration.gvi"(MCS=$MCS, Subcarrier Format=$"subcarrier format", error in=$"error in") -> (bandwidth=w3, format=w4, error out=w5)
  call "MAC Address from String to Byte Array.gvi"(error in=w5, MAC address in=$"device MAC address") -> (error out=w6, MAC address out=w7)
  Feedback Node(initial value=0, input=w8) -> w9
  Increment(x=w9) -> w8
  call "MAC Address from String to Byte Array.gvi"(error in=w6, MAC address in=$"destination MAC address") -> (error out=w10, MAC address out=w11)
  Property Node(instance in="MSDU TX Parameters.gtype" {all zero or empty}, "MSDU index"=w8, "frame type"="Data", "subtype"=0, "to DS"=FALSE, "from DS"=FALSE, "power management"=0, "more data"=0, "protected frame"=0, "HTC / order"=0, "source address"=w7, "destination address"=w11, "MSDU length"=w2, "basic service set identifier"=[2, 0, 0, 0, 0, 0]) -> (instance out=w12)
  $"MSDU TX parameters" <- w12
  To Unsigned 8 Bit Integer(number=$MCS) -> w13
  Property Node(instance in="PHY TX Parameters.gtype" {all zero or empty}, "MSDU index"=w8, "format"=w4, "bandwidth"=w3, "MCS"=w13) -> (instance out=w14)
  $"PHY TX parameters" <- w14
  Property Node(instance in="MSDU TX Payload.gtype" {all zero or empty}, "MSDU index"=w8, "MSDU length"=w2, "MSDU data"=$payload) -> (instance out=w15)
  $"MSDU TX payload" <- w15
  $"error out" <- w10
