vi "Receive MAC RX Indications.gvi"   [LabVIEW NXG 4.0.0]
# Polls input queue for MAC SAP RX indication message pairs from MAC Middle SAP. It decodes and evaluates the received MAC SAP RX messages, for example the specified message sequence. The MAC SAP RX CONFIG IND should receive before MAC SAP RX PAYLOAD IND. In addition, it checks CONFIG and PAYLOAD messages for consistency (e.g. matching MSDU indices and MSDU length values). Then, it calls the MAC High RX Stub function and provides the extracted config & status parameters and payload data.
inputs:
  "UDP interface in": UdpNetworkConnectionRefnum  # UDP reference to the received MAC SAP RX Indications messages at MAC high abstraction.
  "error in": error
  "device bandwidth": u16  # Instantaneous device bandwidth
outputs:
  "MSDU data": u8[]  # Extracted MSDU data.
  "MSDU data valid": bool  # Valid signal for payload.
  "UDP interface out": UdpNetworkConnectionRefnum  # UDP reference to the received MAC SAP RX Indications messages at MAC high abstraction.
  "timeout": bool  # Boolean signal if timeout.
  "error out": error
uses:
  AFW::802_11::MAC Middle SAP::Try Message Read.gvi
  AFW::802_11::Transport::Decode MAC SAP RX Payload Indication.gvi
  AFW::802_11::Transport::Decode MAC SAP RX Configuration Indication.gvi
  AFW::802_11::MAC High Abstraction::Compare MSDU Parameters.gvi
  NI::G Core::Error::Is Error.gvi
diagram:
  Feedback Node(initial value=u8[] [], input=w1) -> w2
  Is Empty Array(array=w2) -> w3
  case (w3) {
    frame False, Default {
      w4 = $"UDP interface in"
      w5 = w2
      w6 = $"error in"
      w7 = TRUE
    }
    frame True {
      call "Try Message Read.gvi"(UDP interface in=$"UDP interface in", error in=$"error in", message id=0x5081) -> (UDP interface out=w4, message=w5, error out=w6, success=w7)
    }
  }
  case (w7) {
    frame False, Default {
      w8 = w4
      w9 = w6
      w10 = u8[] []
      w11 = w7
    }
    frame True {
      call "Try Message Read.gvi"(UDP interface in=w4, error in=w6, message id=0x5082) -> (UDP interface out=w8, message=w10, error out=w9, success=w11)
    }
  }
  $"UDP interface out" <- w8
  Select(s=w11, t=u8[] [], f=w5) -> w1
  case (w11) {
    frame False, Default {
      w12 = w10
      w13 = w9
      w14 = w11
    }
    frame True {
      call "Decode MAC SAP RX Payload Indication.gvi"(received MAC SAP RX payload indication=w10) -> (MAC SAP RX payload indication=w15, error out=w16)
      Property Node(instance in=w15) -> ("MSDU RX Payload:MSDU data"=w12)
      call "Decode MAC SAP RX Configuration Indication.gvi"(received MAC SAP RX configuration indication=w5, device bandwidth=$"device bandwidth") -> (decoded MAC SAP RX configuration indication=w17, error out=w18)
      Merge Errors(w9, w18, w16) -> (error out=w19)
      call "Compare MSDU Parameters.gvi"(MAC SAP RX configuration indication=w17, MAC SAP RX payload indication=w15, error in=w19) -> (error out=w13)
      call "Is Error.gvi"(error in=w13) -> (error?=w20)
      Not(x=w20) -> w14
    }
  }
  $"MSDU data" <- w12
  $"error out" <- w13
  $"MSDU data valid" <- w14
  Not(x=w11) -> w21
  $timeout <- w21
