vi "Check Expected Message.gvi"   [LabVIEW NXG 4.0.0]
# Checks the decoded message type ID if it is supported at the specific interface and if it is the expected message ID at this location in the chain.
inputs:
  "expected message": u16 = 20737  # Expected message type ID that needs to be checked.
  "general message header": "General Message Header.gtype"  # Decoded General message header.
  "error in": error
outputs:
  "error out": error
types:
  "General Message Header.gtype" = cluster{"message type ID": u16, "reference ID": u16, "instance ID": u8}
uses:
  NI::G Core::Error::Build Error Cluster.gvi
diagram:
  Property Node(instance in=$"general message header") -> ("message type ID"=w1)
  Is Equal(x=w1, y=$"expected message") -> w2
  case (w2) {
    frame True {
      w3 = $"error in"
    }
    frame False {
      Is Equal(x=w1, y=0x5101) -> w4
      Is Equal(x=w1, y=0x5102) -> w5
      Logical Or(w4, w5) -> w6
      # Specific message type IDs Message ID (hex)
      # MAC SAP TX CONFIG REQ: 0x5101
      # MAC SAP TX PAYLOAD REQ: 0x5102
      # MAC SAP TX CNF:0x5201
      # MAC SAP TX STATUS IND: 0x5001
      # MAC SAP RX CONFIG IND: 0x5081
      # MAC SAP RX PAYLOAD IND:0x5082
      Search 1D Array(1D array=[20737, 20738, 20993, 20481, 20609, 20610], element=w1) -> (index of element=w7)
      Is Less Than 0(x=w7) -> w8
      w9 = "MAC Middle SAP (TX): \nThe primitive %x \nis unknown/undefined "
      Format Into String(formatString=w9, errIn=$"error in", w1) -> (outString=w10, errOut=w11)
      Type Cast(type=u8 0, x="Unknown Message") -> w12
      To Signed 32 Bit Integer(number=w12) -> w13
      case (w8) {
        frame False, Default {
          w14 = w11
        }
        frame True {
          call "Build Error Cluster.gvi"(code=w13, description=w10, error in=w11, include call chain=TRUE, make warning=FALSE) -> (error out=w14)
        }
      }
      w15 = "MAC Middle SAP (TX): \nreceived message type ID (%x)\nnot supported at this interface"
      Format Into String(formatString=w15, errIn=w14, w1) -> (outString=w16, errOut=w17)
      Type Cast(type=u8 0, x="Message not Supported") -> w18
      To Signed 32 Bit Integer(number=w18) -> w19
      case (w6) {
        frame True {
          w20 = w17
        }
        frame False {
          call "Build Error Cluster.gvi"(code=w19, description=w16, error in=w17, include call chain=TRUE, make warning=FALSE) -> (error out=w20)
        }
      }
      w21 = "MAC Middle SAP (TX): \nExpected message %x mismatches \nreceived message %x"
      Format Into String(formatString=w21, errIn=w20, $"expected message", w1) -> (outString=w22, errOut=w23)
      Type Cast(type=u8 0, x="State Violation") -> w24
      To Signed 32 Bit Integer(number=w24) -> w25
      call "Build Error Cluster.gvi"(code=w25, description=w22, error in=w23, include call chain=TRUE, make warning=FALSE) -> (error out=w3)
    }
  }
  $"error out" <- w3
