vi "Check Instance Identification.gvi"   [LabVIEW NXG 4.0.0]
# Checks if the local instance ID is not like the decoded instance ID.
inputs:
  "instance ID": u8  # Instance ID of the corresponding station.
  "general message header": "General Message Header.gtype"  # Decoded General message header.
  "error in": error
outputs:
  "error out": error
types:
  "General Message Header.gtype" = cluster{"message type ID": u16, "reference ID": u16, "instance ID": u8}
uses:
  NI::G Core::Error::Build Error Cluster.gvi
diagram:
  Property Node(instance in=$"general message header") -> ("instance ID"=w1)
  Is Equal(x=$"instance ID", y=w1) -> w2
  case (w2) {
    frame False, Default {
      Type Cast(type=u8 0, x="Instance ID Mismatch") -> w4
      To Signed 32 Bit Integer(number=w4) -> w5
      w6 = "The local instance ID is not like the decoded instance ID from MAC high. \nDecoded ID: %d, Local ID: %d"
      Format Into String(formatString=w6, w1, $"instance ID") -> w7
      call "Build Error Cluster.gvi"(code=w5, description=w7) -> (error out=w8)
      Merge Errors($"error in", w8) -> (error out=w3)
    }
    frame True {
      w3 = $"error in"
    }
  }
  $"error out" <- w3
