vi "Check MAC SAP TX Configuration and Payload Consistency.gvi"   [LabVIEW NXG 4.0.0]
# Checks if there is mismatch between MAC SAP TX configuration request and MAC SAP TX payload request (MSDU length and MSDU index).
inputs:
  "MAC SAP TX configuration request in": "MAC SAP TX Configuration Request.gtype"  # MAC SAP TX configuration request message.
  "MAC SAP TX payload request in": "MAC SAP TX Payload Request.gtype"  # MAC SAP TX payload request message.
  "error in": error
outputs:
  "error out": error
  "MAC SAP TX configuration request out": "MAC SAP TX Configuration Request.gtype"  # MAC SAP TX configuration request message without change.
  "MAC SAP TX payload request out": "MAC SAP TX Payload Request.gtype"  # MAC SAP TX payload request message without change.
types:
  "General Message Header.gtype" = cluster{"message type ID": u16, "reference ID": u16, "instance ID": u8}
  "SAP Sub Header.gtype" = cluster{"timestamp": u32, "number of submessages": u8, "confirmation mode": bool}
  "MAC Frame Type.gtype" = enum{"Management", "Control", "Data", "Extension"}
  "MSDU TX Parameters.gtype" = cluster{"MSDU index": u8, "frame type": "MAC Frame Type.gtype", "subtype": u8, "to DS": bool, "from DS": bool, "power management": u8, "more data": u8, "protected frame": u8, "HTC / order": u8, "source address": u8[6], "destination address": u8[6], "basic service set identifier": u8[6], "recipient address": u8[6], "transmitter address": u8[6], "MSDU length": u16}
  "PHY Frame Format.gtype" = enum{"NON_HT_OFDM", "VHT", "NON_HT_DUP_OFDM"}
  "Bandwidth.gtype" = enum{"20 MHz", "40 MHz", "80 MHz"}
  "PHY TX Parameters.gtype" = cluster{"MSDU index": u8, "format": "PHY Frame Format.gtype", "bandwidth": "Bandwidth.gtype", "MCS": u8}
  "MAC SAP TX Configuration Request.gtype" = cluster{"General Message Header": "General Message Header.gtype", "SAP Sub Header": "SAP Sub Header.gtype", "MSDU TX Parameters": "MSDU TX Parameters.gtype", "PHY TX Parameters": "PHY TX Parameters.gtype"}
  "MSDU TX Payload.gtype" = cluster{"MSDU index": u8, "MSDU length": u16, "MSDU data": u8[]}
  "MAC SAP TX Payload Request.gtype" = cluster{"General Message Header": "General Message Header.gtype", "SAP Sub Header": "SAP Sub Header.gtype", "MSDU TX Payload": "MSDU TX Payload.gtype"}
uses:
  NI::G Core::Error::Build Error Cluster.gvi
diagram:
  Property Node(instance in=$"MAC SAP TX configuration request in") -> ("MSDU TX Parameters:MSDU index"=w1, "MSDU TX Parameters:MSDU length"=w2, instance out=w3)
  $"MAC SAP TX configuration request out" <- w3
  Property Node(instance in=$"MAC SAP TX payload request in") -> ("MSDU TX Payload:MSDU index"=w4, "MSDU TX Payload:MSDU length"=w5, instance out=w6)
  $"MAC SAP TX payload request out" <- w6
  Is Equal(x=w1, y=w4) -> w7
  Is Equal(x=w2, y=w5) -> w8
  Logical And(w7, w8) -> w9
  case (w9) {
    frame True {
      w10 = $"error in"
    }
    frame False {
      w11 = """parameter mismatch:
MSDU index:
MAC SAP TX Configuration Request: %d
MAC SAP TX payload Request: %d
MSDU length:
MAC SAP TX Configuration Request: %d
MAC SAP TX payload Request:  %d"""
      Format Into String(formatString=w11, w1, w4, w2, w5) -> w12
      Type Cast(type=u8 0, x="Config Payload Mismatch") -> w13
      To Signed 32 Bit Integer(number=w13) -> w14
      call "Build Error Cluster.gvi"(code=w14, description=w12) -> (error out=w15)
      Merge Errors($"error in", w15) -> (error out=w10)
    }
  }
  $"error out" <- w10
