vi "Determine Recipient Address and Transmitter Address.gvi"   [LabVIEW NXG 4.0.0]
# Determines recipient address (RA) and transmitter address (TA) from destination address (DA), source address (SA), and basic service set identifier (BSSID) based on the “To DS” and “from DS” settings. The mapping for data frames is shown in section 9.3.2.1 of IEEE, "Part 11: Wireless LAN Medium Access Control (MAC) and Physical Layer (PHY) Specifications," 2016.
inputs:
  "MSDU TX parameters": "MSDU TX Parameters.gtype"  # MSDU TX parameters.
outputs:
  "recipient address": u8[6]  # Determined recipient address.
  "transmitter address": u8[6]  # Determined transmitter address.
types:
  "MAC Frame Type.gtype" = enum{"Management", "Control", "Data", "Extension"}
  "MSDU TX Parameters.gtype" = cluster{"MSDU index": u8, "frame type": "MAC Frame Type.gtype", "subtype": u8, "to DS": bool, "from DS": bool, "power management": u8, "more data": u8, "protected frame": u8, "HTC / order": u8, "source address": u8[6], "destination address": u8[6], "basic service set identifier": u8[6], "recipient address": u8[6], "transmitter address": u8[6], "MSDU length": u16}
diagram:
  Property Node(instance in=$"MSDU TX parameters") -> ("frame type"=w1, "destination address"=w2, "source address"=w3, "basic service set identifier"=w4, "recipient address"=w5, "transmitter address"=w6, "to DS"=w7, "from DS"=w8)
  Is Equal(x="Management", y=w1) -> w9
  # See section 9.3.2.1: IEEE, "Part 11: Wireless LAN Medium Access Control (MAC) and Physical Layer (PHY) Specifications," 2016.
  case (w9) {
    frame False, Default {
      Logical Or(w7, w8) -> w12
      case (w12) {
        frame False, Default {
          w10 = w2
          w11 = w3
        }
        frame True {
          Logical And(w7, w8) -> w13
          case (w13) {
            frame False, Default {
              Select(s=w8, t=w2, f=w4) -> w10
              Select(s=w8, t=w4, f=w3) -> w11
            }
            frame True {
              w10 = w5
              w11 = w6
            }
          }
        }
      }
    }
    frame True {
      w10 = w2
      w11 = w3
    }
  }
  $"recipient address" <- w10
  $"transmitter address" <- w11
