vi "Generate MAC SAP RX Indication.gvi"   [LabVIEW NXG 4.0.0]
inputs:
  "FPGA interface": "FGPA Reference.gtype"  # Interface to the device's FPGA handle.
  "receive throughput queue": Queue<T1>  # Queue to store statistical information about the payload (time stamp and size).
  "error in": error
  "reset": bool  # To reset the internal cache of duplicate detection node.
  "cache size": u32 = 10  # To set the cache size where the MAC TAs with related sequence numbers and fragment numbers are stored in the duplication node.
  "instance ID": u8  # Instance ID of the corresponding station.
  "UDP send connection": UdpNetworkConnectionRefnum  # Reference to the UDP socket used to send the RX Indication messages (MAC SAP RX configuration indication and MAC SAP RX payload indication).
  "external mode": bool  # True if data source is external mode.
outputs:
  "error out": error
  "num indications received": u32
  "num indications triggered": u32
types:
  T1 = cluster{"Timestamp": u32, "Transferred Bytes": u32}
uses:
  AFW::802_11::Configuration::UDP Port Assignment.gvi
  AFW::802_11::ICP::Decode ICP.gvi
  AFW::802_11::Conversion::MAC RX Indication::Variable Length Byte Array to MAC RX Indication.gvi
  AFW::802_11::RX::Duplicate Detection.gvi
  AFW::802_11::MAC Middle SAP::Parameter Sets Generation of MAC MSDU RX Indication.gvi
  AFW::802_11::Transport::Create MAC SAP RX Payload Indication.gvi
  AFW::802_11::Transport::Encode MAC SAP RX Payload Indication.gvi
  AFW::802_11::Transport::Create MAC SAP RX Configuration Indication.gvi
  AFW::802_11::Transport::Encode MAC SAP RX Configuration Indication.gvi
  NI::G Core::Error::Filter Error Code.gvi
  NI::G Core::Error::Is Error.gvi
diagram:
  To Unsigned 16 Bit Integer(number=$"instance ID") -> w1
  call "UDP Port Assignment.gvi"(station number=w1, external mode=$"external mode") -> (local RX indications=w2)
  Host Fifo Read Node[FifoName="AFW::802_11::Resources::802.11 AFW Resources.grsc::T2H RX Data"](error in=$"error in", number of elements=0, reference in=$"FPGA interface", timeout (ms)=0) -> (elements remaining=w3, error out=w4, reference out=w5)
  Host Fifo Read Node[FifoName="AFW::802_11::Resources::802.11 AFW Resources.grsc::T2H RX Data"](error in=w4, number of elements=w3, reference in=w5, timeout (ms)=-1) -> (data=w6, error out=w7)
  Feedback Node(input=w8) -> w9
  Build Array(w9, w6) -> w10
  s1 = w10  # shift register
  s2 = w7  # shift register
  while {
    call "Decode ICP.gvi"(array=s1) -> (remaining data=w13, decoded=w14, message=w15, payload=w16)
    case (w14) {
      frame False, Default {
        w17 = s2
        w18 = default
        w19 = default
      }
      frame True {
        call "Variable Length Byte Array to MAC RX Indication.gvi"(byte array=w15, error in=s2) -> (MAC RX Indication=w20, error out=w21)
        Property Node(instance in=w20) -> ("valid"=w22, instance out=w23)
        # Convert the byte array of MAC MSDU RX Message to cluster
        case (w22) {
          frame False {
            w17 = w21
            w19 = default
          }
          frame True {
            call "Duplicate Detection.gvi"(MAC RX indication in=w23, MSDU data in=w16, reset=$reset, cache size=$"cache size") -> (MAC RX indication out=w24, MSDU data out=w25)
            Property Node(instance in=w24) -> ("valid"=w19, instance out=w26)
            # Checks if the received MSDU (Data or Management frame) is a duplicate based on its associated sequence number.
            # Generates the corresponding  MAC Middle SAP RX indication pair - MAC SAP RX CONFIG IND - MAC SAP RX PAYLOAD IND
            # Map MSDU RX indication cluster to the clusters of MAC SAP RX Indication:
            # MAC SAP RX Configuration Indication has four sub-messages:
            # - MSDU RX parameters, PHY RX parameters, Additional MSDU RX parameters, MAC RX status
            # MAC SAP RX Payload Indication has one sub-message:
            # - MAC RX payload
            # Encode both messages
            # Write both messages
            # First: MAC SAP RX configuration indication
            # Then: MAC SAP RX payload indication
            # retry if network is busy
            case (w19) {
              frame False, Default {
                w17 = w21
              }
              frame True {
                call "Parameter Sets Generation of MAC MSDU RX Indication.gvi"(MAC RX indication in=w26, MSDU data in=w25) -> (MSDU RX parameters out=w27, PHY RX parameters out=w28, additional MSDU RX parameters out=w29, MAC RX status out=w30, MSDU RX payload out=w31)
                call "Create MAC SAP RX Payload Indication.gvi"(MSDU RX payload=w31, instance ID=$"instance ID") -> (MAC SAP RX payload indication=w32)
                call "Encode MAC SAP RX Payload Indication.gvi"(MAC SAP RX payload indication=w32) -> (encoded MAC SAP RX payload indication=w33)
                Tick Count() -> (timer value=w34)
                Array Size(array=w25) -> (size(s)=w35)
                To Unsigned 32 Bit Integer(number=w35) -> w36
                Property Node(instance in=T1 {all zero or empty}, "Timestamp"=w34, "Transferred Bytes"=w36) -> (instance out=w37)
                Enqueue Element(element=w37, error in=w21, queue=$"receive throughput queue", timeout in ms=-1) -> (error out=w38)
                call "Create MAC SAP RX Configuration Indication.gvi"(MSDU RX parameters=w27, PHY RX parameters=w28, additional MSDU RX parameters=w29, MAC RX status in=w30, instance ID=$"instance ID") -> (MAC SAP RX configuration indication=w39)
                call "Encode MAC SAP RX Configuration Indication.gvi"(MAC SAP RX configuration indication=w39) -> (encoded MAC SAP RX configuration indication=w40)
                s3 = $"UDP send connection"  # shift register
                s4 = w38  # shift register
                while {
                  Udp Write Binary(address="127.0.0.1", connection ID=s3, data in=w40, error in=s4, port or service name=w2) -> (connection ID out=w41, error out=w42)
                  call "Filter Error Code.gvi"(code to clear=55, error in=w42) -> (error cleared?=w43, error out=w44)
                  next s3 = w41
                  next s4 = w44
                  continue if w43
                }
                s5 = s3  # shift register
                s6 = s4  # shift register
                while {
                  Udp Write Binary(address="127.0.0.1", connection ID=s5, data in=w33, error in=s6, port or service name=w2) -> (connection ID out=w45, error out=w46)
                  call "Filter Error Code.gvi"(code to clear=55, error in=w46) -> (error cleared?=w47, error out=w48)
                  next s5 = w45
                  next s6 = w48
                  continue if w47
                }
                w17 = s6
              }
            }
          }
        }
        w18 = TRUE
      }
    }
    call "Is Error.gvi"(error in=w17) -> (error?=w49)
    Logical And(w18, not w49) -> w50
    append TRUE to w11 if w14
    append TRUE to w12 if w19
    next s1 = w13
    next s2 = w17
    continue if w50
  }
  w8 = s1
  $"error out" <- s2
  Array Size(array=w12) -> (size(s)=w51)
  To Unsigned 32 Bit Integer(number=w51) -> w52
  Feedback Node(input=w53) -> w54
  Add(w52, w54) -> w53
  $"num indications triggered" <- w53
  Array Size(array=w11) -> (size(s)=w55)
  To Unsigned 32 Bit Integer(number=w55) -> w56
  Feedback Node(input=w57) -> w58
  Add(w56, w58) -> w57
  $"num indications received" <- w57
