vi "Send TX Confirmation.gvi"   [LabVIEW NXG 4.0.0]
# Writes the TX Confirmation message to the specified UDP port.
inputs:
  "port": u16  # Reference to the UDP socket used to send the TX confirmation.
  "IP address": string  # IP address to send the TX confirmation to.
  "UDP connection in": UdpNetworkConnectionRefnum  # Reference to the UDP socket used to send the TX confirmation.
  "general message header": "General Message Header.gtype"  # Decoded general message header.
  "error in": error
  "confirmation status": "Confirmation States.gtype" = "Success"  # Result of check process stored in the confirmation status enum.
outputs:
  "error out": error
  "connection out": UdpNetworkConnectionRefnum  # Reference to the UDP socket used to send the TX confirmation.
types:
  "General Message Header.gtype" = cluster{"message type ID": u16, "reference ID": u16, "instance ID": u8}
  "Confirmation States.gtype" = enum{"Success", "Unknown Message", "Message not Supported", "Unknown Parameter (Set)", "Missing Parameter (Set)", "Parameter (Set) Repetition", "Range Violation", "State Violation", "Timeout", "Config Payload Mismatch", "Length Mismatch", "Input Buffer Full", "Internal Error", "Instance ID Mismatch"}
uses:
  AFW::802_11::Transport::Create MAC SAP TX Confirmation.gvi
  AFW::802_11::Transport::Encode MAC SAP TX Confirmation.gvi
diagram:
  Property Node(instance in=$"general message header") -> ("reference ID"=w1, "instance ID"=w2)
  call "Create MAC SAP TX Confirmation.gvi"(reference ID=w1, instance ID=w2, confirmation status=$"confirmation status") -> (MAC SAP TX confirmation=w3)
  call "Encode MAC SAP TX Confirmation.gvi"(MAC SAP TX confirmation=w3) -> (encoded MAC SAP TX confirmation=w4)
  Udp Write Binary(address=$"IP address", connection ID=$"UDP connection in", data in=w4, error in=$"error in", port or service name=$port) -> (connection ID out=w5, error out=w6)
  $"connection out" <- w5
  $"error out" <- w6
