vi "Try Message Read.gvi"   [LabVIEW NXG 4.0.0]
# Reads the message from the given UDP reference and decodes the message header. In addition, it checks if the decoded message ID is equal to the given message ID.
inputs:
  "UDP interface in": UdpNetworkConnectionRefnum  # UDP reference in to the corrsponding port.
  "error in": error
  "message id": u16 = 20865  # Message ID that needs to be checked in the header
outputs:
  "UDP interface out": UdpNetworkConnectionRefnum  # UDP reference out to the corrsponding port.
  "message": u8[]  # Received message from the given UDP reference.
  "error out": error
  "success": bool  # Valid signal if the decoded message ID is equal to the given message ID.
uses:
  NI::G Core::Error::Filter Error Code.gvi
  AFW::802_11::Transport::Decode General Message Header.gvi
diagram:
  Udp Read I Pv 6 Binary(connection ID=$"UDP interface in", error in=$"error in", max size=0xFFFF, timeout ms=0) -> (connection ID out=w1, data out=w2, error out=w3)
  $"UDP interface out" <- w1
  call "Filter Error Code.gvi"(code to clear=56, error in=w3) -> (error cleared?=w4, error out=w5)
  call "Decode General Message Header.gvi"(received general message header=w2) -> (decoded general message header=w6)
  Property Node(instance in=w6) -> ("message type ID"=w7)
  Is Equal(x=w7, y=$"message id") -> w8
  Logical And(w8, not w4) -> w9
  Select(s=w9, t=w2, f=u8[] []) -> w10
  $message <- w10
  $success <- w9
  $"error out" <- w5
