vi "Write TX Request Reference Parameters to Queue.gvi"   [LabVIEW NXG 4.0.0]
# Enqueues the reference ID and MSDU length to be used in the Generate MAC SAP TX status indication node.
inputs:
  "TX request confirmation reference queue in": Queue<"TX Request Confirmation Reference Parameters.gtype">  # Queue reference that is used to store the reference ID and MSDU length.
  "MAC TX request in": "MAC TX Request.gtype"  # Transferred MAC TX request to FPGA, which includes the MSDU length.
  "general message header": "General Message Header.gtype"  # Decoded general message header.
  "error in": error
outputs:
  "error out": error
types:
  "MPDU Configuration.gtype" = cluster{"frame control": "MAC Header Frame Control.gtype", "header contents": "MAC Header Contents.gtype", "parameters": "MPDU Parameters.gtype"}
  "PHY Frame Format.gtype" = enum{"NON_HT_OFDM", "VHT", "NON_HT_DUP_OFDM"}
  "Bandwidth.gtype" = enum{"20 MHz", "40 MHz", "80 MHz"}
  "TX Vector.gtype" = cluster{"format": "PHY Frame Format.gtype", "bandwidth": "Bandwidth.gtype", "PSDU length": u32, "(A-)MPDU length": u32, "MCS": UFXP(4.0)}
  "MAC TX Request.gtype" = cluster{"MPDU configuration": "MPDU Configuration.gtype", "TX vector": "TX Vector.gtype", "valid": bool}
  "General Message Header.gtype" = cluster{"message type ID": u16, "reference ID": u16, "instance ID": u8}
  "TX Request Confirmation Reference Parameters.gtype" = cluster{"reference ID": u16, "MSDU length": u16}
diagram:
  # Enqueue the reference elements for MAC SAP TX Status Indication
  Property Node(instance in=$"MAC TX request in") -> ("MPDU configuration:parameters:MSDU length"=w1)
  Property Node(instance in=$"general message header") -> ("reference ID"=w2)
  w3 = "TX Request Confirmation Reference Parameters.gtype" {all zero or empty}
  Property Node(instance in=w3, "MSDU length"=w1, "reference ID"=w2) -> (instance out=w4)
  Enqueue Element(element=w4, error in=$"error in", queue=$"TX request confirmation reference queue in") -> (error out=w5)
  $"error out" <- w5
