vi "Duplicate Detection.gvi"   [LabVIEW NXG 4.0.0]
# Checks if the received MSDU/MMPDU (Data or Management frame) is a duplicate based on its associated sequence number.
inputs:
  "MAC RX indication in": "MAC RX Indication.gtype"  # Consists MAC configuration information passed to the subsequent module in MAC RX chain: RX vector, RX status, MPDU configuration
  "MSDU data in": u8[]  # Received payload that can be set to empty in some cases. Those are invalid MSDU/MPDU or duplicated frame has been detected.
  "reset": bool  # To reset the internal cache.
  "cache size": u32 = 10  # Set the cache size where the MAC TAs with related sequence numbers and fragment numbers will be stored.
outputs:
  "MAC RX indication out": "MAC RX Indication.gtype"  # Updated MAC RX cluster. The updated parameters are MSDU length and MSDU duplicate detection status.
  "MSDU data out": u8[]  # Received payload that has been set to empty if the MSDU/MPDU is invalid or duplicated frame has been detected
types:
  "PHY Frame Format.gtype" = enum{"NON_HT_OFDM", "VHT", "NON_HT_DUP_OFDM"}
  "Bandwidth.gtype" = enum{"20 MHz", "40 MHz", "80 MHz"}
  "Non HT Bandwidth.gtype" = enum{"20 MHz", "40 MHz", "80 MHz", "160 MHz"}
  "RX Vector.gtype" = cluster{"format": "PHY Frame Format.gtype", "bandwidth": "Bandwidth.gtype", "PSDU length": u32, "MCS": UFXP(4.0), "non HT bandwidth": "Non HT Bandwidth.gtype", "dynamic bandwidth support": bool}
  "A-MPDU De-Aggregation Status.gtype" = enum{"A-MPDU De-Aggregation not executed", "A-MPDU De-Aggregation successful", "PSDU length mismatch", "VHT delimiter CRC fail", "VHT delimiter signature comparison fail", "EOF field check fail", "MPDU length mismatch"}
  "FCS Check Status.gtype" = enum{"FCS check not executed", "FCS check pass", "FCS check fail"}
  "MPDU Length Check Status.gtype" = enum{"MPDU length check not executed", "MPDU length check pass", "MPDU length check not standard compliant", "MPDU length check exceeds implemented buffer"}
  "MPDU Disassembly Status.gtype" = enum{"Disassembly not executed", "Disassembly successful", "Disassembly done partially", "Disassembly not successful"}
  "MPDU Filtering Status.gtype" = enum{"MPDU Filtering not executed", "MPDU valid for further processing", "MPDU pass through for sniffer mode"}
  "MSDU Defragmentation Status.gtype" = enum{"Defragmentation not executed", "Unfragmented MSDU successfully received", "Unsupported MSDU fragment received"}
  "MSDU Duplicate Detection Status.gtype" = enum{"Duplicate detection not executed", "Duplicate detection successfully passed", "Duplicate detected"}
  "RX Status.gtype" = cluster{"A-MPDU de-aggregation status": "A-MPDU De-Aggregation Status.gtype", "MPDU FCS check status": "FCS Check Status.gtype", "MPDU length check status": "MPDU Length Check Status.gtype", "MPDU disassembly status": "MPDU Disassembly Status.gtype", "MPDU Filtering Status": "MPDU Filtering Status.gtype", "MSDU Defragmentation Status": "MSDU Defragmentation Status.gtype", "MSDU Duplicate Detection Status": "MSDU Duplicate Detection Status.gtype"}
  "MPDU Configuration.gtype" = cluster{"frame control": "MAC Header Frame Control.gtype", "header contents": "MAC Header Contents.gtype", "parameters": "MPDU Parameters.gtype"}
  "MAC RX Indication.gtype" = cluster{"RX vector": "RX Vector.gtype", "RX status": "RX Status.gtype", "MPDU configuration": "MPDU Configuration.gtype", "valid": bool}
  "RX Cache Parameters.gtype" = cluster{"MAC Transmitter Address": u8[6], "Sequence Number ": UFXP(12.0), "Fragment Number": UFXP(4.0)}
uses:
  AFW::802_11::RX::Check for Frame Exclusion from Duplicate Detection.gvi
  AFW::802_11::RX::RX Cache Update.gvi
diagram:
  # The reset logic is used to reset the cache.
  # Note: Ddifferent receiver caches are defined in the WiFi standard, see [1], table 10-4. The AFW 2.1 supports the RC1 cache (“Non-QoS data”) only
  # [1] 	IEEE, "Part 11: Wireless LAN Medium Access Control (MAC) and Physical Layer (PHY) Specifications," 2016.
  Feedback Node(initial value="RX Cache Parameters.gtype"[] [], input=w1) -> w2
  case ($reset) {
    frame False, Default {
      w3 = w2
    }
    frame True {
      w3 = "RX Cache Parameters.gtype"[] []
    }
  }
  Property Node(instance in=$"MAC RX indication in") -> ("valid"=w4, instance out=w5)
  case (w4) {
    frame False, Default {
      w8 = "Duplicate detected"  # MSDU Duplicate Detection Status
      # Set MSDU length to value 0
      Property Node(instance in=w5, "MPDU configuration:parameters:MSDU length"=0, "RX status:MSDU Duplicate Detection Status"=w8) -> (instance out=w7)
      w6 = u8[] []
      w1 = w3
    }
    frame True {
      # Check for a valid MSDU/MMPDU:
      # Yes: == “Unfragmented MSDU successfully received” (valid MSDU/MMPDU, completely processed by preceding MAC RX modules
      #
      # NO: != “Unfragmented MSDU successfully received”
      Property Node(instance in=w5) -> ("RX status:MSDU Defragmentation Status"=w9, instance out=w10)
      Is Equal(x=w9, y="Unfragmented MSDU successfully received") -> w11
      case (w11) {
        frame False, Default {
          # w3: cache remains the same
          # Invalid MSDU/MMPDU that not completely processed by preceding MAC RX modules
          # The MAC MSDU RX IND has still been generated but it does not contain valid MSDU data (the MSDU input is empty)
          # Set MSDU length to value 0
          # MSDU is empty
          Property Node(instance in=w10, "MPDU configuration:parameters:MSDU length"=0, "RX status:MSDU Duplicate Detection Status"="Duplicate detected") -> (instance out=w7)
          w6 = u8[] []
          w1 = w3
        }
        frame True {
          # Check for frames which are excluded from duplicate detection and RX cache updates: If (frame type (Management) AND subtype (ATIM)) OR recipient address (RA) is group address)
          call "Check for Frame Exclusion from Duplicate Detection.gvi"(MAC RX indication in=w10) -> (MAC RX indication out=w12, is excluded frame from duplicate detection=w13)
          # Valid MSDU/MMPDU that completely processed by preceding MAC RX modules.
          # w13: exclude from duplicate
          # detection?
          case (w13) {
            frame False, Default {
              Property Node(instance in=w12) -> ("MPDU configuration:frame control:retry"=w14, instance out=w15)
              Property Node(instance in=w15) -> ("MPDU configuration:header contents:transmitter address"=w16, "MPDU configuration:header contents:sequence number"=w17, "MPDU configuration:header contents:fragment number"=w18, instance out=w19)
              # Check if retry flag is TRUE
              # Yes: It means retransmission received --> Carry out duplicate detection and cache update
              # No: It means initial transmission received --> Skip the duplicate detection, but do a cache update
              Property Node(instance in="RX Cache Parameters.gtype" {all zero or empty}, "MAC Transmitter Address"=w16, "Sequence Number "=w17, "Fragment Number"=w18) -> (instance out=w20)
              # Carry out duplicate detection and cache update
              # w21: Is identical tuple is
              # found in the cache?
              call "RX Cache Update.gvi"(RX cache in=w3, received parameters=w20, cache size=$"cache size") -> (RX cache out=w1, MAC transmitter address found=w21)
              # w14: retry flag
              Logical And(w21, w14) -> w22
              case (w22) {
                frame False, Default {
                  # w19: Keep MSDU length
                  Property Node(instance in=w19, "RX status:MSDU Duplicate Detection Status"="Duplicate detection successfully passed") -> (instance out=w7)
                  w6 = $"MSDU data in"
                }
                frame True {
                  # If Duplicate is detected
                  #  - Set MSDU length = 0
                  #  - Do not generate a MAC MSDU RX IND for the received MSDU/MMPDU
                  # MSDU data set empty
                  Property Node(instance in=w19, "MPDU configuration:parameters:MSDU length"=0, "valid"=FALSE, "RX status:MSDU Duplicate Detection Status"="Duplicate detected") -> (instance out=w7)
                  w6 = u8[] []
                }
              }
            }
            frame True {
              # •	Group addressed frames are not put into the cache, i.e. no duplicate detection is applied.
              # •	ATIM management frames (frame type=00, subtype 1001) are not put into the cache, i.e. no duplicate detection is applied
              # $"MSDU data in": Forward MSDU
              # without duplicate detection and cache update
              # w3: Forward cache without duplicate detection and update
              Property Node(instance in=w12, "RX status:MSDU Duplicate Detection Status"="Duplicate detection successfully passed") -> (instance out=w7)
              w6 = $"MSDU data in"
              w1 = w3
            }
          }
        }
      }
    }
  }
  $"MAC RX indication out" <- w7
  $"MSDU data out" <- w6
