vi "RX Cache Update.gvi"   [LabVIEW NXG 4.0.0]
# Searches in the cache for a tuple (<transmitter address (TA), sequence number, fragment number>) and then updates the cache if the new entry is not available.
inputs:
  "RX cache in": "RX Cache Parameters.gtype"[]  # RX Cache is an array cluster that stores the transmitter addresses with its sequence numbers and fragment numbers.
  "received parameters": "RX Cache Parameters.gtype"  # Extracted transmitter address, sequence number, and fragment number from the received MPDU configuration.
  "cache size": u32 = 10  # Set the cache size where the MAC TAs with related sequence numbers and fragment numbers will be stored.
outputs:
  "RX cache out": "RX Cache Parameters.gtype"[]  # Updated RX Cache.
  "MAC transmitter address found": bool  # Valid signal if the transmitter address with its sequence number, and fragment number is already available in the cache.
types:
  "RX Cache Parameters.gtype" = cluster{"MAC Transmitter Address": u8[6], "Sequence Number ": UFXP(12.0), "Fragment Number": UFXP(4.0)}
diagram:
  # w1: TA found in the cache
  # with the same Seq. Nr. and
  # Frag. Nr.
  for {
    w2 = each element of $"RX cache in"
    Is Equal[ComparisonMode=CompareAggregates](x=w2, y=$"received parameters") -> w1
    stop if w1
  }
  # Cache update procedure:
  # - Search in cache for a tuple (<transmitter address (TA), sequence number, fragment number> ) with the same transmitter address value as extracted from the received MPDU configuration
  # a. If a tuple with the same transmitter address (TA) value is found in the cache, the item is already in the cache, and it doesnot need to update it.
  # b- If no tuple with the same transmitter address (TA) is found in the cache
  # 	- Create a new tuple entry in the cache with the tuple parameter values extracted from the received MPDU configuration
  # 	 1- On the next free cache element if cache still has free elements or
  # 	 2- On the cache element with the oldest entry (overwrite) if cache is full
  # Cache keeps the most recent entry per transmitter address (TA)
  case (w1) {
    frame False, Default {
      Array Size(array=$"RX cache in") -> (size(s)=w5)
      To Unsigned 32 Bit Integer(number=w5) -> w6
      Is Less(x=w6, y=$"cache size") -> w7
      # Check Cache if it has free element:
      # Yes: No change
      # No: Delete the last element
      case (w7) {
        frame False, Default {
          # Delete last element
          Delete From Array(inArray=$"RX cache in", length (1)=1) -> w8
        }
        frame True {
          w8 = $"RX cache in"
        }
      }
      # Create new entry
      # Insert into the cache at the last location
      Insert Into Array(inArray=w8, new=$"received parameters") -> w3
      w4 = w1
    }
    frame True {
      # The item is already in the cache, and it doesnot need to update it.
      w3 = $"RX cache in"
      w4 = w1
    }
  }
  $"RX cache out" <- w3
  $"MAC transmitter address found" <- w4
