vi "MSDU Sequence Number Assignment.gvi"   [LabVIEW NXG 4.0.0]
# Maintains sequence number counter and cache. The cache ensures successive MAC service data units (MSDUs)/MAC protocol data units (MPDUs) for the same recipient address (RA) are not assigned the same sequence number.
inputs:
  "MAC TX request input": "MAC TX Request.gtype"  # Input MAC TX request cluster that includes the specific parameters that are required for actual processing. Those are recipient address (RA), sequence number, and valid (Boolean) signal. ·
  "MSDU data input": u8[]  # Payload to be transferred to the target MAC TX. It is not used in the processing.
  "error in": error
  "reset": bool  # To reset the internal counter and cache.
  "cache size": u32 = 10  # Set the cache size where the MAC recipient addresses with related sequence numbers will be stored.
outputs:
  "MSDU data output": u8[]  # Payload to be transferred to the target MAC TX.
  "MAC TX request output": "MAC TX Request.gtype"  # Output MAC TX request cluster that includes the sequence number of the current MAC RA.
  "error out": error
types:
  "MPDU Configuration.gtype" = cluster{"frame control": "MAC Header Frame Control.gtype", "header contents": "MAC Header Contents.gtype", "parameters": "MPDU Parameters.gtype"}
  "PHY Frame Format.gtype" = enum{"NON_HT_OFDM", "VHT", "NON_HT_DUP_OFDM"}
  "Bandwidth.gtype" = enum{"20 MHz", "40 MHz", "80 MHz"}
  "TX Vector.gtype" = cluster{"format": "PHY Frame Format.gtype", "bandwidth": "Bandwidth.gtype", "PSDU length": u32, "(A-)MPDU length": u32, "MCS": UFXP(4.0)}
  "MAC TX Request.gtype" = cluster{"MPDU configuration": "MPDU Configuration.gtype", "TX vector": "TX Vector.gtype", "valid": bool}
  T1 = cluster{"MAC Receive Address": u8[6], "Sequence Number ": UFXP(12.0)}
  "Cache Parameters.gtype" = T1[]
uses:
  NI::G Core::Error::Build Error Cluster.gvi
diagram:
  Property Node(instance in=$"MAC TX request input") -> ("MPDU configuration:header contents:recipient address"=w1, "valid"=w2, instance out=w3)
  Feedback Node(initial value=0, input=w4) -> w5
  # Feedback loop for Cache and counter
  # Each sequence number space is represented by a modulo 4096 counter.
  # IEEE Std 802.11™-2016 (Section 10.3.2.11.2)
  Feedback Node(initial value="Cache Parameters.gtype" [], input=w6) -> w7
  # The reset logic is used to reset the counter and cache.
  case ($reset) {
    frame False, Default {
      w8 = w5
      w9 = w7
    }
    frame True {
      w8 = 0
      w9 = default
    }
  }
  # General Task
  # - Maintains sequence number counter and cache
  # - Cache ensures successive MSDUs/MMPDUs for the same RA are not assigned the same sequence number
  # Task of the top Case Structure is to the assignment if the signal is valid else not.
  case (w2) {
    frame False, Default {
      w6 = w9
      w10 = w3
      w4 = w8
    }
    frame True {
      # - Check whether the recipient address (RA) of the MSDU / MMPDU is known (, i.e. if a related cache entry exists)
      # - Find the Index of RA in the cache
      # w11: Index of detected RA
      # w12: Valid Signal if RA existing in cace
      for (iteration -> i1) {
        w13 = each element of w9
        Property Node(instance in=w13) -> ("MAC Receive Address"=w14)
        Is Equal[ComparisonMode=CompareAggregates](x=w14, y=w1) -> w12
        w11 = i1 if w12
        stop if w12
      }
      # Check if the related cache entry exists:
      # Yes:  Compare incremented sequence number with previous sequence number for this RA (see cache corresponding to this RA), if equal, increment sequence number counter again. Then, Assign this sequence number to this MSDU/MMPDU.
      # NO: Update Cache corresponding to the RA with the new sequence number. If there is no entry in the cache for the current recipient address (RA) create a new entry (RA, sequence number)
      case (w12) {
        frame False, Default {
          Array Index(array=w9) -> (out0[_]=w16)
          # Create new entry
          Property Node(instance in=w16, "MAC Receive Address"=w1, "Sequence Number "=w8) -> (instance out=w17)
          Array Size(array=w9) -> (size(s)=w18)
          To Unsigned 32 Bit Integer(number=w18) -> w19
          Is Less(x=w19, y=$"cache size") -> w20
          # Check Cache if it has free element:
          # Yes: No change
          # No: Delete the last element
          case (w20) {
            frame False, Default {
              # Delete last element
              Delete From Array(inArray=w9, length (1)=1) -> w21
            }
            frame True {
              w21 = w9
            }
          }
          # Insert into the cache at location 0
          Insert Into Array(inArray=w21, index0=0, new=w17) -> w6
          w15 = w8
        }
        frame True {
          # Delete the RA from Cache to be updated
          Delete From Array(inArray=w9, index0=w11) -> (outArray=w22, deleted=w23)
          # Compare the value of sequence numbers
          Property Node(instance in=w23) -> ("Sequence Number "=w24, instance out=w25)
          Increment(x=w24) -> w26: UFXP(12.0) Wrap:ConvergentRounding
          Is Equal(x=w24, y=w8) -> w27
          # Add 1 if the Seq. Nr. in cache is equal to counter value
          Select(s=w27, t=w26, f=w8) -> w15
          # Assign this sequence number
          Property Node(instance in=w25, "Sequence Number "=w15) -> (instance out=w28)
          # Insert the new entry to cache
          Insert Into Array(inArray=w22, index0=0, new=w28) -> w6
        }
      }
      Increment(x=w15) -> w4: UFXP(12.0) Wrap:ConvergentRounding
      Property Node(instance in=w3, "MPDU configuration:header contents:sequence number"=w15) -> (instance out=w10)
    }
  }
  $"MAC TX request output" <- w10
  $"MSDU data output" <- $"MSDU data input"
  Is Equal To 0(x=$"cache size") -> w29
  case (w29) {
    frame False, Default {
      w30 = $"error in"
    }
    frame True {
      call "Build Error Cluster.gvi"(code=-1, description="Cache size is zero. It should be larger than zero.", error in=$"error in") -> (error out=w30)
    }
  }
  $"error out" <- w30
