vi "Receive MAC MSDU TX end indication ICP.gvi"   [LabVIEW NXG 4.0.0]
# Reads the interface communication protocol (ICP) header and payload from TX Feedback DMA FIFO. The ICP header is dropped and the payload is passed as MAC MSDU TX end indication output.
inputs:
  "FPGA interface": "FGPA Reference.gtype"  # Interface to the device's FPGA handle.
  "error in": error
outputs:
  "error out": error
  "MAC MSDU TX end indications": "MAC TX End Indication.gtype"[]  # Decoded MAC MSDU TX end indications.
  "FPGA interface out": "FGPA Reference.gtype"  # Output of device's FPGA handle.
  "Array": bool[]
  "Numeric": u32
  "Array Size": i16
types:
  "TX Status.gtype" = enum{"MPDU transmitted", "MPDU discarded"}
  "MAC TX End Indication.gtype" = cluster{"TX status": "TX Status.gtype", "number of transmission tries": u16, "valid": bool}
uses:
  AFW::802_11::ICP::Decode ICP.gvi
diagram:
  case ($"error in") {
    frame Error {
      w1 = $"FPGA interface"
      w2 = $"error in"
      w3 = "MAC TX End Indication.gtype"[] []
      w4 = default
      w5 = default
      w6 = default
    }
    frame No Error {
      Host Fifo Read Node[FifoName="AFW::802_11::Resources::802.11 AFW Resources.grsc::T2H TX Feedback"](error in=$"error in", number of elements=0, reference in=$"FPGA interface", timeout (ms)=0) -> (elements remaining=w7, error out=w8, reference out=w9)
      w10 = 11  # ICP TX End Indication length
      Quotient And Remainder(x=w7, y=w10) -> (floor(x/y)=w11, x-y*floor(x/y)=w12)
      To Signed 32 Bit Integer(number=w11) -> w13
      To Signed 32 Bit Integer(number=w10) -> w14
      Subtract(x=w7, y=w12) -> w5
      Host Fifo Read Node[FifoName="AFW::802_11::Resources::802.11 AFW Resources.grsc::T2H TX Feedback"](error in=w8, number of elements=w5, reference in=w9, timeout (ms)=0) -> (data=w15, error out=w16, reference out=w1)
      s1 = w15  # shift register
      s2 = w16  # shift register
      for (N = w13) {
        Split 1D Array(array=s1, index=w14) -> (first subarray=w17, second subarray=w18)
        call "Decode ICP.gvi"(array=w17) -> (decoded=w19, message=w20)
        case (w19) {
          frame False, Default {
            w21 = default
            w22 = s2
          }
          frame True {
            Array Index(array=w20) -> (out0[_]=w23, out1[_]=w24, out2[_]=w25)
            Type Cast(type="TX Status.gtype" "MPDU transmitted", x=w23) -> w26
            Join Numbers(high(x)=w25, low(x)=w24) -> w27
            Property Node(instance in="MAC TX End Indication.gtype" {all zero or empty}, "TX status"=w26, "valid"=TRUE, "number of transmission tries"=w27) -> (instance out=w21)
            w22 = s2
          }
        }
        append w21 to w3 if w19
        append w19 to w4
        next s1 = w18
        next s2 = w22
      }
      Boolean To 0 Or 1(Boolean=w4) -> (0, 1=w28)
      Add Array Elements(numeric array=w28) -> (sum=w6)
      w2 = s2
    }
  }
  $"FPGA interface out" <- w1
  $"error out" <- w2
  $Numeric <- w5
  $"Array Size" <- w6
  $Array <- w4
  $"MAC MSDU TX end indications" <- w3
