vi "Send PN Data.gvi"   [LabVIEW NXG 4.0.0]
# Queues pseudorandom number data to send the queue at the specified packet rate. The node ensures that the average packet rate is met even if it is not called in a regular time interval.
inputs:
  "PN packets per second": u32 = 1  # Number of packets to enqueue each second.
  "send queue": Queue<u8[]>  # Queue to store the packet for the target transmitter.
  "PN data": u8[]  # Packet to enqueue. The same packet is enqueued as often as requested by pseudorandom number packets per second.
  "error in": error
outputs:
  "data transfer": bool  # Indicates a pseudorandom number packet was enqueued for the transmitter.
  "error out": error
  "FIFO full": bool
  "num packets": u32
diagram:
  Tick Count() -> (timer value=w1)
  Feedback Node(input=$"PN packets per second") -> w2
  Is Not Equal(x=$"PN packets per second", y=w2) -> w3
  Feedback Node(input=w1) -> w4
  Subtract(x=w1, y=w4) -> w5
  Is Greater(x=w5, y=1000) -> w6
  Logical Or(w3, w6) -> w7
  Feedback Node(input=w8) -> w9
  case (w7) {
    frame False, Default {
      w10 = w9
    }
    frame True {
      Property Node(instance in=w9, "Start Tick Count"=w1, "Packets sent"=0) -> (instance out=w10)
    }
  }
  Property Node(instance in=w10) -> ("Start Tick Count"=w11, "Packets sent"=w12, instance out=w13)
  Subtract(x=w1, y=w11) -> w14
  Multiply($"PN packets per second", w14) -> w15
  Quotient And Remainder(x=w15, y=1000) -> (floor(x/y)=w16)
  Property Node(instance in=w13, "Packets sent"=w16) -> (instance out=w8)
  Subtract(x=w16, y=w12) -> w17
  $"num packets" <- w17
  To Signed 32 Bit Integer(number=w17) -> w18
  Is Greater Than 0(x=w18) -> w19
  $"data transfer" <- w19
  s1 = $"error in"  # shift register
  for (N = w18) {
    Enqueue Element(element=$"PN data", error in=s1, queue=$"send queue", timeout in ms=0) -> (error out=w21, queue out=w22, timed out?=w23)
    append w23 to w20
    next s1 = w21
  }
  Or Array Elements(Boolean array=w20) -> (logical OR=w24)
  $"FIFO full" <- w24
  $"error out" <- s1
