vi "Create MAC SAP RX Configuration Indication.gvi"   [LabVIEW NXG 4.0.0]
# Generates the MAC SAP RX Configuration Indication message using the MSDU RX Parameters submessage, PHY RX Parameters submessage, Additional MSDU RX Parameters submessage, and MAC RX Status submessage.
inputs:
  "instance ID": u8  # Instance ID (U8) input.
  "MSDU RX parameters": "MSDU TX Parameters.gtype"  # MSDU RX Parameters cluster.
  "PHY RX parameters": "PHY TX Parameters.gtype"  # PHY RX Parameters cluster.
  "additional MSDU RX parameters": "Additional MSDU RX Parameters.gtype"  # Additional MSDU RX Parameters cluster.
  "MAC RX status in": "RX Status.gtype"
outputs:
  "MAC SAP RX configuration indication": "MAC SAP RX Configuration Indication.gtype"  # Initialized MAC SAP RX Configuration Indication cluster.
types:
  "MAC Frame Type.gtype" = enum{"Management", "Control", "Data", "Extension"}
  "MSDU TX Parameters.gtype" = cluster{"MSDU index": u8, "frame type": "MAC Frame Type.gtype", "subtype": u8, "to DS": bool, "from DS": bool, "power management": u8, "more data": u8, "protected frame": u8, "HTC / order": u8, "source address": u8[6], "destination address": u8[6], "basic service set identifier": u8[6], "recipient address": u8[6], "transmitter address": u8[6], "MSDU length": u16}
  "PHY Frame Format.gtype" = enum{"NON_HT_OFDM", "VHT", "NON_HT_DUP_OFDM"}
  "Bandwidth.gtype" = enum{"20 MHz", "40 MHz", "80 MHz"}
  "PHY TX Parameters.gtype" = cluster{"MSDU index": u8, "format": "PHY Frame Format.gtype", "bandwidth": "Bandwidth.gtype", "MCS": u8}
  "General Message Header.gtype" = cluster{"message type ID": u16, "reference ID": u16, "instance ID": u8}
  "SAP Sub Header.gtype" = cluster{"timestamp": u32, "number of submessages": u8, "confirmation mode": bool}
  "Additional MSDU RX Parameters.gtype" = cluster{"retry flag": bool}
  "A-MPDU De-Aggregation Status.gtype" = enum{"A-MPDU De-Aggregation not executed", "A-MPDU De-Aggregation successful", "PSDU length mismatch", "VHT delimiter CRC fail", "VHT delimiter signature comparison fail", "EOF field check fail", "MPDU length mismatch"}
  "FCS Check Status.gtype" = enum{"FCS check not executed", "FCS check pass", "FCS check fail"}
  "MPDU Length Check Status.gtype" = enum{"MPDU length check not executed", "MPDU length check pass", "MPDU length check not standard compliant", "MPDU length check exceeds implemented buffer"}
  "MPDU Disassembly Status.gtype" = enum{"Disassembly not executed", "Disassembly successful", "Disassembly done partially", "Disassembly not successful"}
  "MPDU Filtering Status.gtype" = enum{"MPDU Filtering not executed", "MPDU valid for further processing", "MPDU pass through for sniffer mode"}
  "MSDU Defragmentation Status.gtype" = enum{"Defragmentation not executed", "Unfragmented MSDU successfully received", "Unsupported MSDU fragment received"}
  "MSDU Duplicate Detection Status.gtype" = enum{"Duplicate detection not executed", "Duplicate detection successfully passed", "Duplicate detected"}
  "RX Status.gtype" = cluster{"A-MPDU de-aggregation status": "A-MPDU De-Aggregation Status.gtype", "MPDU FCS check status": "FCS Check Status.gtype", "MPDU length check status": "MPDU Length Check Status.gtype", "MPDU disassembly status": "MPDU Disassembly Status.gtype", "MPDU Filtering Status": "MPDU Filtering Status.gtype", "MSDU Defragmentation Status": "MSDU Defragmentation Status.gtype", "MSDU Duplicate Detection Status": "MSDU Duplicate Detection Status.gtype"}
  "MAC SAP RX Configuration Indication.gtype" = cluster{"General Message Header": "General Message Header.gtype", "SAP Sub Header": "SAP Sub Header.gtype", "MSDU RX Parameters": "MSDU TX Parameters.gtype", "PHY RX Parameters": "PHY TX Parameters.gtype", "Additional MSDU RX Parameters": "Additional MSDU RX Parameters.gtype", "MAC RX Status": "RX Status.gtype"}
uses:
  AFW::802_11::Transport::Create Timestamp.gvi
diagram:
  call "Create Timestamp.gvi"() -> (timestamp=w1)
  Feedback Node(initial value=0, input=w2) -> w3
  w4 = "MAC SAP RX Configuration Indication.gtype" {all zero or empty}
  Property Node(instance in=w4, "General Message Header:message type ID"=0x5081, "General Message Header:instance ID"=$"instance ID", "General Message Header:reference ID"=w3, "SAP Sub Header:timestamp"=w1, "SAP Sub Header:number of submessages"=4, "SAP Sub Header:confirmation mode"=FALSE, "MSDU RX Parameters"=$"MSDU RX parameters", "PHY RX Parameters"=$"PHY RX parameters", "Additional MSDU RX Parameters"=$"additional MSDU RX parameters", "MAC RX Status"=$"MAC RX status in") -> (instance out=w5)
  $"MAC SAP RX configuration indication" <- w5
  Increment(x=w3) -> w2
