vi "Create MAC SAP TX Confirmation.gvi"   [LabVIEW NXG 4.0.0]
# Creates the MAC SAP TX Confirmation cluster using the given parameters.
inputs:
  "instance ID": u8  # Instance identifier.
  "reference ID": u16  # Filled with reference ID extracted from the incoming request for which the confirm is generated.
  "confirmation status": "Confirmation States.gtype" = "Success"  # Enum includes the confirmation status.
outputs:
  "MAC SAP TX confirmation": "MAC SAP TX Confirmation.gtype"  # Created MAC SAP TX Confirmation cluster using the given parameters. It checks also the confirmation status.
types:
  "Confirmation States.gtype" = enum{"Success", "Unknown Message", "Message not Supported", "Unknown Parameter (Set)", "Missing Parameter (Set)", "Parameter (Set) Repetition", "Range Violation", "State Violation", "Timeout", "Config Payload Mismatch", "Length Mismatch", "Input Buffer Full", "Internal Error", "Instance ID Mismatch"}
  "General Message Header.gtype" = cluster{"message type ID": u16, "reference ID": u16, "instance ID": u8}
  "SAP Sub Header.gtype" = cluster{"timestamp": u32, "number of submessages": u8, "confirmation mode": bool}
  "MAC SAP TX Confirmation.gtype" = cluster{"General Message Header": "General Message Header.gtype", "SAP Sub Header": "SAP Sub Header.gtype", "Confirmation status": "Confirmation States.gtype"}
uses:
  AFW::802_11::Transport::Create Timestamp.gvi
diagram:
  w1 = 1  # number of submessages
  w2 = FALSE  # confirmation mode
  # Number of submessages is 1, only one parameter set is defined for this message, which is mandatory
  # Confirm mode is set to zero since it is used only in requests
  w3 = 0x5201  # message type ID
  call "Create Timestamp.gvi"() -> (timestamp=w4)
  Property Node(instance in="MAC SAP TX Confirmation.gtype" {all zero or empty}, "General Message Header:message type ID"=w3, "General Message Header:reference ID"=$"reference ID", "General Message Header:instance ID"=$"instance ID", "SAP Sub Header:timestamp"=w4, "SAP Sub Header:number of submessages"=w1, "SAP Sub Header:confirmation mode"=w2, "Confirmation status"=$"confirmation status") -> (instance out=w5)
  $"MAC SAP TX confirmation" <- w5
