vi "Create MAC SAP TX Status Indication.gvi"   [LabVIEW NXG 4.0.0]
# Writes the given values into the MAC SAP TX Status Indication cluster.
inputs:
  "instance ID": u8  # Instance ID (U8) input.
  "MSDU transmission status": bool  # MSDU Transmission Status input.
  "reference ID": u16  # Reference ID of the corresponding MAC SAP TX Configuration request.
outputs:
  "MAC SAP TX status indication": "MAC SAP TX Status Indication.gtype"  # Generated MAC SAP TX Status Indication cluster.
types:
  "General Message Header.gtype" = cluster{"message type ID": u16, "reference ID": u16, "instance ID": u8}
  "SAP Sub Header.gtype" = cluster{"timestamp": u32, "number of submessages": u8, "confirmation mode": bool}
  "MAC SAP TX Status Indication.gtype" = cluster{"General Message Header": "General Message Header.gtype", "SAP Sub Header": "SAP Sub Header.gtype", "MSDU transmission status": bool}
uses:
  AFW::802_11::Transport::Create Timestamp.gvi
diagram:
  call "Create Timestamp.gvi"() -> (timestamp=w1)
  Property Node(instance in="MAC SAP TX Status Indication.gtype" {all zero or empty}, "General Message Header:message type ID"=0x5001, "General Message Header:instance ID"=$"instance ID", "General Message Header:reference ID"=$"reference ID", "SAP Sub Header:timestamp"=w1, "SAP Sub Header:number of submessages"=1, "SAP Sub Header:confirmation mode"=FALSE, "MSDU transmission status"=$"MSDU transmission status") -> (instance out=w2)
  $"MAC SAP TX status indication" <- w2
