vi "Create Timestamp.gvi"   [LabVIEW NXG 4.0.0]
# Simply creates a 0.1us tick count (wrapping counter).
outputs:
  "timestamp": u32  # Timestamp (U32) output.
diagram:
  Tick Count[Units=Microseconds]() -> (timer value=w1)
  Multiply(w1, 10) -> w2
  $timestamp <- w2
