vi "Decode General Message Header.gvi"   [LabVIEW NXG 4.0.0]
# Decodes the general message header from the given 1D array of U8 (byte).
inputs:
  "received general message header": u8[]  # General message header in 1D array of U8.
outputs:
  "decoded message body length": u32  # Decoded message body length.
  "decoded general message header": "General Message Header.gtype"  # Decoded General message header.
types:
  "General Message Header.gtype" = cluster{"message type ID": u16, "reference ID": u16, "instance ID": u8}
diagram:
  Split 1D Array(array=$"received general message header", index=5) -> (first subarray=w1, second subarray=w2)
  Array Index(array=w1) -> (out0[_]=w3, out1[_]=w4, out2[_]=w5, out3[_]=w6, out4[_]=w7)
  Join Numbers(high(x)=w3, low(x)=w4) -> w8
  Join Numbers(high(x)=w5, low(x)=w6) -> w9
  Property Node(instance in="General Message Header.gtype" {all zero or empty}, "message type ID"=w8, "reference ID"=w9, "instance ID"=w7) -> (instance out=w10)
  $"decoded general message header" <- w10
  Array Index(array=w2) -> (out0[_]=w11, out1[_]=w12, out2[_]=w13)
  Join Numbers(high(x)=0, low(x)=w11) -> w14
  Join Numbers(high(x)=w12, low(x)=w13) -> w15
  Join Numbers(high(x)=w14, low(x)=w15) -> w16
  $"decoded message body length" <- w16
