vi "Decode MAC SAP RX Payload Indication.gvi"   [LabVIEW NXG 4.0.0]
# Decodes the 1D array (in bytes) of received MAC SAP RX Payload Indication to the corresponding cluster. It also checks if the General Message, SAP Sub and Sub-message Header are correct.
inputs:
  "received MAC SAP RX payload indication": u8[]  # Received MAC SAP RX Payload Indication in 1D array of U8.
outputs:
  "error out": error
  "MAC SAP RX payload indication": "MAC SAP RX Payload Indication.gtype"  # Decoded MAC SAP RX Payload Indication cluster.
types:
  "General Message Header.gtype" = cluster{"message type ID": u16, "reference ID": u16, "instance ID": u8}
  "SAP Sub Header.gtype" = cluster{"timestamp": u32, "number of submessages": u8, "confirmation mode": bool}
  "MSDU TX Payload.gtype" = cluster{"MSDU index": u8, "MSDU length": u16, "MSDU data": u8[]}
  "MAC SAP RX Payload Indication.gtype" = cluster{"General Message Header": "General Message Header.gtype", "SAP Sub Header": "SAP Sub Header.gtype", "MSDU RX Payload": "MSDU TX Payload.gtype"}
uses:
  AFW::802_11::Transport::Check Sub Message Header.gvi
  AFW::802_11::Transport::Decode MSDU TX Payload.gvi
  NI::G Core::Error::Build Error Cluster.gvi
  AFW::802_11::Transport::Decode SAP Sub Header.gvi
  AFW::802_11::Transport::Decode General Message Header.gvi
  AFW::802_11::Transport::Check SAP Sub Header.gvi
  AFW::802_11::Transport::Check General Message Header.gvi
diagram:
  Split 1D Array(array=$"received MAC SAP RX payload indication", index=8) -> (first subarray=w1, second subarray=w2)
  Split 1D Array(array=w2, index=8) -> (first subarray=w3, second subarray=w4)
  Split 1D Array(array=w4, index=4) -> (first subarray=w5, second subarray=w6)
  call "Check Sub Message Header.gvi"(parameter submessage header=w5, maximal submessage type=0, supported parameter set body length=[{"parameter set body length"=4, "minimal size"=TRUE}]) -> (error out=w7, submessage type=w8, parameter set body length=w9)
  To Signed 32 Bit Integer(number=w9) -> w10
  Split 1D Array(array=w6, index=w10) -> (first subarray=w11)
  # w12: reserved (U16)
  case (w8) {
    frame 0 {
      call "Decode MSDU TX Payload.gvi"(received MSDU TX payload=w11) -> (decoded MSDU TX payload=w14)
      w13 = default
    }
    frame 1, Default {
      Type Cast(type=u8 0, x="Unknown Parameter (Set)") -> w15
      To Signed 32 Bit Integer(number=w15) -> w16
      call "Build Error Cluster.gvi"(code=w16, description="invalid parameter set") -> (error out=w13)
      w14 = default
    }
  }
  call "Decode SAP Sub Header.gvi"(received SAP sub header=w3) -> (decoded SAP sub header=w17, reserved=w12)
  call "Decode General Message Header.gvi"(received general message header=w1) -> (decoded general message header=w18, decoded message body length=w19)
  # w19: message body length (U24)
  Property Node(instance in=w18) -> ("message type ID"=w20, instance out=w21)
  Property Node(instance in="MAC SAP RX Payload Indication.gtype" {all zero or empty}, "General Message Header"=w21, "SAP Sub Header"=w17, "MSDU RX Payload"=w14) -> (instance out=w22)
  $"MAC SAP RX payload indication" <- w22
  call "Check SAP Sub Header.gvi"(received SAP sub header=w17, expected number of submessages=1, received reserved field=w12, received message type ID=w20) -> (error out=w23)
  call "Check General Message Header.gvi"(received general message header=w21, expected message ID=0x5082, received message body length=w19, expected message body length=24, check minimal size=TRUE) -> (error out=w24)
  Merge Errors(w24, w23) -> (error out=w25)
  Merge Errors(w25, w7, w13) -> (error out=w26)
  $"error out" <- w26
