vi "Decode MAC SAP TX Configuration Request.gvi"   [LabVIEW NXG 4.0.0]
# Decodes the given 1D array of MAC SAP TX Configuration Request message. An error message is reported if the value of one decoded parameter is not expected.
inputs:
  "received MAC SAP TX configuration request": u8[]  # MAC SAP TX Configuration Request cluster in 1D array of U8.
  "error in": error
  "device bandwidth": u16 = 2
outputs:
  "decoded MAC SAP TX configuration request": "MAC SAP TX Configuration Request.gtype"  # Decoded MAC SAP TX CONFIG REQ message.
  "error out": error
types:
  "General Message Header.gtype" = cluster{"message type ID": u16, "reference ID": u16, "instance ID": u8}
  "SAP Sub Header.gtype" = cluster{"timestamp": u32, "number of submessages": u8, "confirmation mode": bool}
  "MAC Frame Type.gtype" = enum{"Management", "Control", "Data", "Extension"}
  "MSDU TX Parameters.gtype" = cluster{"MSDU index": u8, "frame type": "MAC Frame Type.gtype", "subtype": u8, "to DS": bool, "from DS": bool, "power management": u8, "more data": u8, "protected frame": u8, "HTC / order": u8, "source address": u8[6], "destination address": u8[6], "basic service set identifier": u8[6], "recipient address": u8[6], "transmitter address": u8[6], "MSDU length": u16}
  "PHY Frame Format.gtype" = enum{"NON_HT_OFDM", "VHT", "NON_HT_DUP_OFDM"}
  "Bandwidth.gtype" = enum{"20 MHz", "40 MHz", "80 MHz"}
  "PHY TX Parameters.gtype" = cluster{"MSDU index": u8, "format": "PHY Frame Format.gtype", "bandwidth": "Bandwidth.gtype", "MCS": u8}
  "MAC SAP TX Configuration Request.gtype" = cluster{"General Message Header": "General Message Header.gtype", "SAP Sub Header": "SAP Sub Header.gtype", "MSDU TX Parameters": "MSDU TX Parameters.gtype", "PHY TX Parameters": "PHY TX Parameters.gtype"}
uses:
  AFW::802_11::Transport::Decode General Message Header.gvi
  AFW::802_11::Transport::Decode SAP Sub Header.gvi
  AFW::802_11::Transport::Check General Message Header.gvi
  AFW::802_11::Transport::Check SAP Sub Header.gvi
  AFW::802_11::Transport::Check Sub Message Header.gvi
  AFW::802_11::Transport::Decode MSDU TX Parameters.gvi
  AFW::802_11::Transport::Decode PHY TX Parameters.gvi
  NI::G Core::Error::Build Error Cluster.gvi
  AFW::802_11::MAC Middle SAP::Check Duplication or Missing Parameter Set.gvi
diagram:
  # SAP Sub-headerheader length
  # General Message header length
  Split 1D Array(array=$"received MAC SAP TX configuration request", index=8) -> (first subarray=w1, second subarray=w2)
  Split 1D Array(array=w2, index=8) -> (first subarray=w3, second subarray=w4)
  # parameter set body length of MSDU TX Parameters = 41
  # parameter set body length of MSDU TX Parameters = 4
  w5 = [{"parameter set body length"=41, "minimal size"=FALSE}, {"parameter set body length"=4, "minimal size"=FALSE}]
  call "Decode General Message Header.gvi"(received general message header=w1) -> (decoded general message header=w6, decoded message body length=w7)
  Property Node(instance in=w6) -> ("message type ID"=w8, instance out=w9)
  call "Decode SAP Sub Header.gvi"(received SAP sub header=w3) -> (decoded SAP sub header=w10, reserved=w11)
  Property Node(instance in="MAC SAP TX Configuration Request.gtype" {all zero or empty}, "General Message Header"=w9, "SAP Sub Header"=w10) -> (instance out=w12)
  w13 = 0x5101  # message type ID
  w14 = 69  # given decoded message body length
  call "Check General Message Header.gvi"(received general message header=w9, expected message ID=w13, received message body length=w7, expected message body length=w14) -> (error out=w15)
  w16 = 2  # number of sub-messages
  call "Check SAP Sub Header.gvi"(received SAP sub header=w10, expected number of submessages=w16, received reserved field=w11, received message type ID=w8) -> (error out=w17)
  Merge Errors($"error in", w15, w17) -> (error out=w18)
  # Number of Sub-messages
  Property Node(instance in=w10) -> ("number of submessages"=w19)
  To Signed 32 Bit Integer(number=w19) -> w20
  # A case structure has been added in the for loop to report the error order correctly in case of missing parameter set
  s1 = w4  # shift register
  s2 = w12  # shift register
  s3 = w18  # shift register
  for (N = w20) {
    Array Size(array=s1) -> (size(s)=w22)
    Is Greater Or Equal(x=w22, y=4) -> w23
    case (w23) {
      frame False, Default {
        w24 = s1
        w25 = default
        w26 = s2
        w27 = s3
      }
      frame True {
        Split 1D Array(array=s1, index=4) -> (first subarray=w28, second subarray=w29)
        # Sub-message header length
        w30 = 1  # maximal sub-message type
        call "Check Sub Message Header.gvi"(parameter submessage header=w28, maximal submessage type=w30, supported parameter set body length=w5) -> (error out=w31, submessage type=w25, parameter set body length=w32)
        Merge Errors(s3, w31) -> (error out=w33)
        To Signed 32 Bit Integer(number=w32) -> w34
        Split 1D Array(array=w29, index=w34) -> (first subarray=w35, second subarray=w24)
        case (w25) {
          frame 0 {
            call "Decode MSDU TX Parameters.gvi"(received MSDU TX parameters=w35) -> (decoded MSDU TX parameters=w36, error out=w37)
            Property Node(instance in=s2, "MSDU TX Parameters"=w36) -> (instance out=w26)
            Merge Errors(w33, w37) -> (error out=w27)
          }
          frame 1 {
            call "Decode PHY TX Parameters.gvi"(received PHY TX parameters=w35, device bandwidth=$"device bandwidth") -> (decoded PHY TX parameters=w38, error out=w39)
            Property Node(instance in=s2, "PHY TX Parameters"=w38) -> (instance out=w26)
            Merge Errors(w33, w39) -> (error out=w27)
          }
          frame 2, Default {
            Type Cast(type=u8 0, x="Unknown Parameter (Set)") -> w40
            To Signed 32 Bit Integer(number=w40) -> w41
            call "Build Error Cluster.gvi"(code=w41, description="invalid parameter set") -> (error out=w42)
            Merge Errors(w33, w42) -> (error out=w27)
            w26 = s2
          }
        }
      }
    }
    append w25 to w21 if w23
    next s1 = w24
    next s2 = w26
    next s3 = w27
  }
  $"decoded MAC SAP TX configuration request" <- s2
  w43 = 2  # number of sub-messages
  Build Array(w19, w43) -> w44
  Array Max And Min(array=w44) -> (max value=w45)
  call "Check Duplication or Missing Parameter Set.gvi"(decoded submessages indices=w21, number of submessages=w45) -> (error out=w46)
  Merge Errors(s3, w46) -> (error out=w47)
  $"error out" <- w47
