vi "Decode MAC SAP TX Confirmation.gvi"   [LabVIEW NXG 4.0.0]
# Decodes the given 1D array of MAC SAP TX Confirmation message. An error message is reported if the value of one decoded parameter is not expected.
inputs:
  "received MAC SAP TX confirmation": u8[]  # Received MAC SAP TX Confirmation cluster in 1D array of U8.
outputs:
  "decoded MAC SAP TX confirmation": "MAC SAP TX Confirmation.gtype"  # Decoded MAC SAP TX Confirmation cluster.
  "error out": error
types:
  "General Message Header.gtype" = cluster{"message type ID": u16, "reference ID": u16, "instance ID": u8}
  "SAP Sub Header.gtype" = cluster{"timestamp": u32, "number of submessages": u8, "confirmation mode": bool}
  "Confirmation States.gtype" = enum{"Success", "Unknown Message", "Message not Supported", "Unknown Parameter (Set)", "Missing Parameter (Set)", "Parameter (Set) Repetition", "Range Violation", "State Violation", "Timeout", "Config Payload Mismatch", "Length Mismatch", "Input Buffer Full", "Internal Error", "Instance ID Mismatch"}
  "MAC SAP TX Confirmation.gtype" = cluster{"General Message Header": "General Message Header.gtype", "SAP Sub Header": "SAP Sub Header.gtype", "Confirmation status": "Confirmation States.gtype"}
uses:
  AFW::802_11::Transport::Decode SAP Sub Header.gvi
  AFW::802_11::Transport::Decode General Message Header.gvi
  AFW::802_11::Transport::Check Sub Message Header.gvi
  AFW::802_11::Transport::Check General Message Header.gvi
  AFW::802_11::Transport::Check SAP Sub Header.gvi
diagram:
  # General Message Header length
  Split 1D Array(array=$"received MAC SAP TX confirmation", index=8) -> (first subarray=w1, second subarray=w2)
  # SAP Sub Header length
  Split 1D Array(array=w2, index=8) -> (first subarray=w3, second subarray=w4)
  call "Decode SAP Sub Header.gvi"(received SAP sub header=w3) -> (decoded SAP sub header=w5, reserved=w6)
  call "Decode General Message Header.gvi"(received general message header=w1) -> (decoded general message header=w7, decoded message body length=w8)
  Property Node(instance in=w7) -> ("message type ID"=w9, instance out=w10)
  Property Node(instance in="MAC SAP TX Confirmation.gtype" {all zero or empty}, "General Message Header"=w10, "SAP Sub Header"=w5) -> (instance out=w11)
  # Sub-message header length
  Split 1D Array(array=w4, index=4) -> (first subarray=w12, second subarray=w13)
  Array Index(array=w13) -> (out0[_]=w14)
  To Unsigned 8 Bit Integer(number=w14) -> w15
  Type Cast(type="Confirmation States.gtype" "Success", x=w15) -> w16
  Property Node(instance in=w11, "Confirmation status"=w16) -> (instance out=w17)
  $"decoded MAC SAP TX confirmation" <- w17
  # parameter set body length of MSDU TX Payload = 4
  call "Check Sub Message Header.gvi"(parameter submessage header=w12, maximal submessage type=0, supported parameter set body length=[{"parameter set body length"=1, "minimal size"=FALSE}]) -> (error out=w18)
  # message body length in bytes
  # = MAC confirmation(1) + 4 + 8 + 8
  w19 = 0x5201  # message type ID
  w20 = 21  # given message body length
  call "Check General Message Header.gvi"(received general message header=w10, expected message ID=w19, received message body length=w8, expected message body length=w20) -> (error out=w21)
  w22 = 1  # number of sub-messages
  call "Check SAP Sub Header.gvi"(received SAP sub header=w5, expected number of submessages=w22, received reserved field=w6, received message type ID=w9) -> (error out=w23)
  Merge Errors(w21, w23) -> (error out=w24)
  Merge Errors(w24, w18) -> (error out=w25)
  $"error out" <- w25
