vi "Decode MAC SAP TX Payload Request.gvi"   [LabVIEW NXG 4.0.0]
# Decodes the given 1D array of MAC SAP TX Payload Request message. An error message is reported if the value of one decoded parameter is not expected.
inputs:
  "received MAC SAP TX payload request": u8[]  # Received MAC SAP TX Payload Request cluster in 1D array of U8.
  "error in": error
outputs:
  "decoded MAC SAP TX payload request": "MAC SAP TX Payload Request.gtype"  # Decoded MAC SAP TX Payload Request message.
  "error out": error
types:
  "General Message Header.gtype" = cluster{"message type ID": u16, "reference ID": u16, "instance ID": u8}
  "SAP Sub Header.gtype" = cluster{"timestamp": u32, "number of submessages": u8, "confirmation mode": bool}
  "MSDU TX Payload.gtype" = cluster{"MSDU index": u8, "MSDU length": u16, "MSDU data": u8[]}
  "MAC SAP TX Payload Request.gtype" = cluster{"General Message Header": "General Message Header.gtype", "SAP Sub Header": "SAP Sub Header.gtype", "MSDU TX Payload": "MSDU TX Payload.gtype"}
uses:
  AFW::802_11::Transport::Decode SAP Sub Header.gvi
  AFW::802_11::Transport::Decode General Message Header.gvi
  AFW::802_11::Transport::Check General Message Header.gvi
  AFW::802_11::Transport::Check SAP Sub Header.gvi
  AFW::802_11::Transport::Check Sub Message Header.gvi
  NI::G Core::Error::Build Error Cluster.gvi
  AFW::802_11::Transport::Decode MSDU TX Payload.gvi
  AFW::802_11::MAC Middle SAP::Check Duplication or Missing Parameter Set.gvi
diagram:
  # SAP Sub Header length
  # General Message Header length
  Split 1D Array(array=$"received MAC SAP TX payload request", index=8) -> (first subarray=w1, second subarray=w2)
  Split 1D Array(array=w2, index=8) -> (first subarray=w3, second subarray=w4)
  # minimal parameter set body length of MSDU TX Payload = 4
  call "Decode SAP Sub Header.gvi"(received SAP sub header=w3) -> (decoded SAP sub header=w5, reserved=w6)
  call "Decode General Message Header.gvi"(received general message header=w1) -> (decoded general message header=w7, decoded message body length=w8)
  Property Node(instance in=w7) -> ("message type ID"=w9, instance out=w10)
  Property Node(instance in="MAC SAP TX Payload Request.gtype" {all zero or empty}, "General Message Header"=w10, "SAP Sub Header"=w5) -> (instance out=w11)
  # message body length in bytes = MSDU TX payload (MSDU length +4) + 4 + 8 + 8
  w12 = 0x5102  # message type ID
  w13 = 24  # minimum decoded message body length
  call "Check General Message Header.gvi"(received general message header=w10, expected message ID=w12, received message body length=w8, expected message body length=w13, check minimal size=TRUE) -> (error out=w14)
  w15 = 1  # number of sub-messages
  call "Check SAP Sub Header.gvi"(received SAP sub header=w5, expected number of submessages=w15, received reserved field=w6, received message type ID=w9) -> (error out=w16)
  Merge Errors(w14, w16) -> (error out=w17)
  Merge Errors($"error in", w17) -> (error out=w18)
  # Number of Sub-messages
  Property Node(instance in=w5) -> ("number of submessages"=w19)
  To Signed 32 Bit Integer(number=w19) -> w20
  s1 = w4  # shift register
  s2 = w11  # shift register
  s3 = w18  # shift register
  for (N = w20) {
    Array Size(array=s1) -> (size(s)=w22)
    Is Greater Or Equal(x=w22, y=4) -> w23
    case (w23) {
      frame False, Default {
        w24 = s2
        w25 = s3
        w26 = default
        w27 = s1
      }
      frame True {
        Split 1D Array(array=s1, index=4) -> (first subarray=w28, second subarray=w29)
        w30 = 0  # maximal sub-message type
        call "Check Sub Message Header.gvi"(parameter submessage header=w28, maximal submessage type=w30, supported parameter set body length=[{"parameter set body length"=4, "minimal size"=TRUE}]) -> (error out=w31, submessage type=w26, parameter set body length=w32)
        Merge Errors(s3, w31) -> (error out=w33)
        To Signed 32 Bit Integer(number=w32) -> w34
        Split 1D Array(array=w29, index=w34) -> (first subarray=w35, second subarray=w27)
        case (w26) {
          frame 1, Default {
            Type Cast(type=u8 0, x="Unknown Parameter (Set)") -> w36
            To Signed 32 Bit Integer(number=w36) -> w37
            call "Build Error Cluster.gvi"(code=w37, description="invalid parameter set") -> (error out=w38)
            Merge Errors(w33, w38) -> (error out=w25)
            w24 = s2
          }
          frame 0 {
            call "Decode MSDU TX Payload.gvi"(received MSDU TX payload=w35) -> (decoded MSDU TX payload=w39, error out=w40)
            Property Node(instance in=s2, "MSDU TX Payload"=w39) -> (instance out=w24)
            Merge Errors(w33, w40) -> (error out=w25)
          }
        }
      }
    }
    append w26 to w21 if w23
    next s1 = w27
    next s2 = w24
    next s3 = w25
  }
  $"decoded MAC SAP TX payload request" <- s2
  # max number of submessages
  w41 = 1  # number of sub-messages
  Build Array(w19, w41) -> w42
  Array Max And Min(array=w42) -> (max value=w43)
  call "Check Duplication or Missing Parameter Set.gvi"(decoded submessages indices=w21, number of submessages=w43) -> (error out=w44)
  Merge Errors(s3, w44) -> (error out=w45)
  $"error out" <- w45
