vi "Decode MAC SAP TX Status Indication.gvi"   [LabVIEW NXG 4.0.0]
# Decodes the 1D array (in bytes) of received MAC SAP TX Status Indication to the corresponding cluster. It also checks if the General Message, SAP Sub and Sub-message Header are correct.
inputs:
  "MAC SAP TX status indication in byte": u8[]  # Received MAC SAP TX Status Indication in 1D array of U8.
outputs:
  "MAC SAP TX status indication": "MAC SAP TX Status Indication.gtype"  # Decode MAC SAP TX Status Indication cluster.
  "error out": error
types:
  "General Message Header.gtype" = cluster{"message type ID": u16, "reference ID": u16, "instance ID": u8}
  "SAP Sub Header.gtype" = cluster{"timestamp": u32, "number of submessages": u8, "confirmation mode": bool}
  "MAC SAP TX Status Indication.gtype" = cluster{"General Message Header": "General Message Header.gtype", "SAP Sub Header": "SAP Sub Header.gtype", "MSDU transmission status": bool}
uses:
  AFW::802_11::Transport::Decode SAP Sub Header.gvi
  AFW::802_11::Transport::Decode General Message Header.gvi
  AFW::802_11::Transport::Check Sub Message Header.gvi
  NI::G Core::Error::Build Error Cluster.gvi
  AFW::802_11::Transport::Check General Message Header.gvi
  AFW::802_11::Transport::Check SAP Sub Header.gvi
diagram:
  Split 1D Array(array=$"MAC SAP TX status indication in byte", index=8) -> (first subarray=w1, second subarray=w2)
  Split 1D Array(array=w2, index=8) -> (first subarray=w3, second subarray=w4)
  call "Decode SAP Sub Header.gvi"(received SAP sub header=w3) -> (decoded SAP sub header=w5, reserved=w6)
  call "Decode General Message Header.gvi"(received general message header=w1) -> (decoded general message header=w7, decoded message body length=w8)
  # w8: message body length (U24)
  Property Node(instance in=w7) -> ("message type ID"=w9, instance out=w10)
  # w6: reserved (U16)
  Split 1D Array(array=w4, index=4) -> (first subarray=w11, second subarray=w12)
  Array Index(array=w12) -> (out0[_]=w13)
  case (w13) {
    frame 0, Default {
      w14 = FALSE
    }
    frame 1 {
      w14 = TRUE
    }
  }
  Property Node(instance in="MAC SAP TX Status Indication.gtype" {all zero or empty}, "General Message Header"=w10, "SAP Sub Header"=w5, "MSDU transmission status"=w14) -> (instance out=w15)
  $"MAC SAP TX status indication" <- w15
  call "Check Sub Message Header.gvi"(parameter submessage header=w11, maximal submessage type=0, supported parameter set body length=[{"parameter set body length"=1, "minimal size"=FALSE}]) -> (error out=w16)
  Is Less Or Equal(x=w13, y=1) -> w17
  case (w17) {
    frame True {
      w18 = default
    }
    frame False {
      Format Into String(formatString="MSDU transmission status {0,1} out of range:\nreceived: %d", w13) -> w19
      Type Cast(type=u8 0, x="Range Violation") -> w20
      To Signed 32 Bit Integer(number=w20) -> w21
      call "Build Error Cluster.gvi"(code=w21, description=w19) -> (error out=w18)
    }
  }
  call "Check General Message Header.gvi"(received general message header=w10, expected message ID=0x5001, received message body length=w8, expected message body length=21) -> (error out=w22)
  call "Check SAP Sub Header.gvi"(received SAP sub header=w5, expected number of submessages=1, received reserved field=w6, received message type ID=w9) -> (error out=w23)
  Merge Errors(w22, w23, w16, w18) -> (error out=w24)
  $"error out" <- w24
