vi "Decode RX Status.gvi"   [LabVIEW NXG 4.0.0]
# Decodes the 1D array (in bytes) of received RX Status to the corresponding cluster and also checks if the decoded values are out of range.
inputs:
  "encoded RX status": u8[]  # RX Status in 1D array of U8.
outputs:
  "decoded RX status": "RX Status.gtype"  # Decoded RX Status cluster.
  "error out": error
types:
  "A-MPDU De-Aggregation Status.gtype" = enum{"A-MPDU De-Aggregation not executed", "A-MPDU De-Aggregation successful", "PSDU length mismatch", "VHT delimiter CRC fail", "VHT delimiter signature comparison fail", "EOF field check fail", "MPDU length mismatch"}
  "FCS Check Status.gtype" = enum{"FCS check not executed", "FCS check pass", "FCS check fail"}
  "MPDU Length Check Status.gtype" = enum{"MPDU length check not executed", "MPDU length check pass", "MPDU length check not standard compliant", "MPDU length check exceeds implemented buffer"}
  "MPDU Disassembly Status.gtype" = enum{"Disassembly not executed", "Disassembly successful", "Disassembly done partially", "Disassembly not successful"}
  "MPDU Filtering Status.gtype" = enum{"MPDU Filtering not executed", "MPDU valid for further processing", "MPDU pass through for sniffer mode"}
  "MSDU Defragmentation Status.gtype" = enum{"Defragmentation not executed", "Unfragmented MSDU successfully received", "Unsupported MSDU fragment received"}
  "MSDU Duplicate Detection Status.gtype" = enum{"Duplicate detection not executed", "Duplicate detection successfully passed", "Duplicate detected"}
  "RX Status.gtype" = cluster{"A-MPDU de-aggregation status": "A-MPDU De-Aggregation Status.gtype", "MPDU FCS check status": "FCS Check Status.gtype", "MPDU length check status": "MPDU Length Check Status.gtype", "MPDU disassembly status": "MPDU Disassembly Status.gtype", "MPDU Filtering Status": "MPDU Filtering Status.gtype", "MSDU Defragmentation Status": "MSDU Defragmentation Status.gtype", "MSDU Duplicate Detection Status": "MSDU Duplicate Detection Status.gtype"}
uses:
  NI::G Core::Error::Build Error Cluster.gvi
diagram:
  Array Index(array=$"encoded RX status") -> (out0[_]=w1, out1[_]=w2, out2[_]=w3, out3[_]=w4, out4[_]=w5, out5[_]=w6, out6[_]=w7)
  Is Less Or Equal(x=w7, y=2) -> w8
  case (w8) {
    frame True {
      w9 = default
    }
    frame False {
      w10 = "MPDU Duplicate Detection status {0...2} out of range:\nreceived value: %d"
      Format Into String(initString=w10, w7) -> w11
      call "Build Error Cluster.gvi"(code=-1, description=w11) -> (error out=w9)
    }
  }
  Is Less Or Equal(x=w6, y=2) -> w12
  case (w12) {
    frame True {
      w13 = default
    }
    frame False {
      w14 = "MPDU Defragmentation status {0...2} out of range:\nreceived value: %d"
      Format Into String(initString=w14, w6) -> w15
      call "Build Error Cluster.gvi"(code=-1, description=w15) -> (error out=w13)
    }
  }
  Is Less Or Equal(x=w5, y=2) -> w16
  case (w16) {
    frame True {
      w17 = default
    }
    frame False {
      w18 = "MPDU Filtering status {0...2} out of range:\nreceived value: %d"
      Format Into String(initString=w18, w5) -> w19
      call "Build Error Cluster.gvi"(code=-1, description=w19) -> (error out=w17)
    }
  }
  Is Less Or Equal(x=w4, y=3) -> w20
  case (w20) {
    frame True {
      w21 = default
    }
    frame False {
      w22 = "MPDU disassembly status {0...3} out of range:\nreceived value: %d"
      Format Into String(initString=w22, w4) -> w23
      call "Build Error Cluster.gvi"(code=-1, description=w23) -> (error out=w21)
    }
  }
  Is Less Or Equal(x=w3, y=3) -> w24
  case (w24) {
    frame True {
      w25 = default
    }
    frame False {
      w26 = "MPDU length check status {0...3} out of range:\nreceived value: %d"
      Format Into String(initString=w26, w3) -> w27
      call "Build Error Cluster.gvi"(code=-1, description=w27) -> (error out=w25)
    }
  }
  Is Less Or Equal(x=w2, y=2) -> w28
  case (w28) {
    frame True {
      w29 = default
    }
    frame False {
      w30 = "MPDU FCS check status {0...2} out of range:\nreceived value: %d"
      Format Into String(initString=w30, w2) -> w31
      call "Build Error Cluster.gvi"(code=-1, description=w31) -> (error out=w29)
    }
  }
  Is Less Or Equal(x=w1, y=5) -> w32
  case (w32) {
    frame True {
      w33 = default
    }
    frame False {
      w34 = "A-MPDU De-Aggregation status {0...5} out of range:\nreceived value: %d"
      Format Into String(initString=w34, w1) -> w35
      call "Build Error Cluster.gvi"(code=-1, description=w35) -> (error out=w33)
    }
  }
  Merge Errors(w9, w13, w17, w21, w25, w29, w33) -> (error out=w36)
  $"error out" <- w36
  w37 = "A-MPDU De-Aggregation Status.gtype" "A-MPDU De-Aggregation not executed"  # A-MPDU De-Aggregation Status
  Type Cast(type=w37, x=w1) -> w38
  Type Cast(type="FCS Check Status.gtype" "FCS check not executed", x=w2) -> w39
  w40 = "MPDU Length Check Status.gtype" "MPDU length check not executed"  # MPDU Length Check Status
  Type Cast(type=w40, x=w3) -> w41
  Type Cast(type="MPDU Disassembly Status.gtype" "Disassembly not executed", x=w4) -> w42
  Type Cast(type="MPDU Filtering Status.gtype" "MPDU Filtering not executed", x=w5) -> w43
  w44 = "MSDU Defragmentation Status.gtype" "Defragmentation not executed"  # MSDU Defragmentation Status
  Type Cast(type=w44, x=w6) -> w45
  w46 = "MSDU Duplicate Detection Status.gtype" "Duplicate detection not executed"  # MSDU Duplicate Detection Status
  Type Cast(type=w46, x=w7) -> w47
  Property Node(instance in="RX Status.gtype" {all zero or empty}, "A-MPDU de-aggregation status"=w38, "MPDU FCS check status"=w39, "MPDU length check status"=w41, "MPDU disassembly status"=w42, "MPDU Filtering Status"=w43, "MSDU Defragmentation Status"=w45, "MSDU Duplicate Detection Status"=w47) -> (instance out=w48)
  $"decoded RX status" <- w48
