vi "Decode SAP Sub Header.gvi"   [LabVIEW NXG 4.0.0]
# Decodes the SAP Sub Header from the given 1D array of U8 (byte).
inputs:
  "received SAP sub header": u8[]  # Received SAP Sub Header in 1D array of U8.
outputs:
  "decoded SAP sub header": "SAP Sub Header.gtype"  # Decoded SAP Sub Header using the given 1D array (U8).
  "reserved": u16  # Reserved, it is not used but it should be zero.
types:
  "SAP Sub Header.gtype" = cluster{"timestamp": u32, "number of submessages": u8, "confirmation mode": bool}
diagram:
  Split 1D Array(array=$"received SAP sub header", index=2) -> (first subarray=w1, second subarray=w2)
  Array Index(array=w1) -> (out0[_]=w3, out1[_]=w4)
  Join Numbers(high(x)=w3, low(x)=w4) -> w5
  $reserved <- w5
  Array Index(array=w2) -> (out0[_]=w6, out1[_]=w7, out2[_]=w8, out3[_]=w9, out4[_]=w10, out5[_]=w11)
  case (w11) {
    frame 0, Default {
      w12 = FALSE
    }
    frame 1 {
      w12 = TRUE
    }
  }
  Join Numbers(high(x)=w6, low(x)=w7) -> w13
  Join Numbers(high(x)=w8, low(x)=w9) -> w14
  Join Numbers(high(x)=w13, low(x)=w14) -> w15
  Property Node(instance in="SAP Sub Header.gtype" {all zero or empty}, "timestamp"=w15, "number of submessages"=w10, "confirmation mode"=w12) -> (instance out=w16)
  $"decoded SAP sub header" <- w16
