vi "Encode MAC SAP TX Configuration Request.gvi"   [LabVIEW NXG 4.0.0]
# Converts the MAC SAP TX Configuration Request cluster to 1D array in bytes.
inputs:
  "MAC SAP TX configuration request": "MAC SAP TX Configuration Request.gtype"  # MAC SAP TX Configuration Request cluster that needs to be converted to 1D array in bytes.
outputs:
  "encoded MAC SAP TX configuration request": u8[]  # MAC SAP TX Configuration Request cluster in 1D array of U8.
types:
  "General Message Header.gtype" = cluster{"message type ID": u16, "reference ID": u16, "instance ID": u8}
  "SAP Sub Header.gtype" = cluster{"timestamp": u32, "number of submessages": u8, "confirmation mode": bool}
  "MAC Frame Type.gtype" = enum{"Management", "Control", "Data", "Extension"}
  "MSDU TX Parameters.gtype" = cluster{"MSDU index": u8, "frame type": "MAC Frame Type.gtype", "subtype": u8, "to DS": bool, "from DS": bool, "power management": u8, "more data": u8, "protected frame": u8, "HTC / order": u8, "source address": u8[6], "destination address": u8[6], "basic service set identifier": u8[6], "recipient address": u8[6], "transmitter address": u8[6], "MSDU length": u16}
  "PHY Frame Format.gtype" = enum{"NON_HT_OFDM", "VHT", "NON_HT_DUP_OFDM"}
  "Bandwidth.gtype" = enum{"20 MHz", "40 MHz", "80 MHz"}
  "PHY TX Parameters.gtype" = cluster{"MSDU index": u8, "format": "PHY Frame Format.gtype", "bandwidth": "Bandwidth.gtype", "MCS": u8}
  "MAC SAP TX Configuration Request.gtype" = cluster{"General Message Header": "General Message Header.gtype", "SAP Sub Header": "SAP Sub Header.gtype", "MSDU TX Parameters": "MSDU TX Parameters.gtype", "PHY TX Parameters": "PHY TX Parameters.gtype"}
uses:
  AFW::802_11::Transport::Encode General Message Header.gvi
  AFW::802_11::Transport::Encode SAP Sub Header.gvi
  AFW::802_11::Transport::Encode MSDU TX Parameters.gvi
  AFW::802_11::Transport::Encode PHY TX Parameters.gvi
diagram:
  Property Node(instance in=$"MAC SAP TX configuration request") -> ("General Message Header"=w1, "SAP Sub Header"=w2, "MSDU TX Parameters"=w3, "PHY TX Parameters"=w4)
  # message body length in bytes
  # = MSDU TX parameters(parameter set body length =41) + 4
  # + PHY TX parameters(parameter set body length = 4) + 4
  # + General message header (8)+ SAP Sub-header (8)
  w5 = 69  # parameter set body length
  call "Encode General Message Header.gvi"(general message header=w1, message body length=w5) -> (encoded general message header=w6)
  call "Encode SAP Sub Header.gvi"(SAP sub header=w2) -> (encoded SAP sub header=w7)
  call "Encode MSDU TX Parameters.gvi"(MSDU TX parameters=w3) -> (encoded MSDU TX parameters=w8)
  call "Encode PHY TX Parameters.gvi"(PHY TX parameters=w4) -> (encoded PHY TX parameters=w9)
  Build Array(w6, w7, w8, w9) -> w10
  $"encoded MAC SAP TX configuration request" <- w10
