vi "Encode MAC SAP TX Confirmation.gvi"   [LabVIEW NXG 4.0.0]
# Converts the MAC SAP TX Confirmation cluster to 1D array in bytes.
inputs:
  "MAC SAP TX confirmation": "MAC SAP TX Confirmation.gtype"  # MAC SAP TX Confirmation cluster that needs to be converted to 1D array in bytes.
outputs:
  "encoded MAC SAP TX confirmation": u8[]  # MAC SAP TX Confirmation cluster in 1D array of U8.
types:
  "General Message Header.gtype" = cluster{"message type ID": u16, "reference ID": u16, "instance ID": u8}
  "SAP Sub Header.gtype" = cluster{"timestamp": u32, "number of submessages": u8, "confirmation mode": bool}
  "Confirmation States.gtype" = enum{"Success", "Unknown Message", "Message not Supported", "Unknown Parameter (Set)", "Missing Parameter (Set)", "Parameter (Set) Repetition", "Range Violation", "State Violation", "Timeout", "Config Payload Mismatch", "Length Mismatch", "Input Buffer Full", "Internal Error", "Instance ID Mismatch"}
  "MAC SAP TX Confirmation.gtype" = cluster{"General Message Header": "General Message Header.gtype", "SAP Sub Header": "SAP Sub Header.gtype", "Confirmation status": "Confirmation States.gtype"}
uses:
  AFW::802_11::Transport::Encode General Message Header.gvi
  AFW::802_11::Transport::Encode SAP Sub Header.gvi
diagram:
  Property Node(instance in=$"MAC SAP TX confirmation") -> ("General Message Header"=w1, "SAP Sub Header"=w2, "Confirmation status"=w3)
  # message body length in bytes = MAC confirmation(parameter set body length =1) + 4 + 8 + 8
  call "Encode General Message Header.gvi"(general message header=w1, message body length=21) -> (encoded general message header=w4)
  call "Encode SAP Sub Header.gvi"(SAP sub header=w2) -> (encoded SAP sub header=w5)
  w6 = 0  # sub-message type
  w7 = 0  # parameter set ID
  w8 = 1  # parameter set body length
  Split Number(x=w8) -> (high(x)=w9, low(x)=w10)
  Type Cast(type=u8 0, x=w3) -> w11
  Build Array(w6, w7, w9, w10, w11) -> w12
  Build Array(w4, w5, w12) -> w13
  $"encoded MAC SAP TX confirmation" <- w13
