vi "Encode MAC SAP TX Payload Request.gvi"   [LabVIEW NXG 4.0.0]
# Encodes the MAC SAP TX Payload Request cluster to 1D array of U8 (byte).
inputs:
  "MAC SAP TX payload request": "MAC SAP TX Payload Request.gtype"  # MAC SAP TX Payload Request cluster that needs to be converted to 1D array in bytes.
outputs:
  "encoded MAC SAP TX payload request": u8[]  # MAC SAP TX Payload Request cluster in 1D array of U8.
types:
  "General Message Header.gtype" = cluster{"message type ID": u16, "reference ID": u16, "instance ID": u8}
  "SAP Sub Header.gtype" = cluster{"timestamp": u32, "number of submessages": u8, "confirmation mode": bool}
  "MSDU TX Payload.gtype" = cluster{"MSDU index": u8, "MSDU length": u16, "MSDU data": u8[]}
  "MAC SAP TX Payload Request.gtype" = cluster{"General Message Header": "General Message Header.gtype", "SAP Sub Header": "SAP Sub Header.gtype", "MSDU TX Payload": "MSDU TX Payload.gtype"}
uses:
  AFW::802_11::Transport::Encode General Message Header.gvi
  AFW::802_11::Transport::Encode SAP Sub Header.gvi
  AFW::802_11::Transport::Encode MSDU TX Payload.gvi
diagram:
  Property Node(instance in=$"MAC SAP TX payload request") -> ("General Message Header"=w1, "SAP Sub Header"=w2, "MSDU TX Payload"=w3)
  Property Node(instance in=w3) -> ("MSDU length"=w4, instance out=w5)
  To Unsigned 32 Bit Integer(number=w4) -> w6
  # message body length in bytes
  # = MSDU TX payload(parameter set body length =MSDU length +4) + 4 + 8 + 8
  Add(w6, 4, 4, 8, 8) -> w7
  call "Encode General Message Header.gvi"(general message header=w1, message body length=w7) -> (encoded general message header=w8)
  call "Encode SAP Sub Header.gvi"(SAP sub header=w2) -> (encoded SAP sub header=w9)
  call "Encode MSDU TX Payload.gvi"(MSDU TX payload=w5) -> (encoded MSDU TX payload=w10)
  Build Array(w8, w9, w10) -> w11
  $"encoded MAC SAP TX payload request" <- w11
