vi "Encode MAC SAP TX Status Indication.gvi"   [LabVIEW NXG 4.0.0]
# Converts the MAC SAP TX Status Indication cluster to 1D array in bytes.
inputs:
  "MAC SAP TX status indication": "MAC SAP TX Status Indication.gtype"  # MAC SAP TX Status Indication cluster that needs to be converted to 1D array in bytes.
outputs:
  "encoded MAC SAP TX status indication": u8[]  # MAC SAP TX Status Indication cluster in 1D array of U8.
types:
  "General Message Header.gtype" = cluster{"message type ID": u16, "reference ID": u16, "instance ID": u8}
  "SAP Sub Header.gtype" = cluster{"timestamp": u32, "number of submessages": u8, "confirmation mode": bool}
  "MAC SAP TX Status Indication.gtype" = cluster{"General Message Header": "General Message Header.gtype", "SAP Sub Header": "SAP Sub Header.gtype", "MSDU transmission status": bool}
uses:
  AFW::802_11::Transport::Encode General Message Header.gvi
  AFW::802_11::Transport::Encode SAP Sub Header.gvi
  AFW::802_11::Transport::Encode MSDU Transmission Status.gvi
diagram:
  Property Node(instance in=$"MAC SAP TX status indication") -> ("General Message Header"=w1, "SAP Sub Header"=w2, "MSDU transmission status"=w3)
  # message body length in bytes = MAC TX status (parameter set body length = 1) + 4 + 8 + 8
  call "Encode General Message Header.gvi"(general message header=w1, message body length=21) -> (encoded general message header=w4)
  call "Encode SAP Sub Header.gvi"(SAP sub header=w2) -> (encoded SAP sub header=w5)
  call "Encode MSDU Transmission Status.gvi"(MSDU transmission status=w3) -> (encoded MSDU transmission status=w6)
  Build Array(w4, w5, w6) -> w7
  $"encoded MAC SAP TX status indication" <- w7
