vi "Encode MSDU TX Parameters.gvi"   [LabVIEW NXG 4.0.0]
# Builds an 1D array of U8 (byte) with the MSDU TX Parameters cluster and the sub-message header parameters.
inputs:
  "MSDU TX parameters": "MSDU TX Parameters.gtype"  # MSDU TX Parameters cluster that needs to be flatten to array U8 type.
outputs:
  "encoded MSDU TX parameters": u8[]  # MSDU TX Parameters cluster and sub-message header parameters in 1D array of U8.
types:
  "MAC Frame Type.gtype" = enum{"Management", "Control", "Data", "Extension"}
  "MSDU TX Parameters.gtype" = cluster{"MSDU index": u8, "frame type": "MAC Frame Type.gtype", "subtype": u8, "to DS": bool, "from DS": bool, "power management": u8, "more data": u8, "protected frame": u8, "HTC / order": u8, "source address": u8[6], "destination address": u8[6], "basic service set identifier": u8[6], "recipient address": u8[6], "transmitter address": u8[6], "MSDU length": u16}
diagram:
  w1 = 0  # submessage type
  w2 = 0  # parameter set ID
  Property Node(instance in=$"MSDU TX parameters") -> ("MSDU index"=w3, "frame type"=w4, "subtype"=w5, "to DS"=w6, "from DS"=w7, "power management"=w8, "more data"=w9, "protected frame"=w10, "HTC / order"=w11, "source address"=w12, "destination address"=w13, "basic service set identifier"=w14, "recipient address"=w15, "transmitter address"=w16, "MSDU length"=w17)
  Type Cast(x=w4) -> w18
  w19 = 41  # parameter set body length
  Split Number(x=w19) -> (high(x)=w20, low(x)=w21)
  Build Array(w20, w21) -> w22
  Boolean To 0 Or 1(Boolean=w6) -> (0, 1=w23)
  To Unsigned 8 Bit Integer(number=w23) -> w24
  Boolean To 0 Or 1(Boolean=w7) -> (0, 1=w25)
  To Unsigned 8 Bit Integer(number=w25) -> w26
  Split Number(x=w17) -> (high(x)=w27, low(x)=w28)
  Build Array(w27, w28) -> w29
  Build Array(w1, w2, w22, w3, w18, w5, w24, w26, w8, w9, w10, w11, w12, w13, w14, w15, w16, w29) -> w30
  $"encoded MSDU TX parameters" <- w30
