vi "Encode MSDU TX Payload.gvi"   [LabVIEW NXG 4.0.0]
# Builds an 1D array of U8 (byte) with the MSDU TX Payload cluster and the sub-message header parameters.
inputs:
  "MSDU TX payload": "MSDU TX Payload.gtype"  # MSDU TX Payload cluster that needs to be flatten to array U8 type.
outputs:
  "encoded MSDU TX payload": u8[]  # MSDU TX Payload cluster and sub-message header parameters in 1D array of U8.
types:
  "MSDU TX Payload.gtype" = cluster{"MSDU index": u8, "MSDU length": u16, "MSDU data": u8[]}
diagram:
  w1 = 0  # submessage type
  w2 = 0  # parameter set ID
  Property Node(instance in=$"MSDU TX payload") -> ("MSDU index"=w3, "MSDU length"=w4, "MSDU data"=w5)
  Split Number(x=w4) -> (high(x)=w6, low(x)=w7)
  Build Array(w6, w7) -> w8
  # 4 represents the number of bytes by parameter set ID + submessage type + parameter set body length
  # Parameter set body length in bytes
  # = MSDU length + 4
  w9 = 4  # n bytes
  Add(w9, w4) -> w10
  # w10: parameter set body length
  Split Number(x=w10) -> (high(x)=w11, low(x)=w12)
  Build Array(w11, w12) -> w13
  Build Array(w1, w2, w13, w3, 0, w8, w5) -> w14
  $"encoded MSDU TX payload" <- w14
