vi "Encode SAP Sub Header.gvi"   [LabVIEW NXG 4.0.0]
# Builds an 1D array of U8 (byte) with the SAP Sub Header cluster and a reserved field.
inputs:
  "SAP sub header": "SAP Sub Header.gtype"  # SAP Sub Header cluster.
outputs:
  "encoded SAP sub header": u8[]  # SAP Sub Header in 1D array of U8.
types:
  "SAP Sub Header.gtype" = cluster{"timestamp": u32, "number of submessages": u8, "confirmation mode": bool}
diagram:
  Property Node(instance in=$"SAP sub header") -> ("timestamp"=w1, "number of submessages"=w2, "confirmation mode"=w3)
  w4 = 0  # reserved
  Split Number(x=w4) -> (high(x)=w5, low(x)=w6)
  Split Number(x=w1) -> (high(x)=w7, low(x)=w8)
  Split Number(x=w7) -> (high(x)=w9, low(x)=w10)
  Split Number(x=w8) -> (high(x)=w11, low(x)=w12)
  Boolean To 0 Or 1(Boolean=w3) -> (0, 1=w13)
  To Unsigned 8 Bit Integer(number=w13) -> w14
  Build Array(w5, w6, w9, w10, w11, w12, w2, w14) -> w15
  $"encoded SAP sub header" <- w15
