vi "Counter U16 Dominant Increment.gvi"   [LabVIEW NXG 4.0.0]
# Implements a counter that wraps at unsigned 32 bit border.
# Increment is executed on assertion of reset as well (result will be 1).
# Latency: 0 cycle
inputs:
  "increment": bool = TRUE  # Increments the counter by one.
  "reset": bool  # resets the counter to 0.
outputs:
  "count out": u16  # current counter value
diagram:
  Feedback Node(initial value=0, input=w1) -> w2
  Select(s=$reset, t=0, f=w2) -> w3
  # Latency: 0 cycle
  Increment(x=w3) -> w4
  Select(s=$increment, t=w4, f=w3) -> w1
  $"count out" <- w1
