vi "Get System Model Name.gvi"   [LabVIEW NXG 4.0.0]
inputs:
  "error in": error
outputs:
  "model name": string
  "error out": error
uses:
  NI::G Core::Libraries and Executables::System Exec.gvi
  NI::G Core::Error::Build Error Cluster.gvi
diagram:
  disable {
    frame TARGET_TYPE != "RT", Default {
      w1 = "wmic computersystem get model /format:list"
    }
    frame TARGET_TYPE == "RT" {
      w1 = "dmidecode -s baseboard-product-name"
    }
  }
  call "System Exec.gvi"(command line=w1, error in=$"error in", wait until completion?=TRUE) -> (standard output=w2, return code=w3, error out=w4)
  # trim whitespace from response
  Match Pattern(regular expression="^[\\t\\r\\n\\s]*", string=w2) -> (after substring=w5)
  Match Pattern(regular expression="[\\t\\r\\n\\s]*$", string=w5) -> (before substring=w6)
  # remove "<key>=" if nescessary
  Search Or Split String(search string/char="=", string=w6) -> (match + rest of string=w7, offset of match=w8)
  Is Less Than 0(x=w8) -> w9
  String Subset(offset (0)=1, string=w7) -> w10
  Select(s=w9, t=w6, f=w10) -> w11
  $"model name" <- w11
  Is Not Equal To 0(x=w3) -> w12
  case (w12) {
    frame False, Default {
      w13 = w4
    }
    frame True {
      Format Into String(formatString="Unable to run \"%s\" on target system.", errIn=w4, w1) -> (outString=w14, errOut=w15)
      call "Build Error Cluster.gvi"(code=-1, description=w14, error in=w15) -> (error out=w13)
    }
  }
  $"error out" <- w13
