vi "Search U8 array.gvi"   [LabVIEW NXG 4.0.0]
# Searches for an array subset within a given array.
inputs:
  "array": u8[]  # Array in which string should be searched.
  "search string": u8[]  # Array to find.
outputs:
  "index of sub string": i32  # Index of the search array within given array or -1 if content was not found.
  "remaining array": u8[]  # Array subset starting at search string or empty array.
diagram:
  Delete From Array(inArray=$"search string", length (1)=1, index0=0) -> (outArray=w1, deleted=w2)
  Array Index(array=w2) -> (out0[_]=w3)
  Array Size(array=$"search string") -> (size(s)=w4)
  Decrement(x=w4) -> w5
  s1 = -1  # shift register
  while {
    # s1: search position
    Increment(x=s1) -> w6
    # searches for occurance of sub string in array, search position starts at zero and is incremented each time the rest of the
    # search string does not match at current search position
    # search for first byte
    Search 1D Array(1D array=$array, element=w3, start index (0)=w6) -> (index of element=w7)
    Increment(x=w7) -> w8
    # compare remaining bytes
    Array Subset(array=$array, index0=w8, length0=w5) -> w9
    Is Equal[ComparisonMode=CompareAggregates](x=w9, y=w1) -> w10
    # stop search if either
    # first byte not found
    # anymore or first byte
    # and the rest matches
    Is Less Than 0(x=w7) -> w11
    Logical Or(w11, w10) -> w12
    # w13: last match
    # (-1 if no match at all)
    Feedback Node(initial value=-1, input=w7) -> w13
    next s1 = w7
    stop if w12
  }
  $"index of sub string" <- s1
  Array Size(array=$array) -> (size(s)=w14)
  Is Less Than 0(x=s1) -> w15
  case (w15) {
    frame False, Default {
      Delete From Array(inArray=$array, length (1)=s1, index0=0) -> w16
    }
    frame True {
      # in cases with no match (first and condition) check whether the
      # remaining bytes in array could be extended to a match
      # (second and condition), usefull if array is part of a stream
      Subtract(x=w14, y=w13) -> w17
      Is Greater Or Equal To 0(x=w13) -> w18
      Is Less Or Equal(x=w17, y=w4) -> w19
      Logical And(w18, w19) -> w20
      case (w20) {
        frame False, Default {
          w21 = FALSE
        }
        frame True {
          Increment(x=w13) -> w22
          Decrement(x=w17) -> w23
          Array Subset(array=$array, index0=w22, length0=w23) -> w24
          Array Subset(array=$"search string", index0=1, length0=w23) -> w25
          Is Equal[ComparisonMode=CompareAggregates](x=w24, y=w25) -> w21
        }
      }
      Select(s=w21, t=w13, f=w14) -> w26
      Delete From Array(inArray=$array, length (1)=w26, index0=0) -> w16
    }
  }
  $"remaining array" <- w16
