vi "Stop On Error.gvi"   [LabVIEW NXG 4.0.0]
# Enqueue an element into the stop notifier if error in indicates an error. Call after each loop on host top level to synchronize host shut down in case of any error.
inputs:
  "error in": error
  "error source prefix": string
outputs:
  "error out": error
uses:
  NI::G Core::Error::Read Call Chain.gvi
  NI::G Core::Error::Write Call Chain.gvi
  NI::G Core::Error::Is Error.gvi
  AFW::Common::Create Stop.gvi
diagram:
  Property Node(instance in=$"error in") -> ("status"=w1, instance out=w2)
  Is Empty String Or Path(string/path=$"error source prefix") -> w3
  Logical And(w1, not w3) -> w4
  case (w4) {
    frame False, Default {
      w5 = w2
    }
    frame True {
      call "Read Call Chain.gvi"(error in=w2) -> (call chain=w6)
      Tick Count[Units=Microseconds]() -> (timer value=w7)
      Format Into String(formatString="%s (%dus)", $"error source prefix", w7) -> w8
      Build Array(w8, w6) -> w9
      # add error source and timestamp as additional
      # call chain entry
      call "Write Call Chain.gvi"(call chain=w9, error in=w2) -> (error out=w5)
    }
  }
  call "Is Error.gvi"(error in=w5) -> (error?=w10)
  call "Create Stop.gvi"(stop in=w10, error in=no error) -> (error out=w11)
  # create stop in case of an error
  Merge Errors(w5, w11) -> (error out=w12)
  $"error out" <- w12
