vi "DTP Align 32bit.gvi"   [LabVIEW NXG 4.0.0]
# Converts an array of U8 data to an array of U32 data. If the U8 data array is not U32 aligned, padding bytes are added to ensure that all U8 data elemenets are contained in the U32 data array.
inputs:
  "U8 data array": u8[]  # The input data array containing U8 elements.
outputs:
  "32 bit aligned data array": u32[]  # The output data array containing U32 elements.
diagram:
  Array Size(array=$"U8 data array") -> (size(s)=w1)
  Quotient And Remainder(x=w1, y=4) -> (x-y*floor(x/y)=w2)
  Is Not Equal To 0(x=w2) -> w3
  # ensure sufficient padding bytes
  # if input array is not 32bit aligned.
  # Surplus bytes will be discarded in
  # cast to 32bit array.
  case (w3) {
    frame False, Default {
      w4 = $"U8 data array"
    }
    frame True {
      Build Array($"U8 data array", [0, 0, 0]) -> w4
    }
  }
  Type Cast(type=u32[] [], x=w4) -> w5
  $"32 bit aligned data array" <- w5
