vi "DTP Parse RX Indication.gvi"   [LabVIEW NXG 4.0.0]
# Parses the RX indication that gives information about the received packet. The RX indication is prefixed on the FPGA before sending the packet to the host.
inputs:
  "data in": u8[]  # Received data.
  "read pointer": i32  # Number of bytes to skip in data in before starting RX indication parsing.
outputs:
  "label": u16
  "packet length": u16  # Length of the packet in bytes.
  "counter": u16
diagram:
  # RX indication is 6 bytes long
  w1 = 6  # length(rest)
  Array Subset(array=$"data in", index0=$"read pointer", length0=w1) -> w2
  Array Index(array=w2) -> (out0[_]=w3, out1[_]=w4, out2[_]=w5, out3[_]=w6, out4[_]=w7, out5[_]=w8)
  Join Numbers(high(x)=w3, low(x)=w4) -> w9
  $label <- w9
  Join Numbers(high(x)=w5, low(x)=w6) -> w10
  $counter <- w10
  Join Numbers(high(x)=w7, low(x)=w8) -> w11
  $"packet length" <- w11
