vi "DTP Split RX Data Stream.gvi"   [LabVIEW NXG 4.0.0]
# Parses the RX indications, extracts the packets, and enqueues them to the given RX data queue.
inputs:
  "queue in": Queue<"DTP Host RX Indication.gtype">
  "RX data": u8[]  # Received data (packets with RX indications).
  "error in": error
outputs:
  "error out": error
  "queue out": Queue<"DTP Host RX Indication.gtype">
  "remaining data": u8[]  # Received data that could not be processed. The remaining data must be fed to the module in the next run of this node.
  "packet headers": T1[]
types:
  T1 = cluster{"label": u16, "packet length": u16, "counter": u16}
  "DTP Host RX Indication.gtype" = cluster{"label": u16, "data": DataValueReference<u8[]>}
uses:
  NI::G Core::Error::Is Error.gvi
  AFW::Common::Data Transfer Protocol::DTP Parse RX Indication.gvi
diagram:
  w1 = 6  # header size
  w2 = 0  # array read pointer
  Array Size(array=$"RX data") -> (size(s)=w3)
  s1 = $"RX data"  # shift register
  s2 = w2  # shift register
  s3 = $"queue in"  # shift register
  s4 = $"error in"  # shift register
  while {
    call "Is Error.gvi"(error in=s4) -> (error?=w5)
    Subtract(x=w3, y=s2) -> w6
    Is Greater(x=w6, y=w1) -> w7
    Logical And(w7, not w5) -> w8
    # check if RX indication
    # header can be read
    case (w8) {
      frame True {
        call "DTP Parse RX Indication.gvi"(data in=s1, read pointer=s2) -> (label=w15, packet length=w16, counter=w17)
        Property Node(instance in=T1 {all zero or empty}, "label"=w15, "counter"=w17, "packet length"=w16) -> (instance out=w13)
        # w3: RX data size
        # w1: header size
        # s2: read pointer
        Add(w1, s2) -> w18
        To Signed 32 Bit Integer(number=w16) -> w19
        Subtract(x=w3, y=w18) -> w20
        Is Less Or Equal(x=w19, y=w20) -> w12
        case (w12) {
          frame False, Default {
            w9 = s2
            w10 = s4
            w11 = s3
          }
          frame True {
            Add(w19, w18) -> w9
            Array Subset(array=s1, index0=w18, length0=w19) -> w21
            New Data Value Reference(data value=w21, error in (no error)=s4) -> (data value reference=w22, error out=w23)
            Property Node(instance in="DTP Host RX Indication.gtype" {all zero or empty}, "label"=w15, "data"=w22) -> (instance out=w24)
            Enqueue Element(element=w24, error in=w23, queue=s3) -> (error out=w10, queue out=w11)
          }
        }
        w14 = TRUE
      }
      frame False {
        w9 = s2
        w10 = s4
        w11 = s3
        w12 = default
        w13 = default
        w14 = default
      }
    }
    Logical Or(not w12, not w8) -> w25
    append w13 to w4 if w14
    next s2 = w9
    next s3 = w11
    next s4 = w10
    stop if w25
  }
  Array Subset(array=s1, index0=s2) -> w26
  $"remaining data" <- w26
  $"packet headers" <- w4
  $"queue out" <- s3
  $"error out" <- s4
