vi "Close Pipe Reader.gvi"   [LabVIEW NXG 4.0.0]
# Closes all references accociated with pipe reader.
inputs:
  "error in": error
  "pipe reader": "Pipe Reader.gtype"  # A cluster containing all references accociated with a pipe reader.
outputs:
  "error out": error
types:
  "Pipe Reader.gtype" = cluster{"file name": string, "pipe file descriptor": i32, "timer file descriptor": i32, "epoll file descriptor": i32}
uses:
  AFW::Common::Linux Pipes::System Calls::close.gvi
diagram:
  Property Node(instance in=$"pipe reader") -> ("pipe file descriptor"=w1, "timer file descriptor"=w2, "epoll file descriptor"=w3)
  call "close.gvi"(error in=$"error in", file descriptor=w3) -> (error out=w4)
  call "close.gvi"(error in=w4, file descriptor=w2) -> (error out=w5)
  call "close.gvi"(error in=w5, file descriptor=w1) -> (error out=w6)
  $"error out" <- w6
