vi "mkfifo.gvi"   [LabVIEW NXG 4.0.0]
# Encapsulate system call and evaluates errno if call returns -1.
inputs:
  "error in": error
  "pathname": string
  "mode": u32
outputs:
  "error out": error
uses:
  NI::G Core::Error::Build Error Cluster.gvi
  AFW::Common::Linux Pipes::System Calls::system calls.sli::unlink
  AFW::Common::Linux Pipes::System Calls::system calls.sli::mkfifo
  AFW::Common::Linux Pipes::Convert Errno to LabVIEW Error.gvi
diagram:
  disable {
    frame OS == "Win" {
      w2 = 1072  # not yet implemented
      call "Build Error Cluster.gvi"(code=w2, error in=$"error in") -> (error out=w1)
    }
    frame OS == "Linux", Default {
      call "unlink"(pathname=$pathname, error in=$"error in") -> (error out=w3)
      call "mkfifo"(pathname=$pathname, mode=$mode, error in=w3) -> (return=w4, error out=w5)
      Is Less Than 0(x=w4) -> w6
      case (w6) {
        frame False, Default {
          w1 = w5
        }
        frame True {
          call "Convert Errno to LabVIEW Error.gvi"(error in=w5) -> (error out=w1)
        }
      }
    }
  }
  $"error out" <- w1
