vi "Change Log Configuration.gvi"   [LabVIEW NXG 4.0.0]
# It creates a notifier for the logging entries using the initial value of max log level and if the notification is enabled or disabled.
inputs:
  "notification": "Log Configuration.gtype"  # Log Configuration cluster, which has two items: enabled and max log info. The log level has one of the following states: Trace, Debug, Info, Warn, Error, and Fatal.
  "error in": error
outputs:
  "error out": error
types:
  "Log Level.gtype" = enum{"Trace", "Debug", "Info", "Warn", "Error", "Fatal"}
  "Log Configuration.gtype" = cluster{"enabled": bool, "max log level": "Log Level.gtype"}
diagram:
  Obtain Notifier(create if not found=TRUE, element data type="Log Configuration.gtype" {all zero or empty}, error in=$"error in", name="logger status") -> (created new?=w1, error out=w2, notifier out=w3)
  # remove
  # pending
  # notification
  Cancel Notification(error in (no error)=w2, notifier=w3) -> (error out=w4, notifier out=w5)
  Send Notification(error in (no error)=w4, notification=$notification, notifier=w5) -> (error out=w6, notifier out=w7)
  # set new
  # notification
  case (w1) {
    frame True {
      w8 = w6
    }
    frame False {
      Release Notifier(error in (no error)=w6, notifier=w7) -> (error out=w8)
    }
  }
  $"error out" <- w8
