vi "Host.gvi"   [LabVIEW NXG 4.0.0]
# Calculates the RF signal power on primary and secondary channels. Compares the RF signal power against CCA energy threshold and generated CCA indication based on energy detection.
# Latency: min 10 clock cycles
panel controls:
  "Trigger TX": bool  # A Boolean control to trigger a single TX packet.
  "Clear events": bool  # Boolean control to clear the events history from the front panel. The default register size of the events history is 10,000.
  "Primary Channel Selector": UFXP(2.0) = 1  # Numeric control to determine which subband is used as the primary channel. The PHY covers 80 MHz bandwidth, which can be divided into four subbands {0,…,3} of 20 MHz bandwidth for the non-high throughput (non-HT) signal. For wider bandwidths the subbands get combined. Visit ni.com/info and enter the Info Code 80211AppFWManual to access the LabVIEW Communications 802.11 Application Framework Manual for more information about channelization.
  "Transmit IP Address": string = "127.0.0.1"  # Destination IP address for the UDP output stream.
  "Transmit Port": u16 = 13000  # Target UDP port for UDP output stream, usually between 1,025 and 65,535.
  "Tab": i32
  "Power Level": f64 = 10  # Output power level considering the transmission of a continuous wave (CW) signal that has full digital to analog converter (DAC) range. The high peak-to-average power ratio of OFDM means that the output power of transmitted 802.11 frames is usually 9 dB to 12 dB below the adjusted power level.
  "Primary Channel Center Frequency": f64 = 2475000000  # It is the primary channel center frequency of the transmitter in Hz. Valid values depend on the device the station is running on.
  "TX RF Port": enum{"TX1/RF 0", "TX1/RF 1"} = "TX1/RF 0"  # The RF port used for TX (applicable only for USRP RIO devices).
  "RX RF Port": T1 = "RX2/RF 1"  # The RF port used for RX (applicable only for USRP RIO devices).
  "AGC": bool = TRUE  # If enabled, the optimum gain setting is chosen depending on the received signal power strength. The RX gain value is taken from Manual RX Gain if the AGC has been disabled.
  "Manual RX gain": f64 = 37.5  # Manual RX gain value. Applied if AGC is disabled.
  "PN Data Packet Size": i32 = 10  # Packet size in bytes (range is limited to 4061, which is a single A-MPDU reduced by MAC overhead)
  "Subcarrier Format": "Subcarrier Format.gtype" = "80 MHz (IEEE 802.11 ac)"  # Allows you to switch between IEEE 802.11 standard formats. The supported formats are the following: 802.11a with 20 MHz Bandwidth 802.11ac with 20 MHz Bandwidth 802.11ac with 40 MHz Bandwidth 802.11ac with 80 MHz Bandwidth (supported MCS up to 4)
  "Stop": bool  # Boolean control to stop the station.
  "RIO Device": string = "RIO0"  # The RIO address of the RF hardware device.
  "Enable Station": bool
  "reset TX staistics": bool  # A Boolean control to reset all counters of MAC TX Statistics cluster.
  "reset RX staistics": bool  # A Boolean control to reset all counters of MAC RX Statistics cluster.
  "PN Packets per Second": u32 = 3  # Average number of packets to transmit per second (limited to 10,000. The achievable throughput might be less depending on the configuration of the station).
  "Backoff": i32 = -1  # Backoff value that is applied before a frame is transmitted. The backoff is counted in number of slots of 9 µs duration. Based on the backoff value, the backoff counting for the Backoff procedure could be fixed or random: If the backoff value is larger than or equal zero, a fixed backoff is used. If the backoff value is negative, a random backoff counting is used.
  "All": bool  # Boolean control to enable the events tracking of the above FPGA events.
  "None": bool  # Boolean control to disable the events tracking of the above FPGA events.
  "CCA Energy Detection Threshold": FXP(10.3) = -50  # If the energy of the received signal is above the threshold, the station qualifies the medium as busy and interrupts its Backoff procedure, if any. Set the CCA Energy Detection Threshold [dBm] control to a value which is higher than the minimal value of the current curve in the RF Input Power graph.
  "MCS": UFXP(4.0) = 4  # Modulation and coding scheme index used to encode data frames. ACK frames are always sent with MCS 0. Be aware that not all MCS values are applicable for all subcarrier formats and the meaning of the MCS changes with the subcarrier format. The text field next to the MCS field shows the modulation scheme and coding rate for the current MCS and Subcarrier Format.
  "session": "Host Session.gtype"
  "Data Source Options": i32 = 1
    # Each tab shows the options for the corresponding data sources.
    # UDP Tab—A free UDP port to retrieve data for the transmitter is derived inherently based on the station number.
    # PN Tab - PN Data Packet Size—Packet size in bytes (range is limited to 4061, which is a single A-MPDU reduced by MAC overhead)
    # PN Tab - PN Packets per Second—Average number of packets to transmit per second (limited to 10,000. The achievable throughput might be less depending on the configuration of the station).
    # Manual Tab – Trigger TX—A Boolean control to trigger a single TX packet.
  "Data Sink Option": i32  # It has the following required configurations for the UDP data sink option: · Transmit IP Address—Destination IP address for the UDP output stream. Transmit Port—Target UDP port for UDP output stream, usually between 1,025 and 65,535.
  "Data Source": T7 = "PN Data"
    # Determines the source of MAC frames send from the host to the target.
    # Off— This method is useful to disable transmitting TX data while the TX chain is active to trigger ACK packets.
    # UDP—This method is useful for showing demos, such as when using an external video streaming application, or for using external network testing tool, such as Iperf. In this method, input data arrives at or is generated from the 802.11 station using user datagram protocol (UDP).
    # PN Data—This method sends random bits and is useful for functional tests. Packet size and rate can be easily adapted.
    # Manual—This method is useful to trigger single packets for debugging purposes.
    # External—Allow a potential external upper MAC realization or other external applications to use the MAC & PHY functionalities provided by the 802.11 Application Framework.
  "Data Sink": enum{"Off", "UDP"} = "Off"  # It has the following options: Off—Data is discarded. UDP—If enabled, received frames are forwarded to the configured UDP address and port (see below).
  "Reference Clock": string = "Internal"
    # Configures the reference for the device clocks. The reference frequency must be 10 MHz. You can choose from the following sources:
    # Internal—Uses the internal reference clock.
    # REF IN / ClkIn—The reference is taken from the REF IN port (USRP-294xR, and USRP-295XR) or the ClkIn port (NI 5791).
    # GPS—The reference is taken from the GPS module. Only applicable for the USRP-2950/2952/2953 devices.
    # PXI_CLK—The reference is taken from the PXI chassis. Only applicable for PXIe-7975/7976 targets with NI-5791 adapter modules.
  "dot11RTSThreshold": u32 = 2000
    # Semi-static parameter used by frame sequence selection to decide whether RTS|CTS is allowed or not.
    # If the PSDU length, i.e. PN Data Packet Size, is larger than dot11RTSThreshold, the {RTS | CTS | DATA | ACK} frame sequence is used.
    # If the PSDU length, i.e. PN Data Packet Size, is less than or equal to the dot11RTSThreshold, the {DATA | ACK} frame sequence is used.
    # This mechanism allows stations to be configured to initiate RTS/CTS either always, never, or only on frames longer than a specified length.
  "dot11ShortRetryLimit": u16 = 1  # Semi-static parameter—Maximum number of retries applied for short MPDU type (sequences without RTS|CTS). If the number of retry limits is reached, discards MPDUs and associated MPDU configuration and TX vector.
  "dot11LongRetryLimit": u16 = 1  # Semi-static parameter—Maximum number of retries applied for long MPDU type (sequences including RTS|CTS). If the number of retry limits is reached, discards MPDUs and associated MPDU configuration and TX vector.
  "control frame TX vector configuration": T8  # Applies the configured MCS values in TX vectors for RTS, CTS or ACK frames. The default control frame configuration of those frames is Non-HT-OFDM and 20 MHz bandwidth while the MCS can be configured from the host.
  "FPGA events to track": "Events Enable Mask.gtype"  # It has a set of Boolean controls; each control is used to enable or disable the tracking of the corresponding FPGA event. Those events are as follows: PHY TX start request PHY TX end indication PHY RX start indication PHY RX end indication PHY CCA timing indication PHY RX gain change indication DCF state indication MAC MPDU RX indication MAC MPDU TX request
  "Device MAC Address": string = "46:6F:4B:75:6D:61"  # MAC address associated with the station. The Boolean Indicator shows if the given MAC address is valid or not. The MAC address validation is done in the dynamic mode.
  "Destination MAC Address": string = "46:6F:4B:75:6D:62"  # MAC address of the destination to which packets should be sent. The Boolean indicator shows if the given MAC address is valid or not. If running in RF loopback mode, the Destination MAC Address and the Device MAC Address should be similar.
  "log file prefix": string = "events.txt"  # Name a text file to write the FPGA events data that have been read from the Event DMA FIFO. They presented above in the FPGA events to track. Each event consists of a time stamp and the event data. The text file is created locally in the project folder. Only the selected events in the FPGA events to track above will be written in the text file.
  "write to file": bool  # Boolean control to enable or disable the writing process of the selected FPGA events to the text file.
  "AGC target signal power": FXP(10.3) = -20  # Target RX power in digital base band used if the AGC is enabled. The optimal value depends on the peak to average power ratio (PAPR) of the received signal. Set the AGC target signal power to a value larger than that presented in the Baseband RX Power graph.
  "Station Number": u16 = 1  # Numerical control to set the station number. Each running station should have a different number. It can be up to 10. If the user would like to increase the number of running stations, the cache of MSDU Sequence Number assignment and Duplicate Detection should be increased to the required value, since the default value is 10.
  "values per second": bool  # A Boolean control to show the MAC TX Statistics and MAC RX Statistics either the accumulated values since the last reset or the values per second.
  "RF loop back demo mode": bool
    # Boolean control to switch between the operation modes:
    # RF Multi-Station (Boolean is false): At least two stations are required in the setup, where each station acts as a single 802.11 device.
    # RF Loopback (Boolean is true):  A single device is required. This setup is useful for small demos using a single station. However, the implemented MAC features have some limitations in RF Loopback mode. The ACK packets are lost while the MAC TX is waiting for them; the DCF state machine on FPGA of MAC prevents this mode. Therefore, the MAC TX always reports a transmission failed. Hence, the reported TX packet error rate and the TX block error rate on the graphical indication of TX Error Rates are ones.
panel indicators:
  "Events": string
  "Baseband RX Power": f64[][]  # Graphical indication displays the baseband signal power at packet start. The numerical indicator shows the actual receiver's baseband power. When the AGC is enabled, the 802.11 Application Framework attempts to keep this value at the given AGC target signal power in Advanced tab by changing the RX gain accordingly.
  "Coerced LO frequency TX": f64  # Actual used TX frequency on target.
  "Coerced LO frequency RX": f64  # Actual used RX frequency on target.
  "Channel Estimation": cluster{"Element 1": i32[], "Element 2": f64[]}[]  # Graphical indication shows the amplitude and phase of the estimated channel (based on L-LTF and VHT-LTF).
  "TX Error Rates": f64[][]  # Graphical indication shows the TX packet error rate and TX block error rate. The TX packet error rate is calculated as a ratio of successful MPDU transmitted to the number of transmission tries. The TX block error rate is calculated as a ratio of successful MPDU transmitted to the total number of transmission. The most recent values are displayed on the upper right of the graph.
  "Coerced Power Level": f64  # Power level of a continuous wave of 0 dBFS that provides for the current device settings. The average output power of 802.11 signals is approximately 10 dB below this level. Indicates the actual power level considering RF frequency and device-specific calibration values from the EEPROM.
  "RX Throughput": f64  # Graphical indication shows the data rate of successful received and decoded frames matching the Device MAC Address.
  "Applied RX Gain": f64  # A numerical indicator shows RX gain value currently applied. This value is the Manual RX Gain when the AGC is disabled, or the calculated RX gain when AGC is enabled. In both cases, the gain value is coerced by the capabilities of the device.
  "RX Throughput [bits/s]": f64  # Numerical indication shows the data rate of successful received and decoded frames matching the Device MAC Address.
  "current TX packet error rate": f64
  "RF Frequency": f64  # The RF center frequency after the adjustment based on the Primary Channel Selector control and the operating bandwidth.
  "Station Active": bool  # Boolean indicator shows if the station RF is active after enabling the station by setting the Enable Station control to On.
  "Device Ready": bool  # Boolean indicator shows if the device is ready. If you receive an error, try one of the following: Ensure your RIO device is connected properly. Check the configuration of RIO Device. Check the station number. It should be different if more than one station is running on the same host.
  "Baseband RX Power [dBFS]": f64
  "RX Constellation": c128[]  # Graphical indication shows the constellation of RX I/Q samples of the received data field.
  "RX Power Spectrum": T2  # A snapshot of the current baseband spectrum from the RX.
  "TX Power Spectrum": T2  # A snapshot of the current baseband spectrum from the TX.
  "Data Transfer": bool  # Indicates that the packets are successfully read from the given port. Look to video streaming for more details.
  "FIFO Full": bool  # Indicates that the socket buffer of the UDP reader is small to read the given data, so packets are dropped. Increase the socket buffer size.
  "FIFO Full": bool  # Indicates that the socket buffer of the UDP sender is small to receive the payload from the RX Data direct memory access (DMA) FIFO, so packets are dropped. Increase the socket buffer size.
  "Data Transfer": bool  # Indicates that the packets are successfully read from the DMA FIFO and forwarded to the given UDP port.
  "Compensated CFO": f64  # Carrier frequency offset detected by coarse frequency estimation unit. For FlexRIO/FlexRIO adapter module, set the reference clock to PXI_CLK or REF IN/ClkIn.
  "modulation and coding rate": string
  "Target FIFO Overflow": bool  # Boolean indicator that lights if there is an overflow in the target to host (T2H) first-in-first-out memory buffers (FIFOs). If one of the T2H FIFOs overflows, its information is no longer reliable. Those FIFOs are as follows: T2H RX Data overflow T2H Constellation overflow T2H RX Power Spectrum overflow T2H Channel Estimation overflow TX to RF FIFO overflow
  "RF Input Power": f64[][]  # Displays the current RF input power in dBm regardless of the type of incoming signal if an 802.11 packet has been detected. This indicator displays the RF input power, in dBm, currently being measured, as well as at the most recent packet start.
  "MAC RX statistics": "MAC RX Statistics.gtype"
    # Numerical indication shows the values of the following counters related to MAC RX. The presented values could be the accumulated values since the last reset or the values per second based on the status of the Boolean control values per second.
    # preamble detected (by the synchronization)
    # PHY service data units (PSDUs) received (frames with valid physical layer convergence procedure (PLCP) header, frames without format violations)
    # MPDU CRC OK (the frame check sequence (FCS) check passes)
    # RTS detected
    # CTS detected
    # Data detected
    # ACK detected
  "MAC TX statistics": "MAC TX Statistics.gtype"  # Numerical indication shows the values of the following counters related to MAC TX. The presented values could be the accumulated values since the last reset or the values per second based on the status of the Boolean control values per second. RTS Triggered CTS Triggered Data Triggered ACK Triggered
  "Averaged Retransmissions per Packet": f64  # Graphical indication shows the average number of transmission tries. The recent value is displayed on the upper right of the graph.
  "valid": bool  # Boolean indicator shows if the given Device MAC Address associated with the device station is valid.
  "valid": bool  # Boolean indicator shows if the given Destination MAC Address associated with the device station is valid.
  "Channelization": cluster{"x": f64, "y": f64}[][]  # Graphical indication shows which sub-band is used as the primary channel based on the Primary Channel Selector. The PHY covers 80 MHz bandwidth, which can be divided into four sub-bands {0,…,3} of 20 MHz bandwidth for the non-HT signal. For wider bandwidths (40 MHz or 80 MHz), the sub-bands get combined. Visit ni.com/info and enter the Info Code 80211AppFWManual to access the LabVIEW Communications 802.11 Application Framework Manual for more information about channelization.
  "Averaged Retransmissions p. Packet": f64
  "current TX block error rate": f64
  "Receive Port": u16  # Source UDP port of UDP input stream.
  "num packets source": u32  # Numerical indicator shows the number of packets that have been received from the data source (UDP, PN Data, or Manual).
  "transfer source": bool  # Boolean indicator shows that a data is receiving from the data source (the number of received packets is not zero).
  "num packets sink": u32  # Number of received packets at data sink from MAC high.
  "transfer sink": bool  # Boolean indicator shows that a data is receiving from the MAC high.
  "TX Indications Middle MAC": u32  # Numerical indicator shows the number of MAC TX Status Indications reported from MAC Middle to MAC high using the assigned UDP port located above it.
  "TX Requests to PHY": u32  # Numerical indicator shows the number of MAC MSDU TX requests written to the DMA FIFO.
  "RX Indications from PHY": u32  # : Numerical indicator shows the number of MAC MSDU RX indications read from the DMA FIFO.
  "RX Indications High MAC": u32  # Numerical indicator shows the number of MAC MSDU RX indications with valid MSDU data received at MAC high.
  "RX Indications Middle MAC": u32  # Numerical indicator shows the number of MAC MSDU RX indications that have been decoded correctly and reported to the MAC high using the assigned UDP port located above it.
  "TX Indications from PHY": u32  # Numerical indicator shows the number of MAC MSDU TX end indications read from the DMA FIFO.
  "TX Request High MAC": cluster{"Config": u32, "Payload": u32}  # Numerical indicators show the number of MAC TX Configuration and Payload request messages generated by the MAC high abstraction layer and written to the corresponding UDP port that is located under them.
  "TX Request Middle MAC": cluster{"Config": u32, "Payload": u32}  # Numerical indicators show the number of MAC TX Configuration and Payload request messages received from the MAC high abstraction layer and read from the corresponding UDP port that is located above them. Before transfer both messages to the lower layers, the given configurations are checked if they are supported or not, in addition, the MAC TX Configuration request and MAC TX Payload request are checked if they are consistence.
  "TX Confirmation Middle MAC": cluster{"Config": u32, "Payload": u32}  # Numerical indicators show the number of confirmation messages that have been generated by the MAC middle for the MAC TX Configuration and MAC TX Payload messages and written to the assigned UDP port located above them.
  "TX Indication Overflow Count": u16  # Numerical indicator shows the number of overflows that occurred during the FIFO writing by TX End indications.
  "TX Indication Overflow": bool
  "RX Indication Overflow Count": u16  # Numerical indicator shows the number of overflows that occurred during the FIFO writing by MAC MSDU RX indications.
  "RX Indication Overflow": bool
  "TX requests": u16  # Reference to the UDP socket used to send or receive the TX requests.
  "local TX confirmations": u16  # Reference to the UDP socket used to send or receive the TX confirmations.
  "local RX indications": u16  # Reference to the UDP socket used to send or receive the RX indications.
  "local TX indications": u16  # Reference to the UDP socket used to send or receive the TX indications.
  "Packets dropped count": u32  # Numerical indicator shows the number of MAC MSDU TX requests written to the DMA FIFO.
  "Packets dropped": bool
types:
  T1 = enum{"RX1/RF 0", "RX2/RF 0", "RX1/RF 1", "RX2/RF 1"}
  "Subcarrier Format.gtype" = enum{"20 MHz (IEEE 802.11 a)", "20 MHz (IEEE 802.11 ac)", "40 MHz (IEEE 802.11 ac)", "80 MHz (IEEE 802.11 ac)"}
  T2 = cluster{"f0": f64, "df": f64, "magnitude": f64[]}
  T3 = cluster{"Timestamp": u32, "Transferred Bytes": u32}
  T4 = cluster{"fpga ref": any, "bus instance": u32, "instruction FIFO depth": u32, "executing on FPGA target": bool, "show error call chain": bool}
  T5 = cluster{"Actual Gain [dB]": f64, "Attenuation Table Index": i32}
  T6 = cluster{"Attenuation Table [dB]": f64[][], "Frequencies [Hz]": f64[], "IQ Imbalance Table": "IQ Imbalance.gtype"[], "Gain Table": T5[][]}
  "Register Bus Session.gtype" = Queue<"Session Data.gtype">
  "Semaphore.gtype" = i32
  "DB Queue Reference.gtype" = Queue<"Daughterboard Data.gtype">
  "niUsrpRio Session.gtype" = cluster{"FPGA Interface": any, "RIO Interface Number": u32, "Data Clock Rate": u32, "FPGA Data Clock Rate": u32, "Global Settings Register Bus": "Register Bus Session.gtype", "Radio 0 Settings Register Bus": "Register Bus Session.gtype", "Radio 1 Settings Register Bus": "Register Bus Session.gtype", "Radio Settings Bus Semaphore": "Semaphore.gtype", "DB Queues": "DB Queue Reference.gtype"[], "Characterization Data Valid?": bool, "EEPROM Header": "EEPROM Header.gtype", "Device Data Header": "EEPROM Device Data Header.gtype", "EEPROM Characterization Header": "EEPROM Characterization Header.gtype", "Characterization Data": "Characterization Data.gtype"[], "FPGA Current Version": u32, "FPGA Oldest Compatible Version": u32, "Fixed Logic Current Version": u32, "Fixed Logic Oldest Compatible Version": u32, "FPGA Radio Settings Bus Current Version": u32, "FPGA Radio Settings Bus Oldest Compatible Version": u32, "FPGA Board Config Current Version": u32, "FPGA Board Config Oldest Compatible Version": u32, "Daughterboard Clock Rate": u32}
  "Host Session.gtype" = cluster{"station number": u16, "FPGA interface": "FGPA Reference.gtype", "MAC High Requests": Queue<u8[]>, "MAC High Confirmations": Queue<u8[]>, "Triggered TX Requests": Queue<"TX Request Confirmation Reference Parameters.gtype">, "receive queue": Queue<u8[]>, "receive throughput queue": Queue<T3>, "UDP Receiver": UdpNetworkConnectionRefnum, "PN packet": u8[], "FlexRIO session": Queue<T4>, "FlexRIO TX Characterization Data": T6, "FlexRIO RX Characterization Data": T6, "USRP session": "niUsrpRio Session.gtype", "RF loop clock frequency": f64, "UDP Receiver TX Request": UdpNetworkConnectionRefnum, "UDP Receiver TX Confirmation": UdpNetworkConnectionRefnum, "UDP Receiver RX Indication": UdpNetworkConnectionRefnum, "UDP Sender": UdpNetworkConnectionRefnum}
  T7 = enum{"Off", "UDP", "PN Data", "Manual", "External"}
  T8 = cluster{"RTS MCS": UFXP(4.0), "CTS MCS": UFXP(4.0), "ACK MCS": UFXP(4.0)}
  "MAC RX Statistics.gtype" = cluster{"preamble detected": u32, "PSDUs received": u32, "MPDU CRC OK": u32, "RTS detected": u32, "CTS detected": u32, "Data detected": u32, "ACK detected": u32}
  "MAC TX Statistics.gtype" = cluster{"RTS triggered": u32, "CTS triggered": u32, "Data triggered": u32, "ACK triggered": u32}
  "Events Enable Mask.gtype" = cluster{"PHY TX start request": bool, "PHY TX end indication": bool, "PHY RX start indication": bool, "PHY RX end indication": bool, "PHY CCA timing indication": bool, "PHY RX gain change indication": bool, "DCF state indication": bool, "MAC MPDU RX indication": bool, "MAC MPDU TX request": bool}
  "Log Level.gtype" = enum{"Trace", "Debug", "Info", "Warn", "Error", "Fatal"}
  "Log Configuration.gtype" = cluster{"enabled": bool, "max log level": "Log Level.gtype"}
  "TX Status.gtype" = enum{"MPDU transmitted", "MPDU discarded"}
  "MAC TX End Indication.gtype" = cluster{"TX status": "TX Status.gtype", "number of transmission tries": u16, "valid": bool}
uses:
  AFW::Common::Create Stop Notifier.gvi
  AFW::802_11::Configuration::Host Init.gvi
  AFW::Common::Logging::Change Log Configuration.gvi
  AFW::802_11::RF Control::Mute TX RF Frontend.gvi
  AFW::802_11::RF Control::Abort RF Streams.gvi
  NI::G Core::Error::Legacy::Clear Errors.gvi
  AFW::802_11::RF Control::FPGA Target Configuration.gvi
  AFW::802_11::Configuration::Reset Statistics.gvi
  AFW::802_11::Configuration::Configure Static Parameters.gvi
  AFW::802_11::Configuration::Configure MAC Parameters.gvi
  AFW::802_11::Configuration::Configure RF.gvi
  AFW::802_11::Configuration::Channelization Visualization.gvi
  AFW::802_11::RF Control::Configure AGC Registers.gvi
  AFW::802_11::Configuration::Set Power Calibration Offset.gvi
  AFW::802_11::RF Control::Configure RF Streams.gvi
  AFW::802_11::Configuration::Configure Data Source.gvi
  AFW::802_11::Configuration::UDP Port Assignment.gvi
  AFW::802_11::Configuration::Configure Dynamic Parameters.gvi
  AFW::802_11::RX::FPGA AGC Control.gvi
  AFW::802_11::RX::Gain Control.gvi
  AFW::802_11::Conversion::Subcarrier Format to Configuration.gvi
  AFW::802_11::Conversion::MAC Address from String to Byte Array.gvi
  AFW::Common::Create Stop.gvi
  AFW::Common::Check Stop.gvi
  AFW::Common::Stop On Error.gvi
  AFW::802_11::Transmission::Receive UDP Data.gvi
  AFW::802_11::Transmission::Send PN Data.gvi
  AFW::802_11::Transmission::Send UDP Data.gvi
  AFW::802_11::Conversion::Prepare Constellation.gvi
  AFW::802_11::Conversion::Prepare RX Power Spectrum.gvi
  AFW::802_11::Conversion::Prepare TX Power Spectrum.gvi
  AFW::802_11::Conversion::Prepare Channel Estimation.gvi
  AFW::802_11::Conversion::Read T2H Overflows.gvi
  AFW::802_11::Conversion::Read Target Registers.gvi
  AFW::802_11::Conversion::Read Event FIFO.gvi
  AFW::802_11::Conversion::Log Events.gvi
  AFW::Common::Logging::Log Formatter.gvi
  AFW::802_11::Conversion::Prepare MAC TX and RX Statistics.gvi
  AFW::802_11::Conversion::Prepare Throughput Measurements.gvi
  AFW::802_11::Conversion::Prepare TX Block Error Rate Measurements.gvi
  AFW::802_11::MAC High Abstraction::Prepare MAC SAP TX Request.gvi
  AFW::802_11::MAC High Abstraction::MAC TX Request Confirm Abstraction.gvi
  AFW::802_11::MAC High Abstraction::Receive MAC RX Indications.gvi
  AFW::802_11::MAC High Abstraction::Clear and Log MAC Middle SAP errors.gvi
  NI::G Core::Error::Filter Error Code.gvi
  AFW::802_11::MAC Middle SAP::MAC SAP TX Request Confirmation Handler.gvi
  AFW::802_11::MAC Middle SAP::Generate MAC SAP TX Status Indication.gvi
  AFW::802_11::MAC Middle SAP::Generate MAC SAP RX Indication.gvi
  AFW::802_11::Configuration::Host Release.gvi
  NI::G Core::Error::Legacy::Simple Error Handler.gvi
diagram:
  w1 = ["MAC High Stub", "MAC Middle SAP"]  # Timed Loop Names
  sequence {
    frame 0 {
      $Events <- ""
      $"Device Ready" <- FALSE
      $"Station Active" <- FALSE
      $"Enable Station" <- FALSE
      $"Target FIFO Overflow" <- FALSE
      $"RX Constellation" <- c128[] []
      $"RX Power Spectrum" <- T2 {all zero or empty}
      $"TX Power Spectrum" <- T2 {all zero or empty}
      $"Channel Estimation" <- cluster{"Element 1": i32[], "Element 2": f64[]}[] []
      $"current TX packet error rate" <- 0
      $"current TX block error rate" <- 0
      $"RX Throughput [bits/s]" <- 0
      $"Compensated CFO" <- 0
      $"Averaged Retransmissions p. Packet" <- 0
      for (N = 51) {
        $"RX Throughput" <- NaN
        $"Averaged Retransmissions per Packet" <- NaN
      }
      Initialize Array(element=NaN, size=51, size=2) -> w2
      $"RF Input Power" <- w2
      $"Baseband RX Power" <- w2
      $"TX Error Rates" <- w2
      $"MAC RX statistics" <- "MAC RX Statistics.gtype" {all zero or empty}
      $"MAC TX statistics" <- "MAC TX Statistics.gtype" {all zero or empty}
    }
  }
  call "Create Stop Notifier.gvi"(error in=no error) -> (error out=w3)
  sequence {
    frame 0 {
      w4 = $"Reference Clock"
      w5 = $"RIO Device"
    }
  }
  call "Host Init.gvi"(device=w5, error in=w3, reference clock=w4) -> (session out=w6, error out=w7)
  case (w7) {
    frame Error {
      w8 = w7
    }
    frame No Error {
      $"Device Ready" <- TRUE
      $session <- w6
      w8 = w7
    }
  }
  Property Node(instance in="Log Configuration.gtype" {all zero or empty}, "enabled"=TRUE, "max log level"="Info") -> (instance out=w9)
  call "Change Log Configuration.gvi"(notification=w9, error in=w8) -> (error out=w10)
  s1 = w10  # shift register
  while {
    Feedback Node(input=$"Enable Station") -> w11
    Logical Exclusive Or($"Enable Station", w11) -> w12
    case (w12) {
      frame False, Default {
        w13 = s1
      }
      frame True {
        case ($"Enable Station") {
          frame False, Default {
            Property Node(instance in=$session) -> ("UDP Receiver"=w14, "FPGA interface"=w15, instance out=w16)
            sequence {
              frame 0 {
                $"Station Active" <- FALSE
              }
            }
            Property Node(instance in=w15, "station active"=FALSE, error in=s1) -> (error out=w17, instance out=w18)
            call "Mute TX RF Frontend.gvi"(session=w16, error in=w17) -> (session dup=w19, error out=w20)
            call "Abort RF Streams.gvi"(session in=w19, error in=w20, abort tx streams=TRUE, abort rx streams=FALSE) -> (session out=w21, error out=w22)
            Property Node(instance in=w18, "produce silent samples"=TRUE, "RX data source"="BB Data From Host", error in=w22) -> (error out=w23)
            sequence {
              frame 0 {
                Wait(time to wait=100)
              }
            }
            call "Abort RF Streams.gvi"(session in=w21, error in=w23, abort tx streams=TRUE, abort rx streams=FALSE) -> (error out=w24)
            Udp Close(connection ID=w14, error in=w24) -> (error out=w25)
            call "Clear Errors.gvi"(specific error code to clear=1, error in=w25) -> (error out=w13)
          }
          frame True {
            w26 = $"Station Number"
            Is Equal(x=$"Data Source", y="External") -> w27
            case ($"RF loop back demo mode") {
              frame True {
                w28 = 1
                w29 = 1
                w30 = "RF Loopback"
                w31 = 0x5000
              }
              frame False {
                w28 = $dot11LongRetryLimit
                w29 = $dot11ShortRetryLimit
                w30 = "RF Multi Station"
                w31 = $dot11RTSThreshold
              }
            }
            Property Node(instance in=$session, "station number"=w26) -> (instance out=w32)
            call "FPGA Target Configuration.gvi"(session=w32, error in=s1) -> (session dup=w33, TX advance=w34, error out=w35)
            call "Reset Statistics.gvi"(session in=w33, reset RX statistics=TRUE, reset TX statistics=TRUE, error in=w35) -> (session dup=w36, error out=w37)
            call "Configure Static Parameters.gvi"(TX advance=w34, session in=w36, error in=w37, operation mode=w30, primary channel selector=$"Primary Channel Selector") -> (session dup=w38, error out=w39)
            call "Configure MAC Parameters.gvi"(session in=w38, MAC address=$"Device MAC Address", dot11RTSThreshold=w31, control frame TX vector configuration=$"control frame TX vector configuration", error in=w39, dot11ShortRetryLimit=w29, dot11LongRetryLimit=w28) -> (session dup=w40, error out=w41)
            call "Configure RF.gvi"(session=w40, primary channel center frequency=$"Primary Channel Center Frequency", TX power level=$"Power Level", error in=w41, TX Port=$"TX RF Port", RX port=$"RX RF Port", primary channel selector=$"Primary Channel Selector") -> (RF center frequency=w42, coerced RX LO frequency=w43, coerced TX LO frequency=w44, session dup=w45, coerced TX power level=w46, coerced RX gain=w47, error out=w48)
            call "Channelization Visualization.gvi"(session=w45, primary channel selector=$"Primary Channel Selector", primary channel center frequency=$"Primary Channel Center Frequency", error in=w48) -> (session dup=w49, channelization=w50, error out=w51)
            call "Configure AGC Registers.gvi"(session=w49, error in=w51, RX port=$"RX RF Port", TX Port=$"TX RF Port") -> (session dup=w52, error out=w53)
            call "Set Power Calibration Offset.gvi"(session=w52, frequency=$"Primary Channel Center Frequency", error in=w53, RX port=$"RX RF Port") -> (session dup=w54, error out=w55)
            call "Configure RF Streams.gvi"(session=w54, error in=w55, RX port=$"RX RF Port", TX port=$"TX RF Port") -> (session dup=w56, error out=w57)
            call "Configure Data Source.gvi"(session in=w56, error in=w57, external mode=w27) -> (session out=w58, success?=w59, error out=w13)
            sequence {
              frame 0 {
                $session <- w58
                call "UDP Port Assignment.gvi"(station number=w26, external mode=w27) -> (UDP data=w60, TX requests=w61, local TX confirmations=w62, local RX indications=w63, local TX indications=w64)
              }
              frame 1 {
                $"Enable Station" <- w59
                $"Station Active" <- w59
                $"Receive Port" <- w60
                $"TX requests" <- w61
                $"local TX confirmations" <- w62
                $"local TX indications" <- w64
                $"local RX indications" <- w63
              }
            }
            $Channelization <- w50
            $"Coerced Power Level" <- w46
            $"Applied RX Gain" <- w47
            $"Coerced LO frequency TX" <- w44
            $"Coerced LO frequency RX" <- w43
            $"RF Frequency" <- w42
          }
        }
      }
    }
    # configuration
    Feedback Node(input=$"Station Active") -> w65
    case ($"Station Active") {
      frame False, Default {
        w66 = s1
      }
      frame True {
        Is Not Equal(x=$"Station Active", y=w65) -> w67
        Property Node(instance in=$session) -> ("FPGA interface"=w68, instance out=w69)
        Select(s=$"RF loop back demo mode", t=0, f=$Backoff) -> w70
        To Double Precision Float(number=$"AGC target signal power") -> w71
        call "Configure Dynamic Parameters.gvi"(AGC target signal power=w71, FPGA interface=w68, backoff=w70, error in=s1, CCA energy detection threshold=$"CCA Energy Detection Threshold", event enable mask=$"FPGA events to track") -> (error out=w72)
        call "FPGA AGC Control.gvi"(session=w69, AGC=$AGC, initialize=w67, error in=w72, RX Port (USRP only)=$"RX RF Port") -> (session dup=w73, force host AGC update=w74, error out=w75)
        call "Gain Control.gvi"(Manual RX gain [dB]=$"Manual RX gain", initialize=w67, session=w73, force update=w74, AGC=$AGC, error in=w75, RX Port (USRP only)=$"RX RF Port") -> (Applied RX Gain [dB]=w76, error out=w66)
        $"Applied RX Gain" <- w76
      }
    }
    call "Reset Statistics.gvi"(session in=$session, reset RX statistics=$"reset RX staistics", reset TX statistics=$"reset TX staistics", error in=s1) -> (error out=w77)
    call "Subcarrier Format to Configuration.gvi"(MCS=$MCS, Subcarrier Format=$"Subcarrier Format", error in=w77) -> (modulation and coding rate=w78, error out=w79)
    call "MAC Address from String to Byte Array.gvi"(error in=w79, MAC address in=$"Device MAC Address") -> (error out=w80, MAC address valid=w81)
    call "MAC Address from String to Byte Array.gvi"(error in=w80, MAC address in=$"Destination MAC Address") -> (error out=w82, MAC address valid=w83)
    Merge Errors(w66, w13, w82) -> (error out=w84)
    # disable station in last loop run and assert stop
    Feedback Node(input=$Stop) -> w85
    call "Create Stop.gvi"(error in=w84, stop in=w85, timed loop name array=w1) -> (error out=w86)
    call "Check Stop.gvi"(error in=w86) -> (error out=w87, stop=w88)
    case ($Stop) {
      frame False, Default { }
      frame True {
        $"Enable Station" <- FALSE
      }
    }
    Wait Until Next Multiple(multiple to wait=100)
    $valid <- w81
    $valid <- w83
    $"modulation and coding rate" <- w78
    next s1 = w87
    stop if w88
  }
  call "Stop On Error.gvi"(error in=s1) -> (error out=w89)
  s2 = w10  # shift register
  while {
    # data source and sink
    # (UDP send and receive)
    case ($"Station Active") {
      frame False, Default {
        w90 = s2
      }
      frame True {
        Property Node(instance in=$session) -> ("UDP Receiver"=w91, "MAC High Requests"=w92, "PN packet"=w93, "UDP Sender"=w94, "receive queue"=w95)
        Array Subset(array=w93, length0=$"PN Data Packet Size") -> w96
        case ($"Data Source") {
          frame "Off", "External" {
            w97 = s2
            w98 = FALSE
            w99 = FALSE
            w100 = 0
          }
          frame "UDP" {
            # UDP
            call "Receive UDP Data.gvi"(UDP receiver=w91, send queue=w92, error in=s2) -> (data transfer=w98, error out=w97, FIFO full=w99, num packets=w100)
          }
          frame "PN Data" {
            # PN data
            call "Send PN Data.gvi"(PN packets per second=$"PN Packets per Second", send queue=w92, PN data=w96, error in=s2) -> (data transfer=w98, error out=w97, FIFO full=w99, num packets=w100)
          }
          frame "Manual" {
            # Manual
            case ($"Trigger TX") {
              frame False, Default {
                w97 = s2
                w98 = $"Trigger TX"
                w99 = default
                w100 = default
              }
              frame True {
                Enqueue Element(element=w96, error in=s2, queue=w92, timeout in ms=0) -> (error out=w97, queue out=w101, timed out?=w99)
                w98 = $"Trigger TX"
                w100 = 1
              }
            }
          }
        }
        $"Data Transfer" <- w98
        $"FIFO Full" <- w99
        Is Not Equal To 0(x=w100) -> w102
        $"transfer source" <- w102
        Feedback Node(input=w103) -> w104
        Add(w100, w104) -> w103
        $"num packets source" <- w103
        Is Equal(x=$"Data Sink", y="UDP") -> w105
        call "Send UDP Data.gvi"(target port=$"Transmit Port", target IP address=$"Transmit IP Address", receive queue=w95, UDP sender=w94, enable=w105, error in=s2) -> (DNS resolve failed=w106, FIFO full=w107, error out=w108, data transfer=w109, num packets=w110)
        $"Data Transfer" <- w109
        $"FIFO Full" <- w107
        Is Not Equal To 0(x=w110) -> w111
        $"transfer sink" <- w111
        Merge Errors(w97, w108) -> (error out=w90)
        Feedback Node(input=w112) -> w113
        Add(w110, w113) -> w112
        $"num packets sink" <- w112
        case (w106) {
          frame False, Default { }
          frame True {
            $"Data Sink" <- "Off"
            w114 = "DNS resolve of Transmit IP Address failed, disabled Data Sink"
            One Button Dialog(message=w114)
          }
        }
      }
    }
    call "Check Stop.gvi"(error in=w90) -> (error out=w115, stop=w116)
    Wait Until Next Multiple(multiple to wait=1)
    next s2 = w115
    stop if w116
  }
  call "Stop On Error.gvi"(error in=s2) -> (error out=w117)
  s3 = w10  # shift register
  s4 = string[] []  # shift register
  s5 = uninitialised  # shift register
  while (iteration -> i1) {
    Property Node(instance in=$session) -> ("FPGA interface"=w118)
    Quotient And Remainder(x=i1, y=5) -> (x-y*floor(x/y)=w119)
    # update plots and indicators (slow)
    case (w119) {
      frame 0, Default {
        call "Prepare Constellation.gvi"(FPGA interface=w118, maximal number of subcarriers=4800, error in=s3) -> (data field constellation=w123, update constellation=w124, error out=w120)
        Logical And($"Station Active", w124) -> w125
        case (w125) {
          frame False { }
          frame True {
            $"RX Constellation" <- w123
          }
        }
        w121 = s4
        w122 = s5
      }
      frame 1 {
        call "Prepare RX Power Spectrum.gvi"(FPGA interface=w118, error in=s3) -> (RX power spectrum=w126, update power spectrum=w127, error out=w120)
        Logical And($"Station Active", w127) -> w128
        case (w128) {
          frame False, Default { }
          frame True {
            $"RX Power Spectrum" <- w126
          }
        }
        w121 = s4
        w122 = s5
      }
      frame 2 {
        call "Prepare TX Power Spectrum.gvi"(FPGA interface=w118, error in=s3) -> (TX power spectrum=w129, update power spectrum=w130, error out=w120)
        Logical And($"Station Active", w130) -> w131
        case (w131) {
          frame False, Default { }
          frame True {
            $"TX Power Spectrum" <- w129
          }
        }
        w121 = s4
        w122 = s5
      }
      frame 3 {
        call "Prepare Channel Estimation.gvi"(FPGA interface=w118, error in=s3) -> (channel estimation=w132, update power spectrum=w133, error out=w120)
        Logical And($"Station Active", w133) -> w134
        case (w134) {
          frame False, Default { }
          frame True {
            $"Channel Estimation" <- w132
          }
        }
        w121 = s4
        w122 = s5
      }
      frame 4 {
        call "Read T2H Overflows.gvi"(FPGA interface=w118, error in=s3) -> (TX end indication overflow count=w135, T2H RX Data overflow=w136, error out=w137)
        $"TX Indication Overflow Count" <- w135
        Is Not Equal To 0(x=w135) -> w138
        $"TX Indication Overflow" <- w138
        $"RX Indication Overflow Count" <- w136
        Is Not Equal To 0(x=w136) -> w139
        $"RX Indication Overflow" <- w139
        call "Read Target Registers.gvi"(FPGA interface=w118, error in=s3, station active=$"Station Active") -> (MAC TX statistics=w140, MAC RX statistics=w141, target FIFO overflow=w142, compensated CFO=w143, RF input power=w144, baseband signal power=w145, error out=w146)
        w147 = 10000  # max log entries
        call "Read Event FIFO.gvi"(FPGA interface=w118, error in=s3) -> (FPGA interface dup=w148, raw events=w149, error out=w150)
        call "Log Events.gvi"(FPGA interface=w148, raw event data=w149, error in=w150, maximal number of log entries=w147) -> (dropped events=w151, error out=w152)
        call "Log Formatter.gvi"(error in=w152) -> (error out=w153, log entries=w154)
        Feedback Node(input=$"write to file") -> w155
        Is Not Equal(x=$"write to file", y=w155) -> w156
        case (w156) {
          frame False, Default {
            w157 = s5
            w158 = s3
          }
          frame True {
            case ($"write to file") {
              frame False, Default {
                Close File(error in=s3, refnum=s5) -> (error out=w158)
                w157 = default
              }
              frame True {
                Get Component Directory() -> (Path=w159)
                Get Current Time() -> (current time=w160)
                Format Date Time String(time format string (%c)="_%Y-%m-%d_%H-%M-%S", time stamp=w160) -> (date/time string=w161)
                Concatenate Strings($"log file prefix", w161, ".txt") -> w162
                Build Path(base path=w159, name or relative path=w162) -> (appended path=w163)
                # reopen file if file name changed
                Open Or Create Or Replace File(access (0:read/write)="write-only", error in=s3, file path (use dialog)=w163, operation (0:open)="replace or create") -> (error out=w158, refnum out=w157)
              }
            }
          }
        }
        case (w151) {
          frame False, Default {
            w164 = w154
          }
          frame True {
            Array Subset(array=w154, index0=1) -> w165
            Build Array("(...)\n", w165) -> w164
          }
        }
        case ($"write to file") {
          frame False, Default {
            w122 = w157
            w166 = w158
          }
          frame True {
            Concatenate Strings(w164) -> w167
            Write To Text File(error in=w158, file (use dialog)=w157, text=w167) -> (error out=w166, refnum out=w122)
          }
        }
        Merge Errors(w137, w146, w153, w166) -> (error out=w120)
        $"Target FIFO Overflow" <- w142
        $"Compensated CFO" <- w143
        $"RF Input Power" <- w144
        $"Baseband RX Power" <- w145
        Array Index(array=w145) -> (out0[0, 1]=w168)
        $"Baseband RX Power [dBFS]" <- w168
        Quotient And Remainder(x=i1, y=20) -> (x-y*floor(x/y)=w169)
        Is Equal To 0(x=w169) -> w170
        call "Prepare MAC TX and RX Statistics.gvi"(MAC RX statistics in=w141, MAC TX statistics in=w140, values per second=$"values per second", 1s passed=w170) -> (MAC RX statistics out=w171, MAC TX statistics out=w172)
        $"MAC RX statistics" <- w171
        $"MAC TX statistics" <- w172
        Build Array(s4, w164) -> w173
        Array Size(array=w173) -> (size(s)=w174)
        Is Greater(x=w174, y=w147) -> w175
        case (w175) {
          frame False, Default {
            w176 = w173
          }
          frame True {
            Decrement(x=w147) -> w177
            Delete From Array(inArray=w173, length (1)=w177) -> (deleted=w178)
            case (w151) {
              frame True {
                w176 = w178
              }
              frame False {
                Build Array("(...)\n", w178) -> w176
              }
            }
          }
        }
        Select(s=$"Clear events", t=string[] [], f=w176) -> w121
        Concatenate Strings(w176) -> w179
        $Events <- w179
        Select(s=$None, t="Events Enable Mask.gtype" {all zero or empty}, f=$"FPGA events to track") -> w180
        w181 = "Events Enable Mask.gtype" {"PHY TX start request"=TRUE, "PHY TX end indication"=TRUE, "PHY RX start indication"=TRUE, "PHY RX end indication"=TRUE, "PHY CCA timing indication"=TRUE, "PHY RX gain change indication"=TRUE, "DCF state indication"=TRUE, "MAC MPDU RX indication"=TRUE, "MAC MPDU TX request"=TRUE}
        Select(s=$All, t=w181, f=w180) -> w182
        $"FPGA events to track" <- w182
      }
    }
    call "Check Stop.gvi"(error in=w120) -> (error out=w183, stop=w184)
    Wait(time to wait=50)
    next s3 = w183
    next s4 = w121
    next s5 = w122
    stop if w184
  }
  Is Not A Number Or Path Or Refnum(number=s5) -> w185
  # close file if the reference still exists
  case (w185) {
    frame True {
      w186 = s3
    }
    frame False {
      Close File(error in=s3, refnum=s5) -> (error out=w186)
    }
  }
  call "Stop On Error.gvi"(error in=w186) -> (error out=w187)
  Obtain Queue(element data type="MAC TX End Indication.gtype" {all zero or empty}, error in=w10) -> (error out=w188, queue out=w189)
  s6 = w188  # shift register
  while {
    Feedback Node(input=$"Station Active") -> w190
    Is Not Equal(x=$"Station Active", y=w190) -> w191
    # update plots and indicators (fast)
    case ($"Station Active") {
      frame False, Default {
        w192 = s6
      }
      frame True {
        Property Node(instance in=$session) -> ("FPGA interface"=w193, "receive throughput queue"=w194)
        call "Prepare Throughput Measurements.gvi"(FPGA interface=w193, receive throughput queue=w194, reset=w191, error in=s6, timing granularity=100) -> (RX throughput=w195, error out=w196)
        Flush Queue(error in=w196, queue=w189) -> (error out=w192, remaining elements=w197)
        call "Prepare TX Block Error Rate Measurements.gvi"(TX Status and retransmission data=w197) -> (current TX packet error rate=w198, current TX block error rate=w199, TX Error Rates=w200, averaged retransmissions per packet=w201)
        $"current TX packet error rate" <- w198
        $"current TX block error rate" <- w199
        $"TX Error Rates" <- w200
        $"Averaged Retransmissions per Packet" <- w201
        $"Averaged Retransmissions p. Packet" <- w201
        $"RX Throughput [bits/s]" <- w195
        Divide(x=w195, y=1000000) -> w202
        $"RX Throughput" <- w202
      }
    }
    call "Check Stop.gvi"(error in=w192) -> (error out=w203, stop=w204)
    Wait(time to wait=100)
    next s6 = w203
    stop if w204
  }
  call "Stop On Error.gvi"(error in=s6) -> (error out=w205)
  Array Index(array=w1) -> (out0[_]=w206, out1[_]=w207)
  disable {
    frame TARGET_TYPE == "RT" {
      timed loop forever {
        Left Execution System Border Node(priority_in=100)
        Left Timing Statistics Border Node()
        Left Timing Source Border Node[AlarmName=L, DefaultTimingSourceName="1 kHz", DefaultTimingSourceType=1](period_in=1, structure_in=w206)
        Left Timing Error Border Node(error_in=w10) -> (error_out=w210)
        # MAC High Stub
        Is Not Equal(x=$"Data Source", y="External") -> w211
        Logical And(w211, $"Station Active") -> w212
        case (w212) {
          frame False, Default {
            w213 = w210
          }
          frame True {
            w214 = $session
            Property Node(instance in=w214) -> ("MAC High Requests"=w215)
            Flush Queue(error in=w210, queue=w215) -> (error out=w216, remaining elements=w217)
            Array Subset(array=w217, length0=30) -> w218
            s7 = w216  # shift register
            for (iteration -> i2) {
              w219 = each element of w218
              Property Node(instance in=w214) -> ("station number"=w220, "UDP Sender"=w221)
              Property Node(instance in=w219) -> ("Element 0"=w222)
              Select(s=$"RF loop back demo mode", t=$"Device MAC Address", f=$"Destination MAC Address") -> w223
              call "Prepare MAC SAP TX Request.gvi"(payload=w222, subcarrier format=$"Subcarrier Format", MCS=$MCS, error in=s7, device MAC address=$"Device MAC Address", destination MAC address=w223) -> (MSDU TX parameters=w224, PHY TX parameters=w225, MSDU TX payload=w226, error out=w227)
              To Unsigned 8 Bit Integer(number=w220) -> w228
              call "MAC TX Request Confirm Abstraction.gvi"(UDP connection ID in=w221, MSDU TX parameters=w224, PHY TX parameters=w225, MSDU TX payload=w226, error in=w227, instance ID=w228) -> (error out=w229)
              Increment(x=i2) -> w230
              To Unsigned 32 Bit Integer(number=w230) -> w231
              Property Node(instance in=cluster{"Config": u32, "Payload": u32} {all zero or empty}, "Config"=w231, "Payload"=w231) -> (instance out=w232)
              next s7 = w229
            }
            Property Node(instance in=w214) -> ("receive queue"=w233, "UDP Receiver RX Indication"=w234, "FPGA interface"=w235)
            Property Node(instance in=w235, error in=w210) -> ("device bandwidth"=w236, error out=w237)
            s8 = w237  # shift register
            while {
              call "Receive MAC RX Indications.gvi"(UDP interface in=w234, error in=s8, device bandwidth=w236) -> (MSDU data=w239, MSDU data valid=w240, timeout=w241, error out=w242)
              case (w240) {
                frame False, Default {
                  w243 = w242
                }
                frame True {
                  Enqueue Element(element=w239, error in=w242, queue=w233, timeout in ms=-1) -> (error out=w243)
                }
              }
              call "Clear and Log MAC Middle SAP errors.gvi"(error in=w243) -> (error out=w244)
              append TRUE to w238 if w240
              next s8 = w244
              stop if w241
            }
            Merge Errors(s7, s8) -> (error out=w213)
            Feedback Node(input=w245) -> w246
            Add(w232, w246) -> w245
            $"TX Request High MAC" <- w245
            Array Size(array=w238) -> (size(s)=w247)
            To Unsigned 32 Bit Integer(number=w247) -> w248
            Feedback Node(input=w249) -> w250
            Add(w248, w250) -> w249
            $"RX Indications High MAC" <- w249
          }
        }
        Right Timing Error Border Node(error_in=w213) -> (error_out=w251)
      }
      call "Filter Error Code.gvi"(code to clear=-816, error in=w251) -> (error out=w208)
      timed loop forever {
        Left Execution System Border Node(priority_in=100)
        Left Timing Statistics Border Node()
        Left Timing Source Border Node[AlarmName=L, DefaultTimingSourceName="1 kHz", DefaultTimingSourceType=1](period_in=1, structure_in=w207)
        Left Timing Error Border Node(error_in=w10) -> (error_out=w252)
        # Middle MAC SAP
        case ($"Station Active") {
          frame False, Default {
            w253 = w252
          }
          frame True {
            Property Node(instance in=$session) -> ("station number"=w254, "FPGA interface"=w255, "UDP Receiver TX Request"=w256, "UDP Sender"=w257, "Triggered TX Requests"=w258, "receive throughput queue"=w259)
            Is Equal(x=$"Data Source", y="External") -> w260
            To Unsigned 8 Bit Integer(number=w254) -> w261
            call "MAC SAP TX Request Confirmation Handler.gvi"(FPGA interface=w255, UDP connection TX request=w256, UDP send connection=w257, TX request confirmation reference queue in=w258, error in=w252, instance ID=w261, external mode=w260) -> (num TX Request=w262, num TX Confirmation=w263, num packets to FPGA=w264, num packets dropped=w265, error out=w266)
            $"TX Request Middle MAC" <- w262
            $"TX Confirmation Middle MAC" <- w263
            $"TX Requests to PHY" <- w264
            $"Packets dropped count" <- w265
            Feedback Node(input=w265) -> w267
            Is Not Equal(x=w265, y=w267) -> w268
            $"Packets dropped" <- w268
            call "Generate MAC SAP TX Status Indication.gvi"(FPGA interface=w255, TX request confirmation reference queue in=w258, UDP send connection=w257, TX status and retransmission queue=w189, error in=w252, instance ID=w261, external mode=w260) -> (num indications received=w269, num indications triggered=w270, error out=w271)
            call "Generate MAC SAP RX Indication.gvi"(FPGA interface=w255, receive throughput queue=w259, UDP send connection=w257, error in=w252, instance ID=w261, external mode=w260) -> (num indications received=w272, num indications triggered=w273, error out=w274)
            Merge Errors(w266, w271, w274) -> (error out=w253)
            $"TX Indications from PHY" <- w269
            $"TX Indications Middle MAC" <- w270
            $"RX Indications from PHY" <- w272
            $"RX Indications Middle MAC" <- w273
          }
        }
        Right Timing Error Border Node(error_in=w253) -> (error_out=w275)
      }
      call "Filter Error Code.gvi"(code to clear=-816, error in=w275) -> (error out=w209)
    }
    frame TARGET_TYPE != "RT", Default {
      s9 = w10  # shift register
      while {
        # MAC High Stub
        Is Not Equal(x=$"Data Source", y="External") -> w276
        Logical And(w276, $"Station Active") -> w277
        case (w277) {
          frame False, Default {
            w278 = s9
          }
          frame True {
            w279 = $session
            Property Node(instance in=w279) -> ("MAC High Requests"=w280)
            Flush Queue(error in=s9, queue=w280) -> (error out=w281, remaining elements=w282)
            Array Subset(array=w282, length0=200) -> w283
            s10 = w281  # shift register
            for (iteration -> i3) {
              w284 = each element of w283
              Property Node(instance in=w279) -> ("station number"=w285, "UDP Sender"=w286)
              Property Node(instance in=w284) -> ("Element 0"=w287)
              Select(s=$"RF loop back demo mode", t=$"Device MAC Address", f=$"Destination MAC Address") -> w288
              call "Prepare MAC SAP TX Request.gvi"(payload=w287, subcarrier format=$"Subcarrier Format", MCS=$MCS, error in=s10, device MAC address=$"Device MAC Address", destination MAC address=w288) -> (MSDU TX parameters=w289, PHY TX parameters=w290, MSDU TX payload=w291, error out=w292)
              To Unsigned 8 Bit Integer(number=w285) -> w293
              call "MAC TX Request Confirm Abstraction.gvi"(UDP connection ID in=w286, MSDU TX parameters=w289, PHY TX parameters=w290, MSDU TX payload=w291, error in=w292, instance ID=w293) -> (error out=w294)
              Increment(x=i3) -> w295
              To Unsigned 32 Bit Integer(number=w295) -> w296
              Property Node(instance in=cluster{"Config": u32, "Payload": u32} {all zero or empty}, "Config"=w296, "Payload"=w296) -> (instance out=w297)
              next s10 = w294
            }
            Property Node(instance in=w279) -> ("receive queue"=w298, "UDP Receiver RX Indication"=w299, "FPGA interface"=w300)
            Property Node(instance in=w300, error in=s9) -> ("device bandwidth"=w301, error out=w302)
            s11 = w302  # shift register
            for (N = 200) {
              call "Receive MAC RX Indications.gvi"(UDP interface in=w299, error in=s11, device bandwidth=w301) -> (MSDU data=w304, MSDU data valid=w305, timeout=w306, error out=w307)
              case (w305) {
                frame False, Default {
                  w308 = w307
                }
                frame True {
                  Enqueue Element(element=w304, error in=w307, queue=w298, timeout in ms=-1) -> (error out=w308)
                }
              }
              call "Clear and Log MAC Middle SAP errors.gvi"(error in=w308) -> (error out=w309)
              append TRUE to w303 if w305
              next s11 = w309
              stop if w306
            }
            Merge Errors(s10, s11) -> (error out=w278)
            Feedback Node(input=w310) -> w311
            Add(w297, w311) -> w310
            $"TX Request High MAC" <- w310
            Array Size(array=w303) -> (size(s)=w312)
            To Unsigned 32 Bit Integer(number=w312) -> w313
            Feedback Node(input=w314) -> w315
            Add(w313, w315) -> w314
            $"RX Indications High MAC" <- w314
          }
        }
        call "Check Stop.gvi"(error in=w278) -> (error out=w316, stop=w317)
        Wait(time to wait=10)
        next s9 = w316
        stop if w317
      }
      s12 = w10  # shift register
      while {
        Wait(time to wait=10)
        # Middle MAC SAP
        case ($"Station Active") {
          frame False, Default {
            w318 = s12
          }
          frame True {
            Property Node(instance in=$session) -> ("station number"=w319, "FPGA interface"=w320, "UDP Receiver TX Request"=w321, "UDP Sender"=w322, "Triggered TX Requests"=w323, "receive throughput queue"=w324)
            Is Equal(x=$"Data Source", y="External") -> w325
            To Unsigned 8 Bit Integer(number=w319) -> w326
            call "MAC SAP TX Request Confirmation Handler.gvi"(FPGA interface=w320, UDP connection TX request=w321, UDP send connection=w322, TX request confirmation reference queue in=w323, error in=s12, instance ID=w326, external mode=w325) -> (num TX Request=w327, num TX Confirmation=w328, num packets to FPGA=w329, num packets dropped=w330, error out=w331)
            $"TX Request Middle MAC" <- w327
            $"TX Confirmation Middle MAC" <- w328
            $"TX Requests to PHY" <- w329
            $"Packets dropped count" <- w330
            Feedback Node(input=w330) -> w332
            Is Not Equal(x=w330, y=w332) -> w333
            $"Packets dropped" <- w333
            call "Generate MAC SAP TX Status Indication.gvi"(FPGA interface=w320, TX request confirmation reference queue in=w323, UDP send connection=w322, TX status and retransmission queue=w189, error in=s12, instance ID=w326, external mode=w325) -> (num indications received=w334, num indications triggered=w335, error out=w336)
            call "Generate MAC SAP RX Indication.gvi"(FPGA interface=w320, receive throughput queue=w324, UDP send connection=w322, error in=s12, instance ID=w326, external mode=w325) -> (num indications received=w337, num indications triggered=w338, error out=w339)
            Merge Errors(w331, w336, w339) -> (error out=w318)
            $"TX Indications from PHY" <- w334
            $"TX Indications Middle MAC" <- w335
            $"RX Indications from PHY" <- w337
            $"RX Indications Middle MAC" <- w338
          }
        }
        call "Check Stop.gvi"(error in=w318) -> (error out=w340, stop=w341)
        next s12 = w340
        stop if w341
      }
      call "Stop On Error.gvi"(error in=s12) -> (error out=w209)
      w208 = s9
    }
  }
  call "Stop On Error.gvi"(error in=w208) -> (error out=w342)
  call "Stop On Error.gvi"(error in=w209) -> (error out=w343)
  Merge Errors(w89, w117, w187, w205, w342, w343) -> (error out=w344)
  sequence {
    frame 0 {
      w345 = $session
    }
  }
  call "Host Release.gvi"(session=w345, error in=w344) -> (error out=w346)
  call "Simple Error Handler.gvi"(type of dialog="OK message", error in=w346)
