vi "Close Device.gvi"   [LabVIEW NXG 4.0.0]
# Closes the niUsrpRio session to the device.
inputs:
  "niusrprio session in": "niUsrpRio Session.gtype", required
  "error in": error
outputs:
  "error out": error
types:
  "Register Bus Session.gtype" = Queue<"Session Data.gtype">
  "Semaphore.gtype" = i32
  "DB Queue Reference.gtype" = Queue<"Daughterboard Data.gtype">
  "EEPROM Header.gtype" = cluster{"Checksum": u32, "Product Code": u16, "Hardware Current Version": u16, "Hardware Oldest Compatible Version": u16, "EEPROM Map Current Version": u16, "EEPROM Map Oldest Compatible Version": u16, "User Password": string, "Pointer to Factory Header": u32, "Pointer to User Header": u32, "Recommended Interval": u16, "Number of Reserved Bytes": i32, "Number of Daughterboards": u8, "Daughterboard IDs": u16[], "Daughterboard Serial Numbers": string[]}
  "EEPROM Device Data Header.gtype" = cluster{"Checksum": u32, "Number of Channels": u8, "Number of Gain Settings": u16[], "Pointer to Characterization Data": u32[], "Number of Reserved Bytes": i32, "Number of Frequencies": u16[]}
  "EEPROM Characterization Header.gtype" = cluster{"Checksum": u32, "Date": timestamp, "Temperature": f32, "Misc. Info": string, "Pointer to Device Data Header": u32, "Number of Reserved Bytes": i32}
  "Characterization Data.gtype" = cluster{"Gains[dB]": f64[], "Frequencies [Hz]": f64[], "IQ Imbalance Table": "IQ Imbalance.gtype"[], "Measured Gains[dB]": f64[][]}
  "niUsrpRio Session.gtype" = cluster{"FPGA Interface": any, "RIO Interface Number": u32, "Data Clock Rate": u32, "FPGA Data Clock Rate": u32, "Global Settings Register Bus": "Register Bus Session.gtype", "Radio 0 Settings Register Bus": "Register Bus Session.gtype", "Radio 1 Settings Register Bus": "Register Bus Session.gtype", "Radio Settings Bus Semaphore": "Semaphore.gtype", "DB Queues": "DB Queue Reference.gtype"[], "Characterization Data Valid?": bool, "EEPROM Header": "EEPROM Header.gtype", "Device Data Header": "EEPROM Device Data Header.gtype", "EEPROM Characterization Header": "EEPROM Characterization Header.gtype", "Characterization Data": "Characterization Data.gtype"[], "FPGA Current Version": u32, "FPGA Oldest Compatible Version": u32, "Fixed Logic Current Version": u32, "Fixed Logic Oldest Compatible Version": u32, "FPGA Radio Settings Bus Current Version": u32, "FPGA Radio Settings Bus Oldest Compatible Version": u32, "FPGA Board Config Current Version": u32, "FPGA Board Config Oldest Compatible Version": u32, "Daughterboard Clock Rate": u32}
uses:
  NI::USRPRIO::ConfigV1Host::Query Status.gvi
  AFW::802_11::RF Control::Abort Stream.gvi
  NI::USRPRIO::ConfigV1Host::Enable Front End.gvi
  NI::USRPRIO::ConfigV1Host::Advanced Configure Power and Mixer.gvi
  NI::USRPRIO::ConfigV1Host::Close.gvi
diagram:
  call "Query Status.gvi"(niusrprio session in=$"niusrprio session in", what to query for="Data Clock PLL Lock Status", scope="") -> (niusrprio session out=w1, status=w2, error out=w3)
  Merge Errors($"error in", w3) -> (error out=w4)
  case (w2) {
    frame False, Default {
      w5 = w1
      w6 = w4
    }
    frame True {
      call "Abort Stream.gvi"(niusrprio session in=w1, scope="rx") -> (niusrprio session out=w7, error out=w8)
      call "Abort Stream.gvi"(niusrprio session in=w7, scope="tx") -> (niusrprio session out=w5, error out=w9)
      Merge Errors(w4, w8, w9) -> (error out=w6)
    }
  }
  call "Enable Front End.gvi"(niusrprio session in=w5, enable=FALSE, scope="rx") -> (niusrprio session out=w10, error out=w11)
  call "Enable Front End.gvi"(niusrprio session in=w10, enable=FALSE, scope="tx") -> (niusrprio session out=w12, error out=w13)
  # Unconditionally abort the stream and turn off the device's front end--without losing error information--assuming the Data Clock is valid.
  s1 = w12  # shift register
  for {
    w14 = each element of ["all/RF 0", "all/RF 1"]
    s2 = s1  # shift register
    for {
      w16 = each element of [64, 68, 72, 76]
      call "Advanced Configure Power and Mixer.gvi"(niusrprio session in=s2, atr register=w16, power enable=FALSE, mixer enable=FALSE, scope=w14) -> (niusrprio session out=w18, error out=w19)
      append w19 to w17
      next s2 = w18
    }
    concatenate w17 onto w15
    next s1 = s2
  }
  Merge Errors(w6, w11, w13, w15) -> (error out=w20)
  call "Close.gvi"(niusrprio session in=s1, error in=w20) -> (fpga ref=w21, error out=w22)
  FPGA Close Node(abort?=FALSE, error in=w22, reference in=w21) -> (error out=w23)
  $"error out" <- w23
