vi "Configure AGC Registers.gvi"   [LabVIEW NXG 4.0.0]
# Configures the automatic gain control registers on the FPGA and starts or stops the AGC.
inputs:
  "TX Port": enum{"TX1/RF 0", "TX1/RF 1"} = "TX1/RF 0"
  "session": "Host Session.gtype"
  "RX port": T1 = "RX2/RF 1"
  "error in": error
outputs:
  "error out": error
  "session dup": "Host Session.gtype"
types:
  T1 = enum{"RX1/RF 0", "RX2/RF 0", "RX1/RF 1", "RX2/RF 1"}
  T2 = cluster{"Timestamp": u32, "Transferred Bytes": u32}
  T3 = cluster{"fpga ref": any, "bus instance": u32, "instruction FIFO depth": u32, "executing on FPGA target": bool, "show error call chain": bool}
  T4 = cluster{"Actual Gain [dB]": f64, "Attenuation Table Index": i32}
  T5 = cluster{"Attenuation Table [dB]": f64[][], "Frequencies [Hz]": f64[], "IQ Imbalance Table": "IQ Imbalance.gtype"[], "Gain Table": T4[][]}
  "Register Bus Session.gtype" = Queue<"Session Data.gtype">
  "Semaphore.gtype" = i32
  "DB Queue Reference.gtype" = Queue<"Daughterboard Data.gtype">
  "niUsrpRio Session.gtype" = cluster{"FPGA Interface": any, "RIO Interface Number": u32, "Data Clock Rate": u32, "FPGA Data Clock Rate": u32, "Global Settings Register Bus": "Register Bus Session.gtype", "Radio 0 Settings Register Bus": "Register Bus Session.gtype", "Radio 1 Settings Register Bus": "Register Bus Session.gtype", "Radio Settings Bus Semaphore": "Semaphore.gtype", "DB Queues": "DB Queue Reference.gtype"[], "Characterization Data Valid?": bool, "EEPROM Header": "EEPROM Header.gtype", "Device Data Header": "EEPROM Device Data Header.gtype", "EEPROM Characterization Header": "EEPROM Characterization Header.gtype", "Characterization Data": "Characterization Data.gtype"[], "FPGA Current Version": u32, "FPGA Oldest Compatible Version": u32, "Fixed Logic Current Version": u32, "Fixed Logic Oldest Compatible Version": u32, "FPGA Radio Settings Bus Current Version": u32, "FPGA Radio Settings Bus Oldest Compatible Version": u32, "FPGA Board Config Current Version": u32, "FPGA Board Config Oldest Compatible Version": u32, "Daughterboard Clock Rate": u32}
  "Host Session.gtype" = cluster{"station number": u16, "FPGA interface": "FGPA Reference.gtype", "MAC High Requests": Queue<u8[]>, "MAC High Confirmations": Queue<u8[]>, "Triggered TX Requests": Queue<"TX Request Confirmation Reference Parameters.gtype">, "receive queue": Queue<u8[]>, "receive throughput queue": Queue<T2>, "UDP Receiver": UdpNetworkConnectionRefnum, "PN packet": u8[], "FlexRIO session": Queue<T3>, "FlexRIO TX Characterization Data": T5, "FlexRIO RX Characterization Data": T5, "USRP session": "niUsrpRio Session.gtype", "RF loop clock frequency": f64, "UDP Receiver TX Request": UdpNetworkConnectionRefnum, "UDP Receiver TX Confirmation": UdpNetworkConnectionRefnum, "UDP Receiver RX Indication": UdpNetworkConnectionRefnum, "UDP Sender": UdpNetworkConnectionRefnum}
uses:
  NI::USRPRIO::ConfigV1Host::Dequeue DB Data.gvi
  NI::USRPRIO::ConfigV1Host::Enqueue DB Data.gvi
  NI::USRPRIO::ConfigV1Host::Parse Scope.gvi
  NI::USRPRIO::ConfigV1Host::Decode Daughterboard Names.gvi
diagram:
  Property Node(instance in=$session) -> ("FPGA interface"=w1, "USRP session"=w2, instance out=w3)
  $"session dup" <- w3
  case ($"TX Port") {
    frame "TX1/RF 0", Default {
      case ($"RX port") {
        frame "RX1/RF 0", Default {
          w4 = "Duplex"
        }
        frame "RX2/RF 0" {
          w4 = "Duplex"
        }
        frame "RX1/RF 1" {
          w4 = "Rx"
        }
        frame "RX2/RF 1" {
          w4 = "Rx"
        }
      }
    }
    frame "TX1/RF 1" {
      case ($"RX port") {
        frame "RX1/RF 0", Default {
          w4 = "Rx"
        }
        frame "RX2/RF 0" {
          w4 = "Rx"
        }
        frame "RX1/RF 1" {
          w4 = "Duplex"
        }
        frame "RX2/RF 1" {
          w4 = "Duplex"
        }
      }
    }
  }
  case ($"RX port") {
    frame "RX1/RF 0", Default {
      w5 = "Radio 0 Config"
      w6 = "TX1 RX1 receives and RX2 is unused"
    }
    frame "RX2/RF 0" {
      w5 = "Radio 0 Config"
      w6 = "TX1 RX1 transmits and RX2 receives"
    }
    frame "RX1/RF 1" {
      w5 = "Radio 1 Config"
      w6 = "TX1 RX1 receives and RX2 is unused"
    }
    frame "RX2/RF 1" {
      w5 = "Radio 1 Config"
      w6 = "TX1 RX1 transmits and RX2 receives"
    }
  }
  Type Cast(type=u16 0, x=$"RX port") -> w7
  Quotient And Remainder(x=w7, y=2) -> (floor(x/y)=w8)
  Format Into String(formatString="rx/RF %d", errIn=$"error in", w8) -> (outString=w9, errOut=w10)
  call "Dequeue DB Data.gvi"(niusrprio session in=w2, error in=w10, scope=w9) -> (niusrprio session out=w11, daughterboard data=w12, error out=w13)
  call "Enqueue DB Data.gvi"(niusrprio session in=w11, daughterboard data=w12, error in=w13, scope=w9) -> (niusrprio session out=w14, error out=w15)
  call "Parse Scope.gvi"(niusrprio session in=w14, error in=w15, scope=w9) -> (daughterboard index=w16, niusrprio session out=w17, error out=w18)
  call "Decode Daughterboard Names.gvi"(niusrprio session in=w17, error in=w18) -> (daughterboard names=w19, error out=w20)
  Property Node(instance in=w12) -> ("ATR state data"=w21)
  Type Cast(type=u16 0, x=w4) -> w22
  To Signed 32 Bit Integer(number=w22) -> w23
  Array Index(array=w21) -> (out0[w23]=w24)
  Property Node(instance in=w24) -> ("lo lpf enable"=w25, "rx.configuration:power enable"=w26, "rx.configuration:mixer enable"=w27, "tx.configuration"=w28, "ubx spi address"=w29, "ubx cpld enable"=w30)
  To Signed 32 Bit Integer(number=w16) -> w31
  Array Index(array=w19) -> (out0[w31]=w32)
  Type Cast(type=enum{"sbx", "cbx", "wbx", "unknown", "ubx"} "sbx", x=w32) -> w33
  Property Node(instance in=w1, "Radio Control Destination"=w5, "antenna configuration"=w6, "lo lpf enable"=w25, "power enable"=w26, "mixer enable"=w27, "tx.configuration"=w28, "spi address"=w29, "cpld enable"=w30, "ATR State"=w4, "daughterboard"=w33, error in=w20) -> (error out=w34)
  $"error out" <- w34
