vi "Configure RX RF.gvi"   [LabVIEW NXG 4.0.0]
# Configures the RX RF front end on the target.
inputs:
  "RX frequency": f64 = 1000000000  # RX frequency to configure on the target, in Hz.
  "session": "Host Session.gtype"
  "RX gain": f64  # RX gain to configure on the target, in dB.
  "error in": error
  "RX port": T1 = "RX2/RF 1"  # RX port to be used (USRP only).
  "LO frequency": f64 = -1
outputs:
  "error out": error
  "session dup": "Host Session.gtype"
  "coerced RX gain": f64  # RX gain actually configured on the target, in dB.
  "coerced LO frequency": f64  # LO frequency actually configured for RX on the target, in Hz.
types:
  T1 = enum{"RX1/RF 0", "RX2/RF 0", "RX1/RF 1", "RX2/RF 1"}
  T2 = cluster{"Timestamp": u32, "Transferred Bytes": u32}
  T3 = cluster{"fpga ref": any, "bus instance": u32, "instruction FIFO depth": u32, "executing on FPGA target": bool, "show error call chain": bool}
  T4 = cluster{"Actual Gain [dB]": f64, "Attenuation Table Index": i32}
  T5 = cluster{"Attenuation Table [dB]": f64[][], "Frequencies [Hz]": f64[], "IQ Imbalance Table": "IQ Imbalance.gtype"[], "Gain Table": T4[][]}
  "Register Bus Session.gtype" = Queue<"Session Data.gtype">
  "Semaphore.gtype" = i32
  "DB Queue Reference.gtype" = Queue<"Daughterboard Data.gtype">
  "niUsrpRio Session.gtype" = cluster{"FPGA Interface": any, "RIO Interface Number": u32, "Data Clock Rate": u32, "FPGA Data Clock Rate": u32, "Global Settings Register Bus": "Register Bus Session.gtype", "Radio 0 Settings Register Bus": "Register Bus Session.gtype", "Radio 1 Settings Register Bus": "Register Bus Session.gtype", "Radio Settings Bus Semaphore": "Semaphore.gtype", "DB Queues": "DB Queue Reference.gtype"[], "Characterization Data Valid?": bool, "EEPROM Header": "EEPROM Header.gtype", "Device Data Header": "EEPROM Device Data Header.gtype", "EEPROM Characterization Header": "EEPROM Characterization Header.gtype", "Characterization Data": "Characterization Data.gtype"[], "FPGA Current Version": u32, "FPGA Oldest Compatible Version": u32, "Fixed Logic Current Version": u32, "Fixed Logic Oldest Compatible Version": u32, "FPGA Radio Settings Bus Current Version": u32, "FPGA Radio Settings Bus Oldest Compatible Version": u32, "FPGA Board Config Current Version": u32, "FPGA Board Config Oldest Compatible Version": u32, "Daughterboard Clock Rate": u32}
  "Host Session.gtype" = cluster{"station number": u16, "FPGA interface": "FGPA Reference.gtype", "MAC High Requests": Queue<u8[]>, "MAC High Confirmations": Queue<u8[]>, "Triggered TX Requests": Queue<"TX Request Confirmation Reference Parameters.gtype">, "receive queue": Queue<u8[]>, "receive throughput queue": Queue<T2>, "UDP Receiver": UdpNetworkConnectionRefnum, "PN packet": u8[], "FlexRIO session": Queue<T3>, "FlexRIO TX Characterization Data": T5, "FlexRIO RX Characterization Data": T5, "USRP session": "niUsrpRio Session.gtype", "RF loop clock frequency": f64, "UDP Receiver TX Request": UdpNetworkConnectionRefnum, "UDP Receiver TX Confirmation": UdpNetworkConnectionRefnum, "UDP Receiver RX Indication": UdpNetworkConnectionRefnum, "UDP Sender": UdpNetworkConnectionRefnum}
uses:
  Host SubVIs::Configure Signal (Gain).gvi
diagram:
  Property Node(instance in=$session) -> ("USRP session"=w1, instance out=w2)
  $"session dup" <- w2
  w3 = 80000000  # sample rate
  Type Cast(type=u16 0, x=$"RX port") -> w4
  Quotient And Remainder(x=w4, y=2) -> (floor(x/y)=w5, x-y*floor(x/y)=w6)
  Increment(x=w6) -> w7
  Format Into String(formatString="RX%d", errIn=$"error in", w7) -> (outString=w8, errOut=w9)
  Format Into String(formatString="rx/RF %d", errIn=w9, w5) -> (outString=w10, errOut=w11)
  call "Configure Signal (Gain).gvi"(active antenna=w8, lo frequency [hz]=$"LO frequency", niusrprio session in=w1, sample rate [s/s]=w3, frequency [hz]=$"RX frequency", gain [db]=$"RX gain", error in=w11, scope=w10, correct impairments?=TRUE) -> (coerced lo frequency [hz]=w12, coerced gain [db]=w13, error out=w14)
  $"error out" <- w14
  $"coerced RX gain" <- w13
  $"coerced LO frequency" <- w12
