vi "Configure TX RF.gvi"   [LabVIEW NXG 4.0.0]
# Configures TX RF front end on the target.
inputs:
  "TX port": enum{"TX1/RF 0", "TX1/RF 1"} = "TX1/RF 0"  # TX port to be used (USRP only).
  "session": "Host Session.gtype"
  "TX frequency": f64 = 2450000000  # TX frequency to configure on the target, in Hz.
  "TX power level": f64 = -10  # TX power level to configure on the target, in dBm.
  "LO frequency [Hz]": f64 = -1
  "error in": error
outputs:
  "session dup": "Host Session.gtype"
  "error out": error
  "coerced TX power level": f64  # TX power level actually configured on the target, in dBm.
  "coerced LO frequency": f64  # LO frequency actually configured for TX on the target, in Hz.
types:
  T1 = cluster{"Timestamp": u32, "Transferred Bytes": u32}
  T2 = cluster{"fpga ref": any, "bus instance": u32, "instruction FIFO depth": u32, "executing on FPGA target": bool, "show error call chain": bool}
  T3 = cluster{"Actual Gain [dB]": f64, "Attenuation Table Index": i32}
  T4 = cluster{"Attenuation Table [dB]": f64[][], "Frequencies [Hz]": f64[], "IQ Imbalance Table": "IQ Imbalance.gtype"[], "Gain Table": T3[][]}
  "Register Bus Session.gtype" = Queue<"Session Data.gtype">
  "Semaphore.gtype" = i32
  "DB Queue Reference.gtype" = Queue<"Daughterboard Data.gtype">
  "niUsrpRio Session.gtype" = cluster{"FPGA Interface": any, "RIO Interface Number": u32, "Data Clock Rate": u32, "FPGA Data Clock Rate": u32, "Global Settings Register Bus": "Register Bus Session.gtype", "Radio 0 Settings Register Bus": "Register Bus Session.gtype", "Radio 1 Settings Register Bus": "Register Bus Session.gtype", "Radio Settings Bus Semaphore": "Semaphore.gtype", "DB Queues": "DB Queue Reference.gtype"[], "Characterization Data Valid?": bool, "EEPROM Header": "EEPROM Header.gtype", "Device Data Header": "EEPROM Device Data Header.gtype", "EEPROM Characterization Header": "EEPROM Characterization Header.gtype", "Characterization Data": "Characterization Data.gtype"[], "FPGA Current Version": u32, "FPGA Oldest Compatible Version": u32, "Fixed Logic Current Version": u32, "Fixed Logic Oldest Compatible Version": u32, "FPGA Radio Settings Bus Current Version": u32, "FPGA Radio Settings Bus Oldest Compatible Version": u32, "FPGA Board Config Current Version": u32, "FPGA Board Config Oldest Compatible Version": u32, "Daughterboard Clock Rate": u32}
  "Host Session.gtype" = cluster{"station number": u16, "FPGA interface": "FGPA Reference.gtype", "MAC High Requests": Queue<u8[]>, "MAC High Confirmations": Queue<u8[]>, "Triggered TX Requests": Queue<"TX Request Confirmation Reference Parameters.gtype">, "receive queue": Queue<u8[]>, "receive throughput queue": Queue<T1>, "UDP Receiver": UdpNetworkConnectionRefnum, "PN packet": u8[], "FlexRIO session": Queue<T2>, "FlexRIO TX Characterization Data": T4, "FlexRIO RX Characterization Data": T4, "USRP session": "niUsrpRio Session.gtype", "RF loop clock frequency": f64, "UDP Receiver TX Request": UdpNetworkConnectionRefnum, "UDP Receiver TX Confirmation": UdpNetworkConnectionRefnum, "UDP Receiver RX Indication": UdpNetworkConnectionRefnum, "UDP Sender": UdpNetworkConnectionRefnum}
uses:
  Host SubVIs::Configure Signal (Level).gvi
diagram:
  $"session dup" <- $session
  w1 = 80000000  # sample rate [S/s]
  w2 = TRUE  # correctiImpairments?
  Property Node(instance in=$session) -> ("USRP session"=w3)
  Format Into String(formatString="tx/RF %d", errIn=$"error in", $"TX port") -> (outString=w4, errOut=w5)
  call "Configure Signal (Level).gvi"(active antenna="TX1", lo frequency [hz]=$"LO frequency [Hz]", niusrprio session in=w3, sample rate [s/s]=w1, frequency [hz]=$"TX frequency", level [dbm]=$"TX power level", error in=w5, scope=w4, correct impairments?=w2) -> (coerced lo frequency [hz]=w6, coerced level [dbm]=w7, error out=w8)
  $"error out" <- w8
  $"coerced TX power level" <- w7
  $"coerced LO frequency" <- w6
