vi "Open FPGA Target.gvi"   [LabVIEW NXG 4.0.0]
# Opens an FPGA target according to the RIO device name specified, and returns an FPGA reference.
inputs:
  "RIO device": string = "RIO0"  # Name of the RIO device to use. The device must match the project target device.
  "error in": error
outputs:
  "FPGA interface": "FGPA Reference.gtype"
  "error out": error
  "RF loop clock frequency": f64
  "device bandwidth": u16  # Detected instantaneous device bandwidth
uses:
  AFW::Common::USRP::Read Device Bandwidth.gvi
diagram:
  FPGA Open Node(RIO address=$"RIO device", error in=$"error in", run?=FALSE) -> (error out=w1, reference out=w2)
  call "Read Device Bandwidth.gvi"(FPGA reference in=w2, error in=w1) -> (error out=w3, bandwidth=w4, FPGA reference out=w5)
  Scan Value(default (0 dbl)=0, format string="%d", string=w4) -> (value=w6)
  $"device bandwidth" <- w6
  case (w4) {
    frame "40 MHz" {
      FPGA Close Node(abort?=FALSE, error in=w3, reference in=w5) -> (error out=w10)
      FPGA Open Node(RIO address=$"RIO device", error in=w10, run?=FALSE) -> (error out=w7, reference out=w8)
      w9 = 120000000
    }
    frame Default {
      w7 = w3
      w8 = w5
      w9 = 200000000
    }
  }
  $"RF loop clock frequency" <- w9
  Type Cast(type="FGPA Reference.gtype" constant, x=w8) -> w11
  $"FPGA interface" <- w11
  $"error out" <- w7
