vi "Setup FPGA Target.gvi"   [LabVIEW NXG 4.0.0]
# Opens a reference to the target device.
inputs:
  "Reference Clock": string = "Internal"  # reference clock source
  "session in": "Host Session.gtype"
  "error in": error
outputs:
  "session out": "Host Session.gtype"
  "error out": error
panel controls:
  "FPGA reference": any
types:
  T1 = cluster{"Timestamp": u32, "Transferred Bytes": u32}
  T2 = cluster{"fpga ref": any, "bus instance": u32, "instruction FIFO depth": u32, "executing on FPGA target": bool, "show error call chain": bool}
  T3 = cluster{"Actual Gain [dB]": f64, "Attenuation Table Index": i32}
  T4 = cluster{"Attenuation Table [dB]": f64[][], "Frequencies [Hz]": f64[], "IQ Imbalance Table": "IQ Imbalance.gtype"[], "Gain Table": T3[][]}
  "Register Bus Session.gtype" = Queue<"Session Data.gtype">
  "Semaphore.gtype" = i32
  "DB Queue Reference.gtype" = Queue<"Daughterboard Data.gtype">
  "niUsrpRio Session.gtype" = cluster{"FPGA Interface": any, "RIO Interface Number": u32, "Data Clock Rate": u32, "FPGA Data Clock Rate": u32, "Global Settings Register Bus": "Register Bus Session.gtype", "Radio 0 Settings Register Bus": "Register Bus Session.gtype", "Radio 1 Settings Register Bus": "Register Bus Session.gtype", "Radio Settings Bus Semaphore": "Semaphore.gtype", "DB Queues": "DB Queue Reference.gtype"[], "Characterization Data Valid?": bool, "EEPROM Header": "EEPROM Header.gtype", "Device Data Header": "EEPROM Device Data Header.gtype", "EEPROM Characterization Header": "EEPROM Characterization Header.gtype", "Characterization Data": "Characterization Data.gtype"[], "FPGA Current Version": u32, "FPGA Oldest Compatible Version": u32, "Fixed Logic Current Version": u32, "Fixed Logic Oldest Compatible Version": u32, "FPGA Radio Settings Bus Current Version": u32, "FPGA Radio Settings Bus Oldest Compatible Version": u32, "FPGA Board Config Current Version": u32, "FPGA Board Config Oldest Compatible Version": u32, "Daughterboard Clock Rate": u32}
  "Host Session.gtype" = cluster{"station number": u16, "FPGA interface": "FGPA Reference.gtype", "MAC High Requests": Queue<u8[]>, "MAC High Confirmations": Queue<u8[]>, "Triggered TX Requests": Queue<"TX Request Confirmation Reference Parameters.gtype">, "receive queue": Queue<u8[]>, "receive throughput queue": Queue<T1>, "UDP Receiver": UdpNetworkConnectionRefnum, "PN packet": u8[], "FlexRIO session": Queue<T2>, "FlexRIO TX Characterization Data": T4, "FlexRIO RX Characterization Data": T4, "USRP session": "niUsrpRio Session.gtype", "RF loop clock frequency": f64, "UDP Receiver TX Request": UdpNetworkConnectionRefnum, "UDP Receiver TX Confirmation": UdpNetworkConnectionRefnum, "UDP Receiver RX Indication": UdpNetworkConnectionRefnum, "UDP Sender": UdpNetworkConnectionRefnum}
uses:
  NI::USRPRIO::ConfigV1Host::Open 2.gvi
diagram:
  Property Node(instance in=$"session in") -> ("FPGA interface"=w1, instance out=w2)
  case ($"Reference Clock") {
    frame "Internal", Default {
      w3 = $"Reference Clock"
      w4 = default
    }
    frame "REF IN / ClkIn" {
      w3 = "REF IN"
      w4 = default
    }
    frame "GPS" {
      w3 = $"Reference Clock"
      w4 = default
    }
    frame "PXI_CLK" {
      w5 = error {"status"=TRUE, "code"=1, "source"="PXI_CLK reference clock not supported for USRP target"}
      w3 = "Internal"
      w4 = w5
    }
  }
  Type Cast(type=$"FPGA reference", x=w1) -> w6
  Merge Errors($"error in", w4) -> (error out=w7)
  call "Open 2.gvi"(fpga ref=w6, reference frequency source=w3, gpsdo power enable=TRUE, timeout=1, error in=w7, scope="") -> (niusrprio session out=w8, error out=w9)
  Property Node(instance in=w2, "USRP session"=w8) -> (instance out=w10)
  $"session out" <- w10
  Property Node(instance in=w6, "data clock locked?"=TRUE, error in=w9) -> (error out=w11)
  $"error out" <- w11
