vi "Calculate Power Spectrum.gvi"   [LabVIEW NXG 4.0.0]
# Calculates the power spectrum from the I/Q data.
inputs:
  "waveform": waveform<c128> = {dt=1, Y=[]}, required
outputs:
  "power spectrum (dBm)": T1
types:
  T1 = cluster{"f0": f64, "df": f64, "magnitude": f64[]}
  T2 = enum{"No averaging", "Vector averaging", "RMS averaging", "Peak hold"}
  T3 = cluster{"averaging mode": T2, "weighting mode": enum{"Linear", "Exponential"}, "number of averages": u32}
uses:
  NI::Analysis::Measurement::Power Spectrum for 1 Chan (CDB).gvi
  NI::Analysis::Measurement::Power Spectral Density for 1 Chan (CDB).gvi
diagram:
  w1 = T3 {"averaging mode"="No averaging", "weighting mode"="Exponential", "number of averages"=10}
  # Convert (Volts-peak)^2 to dBm
  #
  # dBm = 10 * log(1000 * Vrms sq / 50)
  #          = 10 * log(1000 * ((Vpeak sq)/2) / 50)
  #          = 10 * log(1000 * (Vpeak sq) / 100)
  #          = 10 * log(10 * Vpeak sq)
  # With the Spectral Measurements Toolkit, conversions like these can be done using the "SMT Spectrum Unit Conversion" VI. SMT also contains many optimized forms of FFT processing, which would increase the speed of forming the power spectrum shown here. See this page for more information:
  #
  # http://sine.ni.com/nips/cds/view/p/lang/en/nid/210567
  case (0) {
    frame 0, Default {
      call "Power Spectrum for 1 Chan (CDB).gvi"(signal=$waveform, window type=1, averaging parameters=w1, dB on=FALSE, error in=no error, restart averaging=FALSE, window parameter=NaN) -> (power spectrum=w2, averaging done=w3, averages completed=w4, error out=w5)
    }
    frame 1 {
      call "Power Spectral Density for 1 Chan (CDB).gvi"(signal=$waveform, averaging parameters=w1, window type=1, dB on=FALSE, error in=no error, restart averaging=FALSE, window parameter=NaN) -> (power spectral density=w2, averaging done=w6, averages completed=w7, error out=w8)
    }
  }
  Property Node(instance in=w2) -> ("magnitude"=w9)
  Multiply(w9, 10) -> w10
  Logarithm Base 10(x=w10) -> w11
  Multiply(w11, 10) -> w12
  Property Node(instance in=w2, "magnitude"=w12) -> (instance out=w13)
  $"power spectrum (dBm)" <- w13
