vi "Generate Waveform (Interleaved).gvi"   [LabVIEW NXG 4.0.0]
# Creates a waveform to send to a device for generation.
# Input Parameters
# number of samples in the generated waveform.
# sample rate is the rate, in samples per second, that will be used to create the waveform.
# tone frequency is the frequency of the tone, in hertz, to generate.
# amplitude is used to set the amplitude of the tone. DSP overflow will occur if the 'amplitude' is too high.
# Output Parameters
# waveform is the real (I) portion and the imaginary (Q) portion of the generated waveform interleaved.
# Waveform is the generated waveform.
# error out contains error information. This output provides standard 'error out' functionality.
inputs:
  "number of samples": u32 = 300000  # in the generated waveform.
  "sample rate": f64 = 10000000  # is the rate, in samples per second, that will be used to create the waveform.
  "tone frequency": f64 = 130000  # is the frequency of the tone, in hertz, to generate.
  "amplitude": f64 = 1  # is used to set the amplitude of the tone. DSP overflow will occur if the amplitude is too high.
outputs:
  "waveform": i16[]  # is the real (I) portion and the imaginary (Q) portion of the generated waveform interleaved.
  "waveform 2": waveform<f64>[]  # is the generated waveform.
  "error out": error
uses:
  NI::Analysis::Generation::Sine Waveform.gvi
diagram:
  Property Node(instance in=cluster{"Fs": f64, "#s": f64} {"Fs"=1000, "#s"=1000}, "Fs"=$"sample rate", "#s"=$"number of samples") -> (instance out=w1)
  Property Node(instance in=w1) -> ("Fs"=w2, "#s"=w3)
  call "Sine Waveform.gvi"(sample rate=w2, samples=w3, amplitude=$amplitude, frequency=$"tone frequency", phase in=90, error in=no error, reset phase=FALSE, offset=0) -> (sine wave=w4, error out=w5)
  Property Node(instance in=w1) -> ("Fs"=w6, "#s"=w7)
  call "Sine Waveform.gvi"(sample rate=w6, samples=w7, amplitude=$amplitude, frequency=$"tone frequency", phase in=0, error in=no error, reset phase=FALSE, offset=0) -> (sine wave=w8, error out=w9)
  Build Array(w4, w8) -> w10
  $"waveform 2" <- w10
  Property Node(instance in=w4) -> ("Y"=w11)
  Multiply(w11, 32767) -> w12
  To Signed 16 Bit Integer(number=w12) -> w13
  Property Node(instance in=w8) -> ("Y"=w14)
  Multiply(w14, 32767) -> w15
  To Signed 16 Bit Integer(number=w15) -> w16
  Interleave Array(w13, w16) -> w17
  $waveform <- w17
  Merge Errors(w5, w9) -> (error out=w18)
  $"error out" <- w18
