vi "FPGA STA.gvi"   [LabVIEW NXG 4.0.0]
# Calculates the RF signal power on primary and secondary channels. Compares the RF signal power against CCA energy threshold and generated CCA indication based on energy detection.
# Latency: min 10 clock cycles
panel controls:
  "reg.host read.go rcvd 0": bool
  "reg.notify host.go rcvd 0": bool
  "reg.reset 0": bool
  "RF 0/Rx/Enable": bool
  "RF 0/Tx/Enable": bool
  "RF 1/Rx/Enable": bool
  "RF 1/Tx/Enable": bool
  "ATR State": enum{"Idle", "Rx", "Tx", "Duplex"} = "Idle"
  "Radio Control Destination": T1 = "Radio 0 Config"
  "lo lpf enable": bool
  "power enable": bool
  "mixer enable": bool
  "tx.configuration": T2 = {"power enable"=TRUE, "mixer enable"=TRUE, "gain"=0}
  "RX data source": T3 = "RF"
  "packet start sample index": u16
  "rearm packet start generator": bool
  "bypass synchronization": bool
  "reset MAC RX statistics": bool
  "noise coefficient": FXP(8.8) = 10
  "mute RX while TX active?": bool = TRUE
  "number of samples to capture": u16 = 1024
  "produce silent samples": bool
  "power calibration offset": FXP(10.3)
  "CCA energy detect threshold": FXP(10.3) = -62
  "RF gain": FXP(10.3)
  "number of samples before trigger": u16
  "manual trigger": bool
  "enable AGC": bool
  "rx.reset": bool = TRUE
  "rx.output sample rate": UFXP(1.47)
  "rx.delay": FXP(0.16)
  "rx 0.frequency shift": FXP(0.48)
  "rx 0.phase": FXP(0.21)
  "rx 0.impairments": T4 = {"inline gain I"=-1, "inline gain Q"=0.999992370605, "cross gain I"=0.999992370605, "cross gain Q"=0, "pre-gain offset I"=0, "pre-gain offset Q"=-1, "post-gain offset I"=0, "post-gain offset Q"=0.999992370605}
  "rx.abort": bool
  "tx.abort": bool
  "tx.reset": bool = TRUE
  "tx.input sample rate": UFXP(1.47)
  "tx.delay": FXP(0.18)
  "tx 0.frequency shift": FXP(0.48)
  "tx 0.phase": FXP(0.21)
  "tx 0.impairments": T4 = {"inline gain I"=0.999992370605, "inline gain Q"=0.999992370605, "post-gain offset I"=0.999992370605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}
  "tx 0.gain": T5 = {"gain I"=1, "gain Q"=1}
  "rx 1.impairments": T4 = {"inline gain I"=-0.999992370605, "inline gain Q"=0.999992370605, "cross gain I"=-0.999992370605, "cross gain Q"=0, "pre-gain offset I"=-1, "pre-gain offset Q"=0, "post-gain offset I"=0, "post-gain offset Q"=0}
  "rx 1.frequency shift": FXP(0.48)
  "rx 1.phase": FXP(0.21)
  "tx 1.impairments": T4 = {"inline gain I"=0.999992370605, "inline gain Q"=0.999992370605, "post-gain offset I"=-1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}
  "tx 1.frequency shift": FXP(0.48)
  "tx 1.phase": FXP(0.21)
  "tx 1.gain": T5 = {"gain I"=1, "gain Q"=1}
  "rx 0.stream enable": bool
  "rx 1.stream enable": bool
  "tx 0.stream enable": bool
  "tx 1.stream enable": bool
  "Data clock cycles per tick (0.1us)": u16 = 20
  "Data clock cycles per OFDM symbol": u16 = 480
  "rx.rf channel": UFXP(1.0)
  "tx.rf channel": UFXP(1.0)
  "enable DC offset correction": bool = TRUE
  "data clock locked?": bool
  "primary channel selector": UFXP(2.0)
  "device MAC address": u8[6]
  "daughterboard": "DB Types.gtype" = "sbx"
  "antenna configuration": "Antenna Configuration.gtype" = "TX1 RX1 transmits and RX2 receives"
  "spi address": u8 = 7
  "cpld enable": bool = TRUE
  "RX Settings": "RX Settings.gtype"
  "DC Offset factor p": UFXP(4.0) = 12
  "synchronization configuration": "Synchronization Configuration.gtype"
  "TX advance": u32
  "use fixed backoff": bool
  "fixed backoff": u16
  "pass all MPDUs": bool
  "dot11RTSThreshold": u32
  "control frame TX vector configuration": "Control Frame MCS Configuration.gtype"
  "dot11ShortRetryLimit": u16
  "dot11LongRetryLimit": u16
  "bypass MAC TX": bool
  "reset MAC TX statistics": bool
  "manual PhyTxStart.req": "PhyTxStart.req.gtype"
  "AGC target signal power": FXP(10.3)
  "event enable mask": "Events Enable Mask.gtype"
  "trigger condition": "PHY RX Capture Trigger Condition.gtype" = "Immediate"
  "T2H Constellation reset": bool
  "T2H Constellation number of samples": u16
  "T2H TX Baseband reset": bool
  "T2H TX Baseband number of samples": u16
  "T2H Constellation pass all samples": bool
  "T2H TX Baseband pass all samples": bool
  "AGC timeout": u16 = 4000
  "PHY clock cycles TX active extension": u32
  "T2H RX Power Spectrum rearm": bool
  "T2H RX Power Spectrum pass all triggers": bool
  "overwrite scrambler seed": bool
  "scrambler seed": UFXP(7.0)
  "AGC gain offset": UFXP(5.1)
  "station active": bool
  "device bandwidth": u16
panel indicators:
  "reg.notify host.go 0": bool
  "reg.host read.data 0": cluster{"go": bool, "data": u32}
  "compensated CFO": FXP(0.48)
  "T2H RX Data overflow": u16
  "T2H Constallation overflow": u16
  "T2H RX Bit Processing Output FIFO overflow": u16
  "T2H RX Power Spectrum overflow": u16
  "T2H Channel Estimation overflow": u16
  "last applied gain": UFXP(6.1)
  "RF input power at packet start": FXP(10.3)
  "signal power at packet start": FXP(10.3)
  "RF input power": FXP(10.3)
  "signal power": FXP(10.3)
  "internal loopback FIFO overflow": u16
  "TX to RF FIFO overflow": u16
  "T2H TX Baseband FIFO overflow": u16
  "T2H TX Bit Processing Output FIFO overflow": u16
  "rx.samples processed": u32
  "rx.number of IQ data overflows": u64
  "rx.number of overflows": u32
  "tx.samples processed": u32
  "tx.underflows": u32
  "tx.number of IQ data overflows": u64
  "rx.dsp reset done": bool
  "tx.dsp reset done": bool
  "Timestamp": u32
  "DC average": CFXP(1.17)
  "PhyTxStart.req": "PhyTxStart.req.gtype"
  "PhyTxEnd.ind": "PhyTxEnd.ind.gtype"
  "PhyRxStart.ind": "PhyRxStart.ind.gtype"
  "PhyRxEnd.ind": "PhyRxEnd.ind.gtype"
  "PSDU TX FIFO overflow counter": u16
  "MAC RX statistics": "MAC RX Statistics.gtype"
  "TX end indication overflow count": u16
  "MAC TX statistics": "MAC TX Statistics.gtype"
  "used scrambler seed": UFXP(7.0)
  "rx.state": "Stream Control State.gtype"
  "tx.state": "Stream Control State.gtype"
types:
  T1 = enum{"Identification", "Board Config", "Global Config", "Radio 0 Config", "Radio 1 Config", "Synchronization", "Time", "Future Events"}
  T2 = cluster{"power enable": bool, "mixer enable": bool, "gain": u8}
  T3 = enum{"RF", "BB Data From Host", "Internal Loopback"}
  T4 = cluster{"inline gain I": FXP(1.17), "inline gain Q": FXP(1.17), "cross gain I": FXP(1.17), "cross gain Q": FXP(1.17), "pre-gain offset I": FXP(1.17), "pre-gain offset Q": FXP(1.17), "post-gain offset I": FXP(1.17), "post-gain offset Q": FXP(1.17)}
  T5 = cluster{"gain I": FXP(3.21), "gain Q": FXP(3.21)}
  "DB Types.gtype" = enum{"sbx", "cbx", "wbx", "unknown", "ubx"}
  "Antenna Configuration.gtype" = enum{"TX1 RX1 transmits and RX2 receives", "TX1 RX1 receives and RX2 is unused"}
  "PHY Frame Format.gtype" = enum{"NON_HT_OFDM", "VHT", "NON_HT_DUP_OFDM"}
  "Bandwidth.gtype" = enum{"20 MHz", "40 MHz", "80 MHz"}
  "TX Vector.gtype" = cluster{"format": "PHY Frame Format.gtype", "bandwidth": "Bandwidth.gtype", "PSDU length": u32, "(A-)MPDU length": u32, "MCS": UFXP(4.0)}
  "PhyTxStart.req.gtype" = cluster{"TX vector": "TX Vector.gtype", "valid": bool}
  "PhyTxEnd.ind.gtype" = cluster{"unsupported mode": bool, "scrambler seed": UFXP(7.0), "valid": bool}
  "Non HT Bandwidth.gtype" = enum{"20 MHz", "40 MHz", "80 MHz", "160 MHz"}
  "RX Vector.gtype" = cluster{"format": "PHY Frame Format.gtype", "bandwidth": "Bandwidth.gtype", "PSDU length": u32, "MCS": UFXP(4.0), "non HT bandwidth": "Non HT Bandwidth.gtype", "dynamic bandwidth support": bool}
  "PhyRxStart.ind.gtype" = cluster{"RX vector": "RX Vector.gtype", "valid": bool}
  "RX Error.gtype" = enum{"NoError", "CarrierLost", "FormatViolation", "UnsupportedRate", "Filtered"}
  "PhyRxEnd.ind.gtype" = cluster{"valid": bool, "RX error": "RX Error.gtype", "RX vector": "RX Vector.gtype"}
  "RX Settings.gtype" = cluster{"format": "PHY Frame Format.gtype", "overwrite format detection": bool}
  "Synchronization Configuration.gtype" = cluster{"consecutive samples over threshold": u8, "squared cross correlation threshold": UFXP(1.17), "maximum peak index deviation": u8, "FFT window shift into CP": u8, "consecutive peaks for preamble detection": u8, "use static frequency shift": bool, "static frequency shift": FXP(0.48)}
  "MAC RX Statistics.gtype" = cluster{"preamble detected": u32, "PSDUs received": u32, "MPDU CRC OK": u32, "RTS detected": u32, "CTS detected": u32, "Data detected": u32, "ACK detected": u32}
  "Control Frame MCS Configuration.gtype" = cluster{"RTS MCS": UFXP(4.0), "CTS MCS": UFXP(4.0), "ACK MCS": UFXP(4.0)}
  "MAC TX Statistics.gtype" = cluster{"RTS triggered": u32, "CTS triggered": u32, "Data triggered": u32, "ACK triggered": u32}
  "Events Enable Mask.gtype" = cluster{"PHY TX start request": bool, "PHY TX end indication": bool, "PHY RX start indication": bool, "PHY RX end indication": bool, "PHY CCA timing indication": bool, "PHY RX gain change indication": bool, "DCF state indication": bool, "MAC MPDU RX indication": bool, "MAC MPDU TX request": bool}
  "PHY RX Capture Trigger Condition.gtype" = enum{"Immediate", "RX Packet Start", "TX Paket Start", "CCA energy detection", "CCA signal detection"}
  "Stream Control State.gtype" = enum{"Idle", "Active"}
  "FPGA Shared Properties.gtype" = cluster{"primary channel selector": UFXP(2.0), "device MAC address": u8[6], "device bandwidth": u16}
  T6 = cluster{"output sample rate": UFXP(1.47), "delay": FXP(0.16), "frequency shift": FXP(0.48), "impairments": T4, "phase": FXP(0.21), "DC Offset factor p": UFXP(4.0)}
  T7 = cluster{"frequency shift": FXP(0.48), "impairments": T4, "phase": FXP(0.21), "input sample rate": UFXP(1.47), "gain": T5, "delay": FXP(0.18)}
uses:
  AFW::802_11::Shared::Create Resources.gvi
  AFW::802_11::RX::PHY-SAP Read MAC.gcdl
  AFW::802_11::RX::MAC::MAC RX.gcdl
  AFW::802_11::RX::MAC::MAC RX to ICP.gcdl
  AFW::802_11::RX::RX Data Sink.gcdl
  AFW::802_11::DCF::DCF Control.gcdl
  AFW::802_11::TX::TX Data Source.gcdl
  AFW::802_11::TX::MAC::ICP to MAC TX.gcdl
  AFW::802_11::TX::MAC::MAC TX.gcdl
  AFW::802_11::TX::TX MAC Bypass.gcdl
  AFW::802_11::TX::PHY-SAP Write MAC.gcdl
  AFW::802_11::Events::Write RX Events.gcdl
  AFW::802_11::TX::MAC::MAC TX to ICP.gcdl
  AFW::802_11::TX::TX Feedback Sink.gcdl
  AFW::802_11::Events::Write TX Events.gcdl
  AFW::802_11::TX::Host Communication::Capture PHY TX Indications.gcdl
  AFW::802_11::TX::MAC::MAC TX Statistics.gcdl
  AFW::802_11::TX::PHY-SAP Read PHY.gcdl
  NI::SDR::BasicElementsV1FPGA::Detect Rising Edge.gcdl
  AFW::802_11::TX::PHY TX Request Handler.gcdl
  AFW::802_11::TX::PSDU Discard.gcdl
  AFW::802_11::TX::Bit Processing::TX Bit Processing.gcdl
  AFW::802_11::TX::Extend TX Active Signal.gcdl
  AFW::802_11::RX::RX Data Source.gcdl
  AFW::802_11::RX::Power Measurement::Signal Filter.gcdl
  AFW::802_11::RX::Power Measurement::CCA Energy Detection.gcdl
  AFW::802_11::RX::Power Measurement::Power Measurement.gcdl
  AFW::802_11::RX::Synchronization::Synchronization.gcdl
  AFW::802_11::RX::Power Measurement::AGC.gcdl
  AFW::802_11::RX::CCA.gcdl
  AFW::802_11::RX::IQ Processing::RX IQ Processing.gcdl
  AFW::802_11::RX::Bit Processing::RX Bit Processing.gcdl
  AFW::802_11::RX::State Machines::RX PHY State Machine.gcdl
  AFW::802_11::RX::PHY-SAP Write PHY.gcdl
  AFW::802_11::RX::Host Communication::Prepare RX IQ Data for T2H.gcdl
  AFW::802_11::RX::Host Communication::Prepare Channel Estimation for T2H.gcdl
  AFW::802_11::RX::Host Communication::Trigger Capture RX Samples.gcdl
  AFW::802_11::RX::Host Communication::Capture RX Samples.gcdl
  AFW::802_11::TX::IQ Processing::TX IQ Processing.gcdl
  AFW::802_11::TX::TX Data Sink.gcdl
  AFW::802_11::RX::Host Communication::RX Bit Processing Data Sink.gcdl
  AFW::802_11::TX::Host Communication::TX Bit Processing Data Sink.gcdl
  AFW::802_11::RX::Host Communication::Capture PHY RX Indications.gcdl
  AFW::Common::Counters::Mod N Indexer U16.gcdl
  NI::SDR::BasicElementsV1FPGA::Count Up U32.gcdl
  AFW::802_11::RF Control::USRP Stream RX.gcdl
  AFW::802_11::RF Control::USRP Stream TX.gcdl
  FPGA SubVIs::Create Resources.gvi
  AFW::802_11::RF Control::Set Gain.gcdl
  AFW::Common::USRP::Type Conversion::read completion from typedef.gcdl
  NI::SDR::RegisterBusV1FPGA::Process.gcdl
  AFW::802_11::RF Control::Retrieve FPGA Scoped Instruction.gcdl
  NI::SDR::RegisterBusV1FPGA::Register Instruction Arbiter (2 inputs).gcdl
  AFW::Common::USRP::Type Conversion::register instruction to typedef.gcdl
  FPGA SubVIs::Registers.gcdl
  NI::USRPRIO::ConfigV1FPGA::Process.gvi
diagram:
  call "Create Resources.gvi"() -> (registers and FIFO resources=w1, PHY SAP resources=w2)
  clock-driven loop (clock = "AFW::802_11::Resources::802.11 AFW Resources.grsc::MAC") forever {
    w3 = "AFW::802_11::Resources::802.11 AFW Resources.grsc::T2H RX Data"
    call "PHY-SAP Read MAC.gcdl"(PHY SAP=w2) -> (PhyTxEnd.ind=w4, PHY RX gain change indication=w5, PhyRxStart.ind=w6, PhyRxEnd.ind=w7, PSDU=w8, PSDU valid=w9, PHY CCA indication=w10)
    Property Node(instance in=w1) -> ("shared properties"=w11, "global timestamp"=w12)
    Register Read(reference in=w11) -> (data=w13)
    Property Node(instance in=w13) -> ("device MAC address"=w14)
    call "MAC RX.gcdl"(PHY PSDU RX Start indication=w6, Phy Rx End Indication=w7, PSDU=w8, PSDU valid=w9, STA MAC address=w14, pass all MPDUs=$"pass all MPDUs", reset MAC RX statistics=$"reset MAC RX statistics") -> (MAC MPDU RX event indication=w15, MAC RX event to TX indication=w16, MAC MPDU RX before filtering event indication=w17, MAC MSDU RX indication=w18, MSDU data=w19, MSDU data valid=w20, MAC RX statistics=w21)
    call "MAC RX to ICP.gcdl"(MAC MSDU RX indication=w18, MSDU data=w19, MSDU data valid=w20) -> (ICP data=w22, output valid=w23)
    call "RX Data Sink.gcdl"(ICP SDU=w22, input valid=w23, FIFO reference=w3) -> (FIFO overflow count=w24)
    $"T2H RX Data overflow" <- w24
    w25 = "AFW::802_11::Resources::802.11 AFW Resources.grsc::H2T TX Data"
    # w26: global time reference
    Register Read(reference in=w12) -> (data=w26)
    # w27: feedback TX to DCF (MAC frame TX start indication)
    Feedback Node(input=w28) -> w27
    # w29: feedback TX to DCF (RX timeout count request)
    Feedback Node(input=w30) -> w29
    # w31: feedback TX to DCF (DCF TX opportunity request)
    Feedback Node(input=w32) -> w31
    # w33: feedback TX to DCF (contention window change request)
    # w16: RX to TX feedback (MAC RX event to TX indication)
    Feedback Node(input=w34) -> w33
    call "DCF Control.gcdl"(PHY CCA indication=w10, PHY TX end indication=w4, PhyRxStart.ind=w6, PhyRxEnd.ind=w7, MAC MPDU RX event indication=w15, contention window change request=w33, DCF TX opportunity request=w31, RX timeout request=w29, MAC frame TX start indication=w27, global timestamp=w26, TX advance=$"TX advance", use fixed backoff=$"use fixed backoff", fixed backoff=$"fixed backoff") -> (DCF TX opportunity indication=w35, SIFS TX opportunity indication=w36, RX timeout pulse=w37, DCF state=w38)
    Feedback Node(input=w39) -> w40
    call "TX Data Source.gcdl"(ready for output=w40, H2T TX Data=w25, bypass MAC TX=$"bypass MAC TX") -> (ICP data=w41, output valid=w42, elements available=w43)
    Feedback Node(input=w44) -> w45
    Property Node(instance in=w45) -> ("valid"=w46)
    call "ICP to MAC TX.gcdl"(ICP data=w41, input valid=w42, elements available=w43, get next MSDU frame=w46) -> (MAC MSDU TX request=w47, MSDU data=w48, MSDU data valid=w49, ready for input=w39)
    Feedback Node(input=w50) -> w51
    call "MAC TX.gcdl"(ready for output=w51, MAC RX event to TX indication=w16, MAC MSDU TX request=w47, MSDU data=w48, MSDU data valid=w49, DCF TX opportunity indication=w35, SIFS TX opportunity indication=w36, RX timeout pulse=w37, dot11RTSThreshold=$dot11RTSThreshold, control frame TX vector configuration=$"control frame TX vector configuration", dot11ShortRetryLimit=$dot11ShortRetryLimit, dot11LongRetryLimit=$dot11LongRetryLimit, station active=$"station active") -> (MAC MSDU TX end indication=w44, contention window change request=w34, MAC frame TX request=w52, PHY PSDU TX request=w53, A-MPDU data=w54, A-MPDU data valid=w55, DCF TX opportunity request=w32, RX timeout count request=w30, MAC frame TX start indication=w28)
    call "TX MAC Bypass.gcdl"(request in=w53, MPDU=w54, input valid=w55, ready for output=w51, TX data FIFO reference=w25, bypass MAC TX=$"bypass MAC TX", manual PhyTxStart.req=$"manual PhyTxStart.req") -> (request out=w56, PSDU=w57, output valid=w58)
    call "PHY-SAP Write MAC.gcdl"(PHY SAP=w2, PSDU=w57, PSDU valid=w58, PhyTxStart.req=w56) -> (FIFO overflow counter=w59, PSDU TX ready for input=w50)
    $"PSDU TX FIFO overflow counter" <- w59
    $"MAC RX statistics" <- w21
    w60 = "AFW::802_11::Resources::802.11 AFW Resources.grsc::T2H Events"
    call "Write RX Events.gcdl"(PHY RX start indication=w6, PHY RX end indication=w7, PHY CCA indication=w10, PHY RX gain change indication=w5, MAC MPDU RX event indication=w17, global timestamp=w26, T2H FIFO reference=w60, event enable mask=$"event enable mask")
    # w44: TX end ind.
    w61 = "AFW::802_11::Resources::802.11 AFW Resources.grsc::T2H TX Feedback"
    call "MAC TX to ICP.gcdl"(MAC MSDU TX end indication=w44) -> (ICP data=w62, output valid=w63)
    call "TX Feedback Sink.gcdl"(ICP data=w62, input valid=w63, FIFO reference=w61) -> (FIFO overflow count=w64)
    $"TX end indication overflow count" <- w64
    w65 = "AFW::802_11::Resources::802.11 AFW Resources.grsc::T2H Events"
    call "Write TX Events.gcdl"(PHY TX end indication=w4, PHY TX start request=w56, MAC frame TX request=w52, DCF state=w38, global time reference=w26, T2H FIFO reference=w65, event enable mask=$"event enable mask")
    call "Capture PHY TX Indications.gcdl"(PhyTxEnd.ind in=w4, PHY TX start request in=w56) -> (PHY TX start request out=w66, PhyTxEnd.ind out=w67)
    $"PhyTxStart.req" <- w66
    $"PhyTxEnd.ind" <- w67
    call "MAC TX Statistics.gcdl"(MAC frame TX request=w52, reset=$"reset MAC TX statistics") -> (MAC TX statistics=w68)
    $"MAC TX statistics" <- w68
  }
  clock-driven loop (clock = "AFW::802_11::Resources::802.11 AFW Resources.grsc::PHY") forever {
    Property Node(instance in=w1) -> ("shared properties"=w69, "TX active"=w70, "OFDM symbol pulse"=w71)
    Register Read(reference in=w69) -> (data=w72)
    # w73: Symbol trigger
    Property Node(instance in=w72) -> ("primary channel selector"=w74, "device bandwidth"=w75)
    Feedback Node(input=w76) -> w77
    call "PHY-SAP Read PHY.gcdl"(PHY SAP=w2, ready for output=w77) -> (PhyTxStart.req=w78, PSDU=w79, PSDU valid=w80)
    Register Read(reference in=w71) -> (data=w73, reference out=w81)
    call "Detect Rising Edge.gcdl"(signal=w73) -> (edge detected=w82)
    Feedback Node(input=w83) -> w84
    call "PHY TX Request Handler.gcdl"(PSDU discard complete=w84, symbol trigger in=w82, PhyTxStart.req=w78, device bandwidth=w75) -> (PSDU discard configuration=w85, symbol trigger out=w86, symbol index=w87, TX vector out=w88, start of packet=w89, PhyTxEnd.ind=w90, TX active=w91)
    Feedback Node(input=w92) -> w93
    call "PSDU Discard.gcdl"(ready for output=w93, PSDU in=w79, PSDU in valid=w80, configuration=w85) -> (ready for input=w76, PSDU out=w94, PSDU out valid=w95, PSDU complete=w83)
    call "TX Bit Processing.gcdl"(overwrite scrambler seed=$"overwrite scrambler seed", scrambler seed=$"scrambler seed", PSDU=w94, input valid=w95, symbol trigger=w86, TX vector=w88, OFDM symbol index=w87) -> (used scrambler seed=w96, bit=w97, output valid=w98, modulation=w99, ready for input=w92)
    Property Node(instance in=w90, "scrambler seed"=w96) -> (instance out=w100)
    Feedback Node(input=w101) -> w102
    To Fixed Point(number=w102) -> w103: FXP(10.3) Saturate:ConvergentRounding
    Select(s=$"enable AGC", t=w103, f=$"RF gain") -> w104
    Property Node(instance in=w1) -> ("RF to RX FIFO"=w105, "internal loopback FIFO"=w106, "TX to RF FIFO"=w107, "Gain Settings FIFO"=w108)
    call "Extend TX Active Signal.gcdl"(TX active=w91, cycles to extend=$"PHY clock cycles TX active extension") -> (extended TX active=w109)
    Register Write(data=w109, reference in=w70) -> (reference out=w110)
    w111 = "AFW::802_11::Resources::802.11 AFW Resources.grsc::H2T RX Baseband"
    call "RX Data Source.gcdl"(RX data source=$"RX data source", mute RX while TX active?=$"mute RX while TX active?", TX active register=w110, RF to RX FIFO=w105, internal loopback FIFO=w106, OFDM symbol trigger register=w81, produce silent samples=$"produce silent samples", H2T FIFO=w111) -> (sample=w112, output valid=w113)
    call "Signal Filter.gcdl"(sample in=w112, input valid=w113, shared properties=w72) -> (primary channel sample=w114, secondary channel sample=w115, secondary 40 MHz channel sample=w116, output valid=w117)
    call "CCA Energy Detection.gcdl"(primary channel sample=w114, secondary channel sample=w115, secondary 40 MHz channel sample=w116, input valid=w117, CCA energy detect threshold=$"CCA energy detect threshold", RF gain=w104, power calibration offset=$"power calibration offset") -> (PHY CCA energy detection indication=w118, primary channel signal power=w119, primary channel signal power valid=w120)
    call "Power Measurement.gcdl"(sample=w112, input valid=w113, power calibration offset=$"power calibration offset", RF gain=w104) -> (signal power=w121, output valid=w122, RF input power=w123)
    Feedback Node(input=w124) -> w125
    call "Synchronization.gcdl"(sample in=w112, input valid=w113, primary channel sample=w114, primary channel sample valid=w117, packet start sample index=$"packet start sample index", rearm packet start generator=$"rearm packet start generator", configuration=$"synchronization configuration", bypass synchronization=$"bypass synchronization", rearm packet detection=w125) -> (packet detected=w126, compensated CFO=w127, sample out=w128, output valid=w129, packet start=w130)
    call "AGC.gcdl"(timeout=$"AGC timeout", target signal power=$"AGC target signal power", gain offset=$"AGC gain offset", overall signal power=w121, overall signal power valid=w122, primary channel signal power=w119, primary channel signal power valid=w120, packet detected=w126, enable AGC=$"enable AGC") -> (gain=w131, trigger gain setting=w132, last applied gain=w101, gain change indication=w133)
    Feedback Node(input=w134) -> w135
    call "CCA.gcdl"(PHY CCA energy detection indication=w118, CCA signal detected=w126, timing valid=w135) -> (PHY CCA indication=w136)
    Feedback Node(input=w137) -> w138
    call "RX IQ Processing.gcdl"(sample=w128, input valid=w129, packet start=w130, configuration=w138) -> (subcarrier=w139, subcarrier timing=w140, subcarrier field map=w141, channel estimate=w142, channel estimate timing=w143, status=w144)
    Feedback Node(input=w145) -> w146
    call "RX Bit Processing.gcdl"(subcarrier=w139, subcarrier timing=w140, field map=w141, noise coefficient=$"noise coefficient", configuration=w146) -> (bit=w147, bit valid=w148, status=w149, PSDU=w150, PSDU valid=w151)
    Feedback Node(enable?=w130, initial value="FPGA Shared Properties.gtype" {all zero or empty}, input=w72) -> w152
    Property Node(instance in=w144) -> ("last sample"=w124, instance out=w153)
    call "RX PHY State Machine.gcdl"(bit=w147, bit valid=w148, bit processing status=w149, IQ processing status=w153, shared properties=w152, RX settings=$"RX Settings") -> (RX bit processing configuration=w145, RX IQ processing configuration=w137, RXTIME known=w134, PhyRxStart.ind=w154, PhyRxEnd.ind=w155)
    call "PHY-SAP Write PHY.gcdl"(PhyTxEnd.ind=w100, PHY RX gain change indication=w133, PhyRxStart.ind=w154, PhyRxEnd.ind=w155, PSDU=w150, PSDU valid=w151, PHY CCA indication=w136, PHY SAP=w2)
    w156 = "AFW::802_11::Resources::802.11 AFW Resources.grsc::T2H Constellation"
    call "Prepare RX IQ Data for T2H.gcdl"(reset=$"T2H Constellation reset", number of samples=$"T2H Constellation number of samples", subcarrier=w139, subcarrier timing=w140, field map=w141, FIFO reference=w156, pass all samples=$"T2H Constellation pass all samples") -> (FIFO overflow count=w157)
    $"T2H Constallation overflow" <- w157
    w158 = "AFW::802_11::Resources::802.11 AFW Resources.grsc::T2H Channel Estimation"
    Property Node(instance in=w138) -> ("format"=w159)
    call "Prepare Channel Estimation for T2H.gcdl"(channel estimate=w142, channel estimate timing=w143, format=w159, FIFO reference=w158) -> (FIFO overflow count=w160)
    $"T2H Channel Estimation overflow" <- w160
    w161 = "AFW::802_11::Resources::802.11 AFW Resources.grsc::T2H RX Power Spectrum"
    call "Trigger Capture RX Samples.gcdl"(manual trigger=$"manual trigger", RX packet start=w130, packet detected=w126, PHY CCA energy detection indication=w118, TX active register=w110, trigger condition=$"trigger condition") -> (trigger=w162)
    call "Capture RX Samples.gcdl"(sample=w128, input valid=w129, trigger=w162, number of samples to capture=$"number of samples to capture", FIFO reference=w161, number of samples before trigger=$"number of samples before trigger", pass all triggers=$"T2H RX Power Spectrum pass all triggers", rearm=$"T2H RX Power Spectrum rearm") -> (FIFO overflow count=w163)
    $"T2H RX Power Spectrum overflow" <- w163
    w164 = "AFW::802_11::Resources::802.11 AFW Resources.grsc::T2H TX Baseband"
    call "TX IQ Processing.gcdl"(primary channel selector=w74, symbol trigger=w86, bit=w97, bit valid=w98, bit processing modulation=w99, start of packet=w89, TX vector=w88, OFDM symbol index=w87) -> (data out=w165, output valid=w166)
    call "TX Data Sink.gcdl"(TX to RF FIFO=w107, internal loopback FIFO=w106, sample=w165, input valid=w166, T2H FIFO=w164, number of samples=$"T2H TX Baseband number of samples", reset=$"T2H TX Baseband reset", pass all samples=$"T2H TX Baseband pass all samples") -> (T2H FIFO overflow count=w167, TX to RF FIFO overflow count=w168, internal loopback FIFO overflow count=w169)
    $"T2H TX Baseband FIFO overflow" <- w167
    $"TX to RF FIFO overflow" <- w168
    $"internal loopback FIFO overflow" <- w169
    $"compensated CFO" <- w127
    w170 = "AFW::802_11::Resources::802.11 AFW Resources.grsc::T2H RX Bit Processing Output"
    call "RX Bit Processing Data Sink.gcdl"(PSDU=w150, input valid=w151, FIFO reference=w170) -> (FIFO overflow count=w171)
    $"T2H RX Bit Processing Output FIFO overflow" <- w171
    w172 = "AFW::802_11::Resources::802.11 AFW Resources.grsc::T2H TX Bit Processing Output"
    call "TX Bit Processing Data Sink.gcdl"(bit=w97, input valid=w98, modulation=w99, FIFO reference=w172) -> (FIFO overflow count=w173)
    $"T2H TX Bit Processing Output FIFO overflow" <- w173
    call "Capture PHY RX Indications.gcdl"(PhyRxStart.ind in=w154, PhyRxEnd.ind in=w155) -> (PhyRxStart.ind out=w174, PhyRxEnd.ind out=w175)
    $"PhyRxStart.ind" <- w174
    $"PhyRxEnd.ind" <- w175
    $"RF input power" <- w123
    $"signal power" <- w121
    $"used scrambler seed" <- w96
    Feedback Node(enable?=w130, input=w123) -> w176
    $"RF input power at packet start" <- w176
    Feedback Node(enable?=w130, input=w121) -> w177
    $"signal power at packet start" <- w177
    FIFO Write(Control Protocol Input=w132, data=w131, reference in=w108)
    $"last applied gain" <- w101
  }
  clock-driven loop (clock = "Data Clock") forever {
    # Baseband to/from RF conversion
    # Data Reception from Antenna, downconversion to baseband sample rate, received data will be written into RX baseband input FIFO
    # Reading of TX baseband FIFO, upconversion and transmission to antenna
    Property Node(instance in=w1) -> ("shared properties"=w178, "global timestamp"=w179, "OFDM symbol pulse"=w180)
    call "Mod N Indexer U16.gcdl"(N=$"Data clock cycles per tick (0.1us)", enable=$"data clock locked?") -> (wrap back=w181)
    call "Count Up U32.gcdl"(increment=w181, reset=FALSE) -> (count out=w182)
    Register Write(data=w182, reference in=w179)
    call "Mod N Indexer U16.gcdl"(N=$"Data clock cycles per OFDM symbol", enable=$"data clock locked?") -> (wrap back=w183)
    Register Write(data=w183, reference in=w180)
    Property Node(instance in="FPGA Shared Properties.gtype" {all zero or empty}, "primary channel selector"=$"primary channel selector", "device MAC address"=$"device MAC address", "device bandwidth"=$"device bandwidth") -> (instance out=w184)
    Register Write(data=w184, reference in=w178)
    $Timestamp <- w182
    Property Node(instance in=w1) -> ("TX to RF FIFO"=w185, "RF to RX FIFO"=w186)
    Build Array($"rx 0.stream enable", $"rx 1.stream enable") -> w187
    w188 = T6 {"0x800000000000", 0, 0, "0x1FFFF", "0x1FFFF", 0, 0, 0, 0, 0, 0, 0, 0}
    Property Node(instance in=w188, "impairments"=$"rx 0.impairments", "frequency shift"=$"rx 0.frequency shift", "phase"=$"rx 0.phase", "output sample rate"=$"rx.output sample rate", "delay"=$"rx.delay", "DC Offset factor p"=$"DC Offset factor p") -> (instance out=w189)
    w190 = T6 {"0x800000000000", 0, 0, "0x1FFFF", "0x1FFFF", 0, 0, 0, 0, 0, 0, 0, 0}
    Property Node(instance in=w190, "delay"=$"rx.delay", "output sample rate"=$"rx.output sample rate", "impairments"=$"rx 1.impairments", "frequency shift"=$"rx 1.frequency shift", "phase"=$"rx 1.phase", "DC Offset factor p"=$"DC Offset factor p") -> (instance out=w191)
    Build Array(w189, w191) -> w192
    call "USRP Stream RX.gcdl"(rx.reset=$"rx.reset", rx.rf channel=$"rx.rf channel", rx. stream enabled=w187, rx.abort=$"rx.abort", DDC parameters=w192, enable DC offset correction=$"enable DC offset correction", RF to RX FIFO reference=w186) -> (DC average=w193, rx.number of IQ data overflows=w194, rx.dsp reset done=w195, rx.state=w196, rx.samples processed=w197, rx.number of overflows=w198)
    $"rx.number of IQ data overflows" <- w194
    Build Array($"tx 0.stream enable", $"tx 1.stream enable") -> w199
    w200 = T7 {0, "0x1FFFF", "0x1FFFF", 0, 0, 0, 0, 0, 0, 0, 0, "0x200000", "0x200000", 0}
    Property Node(instance in=w200, "gain"=$"tx 0.gain", "frequency shift"=$"tx 0.frequency shift", "phase"=$"tx 0.phase", "impairments"=$"tx 0.impairments", "input sample rate"=$"tx.input sample rate", "delay"=$"tx.delay") -> (instance out=w201)
    w202 = T7 {0, "0x1FFFF", "0x1FFFF", 0, 0, 0, 0, 0, 0, 0, 0, "0x200000", "0x200000", 0}
    Property Node(instance in=w202, "delay"=$"tx.delay", "input sample rate"=$"tx.input sample rate", "gain"=$"tx 1.gain", "frequency shift"=$"tx 1.frequency shift", "phase"=$"tx 1.phase", "impairments"=$"tx 1.impairments") -> (instance out=w203)
    Build Array(w201, w203) -> w204
    call "USRP Stream TX.gcdl"(tx.reset=$"tx.reset", tx.rf channel=$"tx.rf channel", tx.enable streams=w199, tx.abort=$"tx.abort", DUC parameters=w204, TX to RF FIFO reference=w185) -> (tx.state=w205, tx.samples processed=w206, tx.underflows=w207, tx.number of IQ data overflows=w208, tx.dsp reset done=w209)
    $"tx.state" <- w205
    $"rx.dsp reset done" <- w195
    $"tx.samples processed" <- w206
    $"rx.state" <- w196
    $"tx.underflows" <- w207
    $"rx.samples processed" <- w197
    $"tx.number of IQ data overflows" <- w208
    $"rx.number of overflows" <- w198
    $"tx.dsp reset done" <- w209
    $"DC average" <- w193
  }
  call "Create Resources.gvi"() -> (config.resources=w210, sync.resources=w211, time.resources=w212)
  clock-driven loop (clock = "40 MHz Onboard Clock") {
    Io Write(data=$"RF 1/Rx/Enable", reference in="RF 1/Rx/Enable")
    Io Write(data=$"RF 0/Tx/Enable", reference in="RF 0/Tx/Enable")
    Io Write(data=$"RF 0/Rx/Enable", reference in="RF 0/Rx/Enable")
    w213 = "AFW::802_11::Resources::802.11 AFW Resources.grsc::AGC Reg Bus 0 Access FIFO"
    Feedback Node(input=w214) -> w215
    Property Node(instance in=w1) -> ("Gain Settings FIFO"=w216)
    FIFO Read(Control Protocol Input=TRUE, reference in=w216) -> (Control Protocol Output=w214, data=w217)
    Feedback Node(enable?=w214, input=w217) -> w218
    To Fixed Point(number=w218) -> w219: UFXP(6.1) Wrap:Truncate
    # Register Bus and Required Controls/Indicators
    Scale By Power Of 2(n=1, x=w219) -> w220
    To Unsigned 8 Bit Integer(number=w220) -> w221
    Property Node(instance in=T2 {"power enable"=TRUE, "mixer enable"=TRUE, "gain"=0}, "power enable"=$"power enable", "mixer enable"=$"mixer enable", "gain"=w221) -> (instance out=w222)
    call "Set Gain.gcdl"(FPGA.Fifo=w213, spi address=$"spi address", cpld enable=$"cpld enable", ATR State=$"ATR State", Radio Control Destination=$"Radio Control Destination", antenna configuration=$"antenna configuration", Write ATR?=w215, lo lpf enable=$"lo lpf enable", daughterboard=$daughterboard, tx.configuration=$"tx.configuration", rx.configuration=w222)
    Io Write(data=$"RF 1/Tx/Enable", reference in="RF 1/Tx/Enable")
    w223 = "NI::SDR::RegisterBusV1FPGA::niInstr Register Bus v0.grsc::reg.host instruction fifo 0"
    Feedback Node(input=w224) -> w225
    Property Node(instance in=w225) -> ("ready for port 0 input"=w226, "ready for port 1 input"=w227)
    Feedback Node(input=w228) -> w229
    call "read completion from typedef.gcdl"(read completion (typedef)=w229) -> (read completion=w230)
    call "Process.gcdl"(reg.notify host.go rcvd=$"reg.notify host.go rcvd 0", reg.host read.go rcvd=$"reg.host read.go rcvd 0", read completion=w230, reg.reset=$"reg.reset 0", reg.host instruction fifo=w223, ready for output=w227) -> (reg.notify host.go=w231, reg.host read.data=w232, register instruction=w233)
    $"reg.notify host.go 0" <- w231
    $"reg.host read.data 0" <- w232
    w234 = "AFW::802_11::Resources::802.11 AFW Resources.grsc::AGC Reg Bus 0 Access FIFO"
    FIFO Read(Control Protocol Input=w226, reference in=w234) -> (Control Protocol Output=w235, data=w236)
    call "Retrieve FPGA Scoped Instruction.gcdl"(number=w236, valid=w235) -> (output cluster=w237)
    Feedback Node(input=w238) -> w239
    call "Register Instruction Arbiter (2 inputs).gcdl"(port 0=w237, port 1=w233, reset=FALSE, ready for output=w239) -> (register instr out=w240, ready for input=w224)
    call "register instruction to typedef.gcdl"(register instruction=w240) -> (register instruction (typedef)=w241)
    call "Registers.gcdl"(register instruction=w241, config.resources=w210, sync.resources=w211, time.resources=w212) -> (ready for input=w238, read completion out=w228)
    stop if FALSE
  }
  call "Process.gvi"(resources=w210)
