vi "AP.gvi"   [LabVIEW NXG 4.0.0]
inputs:
  "element": waveform<f64> = {dt=1, Y=[]}
  "N": f64
  "g": f64
outputs:
  "element {0}": waveform<f64>
diagram:
  Property Node(instance in=$element) -> ("Y"=w1)
  To Signed 32 Bit Integer(number=$N) -> w2
  Array Size(array=w1) -> (size(s)=w3)
  Initialize Array(element=0, size=w3) -> w4
  # y(n)=-gx(n)+x(n-N)+gy(n-N)
  s1 = w1  # shift register
  s2 = w4  # shift register
  for (iteration -> i1) {
    w5 = each element of w1
    Subtract(x=i1, y=w2) -> w6
    # g
    Array Index(array=s2) -> (out0[w6]=w7)
    Negate(x=$g) -> w8
    Multiply(w7, $g) -> w9
    Add(w5, w9) -> w10
    Multiply(w10, w8) -> w11
    Add(w7, w11) -> w12
    Replace Array Subset(inArray=s1, index=i1, new=w12) -> w13
    Increment(x=w6) -> w14
    Replace Array Subset(inArray=s2, index=w14, new=w10) -> w15
    next s1 = w13
    next s2 = w15
  }
  Property Node(instance in=$element, "Y"=s1) -> (instance out=w16)
  $"element {0}" <- w16
