vi "Continuous Sound Input.gvi"   [LabVIEW NXG 4.0.0]
# This VI illustrates how to acquire sound samples continuously from a specified device. It requires the use of a microphone attached to the sound card. You can specify the number of samples to acquire, sample rate, number of channels and a bit rate per sample. The VI also plots the raw data as the acquisition is made.
panel controls:
  "Number of Samples/ch": i32 = 5000
  "Device ID": u32  # Device ID is the input or output device you access for a sound operation. In general, most users should select the default value of 0. The value ranges from 0 to n-1, where n is the number of input or output devices on the computer.
  "Stop": bool
panel indicators:
  "Raw Data": waveform<f64>[]
types:
  "Sound Data Format.gtype" = cluster{"sample rate (S/s)": f64, "number of channels": i32, "bits per sample": i32}
uses:
  NI::G Core::Sound::Input::Sound Input Configure.gvi
  NI::G Core::Sound::Input::Sound Input Read::Sound Input Read (DBL).gvi
  NI::G Core::Sound::Input::Sound Input Clear.gvi
  NI::G Core::Error::Display Error.gvi
diagram:
  w1 = $"Number of Samples/ch"
  # Configure the sound input for continuous acquisition.
  w2 = "Sound Data Format.gtype" {"sample rate (S/s)"=22050, "number of channels"=2, "bits per sample"=16}
  call "Sound Input Configure.gvi"(device ID=$"Device ID", sound format=w2, sample mode="Continuous Samples"(1), number of samples/ch=w1) -> (task ID=w3, error out=w4)
  # Acquire sound samples and plot the raw data to the graph until an error has occurred or the user stops the VI.
  # Stop the acquisition and clear the sound task.
  while {
    call "Sound Input Read (DBL).gvi"(task ID in=w3, error in=w4, number of samples/ch=w1) -> (task ID out=w5, data=w6, error out=w7)
    $"Raw Data" <- w6
    Logical Or(w7, $Stop) -> w8
    stop if w8
  }
  call "Sound Input Clear.gvi"(task ID=w5, error in=w7) -> (error out=w9)
  call "Display Error.gvi"(error in=w9)
