vi "FBCF.gvi"   [LabVIEW NXG 4.0.0]
inputs:
  "element": waveform<f64> = {dt=1, Y=[]}
  "N": f64
  "g": f64
outputs:
  "element {0}": waveform<f64>
diagram:
  Property Node(instance in=$element) -> ("Y"=w1)
  # N
  # g
  To Signed 32 Bit Integer(number=$N) -> w2
  # y(n)=x(n)+gy(n-N)
  s1 = w1  # shift register
  for (iteration -> i1) {
    w3 = each element of w1
    Subtract(x=i1, y=w2) -> w4
    Array Index(array=s1) -> (out0[w4]=w5)
    # y(n-N)
    Multiply(w5, $g) -> w6
    # X(n)
    Add(w3, w6) -> w7
    Replace Array Subset(inArray=s1, index=i1, new=w7) -> w8
    next s1 = w8
  }
  Property Node(instance in=$element, "Y"=s1) -> (instance out=w9)
  $"element {0}" <- w9
