vi "Finite Sound Input.gvi"   [LabVIEW NXG 4.0.0]
# This VI illustrates how to acquire a finite number of samples from a specified device. It requires the use of a microphone attached to the sound card. You can specify the number of samples to acquire, sample rate, number of channels and a bit rate per sample.
panel controls:
  "Number of Samples/ch": i32 = 10000
  "Device ID": u32
panel indicators:
  "Sound Input": waveform<f64>[]
types:
  "Sound Data Format.gtype" = cluster{"sample rate (S/s)": f64, "number of channels": i32, "bits per sample": i32}
uses:
  NI::G Core::Sound::Input::Sound Input Configure.gvi
  NI::G Core::Sound::Input::Sound Input Read::Sound Input Read (DBL).gvi
  NI::G Core::Sound::Input::Sound Input Clear.gvi
  NI::G Core::Error::Display Error.gvi
diagram:
  # Configure the Sound Input, acquire the specified number of samples, and stop the acquisition.
  w1 = "Sound Data Format.gtype" {"sample rate (S/s)"=22050, "number of channels"=2, "bits per sample"=16}
  call "Sound Input Configure.gvi"(device ID=$"Device ID", sound format=w1, sample mode="Finite Samples"(0), number of samples/ch=$"Number of Samples/ch") -> (task ID=w2, error out=w3)
  call "Sound Input Read (DBL).gvi"(task ID in=w2, error in=w3, number of samples/ch=$"Number of Samples/ch") -> (task ID out=w4, data=w5, error out=w6)
  $"Sound Input" <- w5
  call "Sound Input Clear.gvi"(task ID=w4, error in=w6) -> (error out=w7)
  call "Display Error.gvi"(error in=w7)
