vi "Generate Sound.gvi"   [LabVIEW NXG 4.0.0]
# This VI illustrates how to generate and play sine, square, sawtooth and triangle waveforms. You can change the frequency and type of the waveform generated as it plays continuously.
panel controls:
  "Device ID": u32
  "Volume": f64 = 50
  "Stop": bool
  "Frequency": f64 = 440
panel indicators:
  "Generated Sound": waveform<f64>
types:
  "Sound Data Format.gtype" = cluster{"sample rate (S/s)": f64, "number of channels": i32, "bits per sample": i32}
uses:
  NI::G Core::Sound::Output::Sound Output Configure.gvi
  NI::Analysis::Generation::Sine Waveform.gvi
  NI::G Core::Sound::Output::Sound Output Set Volume::Sound Output Set Volume (Single).gvi
  NI::G Core::Sound::Output::Sound Output Write::Sound Output Write (DBL Single).gvi
  NI::G Core::Sound::Output::Sound Output Clear.gvi
  NI::G Core::Error::Display Error.gvi
diagram:
  # Configure the sound input for continuous acquisition.
  w1 = "Sound Data Format.gtype" {"sample rate (S/s)"=44100, "number of channels"=2, "bits per sample"=16}
  call "Sound Output Configure.gvi"(device ID=$"Device ID", sound format=w1, sample mode="Continuous Samples"(1), number of samples/ch=5000) -> (task ID=w2, error out=w3)
  Property Node(instance in=w1) -> ("sample rate (S/s)"=w4)
  while {
    # Generate the sine waveform with specified frequency and amplitude of 1. Display the generated data in the graph. Play the generated waveform by writing the data to the output device.
    call "Sine Waveform.gvi"(frequency=$Frequency, sample rate=w4, samples=5000) -> (sine wave=w5)
    $"Generated Sound" <- w5
    # Set the volume of the output device to the specified value.
    call "Sound Output Set Volume (Single).gvi"(task ID in=w2, volume=$Volume, error in=w3) -> (task ID out=w6, error out=w7)
    call "Sound Output Write (DBL Single).gvi"(task ID in=w6, data=w5, error in=w7) -> (task ID out=w8, error out=w9)
    Logical Or(w9, $Stop) -> w10
    stop if w10
  }
  # Clear the Sound Output task.
  call "Sound Output Clear.gvi"(task ID=w8, error in=w9) -> (error out=w11)
  call "Display Error.gvi"(error in=w11)
