vi "Main.gvi"   [LabVIEW NXG 4.0.0]
# This VI illustrates how to play a sound file directly to the speakers. It uses Play Sound File.vi which opens a file and starts playing immediately and asynchronously (as opposed to the method shown in Sound File to Sound Output.vi example).
panel controls:
  "Device ID": u32
  "Stop": bool
  "Sound File Path": path = path "support\\S-Live 01.wav"
  "decay": f64
  "Reverb?": bool
panel indicators:
  "Sound Is Playing?": bool
  "before": waveform<f64>[]
  "after": waveform<f64>[]
types:
  "Sound Data Format.gtype" = cluster{"sample rate (S/s)": f64, "number of channels": i32, "bits per sample": i32}
uses:
  NI::G Core::Sound::Files::Sound File Read Simple.gvi
  NI::G Core::Sound::Output::Sound Output Configure.gvi
  NI::G Core::Sound::Output::Sound Output Write::Sound Output Write (DBL).gvi
  NI::G Core::Sound::Output::Sound Output Info.gvi
  NI::G Core::Sound::Output::Sound Output Stop.gvi
  NI::G Core::Sound::Output::Sound Output Clear.gvi
  NI::G Core::Error::Display Error.gvi
diagram:
  Get Component Directory() -> (Path=w1)
  Build Path(base path=w1, name or relative path=$"Sound File Path") -> (appended path=w2)
  call "Sound File Read Simple.gvi"(sound file=w2, number of samples/ch=-1) -> (data=w3, error out=w4)
  case ($"Reverb?") {
    frame False, Default {
      w5 = w3
    }
    frame True {
      # right channel
      Array Index(array=w3) -> (out0[1]=w6)
      call "Shredinger Reverb.gvi"(in=w6, decay=$decay) -> (out=w7)
      # left channel
      Array Index(array=w3) -> (out0[0]=w8)
      call "Shredinger Reverb.gvi"(in=w8, decay=$decay) -> (out=w9)
      Build Array(w9, w7) -> w5
    }
  }
  $after <- w5
  $before <- w3
  # Read the 'sample.wav' file that is in the 'support' folder for this example.
  w10 = "Sound Data Format.gtype" {"sample rate (S/s)"=44100, "number of channels"=2, "bits per sample"=16}
  call "Sound Output Configure.gvi"(device ID=$"Device ID", sound format=w10, error in=w4) -> (task ID=w11, error out=w12)
  call "Sound Output Write (DBL).gvi"(task ID in=w11, data=w5, error in=w12) -> (task ID out=w13, error out=w14)
  # Clear the sound output task.
  while {
    Wait(time to wait=100)
    # Stop the loop if the user presses 'Stop', or if the sound file is no longer playing.
    case ($Stop) {
      frame False, Default {
        call "Sound Output Info.gvi"(task ID in=w13, error in=w14) -> (task ID out=w15, is playing?=w17, error out=w16)
      }
      frame True {
        call "Sound Output Stop.gvi"(task ID in=w13, error in=w14) -> (task ID out=w15, error out=w16)
        w17 = FALSE
      }
    }
    $"Sound Is Playing?" <- w17
    Logical Or(w16, not w17) -> w18
    stop if w18
  }
  call "Sound Output Clear.gvi"(task ID=w15, error in=w16) -> (error out=w19)
  call "Display Error.gvi"(error in=w19)
