vi "Normalize Sound Waveform.gvi"   [LabVIEW NXG 4.0.0]
inputs:
  "sum": waveform<f64> = {dt=1, Y=[]}
outputs:
  "wave out": waveform<f64>
uses:
  NI::Analysis::Conditioning::Linear Scale (Wfm).gvi
diagram:
  Property Node(instance in=$sum) -> ("Y"=w1, instance out=w2)
  Array Max And Min(array=w1) -> (max value=w3, min value=w4)
  Absolute Value(x=w4) -> w5
  Max And Min(x=w3, y=w5) -> (max(x,y)=w6: f64)
  Reciprocal(x=w6) -> w7
  call "Linear Scale (Wfm).gvi"(signal=w2, scale=w7) -> (scaled signal=w8)
  $"wave out" <- w8
