vi "Read Sound File to Graph.gvi"   [LabVIEW NXG 4.0.0]
# This VI reads data from a sound file and plots it on a graph.
panel controls:
  "Number of Samples": i32 = -1
panel indicators:
  "Samples Read": i32
  "File Data": waveform<f64>[]
uses:
  NI::G Core::Sound::Files::Sound File Read Simple.gvi
  NI::G Core::Error::Display Error.gvi
diagram:
  # Read the 'sample.wav' file that is in the 'support' folder for this example, and display the specified number of samples in the graph.
  Get Component Directory() -> (Path=w1)
  Build Path(base path=w1, name or relative path=path "support\\sample.wav") -> (appended path=w2)
  call "Sound File Read Simple.gvi"(sound file=w2, number of samples/ch=$"Number of Samples") -> (data=w3, offset=w4, error out=w5)
  $"File Data" <- w3
  $"Samples Read" <- w4
  call "Display Error.gvi"(error in=w5)
