vi "Reverb per Channel.gvi"   [LabVIEW NXG 4.0.0]
inputs:
  "element": waveform<f64> = {dt=1, Y=[]}
  "delay": f64
  "level": f64
  "decay": f64
outputs:
  "element {0}": waveform<f64>
diagram:
  Multiply($delay, 44100) -> w1
  # M
  # g
  To Signed 32 Bit Integer(number=w1) -> w2
  Property Node(instance in=$element) -> ("Y"=w3)
  Multiply($decay, 44100) -> w4
  To Signed 32 Bit Integer(number=w4) -> w5
  Initialize Array(element=0, size=w5) -> w6
  Build Array(w3, w6) -> w7
  # Y(n) = X(n) + g * Y(n - M)
  s1 = w7  # shift register
  for (iteration -> i1) {
    w8 = each element of w7
    Subtract(x=i1, y=w2) -> w9
    Array Index(array=s1) -> (out0[w9]=w10)
    # Y(n - M)
    Multiply(w10, $level) -> w11
    # X(n)
    Add(w8, w11) -> w12
    Replace Array Subset(inArray=s1, index=i1, new=w12) -> w13
    next s1 = w13
  }
  Property Node(instance in=$element, "Y"=s1) -> (instance out=w14)
  $"element {0}" <- w14
