vi "Reverb.gvi"   [LabVIEW NXG 4.0.0]
inputs:
  "wave in": waveform<f64>[]
  "delay": f64
  "level": f64
  "decay": f64
outputs:
  "wave out": waveform<f64>[]
diagram:
  # left channel
  Array Index(array=$"wave in") -> (out0[0]=w1)
  call "Reverb per Channel.gvi"(element=w1, delay=$delay, level=$level, decay=$decay) -> (element {0}=w2)
  # right channel
  Array Index(array=$"wave in") -> (out0[1]=w3)
  call "Reverb per Channel.gvi"(element=w3, delay=$delay, level=$level, decay=$decay) -> (element {0}=w4)
  Build Array(w2, w4) -> w5
  $"wave out" <- w5
