vi "Shredinger Reverb.gvi"   [LabVIEW NXG 4.0.0]
inputs:
  "decay": f64
  "in": waveform<f64> = {dt=1, Y=[]}
outputs:
  "out": waveform<f64>
diagram:
  Multiply($decay, 44100) -> w1
  To Signed 32 Bit Integer(number=w1) -> w2
  Initialize Array(element=0, size=w2) -> w3
  Property Node(instance in=$in) -> ("Y"=w4)
  Build Array(w4, w3) -> w5
  Property Node(instance in=$in, "Y"=w5) -> (instance out=w6)
  call "AP.gvi"(element=w6, g=0.7, N=347) -> (element {0}=w7)
  call "AP.gvi"(element=w7, g=0.7, N=113) -> (element {0}=w8)
  call "AP.gvi"(element=w8, g=0.7, N=37) -> (element {0}=w9)
  call "FBCF.gvi"(element=w9, g=0.773, N=1687) -> (element {0}=w10)
  call "FBCF.gvi"(element=w9, g=0.753, N=2053) -> (element {0}=w11)
  Waveform Add(w10, w11) -> w12
  call "FBCF.gvi"(element=w9, g=0.802, N=1601) -> (element {0}=w13)
  call "FBCF.gvi"(element=w9, g=0.733, N=2251) -> (element {0}=w14)
  Waveform Add(w13, w14) -> w15
  Waveform Add(w12, w15) -> w16
  $out <- w16
