vi "Simultaneous Sound Input Output.gvi"   [LabVIEW NXG 4.0.0]
# This VI illustrates how to perform simultaneous sound IO, i.e., how to continuously play the sound acquired from a microphone. It requires the use of a microphone attached to the sound card. You can specify the IDs of the input and output devices, the frequency to sample at, and the buffer size for both devices. Higher frequencies have better quality, but demand more resources and are limited by the capabilities of your sound card.  A large number of samples decreases the risk of glitches, but increases the delay between acquisition and playback.
panel controls:
  "Output Device ID": u32
  "Input Device ID": u32
  "Stop": bool
panel indicators:
  "Acquired Sound": waveform<f64>[]
types:
  "Sound Data Format.gtype" = cluster{"sample rate (S/s)": f64, "number of channels": i32, "bits per sample": i32}
uses:
  NI::G Core::Sound::Input::Sound Input Configure.gvi
  NI::G Core::Sound::Output::Sound Output Configure.gvi
  NI::G Core::Sound::Output::Sound Output Write::Sound Output Write (DBL Single).gvi
  NI::G Core::Sound::Input::Sound Input Read::Sound Input Read (DBL).gvi
  NI::G Core::Sound::Output::Sound Output Write::Sound Output Write (DBL).gvi
  NI::G Core::Sound::Input::Sound Input Clear.gvi
  NI::G Core::Sound::Output::Sound Output Clear.gvi
  NI::G Core::Error::Display Error.gvi
diagram:
  w1 = 20000  # Number of Samples/ch
  w2 = "Sound Data Format.gtype" {"sample rate (S/s)"=44100, "number of channels"=2, "bits per sample"=16}
  call "Sound Input Configure.gvi"(device ID=$"Input Device ID", sound format=w2, sample mode="Continuous Samples"(1), number of samples/ch=w1) -> (task ID=w3, error out=w4)
  # Configure the sound input and sound output for continuous mode. Write some silence as an initial buffer to prevent underflow.
  call "Sound Output Configure.gvi"(device ID=$"Output Device ID", sound format=w2, sample mode="Continuous Samples"(1), number of samples/ch=w1) -> (task ID=w5, error out=w6)
  Initialize Array(element=0, size=w1) -> w7
  Build Waveform Node(Y=w7) -> (output waveform=w8)
  call "Sound Output Write (DBL Single).gvi"(task ID in=w5, data=w8, error in=w6) -> (task ID out=w9, error out=w10)
  Quotient And Remainder(x=w1, y=2) -> (floor(x/y)=w11)
  # Higher frequencies have better quality, but demand more resources and are limited by the capabilities of your sound card. A large number of samples decreases the risk of glitches, but increases the delay between acquisition and playback.
  while {
    # Acquire samples from the microphone and write them to the output device (i.e., play the sound).
    call "Sound Input Read (DBL).gvi"(task ID in=w3, error in=w4, number of samples/ch=w11) -> (task ID out=w12, data=w13, error out=w14)
    $"Acquired Sound" <- w13
    call "Sound Output Write (DBL).gvi"(task ID in=w9, data=w13, error in=w10) -> (task ID out=w15, error out=w16)
    Logical Or(w14, w16, $Stop) -> w17
    stop if w17
  }
  call "Sound Input Clear.gvi"(task ID=w12, error in=w14) -> (error out=w18)
  # Stop the input/output and clear the tasks.
  call "Sound Output Clear.gvi"(task ID=w15, error in=w16) -> (error out=w19)
  Merge Errors(w18, w19) -> (error out=w20)
  call "Display Error.gvi"(error in=w20)
