vi "Sound File to Sound Output.gvi"   [LabVIEW NXG 4.0.0]
# This VI illustrates how to play a sound file continuously, reading the sound file in pieces, and playing each piece at a time.
panel controls:
  "Device ID": u32
  "Number of Samples/Iteration": i32 = 2500
  "Stop": bool
panel indicators:
  "Current Iteration": i32
  "Current Data": waveform<f64>[]
uses:
  NI::G Core::Sound::Files::Sound File Info::Sound File Info (path).gvi
  NI::G Core::Sound::Files::Sound File Open::Sound File Read Open.gvi
  NI::G Core::Sound::Output::Sound Output Configure.gvi
  NI::G Core::Sound::Files::Sound File Read::Sound File Read (DBL).gvi
  NI::G Core::Sound::Output::Sound Output Write::Sound Output Write (DBL).gvi
  NI::G Core::Sound::Files::Sound File Close.gvi
  NI::G Core::Sound::Output::Sound Output Wait.gvi
  NI::G Core::Sound::Output::Sound Output Clear.gvi
  NI::G Core::Error::Display Error.gvi
diagram:
  w1 = $"Number of Samples/Iteration"
  # Read the 'sample.wav' file that is in the 'support' folder for this example.
  Get Component Directory() -> (Path=w2)
  Build Path(base path=w2, name or relative path=path "support\\sample.wav") -> (appended path=w3)
  call "Sound File Info (path).gvi"(sound file=w3) -> (sound format=w4, error out=w5)
  call "Sound File Read Open.gvi"(sound file=w3, error in=w5) -> (reference=w6, error out=w7)
  # Configure the device for continuous sound output and set the sound format to the one specified in the sound file.
  call "Sound Output Configure.gvi"(device ID=$"Device ID", sound format=w4, error in=w7, sample mode="Continuous Samples"(1), number of samples/ch=w1) -> (task ID=w8, error out=w9)
  while (iteration -> i1) {
    # Read the specified number of samples from the file. Write data read from the file to the sound output device.
    call "Sound File Read (DBL).gvi"(reference in=w6, error in=w9, number of samples/ch=w1) -> (end of file=w10, reference out=w11, data=w12, error out=w13)
    $"Current Data" <- w12
    call "Sound Output Write (DBL).gvi"(task ID in=w8, data=w12, error in=w13) -> (task ID out=w14, error out=w15)
    Logical Or(w15, w10, $Stop) -> w16
    $"Current Iteration" <- i1
    stop if w16
  }
  call "Sound File Close.gvi"(reference=w11, error in=w15) -> (error out=w17)
  call "Sound Output Wait.gvi"(task ID in=w14, error in=w17) -> (task ID out=w18, error out=w19)
  call "Sound Output Clear.gvi"(task ID=w18, error in=w19) -> (error out=w20)
  # Close the sound file, wait until all the sound is played by the output device and clear the sound output task.
  call "Display Error.gvi"(error in=w20)
