vi "Sound Input to File.gvi"   [LabVIEW NXG 4.0.0]
# This VI illustrates how to create a sound file using microphone input as data. It displays the sound data in a graph as it is written to the file.
panel controls:
  "Device ID": u32
  "Stop": bool
panel indicators:
  "Generated Sound File": path
  "Acquired Sound Data": waveform<f64>[]
types:
  "Sound Data Format.gtype" = cluster{"sample rate (S/s)": f64, "number of channels": i32, "bits per sample": i32}
uses:
  NI::G Core::File IO (General)::Generate Temporary File Path.gvi
  NI::G Core::Sound::Files::Sound File Open::Sound File Write Open.gvi
  NI::G Core::Sound::Input::Sound Input Configure.gvi
  NI::G Core::Sound::Input::Sound Input Read::Sound Input Read (DBL).gvi
  NI::G Core::Sound::Files::Sound File Write::Sound File Write (DBL).gvi
  NI::G Core::Sound::Input::Sound Input Clear.gvi
  NI::G Core::Sound::Files::Sound File Close.gvi
  NI::G Core::Error::Display Error.gvi
diagram:
  call "Generate Temporary File Path.gvi"(temporary file extension="wav") -> (unique temporary file path=w1)
  # Open a new sound file in the temp directory.
  $"Generated Sound File" <- w1
  w2 = 10000  # Number of Samples/ch
  # Configure the device for continuous sound input.
  w3 = "Sound Data Format.gtype" {"sample rate (S/s)"=22050, "number of channels"=2, "bits per sample"=16}
  call "Sound File Write Open.gvi"(sound file=w1, sound format=w3) -> (reference=w4, error out=w5)
  call "Sound Input Configure.gvi"(device ID=$"Device ID", sound format=w3, error in=w5, sample mode="Continuous Samples"(1), number of samples/ch=w2) -> (task ID=w6, error out=w7)
  # Clear the sound input task and close the file.
  while {
    # Acquire samples using the microphone.
    call "Sound Input Read (DBL).gvi"(task ID in=w6, error in=w7, number of samples/ch=w2) -> (task ID out=w8, data=w9, error out=w10)
    $"Acquired Sound Data" <- w9
    # Display the acquired data in the graph and write it to the file.
    call "Sound File Write (DBL).gvi"(reference in=w4, data=w9, error in=w10) -> (reference out=w11, error out=w12)
    Logical Or(w12, $Stop) -> w13
    stop if w13
  }
  call "Sound Input Clear.gvi"(task ID=w8, error in=w12) -> (error out=w14)
  call "Sound File Close.gvi"(reference=w11, error in=w14) -> (error out=w15)
  call "Display Error.gvi"(error in=w15)
