vi "Sound Player Demo.gvi"   [LabVIEW NXG 4.0.0]
# This VI illustrates how to play a sound file directly to the speakers. It uses Play Sound File.vi which opens a file and starts playing immediately and asynchronously (as opposed to the method shown in Sound File to Sound Output.vi example).
panel controls:
  "Device ID": u32
  "Stop": bool
  "number of samples/ch": i32 = -1
  "Sound File Path": path = path "support\\sample.wav"
panel indicators:
  "Sound Is Playing?": bool
  "File Data": waveform<f64>[]
  "Samples Read": i32
  "Spectrum": T1[]
types:
  T1 = cluster{"f0": f64, "df": f64, "magnitude": f64[]}
  "Sound Data Format.gtype" = cluster{"sample rate (S/s)": f64, "number of channels": i32, "bits per sample": i32}
uses:
  NI::G Core::Sound::Output::Sound Output Configure.gvi
  NI::G Core::Sound::Files::Sound File Read Simple.gvi
  NI::Analysis::Measurement::Power Spectral Density for N Chan.gvi
  NI::G Core::Sound::Output::Sound Output Write::Sound Output Write (DBL).gvi
  NI::G Core::Sound::Output::Sound Output Info.gvi
  NI::G Core::Sound::Output::Sound Output Stop.gvi
  NI::G Core::Sound::Output::Sound Output Clear.gvi
  NI::G Core::Error::Display Error.gvi
diagram:
  w1 = $"Sound File Path"
  w2 = "Sound Data Format.gtype" {"sample rate (S/s)"=44100, "number of channels"=2, "bits per sample"=16}
  # Read the 'sample.wav' file that is in the 'support' folder for this example.
  call "Sound Output Configure.gvi"(device ID=$"Device ID", sound format=w2) -> (task ID=w3, error out=w4)
  # Clear the sound output task.
  s1 = uninitialised  # shift register
  while {
    call "Sound File Read Simple.gvi"(sound file=w1, position offset=s1, error in=w4, number of samples/ch=1000) -> (data=w5, offset=w6, error out=w7)
    # Stop the loop if the user presses 'Stop', or if the sound file is no longer playing.
    call "Power Spectral Density for N Chan.gvi"(signal=w5, dB on=TRUE, error in=w7, window type="Hanning"(1)) -> (power spectral density=w8, error out=w9)
    $Spectrum <- w8
    call "Sound Output Write (DBL).gvi"(task ID in=w3, data=w5, error in=w7) -> (task ID out=w10, error out=w11)
    case ($Stop) {
      frame False, Default {
        call "Sound Output Info.gvi"(task ID in=w10, error in=w11) -> (task ID out=w12, is playing?=w14, error out=w13)
      }
      frame True {
        call "Sound Output Stop.gvi"(task ID in=w10, error in=w11) -> (task ID out=w12, error out=w13)
        w14 = FALSE
      }
    }
    $"Sound Is Playing?" <- w14
    Logical Or(w13, not w14) -> w15
    next s1 = w6
    stop if w15
  }
  call "Sound File Read Simple.gvi"(sound file=w1, number of samples/ch=$"number of samples/ch") -> (data=w16, offset=w17, error out=w18)
  call "Sound Output Clear.gvi"(task ID=w12, error in=w13) -> (error out=w19)
  Merge Errors(w9, w19, w18) -> (error out=w20)
  call "Display Error.gvi"(error in=w20)
  $"File Data" <- w16
  $"Samples Read" <- w17
