vi "Sound Player Reverb.gvi"   [LabVIEW NXG 4.0.0]
# This VI illustrates how to play a sound file directly to the speakers. It uses Play Sound File.vi which opens a file and starts playing immediately and asynchronously (as opposed to the method shown in Sound File to Sound Output.vi example).
panel controls:
  "Device ID": u32
  "Stop": bool
  "Sound File Path": path = path "support\\S-Live 01.wav"
  "delay": f64 = 0.1
  "level": f64 = 0.7
  "decay": f64
panel indicators:
  "Sound Is Playing?": bool
  "before": waveform<f64>[]
  "after": waveform<f64>[]
types:
  "Sound Data Format.gtype" = cluster{"sample rate (S/s)": f64, "number of channels": i32, "bits per sample": i32}
uses:
  NI::G Core::Sound::Output::Play Sound File.gvi
  NI::G Core::Sound::Files::Sound File Read Simple.gvi
  NI::G Core::Sound::Output::Sound Output Configure.gvi
  NI::G Core::Sound::Output::Sound Output Write::Sound Output Write (DBL).gvi
  NI::G Core::Sound::Output::Sound Output Info.gvi
  NI::G Core::Sound::Output::Sound Output Stop.gvi
  NI::G Core::Sound::Output::Sound Output Clear.gvi
  NI::G Core::Error::Display Error.gvi
diagram:
  disable {
    frame Enabled { }
    frame Disabled {
      call "Play Sound File.gvi"()
    }
  }
  Get Component Directory() -> (Path=w1)
  # Read the 'sample.wav' file that is in the 'support' folder for this example.
  Build Path(base path=w1, name or relative path=$"Sound File Path") -> (appended path=w2)
  call "Sound File Read Simple.gvi"(sound file=w2, number of samples/ch=-1) -> (data=w3, error out=w4)
  $before <- w3
  # Y(n) = X(n) + g * Y(n - M)
  call "Reverb.gvi"(wave in=w3, decay=$decay, delay=$delay, level=$level) -> (wave out=w5)
  $after <- w5
  w6 = "Sound Data Format.gtype" {"sample rate (S/s)"=44100, "number of channels"=2, "bits per sample"=16}
  call "Sound Output Configure.gvi"(device ID=$"Device ID", sound format=w6, error in=w4) -> (task ID=w7, error out=w8)
  call "Sound Output Write (DBL).gvi"(task ID in=w7, data=w5, error in=w8) -> (task ID out=w9, error out=w10)
  # Clear the sound output task.
  while {
    Wait(time to wait=100)
    # Stop the loop if the user presses 'Stop', or if the sound file is no longer playing.
    case ($Stop) {
      frame False, Default {
        call "Sound Output Info.gvi"(task ID in=w9, error in=w10) -> (task ID out=w11, is playing?=w13, error out=w12)
      }
      frame True {
        call "Sound Output Stop.gvi"(task ID in=w9, error in=w10) -> (task ID out=w11, error out=w12)
        w13 = FALSE
      }
    }
    $"Sound Is Playing?" <- w13
    Logical Or(w12, not w13) -> w14
    stop if w14
  }
  call "Sound Output Clear.gvi"(task ID=w11, error in=w12) -> (error out=w15)
  call "Display Error.gvi"(error in=w15)
