vi "Sound Player.gvi"   [LabVIEW NXG 4.0.0]
# This VI illustrates how to play a sound file directly to the speakers. It uses Play Sound File.vi which opens a file and starts playing immediately and asynchronously (as opposed to the method shown in Sound File to Sound Output.vi example).
panel controls:
  "Device ID": u32
  "Stop": bool
  "Sound File Path": path = path "support\\sample.wav"
panel indicators:
  "Sound Is Playing?": bool
uses:
  NI::G Core::Sound::Output::Play Sound File.gvi
  NI::G Core::Sound::Output::Sound Output Info.gvi
  NI::G Core::Sound::Output::Sound Output Stop.gvi
  NI::G Core::Sound::Output::Sound Output Clear.gvi
  NI::G Core::Error::Display Error.gvi
diagram:
  Get Component Directory() -> (Path=w1)
  # Read the 'sample.wav' file that is in the 'support' folder for this example.
  Build Path(base path=w1, name or relative path=$"Sound File Path") -> (appended path=w2)
  call "Play Sound File.gvi"(device ID=$"Device ID", path=w2) -> (task ID=w3, error out=w4)
  # Clear the sound output task.
  while {
    Wait(time to wait=100)
    # Stop the loop if the user presses 'Stop', or if the sound file is no longer playing.
    case ($Stop) {
      frame False, Default {
        call "Sound Output Info.gvi"(task ID in=w3, error in=w4) -> (task ID out=w5, is playing?=w7, error out=w6)
      }
      frame True {
        call "Sound Output Stop.gvi"(task ID in=w3, error in=w4) -> (task ID out=w5, error out=w6)
        w7 = FALSE
      }
    }
    $"Sound Is Playing?" <- w7
    Logical Or(w6, not w7) -> w8
    stop if w8
  }
  call "Sound Output Clear.gvi"(task ID=w5, error in=w6) -> (error out=w9)
  call "Display Error.gvi"(error in=w9)
