vi "Restore Rx IQ Offset Correction Data from File.gvi"   [LabVIEW NXG 4.0.0]
panel controls:
  "usrp rio device": string = "Select USRP RIO Device"
types:
  "IQ Imbalance.gtype" = cluster{"Gain Imbalance [linear]": f64, "Phase Imbalance [radians]": f64, "Offset": c128}
uses:
  Host SubVIs::Open Device.gvi
  NI::G Core::File IO (General)::Legacy::Read from Spreadsheet File (DBL).gvi
  NI::G Core::Error::Legacy::Error Cluster From Error Code.gvi
  NI::USRPRIO::ConfigV1Host::Store Persistent Device Data.gvi
  Host SubVIs::Close Device.gvi
  NI::G Core::Error::Display Error.gvi
diagram:
  call "Open Device.gvi"(usrp rio device=$"usrp rio device") -> (niusrprio session out=w1, error out=w2)
  Property Node(instance in=w1) -> ("Characterization Data"=w3)
  Property Node(instance in=w1) -> ("Device Data Header:Number of Channels"=w4)
  To Signed 32 Bit Integer(number=w4) -> w5
  s1 = w3  # shift register
  s2 = w2  # shift register
  for (N = w5) (iteration -> i1) {
    Quotient And Remainder(x=i1, y=2) -> (x-y*floor(x/y)=w6)
    Is Equal To 0(x=w6) -> w7
    case (w7) {
      frame False, Default {
        # Tx channel
        # There is no information saved for Tx
        w8 = s1
        w9 = s2
      }
      frame True {
        Array Index(array=s1) -> (out0[i1]=w10)
        Property Node(instance in=w10) -> ("Frequencies [Hz]"=w11, "IQ Imbalance Table"=w12)
        # Rx channel
        Divide(x=i1, y=2) -> w13
        Format Into String(formatString="Please select the backup data file for Rx Channel  %d", errIn=s2, w13) -> (outString=w14, errOut=w15)
        Get Component Directory() -> (Path=w16)
        File Dialog[FileDialogSelectionMode=File, NewOrExistingMode=New](default name="", error in=w15, prompt=w14, start path=w16) -> (error out=w17, selected path=w18)
        call "Read from Spreadsheet File (DBL).gvi"(file path=w18) -> (all rows=w19)
        Array Index(array=w19) -> (out0[1, _]=w20)
        Array Index(array=w19) -> (out0[2, _]=w21)
        Array Index(array=w19) -> (out0[0, _]=w22)
        Is Equal(x=w22, y=w11) -> w23
        And Array Elements(Boolean array=w23) -> (logical AND=w24)
        case (w24) {
          frame False, Default {
            w27 = "-1: The characterization data in the selected file does not match data already on the device.  Ensure that the backup file applies to the specified device."
            call "Error Cluster From Error Code.gvi"(error code=-1, error message=w27, show call chain?=TRUE, is warning?=FALSE) -> (error out=w26)
            w25 = w12
          }
          frame True {
            for {
              w28 = each element of w21
              w29 = each element of w20
              w30 = each element of w12
              Real And Imaginary To Complex(x=w29, y=w28) -> w31
              Property Node(instance in=w30, "Offset"=w31) -> (instance out=w32)
              append w32 to w25
            }
            call "Error Cluster From Error Code.gvi"(error code=0, error message="0: No Error", show call chain?=TRUE, is warning?=FALSE) -> (error out=w26)
          }
        }
        Coerce To Type(type="IQ Imbalance.gtype"[] [], x=w25) -> w33
        Property Node(instance in=w10, "IQ Imbalance Table"=w33) -> (instance out=w34)
        Replace Array Subset(inArray=s1, index=i1, new=w34) -> w8
        Merge Errors(w17, w26) -> (error out=w9)
      }
    }
    Coerce To Type(type=no error, x=w9) -> w35
    next s1 = w8
    next s2 = w35
  }
  Property Node(instance in=w1, "Characterization Data"=s1) -> (instance out=w36)
  call "Store Persistent Device Data.gvi"(niusrprio session in=w36, offset=0x0, eeprom data section="Factory Data", error in=s2) -> (niusrprio session out=w37, error out=w38)
  call "Close Device.gvi"(niusrprio session in=w37, error in=w38) -> (error out=w39)
  call "Display Error.gvi"(error in=w39, type of dialog="OK message + warnings")
