vi "Tx Streaming (Host).gvi"   [LabVIEW NXG 4.0.0]
# This template is for the Simple NI-USRP Streaming design, a design that shows the basics of streaming data to and from an NI USRP-294x/295x device. Refer to the block diagram for more information about how to use this template.
panel controls:
  "Tab": i32
  "USRP RIO device": string = "RIO0"
  "Reference Frequency Source": string = "Internal"
  "tx.stop": bool
  "Tab_2": i32
  "tx config": T5 = {"rf enable 0"=TRUE, "rf config 0"={"Antenna RF 0"="TX1", "Frequency RF 0 [Hz]"=2475000000, "LO Frequency RF 0 [Hz]"=-1, "Output Power RF 0 [dBm]"=20}, "rf enable 1"=FALSE, "rf config 1"={"Antenna RF 1"="TX1", "Frequency RF 1 [Hz]"=2000000000, "LO Frequency RF 1 [Hz]"=-1, "Output Power RF 1 [dBm]"=0}, "Generation Mode"="Finite", "Sample Rate [S/s]"=20000000, "Number of Samples"=1000000, "Start Trigger"="Immediate", "Tone Frequency [Hz]"=-1000000}
panel indicators:
  "Output Waveform": waveform<f64>[]
  "TX Coerced Configurations": T1
  "Generating": bool
types:
  T1 = cluster{"Coerced Frequencies [Hz]": f64[], "Coerced LO Frequencies [Hz]": f64[], "Coerced Output Powers [dBm]": f64[], "Coerced Sample Rates [S/s]": f64[]}
  T2 = cluster{"Antenna RF 0": string, "Frequency RF 0 [Hz]": f64, "LO Frequency RF 0 [Hz]": f64, "Output Power RF 0 [dBm]": f64}
  T3 = cluster{"Antenna RF 1": string, "Frequency RF 1 [Hz]": f64, "LO Frequency RF 1 [Hz]": f64, "Output Power RF 1 [dBm]": f64}
  T4 = enum{"Software", "Digital Edge", "Rx Start Trigger", "Tx Start Trigger", "Immediate", "Future Time Event"}
  T5 = cluster{"rf enable 0": bool, "rf config 0": T2, "rf enable 1": bool, "rf config 1": T3, "Generation Mode": enum{"Finite", "Continuous"}, "Sample Rate [S/s]": f64, "Number of Samples": u32, "Start Trigger": T4, "Tone Frequency [Hz]": f64}
uses:
  Host SubVIs::Open and Configure Device.gvi
  Host SubVIs::Initiate and Generate (Single).gvi
  Host SubVIs::Close Device.gvi
  NI::G Core::Error::Display Error.gvi
diagram:
  # 1. Open and configure device
  # 2. Transmit data
  # 3. Close device
  # 1.
  call "Open and Configure Device.gvi"(tx config=$"tx config", USRP RIO Device=$"USRP RIO device", reference frequency source=$"Reference Frequency Source") -> (niUsrpRio Session (out)=w1, tx.coerced configurations=w2, tx.output waveform=w3, error out=w4, tx channels=w5)
  s1 = w4  # shift register
  while (iteration -> i1) {
    Is Equal To 0(x=i1) -> w6
    # 2.
    call "Initiate and Generate (Single).gvi"(niUsrpRio Session=w1, first iteration=w6, error in=s1, tx channels=w5) -> (niUsrpRio Session (out)=w7, error out=w8)
    Logical Or(w8, $"tx.stop") -> w9
    Not(x=w9) -> w10
    $Generating <- w10
    next s1 = w8
    stop if w9
  }
  # 3.
  call "Close Device.gvi"(niusrprio session in=w7, error in=s1) -> (error out=w11)
  call "Display Error.gvi"(error in=w11, type of dialog="OK message + warnings")
  $"TX Coerced Configurations" <- w2
  $"Output Waveform" <- w3
