vi "Tx and Rx Streaming Time (Host).gvi"   [LabVIEW NXG 4.0.0]
# This template is for the Simple NI-USRP Streaming design, a design that shows the basics of streaming data to and from an NI USRP-294x/295x device. Refer to the block diagram for more information about how to use this template.
panel controls:
  "Tab": i32
  "USRP RIO device": string = "RIO0"
  "Reference Frequency Source": string = "Internal"
  "stop": bool
  "Tab_2": i32
  "tx config": T7 = {"rf enable 0"=TRUE, "rf config 0"={"Antenna RF 0"="TX1", "Frequency RF 0 [Hz]"=2000000000, "LO Frequency RF 0 [Hz]"=-1, "Output Power RF 0 [dBm]"=0}, "rf enable 1"=TRUE, "rf config 1"={"Antenna RF 1"="TX1", "Frequency RF 1 [Hz]"=2000000000, "LO Frequency RF 1 [Hz]"=-1, "Output Power RF 1 [dBm]"=0}, "Generation Mode"="Finite", "Sample Rate [S/s]"=10000000, "Number of Samples"=8192, "Start Trigger"="Future Time Event", "Tone Frequency [Hz]"=100000}
  "rx config": T10 = {"rf enable 0"=TRUE, "rf config 0"={"Antenna RF 0"="RX2", "Frequency RF 0 [Hz]"=2000000000, "LO Frequency RF 0 [Hz]"=-1, "Reference Level RF 0 [dBm]"=0}, "rf enable 1"=TRUE, "rf config 1"={"Antenna RF 1"="RX2", "Frequency RF 1 [Hz]"=2000000000, "LO Frequency RF 1 [Hz]"=-1, "Reference Level RF 1 [dBm]"=0}, "Acquisition Mode"="Finite", "Sample Rate [S/s]"=10000000, "Number of Samples"=8192, "Start Trigger"="Future Time Event"}
panel indicators:
  "Power Spectrum": T1[]
  "Power Level": f64[][]
  "I & Q Data": f64[][]
  "Output Waveform": waveform<f64>[]
  "TX Coerced Configurations": T2
  "RX Coerced Configurations": T3
  "Active": bool
types:
  T1 = cluster{"f0": f64, "df": f64, "magnitude": f64[]}
  T2 = cluster{"Coerced Frequencies [Hz]": f64[], "Coerced LO Frequencies [Hz]": f64[], "Coerced Output Powers [dBm]": f64[], "Coerced Sample Rates [S/s]": f64[]}
  T3 = cluster{"Coerced Frequencies [Hz]": f64[], "Coerced LO Frequencies [Hz]": f64[], "Coerced Levels [dBm]": f64[], "Coerced Sample Rates [S/s]": f64[]}
  T4 = cluster{"Antenna RF 0": string, "Frequency RF 0 [Hz]": f64, "LO Frequency RF 0 [Hz]": f64, "Output Power RF 0 [dBm]": f64}
  T5 = cluster{"Antenna RF 1": string, "Frequency RF 1 [Hz]": f64, "LO Frequency RF 1 [Hz]": f64, "Output Power RF 1 [dBm]": f64}
  T6 = enum{"Software", "Digital Edge", "Rx Start Trigger", "Tx Start Trigger", "Immediate", "Future Time Event"}
  T7 = cluster{"rf enable 0": bool, "rf config 0": T4, "rf enable 1": bool, "rf config 1": T5, "Generation Mode": enum{"Finite", "Continuous"}, "Sample Rate [S/s]": f64, "Number of Samples": u32, "Start Trigger": T6, "Tone Frequency [Hz]": f64}
  T8 = cluster{"Antenna RF 0": string, "Frequency RF 0 [Hz]": f64, "LO Frequency RF 0 [Hz]": f64, "Reference Level RF 0 [dBm]": f64}
  T9 = cluster{"Antenna RF 1": string, "Frequency RF 1 [Hz]": f64, "LO Frequency RF 1 [Hz]": f64, "Reference Level RF 1 [dBm]": f64}
  T10 = cluster{"rf enable 0": bool, "rf config 0": T8, "rf enable 1": bool, "rf config 1": T9, "Acquisition Mode": enum{"Finite", "Continuous"}, "Sample Rate [S/s]": f64, "Number of Samples": u32, "Start Trigger": T6}
uses:
  Host SubVIs::Open and Configure Device.gvi
  Host SubVIs::Configure Time (Single).gvi
  NI::USRPRIO::TimeV1Host::Get Time (Single).gvi
  Host SubVIs::Initiate and Fetch Time (Single).gvi
  NI::G Core::Timing::Elapsed Timer.gvi
  Host SubVIs::Calculate Power.gvi
  Host SubVIs::Initiate and Generate Time (Single).gvi
  Host SubVIs::Close Device.gvi
  NI::G Core::Error::Display Error.gvi
diagram:
  # 1.
  call "Open and Configure Device.gvi"(rx config=$"rx config", tx config=$"tx config", USRP RIO Device=$"USRP RIO device", reference frequency source=$"Reference Frequency Source") -> (niUsrpRio Session (out)=w1, rx.coerced configurations=w2, tx.coerced configurations=w3, tx.output waveform=w4, error out=w5, rx channels=w6, tx channels=w7)
  # 2.
  call "Configure Time (Single).gvi"(niUsrpRio Session=w1, error in=w5) -> (niUsrpRio Session (out)=w8, error out=w9)
  # 1. Open and configure device.
  # 2. Configure time.
  # 3.Retrieve and generate data 100 ms from the current time.
  # 4. Close device.
  s1 = w9  # shift register
  while (iteration -> i1) {
    call "Get Time (Single).gvi"(niusrprio session in=w8, error in=s1, when="now") -> (niusrprio session out=w10, time=w11, error out=w12)
    # 3.
    Time Stamp Add(x=0.1, y=w11) -> w13
    Is Equal To 0(x=i1) -> w14
    call "Initiate and Fetch Time (Single).gvi"(niUsrpRio Session=w10, first iteration=w14, start trigger time=w13, error in=w12, rx channels=w6) -> (complex baseband data=w15, error out=w16)
    call "Elapsed Timer.gvi"(target time=0.2) -> (time has elapsed=w17)
    case (w17) {
      frame False, Default { }
      frame True {
        call "Calculate Power.gvi"(waveform=w15) -> (Power Spectrum=w18, Power Level=w19, I & Q Data=w20)
        $"Power Spectrum" <- w18
        $"Power Level" <- w19
        $"I & Q Data" <- w20
      }
    }
    call "Initiate and Generate Time (Single).gvi"(niUsrpRio Session=w10, first iteration=w14, start trigger time=w13, error in=w12, tx channels=w7) -> (niUsrpRio Session (out)=w21, error out=w22)
    Merge Errors(w16, w22) -> (error out=w23)
    Logical Or(w23, $stop) -> w24
    Not(x=w24) -> w25
    $Active <- w25
    next s1 = w23
    stop if w24
  }
  # 4.
  call "Close Device.gvi"(niusrprio session in=w21, error in=s1) -> (error out=w26)
  call "Display Error.gvi"(error in=w26, type of dialog="OK message + warnings")
  $"RX Coerced Configurations" <- w2
  $"TX Coerced Configurations" <- w3
  $"Output Waveform" <- w4
